# Grasshopper definition snaking_around.gh (Grasshopper 1.0.7)

python = GhPythonScript(x=Slider(10000, range=0..100000), y=Slider(5, range=0..10))  # -> out, pts; inputs x: Int32
# ---------- python: Python ----------
import random
import Rhino.Geometry as rg

pts = []

random.seed(0)

for i in range(x):
    pts.append(rg.Point3d((random.random() * 2.0 - 1.0) * y, (random.random() * 2.0 - 1.0) * y, 0.0) )
# ---------- end python ----------
crv = Curve(<curve referenced from the Rhino model>)
pt = Point(Point(-73.664869, -36.64497416, 0))
pt_2 = Point(Point(-64.29792599, 32.57450321, 0))
number_slider = Slider(10, range=0..10)
crv_2 = Curve(<curve referenced from the Rhino model>)
divide = DivideCurve(Curve=crv, Count=Slider(33, range=0..100), Kinks=False)  # -> Points, Tangents, Parameters
crv_3 = Curve(<curve referenced from the Rhino model>)
python_2 = GhPythonScript(pts=python.pts)  # -> out, pts; inputs pts: list of Point3d
# ---------- python_2: Python ----------
import math

angles = [math.atan2(n.X, n.Y) for n in pts]

_, pts = list(zip(*sorted(zip(angles, pts) ) ) )
# ---------- end python_2 ----------
python_3 = GhPythonScript(a=pt, b=pt_2)  # -> out, a; inputs a: Point3d, b: Point3d
# ---------- python_3: Python ----------
import math

def signed_vector_angle(a, b):
    return math.atan2( a.X*b.Y - a.Y*b.X, a.X*b.X + a.Y*b.Y )

def positive_vector_angle(a, b):
    angle = signed_vector_angle(a, b)
    if angle > 0:
        return angle
    else:
        return 6.2831853072 + angle

print(positive_vector_angle( a, b) )
# ---------- end python_3 ----------
crv_4 = Curve(<curve referenced from the Rhino model>)
pline = PolyLine(Vertices=divide.Points, Closed=False)
pt_3 = Point(<point referenced from the Rhino model>)
pline_2 = PolyLine(Vertices=python.pts, Closed=False)
panel = Panel(python_3.out)
python_4 = GhPythonScript(pl=crv_4, distance=number_slider)  # -> out, a, b; inputs pl: Polyline
# ---------- python_4: Python ----------
import sys

sys.path.append("/Users/jonas/Dropbox/Clay_Printing_Brick/PatternBrickLibrary/clusterFromCurves")

import vertex as v

reload(v)

vs = []

v.Vertex.DIS = distance

for pt in pl:
    vs.append(v.Vertex(pt) )

vs[0].add_neighbour(vs[1])
    
for i in range(1, len(vs) - 1, 1):
    vs[i].add_neighbour(vs[i - 1])
    vs[i].add_neighbour(vs[i + 1])
    
vs[len(vs) - 1].add_neighbour(vs[len(vs) - 2])

a = []
b = []

for vx in vs:
    vx.sort_neighbours()
    vx.construct_dir_vectors()
    vx.new_location()
    a.append(vx.curve_representation() )
    b.extend(vx.line_representation() )
# ---------- end python_4 ----------
python_5 = GhPythonScript(pl=pline, distance=number_slider)  # -> out, a, b; inputs pl: Polyline; same code as python_4
pline_3 = PolyLine(Vertices=python_2.pts, Closed=True)
python_6 = GhPythonScript(pt2=pt_3, pl=crv_3, distance=number_slider)  # -> out, a, b; inputs pt2: Point3d, pl: Polyline
# ---------- python_6: Python ----------
import sys

sys.path.append("/Users/jonas/Dropbox/Clay_Printing_Brick/PatternBrickLibrary/clusterFromCurves")

import vertex as v

reload(v)

vs = []

v.Vertex.DIS = distance

for pt in pl:
    vs.append(v.Vertex(pt) )

vs[0].add_neighbour(vs[1])
    
for i in range(1, len(vs) - 1, 1):
    vs[i].add_neighbour(vs[i - 1])
    vs[i].add_neighbour(vs[i + 1])
    
vs[len(vs) - 1].add_neighbour(vs[len(vs) - 2])

vs.append(v.Vertex(pt2) )
vs[-1].add_neighbour(vs[2])
vs[2].add_neighbour(vs[-1])

a = []
b = []

for vx in vs:
    vx.sort_neighbours()
    vx.construct_dir_vectors()
    vx.new_location()
    a.append(vx.curve_representation() )
    b.extend(vx.line_representation() )
# ---------- end python_6 ----------
crv_5 = Curve(python_5.a)
crv_6 = Curve(python_6.a)
line = Line(python_6.b)
item = ListItem(List=crv_6, Index=Slider(2, range=0..10), Wrap=True)
panel_2 = Panel(python_6.out)
