# Grasshopper definition AlternativeOffset.gh (Grasshopper 1.0.7)

crv = Curve()
crv_2 = Curve(<curve referenced from the Rhino model>)
crv_3 = Curve([<curve referenced from the Rhino model> x2])
divide = DivideCurve(Curve=[crv, crv_3], Count=1, Kinks=True)  # -> Points, Tangents, Parameters
divide_2 = DivideCurve(Curve=crv_2, Count=Slider(300, range=0..1000), Kinks=True)  # -> Points, Tangents, Parameters
python = GhPythonScript(radius=Slider(11, range=0..100), resolution=Slider(100, range=0..100))  # -> out, pts; inputs resolution: Int32
# ---------- python: Python ----------
import math
import Rhino.Geometry as rg

delta = 3.1415 * 2.0 / float(resolution)

pts = []

for i in range(resolution):
    
    angle = delta * i
    
    pts.append(rg.Point3d(
        math.cos(angle) * radius,
        math.sin(angle) * radius,
        0.0
    ))
# ---------- end python ----------
number_slider = Slider(6.1, range=-25..25)
merge = Merge(Data1=divide_2.Points, Data2=divide.Points)
item = ListItem(List=divide.Points, Index=0, Wrap=True)  # -> Item1, Item, Item1_2
path_mapper = PathMapper(merge)
merge_2 = Merge(Data1=divide.Points, Data2=item.Item)
pline = PolyLine(Vertices=divide_2.Points, Closed=True)
python_2 = GhPythonScript(pts=divide_2.Points, y=number_slider)  # -> out, a; inputs pts: list of Point3d
# ---------- python_2: Python ----------
import sys

sys.path.append("/Users/jonas/Dropbox/Clay_Printing_Brick/PatternBrickLibrary")

import polyline as pl
reload(pl)

polyline = pl.StructuredPolyline(pts)
# polyline.makeVertexSet()
polyline.offset(y)
a = polyline.toPolyline()

b = [i for i in range(20)]
print(b)
# ---------- end python_2 ----------
offset = OffsetCurve(Curve=pline, Distance=number_slider, Plane=PlaneXY(0, 0, 0), Corners=1)
panel = Panel(python_2.out)
