# Grasshopper definition CleanedVersion_Update.gh (Grasshopper 1.0.7)

python = GhPythonScript()  # -> out, path
# ---------- python: Python ----------
import os

print(os.name)
os_name = str(os.name)

ghComp = ghenv.Component
ghDoc = ghComp.OnPingDocument()

path = str(ghDoc.FilePath)

second_part = [
    "Dropbox",
    "Clay_Printing_Brick",
    "PatternBrickLibrary"
]

if "posix" == os_name:
    
    print("I am a Mac")
    
    first_part = ['/Users']
    
    string_parts = path.split("/Users/")[1]
    user_name = string_parts.split('/')[0]
    print(string_parts)
    print(user_name)

elif "nt" == os_name:

    print("I am a Pc")
    
    first_part = ['C:\\Users']
    
    string_parts = path.split("\\Users\\")[1]
    user_name = string_parts.split('\\')[0]
    print(string_parts)
    print(user_name)

parts = first_part + [user_name] + second_part

path = os.path.join(*parts)
# ---------- end python ----------

# ---- group: Pin Geometry
pt = ConstructPoint(XCoordinate=0, YCoordinate=0, ZCoordinate=0)
python_2 = GhPythonScript(
    b_pt=pt,
    height_body=Slider(10, range=0..1000),
    rad_body=Slider(60, range=0..100),
    res_body=Slider(0, range=0..100),
    height_pin=Slider(15, range=0..1000),
    bot_rad=Slider(35, range=0..100),
    top_rad=Slider(18, range=0..100),
    resolution=Slider(25, range=0..100),
    alfa=Slider(2.09, range=0..10),
    connection_line_count=Slider(4, range=0..10),
    start_height=Slider(1.4, range=0..10),
    layer_height=Slider(2.4, range=0..10))  # -> out, body_slices, connection_line_set, body_pin_slices, pin_slices; inputs b_pt: Point3d, res_body: Int32, resolution: Int32, connection_line_count: Int32
# ---------- python_2: Python ----------
import Rhino.Geometry as rg
import brickSlicer as bs
from copy import deepcopy as dc

reload(bs)

# defining the pins

body_pin = bs.Pin(b_pt, height_body, rad_body, rad_body, res_body)
center_pin = bs.Pin(b_pt, height_pin, bot_rad, top_rad, resolution)

# setting up the connection lines

axis_pt = rg.Point3d(1, 0, 0)
main_line = rg.Line(b_pt, b_pt + axis_pt)

base_line_set = []

alfa_delta = 3.1415927 * 2.0 / float(connection_line_count)

for i in range(connection_line_count):
    
    angle = alfa_delta * i + alfa
    
    rotation = rg.Transform.Rotation(angle, b_pt)
    
    tmp_line = dc(main_line)
    tmp_line.Transform(rotation)
    
    base_line_set.append(tmp_line)
    
# setting up the while loop

height = start_height

body_slices = []
body_pin_slices = []
pin_slices = []

connection_line_set = []

print("height: ", height)
print("height_body: ", height_body)

print(height < height_body)

while height < height_body:
    
    print("height: ", height)
    
    body_slices.append(body_pin.createSlice(height))
    body_pin_slices.append(center_pin.createSlice(height))
    
    # moving the lines onto the right height
    
    mv = rg.Transform.Translation(rg.Vector3d(0,0, height - b_pt.Z))
    
    tmp_line_set = []
    
    for line in base_line_set:
        
        tmp_line = dc(line)
        tmp_line.Transform(mv)
        
        tmp_line_set.append(tmp_line)
        
    connection_line_set.append(tmp_line_set)
    
    height += layer_height
    
print("height: ", height)    
    
while height < height_pin:
    
    pin_slices.append(center_pin.createSlice(height))
    
    height += layer_height
# ---------- end python_2 ----------

# ----
defaultmap = FilePath(python.path)
path = FilePath()
yz = YZPlane(Origin=Point(0, 0, 0))
python_3 = GhPythonScript(default_dropbox_path=defaultmap, costum_path=path)  # -> out, path
# ---------- python_3: Python ----------
import sys

if costum_path == None:
    path = default_dropbox_path
    
else:
    path = costum_path

sys.path.append(path)

print(sys.path)
# ---------- end python_3 ----------
library_path = FilePath(python_3.path)
brep = Brep(<brep referenced from the Rhino model>)
pln = Plane(yz)
line = Line(Line((-1.263981532, -48.84175791, 0), (8.362559972, -74.03462184, 0)))
crv = Curve(<curve referenced from the Rhino model>)
crv_2 = Curve(<curve referenced from the Rhino model>)
python_4 = GhPythonScript(x=crv_2, y=pln)  # -> out, a; inputs x: Curve
# ---------- python_4: Python ----------
import Rhino.Geometry as rg
from copy import deepcopy as dc

def rhinoGeometryObjectType(base_object):

    crv_type_list = ['NurbsCurve', 'Curve', 'PolylineCurve', 'LineCurve']
    brep_type = ['Brep']
    mesh_type = ['Mesh']
    plane_type = ['Plane']
    line_type = ['Line']

    types = [('brep', brep_type), ('mesh', mesh_type), ('crv', crv_type_list), ('plane', plane_type), ('line', line_type)]

    a = str(type(base_object))

    obj_type = "other"

    for type_tuple in types:

        for type_val in type_tuple[1]:

            if (str(type(base_object)).find(type_val) > 0):

                obj_type = type_tuple[0]

                break

    return obj_type
    
def moveToSameHeight(ref_object, mv_object):

    z_ref = ref_object.PointAt(ref_object.Domain[0]).Z
    
    z_mv_obj = mv_object.PointAt(ref_object.Domain[0]).Z

    mv_vec = rg.Vector3d(0 ,0 , z_ref - z_mv_obj)

    mv = rg.Transform.Translation(mv_vec)

    output_obj = dc(mv_object)

    output_obj.Transform(mv)

    return output_obj

def crvIntersector(crv, other_object):

    obj_type = rhinoGeometryObjectType(other_object)

    if obj_type == 'line':

        tmp_other_obj = moveToSameHeight(crv, other_object)

        int_events = rg.Intersect.Intersection.CurveLine(crv, tmp_other_obj, .01, .01)

        pts = [int_event.PointA for int_event in int_events]
        t_vals = [int_event.ParameterA for int_event in int_events]

    elif obj_type == 'crv':

        tmp_other_obj = moveToSameHeight(crv, other_object)

        int_events = rg.Intersect.Intersection.CurveCurve(crv, tmp_other_obj, .01, .01)

        pts = [int_event.PointA for int_event in int_events]
        t_vals = [int_event.ParameterA for int_event in int_events]

    elif obj_type == 'plane':

        int_events = rg.Intersect.Intersection.CurvePlane(crv, other_object, .01)

        pts = [int_event.PointA for int_event in int_events]
        t_vals = [int_event.ParameterA for int_event in int_events]

    elif obj_type == 'brep':

        _, t_vals = rg.Intersect.Intersection.CurveBrep(crv, other_object, .01, .001)

        pts = [crv.PointAt(t_val) for t_val in t_vals]

    else:

        print("object type %s is not supported" % obj_type)

        pts = []
        t_vals = []

    return pts, t_vals
    
a, _ = crvIntersector(x, y)
# ---------- end python_4 ----------
python_5 = GhPythonScript()  # -> out, a
# ---------- python_5: Python ----------
print(type(.05))
print(type(1))
# ---------- end python_5 ----------
pt_2 = Point(python_4.a)
python_6 = GhPythonScript()  # -> out, a
# ---------- python_6: Python ----------
a = [[2, 1, 1], [1, 2, 3], [0, 1, 2]]
# ---------- end python_6 ----------
panel = Panel(python_5.out)
panel_2 = Panel(python_4.out)

# ---- group: cylinder
number_slider = Slider(5, range=0..10)
number_slider_2 = Slider(10, range=0..100)

# ---- group: mod Based Dot Map
number_slider_3 = Slider(2, range=1..10)
number_slider_4 = Slider(50, range=10..100)
toggle = BooleanToggle(False)
number_slider_5 = Slider(0, range=0..3.1416)
number_slider_6 = Slider(0, range=-2..2)
number_slider_7 = Slider(0.7, range=0..2)

# ----
list = ValueList({"dotMap": 0, "ellipsoidBumpMap": 1, "sinWarp": 2, "cylinderMap": 3, "layerMap": 4, "modulorBased": 5}, selected="ellipsoidBumpMap")
xz = XZPlane(Origin=Point(0, 0, 0))
yz_2 = YZPlane(Origin=Point(0, 0, 0))
xy = XYPlane(Origin=Point(0, 0, 0))
crv_3 = Curve(<curve referenced from the Rhino model>)
mesh = Mesh(<mesh referenced from the Rhino model>)
brep_2 = Brep(<brep referenced from the Rhino model>)
rotate = Rotate(Geometry=yz_2, Angle=Slider(0, range=0..1), Plane=xz)  # -> Geometry, Transform
crv_4 = Curve(<curve referenced from the Rhino model>)
brep_3 = Brep(<brep referenced from the Rhino model>)
mesh_2 = Mesh(<mesh referenced from the Rhino model>)
type = GhPythonScript(x=xy)  # -> out
# ---------- type: Python ----------
# snippet of code to make this python component look for it's   code in the parent folder of the .gh file

import os

ghComp = ghenv.Component
ghDoc = ghComp.OnPingDocument()

file_name = "brickSlicer.py"
gh_file_location = ghDoc.FilePath
parent = os.path.dirname(os.path.realpath(gh_file_location))

file_path = os.path.join(parent, file_name)
print(file_path)

parent = os.path.dirname(os.path.realpath(parent))
parent = os.path.dirname(os.path.realpath(parent))
print(parent)

# hacky-hacky run-fun
execfile(file_path)

print(type(x))

# lines = gCodeGenerator(lists, extrusion_rate)
# ---------- end type ----------
ghpython_script = GhPythonScript(x=xy)  # -> out
# ---------- ghpython_script: Python ----------
print(type(x))
# ---------- end ghpython_script ----------
number_slider_8 = Slider(40, range=0..100)
rotate_2 = Rotate(Geometry=rotate.Geometry, Angle=Slider(0, range=0..1), Plane=PlaneXY(0, 0, 0))  # -> Geometry, Transform
pt_3 = Point(Point(0, 0, 0))
brep_4 = Brep(<brep referenced from the Rhino model>)
number_slider_9 = Slider(1.6, range=0..10)
number_slider_10 = Slider(2, range=0..10)
number_slider_11 = Slider(2, range=0..10)
move = Move(Geometry=rotate_2.Geometry, Motion=pt_3)  # -> Geometry, Transform
curve = Curve(<curve referenced from the Rhino model>)
python_7 = GhPythonScript(crvs=python_2.body_pin_slices, count=Slider(3, range=0..10), max_amount=Slider(3, range=0..10))  # -> out, flatten(a); inputs crvs: list of Curve, count: Int32
# ---------- python_7: Python ----------
import Rhino.Geometry as rg
import generalFunctions as gf

if count > 0:
    
    count_delta = max_amount / float(count)
    
    for i in range(count):
        
        active_crv = crvs[i]
        
        offset = count_delta * (count - i)
        
        crvs[i] = gf.offsetCurveSet(active_crv, offset, "outside", count = 2)[1].ToNurbsCurve()

a = crvs
# ---------- end python_7 ----------
line_2 = Line(Line((-201.1386315, 0, 75.49808693), (-150.385624, 53.47869293, 0)))
crv_5 = Curve(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)
crv_6 = Curve(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)
library_path_2 = FilePath(python_3.path)
list_2 = ValueList({"Inside": "inside", "Outside": "outside"}, selected="Inside")
graft = GraftTree(Tree=python_2.body_slices, IncludeEmptyLists=True, IncludeNullItems=True)
layer_slicing = GhPythonScript(
    x=library_path_2,
    geometry=crv_4,
    slice_geo=brep_4,
    layer_height=Slider(2.5, range=0..10),
    extra_z=number_slider_9,
    layer_count=number_slider_8)  # -> out, ori_crvs, crv_sets, a, b, c, d; inputs geometry: GeometryBase
# ---------- layer_slicing: Python ----------
import sys

sys.path.append(x)

import brickSlicer as bs

ori_crvs = bs.slicing(geometry, layer_height = layer_height, layer_count = layer_count, extra_z = extra_z)
crv_sets, a, b, c, d = bs.splitter(ori_crvs, slicing_object = slice_geo, split_type = "object")
# ---------- end layer_slicing ----------
python_8 = GhPythonScript(line=line_2, crv_a=crv_5, crv_b=crv_6)  # -> out, a; inputs line: Line, crv_a: Curve, crv_b: Curve
# ---------- python_8: Python ----------
import ghpythonlib.components as gh

gh.CurveXLine(crv_a, line)
# ---------- end python_8 ----------
geometry = Geometry(brep_4)
number_slider_12 = Slider(3.2, range=0.5..25)
library_path_3 = FilePath(library_path)
panel_3 = Panel(python_2.body_slices)
line_visualization = GhPythonScript(x=pt, y=python_2.connection_line_set)  # -> out, a; inputs x: Point3d, y: list
# ---------- line_visualization: Python ----------
import ghpythonlib.components as gh

lines = y[0]

a = []

for line in lines:
    
    # print()
    
    a.extend(gh.Scale(line, line.PointAt(0.0), 250))
# ---------- end line_visualization ----------
layer_structure = GhPythonScript(
    x=library_path_2,
    ori_crvs=layer_slicing.ori_crvs,
    crv_set=layer_slicing.crv_sets,
    spacing=number_slider_12,
    direction=Toggle(True),
    item=Toggle(False))  # -> out, layers, set_tuple, a; inputs ori_crvs: list, crv_set: list, direction: Boolean, item: Boolean
# ---------- layer_structure: Python ----------
from sys import path
from scriptcontext import sticky

path.append(x)

import vertexClass as vc

if direction:
    
    dir = 1
    
else:
    
    dir = -1
    
if item:
    
    item = 0

else:
    
    item = 1

print(ori_crvs)

layers, set_tuple, _ = vc.moveSet(crv_set, ori_crvs, spacing, dir, item)

a = ori_crvs
# ---------- end layer_structure ----------
pline = PolyLine(Closed=False)
patternmapset = GhPythonScript()  # -> a; same code as python_6
pt_4 = Point([Point(-31.24337795, -57.70709102, 0), Point(49.16917869, 20.02504706, 0), Point(154.5989752, 69.1660539, 0), Point(264.4961359, 74.52689101, 0)])
crv_7 = Curve()
library_path_4 = FilePath(library_path_2)
list_3 = ValueList({"dotMap": 0, "ellipsoidBumpMap": 1, "sinWarp": 2, "cylinderMap": 3, "layerMap": 4}, selected="sinWarp")
library_path_5 = FilePath(library_path_4)
line_3 = Line([Line((-390.2661573, 21.61776118, 0), (-367.4570229, 82.6657386, 0)), Line((-334.585035, 123.5880092, 0), (-271.5244869, 153.1057125, 0)), Line((-154.1245304, 153.1057125, 0), (-74.96341678, 118.8920109, 0)), Line((-27.33257726, 41.07261113, 0), (-10.56115489, -30.7090766, 0)), Line((-34.91360693, -77.41189496, 0), (-162.3764169, -121.0175931, 0)), Line((-293.1935114, -127.7261621, 0), (-377.0506232, -60.64047259, 0))])
pt_5 = Point([Point(-936.2368397, -300.1514269, 0), Point(-904.4762698, -43.79825533, 0), Point(-806.9259478, 253.3899347, 0)])
number_slider_13 = Slider(3, range=1..4)
number_slider_14 = Slider(50, range=25..250)
number_slider_15 = Slider(1.535, range=0..3.142)
number_slider_16 = Slider(260, range=0..1000)
number_slider_17 = Slider(16, range=0..100)
number_slider_18 = Slider(0.8, range=0..10)
number_slider_19 = Slider(0.529, range=0..3.142)
number_slider_20 = Slider(48.3, range=0..100)
number_slider_21 = Slider(19.8, range=0..100)
line_4 = Line([Line((-691.194855, -414.4627288, 0), (-861.3153809, -195.7403743, 0)), Line((-694.1537675, -49.91815777, 0), (-453.7071245, -60.22066815, 0))])
pattern = GhPythonScript(
    x=library_path_4,
    periodic=Toggle(True),
    layers=layer_structure.layers,
    set_tuple=layer_structure.set_tuple,
    edge_easing=Toggle(True),
    edge_ease_zero=Slider(0, range=0..100),
    edge_ease_end=Slider(4, range=0..100),
    pattern_type=list_3,
    period=Slider(25, range=0..100),
    phase_shift=Slider(0.2, range=0..2),
    spacing=Slider(20, range=0..100),
    radius=Slider(35, range=0..100),
    max_val=Slider(0, range=0..100),
    height=Slider(40, range=0..100),
    radius_bot=Slider(0, range=0..10),
    pattern_set=patternmapset,
    direction=Toggle(False))  # -> out, curve_list, a, b, c; inputs periodic: Boolean, layers: list, set_tuple: list, edge_easing: Boolean, pattern_type: Int32, pattern_set: list, direction: Boolean
# ---------- pattern: Python ----------
import sys

sys.path.append(x)

print(sys.path)

import patternGenv2_2 as pm

reload(pm)

pattern_map = pm.PatternMap(layers, set_tuple, periodic)
pattern_map.build()
# pattern_map.subdivide(sub_length)
# pattern_map.generate(layer_height, layer_count)

if edge_easing:

    pattern_map.edgeEasing(edge_ease_zero, edge_ease_end)

if pattern_type == 0:
    
    pattern_map.dotMap(spacing, radius, max_val, direction)

elif pattern_type == 1:

    pattern_map.ellipsoidBumpMap(spacing, radius, max_val, direction)

elif pattern_type == 2:

    pattern_map.sinWarp(period, max_val, phase_shift, direction)

elif pattern_type == 3:

    if radius_bot < .01:

        radius_bot = radius

    else:

        radius_bot = radius_bot

    pattern_map.cylinderMap(spacing, height, radius, max_val, radius_bot, direction)

elif pattern_type == 4:

    pattern_map.layerMap(spacing, pattern_set, radius, max_val, direction)


c = pattern_map.makeMesh()
b = pattern_map.makeCurves()
# ---------- end pattern ----------
end = EndPoints(Curve=line_4)  # -> graft(Start), graft(End)
pt_6 = Point(pt_4)
split = SplitList(List=pt_5, Index=Slider(4, range=0..10))  # -> ListA, ListB
pt_7 = Point([Point(-1021.620417, -290.4807191, 0), Point(-917.5019076, 118.0556972, 0), Point(-521.2068148, 207.3795595, 0)])
crv_8 = Curve(<curve referenced from the Rhino model>)
python_9 = GhPythonScript(
    x=library_path_4,
    pin_points=pt_6,
    connection_count=Slider(3, range=1..4),
    max_main_line=Slider(50, range=25..250),
    start_end_alfa=Slider(1.535, range=0..3.142),
    mid_alfa=Slider(0.529, range=0..3.142))  # -> out, main_links, link_lines, split_lines, pin_pt_sets; inputs pin_points: list of Point3d, connection_count: Int32
# ---------- python_9: Python ----------
import sys

sys.path.append(x)

import pinLinkingBis as pl

reload(pl)

main_links, link_lines, split_lines, pin_pt_sets = pl.createLinks(
    pin_pts = pin_points,
    connection_count = connection_count,
    max_main_line = max_main_line,
    start_end_alfa = start_end_alfa,
    mid_alfa = mid_alfa
)
# ---------- end python_9 ----------
python_10 = GhPythonScript(
    x=library_path_5,
    pin_pts=split.ListA,
    connection_count=number_slider_13,
    max_main_line=number_slider_14,
    start_end_alfa=number_slider_15,
    mid_alfa=number_slider_19,
    pin_height=number_slider_16,
    bot_rad=number_slider_20,
    top_rad=number_slider_21,
    resolution=number_slider_17,
    spacing=number_slider_18)  # -> out, main_links, side_links, split_lines, pin_pt_sets, pins, link_line_vis; inputs pin_pts: list of Point3d, connection_count: Int32, resolution: Int32
# ---------- python_10: Python ----------
import sys

sys.path.append(x)

import pinLinkingBis as pl

reload(pl)

main_links, link_lines, split_lines, pin_pt_sets = pl.createLinks(
    pin_pts = pin_pts,
    connection_count = connection_count,
    max_main_line = max_main_line,
    start_end_alfa = start_end_alfa,
    mid_alfa = mid_alfa
)

link_line_vis = link_lines

main_links = pl.linkSetGeneration(main_links, spacing)
side_links = pl.linkSetGeneration(link_lines, spacing, 2)

pins = pl.pinMaker(pin_pts, pin_height, bot_rad, top_rad, resolution)
# ---------- end python_10 ----------
merge = Merge(Data1=end.Start, Data2=end.End)  # -> flatten(Result)
pt_8 = Point(merge)
panel_4 = Panel(pattern.out)
library_path_6 = FilePath(library_path_4)
layer_structure_2 = GhPythonScript(
    x=library_path_6,
    ori_crvs=python_2.body_slices,
    spacing=Slider(2.5, range=0..10),
    direction=Toggle(False),
    inverse=Toggle(False))  # -> out, layers, set_tuple, a; inputs ori_crvs: list of Curve, direction: Boolean, inverse: Boolean
# ---------- layer_structure_2: Python ----------
# snippet of code to make this python component look for it's   code in the parent folder of the .gh file

import sys

sys.path.append(x)

import vertexClass_v1 as vc

reload(vc)

if direction:
    
    dir = 1
    
else:
    
    dir = -1
    

print(ori_crvs)

layers, set_tuple = vc.singleCurve(ori_crvs, spacing)

a = ori_crvs
# ---------- end layer_structure_2 ----------
pattern_2 = GhPythonScript(
    x=library_path_6,
    layers=layer_structure_2.layers,
    set_tuple=layer_structure_2.set_tuple,
    periodic=Toggle(True),
    sub_length=Slider(2, range=0..10),
    layer_count=Slider(70, range=0..100),
    layer_height=Slider(2.3, range=0..10),
    edge_easing=Toggle(False),
    edge_ease_zero=Slider(0, range=0..100),
    edge_ease_end=Slider(25.4, range=0..100),
    pattern_type=list,
    period=Slider(15, range=0..100),
    phase_shift=Slider(0.3, range=0..2),
    spacing=Slider(50, range=10..100),
    radius=Slider(15, range=0..100),
    max_val=Slider(12.5, range=0..100),
    y_spacing=number_slider_4,
    layer_shift=number_slider_3,
    shift_a=number_slider_7,
    shift_b=number_slider_6,
    ellipsoid=toggle,
    rot_alfa=number_slider_5,
    height=number_slider_2,
    radius_bot=number_slider,
    pattern_set=python_6.a,
    direction=Toggle(True))  # -> out, curve_list, a, b, c; inputs layers: list, set_tuple: list, periodic: Boolean, layer_count: Int32, layer_height: Int32, edge_easing: Boolean, pattern_type: Int32, ellipsoid: Boolean, pattern_set: list, direction: Boolean
# ---------- pattern_2: Python ----------
import sys

sys.path.append(x)

print(sys.path)

import patternGenv2_2 as pm

reload(pm)

pattern_map = pm.PatternMap(layers, set_tuple, periodic)
pattern_map.build()
# pattern_map.subdivide(sub_length)
# pattern_map.generate(layer_height, layer_count)

print("I am out 3")

if edge_easing:

    pattern_map.edgeEasing(edge_ease_zero, edge_ease_end)

if pattern_type == 0:
    
    pattern_map.dotMap(spacing, radius, max_val, direction)

elif pattern_type == 1:

    pattern_map.ellipsoidBumpMap(spacing, radius, max_val, direction)

elif pattern_type == 2:

    pattern_map.sinWarp(period, max_val, phase_shift, direction)

elif pattern_type == 3:

    if radius_bot < .01:

        radius_bot = radius

    else:

        radius_bot = radius_bot

    pattern_map.cylinderMap(spacing, height, radius, max_val, radius_bot, direction)

elif pattern_type == 4:

    pattern_map.layerMap(spacing, pattern_set, radius, max_val, direction)
    
elif pattern_type == 5:
    
    print("I am out 4")
    
    pattern_map.modBasedDotMap(
        x_spacing = spacing,
        y_spacing = y_spacing,
        max_val = max_val,
        ellipsoid = ellipsoid,
        direction = direction,
        layer_shift = layer_shift,
        shift_a = shift_a,
        shift_b = shift_b,
        rot_alfa = rot_alfa
    )

print("I am out 5")

c = pattern_map.makeMesh()
b = pattern_map.makeCurves()
a = [set[1:] for set in pattern_map.pts_set]
# ---------- end pattern_2 ----------
crv_9 = Curve(flatten(pattern_2.b))
panel_5 = Panel(pattern_2.out)
graft_2 = GraftTree(Tree=crv_9, IncludeEmptyLists=True, IncludeNullItems=True)  # -> graft(Tree)
path_mapper = PathMapper(graft_2, source="{A;B;C}", target="{A;C}")

# ---- group: Shell Type
python_11 = GhPythonScript(crv=path_mapper, distance=number_slider_10, direction=list_2, count=Slider(1, range=0..10))  # -> out, a, b; inputs count: Int32
# ---------- python_11: Python ----------
import generalFunctions as gf

reload(gf)

b = crv

a = gf.offsetCurveSet(crv, distance, direction, count)
# ---------- end python_11 ----------
python_12 = GhPythonScript(crv=python_7.a, distance=number_slider_10, direction=list_2, count=number_slider_11)  # -> out, a, b; inputs count: Int32; same code as python_11
python_13 = GhPythonScript(crv=python_2.pin_slices, distance=number_slider_10, direction=list_2, count=number_slider_11)  # -> out, a, b; inputs count: Int32; same code as python_11
number_slider_22 = Slider(3.2, range=-10..10)
toggle_2 = BooleanToggle(True)
list_4 = ValueList({"detached", "crossing"}, selected="crossing")
path_mapper_2 = PathMapper(python_11.a, source="{A;B;C}", target="{C}")
path_mapper_3 = PathMapper(python_12.a, source="{A;B}", target="{B}")
path_mapper_4 = PathMapper(python_13.a, source="{A;B;C}", target="{C}")
crv_10 = Curve(python_11.b)
python_14 = GhPythonScript(crvs=path_mapper_4, split_distance=number_slider_22, split_type=list_4, side_bool=toggle_2)  # -> out, a, b, c, d, e, f; inputs crvs: list, side_bool: Boolean
# ---------- python_14: Python ----------
import sys

sys.path.append(x)

print sys.path

import layerFunctions as lf

reload(lf)

later_set = lf.LinkingLayers(crvs, split_distance, side_bool, split_type)
# later_set.splitLineGeneration(split_line = main_line, angle = -.05)
a, b, c, d, e = later_set.createOrganisedCurves()
f = later_set.joinCrvs()
# ---------- end python_14 ----------
python_15 = GhPythonScript(crvs=path_mapper_3, split_distance=number_slider_22, x=library_path_3, split_type=list_4, side_bool=toggle_2)  # -> out, a, b, c, d, e, f; inputs crvs: list, side_bool: Boolean; same code as python_14
python_16 = GhPythonScript(crvs=path_mapper_2, split_distance=number_slider_22, x=library_path_3, split_type=list_4, side_bool=toggle_2)  # -> out, a, b, c, d, e, f; inputs crvs: list, side_bool: Boolean
# ---------- python_16: Python ----------
import sys

sys.path.append(x)

print sys.path

import layerFunctions as lf

reload(lf)

later_set = lf.LinkingLayers(crvs, split_distance, side_bool, split_type)
# later_set.splitLineGeneration(angle = -.05)
a, b, c, d, e = later_set.createOrganisedCurves()
f = later_set.joinCrvs()
# ---------- end python_16 ----------

# ----
panel_6 = Panel(python_12.a)
item = ListItem(List=path_mapper_2, Index=0, Wrap=True)  # -> Item1, Item
crv_11 = Curve(item.Item1)
crv_12 = Curve(item.Item)
panel_7 = Panel(path_mapper)
panel_8 = Panel(python_16.out)
pline_2 = PolyLine(Vertices=python_14.f, Closed=True)  # -> flatten(Polyline)
offset = OffsetCurve(Curve=crv_11, Distance=Slider(-0.5, range=-10..10), Plane=PlaneXY(0, 0, 0), Corners=1)  # -> flatten(Curve)

# ---- group: Creating Body
pline_3 = PolyLine(Vertices=python_15.f, Closed=True)  # -> flatten(Polyline)
pline_4 = PolyLine(Vertices=python_16.f, Closed=False)  # -> flatten(Polyline)
python_17 = GhPythonScript(
    lines=flatten(python_2.connection_line_set),
    y=flatten(offset),
    z=flatten(pline_3),
    main_exterior_crv=flatten(crv_11),
    inner_boundary_crv=flatten(python_7.a),
    distance=Slider(2, range=0..10),
    count=Slider(2, range=0..10))  # -> out, a, b, c, d, e, f, z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; inputs y: Curve, z: Curve, main_exterior_crv: Polyline, inner_boundary_crv: Polyline, count: Int32
# ---------- python_17: Python ----------
import Rhino.Geometry as rg
import layerFunctions as lf
import generalFunctions as gf
import ghpythonlib.components as gh

reload(lf)
reload(gf)

# exterior_curve_main = gf.curveToPolyline(y)
exterior_curve_main = y
print(type(exterior_curve_main))
inner_curve = gf.curveToPolyline(z)

print("am I closed?")
print(inner_curve.IsClosed)

line_vis_set = []
pt_vis_set = []
curve_vis = []

for i in range(len(lines) - 1):

    line_set = lf.LineSet(lines[i], distance, count)
    line_set.createLines()
    line_set.trimLines(exterior_curve_main, True)
    tmp_lines = line_set.trimLines(inner_boundary_crv, False)
    
    line_vis_set.extend(tmp_lines)
    
    a = line_set.joinLines()
    line_set.lines
    c = line_set.getStartEnd()
    end_pts = line_set.getStartEnd(False)
    
    pt_vis_set.extend(c)

    
    z = gf.polylineTypesToCurve(inner_curve)

    d, _ = gf.layer2ptIntersect(z, c)

    e = gf.longestCurve(d)
    
    curve_vis.extend(d)

    e = gf.curveToPolyline(e)
    
    a.reverse()

    f = a + [pt for pt in e.ToArray()]
    
    inner_curve = gh.PolyLine(f, True)
 
    print("am I closed?")
    print(inner_curve.IsClosed)

line_set = lf.LineSet(lines[-1], distance, count)
line_set.createLines()
line_set.trimLines(exterior_curve_main, True)
tmp_lines = line_set.trimLines(inner_boundary_crv, False)

line_vis_set.extend(tmp_lines)

a = line_set.joinLines()
line_set.lines
c = line_set.getStartEnd()
end_pts = line_set.getStartEnd(False)

pt_vis_set.extend(c)


z = gf.polylineTypesToCurve(inner_curve)

d, _ = gf.layer2ptIntersect(z, c)

e = gf.longestCurve(d)

curve_vis.extend(d)

e = gf.curveToPolyline(e)

a.reverse()

f = [a[-1]] + [pt for pt in e.ToArray()] + [a[0]]

inner_curve = gh.PolyLine(f, False)

print("am I closed?")
print(inner_curve.IsClosed)
# ---------- end python_17 ----------
crv_13 = Curve(python_17.inner_curve)
crv_14 = Curve(pline_4)
panel_9 = Panel(python_17.out)
python_18 = GhPythonScript(inner_curve=crv_13, shell_curve=crv_14)  # -> out, flatten(shell_pt_set); inputs inner_curve: Curve, shell_curve: Curve
# ---------- python_18: Python ----------
import Rhino.Geometry as rg
import layerFunctions as lf
import generalFunctions as gf
import ghpythonlib.components as gh

inner_curve = gf.curveToPolyline(inner_curve)
inner_curve = [pt for pt in inner_curve.ToArray()]
shell_curve.Domain = rg.Interval(0,1)

end_pts_shell = [shell_curve.PointAt(0.0), shell_curve.PointAt(1.0)]
end_pts_inner_curve = [inner_curve[0], inner_curve[-1]]

shell_pl_set = gf.curveToPolyline(shell_curve)

shell_pt_set = [pt for pt in shell_pl_set.ToArray()]

shell_crv = gh.PolyLine(shell_pt_set, True)

y_set, _ = gf.layer2ptIntersect(shell_crv, end_pts_inner_curve)
shell_pt_set = [pt for pt in gf.curveToPolyline(gf.longestCurve(y_set)).ToArray()]

inner_curve = gf.shortenPolylineSet(inner_curve, 2.0, "both")

total_set = shell_pt_set + inner_curve

total_crv = gh.PolyLine(total_set, False)

# y_set, _ = gf.layer2ptIntersect(total_crv, end_pts_shell)
# shell_pt_set = gf.curveToPolyline(gf.longestCurve(y_set))

shell_pt_set = gf.curveToPolyline(total_crv)
# ---------- end python_18 ----------
pline_5 = PolyLine(Vertices=python_18.shell_pt_set, Closed=False)

# ----
panel_10 = Panel(offset)
pline_6 = PolyLine(Vertices=merge, Closed=False)
divide = DivideCurve(Curve=crv_8, Count=Slider(50, range=0..1000), Kinks=False)  # -> Points, Tangents, Parameters
mesh_3 = Mesh(pattern.c)
line_5 = Line(python_9.main_links)
line_6 = Line(python_9.link_lines)
line_7 = Line(python_9.split_lines)
python_19 = GhPythonScript(
    x=library_path_5,
    pin_pts=merge,
    connection_count=number_slider_13,
    max_main_line=number_slider_14,
    start_end_alfa=number_slider_15,
    mid_alfa=number_slider_19,
    pin_height=number_slider_16,
    bot_rad=number_slider_20,
    top_rad=number_slider_21,
    resolution=number_slider_17,
    spacing=number_slider_18)  # -> out, main_links, link_lines, split_lines, pin_pt_sets, pins; inputs pin_pts: list of Point3d, connection_count: Int32, resolution: Int32
# ---------- python_19: Python ----------
import sys

sys.path.append(x)

import brickSlicer as bs
import pinLinkingBis as pl
import layerFunctions as lf
import generalFunctions as gf

reload(bs)
reload(pl)
reload(lf)
reload(gf)

def pinMaker(pin_pts, pin_height, bot_rad, top_rad, resolution = 16):

    return [pl.Pin(pt, pin_height, bot_rad, top_rad, resolution) for pt in pin_pts]


def joinShape(prev_crv, next_crv, line_set):

    prev_crv = prev_crv.ToNurbsCurve()
    next_crv = next_crv.ToNurbsCurve()

    line_set.trimLines(next_crv, True)
    line_set.trimLines(prev_crv, False)

    start_pts = line_set.getStartEnd(True)
    end_pts = line_set.getStartEnd(False)

    result_crvs, _ = gf.layer2ptIntersect(prev_crv, start_pts)
    main_crv = curveToPolyline(result_crvs[0]).ToArray()

    result_crvs, _ = gf.layer2ptIntersect(prev_crv, end_pts)
    next_crv = curveToPolyline(result_crvs[0]).ToArray()

    main_shape = rg.Polyline(main_crv + next_crv)

    return main_shape


def mainLinkOffsetSet(lines, spacing):

    main_link_set = []

    for line in lines:

        loc_line_set = lf.LineSet(line, spacing, 2)
        loc_line_set.createLines()

        main_link_set.append(loc_line_set)

    return main_link_set

main_links, link_lines, split_lines, pin_pt_sets = pl.createLinks(
    pin_pts = pin_pts,
    connection_count = connection_count,
    max_main_line = max_main_line,
    start_end_alfa = start_end_alfa,
    mid_alfa = mid_alfa
)

main_links = mainLinkOffsetSet(main_links, spacing)

pins = pinMaker(pin_pts, pin_height, bot_rad, top_rad, resolution)
# ---------- end python_19 ----------
line_8 = Line(python_10.link_line_vis)
line_9 = Line(python_10.side_links)
line_10 = Line(python_10.split_lines)
python_20 = GhPythonScript(start_height=Slider(1.1, range=0..10), layer_height=Slider(1.4, range=0..10), max_height=Slider(2.6, range=0..100))  # -> out, height_list
# ---------- python_20: Python ----------
safety = 20

count = 0
current_h = start_height

height_list = []

while current_h < max_height:
    
    height_list.append(current_h)
    
    current_h += layer_height
    
    count += 1
    
    if count > safety:
        
        break
# ---------- end python_20 ----------
python_21 = GhPythonScript(x=python_9.pin_pt_sets)  # -> out, a; inputs x: list
# ---------- python_21: Python ----------
a = []

for pt_set in x:
    
    a.extend(pt_set)
# ---------- end python_21 ----------
item_2 = ListItem(List=line_8, Index=0, Wrap=True)
python_22 = GhPythonScript(x=python_10.pin_pt_sets)  # -> out, a; inputs x: list; same code as python_21
re_slicer = GhPythonScript(x=library_path_4, ori_crvs=pattern.b, slice_geo=geometry, layer_count=number_slider_8)  # -> out, ori_crvs, crv_sets, a, b, c, d; inputs ori_crvs: list
# ---------- re_slicer: Python ----------
# snippet of code to make this python component look for it's   code in the parent folder of the .gh file

import sys

sys.path.append(x)

print(sys.path)

import brickSlicer as bs

reload(bs)


print(type(slice_geo))

crv_sets, a, b, c, d = bs.splitter(ori_crvs, slicing_object = slice_geo, split_type = "object")
# ---------- end re_slicer ----------
Z = UnitZ(Factor=python_20.height_list)
pline_7 = PolyLine(Vertices=divide.Points, Closed=False)
number_slider_23 = Slider(1.4, range=0.5..12)
move_2 = Move(Geometry=pline_7, Motion=Z)  # -> Geometry, Transform
line_11 = Line(python_10.main_links)
num = Number(100)
path_mapper_5 = PathMapper(python_10.side_links, source="{A;B;C}", target="{A;B}")
number_slider_24 = Slider(2, range=0..10)
python_23 = GhPythonScript(
    x=library_path_5,
    main_links=python_10.main_links,
    pins=python_10.pins,
    link_set=python_10.side_links,
    heights=python_20.height_list)  # -> out, main_crv, b, c, inner_crvs, main_crv_pt_set, main_links; inputs main_links: list, pins: list, link_set: list
# ---------- python_23: Python ----------
import sys

sys.path.append(x)

import pinLinkingBis as pl

reload(pl)

main_crv, b, main_links, inner_crvs = pl.makeMainShape(pins, main_links, heights)
# ---------- end python_23 ----------
path_mapper_6 = PathMapper(python_23.main_crv, source="{A;B;C}", target="{A;B}")
layer_structure_3 = GhPythonScript(
    x=library_path_6,
    ori_crvs=layer_slicing.ori_crvs,
    crv_set=re_slicer.crv_sets,
    spacing=number_slider_12,
    direction=Toggle(False),
    inverse=Toggle(False),
    end_smooth=Toggle(True),
    crv_l=num)  # -> out, layers, set_tuple, a; inputs ori_crvs: list, crv_set: list, direction: Boolean, inverse: Boolean, end_smooth: Boolean
# ---------- layer_structure_3: Python ----------
# snippet of code to make this python component look for it's   code in the parent folder of the .gh file

import sys

sys.path.append(x)

import vertexClass_v1 as vc

reload(vc)

if direction:
    
    dir = 1
    
else:
    
    dir = -1
    

print(ori_crvs)

layers, set_tuple = vc.singleCurve(ori_crvs, spacing, end_smooth, crv_l)

a = ori_crvs
# ---------- end layer_structure_3 ----------
python_24 = GhPythonScript(x=library_path_5, main_links=python_10.main_links, pins=python_10.pins, heights=python_20.height_list)  # -> out, main_links, link_lines, split_lines, pin_pt_sets, pins, a, b, c; inputs main_links: list, pins: list
# ---------- python_24: Python ----------
import Rhino.Geometry as rg
from copy import deepcopy as dc

import sys

sys.path.append(x)

import brickSlicer as bs
import pinLinkingBis as pl
import layerFunctions as lf
import generalFunctions as gf

reload(bs)
reload(pl)
reload(lf)
reload(gf)

def joinShape(prev_crv, next_crv, line_set):
    
    print("----extending----")
    line_set.trimLines(next_crv, True)
    print("----trimming----")
    line_set.trimLines(prev_crv, False)
    print("----end of trim/extend----")
    
    lines = line_set.lines
    
    print("----start_pts----")
    start_pts = line_set.getStartEnd(True)
    print("----end_pts----")
    end_pts = line_set.getStartEnd(False)
    print("----end of start & ends----")
    
    print("----results----")
    print("--cutting main curve--")
    result_crvs_0, _ = gf.layer2ptIntersect(prev_crv, start_pts)
    print("----main curve assignment----")
    main_crv = gf.curveToPolyline(gf.longestCurve(result_crvs_0)).ToArray()
    
    print("----results----")
    print("--cutting next curve--")
    result_crvs_1, _ = gf.layer2ptIntersect(next_crv, end_pts)
    print("----next curve assignment----")
    next_crv = gf.curveToPolyline(gf.longestCurve(result_crvs_1)).ToArray()
    
    print("----pt_set----")
    pt_set = main_crv + next_crv
    print(pt_set)
    print("----output generation----")
    pt_set = list(pt_set)
    # pt_set.reverse()
    
    print("----end----")
    print(pt_set)
    
    return pt_set + [pt_set[0]], lines


def makeMainShape(pins, main_link_set, height):

    main_curve = pins[0].createSlice(height).ToPolylineCurve()

    mv_m = rg.Transform.Translation(rg.Vector3d(0,0,height))

    print(height)
    
    lines = []

    for i, main_link in enumerate(main_link_set):

        con_line_set = dc(main_link)
        con_line_set.Transform(mv_m)

        next_crv = pins[i + 1].createSlice(height).ToPolylineCurve()

        new_pt_set, line_set = joinShape(main_curve, next_crv, con_line_set)
        
        main_curve = rg.Polyline(new_pt_set).ToPolylineCurve()
        
        lines.extend(line_set)
        
    return new_pt_set, lines

a, b = makeMainShape(pins, main_links, heights)
# ---------- end python_24 ----------
layer_structure_4 = GhPythonScript(
    x=library_path_6,
    ori_crvs=re_slicer.ori_crvs,
    crv_set=re_slicer.crv_sets,
    spacing=number_slider_12,
    direction=Toggle(True),
    item=Toggle(False))  # -> out, layers, set_tuple, a; inputs ori_crvs: list, crv_set: list, direction: Boolean, item: Boolean; same code as layer_structure
python_25 = GhPythonScript(x=path_mapper_5)  # -> out, a; inputs x: list
# ---------- python_25: Python ----------
a = []

for set in x:
    
    a.extend(set.lines)
# ---------- end python_25 ----------
python_26 = GhPythonScript(
    x=library_path_5,
    exterior_crv=move_2.Geometry,
    side_link_set=python_10.side_links,
    main_crv=python_23.main_crv,
    heights=python_20.height_list)  # -> out, main_crv_pt_set, d; inputs exterior_crv: Curve, side_link_set: list, main_crv: Curve
# ---------- python_26: Python ----------
import sys

sys.path.append(x)

import pinLinkingBis as pl

reload(pl)

print(main_crv.PointAt(0.0))
print(exterior_crv.PointAt(0.0))

print(main_crv.GetLength())
print(exterior_crv.GetLength())

main_crv_pt_set, side_link_set = pl.makeSideLinks(main_crv, exterior_crv, side_link_set, heights)

d = []

for link in side_link_set:
    
    d.extend(link.lines)
# ---------- end python_26 ----------
python_27 = GhPythonScript()  # -> out, a; same code as python_6
line_12 = Line(python_23.inner_crvs)
python_28 = GhPythonScript(x=library_path_5, side_links=flatten(path_mapper_5), interior_crv=path_mapper_6, exterior_crv=move_2.Geometry)  # -> out, side_link_lines; inputs side_links: list, interior_crv: Curve, exterior_crv: Curve
# ---------- python_28: Python ----------
import Rhino.Geometry as rg
from copy import deepcopy as dc

import sys

sys.path.append(x)

height_val = interior_crv.PointAt(0.0).Z

mv_m = rg.Transform.Translation(rg.Vector3d(0,0,height_val))

side_link_lines = []

print(type(exterior_crv))

for side_link in side_links:
    
    loc_link = dc(side_link)
    loc_link.Transform(mv_m)
    
    loc_link.trimLines(exterior_crv, True)
    loc_link.trimLines(interior_crv, False)
    
    side_link_lines.extend(loc_link.lines)
    
print(side_link_lines[0].To.Z)
# ---------- end python_28 ----------
python_29 = GhPythonScript()  # -> out, a; same code as python_6

# ---- group: cylinder
number_slider_25 = Slider(5, range=0..10)
number_slider_26 = Slider(10, range=0..100)

# ---- group: mod Based Dot Map
number_slider_27 = Slider(2, range=1..10)
number_slider_28 = Slider(10, range=10..100)
toggle_3 = BooleanToggle(True)
number_slider_29 = Slider(1.5708, range=0..3.1416)
number_slider_30 = Slider(-0.3, range=-2..2)
number_slider_31 = Slider(1.3, range=0..2)

# ----
item_3 = ListItem(List=python_25.a, Index=number_slider_24, Wrap=True)
item_4 = ListItem(List=move_2.Geometry, Index=number_slider_24, Wrap=True)

# ---- group: cylinder
number_slider_32 = Slider(5, range=0..10)
number_slider_33 = Slider(10, range=0..100)

# ---- group: mod Based Dot Map
number_slider_34 = Slider(3, range=1..10)
number_slider_35 = Slider(9.69, range=5..100)
toggle_4 = BooleanToggle(True)
number_slider_36 = Slider(1.5708, range=0..3.1416)
number_slider_37 = Slider(-0.2, range=-2..2)
number_slider_38 = Slider(1.4, range=0..2)

# ----
panel_11 = Panel(layer_structure_3.out)
crv_15 = Curve(python_23.main_crv)
list_5 = ValueList({"dotMap": 0, "ellipsoidBumpMap": 1, "sinWarp": 2, "cylinderMap": 3, "layerMap": 4, "modulorBased": 5}, selected="modulorBased")
item_5 = ListItem(List=crv_9, Index=0, Wrap=True)
list_6 = ValueList({"dotMap": 0, "ellipsoidBumpMap": 1, "sinWarp": 2, "cylinderMap": 3, "layerMap": 4, "modulorBased": 5}, selected="sinWarp")
library_path_7 = FilePath(library_path_6)
pline_8 = PolyLine(Vertices=python_26.main_crv_pt_set, Closed=False)
python_30 = GhPythonScript(x=item_3)  # -> out, a
# ---------- python_30: Python ----------
print(x.PointAt(0.0).Z)
# ---------- end python_30 ----------
panel_12 = Panel(python_28.out)
panel_13 = Panel(python_10.side_links)
python_31 = GhPythonScript()  # -> out, a
# ---------- python_31: Python ----------
import sys

sys.path.append("/Volumes/GoogleDrive/My Drive/ClayPrinting")

import brickSlicer as bs

reload(bs)


bs.slicing
# ---------- end python_31 ----------
number_slider_39 = Slider(0, range=0..10)
brim = GhPythonScript(crv=item_5, offset_amount=Slider(10, range=0..10))  # -> out, flatten(a); inputs crv: Curve
# ---------- brim: Python ----------
import Rhino.Geometry as rg
import generalFunctions as gf
        
a = gf.offsetCurveSet(crv, offset_amount, "outside", count = 2)[1]
# ---------- end brim ----------
pattern_3 = GhPythonScript(
    x=library_path_6,
    layers=layer_structure_3.layers,
    set_tuple=layer_structure_3.set_tuple,
    periodic=Toggle(True),
    sub_length=Slider(2, range=0..10),
    layer_count=Slider(70, range=0..100),
    layer_height=Slider(2.3, range=0..10),
    edge_easing=Toggle(False),
    edge_ease_zero=Slider(0, range=0..100),
    edge_ease_end=Slider(25.4, range=0..100),
    pattern_type=list_6,
    period=Slider(2, range=0..100),
    phase_shift=Slider(0.5, range=0..2),
    spacing=Slider(20, range=10..100),
    radius=Slider(9, range=0..100),
    max_val=Slider(4, range=0..100),
    y_spacing=number_slider_35,
    layer_shift=number_slider_34,
    shift_a=number_slider_38,
    shift_b=number_slider_37,
    ellipsoid=toggle_4,
    rot_alfa=number_slider_36,
    height=number_slider_33,
    radius_bot=number_slider_32,
    pattern_set=python_29.a,
    direction=Toggle(False))  # -> out, curve_list, a, b, c; inputs layers: list, set_tuple: list, periodic: Boolean, layer_count: Int32, layer_height: Int32, edge_easing: Boolean, pattern_type: Int32, ellipsoid: Boolean, pattern_set: list, direction: Boolean; same code as pattern_2
layer_structure_5 = GhPythonScript(
    x=library_path_6,
    ori_crvs=pattern_3.b,
    crv_set=re_slicer.crv_sets,
    spacing=number_slider_12,
    direction=Toggle(False),
    inverse=Toggle(False))  # -> out, layers, set_tuple, a; inputs ori_crvs: list, crv_set: list, direction: Boolean, inverse: Boolean; same code as layer_structure_2
pattern_4 = GhPythonScript(
    x=library_path_6,
    layers=layer_structure_5.layers,
    set_tuple=layer_structure_5.set_tuple,
    periodic=Toggle(True),
    sub_length=Slider(2, range=0..10),
    layer_count=Slider(70, range=0..100),
    layer_height=Slider(2.3, range=0..10),
    edge_easing=Toggle(False),
    edge_ease_zero=Slider(0, range=0..100),
    edge_ease_end=Slider(25.4, range=0..100),
    pattern_type=list_5,
    period=Slider(1, range=0..100),
    phase_shift=Slider(-0.25, range=-2..2),
    spacing=Slider(50, range=10..100),
    radius=Slider(2, range=0..100),
    max_val=Slider(7, range=0..100),
    y_spacing=number_slider_28,
    layer_shift=number_slider_27,
    shift_a=number_slider_31,
    shift_b=number_slider_30,
    ellipsoid=toggle_3,
    rot_alfa=number_slider_29,
    height=number_slider_26,
    radius_bot=number_slider_25,
    pattern_set=python_27.a,
    direction=Toggle(True))  # -> out, curve_list, a, b, c; inputs layers: list, set_tuple: list, periodic: Boolean, layer_count: Int32, layer_height: Int32, edge_easing: Boolean, pattern_type: Int32, ellipsoid: Boolean, pattern_set: list, direction: Boolean; same code as pattern_2
panel_14 = Panel(python_24.out)
list_7 = ValueList({"detached", "crossing"}, selected="crossing")
line_13 = Line(flatten(line_10))
re_slicer_2 = GhPythonScript(x=library_path_7, ori_crvs=pattern_3.b, slice_geo=move.Geometry, layer_count=number_slider_8)  # -> out, ori_crvs, crv_sets, a, b, c, d; inputs ori_crvs: list; disabled
# ---------- re_slicer_2: Python ----------
import sys

sys.path.append(x)

import brickSlicer as bs

reload(bs)

crv_sets, a, b, c, d = bs.splitter(ori_crvs, slicing_object = slice_geo, split_type = "object")
# ---------- end re_slicer_2 ----------
crv_16 = Curve(python_23.inner_crvs)
panel_15 = Panel(python_26.out)
list_8 = ValueList({"Inside": "inside", "Outside": "outside"}, selected="Inside")
python_32 = GhPythonScript(x=flatten(python_14.f))  # -> out, b, a; inputs x: list
# ---------- python_32: Python ----------
b = [[pt for pt in x]]
# ---------- end python_32 ----------
python_33 = GhPythonScript(x=python_18.shell_pt_set)  # -> out, b, a, z; inputs x: list
# ---------- python_33: Python ----------
b = [[pt for pt in x]]

z = b[0][0].Z
# ---------- end python_33 ----------

# ---- group: Brim
crv_17 = Curve(<curve referenced from the Rhino model>)
divide_2 = DivideCurve(Curve=crv_17, Count=10, Kinks=True)  # -> Points, Tangents, Parameters
python_34 = GhPythonScript(x=brim.a, z=python_33.z)  # -> out, b, a; inputs x: list
# ---------- python_34: Python ----------
import Rhino.Geometry as rg

b = [rg.Point3d(pt.X, pt.Y, z) for pt in x]
a = [b + [b[0]]]
# ---------- end python_34 ----------

# ----
path_mapper_7 = PathMapper(crv_16, source="{A;B;C;D}", target="{A;D}")
path_mapper_8 = PathMapper(python_23.main_links, source="{A;B;C;D}", target="{A;D}")
crv_18 = Curve(<curve referenced from the Rhino model>)
panel_16 = Panel(python_20.height_list)
panel_17 = Panel(pattern_3.out)
mesh_4 = Mesh(pattern_3.c)
list_9 = ValueList({"detached", "crossing"}, selected="detached")
list_10 = ValueList({"Inside": "inside", "Outside": "outside"}, selected="Inside")
mesh_5 = Mesh(pattern_4.c)
move_3 = Move(Motion=Vector(0, 0, 10))  # -> Geometry, Transform
item_6 = ListItem(List=line_13, Index=number_slider_39, Wrap=True)
item_7 = ListItem(List=crv_16, Index=number_slider_39, Wrap=True)
python_35 = GhPythonScript(
    x=library_path_7,
    main_links=path_mapper_8,
    crvs=path_mapper_7,
    split_lines=line_13,
    heights=python_20.height_list,
    distance=Slider(1.1, range=0..10),
    direction=list_8,
    count=Slider(4, range=0..10),
    split_distance=Slider(-1.1, range=-10..10),
    split_type=list_7,
    side_bool=Toggle(True))  # -> out, a, b, c, d, e, pt_sets, crv_set, main_crv; inputs main_links: list, side_links: list, crvs: list of Curve, split_lines: list of Line, count: Int32, side_bool: Boolean
# ---------- python_35: Python ----------
import sys

sys.path.append(x)

# print(sys.path)

import generalFunctions as gf
import layerFunctions as lf
import Rhino.Geometry as rg
import pinLinkingBis as pl

from copy import deepcopy as dc

reload(gf)
reload(lf)
reload(pl)

pt_sets = []

inner_crvs = []

mv_m = rg.Transform.Translation(rg.Vector3d(0,0,heights))

loc_split_lines = dc(split_lines)
[line.Transform(mv_m) for line in loc_split_lines]

print loc_split_lines

crv_count = len(crvs)
print("there are %s curves in your list" % crv_count)

for crv_i, crv in enumerate(crvs):
    
    a = gf.offsetCurveSet(crv, distance, direction, count)
    layer_set = lf.LinkingLayers(a, split_distance, side_bool, split_type, split_line = loc_split_lines[crv_i])
    # a = layer_set.split_a
    # b = layer_set.split_b
    # c = layer_set.split_line
    # d = layer_set.split_axis
    a, b, c, d, e = layer_set.createOrganisedCurves()
    
    pt_set = layer_set.joinCrvs()
    pt_set = pt_set[1:-1] + [pt_set[1]]
    
    crv = rg.Polyline(pt_set).ToPolylineCurve()
    
    inner_crvs.append(crv)

print("I passed this hurdle")

main_crv = pl.makeInnerCurve(inner_crvs, main_links, side_links, end_link)
    

print(type(a))
# ---------- end python_35 ----------
python_36 = GhPythonScript(x=pattern_3.a)  # -> out, a; inputs x: list; disabled
# ---------- python_36: Python ----------
print(x[0])
# ---------- end python_36 ----------
python_37 = GhPythonScript(x=crv_18)  # -> out, a, x; inputs x: Curve
# ---------- python_37: Python ----------
import Rhino.Geometry as rg
from copy import deepcopy as dc

pln = rg.Plane(x.PointAt(0.0), rg.Vector3d(0,0,1))

tmp_offset_crv_1 = x.Offset(pln, 1.0, .01, rg.CurveOffsetCornerStyle.Round)[0]
tmp_offset_crv_2 = x.Offset(pln, -1.0, .01, rg.CurveOffsetCornerStyle.Round)[0]

x.Domain = rg.Interval(0,1)
a = dc(x)

if tmp_offset_crv_1.GetLength() < tmp_offset_crv_2.GetLength():
    
    print("curve needed to be reversed!")

    a.Reverse()
    
a
a.Domain = rg.Interval(0,1)
# ---------- end python_37 ----------
panel_18 = Panel(mesh_5)
panel_19 = Panel(crv_16)
python_38 = GhPythonScript(
    x=library_path_7,
    crvs=re_slicer_2.ori_crvs,
    distance=Slider(1.1, range=0..10),
    direction=list_10,
    count=Slider(4, range=0..10),
    split_distance=Slider(-1.1, range=-10..10),
    split_type=list_9,
    side_bool=Toggle(True))  # -> out, a, b, c, d, e, pt_sets; inputs crvs: list of Curve, count: Int32, side_bool: Boolean
# ---------- python_38: Python ----------
import sys

sys.path.append(x)

# print(sys.path)

import generalFunctions as gf
import layerFunctions as lf

reload(gf)
reload(lf)

pt_sets = []

for crv_i, crv in enumerate(crvs):
    
    print(crv_i)
    
    a = gf.offsetCurveSet(crv, distance, direction, count)
    layer_set = lf.LinkingLayers(a, split_distance, side_bool, split_type)
    a, b, c, d, e = layer_set.createOrganisedCurves()
    pt_sets.append(layer_set.joinCrvs())
print(type(a))
# ---------- end python_38 ----------
eval = EvaluateCurve(Curve=[python_37.a, python_37.x], Parameter=Slider(0.51, range=0..1))  # -> Point, Tangent, Angle
crv_19 = Curve(python_35.main_crv)
panel_20 = Panel(python_37.out)
merge_2 = Merge(Data1=flatten(python_34.a), Data2=flatten(python_33.b), Data3=flatten(python_32.b))
start_stop_feedrate_in_mm_min = Slider(100, range=0..1000)

# ---- group: Brim
cluster = Cluster(crv=pattern_3.b, shift=Slider(2, range=0..10), z_height=number_slider_9)  # -> crv_3, list

# ----
python_39 = GhPythonScript(x=cluster.list)  # -> out, b, a; inputs x: list; disabled
# ---------- python_39: Python ----------
b = [pt for pt in x]
a = [b + [b[0]]]
# ---------- end python_39 ----------
panel_21 = Panel(python_23.out)
panel_22 = Panel(python_35.out)
panel_23 = Panel(python_36.out)  # disabled
list_11 = ValueList({"detached", "crossing"}, selected="detached")
feed_rate_in_mm_s = Slider(25, range=0..100)
merge_3 = Merge(Data1=flatten(python_39.a), Data2=flatten(pattern_3.a))  # disabled
crv_20 = Curve(python_38.pt_sets)
list_12 = ValueList({"start / stop": "start_stop", "continious"}, selected="continious")
python_40 = GhPythonScript(
    x=library_path_7,
    crvs=python_38.pt_sets,
    split_distance=Slider(1.1, range=0..10),
    split_type=list_11,
    side_bool=Toggle(True))  # -> out, a, b, c, d, e, f; inputs crvs: list, side_bool: Boolean
# ---------- python_40: Python ----------
import sys

sys.path.append(x)

# print(sys.path)

import layerFunctions as lf

reload(lf)

later_set = lf.LinkingLayers(crvs, split_distance, side_bool, split_type)
a, b, c, d, e = later_set.createOrganisedCurves()
f = later_set.joinCrvs()
# ---------- end python_40 ----------
crv_21 = Curve(python_40.d)
crv_22 = Curve(python_40.b)
pt_9 = Point(python_40.a)

# ---- group: G-Code
start_stop_feedrate_in_mm_min_2 = Slider(100, range=0..1000)
feed_rate_in_mm_s_2 = Slider(10, range=0..100)
list_13 = ValueList({"start / stop": "start_stop", "continious"}, selected="continious")
gcodelines = GhPythonScript(
    x=library_path_7,
    pts=merge_3,
    feed_rate=feed_rate_in_mm_s_2,
    extrusion_rate=Slider(0.5, range=0..10),
    link_type=list_13,
    global_trim_distance=Slider(0, range=0..10),
    ss_trim_distance=Slider(5, range=0..10),
    cull_distance=Slider(2.1, range=0..10),
    lift_val=Slider(4.4, range=0..10),
    ss_f_rate=start_stop_feedrate_in_mm_min_2,
    ss_e_rate=Slider(300, range=0..1000))  # -> out, a, path_vis; inputs pts: list
# ---------- gcodelines: Python ----------
import sys

sys.path.append(x)

import Rhino.Geometry as rg
import simpleStartStop as ss

reload(ss)

# print(pts)

p_set = ss.PrintSettings(
    feed_rate = feed_rate, 
    extrusion_rate = extrusion_rate, 
    extrusion_mode = 'relative', 
    movement_mode = 'relative'
)

l_type = ss.LinkType(
    link_type = link_type,
    global_trim_distance = global_trim_distance,
    ss_trim_distance = ss_trim_distance,
    cull_distance = cull_distance,
    lift_val = lift_val
)

l_type.ss_f_rate = ss_f_rate
l_type.ss_e_rate = ss_e_rate

gcodeset = ss.GCodeSet(pts, p_set, l_type)
a = gcodeset.generateGCode()

path_vis = gcodeset.path_vis
# ---------- end gcodelines ----------
end_start_gcode = GhPythonScript(lines=flatten(gcodelines.a))  # -> out, a; inputs lines: list
# ---------- end_start_gcode: Python ----------
__author__ = "JesusBarney"
__version__ = "2019.04.06"

import rhinoscriptsyntax as rs

#move_mode = "G1"
#extrusion_rate = 0.12
#extrusion_start = 0
offset_z = 0.10
#speed = 500
g_code = []

initiate_gcode = """;FLAVOR:Marlin
;TIME:0
;Filament used: 6.75709m
;Layer height: 1.1
;MINX:-47.897
;MINY:-47.91
;MINZ:1.1
;MAXX:47.895
;MAXY:47.91
;MAXZ:99
;Generated with Cura_SteamEngine 4.1.0
M104 S210
M105
M109 S210
M83 ;relative extrusion mode
G28 ;Home
G1 Z15.0 F6000 ;Move the platform down 15mm
;Prime the extruder
G92 E0
G1 F200 E3
G92 E0
G92 E0
G92 E0
G1 F1500 E-6.5
;LAYER_COUNT:90
;LAYER:0
M107
M203 Z50
M205 X30 Y30
G0 F1500 X30 Y-3.573 Z20
M205 X20 Y20
;TYPE:SKIRT
G1 X0 Y0 Z20 E1"""

# ;TIME_ELAPSED:751.629903
# G1 F1500 E510.30819   

end_gcode = """M205 X30 Y30 Z30 E-1
G0 F3000 X-43.931 Y-19.114
G0 X-40.689 Y-17.797
M205 X20 Y20
M203 Z299792458000
M107
M104 S0
M140 S0
;Retract the filament
G92 E1
G1 E-1 F300
G28 X0 Y0
M84
M83 ;absolute extrusion mode
M104 S0"""

print initiate_gcode

for line in lines:

    print(line)

print end_gcode
# ---------- end end_start_gcode ----------

# ----
pline_9 = PolyLine(Vertices=python_40.f, Closed=False)  # -> flatten(Polyline)
item_8 = ListItem(List=pline_9, Index=0, Wrap=True)
gcodelines_2 = GhPythonScript(
    pts=merge_2,
    feed_rate=feed_rate_in_mm_s,
    extrusion_rate=Slider(0.5, range=0..10),
    link_type=list_12,
    global_trim_distance=Slider(0, range=0..10),
    ss_trim_distance=Slider(5, range=0..10),
    cull_distance=Slider(0, range=0..10),
    lift_val=Slider(4.4, range=0..10),
    ss_f_rate=start_stop_feedrate_in_mm_min,
    ss_e_rate=Slider(300, range=0..1000))  # -> out, a, path_vis; inputs pts: list; same code as gcodelines
eval_2 = EvaluateCurve(Curve=item_8, Parameter=Slider(256, range=0..1000))  # -> Point, Tangent, Angle
panel_24 = Panel(python_40.out)
pline_10 = PolyLine(Vertices=gcodelines_2.path_vis, Closed=False)
end_start_gcode_2 = GhPythonScript(lines=flatten(gcodelines_2.a))  # -> out, a; inputs lines: list
# ---------- end_start_gcode_2: Python ----------
__author__ = "JesusBarney"
__version__ = "2019.04.06"

import rhinoscriptsyntax as rs

#move_mode = "G1"
#extrusion_rate = 0.12
#extrusion_start = 0
offset_z = 0.10
#speed = 500
g_code = []

initiate_gcode = """;FLAVOR:Marlin
;TIME:0
;Filament used: 6.75709m
;Layer height: 1.1
;MINX:-47.897
;MINY:-47.91
;MINZ:1.1
;MAXX:47.895
;MAXY:47.91
;MAXZ:99
;Generated with Cura_SteamEngine 4.1.0
M104 S210
M105
M109 S210
M83 ;relative extrusion mode
G28 ;Home
G1 Z15.0 F6000 ;Move the platform down 15mm
;Prime the extruder
G92 E0
G1 F200 E3
G92 E0
G92 E0
G92 E0
G1 F1500
;LAYER_COUNT:90
;LAYER:0
M107
M203 Z50
M205 X30 Y30
G0 F1500 X30 Y-3.573 Z20
M205 X20 Y20
;TYPE:SKIRT
G1 X0 Y0 Z20 E25"""

# ;TIME_ELAPSED:751.629903
# G1 F1500 E510.30819   

end_gcode = """M205 X30 Y30 Z30 E-1
G0 F600 X-43.931 Y-19.114
G0 X-40.689 Y-17.797
M205 X20 Y20
M203 Z299792458000
M107
M104 S0
M140 S0
;Retract the filament
G92 E1
G1 E-1 F300
G28 X0 Y0
M84
M83 ;absolute extrusion mode
M104 S0"""

print initiate_gcode

for line in lines:

    print(line)

print end_gcode
# ---------- end end_start_gcode_2 ----------
pline_11 = PolyLine(Vertices=gcodelines.path_vis, Closed=False)
crv_23 = Curve(<curve referenced from the Rhino model>)
panel_25 = Panel(gcodelines.out)
panel_26 = Panel(end_start_gcode_2.out)
list_14 = ValueList({"Inside": "inside", "Outside": "outside"}, selected="Inside")
offset_2 = OffsetCurve(Curve=crv_23, Distance=1, Plane=PlaneXY(0, 0, 0), Corners=1)
crv_24 = Curve([<curve referenced from the Rhino model> x3])
panel_27 = Panel(end_start_gcode.out)
python_41 = GhPythonScript(x=offset_2)  # -> out, a; same code as ghpython_script
python_42 = GhPythonScript(crv=crv_23, distance=Slider(0.4, range=0..10), direction=list_14, count=Slider(1, range=0..10))  # -> out, a; inputs count: Int32
# ---------- python_42: Python ----------
from sys import path
from scriptcontext import sticky

path.append(sticky["clay_printing_library"])

import generalFunctions as gf

reload(gf)

a = gf.offsetCurveSet(crv, distance, direction, count)

for crv in a:
    
    gf.polylinePeriodicizer(crv)
# ---------- end python_42 ----------
python_43 = GhPythonScript(crvs=crv_24, count=Slider(110, range=0..1000))  # -> out, a, b, c, d; inputs crvs: list of Curve, count: Int32
# ---------- python_43: Python ----------
import Rhino.Geometry as rg

for crv in crvs:

    crv.Domain = rg.Interval(0, count - 1)

a = [[crv.PointAt(t) for t in range(count)] for crv in crvs]

d = []

for i in range(10):
    
    mv_pt = rg.Point3d(0, 0, i * 1.5)
    
    for a_set in a:
        
        d.append([pt + mv_pt for pt in a_set])
     
c = []

for e in d:
    c.extend(e)
# ---------- end python_43 ----------
crv_25 = Curve(<curve referenced from the Rhino model>)
list_15 = ValueList({"start", "end", "both"}, selected="both")
eval_3 = Evaluate()
list_16 = ValueList({"start", "end", "both"}, selected="both")
panel_28 = Panel(python_42.out)
divide_3 = DivideCurve(Curve=crv_25, Count=Slider(110, range=0..1000), Kinks=False)  # -> Points, Tangents, Parameters
python_44 = GhPythonScript(pt_sets=python_43.d, distance=Slider(2.8, range=0..10), location=list_15, count=Slider(1, range=0..10))  # -> out, a, b, c; inputs pt_sets: list, count: Int32
# ---------- python_44: Python ----------
from sys import path
from scriptcontext import sticky

path.append(sticky["clay_printing_library"])

import generalFunctions as gf

reload(gf)

# print(pts)

a = [gf.collapsePolylinePts(pts, distance) for pts in pt_sets]

c = []

for b in a:
    c.extend(b)
# ---------- end python_44 ----------
pline_12 = PolyLine(Vertices=divide_3.Points, Closed=False)
python_45 = GhPythonScript(pts=divide_3.Points, distance=Slider(0, range=0..10), location=list_16, count=Slider(1, range=0..10))  # -> out, a; inputs pts: list, count: Int32
# ---------- python_45: Python ----------
from sys import path
from scriptcontext import sticky

path.append(sticky["clay_printing_library"])

import simpleStartStop as sSS

reload(sSS)

# print(pts)

a = sSS.shortenPolylineSet(pts, distance, location)
# ---------- end python_45 ----------
python_46 = GhPythonScript(x=python_44.a)  # -> out, a; inputs x: list
# ---------- python_46: Python ----------
print(x)
# ---------- end python_46 ----------
pline_13 = PolyLine(Vertices=python_45.a, Closed=False)
len = Length(Curve=pline_12)
len_2 = Length(Curve=pline_13)
subtraction = Subtraction(A=len, B=len_2)

# ==== cluster Cluster
crv = ClusterInput()
crv_2 = Curve(crv)
crv_3 = ClusterOutput(crv_2)
z_height = ClusterInput()
item = ListItem(List=crv_2, Index=0, Wrap=True)
python = GhPythonScript(x=item, z_height=z_height)  # -> out, a; inputs x: Curve
# ---------- python: Python ----------
import Rhino.Geometry as rg
import math

def crvOrienter(crv):

    x_or_y = True
    rot_angle = 0.0
    area = 9999999

    for i in range(90):

        angle = math.pi * i / 180

        # bounding box translation
        x_vec = rg.Vector3d(math.cos(angle), math.sin(angle), 0.0)
        y_vec = rg.Vector3d(- math.sin(angle), math.cos(angle), 0.0)
        b_box = crv.GetBoundingBox(rg.Plane(rg.Point3d(0,0,0), x_vec, y_vec))

        x_delta = b_box.Max.X - b_box.Min.X
        y_delta = b_box.Max.Y - b_box.Min.Y

        loc_are = x_delta * y_delta

        if loc_are < area:

            rot_angle = angle

            area = loc_are

            if x_delta < y_delta:

                x_or_y = False

            else:

                x_or_y = True

    if x_or_y:

        x_vec = rg.Vector3d(1, 0, 0)
        y_vec = rg.Vector3d(0, 1, 0)

    else:

        x_vec = rg.Vector3d(0, 1, 0)
        y_vec = rg.Vector3d(-1, 0, 0)

    x_vec.Transform(rg.Transform.Rotation(rot_angle, rg.Point3d(0,0,0)))
    y_vec.Transform(rg.Transform.Rotation(rot_angle, rg.Point3d(0,0,0)))

    tmp_pln = rg.Plane(rg.Point3d(0,0,z_height), x_vec, y_vec)
    
    b_box = crv.GetBoundingBox(tmp_pln)
    
    x0, x1 = b_box.Min.X, b_box.Max.X
    y1, y0 = b_box.Max.Y, b_box.Min.Y
    
    crv = rg.Rectangle3d(tmp_pln, rg.Interval(x0,x1), rg.Interval(y0,y1))
    
    return crv
    
a = crvOrienter(x)
# ---------- end python ----------
offset = OffsetCurve(Curve=python.a, Distance=Slider(20, range=0..25), Plane=PlaneXY(0, 0, 0), Corners=1)
divide = DivideCurve(Curve=offset, Count=1, Kinks=True)  # -> Points, Tangents, Parameters
shift = ClusterInput()
panel = Panel(python.out)
shift_list = ShiftList(List=divide.Points, Shift=shift, Wrap=True)
list = ClusterOutput(shift_list)
