# Grasshopper definition CleanerVersion_EndEdition_7.gh (Grasshopper 1.0.7)

yz = YZPlane(Origin=Point(0, 0, 0))
brep = Brep(<brep referenced from the Rhino model>)
pln = Plane(yz)
line = Line(Line((-1.263981532, -48.84175791, 0), (8.362559972, -74.03462184, 0)))
crv = Curve(<curve referenced from the Rhino model>)
crv_2 = Curve(<curve referenced from the Rhino model>)
python = GhPythonScript(x=crv_2, y=pln)  # -> out, a; inputs x: Curve
# ---------- python: Python ----------
import Rhino.Geometry as rg
from copy import deepcopy as dc

def rhinoGeometryObjectType(base_object):

    crv_type_list = ['NurbsCurve', 'Curve', 'PolylineCurve', 'LineCurve']
    brep_type = ['Brep']
    mesh_type = ['Mesh']
    plane_type = ['Plane']
    line_type = ['Line']

    types = [('brep', brep_type), ('mesh', mesh_type), ('crv', crv_type_list), ('plane', plane_type), ('line', line_type)]

    a = str(type(base_object))

    obj_type = "other"

    for type_tuple in types:

        for type_val in type_tuple[1]:

            if (str(type(base_object)).find(type_val) > 0):

                obj_type = type_tuple[0]

                break

    return obj_type
    
def moveToSameHeight(ref_object, mv_object):

    z_ref = ref_object.PointAt(ref_object.Domain[0]).Z
    
    z_mv_obj = mv_object.PointAt(ref_object.Domain[0]).Z

    mv_vec = rg.Vector3d(0 ,0 , z_ref - z_mv_obj)

    mv = rg.Transform.Translation(mv_vec)

    output_obj = dc(mv_object)

    output_obj.Transform(mv)

    return output_obj

def crvIntersector(crv, other_object):

    obj_type = rhinoGeometryObjectType(other_object)

    if obj_type == 'line':

        tmp_other_obj = moveToSameHeight(crv, other_object)

        int_events = rg.Intersect.Intersection.CurveLine(crv, tmp_other_obj, .01, .01)

        pts = [int_event.PointA for int_event in int_events]
        t_vals = [int_event.ParameterA for int_event in int_events]

    elif obj_type == 'crv':

        tmp_other_obj = moveToSameHeight(crv, other_object)

        int_events = rg.Intersect.Intersection.CurveCurve(crv, tmp_other_obj, .01, .01)

        pts = [int_event.PointA for int_event in int_events]
        t_vals = [int_event.ParameterA for int_event in int_events]

    elif obj_type == 'plane':

        int_events = rg.Intersect.Intersection.CurvePlane(crv, other_object, .01)

        pts = [int_event.PointA for int_event in int_events]
        t_vals = [int_event.ParameterA for int_event in int_events]

    elif obj_type == 'brep':

        _, t_vals = rg.Intersect.Intersection.CurveBrep(crv, other_object, .01, .001)

        pts = [crv.PointAt(t_val) for t_val in t_vals]

    else:

        print("object type %s is not supported" % obj_type)

        pts = []
        t_vals = []

    return pts, t_vals
    
a, _ = crvIntersector(x, y)
# ---------- end python ----------
python_2 = GhPythonScript()  # -> out, a
# ---------- python_2: Python ----------
print(type(.05))
print(type(1))
# ---------- end python_2 ----------
pt = Point(python.a)
python_3 = GhPythonScript()  # -> out, path
# ---------- python_3: Python ----------
import os

print(os.name)
os_name = str(os.name)

ghComp = ghenv.Component
ghDoc = ghComp.OnPingDocument()

path = str(ghDoc.FilePath)

second_part = [
    "Dropbox",
    "Clay_Printing_Brick",
    "PatternBrickLibrary"
]

if "posix" == os_name:
    
    print("I am a Mac")
    
    first_part = ['/Users']
    
    string_parts = path.split("/Users/")[1]
    user_name = string_parts.split('/')[0]
    print(string_parts)
    print(user_name)

elif "nt" == os_name:

    print("I am a Pc")
    
    first_part = ['C:\\Users']
    
    string_parts = path.split("\\Users\\")[1]
    user_name = string_parts.split('\\')[0]
    print(string_parts)
    print(user_name)

parts = first_part + [user_name] + second_part

path = os.path.join(*parts)
# ---------- end python_3 ----------
panel = Panel(python_2.out)
panel_2 = Panel(python.out)

# ---- group: Brick Geometry
python_4 = GhPythonScript(
    height_body=Slider(150, range=0..1000),
    height_pin=Slider(260, range=0..1000),
    start_height=Slider(1.4, range=0..10),
    layer_height=Slider(2.4, range=0..10),
    brick_length=Slider(350, range=100..450),
    brick_width=Slider(250, range=40..250),
    pin_spacing=Slider(250, range=40..250))  # -> out, flatten(body_heights), flatten(pin_only_heights), flatten(poly_crv), flatten(pin_pts)
# ---------- python_4: Python ----------
import Rhino.Geometry as rg

def sortValues(*args):
    
    args = list(args)
    args.sort()
    
    return args

# creating the heights

body_heights = []
pin_only_heights = []

height = start_height

height_body, height_pin = sortValues(height_body, height_pin)

print (height_body, height_pin)

while height < height_body:
    
    body_heights.append(height)
    
    height += layer_height
    
while height < height_pin:
    
    pin_only_heights.append(height)
    
    height += layer_height
    
# creating the base shape and pins

brick_width, brick_length  = sortValues(brick_length, brick_width)

print (brick_length, brick_width)

half_l = brick_length * .5
half_w = brick_width * .5

#     *       *
#   *            *
#     *       *

val_list = [(1,1), (1, -1), (-1, -1), (-1, 1)]

pt_list = []

for i in range(4):
    
    pt_list.append(rg.Point3d(half_l * val_list[i][0], half_w * val_list[i][1], 0.0))
    
    if i == 0:
        
        pt_list.append(rg.Point3d(half_l + half_w, 0, 0))
        
    elif i == 2:
        
        pt_list.append(rg.Point3d(- (half_l + half_w), 0, 0))

arc_set = [[0,1,2],[3,4,5]]
line_set = [[5,0],[2,3]]

poly_crv = rg.PolyCurve()
pin_pts = [rg.Point3d(-.5 * pin_spacing, 0, 0), rg.Point3d(.5 * pin_spacing, 0, 0)]

for i in range(2):
    
    pt_0, pt_1, pt_2, pt_3 = pt_list[-1 + i * 3], pt_list[0 + i * 3], pt_list[1 + i * 3], pt_list[2 + i * 3]
    
    line = rg.Line(pt_0, pt_1)
    
    poly_crv.Append(line)
    
    crv = rg.Arc(pt_1, pt_2, pt_3)
    
    poly_crv.Append(crv)
# ---------- end python_4 ----------

# ----
defaultmap = FilePath(python_3.path)
path = FilePath()
python_5 = GhPythonScript(default_dropbox_path=defaultmap, costum_path=path)  # -> out, path
# ---------- python_5: Python ----------
import sys

if costum_path == None:
    path = default_dropbox_path
    
else:
    path = costum_path

sys.path.append(path)

print(sys.path)
# ---------- end python_5 ----------

# ---- group: Pin Geometry
pt_2 = ConstructPoint(XCoordinate=0, YCoordinate=0, ZCoordinate=0)
python_6 = GhPythonScript(
    b_pt=pt_2,
    height_body=Slider(10, range=0..1000),
    rad_body=Slider(60, range=0..100),
    res_body=Slider(0, range=0..100),
    height_pin=Slider(15, range=0..1000),
    bot_rad=Slider(35, range=0..100),
    top_rad=Slider(18, range=0..100),
    resolution=Slider(25, range=0..100),
    alfa=Slider(2.09, range=0..10),
    connection_line_count=Slider(4, range=0..10),
    start_height=Slider(1.4, range=0..10),
    layer_height=Slider(2.4, range=0..10))  # -> out, body_slices, connection_line_set, body_pin_slices, pin_slices; inputs b_pt: Point3d, res_body: Int32, resolution: Int32, connection_line_count: Int32
# ---------- python_6: Python ----------
import Rhino.Geometry as rg
import brickSlicer as bs
from copy import deepcopy as dc

reload(bs)

# defining the pins

body_pin = bs.Pin(b_pt, height_body, rad_body, rad_body, res_body)
center_pin = bs.Pin(b_pt, height_pin, bot_rad, top_rad, resolution)

# setting up the connection lines

axis_pt = rg.Point3d(1, 0, 0)
main_line = rg.Line(b_pt, b_pt + axis_pt)

base_line_set = []

alfa_delta = 3.1415927 * 2.0 / float(connection_line_count)

for i in range(connection_line_count):
    
    angle = alfa_delta * i + alfa
    
    rotation = rg.Transform.Rotation(angle, b_pt)
    
    tmp_line = dc(main_line)
    tmp_line.Transform(rotation)
    
    base_line_set.append(tmp_line)
    
# setting up the while loop

height = start_height

body_slices = []
body_pin_slices = []
pin_slices = []

connection_line_set = []

print("height: ", height)
print("height_body: ", height_body)

print(height < height_body)

while height < height_body:
    
    print("height: ", height)
    
    body_slices.append(body_pin.createSlice(height))
    body_pin_slices.append(center_pin.createSlice(height))
    
    # moving the lines onto the right height
    
    mv = rg.Transform.Translation(rg.Vector3d(0,0, height - b_pt.Z))
    
    tmp_line_set = []
    
    for line in base_line_set:
        
        tmp_line = dc(line)
        tmp_line.Transform(mv)
        
        tmp_line_set.append(tmp_line)
        
    connection_line_set.append(tmp_line_set)
    
    height += layer_height
    
print("height: ", height)    
    
while height < height_pin:
    
    pin_slices.append(center_pin.createSlice(height))
    
    height += layer_height
# ---------- end python_6 ----------

# ----
xz = XZPlane(Origin=Point(0, 0, 0))
yz_2 = YZPlane(Origin=Point(0, 0, 0))
xy = XYPlane(Origin=Point(0, 0, 0))
crv_3 = Curve(<curve referenced from the Rhino model>)
library_path = FilePath(python_5.path)
mesh = Mesh(<mesh referenced from the Rhino model>)
brep_2 = Brep(<brep referenced from the Rhino model>)
rotate = Rotate(Geometry=yz_2, Angle=Slider(0, range=0..1), Plane=xz)  # -> Geometry, Transform
brep_3 = Brep(<brep referenced from the Rhino model>)
mesh_2 = Mesh(<mesh referenced from the Rhino model>)
crv_4 = Curve(<curve referenced from the Rhino model>)
type = GhPythonScript(x=xy)  # -> out
# ---------- type: Python ----------
# snippet of code to make this python component look for it's   code in the parent folder of the .gh file

import os

ghComp = ghenv.Component
ghDoc = ghComp.OnPingDocument()

file_name = "brickSlicer.py"
gh_file_location = ghDoc.FilePath
parent = os.path.dirname(os.path.realpath(gh_file_location))

file_path = os.path.join(parent, file_name)
print(file_path)

parent = os.path.dirname(os.path.realpath(parent))
parent = os.path.dirname(os.path.realpath(parent))
print(parent)

# hacky-hacky run-fun
execfile(file_path)

print(type(x))

# lines = gCodeGenerator(lists, extrusion_rate)
# ---------- end type ----------
ghpython_script = GhPythonScript(x=xy)  # -> out
# ---------- ghpython_script: Python ----------
print(type(x))
# ---------- end ghpython_script ----------
rotate_2 = Rotate(Geometry=rotate.Geometry, Angle=Slider(0, range=0..1), Plane=PlaneXY(0, 0, 0))  # -> Geometry, Transform
pt_3 = Point(Point(0, 0, 0))
library_path_2 = FilePath(python_5.path)
move = Move(Geometry=rotate_2.Geometry, Motion=pt_3)  # -> Geometry, Transform
python_7 = GhPythonScript()  # -> out, a
# ---------- python_7: Python ----------
a = [[2, 1, 1], [1, 2, 3], [0, 1, 2]]
# ---------- end python_7 ----------
layer_slicing = GhPythonScript(x=library_path_2, geometry=python_4.poly_crv, heights=python_4.body_heights)  # -> out, ori_crvs, crv_sets, a, b, c, d; inputs geometry: GeometryBase, heights: list
# ---------- layer_slicing: Python ----------
import sys

sys.path.append(x)

import brickSlicer as bs

reload(bs)

ori_crvs = bs.slicing(geometry, heights)
# crv_sets, a, b, c = bs.splitter(ori_crvs, slicing_object = slice_geo, split_type = "first_layer")
# ---------- end layer_slicing ----------
splitting_geometry = Geometry(crv_4)

# ---- group: cylinder
number_slider = Slider(5, range=0..10)
number_slider_2 = Slider(10, range=0..100)

# ---- group: mod Based Dot Map
number_slider_3 = Slider(2, range=1..10)
number_slider_4 = Slider(50, range=10..100)
toggle = BooleanToggle(False)
number_slider_5 = Slider(0, range=0..3.1416)
number_slider_6 = Slider(0, range=-2..2)
number_slider_7 = Slider(0.7, range=0..2)

# ----
list = ValueList({"dotMap": 0, "ellipsoidBumpMap": 1, "sinWarp": 2, "cylinderMap": 3, "layerMap": 4, "modulorBased": 5}, selected="ellipsoidBumpMap")
crv_5 = Curve(layer_slicing.ori_crvs)
number_slider_8 = Slider(2, range=0..10)
number_slider_9 = Slider(2, range=0..10)
python_8 = GhPythonScript(crvs=python_6.body_pin_slices, count=Slider(3, range=0..10), max_amount=Slider(3, range=0..10))  # -> out, flatten(a); inputs crvs: list of Curve, count: Int32
# ---------- python_8: Python ----------
import Rhino.Geometry as rg
import generalFunctions as gf

if count > 0:
    
    count_delta = max_amount / float(count)
    
    for i in range(count):
        
        active_crv = crvs[i]
        
        offset = count_delta * (count - i)
        
        crvs[i] = gf.offsetCurveSet(active_crv, offset, "outside", count = 2)[1].ToNurbsCurve()

a = crvs
# ---------- end python_8 ----------
line_2 = Line(Line((-201.1386315, 0, 75.49808693), (-150.385624, 53.47869293, 0)))
crv_6 = Curve(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)
crv_7 = Curve(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)
list_2 = ValueList({"Inside": "inside", "Outside": "outside"}, selected="Inside")
graft = GraftTree(Tree=python_6.body_slices, IncludeEmptyLists=True, IncludeNullItems=True)
python_9 = GhPythonScript(line=line_2, crv_a=crv_6, crv_b=crv_7)  # -> out, a; inputs line: Line, crv_a: Curve, crv_b: Curve
# ---------- python_9: Python ----------
import ghpythonlib.components as gh

gh.CurveXLine(crv_a, line)
# ---------- end python_9 ----------
library_path_3 = FilePath(library_path)
panel_3 = Panel(python_6.body_slices)
python_10 = GhPythonScript()  # -> out, a; same code as python_7
library_path_4 = FilePath(library_path_2)
layer_structure = GhPythonScript(
    x=library_path_4,
    ori_crvs=python_6.body_slices,
    spacing=Slider(2.5, range=0..10),
    direction=Toggle(False),
    inverse=Toggle(False))  # -> out, layers, set_tuple, a; inputs ori_crvs: list of Curve, direction: Boolean, inverse: Boolean
# ---------- layer_structure: Python ----------
# snippet of code to make this python component look for it's   code in the parent folder of the .gh file

import sys

sys.path.append(x)

import vertexClass_v1 as vc

reload(vc)

if direction:
    
    dir = 1
    
else:
    
    dir = -1
    

print(ori_crvs)

layers, set_tuple = vc.singleCurve(ori_crvs, spacing)

a = ori_crvs
# ---------- end layer_structure ----------
pattern = GhPythonScript(
    x=library_path_4,
    layers=layer_structure.layers,
    set_tuple=layer_structure.set_tuple,
    periodic=Toggle(True),
    sub_length=Slider(2, range=0..10),
    layer_count=Slider(70, range=0..100),
    layer_height=Slider(2.3, range=0..10),
    edge_easing=Toggle(False),
    edge_ease_zero=Slider(0, range=0..100),
    edge_ease_end=Slider(25.4, range=0..100),
    pattern_type=list,
    period=Slider(15, range=0..100),
    phase_shift=Slider(0.3, range=0..2),
    spacing=Slider(50, range=10..100),
    radius=Slider(15, range=0..100),
    max_val=Slider(12.5, range=0..100),
    y_spacing=number_slider_4,
    layer_shift=number_slider_3,
    shift_a=number_slider_7,
    shift_b=number_slider_6,
    ellipsoid=toggle,
    rot_alfa=number_slider_5,
    height=number_slider_2,
    radius_bot=number_slider,
    pattern_set=python_7.a,
    direction=Toggle(True))  # -> out, curve_list, a, b, c; inputs layers: list, set_tuple: list, periodic: Boolean, layer_count: Int32, layer_height: Int32, edge_easing: Boolean, pattern_type: Int32, ellipsoid: Boolean, pattern_set: list, direction: Boolean
# ---------- pattern: Python ----------
import sys

sys.path.append(x)

print(sys.path)

import patternGenv2_2 as pm

reload(pm)

pattern_map = pm.PatternMap(layers, set_tuple, periodic)
pattern_map.build()
# pattern_map.subdivide(sub_length)
# pattern_map.generate(layer_height, layer_count)

print("I am out 3")

if edge_easing:

    pattern_map.edgeEasing(edge_ease_zero, edge_ease_end)

if pattern_type == 0:
    
    pattern_map.dotMap(spacing, radius, max_val, direction)

elif pattern_type == 1:

    pattern_map.ellipsoidBumpMap(spacing, radius, max_val, direction)

elif pattern_type == 2:

    pattern_map.sinWarp(period, max_val, phase_shift, direction)

elif pattern_type == 3:

    if radius_bot < .01:

        radius_bot = radius

    else:

        radius_bot = radius_bot

    pattern_map.cylinderMap(spacing, height, radius, max_val, radius_bot, direction)

elif pattern_type == 4:

    pattern_map.layerMap(spacing, pattern_set, radius, max_val, direction)
    
elif pattern_type == 5:
    
    print("I am out 4")
    
    pattern_map.modBasedDotMap(
        x_spacing = spacing,
        y_spacing = y_spacing,
        max_val = max_val,
        ellipsoid = ellipsoid,
        direction = direction,
        layer_shift = layer_shift,
        shift_a = shift_a,
        shift_b = shift_b,
        rot_alfa = rot_alfa
    )

print("I am out 5")

c = pattern_map.makeMesh()
b = pattern_map.makeCurves()
a = [set[1:] for set in pattern_map.pts_set]
# ---------- end pattern ----------

# ---- group: — Slicing for pattern —
num = Number(100)
slicing_structuring = GhPythonScript(
    x=library_path_4,
    ori_crvs=layer_slicing.ori_crvs,
    spacing=Slider(10, range=0..10),
    end_smooth=Toggle(False),
    custom_crv_length=Toggle(False),
    crv_l=num,
    split=Toggle(True),
    slice_geo=splitting_geometry,
    split_item=Slider(0, range=0..1))  # -> out, split, layers, set_tuple, crv_sets, ori_crvs, slice_geo; inputs ori_crvs: list, end_smooth: Boolean, custom_crv_length: Boolean, split: Boolean, split_item: Int32
# ---------- slicing_structuring: Python ----------
# snippet of code to make this python component look for it's   code in the parent folder of the .gh file

import sys

sys.path.append(x)

import vertexClass_v1 as vc
import brickSlicer as bs

reload(bs)
reload(vc)

print(type(slice_geo))

    
if custom_crv_length:
    
    crv_l = crv_l
    
else:
    
    crv_l = None


if split:

    crv_sets, vis_a, vis_b, pts_crv_a_and_b = bs.splitter(ori_crvs, slicing_object = slice_geo, split_type = "first_layer")
    
    crv_set_a = [crv_set[0] for crv_set in crv_sets]
    crv_set_b = [crv_set[1] for crv_set in crv_sets]
    
    crv_sets = [crv_set_a, crv_set_b]
    
    non_pattern_part = [vc.divideCurveByLength(crv, spacing) for crv in crv_sets[(split_item + 1) % 2]]
    
    pattern_part, set_tuple, _ = vc.moveSet(crv_sets[split_item], ori_crvs, spacing, crv_l)
    layers = [pattern_part, non_pattern_part]
    
    
else:

    layers, set_tuple = vc.singleCurve(ori_crvs, spacing, end_smooth, crv_l)
# ---------- end slicing_structuring ----------

# ----
crv_8 = Curve(flatten(pattern.b))
panel_4 = Panel(pattern.out)
graft_2 = GraftTree(Tree=crv_8, IncludeEmptyLists=True, IncludeNullItems=True)  # -> graft(Tree)
path_mapper = PathMapper(graft_2, source="{A;B;C}", target="{A;C}")

# ---- group: Shell Type
python_11 = GhPythonScript(crv=path_mapper, distance=number_slider_8, direction=list_2, count=Slider(1, range=0..10))  # -> out, a, b; inputs count: Int32
# ---------- python_11: Python ----------
import generalFunctions as gf

reload(gf)

b = crv

a = gf.offsetCurveSet(crv, distance, direction, count)
# ---------- end python_11 ----------
python_12 = GhPythonScript(crv=python_8.a, distance=number_slider_8, direction=list_2, count=number_slider_9)  # -> out, a, b; inputs count: Int32; same code as python_11
python_13 = GhPythonScript(crv=python_6.pin_slices, distance=number_slider_8, direction=list_2, count=number_slider_9)  # -> out, a, b; inputs count: Int32; same code as python_11
number_slider_10 = Slider(3.2, range=-10..10)
toggle_2 = BooleanToggle(True)
list_3 = ValueList({"detached", "crossing"}, selected="crossing")
path_mapper_2 = PathMapper(python_11.a, source="{A;B;C}", target="{C}")
path_mapper_3 = PathMapper(python_12.a, source="{A;B}", target="{B}")
path_mapper_4 = PathMapper(python_13.a, source="{A;B;C}", target="{C}")
crv_9 = Curve(python_11.b)
python_14 = GhPythonScript(crvs=path_mapper_4, split_distance=number_slider_10, split_type=list_3, side_bool=toggle_2)  # -> out, a, b, c, d, e, f; inputs crvs: list, side_bool: Boolean
# ---------- python_14: Python ----------
import sys

sys.path.append(x)

print sys.path

import layerFunctions as lf

reload(lf)

later_set = lf.LinkingLayers(crvs, split_distance, side_bool, split_type)
# later_set.splitLineGeneration(split_line = main_line, angle = -.05)
a, b, c, d, e = later_set.createOrganisedCurves()
f = later_set.joinCrvs()
# ---------- end python_14 ----------
python_15 = GhPythonScript(crvs=path_mapper_3, split_distance=number_slider_10, x=library_path_3, split_type=list_3, side_bool=toggle_2)  # -> out, a, b, c, d, e, f; inputs crvs: list, side_bool: Boolean; same code as python_14
python_16 = GhPythonScript(crvs=path_mapper_2, split_distance=number_slider_10, x=library_path_3, split_type=list_3, side_bool=toggle_2)  # -> out, a, b, c, d, e, f; inputs crvs: list, side_bool: Boolean
# ---------- python_16: Python ----------
import sys

sys.path.append(x)

print sys.path

import layerFunctions as lf

reload(lf)

later_set = lf.LinkingLayers(crvs, split_distance, side_bool, split_type)
# later_set.splitLineGeneration(angle = -.05)
a, b, c, d, e = later_set.createOrganisedCurves()
f = later_set.joinCrvs()
# ---------- end python_16 ----------

# ----
panel_5 = Panel(python_12.a)
item = ListItem(List=path_mapper_2, Index=0, Wrap=True)  # -> Item1, Item
crv_10 = Curve(item.Item1)
crv_11 = Curve(item.Item)
panel_6 = Panel(path_mapper)

# ---- group: cylinder
number_slider_11 = Slider(5, range=0..10)
number_slider_12 = Slider(10, range=0..100)

# ---- group: mod Based Dot Map
number_slider_13 = Slider(3, range=1..10)
number_slider_14 = Slider(9.69, range=5..100)
toggle_3 = BooleanToggle(True)
number_slider_15 = Slider(1.5708, range=0..3.1416)
number_slider_16 = Slider(-0.2, range=-2..2)
number_slider_17 = Slider(1.4, range=0..2)

# ----
line_visualization = GhPythonScript(x=pt_2, y=python_6.connection_line_set)  # -> out, a; inputs x: Point3d, y: list
# ---------- line_visualization: Python ----------
import ghpythonlib.components as gh

lines = y[0]

a = []

for line in lines:
    
    # print()
    
    a.extend(gh.Scale(line, line.PointAt(0.0), 250))
# ---------- end line_visualization ----------
list_4 = ValueList({"dotMap": 0, "ellipsoidBumpMap": 1, "sinWarp": 2, "cylinderMap": 3, "layerMap": 4, "modulorBased": 5}, selected="dotMap")
pattern_2 = GhPythonScript(
    x=library_path_4,
    split=slicing_structuring.split,
    layers=slicing_structuring.layers,
    set_tuple=slicing_structuring.set_tuple,
    periodic=Toggle(True),
    sub_length=Slider(2, range=0..10),
    layer_count=Slider(70, range=0..100),
    layer_height=Slider(2.3, range=0..10),
    edge_easing=Toggle(True),
    edge_ease_zero=Slider(0, range=0..100),
    edge_ease_end=Slider(10, range=0..100),
    pattern_type=list_4,
    period=Slider(2, range=0..100),
    phase_shift=Slider(0.5, range=0..2),
    spacing=Slider(20, range=10..100),
    radius=Slider(9, range=0..100),
    max_val=Slider(4, range=0..100),
    y_spacing=number_slider_14,
    layer_shift=number_slider_13,
    shift_a=number_slider_17,
    shift_b=number_slider_16,
    ellipsoid=toggle_3,
    rot_alfa=number_slider_15,
    height=number_slider_12,
    radius_bot=number_slider_11,
    pattern_set=python_10.a,
    direction=Toggle(False))  # -> out, curve_list, pt_sets, curve_set, c; inputs split: Boolean, layers: list, set_tuple: list, periodic: Boolean, layer_count: Int32, layer_height: Int32, edge_easing: Boolean, pattern_type: Int32, ellipsoid: Boolean, pattern_set: list, direction: Boolean
# ---------- pattern_2: Python ----------
import sys

sys.path.append(x)

print(sys.path)

import patternGenv2_2 as pm

reload(pm)

if split:
    
    other_part = layers[1]
    pattern_part = layers[0]
    periodic = False
    
else:
    
    other_part = None
    pattern_part = layers
    edge_easing = False

pattern_map = pm.PatternMap(pattern_part, set_tuple, periodic, other_set = other_part)
pattern_map.build()
# pattern_map.subdivide(sub_length)
# pattern_map.generate(layer_height, layer_count)

print("I am out 3")

if edge_easing:

    pattern_map.edgeEasing(edge_ease_zero, edge_ease_end)

if pattern_type == 0:
    
    pattern_map.dotMap(spacing, radius, max_val, direction)

elif pattern_type == 1:

    pattern_map.ellipsoidBumpMap(spacing, radius, max_val, direction)

elif pattern_type == 2:

    pattern_map.sinWarp(period, max_val, phase_shift, direction)

elif pattern_type == 3:

    if radius_bot < .01:

        radius_bot = radius

    else:

        radius_bot = radius_bot

    pattern_map.cylinderMap(spacing, height, radius, max_val, radius_bot, direction)

elif pattern_type == 4:

    pattern_map.layerMap(spacing, pattern_set, radius, max_val, direction)
    
elif pattern_type == 5:
    
    print("I am out 4")
    
    pattern_map.modBasedDotMap(
        x_spacing = spacing,
        y_spacing = y_spacing,
        max_val = max_val,
        ellipsoid = ellipsoid,
        direction = direction,
        layer_shift = layer_shift,
        shift_a = shift_a,
        shift_b = shift_b,
        rot_alfa = rot_alfa
    )

print("I am out 5")

c = pattern_map.makeMesh()
curve_set = pattern_map.makeCurves()

pt_sets = pattern_map.pts_set
# ---------- end pattern_2 ----------
line_linking_spacing = Slider(3.2, range=0..10)
inter_line_spacing = Slider(2.5, range=0..10)
split_distance = Slider(2.5, range=-10..10)
panel_7 = Panel(python_16.out)
panel_8 = Panel(pattern_2.out)
pline = PolyLine(Vertices=python_14.f, Closed=True)  # -> flatten(Polyline)
line_3 = Line(Line((-27.46198946, 138.4851678, 0), (-0.1413537679, -0.6893088134, 0)))
loft = Loft(
    Curves=pattern_2.curve_set,
    Options={Adjust=False, Closed=False, LoftEnds=0, LoftSimp=0, LoftType=0, Rebuild=10, Refit=0.01})
offset = OffsetCurve(Curve=crv_10, Distance=Slider(-0.5, range=-10..10), Plane=PlaneXY(0, 0, 0), Corners=1)  # -> flatten(Curve)

# ---- group: Creating Body
pline_2 = PolyLine(Vertices=python_15.f, Closed=True)  # -> flatten(Polyline)
pline_3 = PolyLine(Vertices=python_16.f, Closed=False)  # -> flatten(Polyline)
python_17 = GhPythonScript(
    lines=flatten(python_6.connection_line_set),
    y=flatten(offset),
    z=flatten(pline_2),
    main_exterior_crv=flatten(crv_10),
    inner_boundary_crv=flatten(python_8.a),
    distance=Slider(2, range=0..10),
    count=Slider(2, range=0..10))  # -> out, a, b, c, d, e, f, z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; inputs y: Curve, z: Curve, main_exterior_crv: Polyline, inner_boundary_crv: Polyline, count: Int32
# ---------- python_17: Python ----------
import Rhino.Geometry as rg
import layerFunctions as lf
import generalFunctions as gf
import ghpythonlib.components as gh

reload(lf)
reload(gf)

# exterior_curve_main = gf.curveToPolyline(y)
exterior_curve_main = y
print(type(exterior_curve_main))
inner_curve = gf.curveToPolyline(z)

print("am I closed?")
print(inner_curve.IsClosed)

line_vis_set = []
pt_vis_set = []
curve_vis = []

for i in range(len(lines) - 1):

    line_set = lf.LineSet(lines[i], distance, count)
    line_set.createLines()
    line_set.trimLines(exterior_curve_main, True)
    tmp_lines = line_set.trimLines(inner_boundary_crv, False)
    
    line_vis_set.extend(tmp_lines)
    
    a = line_set.joinLines()
    line_set.lines
    c = line_set.getStartEnd()
    end_pts = line_set.getStartEnd(False)
    
    pt_vis_set.extend(c)

    
    z = gf.polylineTypesToCurve(inner_curve)

    d, _ = gf.layer2ptIntersect(z, c)

    e = gf.longestCurve(d)
    
    curve_vis.extend(d)

    e = gf.curveToPolyline(e)
    
    a.reverse()

    f = a + [pt for pt in e.ToArray()]
    
    inner_curve = gh.PolyLine(f, True)
 
    print("am I closed?")
    print(inner_curve.IsClosed)

line_set = lf.LineSet(lines[-1], distance, count)
line_set.createLines()
line_set.trimLines(exterior_curve_main, True)
tmp_lines = line_set.trimLines(inner_boundary_crv, False)

line_vis_set.extend(tmp_lines)

a = line_set.joinLines()
line_set.lines
c = line_set.getStartEnd()
end_pts = line_set.getStartEnd(False)

pt_vis_set.extend(c)


z = gf.polylineTypesToCurve(inner_curve)

d, _ = gf.layer2ptIntersect(z, c)

e = gf.longestCurve(d)

curve_vis.extend(d)

e = gf.curveToPolyline(e)

a.reverse()

f = [a[-1]] + [pt for pt in e.ToArray()] + [a[0]]

inner_curve = gh.PolyLine(f, False)

print("am I closed?")
print(inner_curve.IsClosed)
# ---------- end python_17 ----------
crv_12 = Curve(python_17.inner_curve)
crv_13 = Curve(pline_3)
panel_9 = Panel(python_17.out)
python_18 = GhPythonScript(inner_curve=crv_12, shell_curve=crv_13)  # -> out, flatten(shell_pt_set); inputs inner_curve: Curve, shell_curve: Curve
# ---------- python_18: Python ----------
import Rhino.Geometry as rg
import layerFunctions as lf
import generalFunctions as gf
import ghpythonlib.components as gh

inner_curve = gf.curveToPolyline(inner_curve)
inner_curve = [pt for pt in inner_curve.ToArray()]
shell_curve.Domain = rg.Interval(0,1)

end_pts_shell = [shell_curve.PointAt(0.0), shell_curve.PointAt(1.0)]
end_pts_inner_curve = [inner_curve[0], inner_curve[-1]]

shell_pl_set = gf.curveToPolyline(shell_curve)

shell_pt_set = [pt for pt in shell_pl_set.ToArray()]

shell_crv = gh.PolyLine(shell_pt_set, True)

y_set, _ = gf.layer2ptIntersect(shell_crv, end_pts_inner_curve)
shell_pt_set = [pt for pt in gf.curveToPolyline(gf.longestCurve(y_set)).ToArray()]

inner_curve = gf.shortenPolylineSet(inner_curve, 2.0, "both")

total_set = shell_pt_set + inner_curve

total_crv = gh.PolyLine(total_set, False)

# y_set, _ = gf.layer2ptIntersect(total_crv, end_pts_shell)
# shell_pt_set = gf.curveToPolyline(gf.longestCurve(y_set))

shell_pt_set = gf.curveToPolyline(total_crv)
# ---------- end python_18 ----------
pline_4 = PolyLine(Vertices=python_18.shell_pt_set, Closed=False)

# ----
crv_14 = Curve(pattern_2.curve_set)
mesh_3 = Mesh(pattern_2.c)

# ---- group: — Shell Setup —
list_5 = ValueList({"detached", "crossing"}, selected="detached")
list_6 = ValueList({"Inside": "inside", "Outside": "outside"}, selected="Outside")
python_19 = GhPythonScript(
    x=library_path_4,
    crvs=pattern_2.curve_set,
    distance=inter_line_spacing,
    direction=list_6,
    count=Slider(1, range=0..10),
    split_distance=split_distance,
    split_type=list_5,
    split_line=line_3,
    side_bool=Toggle(True))  # -> out, a, b, link_inner_crvs, main_inner_crvs, outer_crvs, pt_sets; inputs crvs: list of Curve, count: Int32, side_bool: Boolean
# ---------- python_19: Python ----------
import sys
import Rhino.Geometry as rg
import time

sys.path.append(x)

# print(sys.path)

import generalFunctions as gf
import layerFunctions as lf

reload(gf)
reload(lf)

start_time = time.time()

o_crv_sets = []
outer_crvs = []

print("start of the program:")
print(time.time() - start_time)

if count > 1:

    for crv_i, crv in enumerate(crvs):
        
        print(crv_i)
    
        o_crv_set = gf.offsetCurveSet(crv, distance, direction, count)
        layer_set = lf.LinkingLayers(o_crv_set, split_distance, side_bool, split_type, split_line)
        layer_set.createOrganisedCurves()
        pt_set = layer_set.joinCrvs()
    
        pt_set = pt_set[1:-1] + [pt_set[1]]
    
        crv = rg.Polyline(pt_set).ToPolylineCurve()
    
        o_crv_sets.append(o_crv_set)
        outer_crvs.append(crv)
        
else:
    
    outer_crvs = crvs

print("after curve set generation:")
print(time.time() - start_time)

o_type = rg.CurveOffsetCornerStyle.Sharp

main_inner_crvs = []
link_inner_crvs = []

if count == 1:
    
    for crv in crvs:
        
        print(crv)
    
        main_inner_crv = crv
        
        pln = rg.Plane(main_inner_crv.PointAt(0.0), rg.Vector3d(0,0,1))
        
        link_inner_crv = main_inner_crv.Offset(pln, -distance, .01, o_type)[0]
        
        main_inner_crvs.append(main_inner_crv)
        link_inner_crvs.append(link_inner_crv)

elif direction == "outside":
    
    for o_crv_set in o_crv_sets:
    
        main_inner_crv = rg.Polyline(o_crv_set[0]).ToPolylineCurve()
        
        pln = rg.Plane(main_inner_crv.PointAt(0.0), rg.Vector3d(0,0,1))
        
        link_inner_crv = main_inner_crv.Offset(pln, -distance, .01, o_type)[0]
        
        main_inner_crvs.append(main_inner_crv)
        link_inner_crvs.append(link_inner_crv)
    
else:
    
    for o_crv_set in o_crv_sets:
    
        main_inner_crv = rg.Polyline(o_crv_set[0]).ToPolylineCurve()
        
        pln = rg.Plane(main_inner_crv.PointAt(0.0), rg.Vector3d(0,0,1))
        
        link_inner_crv = main_inner_crv.Offset(pln, -distance, .01, o_type)[0]
        
        main_inner_crvs.append(main_inner_crv)
        link_inner_crvs.append(link_inner_crv)
    
print("program end:")
print(time.time() - start_time)
# ---------- end python_19 ----------

# ----
panel_10 = Panel(offset)
pt_4 = Point(python_4.pin_pts)
pin_only_heights = Number(python_4.pin_only_heights)
split = SplitList(List=pt_4, Index=Slider(4, range=0..10))  # -> ListA, ListB
library_path_5 = FilePath(library_path_4)

# ---- group: — PIN Setup —
number_slider_18 = Slider(3, range=0..10)
number_slider_19 = Slider(3, range=0..10)
python_20 = GhPythonScript(
    x=library_path_5,
    pin_pts=flatten(pt_4),
    connection_count=Slider(3, range=1..4),
    max_main_line=Slider(100, range=25..250),
    start_end_alfa=Slider(1.571, range=0..3.142),
    mid_alfa=Slider(0.5, range=0..3.142),
    pin_height=Slider(260, range=0..1000),
    bot_rad=Slider(35, range=0..100),
    top_rad=Slider(18, range=0..100),
    resolution=Slider(16, range=0..100),
    spacing=line_linking_spacing)  # -> out, main_links, side_links, split_lines, pin_pt_sets, pins, link_line_vis, pin_geo; inputs pin_pts: list of Point3d, connection_count: Int32, resolution: Int32
# ---------- python_20: Python ----------
import sys

sys.path.append(x)

import pinLinkingBis as pl

reload(pl)

main_links, link_lines, split_lines, pin_pt_sets = pl.createLinks(
    pin_pts = pin_pts,
    connection_count = connection_count,
    max_main_line = max_main_line,
    start_end_alfa = start_end_alfa,
    mid_alfa = mid_alfa
)

link_line_vis = link_lines

main_links = pl.linkSetGeneration(main_links, spacing)
side_links = pl.linkSetGeneration(link_lines, spacing, 2)

pins = pl.pinMaker(pin_pts, pin_height, bot_rad, top_rad, resolution)

pin_geo = []

for pin in pins:
    
    pin_geo.append(pin.createGeometry())
# ---------- end python_20 ----------

# ----
pins = Geometry(python_20.pin_geo)
total = Geometry(pins)
crv_15 = Curve(<curve referenced from the Rhino model>)
panel_11 = Panel(python_19.out)
list_7 = ValueList({"Inside": "inside", "Outside": "outside"}, selected="Inside")
offset_2 = OffsetCurve(Curve=crv_15, Distance=1, Plane=PlaneXY(0, 0, 0), Corners=1)
crv_16 = Curve([<curve referenced from the Rhino model> x3])
side_link_curve = Curve(graft(python_19.link_inner_crvs))
end_link_curve = Curve(graft(python_19.main_inner_crvs))
python_21 = GhPythonScript(x=offset_2)  # -> out, a; same code as ghpython_script
python_22 = GhPythonScript(crv=crv_15, distance=Slider(0.4, range=0..10), direction=list_7, count=Slider(1, range=0..10))  # -> out, a; inputs count: Int32
# ---------- python_22: Python ----------
from sys import path
from scriptcontext import sticky

path.append(sticky["clay_printing_library"])

import generalFunctions as gf

reload(gf)

a = gf.offsetCurveSet(crv, distance, direction, count)

for crv in a:
    
    gf.polylinePeriodicizer(crv)
# ---------- end python_22 ----------
python_23 = GhPythonScript(crvs=crv_16, count=Slider(110, range=0..1000))  # -> out, a, b, c, d; inputs crvs: list of Curve, count: Int32
# ---------- python_23: Python ----------
import Rhino.Geometry as rg

for crv in crvs:

    crv.Domain = rg.Interval(0, count - 1)

a = [[crv.PointAt(t) for t in range(count)] for crv in crvs]

d = []

for i in range(10):
    
    mv_pt = rg.Point3d(0, 0, i * 1.5)
    
    for a_set in a:
        
        d.append([pt + mv_pt for pt in a_set])
     
c = []

for e in d:
    c.extend(e)
# ---------- end python_23 ----------
python_24 = GhPythonScript(x=python_20.pin_geo)  # -> out, a
# ---------- python_24: Python ----------
print(x)
# ---------- end python_24 ----------
crv_17 = Curve(<curve referenced from the Rhino model>)
panel_12 = Panel(python_20.out)
list_8 = ValueList({"start", "end", "both"}, selected="both")
python_25 = GhPythonScript(side_links=python_20.side_links, end_link_index=Slider(1, range=0..100))  # -> out, flatten(side_links), flatten(end_link), end_link_vis; inputs side_links: list, end_link_index: Int32
# ---------- python_25: Python ----------
import Rhino.Geometry as rg
from copy import deepcopy as dc

side_link_count = len(side_links)

end_link_index = end_link_index % side_link_count

end_link = side_links.pop(end_link_index)

# visualisation of the end link

end_link_vis = dc(end_link.lines)

for end_link_line in end_link_vis:
    
    sc_m = rg.Transform.Scale(end_link_line.From, 100.0)
    
    end_link_line.Transform(sc_m)
# ---------- end python_25 ----------
eval = Evaluate()
panel_13 = Panel(python_24.out)
list_9 = ValueList({"start", "end", "both"}, selected="both")
panel_14 = Panel(python_22.out)
python_26 = GhPythonScript(x=flatten(end_link_curve))  # -> out, flatten(heights), flatten(index); inputs x: list of Curve
# ---------- python_26: Python ----------
heights = []
index = []

for crv_i, crv in enumerate(x):
    
    heights.append(crv.PointAt(0.0).Z)
    index.append(crv_i)
# ---------- end python_26 ----------
python_27 = GhPythonScript(pin=python_20.pins, pin_heights=pin_only_heights)  # -> out, slices; inputs pin_heights: list
# ---------- python_27: Python ----------
slices = []

for h in pin_heights:
    
    slices.append(pin.createSlice(h))
# ---------- end python_27 ----------
item_2 = ListItem(List=crv_8, Index=0, Wrap=True)
divide = DivideCurve(Curve=crv_17, Count=Slider(110, range=0..1000), Kinks=False)  # -> Points, Tangents, Parameters
python_28 = GhPythonScript(pt_sets=python_23.d, distance=Slider(2.8, range=0..10), location=list_8, count=Slider(1, range=0..10))  # -> out, a, b, c; inputs pt_sets: list, count: Int32
# ---------- python_28: Python ----------
from sys import path
from scriptcontext import sticky

path.append(sticky["clay_printing_library"])

import generalFunctions as gf

reload(gf)

# print(pts)

a = [gf.collapsePolylinePts(pts, distance) for pts in pt_sets]

c = []

for b in a:
    c.extend(b)
# ---------- end python_28 ----------
pline_5 = PolyLine(Vertices=divide.Points, Closed=False)
python_29 = GhPythonScript(pts=divide.Points, distance=Slider(0, range=0..10), location=list_9, count=Slider(1, range=0..10))  # -> out, a; inputs pts: list, count: Int32
# ---------- python_29: Python ----------
from sys import path
from scriptcontext import sticky

path.append(sticky["clay_printing_library"])

import simpleStartStop as sSS

reload(sSS)

# print(pts)

a = sSS.shortenPolylineSet(pts, distance, location)
# ---------- end python_29 ----------
brim = GhPythonScript(crv=item_2, offset_amount=Slider(10, range=0..10))  # -> out, flatten(a); inputs crv: Curve
# ---------- brim: Python ----------
import Rhino.Geometry as rg
import generalFunctions as gf
        
a = gf.offsetCurveSet(crv, offset_amount, "outside", count = 2)[1]
# ---------- end brim ----------
python_30 = GhPythonScript(
    x=library_path_5,
    main_links=flatten(python_20.main_links),
    pins=flatten(python_20.pins),
    link_set=flatten(python_20.side_links),
    heights=flatten(python_26.heights),
    count=flatten(python_26.index),
    bottom_shift_count=number_slider_18,
    bottom_max_shift=number_slider_19)  # -> out, graft(main_crv), b, c, inner_crvs, main_crv_pt_set, main_links; inputs main_links: list, pins: list, link_set: list
# ---------- python_30: Python ----------
import sys

sys.path.append(x)

import pinLinkingBis as pl

reload(pl)

if count < bottom_shift_count:
    
    print("I am shifting the bottom layer with: ")
    
    count_delta = bottom_max_shift / float(bottom_shift_count)
    
    bottom_offset = count_delta * (bottom_shift_count - count)
    print("bottom offset: %s" % bottom_offset)
    
else:
    
    bottom_offset = None

main_crv, b, main_links, inner_crvs = pl.makeMainShape(pins, main_links, heights, bottom_offset)
# ---------- end python_30 ----------
panel_15 = Panel(python_27.out)
path_mapper_5 = PathMapper(python_30.main_crv, source="{A;B}", target="{B}")
path_mapper_6 = PathMapper(side_link_curve, source="{A;B;C;D;E}", target="{E}")
pline_6 = PolyLine(Vertices=python_29.a, Closed=False)
path_mapper_7 = PathMapper(end_link_curve, source="{A;B;C;D;E}", target="{E}")
python_31 = GhPythonScript(x=flatten(python_14.f))  # -> out, b, a; inputs x: list
# ---------- python_31: Python ----------
b = [[pt for pt in x]]
# ---------- end python_31 ----------
python_32 = GhPythonScript(x=python_18.shell_pt_set)  # -> out, b, a, z; inputs x: list
# ---------- python_32: Python ----------
b = [[pt for pt in x]]

z = b[0][0].Z
# ---------- end python_32 ----------

# ---- group: Brim
crv_18 = Curve(<curve referenced from the Rhino model>)
divide_2 = DivideCurve(Curve=crv_18, Count=10, Kinks=True)  # -> Points, Tangents, Parameters
python_33 = GhPythonScript(x=brim.a, z=python_32.z)  # -> out, b, a; inputs x: list
# ---------- python_33: Python ----------
import Rhino.Geometry as rg

b = [rg.Point3d(pt.X, pt.Y, z) for pt in x]
a = [b + [b[0]]]
# ---------- end python_33 ----------

# ----
len = Length(Curve=pline_5)
len_2 = Length(Curve=pline_6)
python_34 = GhPythonScript(x=python_28.a)  # -> out, a; inputs x: list; same code as python_24
subtraction = Subtraction(A=len, B=len_2)
python_35 = GhPythonScript(x=library_path_5, side_links=flatten(python_25.side_links), interior_crv=path_mapper_5, exterior_crv=path_mapper_6)  # -> out, output_side_links, side_link_lines; inputs side_links: list, interior_crv: Curve, exterior_crv: Curve
# ---------- python_35: Python ----------
import Rhino.Geometry as rg
from copy import deepcopy as dc

import sys

sys.path.append(x)

height_val = interior_crv.PointAt(0.0).Z

mv_m = rg.Transform.Translation(rg.Vector3d(0,0,height_val))

side_link_lines = []

print(type(exterior_crv))

output_side_links = []

for side_link in side_links:
    
    loc_link = dc(side_link)
    loc_link.Transform(mv_m)
    
    loc_link.trimLines(exterior_crv, True)
    loc_link.trimLines(interior_crv, False)
    
    output_side_links.append(loc_link)
    
    side_link_lines.extend(loc_link.lines)
    
print(side_link_lines[0].To.Z)
# ---------- end python_35 ----------
python_36 = GhPythonScript(x=library_path_5, end_link=flatten(python_25.end_link), interior_crv=path_mapper_5, exterior_crv=path_mapper_7)  # -> out, graft(output_end_link), side_link_lines; inputs interior_crv: Curve, exterior_crv: Curve
# ---------- python_36: Python ----------
import Rhino.Geometry as rg
from copy import deepcopy as dc

import sys

sys.path.append(x)

height_val = interior_crv.PointAt(0.0).Z

mv_m = rg.Transform.Translation(rg.Vector3d(0,0,height_val))
    
output_end_link = dc(end_link)
output_end_link.Transform(mv_m)
    
output_end_link.trimLines(exterior_crv, True)
output_end_link.trimLines(interior_crv, False)

side_link_lines = dc(output_end_link.lines)
# ---------- end python_36 ----------
panel_16 = Panel(python_35.out)
merge = Merge(Data1=flatten(python_33.a), Data2=flatten(python_32.b), Data3=flatten(python_31.b))
library_path_6 = FilePath(library_path_5)

line_4 = Line(flatten(python_20.split_lines))
crv_19 = Curve(python_30.inner_crvs)
path_mapper_8 = PathMapper(python_36.output_end_link, source="{D;E}", target="{D}")
path_mapper_9 = PathMapper(python_30.main_links, source="{C;D}", target="{D}")
list_10 = ValueList({"detached", "crossing"}, selected="crossing")
list_11 = ValueList({"Inside": "inside", "Outside": "outside"}, selected="Inside")
path_mapper_10 = PathMapper(crv_19, source="{C;D}", target="{D}")
path_mapper_11 = PathMapper(python_35.output_side_links, source="{D;E}", target="{D}")
python_37 = GhPythonScript(
    x=library_path_6,
    main_links=path_mapper_9,
    side_links=path_mapper_11,
    end_link=path_mapper_8,
    crvs=path_mapper_10,
    split_lines=line_4,
    distance=inter_line_spacing,
    direction=list_11,
    count=Slider(1, range=0..10),
    split_distance=split_distance,
    split_type=list_10,
    side_bool=Toggle(True))  # -> out, log, b, c, d, e, pt_sets, start_and_end_pt, main_crv; inputs main_links: list, side_links: list, crvs: list of Curve, split_lines: list of Line, count: Int32, side_bool: Boolean
# ---------- python_37: Python ----------
import sys

sys.path.append(x)

# print(sys.path)

import generalFunctions as gf
import layerFunctions as lf
import Rhino.Geometry as rg
import pinLinkingBis as pl

from copy import deepcopy as dc

reload(gf)
reload(lf)
reload(pl)

log = ["new sequence start"]

pt_sets = []

inner_crvs = []

height = crvs[0].PointAt(0.0).Z

mv_m = rg.Transform.Translation(rg.Vector3d(0,0, height))

loc_split_lines = dc(split_lines)
[line.Transform(mv_m) for line in loc_split_lines]

print loc_split_lines

crv_count = len(crvs)
print("there are %s curves in your list" % crv_count)

if count == 1:
    
    for crv in crvs:
        
        crv.Reverse()
        
    inner_crvs = crvs
    
else:
    
    for crv_i, crv in enumerate(crvs):
        
        a = gf.offsetCurveSet(crv, distance, direction, count)
        layer_set = lf.LinkingLayers(a, split_distance, side_bool, split_type, split_line = loc_split_lines[crv_i])
        # a = layer_set.split_a
        # b = layer_set.split_b
        # c = layer_set.split_line
        # d = layer_set.split_axis
        a, b, c, d, e = layer_set.createOrganisedCurves()
        
        pt_set = layer_set.joinCrvs()
        pt_set = pt_set[1:-1] + [pt_set[1]]
        
        crv = rg.Polyline(pt_set).ToPolylineCurve()
        
        inner_crvs.append(crv)

print("I passed this hurdle")

main_crv = pl.makeInnerCurve(inner_crvs, main_links, side_links, end_link)

print(main_crv)

start_and_end_pt = [main_crv.PointAt(main_crv.Domain[0]), main_crv.PointAt(main_crv.Domain[1])]
# ---------- end python_37 ----------

start_stop_feedrate_in_mm_min = Slider(100, range=0..1000)
feed_rate_in_mm_s = Slider(25, range=0..100)
list_12 = ValueList({"start / stop": "start_stop", "continious"}, selected="continious")
outer_crv = Curve(graft(python_19.outer_crvs))
gcodelines = GhPythonScript(
    pts=merge,
    feed_rate=feed_rate_in_mm_s,
    extrusion_rate=Slider(0.5, range=0..10),
    link_type=list_12,
    global_trim_distance=Slider(0, range=0..10),
    ss_trim_distance=Slider(5, range=0..10),
    cull_distance=Slider(0, range=0..10),
    lift_val=Slider(4.4, range=0..10),
    ss_f_rate=start_stop_feedrate_in_mm_min,
    ss_e_rate=Slider(300, range=0..1000))  # -> out, a, path_vis; inputs pts: list
# ---------- gcodelines: Python ----------
import sys

sys.path.append(x)

import Rhino.Geometry as rg
import simpleStartStop as ss

reload(ss)

# print(pts)

p_set = ss.PrintSettings(
    feed_rate = feed_rate, 
    extrusion_rate = extrusion_rate, 
    extrusion_mode = 'relative', 
    movement_mode = 'relative'
)

l_type = ss.LinkType(
    link_type = link_type,
    global_trim_distance = global_trim_distance,
    ss_trim_distance = ss_trim_distance,
    cull_distance = cull_distance,
    lift_val = lift_val
)

l_type.ss_f_rate = ss_f_rate
l_type.ss_e_rate = ss_e_rate

gcodeset = ss.GCodeSet(pts, p_set, l_type)
a = gcodeset.generateGCode()

path_vis = gcodeset.path_vis
# ---------- end gcodelines ----------
pline_7 = PolyLine(Vertices=gcodelines.path_vis, Closed=False)
path_mapper_12 = PathMapper(outer_crv, source="{A;B;C;D;E}", target="{E}")
panel_17 = Panel(python_37.out)
end_start_gcode = GhPythonScript(lines=flatten(gcodelines.a))  # -> out, a; inputs lines: list
# ---------- end_start_gcode: Python ----------
__author__ = "JesusBarney"
__version__ = "2019.04.06"

import rhinoscriptsyntax as rs

#move_mode = "G1"
#extrusion_rate = 0.12
#extrusion_start = 0
offset_z = 0.10
#speed = 500
g_code = []

initiate_gcode = """;FLAVOR:Marlin
;TIME:0
;Filament used: 6.75709m
;Layer height: 1.1
;MINX:-47.897
;MINY:-47.91
;MINZ:1.1
;MAXX:47.895
;MAXY:47.91
;MAXZ:99
;Generated with Cura_SteamEngine 4.1.0
M104 S210
M105
M109 S210
M83 ;relative extrusion mode
G28 ;Home
G1 Z15.0 F6000 ;Move the platform down 15mm
;Prime the extruder
G92 E0
G1 F200 E3
G92 E0
G92 E0
G92 E0
G1 F1500
;LAYER_COUNT:90
;LAYER:0
M107
M203 Z50
M205 X30 Y30
G0 F1500 X30 Y-3.573 Z20
M205 X20 Y20
;TYPE:SKIRT
G1 X0 Y0 Z20 E25"""

# ;TIME_ELAPSED:751.629903
# G1 F1500 E510.30819   

end_gcode = """M205 X30 Y30 Z30 E-1
G0 F600 X-43.931 Y-19.114
G0 X-40.689 Y-17.797
M205 X20 Y20
M203 Z299792458000
M107
M104 S0
M140 S0
;Retract the filament
G92 E1
G1 E-1 F300
G28 X0 Y0
M84
M83 ;absolute extrusion mode
M104 S0"""

print initiate_gcode

for line in lines:

    print(line)

print end_gcode
# ---------- end end_start_gcode ----------
path_mapper_13 = PathMapper(python_37.start_and_end_pt, source="{A;B}", target="{A}")
crv_20 = Curve(python_37.main_crv)
panel_18 = Panel(end_start_gcode.out)
python_38 = GhPythonScript(x=library_path_6, start_end_pts=path_mapper_13, exterior_crv=path_mapper_12, interior_crv=crv_20)  # -> out, a; inputs start_end_pts: list of Point3d, exterior_crv: Curve, interior_crv: Curve
# ---------- python_38: Python ----------
import sys

sys.path.append(x)

import generalFunctions as gf

result_crvs, _ = gf.layer2ptIntersect(exterior_crv, start_end_pts)
pt_set = list(gf.curveToPolyline(gf.longestCurve(result_crvs)).ToArray())
pt_set_2 = list(gf.curveToPolyline(interior_crv).ToArray())

pt_set_2.reverse()

a = pt_set + pt_set_2[1:-1]
# ---------- end python_38 ----------
pt_5 = Point(flatten(python_38.a))
list_item = ListItem(List=pt_5, Index=0, Wrap=True)

# ---- group: — BRIM —
item_3 = ListItem(List=pattern_2.curve_set, Index=0, Wrap=True)
brim_2 = GhPythonScript(first_pt=list_item, crv=item_3, offset_amount=Slider(10, range=0..10))  # -> out, flatten(a); inputs first_pt: Point3d, crv: Curve
# ---------- brim_2: Python ----------
import Rhino.Geometry as rg
import generalFunctions as gf
        
brim_pt_set = gf.offsetCurveSet(crv, offset_amount, "outside", count = 2)[1]

brim_crv = rg.Polyline(brim_pt_set).ToPolylineCurve()
_, t_val = brim_crv.ClosestPoint(first_pt)

brim_crv.ChangeClosedCurveSeam(t_val)
a = list(brim_crv.ToPolyline().ToArray())
# ---------- end brim_2 ----------

# ----
python_39 = GhPythonScript(x=pt_5)  # -> out, a; inputs x: list of Point3d
# ---------- python_39: Python ----------
a = [list(x)]
# ---------- end python_39 ----------
merge_2 = Merge(Data1=flatten(brim_2.a), Data2=flatten(pt_5))
pt_6 = Point(flatten(merge_2))

# ---- group: G-Code
start_stop_feedrate_in_mm_min_2 = Slider(100, range=0..1000)
feed_rate_in_mm_s_2 = Slider(20, range=0..100)
list_13 = ValueList({"start / stop": "start_stop", "continious"}, selected="continious")
gcodelines_2 = GhPythonScript(
    x=library_path_6,
    pts=pt_6,
    feed_rate=feed_rate_in_mm_s_2,
    extrusion_rate=Slider(0.8, range=0..10),
    link_type=list_13,
    global_trim_distance=Slider(0, range=0..10),
    ss_trim_distance=Slider(5, range=0..10),
    cull_distance=Slider(0.1, range=0..10),
    lift_val=Slider(4.4, range=0..10),
    ss_f_rate=start_stop_feedrate_in_mm_min_2,
    ss_e_rate=Slider(300, range=0..1000))  # -> out, a, path_vis; inputs pts: list; same code as gcodelines
end_start_gcode_2 = GhPythonScript(lines=flatten(gcodelines_2.a))  # -> out, a; inputs lines: list
# ---------- end_start_gcode_2: Python ----------
__author__ = "JesusBarney"
__version__ = "2019.04.06"

import rhinoscriptsyntax as rs

#move_mode = "G1"
#extrusion_rate = 0.12
#extrusion_start = 0
offset_z = 0.10
#speed = 500
g_code = []

initiate_gcode = """;FLAVOR:Marlin
;TIME:0
;Filament used: 6.75709m
;Layer height: 1.1
;MINX:-47.897
;MINY:-47.91
;MINZ:1.1
;MAXX:47.895
;MAXY:47.91
;MAXZ:99
;Generated with Cura_SteamEngine 4.1.0
M104 S210
M105
M109 S210
M83 ;relative extrusion mode
G28 ;Home
G1 Z15.0 F6000 ;Move the platform down 15mm
;Prime the extruder
G92 E0
G1 F200 E3
G92 E0
G92 E0
G92 E0
G1 F1500 E-6.5
;LAYER_COUNT:90
;LAYER:0
M107
M203 Z50
M205 X30 Y30
G0 F1500 X30 Y-3.573 Z20
M205 X20 Y20
;TYPE:SKIRT
G1 X0 Y0 Z20 E1"""

# ;TIME_ELAPSED:751.629903
# G1 F1500 E510.30819   

end_gcode = """M205 X30 Y30 Z30 E-1
G0 F3000 X-43.931 Y-19.114
G0 X-40.689 Y-17.797
M205 X20 Y20
M203 Z299792458000
M107
M104 S0
M140 S0
;Retract the filament
G92 E1
G1 E-1 F300
G28 X0 Y0
M84
M83 ;absolute extrusion mode
M104 S0"""

print initiate_gcode

for line in lines:

    print(line)

print end_gcode
# ---------- end end_start_gcode_2 ----------

# ----
pline_8 = PolyLine(Vertices=gcodelines_2.path_vis, Closed=False)
panel_19 = Panel(gcodelines_2.out)
panel_20 = Panel(end_start_gcode_2.out)
