# Grasshopper definition GCode2_plane.gh (Grasshopper 1.0.7)

yz = YZPlane(Origin=Point(0, 0, 0))
series = Series(Start=0, Step=Slider(2, range=0..10), Count=Slider(8, range=0..10))
brep = Brep(<brep referenced from the Rhino model>)
pln = Plane(yz)
line = Line(Line((-1.263981532, -48.84175791, 0), (8.362559972, -74.03462184, 0)))
crv = Curve(<curve referenced from the Rhino model>)
crv_2 = Curve(<curve referenced from the Rhino model>)
Z = UnitZ(Factor=series)
python = GhPythonScript(x=crv_2, y=pln)  # -> out, a; inputs x: Curve
# ---------- python: Python ----------
import Rhino.Geometry as rg
from copy import deepcopy as dc

def rhinoGeometryObjectType(base_object):

    crv_type_list = ['NurbsCurve', 'Curve', 'PolylineCurve', 'LineCurve']
    brep_type = ['Brep']
    mesh_type = ['Mesh']
    plane_type = ['Plane']
    line_type = ['Line']

    types = [('brep', brep_type), ('mesh', mesh_type), ('crv', crv_type_list), ('plane', plane_type), ('line', line_type)]

    a = str(type(base_object))

    obj_type = "other"

    for type_tuple in types:

        for type_val in type_tuple[1]:

            if (str(type(base_object)).find(type_val) > 0):

                obj_type = type_tuple[0]

                break

    return obj_type
    
def moveToSameHeight(ref_object, mv_object):

    z_ref = ref_object.PointAt(ref_object.Domain[0]).Z
    
    z_mv_obj = mv_object.PointAt(ref_object.Domain[0]).Z

    mv_vec = rg.Vector3d(0 ,0 , z_ref - z_mv_obj)

    mv = rg.Transform.Translation(mv_vec)

    output_obj = dc(mv_object)

    output_obj.Transform(mv)

    return output_obj

def crvIntersector(crv, other_object):

    obj_type = rhinoGeometryObjectType(other_object)

    if obj_type == 'line':

        tmp_other_obj = moveToSameHeight(crv, other_object)

        int_events = rg.Intersect.Intersection.CurveLine(crv, tmp_other_obj, .01, .01)

        pts = [int_event.PointA for int_event in int_events]
        t_vals = [int_event.ParameterA for int_event in int_events]

    elif obj_type == 'crv':

        tmp_other_obj = moveToSameHeight(crv, other_object)

        int_events = rg.Intersect.Intersection.CurveCurve(crv, tmp_other_obj, .01, .01)

        pts = [int_event.PointA for int_event in int_events]
        t_vals = [int_event.ParameterA for int_event in int_events]

    elif obj_type == 'plane':

        int_events = rg.Intersect.Intersection.CurvePlane(crv, other_object, .01)

        pts = [int_event.PointA for int_event in int_events]
        t_vals = [int_event.ParameterA for int_event in int_events]

    elif obj_type == 'brep':

        _, t_vals = rg.Intersect.Intersection.CurveBrep(crv, other_object, .01, .001)

        pts = [crv.PointAt(t_val) for t_val in t_vals]

    else:

        print("object type %s is not supported" % obj_type)

        pts = []
        t_vals = []

    return pts, t_vals
    
a, _ = crvIntersector(x, y)
# ---------- end python ----------
python_2 = GhPythonScript()  # -> out, a
# ---------- python_2: Python ----------
print(type(.05))
print(type(1))
# ---------- end python_2 ----------
crv_3 = Curve(<curve referenced from the Rhino model>)
crv_4 = Curve([<curve referenced from the Rhino model> x2])
pt = Point(python.a)
move = Move(Geometry=graft(crv_4), Motion=Z)  # -> graft(Geometry), Transform
panel = Panel(python_2.out)
panel_2 = Panel(python.out)
path_mapper = PathMapper(move.Geometry, source="{A;B;C}", target="{C}")
xz = XZPlane(Origin=Point(0, 0, 0))
merge = Merge(Data1=crv_3, Data2=path_mapper)  # -> flatten(Result)
yz_2 = YZPlane(Origin=Point(0, 0, 0))
crv_5 = Curve(<curve referenced from the Rhino model>)
mesh = Mesh(<mesh referenced from the Rhino model>)
brep_2 = Brep(<brep referenced from the Rhino model>)
mesh_2 = Mesh(<mesh referenced from the Rhino model>)
brep_3 = Brep(<brep referenced from the Rhino model>)
crv_6 = Curve(<curve referenced from the Rhino model>)
crv_to_lists = GhPythonScript(crvs=merge, divs=Slider(20, range=0..50))  # -> out, lists, pts; inputs crvs: list of Curve, divs: Int32
# ---------- crv_to_lists: Python ----------
import ghpythonlib.components as gh

lists = []

for crv in crvs:
    
    pts = gh.DivideCurve(crv, divs, True)[0]
    
    if crv.IsPeriodic:
        
        pts.append(pts[0])
    
    lists.append(pts)
# ---------- end crv_to_lists ----------
rotate = Rotate(Geometry=yz_2, Angle=Slider(0, range=0..1), Plane=xz)  # -> Geometry, Transform
xy = XYPlane(Origin=Point(0, 0, 0))
brep_4 = Brep(<brep referenced from the Rhino model>)
mesh_3 = Mesh(<mesh referenced from the Rhino model>)
number_slider = Slider(77, range=0..100)
rotate_2 = Rotate(Geometry=rotate.Geometry, Angle=Slider(0, range=0..1), Plane=PlaneXY(0, 0, 0))  # -> Geometry, Transform
pt_2 = Point(Point(0, 0, 0))
lists_to_gcode = GhPythonScript(base_object=crv_6, extrusion_rate=Slider(1.5, range=0..10))  # -> out, lines; inputs base_object: GeometryBase
# ---------- lists_to_gcode: Python ----------
# snippet of code to make this python component look for it's   code in the parent folder of the .gh file

import os

ghComp = ghenv.Component
ghDoc = ghComp.OnPingDocument()

file_name = "brickSlicer.py"
gh_file_location = ghDoc.FilePath
parent = os.path.dirname(os.path.realpath(gh_file_location))

file_path = os.path.join(parent, file_name)
print(file_path)

parent = os.path.dirname(os.path.realpath(parent))
parent = os.path.dirname(os.path.realpath(parent))
print(parent)

# hacky-hacky run-fun
execfile(file_path)

# lines = gCodeGenerator(lists, extrusion_rate)
# ---------- end lists_to_gcode ----------
brep_5 = Brep(<brep referenced from the Rhino model>)
lists_to_gcode_2 = GhPythonScript(lists=crv_to_lists.lists, extrusion_rate=Slider(1.5, range=0..10))  # -> out, lines; inputs lists: list
# ---------- lists_to_gcode_2: Python ----------
# snippet of code to make this python component look for it's code in the parent folder of the .gh file

import os

ghComp = ghenv.Component
ghDoc = ghComp.OnPingDocument()

file_name = "simpleStartStop.py"
gh_file_location = ghDoc.FilePath
parent = os.path.dirname(os.path.realpath(gh_file_location))

file_path = os.path.join(parent, file_name)
print(file_path)

parent = os.path.dirname(os.path.realpath(parent))
parent = os.path.dirname(os.path.realpath(parent))
print(parent)

# hacky-hacky run-fun
execfile(file_path)

lines = gCodeGenerator(lists, extrusion_rate)
# ---------- end lists_to_gcode_2 ----------
number_slider_2 = Slider(1.6, range=0..10)
type = GhPythonScript(x=xy)  # -> out
# ---------- type: Python ----------
# snippet of code to make this python component look for it's   code in the parent folder of the .gh file

import os

ghComp = ghenv.Component
ghDoc = ghComp.OnPingDocument()

file_name = "brickSlicer.py"
gh_file_location = ghDoc.FilePath
parent = os.path.dirname(os.path.realpath(gh_file_location))

file_path = os.path.join(parent, file_name)
print(file_path)

parent = os.path.dirname(os.path.realpath(parent))
parent = os.path.dirname(os.path.realpath(parent))
print(parent)

# hacky-hacky run-fun
execfile(file_path)

print(type(x))

# lines = gCodeGenerator(lists, extrusion_rate)
# ---------- end type ----------
ghpython_script = GhPythonScript(x=xy)  # -> out
# ---------- ghpython_script: Python ----------
print(type(x))
# ---------- end ghpython_script ----------
move_2 = Move(Geometry=rotate_2.Geometry, Motion=pt_2)  # -> Geometry, Transform
claylibrarypathlocation = FilePath("/Volumes/GoogleDrive/My Drive/ClayPrinting/")
curve = Curve(<curve referenced from the Rhino model>)
end_start_gcode = GhPythonScript(lines=flatten(lists_to_gcode_2.lines))  # -> out, a; inputs lines: list
# ---------- end_start_gcode: Python ----------
__author__ = "JesusBarney"
__version__ = "2019.04.06"

import rhinoscriptsyntax as rs

#move_mode = "G1"
#extrusion_rate = 0.12
#extrusion_start = 0
offset_z = 0.10
#speed = 500
g_code = []

initiate_gcode = """;FLAVOR:Marlin
;TIME:0
;Filament used: 6.75709m
;Layer height: 1.1
;MINX:-47.897
;MINY:-47.91
;MINZ:1.1
;MAXX:47.895
;MAXY:47.91
;MAXZ:99
;Generated with Cura_SteamEngine 4.1.0
M104 S210
M105
M109 S210
M83 ;relative extrusion mode
G28 ;Home
G1 Z15.0 F6000 ;Move the platform down 15mm
;Prime the extruder
G92 E0
G1 F200 E3
G92 E0
G92 E0
G92 E0
G1 F1500 E-6.5
;LAYER_COUNT:90
;LAYER:0
M107
M203 Z50
M205 X30 Y30
G0 F1500 X30 Y-3.573 Z1.1
M205 X20 Y20
;TYPE:SKIRT
G1 F1500
G1 X0 Y0 Z20 E100"""

# ;TIME_ELAPSED:751.629903
# G1 F1500 E510.30819   

end_gcode = """M205 X30 Y30 Z30 E-100
G0 F3000 X-43.931 Y-19.114
G0 X-40.689 Y-17.797
M205 X20 Y20
M203 Z299792458000
M107
M104 S0
M140 S0
;Retract the filament
G92 E1
G1 E-1 F300
G28 X0 Y0
M84
M83 ;absolute extrusion mode
M104 S0"""

print initiate_gcode

for line in lines:
    print line

print end_gcode
# ---------- end end_start_gcode ----------
layer_slicing = GhPythonScript(
    x=claylibrarypathlocation,
    geometry=brep_4,
    slice_geo=brep_5,
    layer_height=Slider(2.5, range=0..10),
    extra_z=number_slider_2,
    layer_count=number_slider)  # -> out, ori_crvs, crv_sets, a, b, c, d; inputs geometry: GeometryBase
# ---------- layer_slicing: Python ----------
import sys

sys.path.append(x)

import brickSlicer as bs

ori_crvs = bs.slicing(geometry, layer_height = layer_height, layer_count = layer_count, extra_z = extra_z)
crv_sets, a, b, c, d = bs.splitter(ori_crvs, slicing_object = slice_geo, split_type = "object")
# ---------- end layer_slicing ----------
geometry = Geometry(brep_5)
number_slider_3 = Slider(2.5, range=0.5..25)
python_3 = GhPythonScript(x=layer_slicing.crv_sets)  # -> out, a
# ---------- python_3: Python ----------
for crv in x:
    
    print(type(crv))
    print(crv.GetLength())
# ---------- end python_3 ----------
path_assignment = GhPythonScript(x=claylibrarypathlocation)  # -> out, a
# ---------- path_assignment: Python ----------
import sys

sys.path.append(x)
# ---------- end path_assignment ----------
panel_3 = Panel(layer_slicing.out)
panel_4 = Panel(path_assignment.out)
layer_structure = GhPythonScript(
    x=claylibrarypathlocation,
    ori_crvs=layer_slicing.ori_crvs,
    crv_set=layer_slicing.crv_sets,
    spacing=number_slider_3,
    direction=Toggle(True),
    item=Toggle(False))  # -> out, layers, set_tuple, a; inputs ori_crvs: list, crv_set: list, direction: Boolean, item: Boolean
# ---------- layer_structure: Python ----------
from sys import path
from scriptcontext import sticky

path.append(x)

import vertexClass as vc

if direction:
    
    dir = 1
    
else:
    
    dir = -1
    
if item:
    
    item = 0

else:
    
    item = 1

print(ori_crvs)

layers, set_tuple, _ = vc.moveSet(crv_set, ori_crvs, spacing, dir, item)

a = ori_crvs
# ---------- end layer_structure ----------
pline = PolyLine(Closed=False)
crv_7 = Curve(layer_slicing.ori_crvs)
python_4 = GhPythonScript()  # -> out, a
# ---------- python_4: Python ----------
a = [[2, 1, 1], [1, 2, 3], [0, 1, 2]]
# ---------- end python_4 ----------
crv_8 = Curve()
list = ValueList({"dotMap": 0, "ellipsoidBumpMap": 1, "sinWarp": 2, "cylinderMap": 3, "layerMap": 4}, selected="sinWarp")
panel_5 = Panel(layer_structure.out)
pattern = GhPythonScript(
    layers=layer_structure.layers,
    set_tuple=layer_structure.set_tuple,
    edge_easing=Toggle(True),
    edge_ease_zero=Slider(0, range=0..100),
    edge_ease_end=Slider(4, range=0..100),
    pattern_type=list,
    period=Slider(25, range=0..100),
    phase_shift=Slider(0.2, range=0..2),
    spacing=Slider(20, range=0..100),
    radius=Slider(35, range=0..100),
    max_val=Slider(0, range=0..100),
    height=Slider(40, range=0..100),
    radius_bot=Slider(0, range=0..10),
    pattern_set=python_4.a,
    direction=Toggle(False))  # -> out, curve_list, a, b, c; inputs layers: list, set_tuple: list, edge_easing: Boolean, pattern_type: Int32, pattern_set: list, direction: Boolean
# ---------- pattern: Python ----------
# snippet of code to make this python component look for it's code in the parent folder of the .gh file

import os

ghComp = ghenv.Component
ghDoc = ghComp.OnPingDocument()

file_name = "patternGenv2bis.py"
gh_file_location = ghDoc.FilePath
parent = os.path.dirname(os.path.realpath(gh_file_location))

file_path = os.path.join(parent, file_name)

# hacky-hacky run-fun
execfile(file_path)

pattern_map = PatternMap(layers, set_tuple)
pattern_map.build()
# pattern_map.subdivide(sub_length)
# pattern_map.generate(layer_height, layer_count)

if edge_easing:

    pattern_map.edgeEasing(edge_ease_zero, edge_ease_end)

if pattern_type == 0:
    
    pattern_map.dotMap(spacing, radius, max_val, direction)

elif pattern_type == 1:

    pattern_map.ellipsoidBumpMap(spacing, radius, max_val, direction)

elif pattern_type == 2:

    pattern_map.sinWarp(period, max_val, phase_shift, direction)

elif pattern_type == 3:

    if radius_bot < .01:

        radius_bot = radius

    else:

        radius_bot = radius_bot

    pattern_map.cylinderMap(spacing, height, radius, max_val, radius_bot, direction)

elif pattern_type == 4:

    pattern_map.layerMap(spacing, pattern_set, radius, max_val, direction)


c = pattern_map.makeMesh()
b = pattern_map.makeCurves()
# ---------- end pattern ----------
pt_3 = Point([Point(-567.6327734, -216.8740716, 0), Point(-514.2246771, -164.3273963, 0), Point(-447.0338464, -155.7131872, 0), Point(-381.5658574, -159.1588708, 0), Point(-371.2288065, -205.6755998, 0), Point(-403.1013801, -234.1024898, 0), Point(-511.6404144, -262.5293797, 0), Point(-554.7114598, -256.4994334, 0)])
python_5 = GhPythonScript(
    x=claylibrarypathlocation,
    pin_points=pt_3,
    connection_count=Slider(3, range=1..4),
    max_main_line=Slider(50, range=25..250),
    start_end_alfa=Slider(1.535, range=0..3.142),
    mid_alfa=Slider(0.529, range=0..3.142))  # -> out, main_links, link_lines, split_lines, pin_pt_sets; inputs pin_points: list of Point3d, connection_count: Int32
# ---------- python_5: Python ----------
import sys

sys.path.append(x)

import pinLinkingBis as pl

main_links, link_lines, split_lines, pin_pt_sets = pl.createLinks(
    pin_pts = pin_points,
    connection_count = connection_count,
    max_main_line = max_main_line,
    start_end_alfa = start_end_alfa,
    mid_alfa = mid_alfa
)
# ---------- end python_5 ----------
crv_9 = Curve(pattern.b)
line_2 = Line(python_5.link_lines)
line_3 = Line(python_5.split_lines)
mesh_4 = Mesh(pattern.c)
line_4 = Line(python_5.main_links)
re_slicer = GhPythonScript(ori_crvs=pattern.b, slice_geo=geometry, layer_count=number_slider)  # -> out, ori_crvs, crv_sets, a, b, c, d; inputs ori_crvs: list
# ---------- re_slicer: Python ----------
# snippet of code to make this python component look for it's   code in the parent folder of the .gh file

import os

ghComp = ghenv.Component
ghDoc = ghComp.OnPingDocument()

file_name = "brickSlicer.py"
gh_file_location = ghDoc.FilePath
parent = os.path.dirname(os.path.realpath(gh_file_location))

file_path = os.path.join(parent, file_name)
print(file_path)

parent = os.path.dirname(os.path.realpath(parent))
parent = os.path.dirname(os.path.realpath(parent))
print(parent)

# hacky-hacky run-fun
execfile(file_path)

print(type(slice_geo))

crv_sets, a, b, c, d = splitter(ori_crvs, slicing_object = slice_geo, split_type = "object")
# ---------- end re_slicer ----------
panel_6 = Panel(python_5.out)
number_slider_4 = Slider(1.4, range=0.5..12)
panel_7 = Panel(pattern.out)
panel_8 = Panel(re_slicer.out)
layer_structure_2 = GhPythonScript(
    ori_crvs=re_slicer.ori_crvs,
    crv_set=re_slicer.crv_sets,
    spacing=number_slider_3,
    direction=Toggle(False),
    item=Toggle(False))  # -> out, layers, set_tuple, a; inputs ori_crvs: list, crv_set: list, direction: Boolean, item: Boolean
# ---------- layer_structure_2: Python ----------
# snippet of code to make this python component look for it's   code in the parent folder of the .gh file

import os

ghComp = ghenv.Component
ghDoc = ghComp.OnPingDocument()

file_name = "vertexClass.py"
gh_file_location = ghDoc.FilePath
parent = os.path.dirname(os.path.realpath(gh_file_location))

file_path = os.path.join(parent, file_name)
print(file_path)

parent = os.path.dirname(os.path.realpath(parent))
parent = os.path.dirname(os.path.realpath(parent))
print(parent)

# hacky-hacky run-fun
execfile(file_path)

if direction:
    
    dir = 1
    
else:
    
    dir = -1
    
if item:
    
    item = 0

else:
    
    item = 1

print(ori_crvs)

layers, set_tuple, _ = moveSet(crv_set, ori_crvs, spacing, dir, item)

a = ori_crvs
# ---------- end layer_structure_2 ----------
python_6 = GhPythonScript()  # -> out, a; same code as python_4

# ---- group: cylinder
number_slider_5 = Slider(5, range=0..10)
number_slider_6 = Slider(10, range=0..100)

# ---- group: mod Based Dot Map
number_slider_7 = Slider(2, range=1..10)
number_slider_8 = Slider(25, range=10..100)
toggle = BooleanToggle(True)
number_slider_9 = Slider(1.1984, range=0..3.1416)
number_slider_10 = Slider(0, range=-2..2)
number_slider_11 = Slider(1.3, range=0..2)

# ----
list_2 = ValueList({"dotMap": 0, "ellipsoidBumpMap": 1, "sinWarp": 2, "cylinderMap": 3, "layerMap": 4, "modulorBased": 5}, selected="modulorBased")
python_7 = GhPythonScript()  # -> out, a
# ---------- python_7: Python ----------
import sys

sys.path.append("/Volumes/GoogleDrive/My Drive/ClayPrinting")

import brickSlicer as bs

reload(bs)


bs.slicing
# ---------- end python_7 ----------
pattern_2 = GhPythonScript(
    layers=layer_structure_2.layers,
    set_tuple=layer_structure_2.set_tuple,
    sub_length=Slider(2, range=0..10),
    layer_count=Slider(70, range=0..100),
    layer_height=Slider(2.3, range=0..10),
    edge_easing=Toggle(True),
    edge_ease_zero=Slider(0.9, range=0..100),
    edge_ease_end=Slider(25.4, range=0..100),
    pattern_type=list_2,
    period=Slider(10, range=0..100),
    phase_shift=Slider(1, range=0..2),
    spacing=Slider(100, range=10..100),
    radius=Slider(9, range=0..100),
    max_val=Slider(29.27, range=0..100),
    y_spacing=number_slider_8,
    layer_shift=number_slider_7,
    shift_a=number_slider_11,
    shift_b=number_slider_10,
    ellipsoid=toggle,
    rot_alfa=number_slider_9,
    height=number_slider_6,
    radius_bot=number_slider_5,
    pattern_set=python_6.a,
    direction=Toggle(False))  # -> out, curve_list, a, b, c; inputs layers: list, set_tuple: list, layer_count: Int32, layer_height: Int32, edge_easing: Boolean, pattern_type: Int32, ellipsoid: Boolean, pattern_set: list, direction: Boolean
# ---------- pattern_2: Python ----------
# snippet of code to make this python component look for it's code in the parent folder of the .gh file

import os

ghComp = ghenv.Component
ghDoc = ghComp.OnPingDocument()

file_name = "patternGenv2bis.py"
gh_file_location = ghDoc.FilePath
parent = os.path.dirname(os.path.realpath(gh_file_location))

file_path = os.path.join(parent, file_name)

# hacky-hacky run-fun
execfile(file_path)

print("I am out 1")

pattern_map = PatternMap(layers, set_tuple)

print("I am out 2")

pattern_map.build()
# pattern_map.subdivide(sub_length)
# pattern_map.generate(layer_height, layer_count)

print("I am out 3")

if edge_easing:

    pattern_map.edgeEasing(edge_ease_zero, edge_ease_end)

if pattern_type == 0:
    
    pattern_map.dotMap(spacing, radius, max_val, direction)

elif pattern_type == 1:

    pattern_map.ellipsoidBumpMap(spacing, radius, max_val, direction)

elif pattern_type == 2:

    pattern_map.sinWarp(period, max_val, phase_shift, direction)

elif pattern_type == 3:

    if radius_bot < .01:

        radius_bot = radius

    else:

        radius_bot = radius_bot

    pattern_map.cylinderMap(spacing, height, radius, max_val, radius_bot, direction)

elif pattern_type == 4:

    pattern_map.layerMap(spacing, pattern_set, radius, max_val, direction)
    
elif pattern_type == 5:
    
    print("I am out 4")
    
    pattern_map.modBasedDotMap(
        x_spacing = spacing,
        y_spacing = y_spacing,
        max_val = max_val,
        ellipsoid = ellipsoid,
        direction = direction,
        layer_shift = layer_shift,
        shift_a = shift_a,
        shift_b = shift_b,
        rot_alfa = rot_alfa
    )

print("I am out 5")

c = pattern_map.makeMesh()
b = pattern_map.makeCurves()
a = [set[1:] for set in pattern_map.pts_set]
# ---------- end pattern_2 ----------
re_slicer_2 = GhPythonScript(ori_crvs=pattern_2.b, slice_geo=move_2.Geometry, layer_count=number_slider)  # -> out, ori_crvs, crv_sets, a, b, c, d; inputs ori_crvs: list
# ---------- re_slicer_2: Python ----------
from sys import path
from scriptcontext import sticky

path.append(sticky["clay_printing_library"])

import brickSlicer as bs

crv_sets, a, b, c, d = bs.splitter(ori_crvs, slicing_object = slice_geo, split_type = "object")
# ---------- end re_slicer_2 ----------
crv_10 = Curve(<curve referenced from the Rhino model>)
crv_11 = Curve(re_slicer_2.ori_crvs)
list_3 = ValueList({"detached", "crossing"}, selected="detached")
mesh_5 = Mesh(pattern_2.c)
list_4 = ValueList({"Inside": "inside", "Outside": "outside"}, selected="Inside")
panel_9 = Panel(pattern_2.out)
move_3 = Move(Motion=Vector(0, 0, 10))  # -> Geometry, Transform
python_8 = GhPythonScript(x=pattern_2.a)  # -> out, a; inputs x: list
# ---------- python_8: Python ----------
print(x[0])
# ---------- end python_8 ----------
python_9 = GhPythonScript(x=crv_10)  # -> out, a, x; inputs x: Curve
# ---------- python_9: Python ----------
import Rhino.Geometry as rg
from copy import deepcopy as dc

pln = rg.Plane(x.PointAt(0.0), rg.Vector3d(0,0,1))

tmp_offset_crv_1 = x.Offset(pln, 1.0, .01, rg.CurveOffsetCornerStyle.Round)[0]
tmp_offset_crv_2 = x.Offset(pln, -1.0, .01, rg.CurveOffsetCornerStyle.Round)[0]

x.Domain = rg.Interval(0,1)
a = dc(x)

if tmp_offset_crv_1.GetLength() < tmp_offset_crv_2.GetLength():
    
    print("curve needed to be reversed!")

    a.Reverse()
    
a
a.Domain = rg.Interval(0,1)
# ---------- end python_9 ----------
python_10 = GhPythonScript(
    crvs=re_slicer_2.ori_crvs,
    distance=Slider(1.1, range=0..10),
    direction=list_4,
    count=Slider(4, range=0..10),
    split_distance=Slider(-1.1, range=-10..10),
    split_type=list_3,
    side_bool=Toggle(True))  # -> out, a, b, c, d, e, pt_sets; inputs crvs: list of Curve, count: Int32, side_bool: Boolean
# ---------- python_10: Python ----------
import sys
from scriptcontext import sticky

sys.path.append(sticky["clay_printing_library"])

# print(sys.path)

import generalFunctions as gf
import layerFunctions as lf

reload(gf)
reload(lf)

pt_sets = []

for crv_i, crv in enumerate(crvs):
    
    print(crv_i)
    
    a = gf.offsetCurveSet(crv, distance, direction, count)
    layer_set = lf.LinkingLayers(a, split_distance, side_bool, split_type)
    a, b, c, d, e = layer_set.createOrganisedCurves()
    pt_sets.append(layer_set.joinCrvs())
print(type(a))
# ---------- end python_10 ----------
eval = EvaluateCurve(Curve=[python_9.a, python_9.x], Parameter=Slider(0.51, range=0..1))  # -> Point, Tangent, Angle
panel_10 = Panel(python_9.out)
crv_12 = Curve()
list_5 = ValueList({"detached", "crossing"}, selected="detached")
item = ListItem(List=crv_11, Index=Slider(34, range=0..100), Wrap=True)
cls = Closed(Curve=python_10.a)  # -> Closed, Periodic

# ---- group: Brim
cluster = Cluster(crv=pattern_2.b, shift=Slider(2, range=0..10), z_height=number_slider_2)  # -> crv_3, list

# ----
crv_13 = Curve(cluster.crv_3)
python_11 = GhPythonScript(x=cluster.list)  # -> out, b, a; inputs x: list
# ---------- python_11: Python ----------
b = [pt for pt in x]
a = [b + [b[0]]]
# ---------- end python_11 ----------
python_12 = GhPythonScript(crvs=python_10.a, split_type=list_5, side_bool=Toggle(True))  # -> out, a, b, c, d, e, f; inputs crvs: list, side_bool: Boolean
# ---------- python_12: Python ----------
import sys
from scriptcontext import sticky

sys.path.append(sticky["clay_printing_library"])

import layerFunctions as lf

reload(lf)

later_set = lf.LinkingLayers(crvs, split_distance, side_bool, split_type)
a, b, c, d, e = later_set.createOrganisedCurves()
f = later_set.joinCrvs()
# ---------- end python_12 ----------
panel_11 = Panel(python_8.out)
sift = SiftPattern(List=python_10.a, SiftPattern=cls.Closed)  # -> Output0, Output1
merge_2 = Merge(Data1=flatten(python_11.a), Data2=flatten(pattern_2.a))
clean = CleanTree(RemoveNulls=True, RemoveInvalid=True, RemoveEmpty=False, Tree=sift.Output0)
crv_14 = Curve(python_12.d)
crv_15 = Curve(clean)
crv_16 = Curve(python_12.b)
pt_4 = Point(python_12.a)

# ---- group: G-Code
start_stop_feedrate_in_mm_min = Slider(100, range=0..1000)
feed_rate_in_mm_s = Slider(10, range=0..100)
list_6 = ValueList({"start / stop": "start_stop", "continious"}, selected="continious")
gcodelines = GhPythonScript(
    x=claylibrarypathlocation,
    pts=merge_2,
    feed_rate=feed_rate_in_mm_s,
    extrusion_rate=Slider(0.5, range=0..10),
    link_type=list_6,
    global_trim_distance=Slider(0, range=0..10),
    ss_trim_distance=Slider(5, range=0..10),
    cull_distance=Slider(2.1, range=0..10),
    lift_val=Slider(4.4, range=0..10),
    ss_f_rate=start_stop_feedrate_in_mm_min,
    ss_e_rate=Slider(300, range=0..1000))  # -> out, a, path_vis; inputs pts: list
# ---------- gcodelines: Python ----------
from sys import path
from scriptcontext import sticky

path.append(x)

print(path)

import Rhino.Geometry as rg
import simpleStartStop as ss

reload(ss)

# print(pts)

p_set = ss.PrintSettings(
    feed_rate = feed_rate, 
    extrusion_rate = extrusion_rate, 
    extrusion_mode = 'relative', 
    movement_mode = 'relative'
)

l_type = ss.LinkType(
    link_type = link_type,
    global_trim_distance = global_trim_distance,
    ss_trim_distance = ss_trim_distance,
    cull_distance = cull_distance,
    lift_val = lift_val
)

l_type.ss_f_rate = ss_f_rate
l_type.ss_e_rate = ss_e_rate

gcodeset = ss.GCodeSet(pts, p_set, l_type)
a = gcodeset.generateGCode()

path_vis = gcodeset.path_vis
# ---------- end gcodelines ----------
end_start_gcode_2 = GhPythonScript(lines=flatten(gcodelines.a))  # -> out, a; inputs lines: list
# ---------- end_start_gcode_2: Python ----------
__author__ = "JesusBarney"
__version__ = "2019.04.06"

import rhinoscriptsyntax as rs

#move_mode = "G1"
#extrusion_rate = 0.12
#extrusion_start = 0
offset_z = 0.10
#speed = 500
g_code = []

initiate_gcode = """;FLAVOR:Marlin
;TIME:0
;Filament used: 6.75709m
;Layer height: 1.1
;MINX:-47.897
;MINY:-47.91
;MINZ:1.1
;MAXX:47.895
;MAXY:47.91
;MAXZ:99
;Generated with Cura_SteamEngine 4.1.0
M104 S210
M105
M109 S210
M83 ;relative extrusion mode
G28 ;Home
G1 Z15.0 F6000 ;Move the platform down 15mm
;Prime the extruder
G92 E0
G1 F200 E3
G92 E0
G92 E0
G92 E0
G1 F1500 E-6.5
;LAYER_COUNT:90
;LAYER:0
M107
M203 Z50
M205 X30 Y30
G0 F1500 X30 Y-3.573 Z20
M205 X20 Y20
;TYPE:SKIRT
G1 X0 Y0 Z20 E1"""

# ;TIME_ELAPSED:751.629903
# G1 F1500 E510.30819   

end_gcode = """M205 X30 Y30 Z30 E-1
G0 F3000 X-43.931 Y-19.114
G0 X-40.689 Y-17.797
M205 X20 Y20
M203 Z299792458000
M107
M104 S0
M140 S0
;Retract the filament
G92 E1
G1 E-1 F300
G28 X0 Y0
M84
M83 ;absolute extrusion mode
M104 S0"""

print initiate_gcode

for line in lines:

    print(line)

print end_gcode
# ---------- end end_start_gcode_2 ----------

# ----
pline_2 = PolyLine(Vertices=python_12.f, Closed=False)  # -> flatten(Polyline)
domain = Domain(crv_15)
item_2 = ListItem(List=pline_2, Index=0, Wrap=True)
eval_2 = EvaluateCurve(Curve=crv_15, Parameter=Slider(0, range=0..1))  # -> Point, Tangent, Angle
eval_3 = EvaluateCurve(Curve=crv_15, Parameter=Slider(1, range=0..1))  # -> Point, Tangent, Angle
eval_4 = EvaluateCurve(Curve=item_2, Parameter=Slider(256, range=0..1000))  # -> Point, Tangent, Angle
panel_12 = Panel(python_12.out)
pline_3 = PolyLine(Vertices=gcodelines.path_vis, Closed=False)
crv_17 = Curve(<curve referenced from the Rhino model>)
list_7 = ValueList({"Inside": "inside", "Outside": "outside"}, selected="Inside")
offset = OffsetCurve(Curve=crv_17, Distance=1, Plane=PlaneXY(0, 0, 0), Corners=1)
crv_18 = Curve([<curve referenced from the Rhino model> x3])
panel_13 = Panel(end_start_gcode_2.out)
python_13 = GhPythonScript(x=offset)  # -> out, a; same code as ghpython_script
python_14 = GhPythonScript(crv=crv_17, distance=Slider(0.4, range=0..10), direction=list_7, count=Slider(1, range=0..10))  # -> out, a; inputs count: Int32
# ---------- python_14: Python ----------
from sys import path
from scriptcontext import sticky

path.append(sticky["clay_printing_library"])

import generalFunctions as gf

reload(gf)

a = gf.offsetCurveSet(crv, distance, direction, count)

for crv in a:
    
    gf.polylinePeriodicizer(crv)
# ---------- end python_14 ----------
python_15 = GhPythonScript(crvs=crv_18, count=Slider(110, range=0..1000))  # -> out, a, b, c, d; inputs crvs: list of Curve, count: Int32
# ---------- python_15: Python ----------
import Rhino.Geometry as rg

for crv in crvs:

    crv.Domain = rg.Interval(0, count - 1)

a = [[crv.PointAt(t) for t in range(count)] for crv in crvs]

d = []

for i in range(10):
    
    mv_pt = rg.Point3d(0, 0, i * 1.5)
    
    for a_set in a:
        
        d.append([pt + mv_pt for pt in a_set])
     
c = []

for e in d:
    c.extend(e)
# ---------- end python_15 ----------
crv_19 = Curve(<curve referenced from the Rhino model>)
list_8 = ValueList({"start", "end", "both"}, selected="both")
eval_5 = Evaluate()
list_9 = ValueList({"start", "end", "both"}, selected="both")
panel_14 = Panel(python_14.out)
panel_15 = Panel(python_15.out)
divide = DivideCurve(Curve=crv_19, Count=Slider(110, range=0..1000), Kinks=False)  # -> Points, Tangents, Parameters
python_16 = GhPythonScript(pt_sets=python_15.d, distance=Slider(2.8, range=0..10), location=list_8, count=Slider(1, range=0..10))  # -> out, a, b, c; inputs pt_sets: list, count: Int32
# ---------- python_16: Python ----------
from sys import path
from scriptcontext import sticky

path.append(sticky["clay_printing_library"])

import generalFunctions as gf

reload(gf)

# print(pts)

a = [gf.collapsePolylinePts(pts, distance) for pts in pt_sets]

c = []

for b in a:
    c.extend(b)
# ---------- end python_16 ----------
pline_4 = PolyLine(Vertices=divide.Points, Closed=False)
python_17 = GhPythonScript(pts=divide.Points, distance=Slider(0, range=0..10), location=list_9, count=Slider(1, range=0..10))  # -> out, a; inputs pts: list, count: Int32
# ---------- python_17: Python ----------
from sys import path
from scriptcontext import sticky

path.append(sticky["clay_printing_library"])

import simpleStartStop as sSS

reload(sSS)

# print(pts)

a = sSS.shortenPolylineSet(pts, distance, location)
# ---------- end python_17 ----------
panel_16 = Panel(python_17.a)
panel_17 = Panel(python_16.out)
python_18 = GhPythonScript(x=python_16.a)  # -> out, a; inputs x: list
# ---------- python_18: Python ----------
print(x)
# ---------- end python_18 ----------
pline_5 = PolyLine(Vertices=python_17.a, Closed=False)
panel_18 = Panel(python_17.out)
len = Length(Curve=pline_4)
len_2 = Length(Curve=pline_5)
panel_19 = Panel(python_10.out)
subtraction = Subtraction(A=len, B=len_2)

# ==== cluster Cluster
crv = ClusterInput()
crv_2 = Curve(crv)
crv_3 = ClusterOutput(crv_2)
z_height = ClusterInput()
item = ListItem(List=crv_2, Index=0, Wrap=True)
python = GhPythonScript(x=item, z_height=z_height)  # -> out, a; inputs x: Curve
# ---------- python: Python ----------
import Rhino.Geometry as rg
import math

def crvOrienter(crv):

    x_or_y = True
    rot_angle = 0.0
    area = 9999999

    for i in range(90):

        angle = math.pi * i / 180

        # bounding box translation
        x_vec = rg.Vector3d(math.cos(angle), math.sin(angle), 0.0)
        y_vec = rg.Vector3d(- math.sin(angle), math.cos(angle), 0.0)
        b_box = crv.GetBoundingBox(rg.Plane(rg.Point3d(0,0,0), x_vec, y_vec))

        x_delta = b_box.Max.X - b_box.Min.X
        y_delta = b_box.Max.Y - b_box.Min.Y

        loc_are = x_delta * y_delta

        if loc_are < area:

            rot_angle = angle

            area = loc_are

            if x_delta < y_delta:

                x_or_y = False

            else:

                x_or_y = True

    if x_or_y:

        x_vec = rg.Vector3d(1, 0, 0)
        y_vec = rg.Vector3d(0, 1, 0)

    else:

        x_vec = rg.Vector3d(0, 1, 0)
        y_vec = rg.Vector3d(-1, 0, 0)

    x_vec.Transform(rg.Transform.Rotation(rot_angle, rg.Point3d(0,0,0)))
    y_vec.Transform(rg.Transform.Rotation(rot_angle, rg.Point3d(0,0,0)))

    tmp_pln = rg.Plane(rg.Point3d(0,0,z_height), x_vec, y_vec)
    
    b_box = crv.GetBoundingBox(tmp_pln)
    
    x0, x1 = b_box.Min.X, b_box.Max.X
    y1, y0 = b_box.Max.Y, b_box.Min.Y
    
    crv = rg.Rectangle3d(tmp_pln, rg.Interval(x0,x1), rg.Interval(y0,y1))
    
    return crv
    
a = crvOrienter(x)
# ---------- end python ----------
offset = OffsetCurve(Curve=python.a, Distance=Slider(20, range=0..25), Plane=PlaneXY(0, 0, 0), Corners=1)
divide = DivideCurve(Curve=offset, Count=1, Kinks=True)  # -> Points, Tangents, Parameters
shift = ClusterInput()
panel = Panel(python.out)
shift_list = ShiftList(List=divide.Points, Shift=shift, Wrap=True)
list = ClusterOutput(shift_list)
