# Grasshopper definition InfillPureGHTests.gh (Grasshopper 1.0.7)

crv = Curve(<curve referenced from the Rhino model>)
divide = DivideCurve(Curve=crv, Count=Slider(25, range=0..100), Kinks=False)  # -> Points, Tangents, Parameters
ma = MassAddition(Input=divide.Points)  # -> Result, PartialResults
lng = ListLength(List=divide.Points)
division = Division(A=ma.Result, B=lng)
dist = Distance(PointA=divide.Points, PointB=division)
sort = SortList(Keys=dist)  # -> Keys, ValuesA
layerwidth = Number(Slider(2.5, range=0..10))
item = ListItem(List=sort.Keys, Index=0, Wrap=True)  # -> Item1, Item
division_2 = Division(A=item.Item1, B=layerwidth)
circle = CircleCNR(Center=division, Normal=Vector(0, 0, 1), Radius=item.Item1)
ln = Line(StartPoint=division, EndPoint=divide.Points)
round = Round(Number=division_2)  # -> Nearest, Floor, Ceiling
python = GhPythonScript(lines=ln, count=round.Ceiling)  # -> out, pts; inputs lines: list of Line, count: Int32
# ---------- python: Python ----------
import Rhino.Geometry as rg

pt_set = [[] for i in range(count + 1)]

f_count = float(count)
delta = 1.0 / float(f_count)

for line_idx, line in enumerate(lines):
    
    extra_val = line_idx * delta
    
    for i in range(count):
        
        pt = line.PointAt( (i + extra_val) / f_count )
        
        pt_set[i].append(pt)
    
pts = []

[pts.extend(loc_pts) for loc_pts in pt_set]
# ---------- end python ----------
division_3 = Division(A=item.Item1, B=round.Ceiling)
rev = ReverseList(List=python.pts)
series = Series(Start=division_3, Step=division_3, Count=round.Ceiling)
panel = Panel(python.out)
circle_2 = CircleCNR(Center=division, Normal=Vector(0, 0, 1), Radius=series)
pline = PolyLine(Vertices=rev, Closed=False)
eval = EvaluateCurve(Curve=pline, Parameter=Slider(100, range=0..100))  # -> Point, Tangent, Angle
