# Grasshopper definition Merging_b.gh (Grasshopper 1.0.7)

yz = YZPlane(Origin=Point(0, 0, 0))
series = Series(Start=0, Step=Slider(2, range=0..10), Count=Slider(8, range=0..10))
brep = Brep(<brep referenced from the Rhino model>)
pln = Plane(yz)
line = Line(Line((-1.263981532, -48.84175791, 0), (8.362559972, -74.03462184, 0)))
crv = Curve(<curve referenced from the Rhino model>)
crv_2 = Curve(<curve referenced from the Rhino model>)
Z = UnitZ(Factor=series)
number_slider = Slider(1, range=0..1)
python = GhPythonScript(x=crv_2, y=pln)  # -> out, a; inputs x: Curve
# ---------- python: Python ----------
import Rhino.Geometry as rg
from copy import deepcopy as dc

def rhinoGeometryObjectType(base_object):

    crv_type_list = ['NurbsCurve', 'Curve', 'PolylineCurve', 'LineCurve']
    brep_type = ['Brep']
    mesh_type = ['Mesh']
    plane_type = ['Plane']
    line_type = ['Line']

    types = [('brep', brep_type), ('mesh', mesh_type), ('crv', crv_type_list), ('plane', plane_type), ('line', line_type)]

    a = str(type(base_object))

    obj_type = "other"

    for type_tuple in types:

        for type_val in type_tuple[1]:

            if (str(type(base_object)).find(type_val) > 0):

                obj_type = type_tuple[0]

                break

    return obj_type
    
def moveToSameHeight(ref_object, mv_object):

    z_ref = ref_object.PointAt(ref_object.Domain[0]).Z
    
    z_mv_obj = mv_object.PointAt(ref_object.Domain[0]).Z

    mv_vec = rg.Vector3d(0 ,0 , z_ref - z_mv_obj)

    mv = rg.Transform.Translation(mv_vec)

    output_obj = dc(mv_object)

    output_obj.Transform(mv)

    return output_obj

def crvIntersector(crv, other_object):

    obj_type = rhinoGeometryObjectType(other_object)

    if obj_type == 'line':

        tmp_other_obj = moveToSameHeight(crv, other_object)

        int_events = rg.Intersect.Intersection.CurveLine(crv, tmp_other_obj, .01, .01)

        pts = [int_event.PointA for int_event in int_events]
        t_vals = [int_event.ParameterA for int_event in int_events]

    elif obj_type == 'crv':

        tmp_other_obj = moveToSameHeight(crv, other_object)

        int_events = rg.Intersect.Intersection.CurveCurve(crv, tmp_other_obj, .01, .01)

        pts = [int_event.PointA for int_event in int_events]
        t_vals = [int_event.ParameterA for int_event in int_events]

    elif obj_type == 'plane':

        int_events = rg.Intersect.Intersection.CurvePlane(crv, other_object, .01)

        pts = [int_event.PointA for int_event in int_events]
        t_vals = [int_event.ParameterA for int_event in int_events]

    elif obj_type == 'brep':

        _, t_vals = rg.Intersect.Intersection.CurveBrep(crv, other_object, .01, .001)

        pts = [crv.PointAt(t_val) for t_val in t_vals]

    else:

        print("object type %s is not supported" % obj_type)

        pts = []
        t_vals = []

    return pts, t_vals
    
a, _ = crvIntersector(x, y)
# ---------- end python ----------
python_2 = GhPythonScript()  # -> out, a
# ---------- python_2: Python ----------
print(type(.05))
print(type(1))
# ---------- end python_2 ----------
crv_3 = Curve(<curve referenced from the Rhino model>)
crv_4 = Curve([<curve referenced from the Rhino model> x2])
pt = Point(python.a)
move = Move(Geometry=graft(crv_4), Motion=Z)  # -> graft(Geometry), Transform
panel = Panel(python_2.out)
panel_2 = Panel(python.out)
crv_5 = Curve(<curve referenced from the Rhino model>)
path_mapper = PathMapper(move.Geometry, source="{A;B;C}", target="{C}")
scale = Scale(Geometry=crv_5, Center=Point(0, 0, 0), Factor=number_slider)  # -> Geometry, Transform
xz = XZPlane(Origin=Point(0, 0, 0))
crv_6 = Curve(scale.Geometry)
merge = Merge(Data1=crv_3, Data2=path_mapper)  # -> flatten(Result)
number_slider_2 = Slider(30, range=0..100)
yz_2 = YZPlane(Origin=Point(0, 0, 0))
mesh = Mesh(<mesh referenced from the Rhino model>)
brep_2 = Brep(<brep referenced from the Rhino model>)
mesh_2 = Mesh(<mesh referenced from the Rhino model>)
brep_3 = Brep(<brep referenced from the Rhino model>)
crv_7 = Curve(<curve referenced from the Rhino model>)
crv_to_lists = GhPythonScript(crvs=merge, divs=Slider(20, range=0..50))  # -> out, lists, pts; inputs crvs: list of Curve, divs: Int32
# ---------- crv_to_lists: Python ----------
import ghpythonlib.components as gh

lists = []

for crv in crvs:
    
    pts = gh.DivideCurve(crv, divs, True)[0]
    
    if crv.IsPeriodic:
        
        pts.append(pts[0])
    
    lists.append(pts)
# ---------- end crv_to_lists ----------
rotate = Rotate(Geometry=yz_2, Angle=Slider(0, range=0..1), Plane=xz)  # -> Geometry, Transform
xy = XYPlane(Origin=Point(0, 0, 0))
brep_4 = Brep(<brep referenced from the Rhino model>)
mesh_3 = Mesh(<mesh referenced from the Rhino model>)
rotate_2 = Rotate(Geometry=rotate.Geometry, Angle=Slider(0, range=0..1), Plane=PlaneXY(0, 0, 0))  # -> Geometry, Transform
pt_2 = Point(<point referenced from the Rhino model>)
lists_to_gcode = GhPythonScript(base_object=crv_7, extrusion_rate=Slider(1.5, range=0..10))  # -> out, lines; inputs base_object: GeometryBase
# ---------- lists_to_gcode: Python ----------
# snippet of code to make this python component look for it's   code in the parent folder of the .gh file

import os

ghComp = ghenv.Component
ghDoc = ghComp.OnPingDocument()

file_name = "brickSlicer.py"
gh_file_location = ghDoc.FilePath
parent = os.path.dirname(os.path.realpath(gh_file_location))

file_path = os.path.join(parent, file_name)
print(file_path)

parent = os.path.dirname(os.path.realpath(parent))
parent = os.path.dirname(os.path.realpath(parent))
print(parent)

# hacky-hacky run-fun
execfile(file_path)

# lines = gCodeGenerator(lists, extrusion_rate)
# ---------- end lists_to_gcode ----------
lists_to_gcode_2 = GhPythonScript(lists=crv_to_lists.lists, extrusion_rate=Slider(1.5, range=0..10))  # -> out, lines; inputs lists: list
# ---------- lists_to_gcode_2: Python ----------
# snippet of code to make this python component look for it's code in the parent folder of the .gh file

import os

ghComp = ghenv.Component
ghDoc = ghComp.OnPingDocument()

file_name = "simpleStartStop.py"
gh_file_location = ghDoc.FilePath
parent = os.path.dirname(os.path.realpath(gh_file_location))

file_path = os.path.join(parent, file_name)
print(file_path)

parent = os.path.dirname(os.path.realpath(parent))
parent = os.path.dirname(os.path.realpath(parent))
print(parent)

# hacky-hacky run-fun
execfile(file_path)

lines = gCodeGenerator(lists, extrusion_rate)
# ---------- end lists_to_gcode_2 ----------
number_slider_3 = Slider(1.5, range=0..10)
type = GhPythonScript(x=xy)  # -> out
# ---------- type: Python ----------
# snippet of code to make this python component look for it's   code in the parent folder of the .gh file

import os

ghComp = ghenv.Component
ghDoc = ghComp.OnPingDocument()

file_name = "brickSlicer.py"
gh_file_location = ghDoc.FilePath
parent = os.path.dirname(os.path.realpath(gh_file_location))

file_path = os.path.join(parent, file_name)
print(file_path)

parent = os.path.dirname(os.path.realpath(parent))
parent = os.path.dirname(os.path.realpath(parent))
print(parent)

# hacky-hacky run-fun
execfile(file_path)

print(type(x))

# lines = gCodeGenerator(lists, extrusion_rate)
# ---------- end type ----------
ghpython_script = GhPythonScript(x=xy)  # -> out
# ---------- ghpython_script: Python ----------
print(type(x))
# ---------- end ghpython_script ----------
number_slider_4 = Slider(0, range=0..1)
move_2 = Move(Geometry=rotate_2.Geometry, Motion=pt_2)  # -> Geometry, Transform
pt_3 = Point(Point(0, 0, 0))
rotate_3 = Rotate(Geometry=crv_6, Angle=number_slider_4, Plane=pt_3)  # -> Geometry, Transform
end_start_gcode = GhPythonScript(lines=flatten(lists_to_gcode_2.lines))  # -> out, a; inputs lines: list
# ---------- end_start_gcode: Python ----------
__author__ = "JesusBarney"
__version__ = "2019.04.06"

import rhinoscriptsyntax as rs

#move_mode = "G1"
#extrusion_rate = 0.12
#extrusion_start = 0
offset_z = 0.10
#speed = 500
g_code = []

initiate_gcode = """;FLAVOR:Marlin
;TIME:0
;Filament used: 6.75709m
;Layer height: 1.1
;MINX:-47.897
;MINY:-47.91
;MINZ:1.1
;MAXX:47.895
;MAXY:47.91
;MAXZ:99
;Generated with Cura_SteamEngine 4.1.0
M104 S210
M105
M109 S210
M83 ;relative extrusion mode
G28 ;Home
G1 Z15.0 F6000 ;Move the platform down 15mm
;Prime the extruder
G92 E0
G1 F200 E3
G92 E0
G92 E0
G92 E0
G1 F1500 E-6.5
;LAYER_COUNT:90
;LAYER:0
M107
M203 Z50
M205 X30 Y30
G0 F1500 X30 Y-3.573 Z1.1
M205 X20 Y20
;TYPE:SKIRT
G1 F1500
G1 X0 Y0 Z20 E100"""

# ;TIME_ELAPSED:751.629903
# G1 F1500 E510.30819   

end_gcode = """M205 X30 Y30 Z30 E-100
G0 F3000 X-43.931 Y-19.114
G0 X-40.689 Y-17.797
M205 X20 Y20
M203 Z299792458000
M107
M104 S0
M140 S0
;Retract the filament
G92 E1
G1 E-1 F300
G28 X0 Y0
M84
M83 ;absolute extrusion mode
M104 S0"""

print initiate_gcode

for line in lines:
    print line

print end_gcode
# ---------- end end_start_gcode ----------
layer_slicing = GhPythonScript(
    geometry=rotate_3.Geometry,
    slice_geo=move_2.Geometry,
    layer_height=Slider(2.2, range=0..10),
    extra_z=number_slider_3,
    layer_count=number_slider_2)  # -> out, ori_crvs, crv_sets, a, b, c, d; inputs geometry: GeometryBase
# ---------- layer_slicing: Python ----------
import brickSlicer as bs

ori_crvs = bs.slicing(geometry, layer_height = layer_height, layer_count = layer_count, extra_z = extra_z)
crv_sets, a, b, c, d = bs.splitter(ori_crvs, slicing_object = slice_geo, split_type = "object")
# ---------- end layer_slicing ----------
claylibrarypathlocation = FilePath("/Volumes/GoogleDrive/My Drive/ClayPrinting/")
number_slider_5 = Slider(5, range=0.5..12)
python_3 = GhPythonScript(x=layer_slicing.crv_sets)  # -> out, a
# ---------- python_3: Python ----------
for crv in x:
    
    print(type(crv))
    print(crv.GetLength())
# ---------- end python_3 ----------
path_assignment = GhPythonScript(x=claylibrarypathlocation)  # -> out, a
# ---------- path_assignment: Python ----------
import sys

sys.path.append(x)

print sys.path
# ---------- end path_assignment ----------
layer_structure = GhPythonScript(
    x=claylibrarypathlocation,
    ori_crvs=layer_slicing.ori_crvs,
    crv_set=layer_slicing.crv_sets,
    spacing=number_slider_5,
    direction=Toggle(True),
    item=Toggle(False))  # -> out, layers, set_tuple, a; inputs ori_crvs: list, crv_set: list, direction: Boolean, item: Boolean
# ---------- layer_structure: Python ----------
import sys

sys.path.append(x)

print sys.path

import vertexClass as vc

if direction:
    
    dir = 1
    
else:
    
    dir = -1
    
if item:
    
    item = 0

else:
    
    item = 1

print(ori_crvs)

layers, set_tuple, _ = vc.moveSet(crv_set, ori_crvs, spacing, dir, item)

a = ori_crvs
# ---------- end layer_structure ----------
pline = PolyLine(Closed=False)
crv_8 = Curve(layer_slicing.ori_crvs)
python_4 = GhPythonScript()  # -> out, a
# ---------- python_4: Python ----------
a = [[2, 1, 1], [1, 2, 3], [0, 1, 2]]
# ---------- end python_4 ----------
crv_9 = Curve()
list = ValueList({"dotMap": 0, "ellipsoidBumpMap": 1, "sinWarp": 2, "cylinderMap": 3, "layerMap": 4}, selected="sinWarp")
pattern = GhPythonScript(
    layers=layer_structure.layers,
    set_tuple=layer_structure.set_tuple,
    sub_length=Slider(2, range=0..10),
    layer_count=Slider(70, range=0..100),
    layer_height=Slider(2.3, range=0..10),
    edge_easing=Toggle(True),
    edge_ease_zero=Slider(0, range=0..100),
    edge_ease_end=Slider(21.9, range=0..100),
    pattern_type=list,
    period=Slider(20, range=0..100),
    phase_shift=Slider(0.1, range=0..2),
    spacing=Slider(40, range=0..100),
    radius=Slider(30, range=0..100),
    max_val=Slider(5, range=0..100),
    height=Slider(26.9, range=0..100),
    radius_bot=Slider(0, range=0..10),
    pattern_set=python_4.a,
    direction=Toggle(False))  # -> out, curve_list, a, b, c; inputs layers: list, set_tuple: list, layer_count: Int32, layer_height: Int32, edge_easing: Boolean, pattern_type: Int32, pattern_set: list, direction: Boolean
# ---------- pattern: Python ----------
# snippet of code to make this python component look for it's code in the parent folder of the .gh file

import os

ghComp = ghenv.Component
ghDoc = ghComp.OnPingDocument()

file_name = "patternGenv2.py"
gh_file_location = ghDoc.FilePath
parent = os.path.dirname(os.path.realpath(gh_file_location))

file_path = os.path.join(parent, file_name)

# hacky-hacky run-fun
execfile(file_path)

pattern_map = PatternMap(layers, set_tuple)
pattern_map.build()
# pattern_map.subdivide(sub_length)
# pattern_map.generate(layer_height, layer_count)

if edge_easing:

    pattern_map.edgeEasing(edge_ease_zero, edge_ease_end)

if pattern_type == 0:
    
    pattern_map.dotMap(spacing, radius, max_val, direction)

elif pattern_type == 1:

    pattern_map.ellipsoidBumpMap(spacing, radius, max_val, direction)

elif pattern_type == 2:

    pattern_map.sinWarp(period, max_val, phase_shift, direction)

elif pattern_type == 3:

    if radius_bot < .01:

        radius_bot = radius

    else:

        radius_bot = radius_bot

    pattern_map.cylinderMap(spacing, height, radius, max_val, radius_bot, direction)

elif pattern_type == 4:

    pattern_map.layerMap(spacing, pattern_set, radius, max_val, direction)


c = pattern_map.makeMesh()
b = pattern_map.makeCurves()
# ---------- end pattern ----------
re_slicer = GhPythonScript(ori_crvs=pattern.b, slice_geo=move_2.Geometry, layer_count=number_slider_2)  # -> out, ori_crvs, crv_sets, a, b, c, d; inputs ori_crvs: list
# ---------- re_slicer: Python ----------
# snippet of code to make this python component look for it's   code in the parent folder of the .gh file

import os

ghComp = ghenv.Component
ghDoc = ghComp.OnPingDocument()

file_name = "brickSlicer.py"
gh_file_location = ghDoc.FilePath
parent = os.path.dirname(os.path.realpath(gh_file_location))

file_path = os.path.join(parent, file_name)
print(file_path)

parent = os.path.dirname(os.path.realpath(parent))
parent = os.path.dirname(os.path.realpath(parent))
print(parent)

# hacky-hacky run-fun
execfile(file_path)

print(type(slice_geo))

crv_sets, a, b, c, d = splitter(ori_crvs, slicing_object = slice_geo, split_type = "object")
# ---------- end re_slicer ----------
crv_10 = Curve(pattern.b)
mesh_4 = Mesh(pattern.c)
number_slider_6 = Slider(1.4, range=0.5..12)
layer_structure_2 = GhPythonScript(
    ori_crvs=re_slicer.ori_crvs,
    crv_set=re_slicer.crv_sets,
    spacing=number_slider_5,
    direction=Toggle(False),
    item=Toggle(False))  # -> out, layers, set_tuple, a; inputs ori_crvs: list, crv_set: list, direction: Boolean, item: Boolean
# ---------- layer_structure_2: Python ----------
# snippet of code to make this python component look for it's   code in the parent folder of the .gh file

import os

ghComp = ghenv.Component
ghDoc = ghComp.OnPingDocument()

file_name = "vertexClass.py"
gh_file_location = ghDoc.FilePath
parent = os.path.dirname(os.path.realpath(gh_file_location))

file_path = os.path.join(parent, file_name)
print(file_path)

parent = os.path.dirname(os.path.realpath(parent))
parent = os.path.dirname(os.path.realpath(parent))
print(parent)

# hacky-hacky run-fun
execfile(file_path)

if direction:
    
    dir = 1
    
else:
    
    dir = -1
    
if item:
    
    item = 0

else:
    
    item = 1

print(ori_crvs)

layers, set_tuple, _ = moveSet(crv_set, ori_crvs, spacing, dir, item)

a = ori_crvs
# ---------- end layer_structure_2 ----------
pt_4 = Point(<point referenced from the Rhino model>)
pt_5 = Point(<point referenced from the Rhino model>)
python_5 = GhPythonScript()  # -> out, a
# ---------- python_5: Python ----------
a = [[2, 1, 1], [1, 2, 3], [0, 1, 2],[4, 1.5,6]]
# ---------- end python_5 ----------
rotate_4 = Rotate(Geometry=pt_5, Angle=number_slider_4, Plane=pt_3)  # -> Geometry, Transform
rotate_5 = Rotate(Geometry=pt_4, Angle=number_slider_4, Plane=pt_3)  # -> Geometry, Transform
scale_2 = Scale(Geometry=rotate_5.Geometry, Center=Point(0, 0, 0), Factor=number_slider)  # -> Geometry, Transform
scale_3 = Scale(Geometry=rotate_4.Geometry, Center=Point(0, 0, 0), Factor=number_slider)  # -> Geometry, Transform
list_2 = ValueList({"dotMap": 0, "ellipsoidBumpMap": 1, "sinWarp": 2, "cylinderMap": 3, "layerMap": 4}, selected="layerMap")
line_2 = Line(Line((430.4850107, 65.01726778, 0), (436.8467708, 77.74078793, 0)))
crva = Curve(<curve referenced from the Rhino model>)
python_6 = GhPythonScript()  # -> out, a
# ---------- python_6: Python ----------
import sys

sys.path.append("/Volumes/GoogleDrive/My Drive/ClayPrinting")

import brickSlicer as bs

reload(bs)


bs.slicing
# ---------- end python_6 ----------
pattern_2 = GhPythonScript(
    layers=layer_structure_2.layers,
    set_tuple=layer_structure_2.set_tuple,
    sub_length=Slider(2, range=0..10),
    layer_count=Slider(70, range=0..100),
    layer_height=Slider(2.3, range=0..10),
    edge_easing=Toggle(True),
    edge_ease_zero=Slider(0, range=0..100),
    edge_ease_end=Slider(21.9, range=0..100),
    pattern_type=list_2,
    period=Slider(27.9, range=0..100),
    phase_shift=Slider(0.1, range=0..2),
    spacing=Slider(30, range=0..100),
    radius=Slider(15, range=0..100),
    max_val=Slider(10, range=0..100),
    height=Slider(26.9, range=0..100),
    radius_bot=Slider(0, range=0..10),
    pattern_set=python_5.a,
    direction=Toggle(False))  # -> out, curve_list, a, b, c; inputs layers: list, set_tuple: list, layer_count: Int32, layer_height: Int32, edge_easing: Boolean, pattern_type: Int32, pattern_set: list, direction: Boolean
# ---------- pattern_2: Python ----------
# snippet of code to make this python component look for it's code in the parent folder of the .gh file

import os

ghComp = ghenv.Component
ghDoc = ghComp.OnPingDocument()

file_name = "patternGenv2.py"
gh_file_location = ghDoc.FilePath
parent = os.path.dirname(os.path.realpath(gh_file_location))

file_path = os.path.join(parent, file_name)

# hacky-hacky run-fun
execfile(file_path)

pattern_map = PatternMap(layers, set_tuple)
pattern_map.build()
# pattern_map.subdivide(sub_length)
# pattern_map.generate(layer_height, layer_count)

if edge_easing:

    pattern_map.edgeEasing(edge_ease_zero, edge_ease_end)

if pattern_type == 0:
    
    pattern_map.dotMap(spacing, radius, max_val, direction)

elif pattern_type == 1:

    pattern_map.ellipsoidBumpMap(spacing, radius, max_val, direction)

elif pattern_type == 2:

    pattern_map.sinWarp(period, max_val, phase_shift, direction)

elif pattern_type == 3:

    if radius_bot < .01:

        radius_bot = radius

    else:

        radius_bot = radius_bot

    pattern_map.cylinderMap(spacing, height, radius, max_val, radius_bot, direction)

elif pattern_type == 4:

    pattern_map.layerMap(spacing, pattern_set, radius, max_val, direction)


c = pattern_map.makeMesh()
b = pattern_map.makeCurves()
a = pattern_map.pts_set
# ---------- end pattern_2 ----------
re_slicer_2 = GhPythonScript(ori_crvs=pattern_2.b, slice_geo=move_2.Geometry, layer_count=number_slider_2)  # -> out, ori_crvs, crv_sets, a, b, c, d; inputs ori_crvs: list
# ---------- re_slicer_2: Python ----------
import brickSlicer as bs

crv_sets, a, b, c, d = bs.splitter(ori_crvs, slicing_object = slice_geo, split_type = "object")
# ---------- end re_slicer_2 ----------
number_slider_7 = Slider(2, range=0..10)
number_slider_8 = Slider(2, range=0..10)
crv_11 = Curve(<curve referenced from the Rhino model>)
crv_12 = Curve(re_slicer_2.ori_crvs)
bbox = BoundingBox(Content=crv_12, Plane=PlaneXY(0, 0, 0))  # -> Box, Box_2
boxprop = BoxProperties(Box=bbox.Box)  # -> Center, Diagonal, Area, Volume, Degeneracy
pdecon = Deconstruct(Point=boxprop.Center)  # -> XComponent, YComponent, ZComponent
python_7 = GhPythonScript(
    b_pt=scale_2.Geometry,
    b_pt_2=scale_3.Geometry,
    height=Slider(300, range=0..1000),
    bot_rad=Slider(35, range=0..100),
    top_rad=Slider(15, range=0..100),
    resolution=Slider(16, range=0..100),
    alfa=Slider(2.09, range=0..10),
    heights=pdecon.ZComponent)  # -> out, a, slices_a, slices_b, main_line_set, line_set; inputs b_pt: Point3d, b_pt_2: Point3d, resolution: Int32, heights: list
# ---------- python_7: Python ----------
import Rhino.Geometry as rg
import brickSlicer as bs
from copy import deepcopy as dc

reload(bs)

b_pt = rg.Point3d(b_pt.X, b_pt.Y, 0.0)
b_pt_2 = rg.Point3d(b_pt_2.X, b_pt_2.Y, 0.0)

# defining the connections

# main connection

distance = b_pt.DistanceTo(b_pt_2)
pt_delta = (b_pt_2 - b_pt) / distance

main_line = rg.Line(b_pt, b_pt + pt_delta)

# b_pt

rot_1 = rg.Transform.Rotation(alfa, b_pt)
rot_2 = rg.Transform.Rotation(-alfa, b_pt)

# b_pt_2

mv = rg.Transform.Translation(b_pt_2 - b_pt)
rot_34 = rg.Transform.Rotation(3.1415927, b_pt_2)

line_a = dc(main_line)
line_a.Transform(rot_1)

line_b = dc(main_line)
line_b.Transform(rot_2)

line_c = dc(line_a)
line_c.Transform(mv)
line_c.Transform(rot_34)

line_d = dc(line_b)
line_d.Transform(mv)
line_d.Transform(rot_34)

# mid lines

mid_pt = (b_pt + b_pt_2) * .5
mv = rg.Transform.Translation(mid_pt - b_pt)
rot_a = rg.Transform.Rotation(1.5707963268, mid_pt)
rot_b = rg.Transform.Rotation(-1.5707963268, mid_pt)

line_e = dc(main_line)
line_e.Transform(mv)
line_e.Transform(rot_a)

line_f = dc(main_line)
line_f.Transform(mv)
line_f.Transform(rot_b)

pin_a = bs.Pin(b_pt, height, bot_rad, top_rad, resolution)
pin_b = bs.Pin(b_pt_2, height, bot_rad, top_rad, resolution)

a = [pin_a.createGeometry(), pin_b.createGeometry()]

slices_a = [pin_a.createSlice(h) for h in heights]
slices_b = [pin_b.createSlice(h) for h in heights]

lines = [line_a, line_b, line_c, line_e, line_f, line_d]

main_line_set = []
line_set = []

for h in heights:
    
    mv = rg.Transform.Translation(rg.Vector3d(0, 0, h))
    
    tmp_line_set = []
    
    loc_main_line = dc(main_line)
    loc_main_line.Transform(mv)
    
    main_line_set.append(loc_main_line)
    
    for line in lines:
        
        loc_line = dc(line)
        
        loc_line.Transform(mv)
        
        tmp_line_set.append(loc_line)
        
    line_set.append(tmp_line_set)
# ---------- end python_7 ----------
eval = EvaluateCurve(Curve=python_7.main_line_set, Parameter=Slider(1, range=0..1))  # -> Point, Tangent, Angle
python_8 = GhPythonScript(x=python_7.line_set)  # -> out, a; inputs x: list
# ---------- python_8: Python ----------
a = x[0]
# ---------- end python_8 ----------
mesh_5 = Mesh(pattern_2.c)
list_3 = ValueList({"Inside": "inside", "Outside": "outside"}, selected="Inside")
crv_b = Curve(python_7.slices_b)
end = EndPoints(Curve=python_8.a)  # -> Start, End
crv_13 = Curve(pattern_2.b)
mesh_6 = Mesh(pattern_2.c)
split = SplitList(List=pdecon.ZComponent, Index=Slider(10, range=0..10))  # -> ListA, ListB
list_4 = ValueList({"Inside": "inside", "Outside": "outside"}, selected="Inside")
crv_a = Curve(python_7.slices_a)
python_9 = GhPythonScript(crv=crv_a, distance=number_slider_7, direction=list_3, count=number_slider_8)  # -> out, a, b; inputs count: Int32
# ---------- python_9: Python ----------
import generalFunctions as gf

reload(gf)

b = crv

a = gf.offsetCurveSet(crv, distance, direction, count)
# ---------- end python_9 ----------
python_10 = GhPythonScript(x=pattern_2.a)  # -> out, a; inputs x: list
# ---------- python_10: Python ----------
print(x[0])
# ---------- end python_10 ----------
number_slider_9 = Slider(3.6, range=-10..10)
python_11 = GhPythonScript(x=crv_11)  # -> out, a, x; inputs x: Curve
# ---------- python_11: Python ----------
import Rhino.Geometry as rg
from copy import deepcopy as dc

pln = rg.Plane(x.PointAt(0.0), rg.Vector3d(0,0,1))

tmp_offset_crv_1 = x.Offset(pln, 1.0, .01, rg.CurveOffsetCornerStyle.Round)[0]
tmp_offset_crv_2 = x.Offset(pln, -1.0, .01, rg.CurveOffsetCornerStyle.Round)[0]

x.Domain = rg.Interval(0,1)
a = dc(x)

if tmp_offset_crv_1.GetLength() < tmp_offset_crv_2.GetLength():
    
    print("curve needed to be reversed!")

    a.Reverse()
    
a
a.Domain = rg.Interval(0,1)
# ---------- end python_11 ----------
python_12 = GhPythonScript(crv=crv_b, distance=number_slider_7, direction=list_3, count=number_slider_8)  # -> out, a, b; inputs count: Int32; same code as python_9
graft = GraftTree(Tree=python_7.main_line_set, IncludeEmptyLists=True, IncludeNullItems=True)
crv_14 = Curve(crv_13)
item = ListItem(List=crv_13, Index=0, Wrap=True)
python_13 = GhPythonScript(crv=re_slicer_2.ori_crvs, distance=Slider(2.5, range=0..10), direction=list_4, count=Slider(2, range=0..10))  # -> out, a, b; inputs count: Int32; same code as python_9
toggle = BooleanToggle(True)
number_slider_10 = Slider(300, range=0..1000)
list_5 = ValueList({"detached", "crossing"}, selected="crossing")
path_mapper_2 = PathMapper(python_9.a, source="{A;B;C;D;E;F;G;H;I;J;K}", target="{K}")
eval_2 = EvaluateCurve(Curve=[python_11.a, python_11.x], Parameter=Slider(0.51, range=0..1))  # -> Point, Tangent, Angle
path_mapper_3 = PathMapper(graft, source="{A;B;C;D;E;F;G;H;I;J;K}", target="{K}")
path_mapper_4 = PathMapper(python_12.a, source="{A;B;C;D;E;F;G;H;I;J;K}", target="{K}")
python_14 = GhPythonScript(x=item)  # -> out, a; inputs x: Curve
# ---------- python_14: Python ----------
import Rhino.Geometry as rg
import math

def crvOrienter(crv):

    x_or_y = True
    rot_angle = 0.0
    area = 9999999

    for i in range(90):

        angle = math.pi * i / 180

        # bounding box translation
        x_vec = rg.Vector3d(math.cos(angle), math.sin(angle), 0.0)
        y_vec = rg.Vector3d(- math.sin(angle), math.cos(angle), 0.0)
        b_box = crv.GetBoundingBox(rg.Plane(rg.Point3d(0,0,0), x_vec, y_vec))

        x_delta = b_box.Max.X - b_box.Min.X
        y_delta = b_box.Max.Y - b_box.Min.Y

        loc_are = x_delta * y_delta

        if loc_are < area:

            rot_angle = angle

            area = loc_are

            if x_delta < y_delta:

                x_or_y = False

            else:

                x_or_y = True

    if x_or_y:

        x_vec = rg.Vector3d(1, 0, 0)
        y_vec = rg.Vector3d(0, 1, 0)

    else:

        x_vec = rg.Vector3d(0, 1, 0)
        y_vec = rg.Vector3d(-1, 0, 0)

    x_vec.Transform(rg.Transform.Rotation(rot_angle, rg.Point3d(0,0,0)))
    y_vec.Transform(rg.Transform.Rotation(rot_angle, rg.Point3d(0,0,0)))

    tmp_pln = rg.Plane(rg.Point3d(0,0,0), x_vec, y_vec)
    
    b_box = crv.GetBoundingBox(tmp_pln)
    
    x0, x1 = b_box.Min.X, b_box.Max.X
    y1, y0 = b_box.Max.Y, b_box.Min.Y
    
    crv = rg.Rectangle3d(tmp_pln, rg.Interval(x0,x1), rg.Interval(y0,y1))
    
    return crv
    
a = crvOrienter(x)
# ---------- end python_14 ----------
panel_3 = Panel(python_9.out)
list_6 = ValueList({"detached", "crossing"}, selected="crossing")
crv_15 = Curve(<curve referenced from the Rhino model>)
crv_16 = Curve()
panel_4 = Panel(python_11.out)
item_2 = ListItem(List=crv_12, Index=Slider(34, range=0..100), Wrap=True)
line_3 = Line(Line((-12.72990472, 11.62263406, 0), (-16.16061334, 5.766407065, 0)))
panel_5 = Panel(python_13.a)
cls = Closed(Curve=python_13.a)  # -> Closed, Periodic

# ---- group: Brim
cluster = Cluster(crv=python_7.main_line_set, shift=Slider(1, range=0..10), z_height=number_slider_3)  # -> crv_3, list

# ----
crv_17 = Curve(cluster.crv_3)
divide = DivideCurve(Curve=crv_15, Count=10, Kinks=True)  # -> Points, Tangents, Parameters
python_15 = GhPythonScript(x=divide.Points)  # -> out, b, a; inputs x: list
# ---------- python_15: Python ----------
b = [pt for pt in x]
a = [b + [b[0]]]
# ---------- end python_15 ----------
offset = OffsetCurve(Curve=python_14.a, Distance=Slider(20, range=0..25), Plane=PlaneXY(0, 0, 0), Corners=1)
python_16 = GhPythonScript(
    crvs=path_mapper_2,
    split_distance=number_slider_9,
    x=claylibrarypathlocation,
    split_type=list_5,
    side_bool=toggle,
    main_line=path_mapper_3)  # -> out, a, b, c, d, e, f; inputs crvs: list, side_bool: Boolean, main_line: Line
# ---------- python_16: Python ----------
import sys

sys.path.append(x)

print sys.path

import layerFunctions as lf

reload(lf)

later_set = lf.LinkingLayers(crvs, split_distance, side_bool, split_type)
later_set.splitLineGeneration(split_line = main_line, angle = -.05)
a, b, c, d, e = later_set.createOrganisedCurves()
f = later_set.joinCrvs()
# ---------- end python_16 ----------
python_17 = GhPythonScript(
    crvs=python_13.a,
    split_distance=Slider(-1.1, range=-10..10),
    x=claylibrarypathlocation,
    split_type=list_6,
    side_bool=Toggle(True),
    split_axis=line_3)  # -> out, a, b, c, d, e, f; inputs crvs: list, side_bool: Boolean, split_axis: Line
# ---------- python_17: Python ----------
import sys

sys.path.append(x)

print sys.path

import layerFunctions as lf

reload(lf)

later_set = lf.LinkingLayers(crvs, split_distance, side_bool, split_type)
later_set.splitLineGeneration(split_axis)
a, b, c, d, e = later_set.createOrganisedCurves()
f = later_set.joinCrvs()
# ---------- end python_17 ----------
python_18 = GhPythonScript(
    crvs=path_mapper_4,
    split_distance=number_slider_9,
    x=claylibrarypathlocation,
    split_type=list_5,
    side_bool=toggle,
    main_line=path_mapper_3)  # -> out, a, b, c, d, e, f; inputs crvs: list, side_bool: Boolean, main_line: Line; same code as python_16
number_slider_11 = Slider(2, range=0..50)
number_slider_12 = Slider(2, range=0..10)
panel_6 = Panel(python_16.out)
item_3 = ListItem(List=python_13.a, Index=0, Wrap=True)  # -> Item1, Item
divide_2 = DivideCurve(Curve=offset, Count=1, Kinks=True)  # -> Points, Tangents, Parameters
sift = SiftPattern(List=python_13.a, SiftPattern=cls.Closed)  # -> Output0, Output1
panel_7 = Panel(python_14.out)
clean = CleanTree(RemoveNulls=True, RemoveInvalid=True, RemoveEmpty=False, Tree=sift.Output0)
pline_2 = PolyLine(Vertices=python_18.f, Closed=True)  # -> flatten(Polyline)
pline_3 = PolyLine(Vertices=python_16.f, Closed=True)  # -> flatten(Polyline)
python_19 = GhPythonScript(x=divide_2.Points)  # -> out, a; inputs x: list
# ---------- python_19: Python ----------
a = [[pt for pt in x]]
# ---------- end python_19 ----------
merge_2 = Merge(Data1=flatten(python_19.a), Data2=flatten(pattern_2.a))
lists_to_gcode_3 = GhPythonScript(lists=merge_2, extrusion_rate=Slider(0.5, range=0..10), extra_z=Slider(1.5, range=0..10))  # -> out, lines; inputs lists: list
# ---------- lists_to_gcode_3: Python ----------
# snippet of code to make this python component look for it's code in the parent folder of the .gh file

import os

ghComp = ghenv.Component
ghDoc = ghComp.OnPingDocument()

file_name = "simpleStartStop.py"
gh_file_location = ghDoc.FilePath
parent = os.path.dirname(os.path.realpath(gh_file_location))

file_path = os.path.join(parent, file_name)
print(file_path)

# hacky-hacky run-fun
execfile(file_path)

lines = gCodeGenerator(lists, extrusion_rate, extra_z)
# ---------- end lists_to_gcode_3 ----------
crv_18 = Curve(python_17.d)
crv_19 = Curve(clean)
pt_6 = Point(python_17.a)
crv_20 = Curve(python_17.b)
pline_4 = PolyLine(Vertices=python_17.f, Closed=False)  # -> flatten(Polyline)
domain = Domain(crv_19)
item_4 = ListItem(List=pline_4, Index=0, Wrap=True)
eval_3 = EvaluateCurve(Curve=crv_19, Parameter=Slider(0, range=0..1))  # -> Point, Tangent, Angle
python_20 = GhPythonScript(
    x=python_7.main_line_set,
    y=crv_a,
    z=crv_b,
    z_offseted=pline_3,
    y_offseted=pline_2,
    distance=number_slider_11,
    count=number_slider_12)  # -> out, a, b, c, d, e, f, z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; inputs x: Line, y: Curve, z: Curve, z_offseted: Polyline, y_offseted: Polyline, count: Int32
# ---------- python_20: Python ----------
import layerFunctions as lf
import generalFunctions as gf
from copy import deepcopy as dc

reload(lf)
reload(gf)

print("---- !!! New Item !!! ----")

z_boundary = dc(z)
y_boundary = dc(y)

# y = gf.curveToPolyline(y)
# z = gf.curveToPolyline(z)

line_set = lf.LineSet(x, distance, count)
line_set.createLines()
print(line_set.lines)
print("first trim")
g = line_set.trimLines(y, False)
print("second trim")
h = line_set.trimLines(z, True)
a = line_set.joinLines()
b = line_set.lines
c = line_set.getStartEnd()
d = line_set.getStartEnd(False)
# ---------- end python_20 ----------
eval_4 = EvaluateCurve(Curve=crv_19, Parameter=Slider(1, range=0..1))  # -> Point, Tangent, Angle
python_21 = GhPythonScript(
    x=python_7.main_line_set,
    y=crv_a,
    z=crv_b,
    z_offseted=pline_2,
    y_offseted=pline_3,
    distance=number_slider_11,
    count=number_slider_12)  # -> out, a, b, c, d, e, f, z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; inputs x: Line, y: Curve, z: Curve, z_offseted: Polyline, y_offseted: Polyline, count: Int32
# ---------- python_21: Python ----------
import layerFunctions as lf
import generalFunctions as gf
from copy import deepcopy as dc

reload(lf)
reload(gf)

print("---- !!! New Item !!! ----")

z_boundary = dc(z)
y_boundary = dc(y)

# y = gf.curveToPolyline(y)
# z = gf.curveToPolyline(z)

line_set = lf.LineSet(x, distance, count)
line_set.createLines()
print(line_set.lines)
print("first trim")
g = line_set.trimLines(y, False)
print("second trim")
h = line_set.trimLines(z, True)
a = line_set.joinLines()
b = line_set.lines
c = line_set.getStartEnd()
d = line_set.getStartEnd(False)

z = gf.polylineTypesToCurve(z_offseted)
y = gf.polylineTypesToCurve(y_offseted)

c = list(c)

y_set, pts = gf.layer2ptIntersect(y, c)

y = gf.longestCurve(y_set)

z_set, _ = gf.layer2ptIntersect(z, d)
z = gf.longestCurve(z_set)

y = gf.curveToPolyline(y)
z = gf.curveToPolyline(z)

y = [pt for pt in y.ToArray()]
z = [pt for pt in z.ToArray()]

f = y + z + [y[0]]

z = gf.polylineTypesToCurve(z_boundary)
y = gf.polylineTypesToCurve(y_boundary)

y_set, _ = gf.layer2ptIntersect(y, c)
y = gf.longestCurve(y_set)

z_set, _ = gf.layer2ptIntersect(z, d)
z = gf.longestCurve(z_set)

y = gf.curveToPolyline(y)
z = gf.curveToPolyline(z)

y = [pt for pt in y.ToArray()]
z = [pt for pt in z.ToArray()]

boundary_curve = y + z + [y[0]]
# ---------- end python_21 ----------
panel_8 = Panel(lists_to_gcode_3.out)
eval_5 = EvaluateCurve(Curve=item_4, Parameter=Slider(256, range=0..1000))  # -> Point, Tangent, Angle
flatten = FlattenTree(Tree=python_16.f, Path="{0}")
panel_10 = Panel(python_17.out)
line_4 = Line(python_21.h)
path_mapper_5 = PathMapper(python_21.f, source="{A;B;C;D;E;F;G;H;I;J;K}", target="{K}")
path_mapper_6 = PathMapper(python_21.boundary_curve, source="{A;B;C;D;E;F;G;H;I;J;K}", target="{K}")
line_5 = Line(python_20.h)
pt_7 = Point(python_20.c)
crv_21 = Curve(python_20.y)
pline_5 = PolyLine(Vertices=python_20.y, Closed=False)
item_5 = ListItem(List=pline_3, Index=0, Wrap=True)
panel_11 = Panel(python_21.out)
offset_2 = OffsetCurve(Curve=item_3.Item1, Distance=Slider(-1.1, range=-10..10), Plane=PlaneXY(0, 0, 0), Corners=1)  # -> flatten(Curve)
exteriorcrv = Curve(<curve referenced from the Rhino model>)
crv_22 = Curve(flatten(item_3.Item1))
pline_6 = PolyLine(Vertices=path_mapper_5, Closed=True)  # -> flatten(Polyline)
pline_7 = PolyLine(Vertices=path_mapper_6, Closed=True)  # -> flatten(Polyline)
item_6 = ListItem(List=offset_2, Index=Slider(9, range=0..100), Wrap=True)
python_22 = GhPythonScript(
    lines=flatten(python_7.line_set),
    y=flatten(offset_2),
    z=flatten(pline_6),
    main_exterior_crv=flatten(crv_22),
    inner_boundary_crv=pline_7,
    distance=Slider(2, range=0..10),
    count=Slider(2, range=0..10))  # -> out, a, b, c, d, e, f, z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; inputs y: Curve, z: Curve, main_exterior_crv: Polyline, inner_boundary_crv: Polyline, count: Int32
# ---------- python_22: Python ----------
import Rhino.Geometry as rg
import layerFunctions as lf
import generalFunctions as gf
import ghpythonlib.components as gh

reload(lf)
reload(gf)

exterior_curve_main = gf.curveToPolyline(y)
inner_curve = gf.curveToPolyline(z)

print("am I closed?")
print(inner_curve.IsClosed)

line_vis_set = []
pt_vis_set = []
curve_vis = []

for i in range(len(lines) - 1):

    line_set = lf.LineSet(lines[i], distance, count)
    line_set.createLines()
    line_set.trimLines(exterior_curve_main, True)
    tmp_lines = line_set.trimLines(inner_boundary_crv, False)
    
    line_vis_set.extend(tmp_lines)
    
    a = line_set.joinLines()
    line_set.lines
    c = line_set.getStartEnd()
    end_pts = line_set.getStartEnd(False)
    
    pt_vis_set.extend(c)

    
    z = gf.polylineTypesToCurve(inner_curve)

    d, _ = gf.layer2ptIntersect(z, c)

    e = gf.longestCurve(d)
    
    curve_vis.extend(d)

    e = gf.curveToPolyline(e)
    
    a.reverse()

    f = a + [pt for pt in e.ToArray()]
    
    inner_curve = gh.PolyLine(f, True)
 
    print("am I closed?")
    print(inner_curve.IsClosed)

line_set = lf.LineSet(lines[-1], distance, count)
line_set.createLines()
line_set.trimLines(exterior_curve_main, True)
tmp_lines = line_set.trimLines(inner_boundary_crv, False)

line_vis_set.extend(tmp_lines)

a = line_set.joinLines()
line_set.lines
c = line_set.getStartEnd()
end_pts = line_set.getStartEnd(False)

pt_vis_set.extend(c)


z = gf.polylineTypesToCurve(inner_curve)

d, _ = gf.layer2ptIntersect(z, c)

e = gf.longestCurve(d)

curve_vis.extend(d)

e = gf.curveToPolyline(e)

a.reverse()

f = [a[-1]] + [pt for pt in e.ToArray()] + [a[0]]

inner_curve = gh.PolyLine(f, False)

print("am I closed?")
print(inner_curve.IsClosed)
# ---------- end python_22 ----------
copyoflink_offset = GhPythonScript()  # -> out, a
# ---------- copyoflink_offset: Python ----------
z = gf.polylineTypesToCurve(z_offseted)
y = gf.polylineTypesToCurve(y_offseted)

y_set, _ = gf.layer2ptIntersect(y, c)
y = gf.longestCurve(y_set)

z_set, _ = gf.layer2ptIntersect(z, d)
z = gf.longestCurve(z_set)

y = gf.curveToPolyline(y)
z = gf.curveToPolyline(z)

y = [pt for pt in y.ToArray()]
z = [pt for pt in z.ToArray()]

f = y + z + [y[0]]
# ---------- end copyoflink_offset ----------
pt_8 = Point(python_22.pt_vis_set)
crv_23 = Curve(pline_4)
crv_24 = Curve(python_22.inner_curve)
crv_25 = Curve(python_22.curve_vis)
python_23 = GhPythonScript(inner_curve=crv_24, shell_curve=crv_23)  # -> out, flatten(shell_pt_set); inputs inner_curve: Curve, shell_curve: Curve
# ---------- python_23: Python ----------
import Rhino.Geometry as rg
import layerFunctions as lf
import generalFunctions as gf
import ghpythonlib.components as gh

inner_curve = gf.curveToPolyline(inner_curve)
inner_curve = [pt for pt in inner_curve.ToArray()]
shell_curve.Domain = rg.Interval(0,1)

end_pts_shell = [shell_curve.PointAt(0.0), shell_curve.PointAt(1.0)]
end_pts_inner_curve = [inner_curve[0], inner_curve[-1]]

shell_pl_set = gf.curveToPolyline(shell_curve)

shell_pt_set = [pt for pt in shell_pl_set.ToArray()]

shell_crv = gh.PolyLine(shell_pt_set, True)

y_set, _ = gf.layer2ptIntersect(shell_crv, end_pts_inner_curve)
shell_pt_set = [pt for pt in gf.curveToPolyline(gf.longestCurve(y_set)).ToArray()]

inner_curve.reverse()

total_set = shell_pt_set + inner_curve[1:-1]

total_crv = gh.PolyLine(total_set, True)

y_set, _ = gf.layer2ptIntersect(total_crv, end_pts_shell)
shell_pt_set = gf.curveToPolyline(gf.longestCurve(y_set))
# ---------- end python_23 ----------
python_24 = GhPythonScript(x=python_23.shell_pt_set)  # -> out, b, a; inputs x: list
# ---------- python_24: Python ----------
b = [[pt for pt in x]]
# ---------- end python_24 ----------
merge_3 = Merge(Data1=flatten(python_15.a), Data2=flatten(python_24.b))

# ---- group: G-Code
start_stop_feedrate_in_mm_min = Slider(100, range=0..1000)
feed_rate_in_mm_s = Slider(25, range=0..100)
list_7 = ValueList({"start / stop": "start_stop", "continious"}, selected="continious")
gcodelines = GhPythonScript(
    x=claylibrarypathlocation,
    pts=merge_3,
    feed_rate=feed_rate_in_mm_s,
    extrusion_rate=Slider(0.4, range=0..10),
    link_type=list_7,
    global_trim_distance=Slider(0, range=0..10),
    ss_trim_distance=Slider(5, range=0..10),
    cull_distance=Slider(1, range=0..10),
    lift_val=Slider(4.4, range=0..10),
    ss_f_rate=start_stop_feedrate_in_mm_min,
    ss_e_rate=Slider(300, range=0..1000))  # -> out, a, path_vis; inputs pts: list
# ---------- gcodelines: Python ----------
import sys

sys.path.append(x)

import Rhino.Geometry as rg
import simpleStartStop as ss

reload(ss)

# print(pts)

p_set = ss.PrintSettings(
    feed_rate = feed_rate, 
    extrusion_rate = extrusion_rate, 
    extrusion_mode = 'relative', 
    movement_mode = 'relative'
)

l_type = ss.LinkType(
    link_type = link_type,
    global_trim_distance = global_trim_distance,
    ss_trim_distance = ss_trim_distance,
    cull_distance = cull_distance,
    lift_val = lift_val
)

l_type.ss_f_rate = ss_f_rate
l_type.ss_e_rate = ss_e_rate

gcodeset = ss.GCodeSet(pts, p_set, l_type)
a = gcodeset.generateGCode()

path_vis = gcodeset.path_vis
# ---------- end gcodelines ----------

# ----
pline_8 = PolyLine(Vertices=gcodelines.path_vis, Closed=False)
end_start_gcode_2 = GhPythonScript(lines=flatten(gcodelines.a))  # -> out, a; inputs lines: list
# ---------- end_start_gcode_2: Python ----------
__author__ = "JesusBarney"
__version__ = "2019.04.06"

import rhinoscriptsyntax as rs

#move_mode = "G1"
#extrusion_rate = 0.12
#extrusion_start = 0
offset_z = 0.10
#speed = 500
g_code = []

initiate_gcode = """;FLAVOR:Marlin
;TIME:0
;Filament used: 6.75709m
;Layer height: 1.1
;MINX:-47.897
;MINY:-47.91
;MINZ:1.1
;MAXX:47.895
;MAXY:47.91
;MAXZ:99
;Generated with Cura_SteamEngine 4.1.0
M104 S210
M105
M109 S210
M83 ;relative extrusion mode
G28 ;Home
G1 Z15.0 F6000 ;Move the platform down 15mm
;Prime the extruder
G92 E0
G1 F200 E3
G92 E0
G92 E0
G92 E0
G1 F1500
;LAYER_COUNT:90
;LAYER:0
M107
M203 Z50
M205 X30 Y30
G0 F1500 X30 Y-3.573 Z20
M205 X20 Y20
;TYPE:SKIRT
G1 X0 Y0 Z20 E25"""

# ;TIME_ELAPSED:751.629903
# G1 F1500 E510.30819   

end_gcode = """M205 X30 Y30 Z30 E-1
G0 F600 X-43.931 Y-19.114
G0 X-40.689 Y-17.797
M205 X20 Y20
M203 Z299792458000
M107
M104 S0
M140 S0
;Retract the filament
G92 E1
G1 E-1 F300
G28 X0 Y0
M84
M83 ;absolute extrusion mode
M104 S0"""

print initiate_gcode

for line in lines:

    print(line)

print end_gcode
# ---------- end end_start_gcode_2 ----------
panel_13 = Panel(end_start_gcode_2.out)
panel_14 = Panel(python_22.out)
pline_9 = PolyLine(Vertices=python_23.shell_pt_set, Closed=False)
panel_15 = Panel(python_23.out)
crv_26 = Curve(<curve referenced from the Rhino model>)
list_8 = ValueList({"Inside": "inside", "Outside": "outside"}, selected="Inside")
offset_3 = OffsetCurve(Curve=crv_26, Distance=1, Plane=PlaneXY(0, 0, 0), Corners=1)
crv_27 = Curve(<curve referenced from the Rhino model>)
python_25 = GhPythonScript(x=offset_3)  # -> out, a; same code as ghpython_script
python_26 = GhPythonScript(crv=crv_26, distance=Slider(0.4, range=0..10), direction=list_8, count=Slider(1, range=0..10))  # -> out, a; inputs count: Int32
# ---------- python_26: Python ----------
from sys import path
from scriptcontext import sticky

path.append(sticky["clay_printing_library"])

import generalFunctions as gf

reload(gf)

a = gf.offsetCurveSet(crv, distance, direction, count)

for crv in a:
    
    gf.polylinePeriodicizer(crv)
# ---------- end python_26 ----------
python_27 = GhPythonScript(crv=crv_27, count=Slider(110, range=0..1000))  # -> out, a; inputs crv: Curve, count: Int32
# ---------- python_27: Python ----------
import Rhino.Geometry as rg

crv.Domain = rg.Interval(0, count - 1)

a = [crv.PointAt(t) for t in range(count)]
# ---------- end python_27 ----------
crv_28 = Curve(<curve referenced from the Rhino model>)
list_9 = ValueList({"start", "end", "both"}, selected="both")
eval_6 = Evaluate()
list_10 = ValueList({"start", "end", "both"}, selected="both")
panel_16 = Panel(python_26.out)
divide_3 = DivideCurve(Curve=crv_28, Count=Slider(110, range=0..1000), Kinks=False)  # -> Points, Tangents, Parameters
python_28 = GhPythonScript(pts=python_27.a, distance=Slider(10, range=0..10), location=list_9, count=Slider(1, range=0..10))  # -> out, a; inputs pts: list, count: Int32
# ---------- python_28: Python ----------
from sys import path
from scriptcontext import sticky

path.append(sticky["clay_printing_library"])

import generalFunctions as gf

reload(gf)

# print(pts)

a = gf.collapsePolylinePts(pts, distance)
# ---------- end python_28 ----------
python_29 = GhPythonScript(x=python_28.a)  # -> out, a; inputs x: list of Point3d
# ---------- python_29: Python ----------
from sys import path
from scriptcontext import sticky

path.append(sticky["clay_printing_library"])

import simpleStartStop as ss

reload(ss)

# print(pts)

gcodeset = ss.GCodeSet(x)
a = gcodeset.generateGCode()
# ---------- end python_29 ----------
pline_10 = PolyLine(Vertices=divide_3.Points, Closed=False)
python_30 = GhPythonScript(pts=divide_3.Points, distance=Slider(0, range=0..10), location=list_10, count=Slider(1, range=0..10))  # -> out, a; inputs pts: list, count: Int32
# ---------- python_30: Python ----------
from sys import path
from scriptcontext import sticky

path.append(sticky["clay_printing_library"])

import simpleStartStop as sSS

reload(sSS)

# print(pts)

a = sSS.shortenPolylineSet(pts, distance, location)
# ---------- end python_30 ----------
panel_17 = Panel(python_30.a)
pline_11 = PolyLine(Vertices=python_30.a, Closed=False)
panel_18 = Panel(python_29.a)
panel_19 = Panel(python_30.out)
len = Length(Curve=pline_10)
panel_20 = Panel(python_28.out)
item_7 = ListItem(List=crv_25, Index=0, Wrap=True)
len_2 = Length(Curve=pline_11)
panel_21 = Panel(python_13.out)
subtraction = Subtraction(A=len, B=len_2)
panel_22 = Panel(subtraction)

# ==== cluster Cluster
crv = ClusterInput()
crv_2 = Curve(crv)
crv_3 = ClusterOutput(crv_2)
z_height = ClusterInput()
item = ListItem(List=crv_2, Index=0, Wrap=True)
python = GhPythonScript(x=item, z_height=z_height)  # -> out, a; inputs x: Curve
# ---------- python: Python ----------
import Rhino.Geometry as rg
import math

def crvOrienter(crv):

    x_or_y = True
    rot_angle = 0.0
    area = 9999999

    for i in range(90):

        angle = math.pi * i / 180

        # bounding box translation
        x_vec = rg.Vector3d(math.cos(angle), math.sin(angle), 0.0)
        y_vec = rg.Vector3d(- math.sin(angle), math.cos(angle), 0.0)
        b_box = crv.GetBoundingBox(rg.Plane(rg.Point3d(0,0,0), x_vec, y_vec))

        x_delta = b_box.Max.X - b_box.Min.X
        y_delta = b_box.Max.Y - b_box.Min.Y

        loc_are = x_delta * y_delta

        if loc_are < area:

            rot_angle = angle

            area = loc_are

            if x_delta < y_delta:

                x_or_y = False

            else:

                x_or_y = True

    if x_or_y:

        x_vec = rg.Vector3d(1, 0, 0)
        y_vec = rg.Vector3d(0, 1, 0)

    else:

        x_vec = rg.Vector3d(0, 1, 0)
        y_vec = rg.Vector3d(-1, 0, 0)

    x_vec.Transform(rg.Transform.Rotation(rot_angle, rg.Point3d(0,0,0)))
    y_vec.Transform(rg.Transform.Rotation(rot_angle, rg.Point3d(0,0,0)))

    tmp_pln = rg.Plane(rg.Point3d(0,0,z_height), x_vec, y_vec)
    
    b_box = crv.GetBoundingBox(tmp_pln)
    
    x0, x1 = b_box.Min.X, b_box.Max.X
    y1, y0 = b_box.Max.Y, b_box.Min.Y
    
    crv = rg.Rectangle3d(tmp_pln, rg.Interval(x0,x1), rg.Interval(y0,y1))
    
    return crv
    
a = crvOrienter(x)
# ---------- end python ----------
offset = OffsetCurve(Curve=python.a, Distance=Slider(20, range=0..25), Plane=PlaneXY(0, 0, 0), Corners=1)
divide = DivideCurve(Curve=offset, Count=1, Kinks=True)  # -> Points, Tangents, Parameters
shift = ClusterInput()
panel = Panel(python.out)
shift_list = ShiftList(List=divide.Points, Shift=shift, Wrap=True)
list = ClusterOutput(shift_list)
