# Grasshopper definition PatternMerge.gh (Grasshopper 1.0.7)

layer_height = Slider(19, range=0..300)  # disabled
number_slider = Slider(34, range=0..1000)  # disabled
# Brick Type I
number_slider_2 = Slider(109, range=0..1000)  # disabled
number_slider_3 = Slider(13, range=0..100)  # disabled
number_slider_4 = Slider(14, range=0..100)  # disabled
number_slider_5 = Slider(40, range=0..100)
number_slider_6 = Slider(5, range=0..10)
list = ValueList({"middle": 0, "left_middle": 1, "right_middle": 2, "left_up": 3, "left_down": 4, "right_up": 5, "right_down": 6}, selected="left_middle")  # disabled
list_2 = ValueList({"middle": 0, "left_middle": 1, "right_middle": 2, "left_up": 3, "left_down": 4, "right_up": 5, "right_down": 6}, selected="right_middle")  # disabled
list_3 = ValueList({"middle": 0, "left_middle": 1, "right_middle": 2, "left_up": 3, "left_down": 4, "right_up": 5, "right_down": 6}, selected="middle")  # disabled

list_4 = ValueList({"Tall_connection": 0, "Short_connection": 1, "Brick": 2}, selected="Tall_connection")  # disabled
list_5 = ValueList({"Tall_connection": 0, "Short_connection": 1, "Brick": 2}, selected="Brick")  # disabled
list_6 = ValueList({"Tall_connection": 0, "Short_connection": 1, "Brick": 2}, selected="Tall_connection")  # disabled
list_7 = ValueList({"Tall_connection": 0, "Short_connection": 1, "Brick": 2}, selected="Brick")  # disabled
list_8 = ValueList({"middle": 0, "left_middle": 1, "right_middle": 2, "left_up": 3, "left_down": 4, "right_up": 5, "right_down": 6}, selected="middle")  # disabled
python = GhPythonScript(
    layer_height=layer_height,
    rad_bottom=number_slider_4,
    rad_top=number_slider_3,
    height=number_slider,
    height_2=number_slider_2,
    connection_type=list_5,
    position=list_8)  # -> out, curves; inputs connection_type: Int32, position: Int32; disabled
# ---------- python: Python ----------
__author__ = "Chaoyu"
__version__ = "2019.10.03"

import rhinoscriptsyntax as rs
import Rhino.Geometry as rg
import ghpythonlib.treehelpers as th
import ghpythonlib.components as gh


layers_tall = int(height/ layer_height)
layers_short = int(height_2/ layer_height)
curves = []


if connection_type == 0:
    for i in range(layers_tall):
        rad = rad_bottom + (layer_height * i/height)*(rad_top-rad_bottom)
        cen_pt = rg.Point3d(0,0,layer_height * i)
        circle = rg.Circle(cen_pt, rad)
        curves.append(circle)
        
elif connection_type == 1:
    for i in range(layers_short):
        rad = rad_bottom + (layer_height * i/height)*(rad_top-rad_bottom)
        cen_pt = rg.Point3d(0,0,layer_height * i)
        circle = rg.Circle(cen_pt, rad)
        curves.append(circle)
        
elif connection_type ==2:
    cur = []
    for i in range(layers_short):
        z = layer_height * i
        cur_1 = rg.Line(rg.Point3d(-10,10,z), rg.Point3d(10,10,z)).ToNurbsCurve()
        cur_2 = rg.Arc(rg.Point3d(10,10,z), rg.Vector3d(1,0,0), rg.Point3d(10,-10,z)).ToNurbsCurve()
        cur_3 = rg.Line(rg.Point3d(10,-10,z), rg.Point3d(-10,-10,z)).ToNurbsCurve()
        cur_4 = rg.Arc(rg.Point3d(-10,-10,z),rg.Vector3d(-1,0,0), rg.Point3d(-10,10,z)).ToNurbsCurve()
        cur.append([cur_1, cur_2, cur_3, cur_4])
        curves = th.list_to_tree(cur, source = [0])
#        curves.append(cur)

if position == 1:
    curves = gh.Move(curves, rg.Vector3d(-10,0,0))[0]
elif position ==2:
    curves = gh.Move(curves, rg.Vector3d(10,0,0))[0]
elif position == 3:  # left up
    curves = gh.Move(curves, rg.Vector3d(-10,5,0))[0]
elif position == 4:
    curves = gh.Move(curves, rg.Vector3d(-10,-5,0))[0]
elif position ==5:
    curves = gh.Move(curves, rg.Vector3d(10,5,0))[0]
elif position ==6:
    curves = gh.Move(curves, rg.Vector3d(10,-5,0))[0]
# ---------- end python ----------
python_2 = GhPythonScript(
    layer_height=layer_height,
    rad_bottom=number_slider_4,
    rad_top=number_slider_3,
    height=number_slider,
    height_2=number_slider_2,
    connection_type=list_4,
    position=list)  # -> out, curves; inputs connection_type: Int32, position: Int32; disabled; same code as python
python_3 = GhPythonScript(
    layer_height=layer_height,
    rad_bottom=number_slider_4,
    rad_top=number_slider_3,
    height=number_slider,
    height_2=number_slider_2,
    connection_type=list_6,
    position=list_2)  # -> out, curves; inputs connection_type: Int32, position: Int32; disabled; same code as python
python_4 = GhPythonScript(
    layer_height=layer_height,
    rad_bottom=number_slider_4,
    rad_top=number_slider_3,
    height=number_slider,
    height_2=number_slider_2,
    connection_type=list_7,
    position=list_3)  # -> out, curves; inputs connection_type: Int32, position: Int32; disabled; same code as python
geo = Geometry(python.curves)  # disabled
geo_2 = Geometry(python_2.curves)  # disabled
geo_3 = Geometry(python_3.curves)  # disabled
geo_4 = Geometry(python_4.curves)  # disabled

join = JoinCurves(Curves=flatten(python_4.curves), Preserve=False)
birckgeneration = GhPythonScript(
    Length=Slider(101, range=0..1000),
    Width=Slider(119.1, range=0..1000),
    Height=Slider(50, range=0..100),
    FittingHeight=Slider(50, range=0..100),
    BottomRadius=Slider(17.2, range=0..100),
    TopRadius=Slider(11, range=0..100))  # -> out, b_crv, b_line, half_crv
# ---------- birckgeneration: Python ----------
import Rhino.Geometry as rg

if Length < Width:
    
    temp_length = Width
    Width = Length
    Length = temp_length
    
radius = Width * .5
length = Length - Width
half_length = length * .5

# creating the base curve
rectangle = rg.Rectangle3d(rg.Plane.WorldXY, rg.Interval(- half_length, half_length), rg.Interval(- radius, radius)).ToNurbsCurve()
circle_1 = rg.Circle(rg.Point3d(half_length, 0, 0), radius).ToNurbsCurve()
circle_2 = rg.Circle(rg.Point3d(-half_length, 0, 0), radius).ToNurbsCurve()

b_crv = rg.Curve.CreateBooleanUnion([rectangle, circle_1, circle_2], 0.01)[0]

# splitting the base_crv

pt_1 = rg.Point3d(-1 * ( radius + half_length), 0, 0)
pt_2 = rg.Point3d(radius + half_length, 0, 0)

b_line = rg.Line(pt_1, pt_2)

_, t1 = b_crv.ClosestPoint(pt_1)
_, t2 = b_crv.ClosestPoint(pt_2)

half_crv = b_crv.Split([t1, t2])[1]
# ---------- end birckgeneration ----------
crvsplit = GhPythonScript(b_crv=join)  # -> out, half_crv; inputs b_crv: list of Curve
# ---------- crvsplit: Python ----------
import Rhino.Geometry as rg
import math

rec = rg.Box(rg.Plane.WorldXY, b_crv)

min, max = rec.X[0], rec.X[1]
y_min = rec.Y[0]

pt_1, pt_2 = rg.Point3d(min, 0, 0), rg.Point3d(max, 0, 0)
bot_pt = rg.Point3d(0, y_min, 0)

_, t1 = b_crv.ClosestPoint(pt_1)
_, t2 = b_crv.ClosestPoint(pt_2)

crv_split = b_crv.Split([t1, t2])

def getKey(item):

    return item[0]

if len(crv_split) == 2:
    
    _, t_val = crv_split[0].ClosestPoint(bot_pt)
    crv_1_pt = crv_split[0].PointAt(t_val)
    
    if crv_1_pt.DistanceTo(bot_pt) < 0.01:
        
        half_crv = crv_split[0]
        
    else:
        
        half_crv = crv_split[1]
    
elif len(crv_split) == 3:
    
    distance_tuple_list = []
    
    for crv in crv_split:
        
        _, t_val = crv.ClosestPoint(bot_pt)
        crv_pt = crv.PointAt(t_val)
        
        distance_tuple_list.append(crv_pt.DistanceTo(bot_pt), crv)
        
    half_crv = sorted(l, key=getKey)[0][1]
    
    _, t_val = half_crv.ClosestPoint(bot_pt)
    crv_pt = half_crv.PointAt(t_val)
    distance = crv_pt.DistanceTo(bot_pt)
    
    if distance > .01:
        
        rot_180 = rg.Transform.Rotation(rg.Plane.WordlXY, math.pi)
        
        half_crv.Transform(rot_180)
# ---------- end crvsplit ----------
pattern = GhPythonScript()  # -> out, a; inputs base_crv: Curve, origin: Point3d
# ---------- pattern: Python ----------
# snippet of code to make this python component look for it's code in the parent folder of the .gh file

import os

ghComp = ghenv.Component
ghDoc = ghComp.OnPingDocument()

file_name = "patternGenv1.py"
gh_file_location = ghDoc.FilePath
parent = os.path.dirname(os.path.realpath(gh_file_location))

file_path = os.path.join(parent, file_name)
print(file_path)

# hacky-hacky run-fun
execfile(file_path)
# ---------- end pattern ----------
panel = Panel("""edge_easing
edge_ease_zero
edge_ease_end

pattern_type

period
amplitude
phase_shift

spacing
radius
max_val

radius_bot

direction""")
python_5 = GhPythonScript(crv=birckgeneration.half_crv)  # -> out, a; unedited script template
python_6 = GhPythonScript()  # -> out, a
# ---------- python_6: Python ----------
a = [[2, 1, 1], [1, 2, 3], [0, 1, 2]]
# ---------- end python_6 ----------
crv = Curve(<curve referenced from the Rhino model>)
crv_2 = Curve(birckgeneration.half_crv)
crv_3 = Curve(crv_2)
len = Length(Curve=crv_3)
division = Division(A=len, B=Slider(120, range=0..1000))
divlength = DivideLength(Curve=crv_3, Length=division)  # -> Points, Tangents, Parameters
eval = EvaluateCurve(Curve=crv_3, Parameter=divlength.Parameters)  # -> Point, Tangent, Angle
rotate = Rotate(Geometry=eval.Tangent, Angle=1.570796327, Plane=PlaneXY(0, 0, 0))  # -> Geometry, Transform
multiplication = Multiplication(A=rotate.Geometry, B=Slider(1, range=0..10))
addition = Addition(A=eval.Point, B=multiplication)
line = Line(Line((-72.36502514, 101.2472381, 0), (157.745129, 103.3994262, 0)))
number_slider_7 = Slider(10, range=0..10)
number_slider_8 = Slider(0.691, range=0..3.141)
number_slider_9 = Slider(2.87, range=0..15.707)
list_9 = ValueList({"dotMap": 0, "ellipsoidBumpMap": 1, "sinWarp": 2, "cylinderMap": 3, "layerMap": 4}, selected="ellipsoidBumpMap")
crv_4 = Curve(crv_2)
pt = Point(<point referenced from the Rhino model>)
normalscaling = GhPythonScript(
    normals=rotate.Geometry,
    pts=eval.Point,
    base_line=crv,
    cut_off_distance=Slider(0, range=0..100),
    zero_distance=Slider(10.1, range=0..100))  # -> out, normalised_normals; inputs normals: list of Vector3d, pts: list of Point3d, base_line: Curve
# ---------- normalscaling: Python ----------
import Rhino.Geometry as rg

normalised_normals = []

cut_off_delta = cut_off_distance - zero_distance

for pt_i, pt in enumerate(pts):
    
    active_normal = normals[pt_i]
    
    _, t_val = base_line.ClosestPoint(pt)
    
    pt_on_crv = base_line.PointAt(t_val)
    
    distance = pt_on_crv.DistanceTo(pt)
    
    print distance
    
    if distance < zero_distance:
        
        scale_val = 0.0
    
    elif distance < cut_off_distance:
        
        scale_val = (distance - zero_distance) / cut_off_delta
        
        print(scale_val)
        
    else:
        
        scale_val = 1.0
        
    normalised_normals.append(scale_val * active_normal)
# ---------- end normalscaling ----------
pattern_2 = GhPythonScript(
    base_crv=eval.Point,
    layer_count=number_slider_5,
    layer_height=number_slider_6,
    min_max_val=number_slider_7,
    period=number_slider_9,
    phase_shift=number_slider_8)  # -> out, curve_list; inputs base_crv: list of Point3d, layer_count: Int32, layer_height: Int32; same code as pattern
pattern_3 = GhPythonScript(
    base_points=eval.Point,
    normals=normalscaling.normalised_normals,
    layer_count=number_slider_5,
    layer_height=number_slider_6,
    min_max_val=number_slider_7,
    period=number_slider_9,
    phase_shift=number_slider_8)  # -> out, curve_list; inputs base_points: list of Point3d, normals: list of Point3d, layer_count: Int32, layer_height: Int32
# ---------- pattern_3: Python ----------
# snippet of code to make this python component look for it's code in the parent folder of the .gh file

import os

ghComp = ghenv.Component
ghDoc = ghComp.OnPingDocument()

file_name = "patternGenv0.py"
gh_file_location = ghDoc.FilePath
parent = os.path.dirname(os.path.realpath(gh_file_location))

file_path = os.path.join(parent, file_name)
print(file_path)

# hacky-hacky run-fun
execfile(file_path)
# ---------- end pattern_3 ----------
distance_to_border = Slider(21, range=0..200)  # disabled
dis_between_paths = Slider(23, range=0..200)  # disabled
number_slider_10 = Slider(9, range=0..20)  # disabled
extra_shell = Slider(2, range=0..5)  # disabled
pattern_4 = GhPythonScript(
    base_crv=crv_4,
    origin=pt,
    sub_length=Slider(2, range=0..10),
    layer_count=Slider(70, range=0..100),
    layer_height=Slider(2.3, range=0..10),
    edge_easing=Toggle(True),
    edge_ease_zero=Slider(4, range=0..100),
    edge_ease_end=Slider(25.3, range=0..100),
    pattern_type=list_9,
    period=Slider(27.9, range=0..100),
    phase_shift=Slider(0.1, range=0..2),
    spacing=Slider(40, range=0..100),
    radius=Slider(15.2, range=0..100),
    max_val=Slider(5.02, range=0..100),
    height=Slider(26.9, range=0..100),
    radius_bot=Slider(0, range=0..10),
    pattern_set=python_6.a,
    direction=Toggle(False))  # -> out, curve_list, a, b, c; inputs base_crv: Curve, layer_count: Int32, layer_height: Int32, edge_easing: Boolean, pattern_type: Int32, pattern_set: list, direction: Boolean; same code as pattern
panel_2 = Panel(pattern_3.out)
crv_5 = Curve(pattern_4.b)
mesh = Mesh(pattern_4.c)
panel_3 = Panel(normalscaling.out)
python_7 = GhPythonScript(
    left_curves=geo_2,
    middle_curves=geo,
    right_curves=geo_3,
    outer_curves=simplify(geo_4),
    dis_to_border=distance_to_border,
    dis_between_paths=dis_between_paths,
    division_num=number_slider_10,
    layer_height=layer_height,
    extra_shell=extra_shell)  # -> out, a, pt, temp_geo, o_pts, o_pts_tree, o_pts_tree_substract; inputs left_curves: list, middle_curves: list, right_curves: list, outer_curves: tree of Curve, division_num: Int32, extra_shell: Int32; disabled
# ---------- python_7: Python ----------
__author__ = "Chaoyu"
__version__ = "2019.10.03"

import rhinoscriptsyntax as rs
import Rhino.Geometry as rg
import ghpythonlib.components as gh
import math as m
import ghpythonlib.treehelpers as th

def trans(curve, t):
    """
    transform a curve with a trasformation matrix
    curve: input curve
    t: transformation matrix
    return: a transformed curve
    """
    new_curve = curve.Clone()
    new_curve.Transform(t)
    return new_curve


def draw_arc(pt_start, pt_end, pt_center):
    tan = rg.Vector3d.Subtract(rg.Vector3d(pt_start), rg.Vector3d(pt_center))
    tan.Rotate(m.pi/2, rg.Vector3d(0,0,1))
    arc = rg.Arc(pt_start, tan, pt_end)
    return arc


def adjust_distance(pt_in, pt_out):
    dis = pt_in.DistanceTo(pt_out)
    dis_opt = dis - dis_to_border
    dir = rg.Vector3d.Subtract(rg.Vector3d(pt_out), rg.Vector3d(pt_in))
    line = rg.Line(pt_in, dir, dis_opt)
    pt = line.PointAt(1)
    return pt


def divide_arc(arc, division_num):
    arc = arc.ToNurbsCurve()
    divisions = arc.DivideByCount(division_num, True)
    pt_arc = [arc.PointAt(d) for d in divisions]
    return pt_arc


print len(left_curves), len(middle_curves), len(right_curves)
print len(outer_curves.Branches)




o_pts_list = []
temp_geo = []

for i in range(len(outer_curves.Branches)):
    z = i * layer_height
    o_pts = []
    line_left_curve = rg.Line(rg.Point3d(-10,10,z), rg.Point3d(-10,-10,z))
    line_middle_curve = rg.Line(rg.Point3d(0,10,z), rg.Point3d(0,-10,z))
    line_right_curve = rg.Line(rg.Point3d(10,10,z), rg.Point3d(10,-10,z))
    brick_left = rg.Arc(rg.Circle(rg.Point3d(-10,0,z), 10),rg.Interval(m.pi/2, m.pi*3/2))
    brick_up = rg.Line(rg.Point3d(-10,10,z), rg.Point3d(10,10,z))
    brick_down = rg.Line(rg.Point3d(-10,-10,z), rg.Point3d(10,-10,z))
    brick_right = rg.Arc(rg.Circle(rg.Point3d(10,0,z), 10),rg.Interval(-m.pi/2, m.pi/2))
    temp_geo.append(brick_left)
    temp_geo.append(brick_right)
    t_left  = rg.Transform.ChangeBasis(rg.Plane(rg.Point3d(0,0,0),rg.Vector3d(0,0,1)), rg.Plane(rg.Point3d(dis_between_paths/2, 0,0), rg.Vector3d(0,0,1)))
    t_right = rg.Transform.ChangeBasis(rg.Plane(rg.Point3d(0,0,0),rg.Vector3d(0,0,1)), rg.Plane(rg.Point3d(-dis_between_paths/2, 0,0), rg.Vector3d(0,0,1)))
    t_up    = rg.Transform.ChangeBasis(rg.Plane(rg.Point3d(0,0,0),rg.Vector3d(0,0,1)), rg.Plane(rg.Point3d(0, -dis_between_paths/2,0), rg.Vector3d(0,0,1)))
    t_down  = rg.Transform.ChangeBasis(rg.Plane(rg.Point3d(0,0,0),rg.Vector3d(0,0,1)), rg.Plane(rg.Point3d(0, dis_between_paths/2,0), rg.Vector3d(0,0,1)))
    line_left_curve_left = trans(line_left_curve, t_left)
    line_left_curve_right = trans(line_left_curve, t_right)
    line_middle_curve_left = trans(line_middle_curve, t_left)
    line_middle_curve_right = trans(line_middle_curve, t_right)
    line_right_curve_left = trans(line_right_curve, t_left)
    line_right_curve_right = trans(line_right_curve, t_right)
    
    
    pt_0 = rg.Intersect.Intersection.LineCircle(line_left_curve_left, left_curves[i])[2]
    pt_1 = rg.Intersect.Intersection.LineCircle(line_left_curve_left, left_curves[i])[4]
    pt_2 = rg.Intersect.Intersection.LineCircle(line_left_curve_right, left_curves[i])[2]
    pt_3 = rg.Intersect.Intersection.LineCircle(line_left_curve_right, left_curves[i])[4]
    temp_geo.extend([pt_0, pt_1, pt_2, pt_3])
    
    left_left_curve = rg.Line(left_curves[i].Center, rg.Vector3d(-1,0,0), 10)
    left_left_curve_up = trans(left_left_curve, t_up)
    left_left_curve_down = trans(left_left_curve, t_down)
    pt_4 = rg.Intersect.Intersection.LineCircle(left_left_curve_up, left_curves[i])[4]
    pt_5 = rg.Intersect.Intersection.LineCircle(left_left_curve_down, left_curves[i])[4]
    temp_geo.append(pt_4)
    temp_geo.append(pt_5)
    
    left_right_curve = rg.Line(left_curves[i].Center, middle_curves[i].Center)
    left_right_curve_up = trans(left_right_curve, t_up)
    left_right_curve_down = trans(left_right_curve, t_down)
    pt_6 = rg.Intersect.Intersection.LineCircle(left_right_curve_up, left_curves[i])[4]
    pt_7 = rg.Intersect.Intersection.LineCircle(left_right_curve_down, left_curves[i])[4]
    temp_geo.append(pt_6)
    temp_geo.append(pt_7)
    
    
    pt_a = rg.Intersect.Intersection.CurveCurve(line_left_curve_left.ToNurbsCurve(), brick_left.ToNurbsCurve(),0,0)[0].PointA
    pt_b = rg.Intersect.Intersection.CurveCurve(line_left_curve_left.ToNurbsCurve(), brick_left.ToNurbsCurve(),0,0)[1].PointA
    pt_c = rg.Intersect.Intersection.CurveCurve(left_left_curve_up.ToNurbsCurve(), brick_left.ToNurbsCurve(),1,0)[0].PointA
    pt_d = rg.Intersect.Intersection.CurveCurve(left_left_curve_down.ToNurbsCurve(), brick_left.ToNurbsCurve(),1,0)[0].PointA
    pt_e = rg.Intersect.Intersection.LineCircle(left_right_curve_up, middle_curves[i])[2]
    pt_f = rg.Intersect.Intersection.LineCircle(left_right_curve_down, middle_curves[i])[2]
    pt_g = line_left_curve_right.PointAt(0)
    pt_i = line_left_curve_right.PointAt(1)
    temp_geo.extend([pt_a,pt_b, pt_c, pt_d, pt_e, pt_f, pt_g, pt_i])
    
    
    
    pt_a_ = adjust_distance(pt_0, pt_a)
    pt_b_ = adjust_distance(pt_4, pt_c)
    pt_c_ = adjust_distance(pt_5, pt_d)
    pt_d_ = adjust_distance(pt_1, pt_b)
    pt_e_ = adjust_distance(pt_3, pt_i)
    pt_f_ = adjust_distance(pt_7, pt_f)
    pt_g_ = adjust_distance(pt_6, pt_e)
    pt_i_ = adjust_distance(pt_2, pt_g)
    temp_geo.extend([pt_a_, pt_b_, pt_c_, pt_d_, pt_e_, pt_f_, pt_g_, pt_i_])
    
    
    
    arc_1 = draw_arc(pt_0, pt_4, left_curves[i].Center)
    arc_2 = draw_arc(pt_5, pt_1, left_curves[i].Center)
    arc_3 = draw_arc(pt_3, pt_7, left_curves[i].Center)
    arc_4 = draw_arc(pt_6, pt_2, left_curves[i].Center)
    
    
    
    o_pts.append(pt_a)
    o_pts.extend(divide_arc(arc_1,division_num))
    o_pts.extend([pt_b_, pt_c_])
    o_pts.extend(divide_arc(arc_2,division_num))
    o_pts.extend([pt_d_, pt_e_])
    o_pts.extend(divide_arc(arc_3,division_num))
    
    if extra_shell != 0:
        for j in range(extra_shell):
            arc = rg.Arc(left_curves[i].Center, left_curves[i].Radius -(dis_between_paths*(j+1)), m.pi*2)
            o_pts.extend(divide_arc(arc,division_num*4))
            
    o_pts.extend([divide_arc(arc_3,division_num)[-1], pt_f_, pt_g_, divide_arc(arc_4,division_num)[0]])
    o_pts.extend(divide_arc(arc_4,division_num))
    o_pts.append(pt_g)
    
    
    pt_m_0 = rg.Intersect.Intersection.LineCircle(line_middle_curve_left, middle_curves[i])[2]
    pt_m_1 = rg.Intersect.Intersection.LineCircle(line_middle_curve_left, middle_curves[i])[4]
    pt_m_2 = rg.Intersect.Intersection.LineCircle(line_middle_curve_right, middle_curves[i])[2]
    pt_m_3 = rg.Intersect.Intersection.LineCircle(line_middle_curve_right, middle_curves[i])[4]
    temp_geo.extend([pt_m_0, pt_m_1, pt_m_2, pt_m_3])
    
    pt_m_a = line_middle_curve_left.PointAt(0)
    pt_m_b = line_middle_curve_left.PointAt(1)
    pt_m_c = line_middle_curve_right.PointAt(1)
    pt_m_d = line_middle_curve_right.PointAt(0)
    temp_geo.extend([pt_m_a, pt_m_b, pt_m_c, pt_m_d])
    
    pt_m_a_ = adjust_distance(pt_m_0, pt_m_a)
    pt_m_b_ = adjust_distance(pt_m_1, pt_m_b)
    pt_m_c_ = adjust_distance(pt_m_2, pt_m_c)
    pt_m_d_ = adjust_distance(pt_m_3, pt_m_d)
    temp_geo.extend([pt_m_a_, pt_m_b_, pt_m_c_, pt_m_d_])
    
    
    arc_m_1 = draw_arc(pt_m_0, pt_m_1, middle_curves[i].Center)
    arc_m_2 = draw_arc(pt_m_3, pt_m_2, middle_curves[i].Center)
    
    
    o_pts.append(pt_m_a)
    o_pts.extend(divide_arc(arc_m_1,division_num*2))
    o_pts.extend([pt_m_b_, pt_m_c_])
    o_pts.extend(divide_arc(arc_m_2,division_num*2))
    
    if extra_shell != 0:
        for j in range(extra_shell):
            arc = rg.Arc(rg.Circle(middle_curves[i].Center, middle_curves[i].Radius -(dis_between_paths*(j+1))), rg.Interval(m.pi/2, m.pi/2*5))
            o_pts.extend(divide_arc(arc,division_num*4))
    o_pts.append(divide_arc(arc_m_2,division_num*2)[-1])
    o_pts.append(pt_m_d)
    
    
    pt_r_0 = rg.Intersect.Intersection.LineCircle(line_right_curve_left, right_curves[i])[2]
    pt_r_1 = rg.Intersect.Intersection.LineCircle(line_right_curve_left, right_curves[i])[4]
    pt_r_2 = rg.Intersect.Intersection.LineCircle(line_right_curve_right, right_curves[i])[2]
    pt_r_3 = rg.Intersect.Intersection.LineCircle(line_right_curve_right, right_curves[i])[4]
    temp_geo.extend([pt_r_0, pt_r_1, pt_r_2, pt_r_3])
    
    
    right_right_curve = rg.Line(right_curves[i].Center, rg.Vector3d(1,0,0), 10)
    right_right_curve_up = trans(right_right_curve, t_up)
    right_right_curve_down = trans(right_right_curve, t_down)
    pt_r_4 = rg.Intersect.Intersection.LineCircle(right_right_curve_up, right_curves[i])[4]
    pt_r_5 = rg.Intersect.Intersection.LineCircle(right_right_curve_down, right_curves[i])[4]
    temp_geo.append(pt_r_4)
    temp_geo.append(pt_r_5)
    
    right_left_curve = rg.Line(right_curves[i].Center, middle_curves[i].Center)
    right_left_curve_up = trans(right_left_curve, t_up)
    right_left_curve_down = trans(right_left_curve, t_down)
    pt_r_6 = rg.Intersect.Intersection.LineCircle(right_left_curve_up, right_curves[i])[4]
    pt_r_7 = rg.Intersect.Intersection.LineCircle(right_left_curve_down, right_curves[i])[4]
    temp_geo.append(pt_r_6)
    temp_geo.append(pt_r_7)
    
    
    pt_r_a = rg.Intersect.Intersection.CurveCurve(line_right_curve_right.ToNurbsCurve(), brick_right.ToNurbsCurve(),0,0)[0].PointA
    pt_r_b = rg.Intersect.Intersection.CurveCurve(line_right_curve_right.ToNurbsCurve(), brick_right.ToNurbsCurve(),0,0)[1].PointA
    pt_r_c = rg.Intersect.Intersection.CurveCurve(right_right_curve_up.ToNurbsCurve(), brick_right.ToNurbsCurve(),1,0)[0].PointA
    pt_r_d = rg.Intersect.Intersection.CurveCurve(right_right_curve_down.ToNurbsCurve(), brick_right.ToNurbsCurve(),1,0)[0].PointA
    pt_r_e = rg.Intersect.Intersection.LineCircle(right_left_curve_up, middle_curves[i])[2]
    pt_r_f = rg.Intersect.Intersection.LineCircle(right_left_curve_down, middle_curves[i])[2]
    pt_r_g = line_right_curve_left.PointAt(0)
    pt_r_i = line_right_curve_left.PointAt(1)
    temp_geo.extend([pt_r_a,pt_r_b, pt_r_c, pt_r_d, pt_r_e, pt_r_f, pt_r_g, pt_r_i])
    
    
    pt_r_a_ = adjust_distance(pt_r_0, pt_r_a)
    pt_r_b_ = adjust_distance(pt_r_4, pt_r_c)
    pt_r_c_ = adjust_distance(pt_r_5, pt_r_d)
    pt_r_d_ = adjust_distance(pt_r_3, pt_r_b)
    pt_r_e_ = adjust_distance(pt_r_1, pt_r_i)
    pt_r_f_ = adjust_distance(pt_r_7, pt_r_f)
    pt_r_g_ = adjust_distance(pt_r_6, pt_r_e)
    pt_r_i_ = adjust_distance(pt_r_2, pt_r_g)
    temp_geo.extend([pt_r_a_, pt_r_b_, pt_r_c_, pt_r_d_, pt_r_e_, pt_r_f_, pt_r_g_, pt_r_i_])
    
    arc_r_1 = draw_arc(pt_r_0, pt_r_6, right_curves[i].Center)
    arc_r_2 = draw_arc(pt_r_7, pt_r_1, right_curves[i].Center)
    arc_r_3 = draw_arc(pt_r_3, pt_r_5, right_curves[i].Center)
    arc_r_4 = draw_arc(pt_r_4, pt_r_2, right_curves[i].Center)
    
    
    o_pts.append(pt_r_g)
    o_pts.extend(divide_arc(arc_r_1,division_num))
    o_pts.extend([pt_r_g_, pt_r_f_])
    o_pts.extend(divide_arc(arc_r_2,division_num))
    o_pts.extend([pt_r_e_, pt_r_d_])
    o_pts.extend(divide_arc(arc_r_3,division_num))
    
    
    if extra_shell != 0:
        for j in range(extra_shell):
            arc = rg.Arc(right_curves[i].Center, right_curves[i].Radius -(dis_between_paths*(j+1)), m.pi*2)
            o_pts.extend(divide_arc(arc,division_num*4))
            
    o_pts.extend([divide_arc(arc_r_3,division_num)[-1],pt_r_c_, pt_r_b_])
    o_pts.extend(divide_arc(arc_r_4,division_num))
    o_pts.append(pt_r_a)
    
    o_pts_list.append(o_pts)

o_pts_tree = th.list_to_tree(o_pts_list, source = [0])


o_pts_list_substract = []
for i in range(len(outer_curves.Branches), len(left_curves)):
    o_pts_left = []
    o_pts_right = []
    arc_left = rg.Arc(left_curves[i].Center, left_curves[i].Radius, m.pi *2)
    arc_right = rg.Arc(right_curves[i].Center, right_curves[i].Radius, m.pi *2)
    
    o_pts_left.extend(divide_arc(arc_left,division_num*4))
    o_pts_left.append(divide_arc(arc_left,division_num*4)[0])
    
    if extra_shell != 0:
        for j in range(extra_shell):
            arc = rg.Arc(left_curves[i].Center, left_curves[i].Radius -(dis_between_paths*(j+1)), m.pi*2)
            o_pts_left.extend(divide_arc(arc,division_num*4))
    
    
    o_pts_list_substract.append(o_pts_left)
    
    o_pts_right.extend(divide_arc(arc_right,division_num*4))
    o_pts_right.append(divide_arc(arc_right,division_num*4)[0])
    
    if extra_shell != 0:
        for j in range(extra_shell):
            arc = rg.Arc(right_curves[i].Center, right_curves[i].Radius -(dis_between_paths*(j+1)), m.pi*2)
            o_pts_right.extend(divide_arc(arc,division_num*4))
            
            
    o_pts_list_substract.append(o_pts_right)
    

o_pts_tree_substract = th.list_to_tree(o_pts_list_substract, source = [0])
# ---------- end python_7 ----------
python_8 = GhPythonScript(
    left_curves=geo_2,
    middle_curves=geo,
    right_curves=geo_3,
    outer_curves=simplify(geo_4),
    dis_to_border=distance_to_border,
    dis_between_paths=dis_between_paths,
    division_num=number_slider_10,
    layer_height=layer_height)  # -> pt, temp_geo, o_pts; inputs left_curves: list, middle_curves: list, right_curves: list, outer_curves: tree of Guid, division_num: Int32; disabled
# ---------- python_8: Python ----------
__author__ = "Chaoyu"
__version__ = "2019.10.03"

import rhinoscriptsyntax as rs
import Rhino.Geometry as rg
import ghpythonlib.components as gh
import math as m


def trans(curve, t):
    """
    transform a curve with a trasformation matrix
    curve: input curve
    t: transformation matrix
    return: a transformed curve
    """
    new_curve = curve.Clone()
    new_curve.Transform(t)
    return new_curve


def draw_arc(pt_start, pt_end, pt_center):
    tan = rg.Vector3d.Subtract(rg.Vector3d(pt_start), rg.Vector3d(pt_center))
    tan.Rotate(m.pi/2, rg.Vector3d(0,0,1))
    arc = rg.Arc(pt_start, tan, pt_end)
    return arc


def adjust_distance(pt_in, pt_out):
    dis = pt_in.DistanceTo(pt_out)
    dis_opt = dis - dis_to_border
    dir = rg.Vector3d.Subtract(rg.Vector3d(pt_out), rg.Vector3d(pt_in))
    line = rg.Line(pt_in, dir, dis_opt)
    pt = line.PointAt(1)
    return pt


def divide_arc(arc, division_num):
    arc = arc.ToNurbsCurve()
    divisions = arc.DivideByCount(division_num, True)
    pt_arc = [arc.PointAt(d) for d in divisions]
    return pt_arc


print len(left_curves), len(middle_curves), len(right_curves)
print len(outer_curves.Branches)




o_pts_tree = []
temp_geo = []

for i in range(len(outer_curves.Branches)):
    z = i * layer_height
o_pts = []
line_left_curve = rg.Line(rg.Point3d(-10,10,0), rg.Point3d(-10,-10,0))
line_middle_curve = rg.Line(rg.Point3d(0,10,0), rg.Point3d(0,-10,0))
line_right_curve = rg.Line(rg.Point3d(10,10,0), rg.Point3d(10,-10,0))
brick_left = rg.Arc(rg.Circle(rg.Point3d(-10,0,0), 10),rg.Interval(m.pi/2, m.pi*3/2))
brick_up = rg.Line(rg.Point3d(-10,10,0), rg.Point3d(10,10,0))
brick_down = rg.Line(rg.Point3d(-10,-10,0), rg.Point3d(10,-10,0))
brick_right = rg.Arc(rg.Circle(rg.Point3d(10,0,0), 10),rg.Interval(-m.pi/2, m.pi/2))
temp_geo.append(brick_left)
temp_geo.append(brick_right)
t_left  = rg.Transform.ChangeBasis(rg.Plane(rg.Point3d(0,0,0),rg.Vector3d(0,0,1)), rg.Plane(rg.Point3d(dis_between_paths/2, 0,0), rg.Vector3d(0,0,1)))
t_right = rg.Transform.ChangeBasis(rg.Plane(rg.Point3d(0,0,0),rg.Vector3d(0,0,1)), rg.Plane(rg.Point3d(-dis_between_paths/2, 0,0), rg.Vector3d(0,0,1)))
t_up    = rg.Transform.ChangeBasis(rg.Plane(rg.Point3d(0,0,0),rg.Vector3d(0,0,1)), rg.Plane(rg.Point3d(0, -dis_between_paths/2,0), rg.Vector3d(0,0,1)))
t_down  = rg.Transform.ChangeBasis(rg.Plane(rg.Point3d(0,0,0),rg.Vector3d(0,0,1)), rg.Plane(rg.Point3d(0, dis_between_paths/2,0), rg.Vector3d(0,0,1)))
line_left_curve_left = trans(line_left_curve, t_left)
line_left_curve_right = trans(line_left_curve, t_right)
line_middle_curve_left = trans(line_middle_curve, t_left)
line_middle_curve_right = trans(line_middle_curve, t_right)
line_right_curve_left = trans(line_right_curve, t_left)
line_right_curve_right = trans(line_right_curve, t_right)


pt_0 = rg.Intersect.Intersection.LineCircle(line_left_curve_left, left_curves[0])[2]
pt_1 = rg.Intersect.Intersection.LineCircle(line_left_curve_left, left_curves[0])[4]
pt_2 = rg.Intersect.Intersection.LineCircle(line_left_curve_right, left_curves[0])[2]
pt_3 = rg.Intersect.Intersection.LineCircle(line_left_curve_right, left_curves[0])[4]
temp_geo.extend([pt_0, pt_1, pt_2, pt_3])

left_left_curve = rg.Line(left_curves[0].Center, rg.Vector3d(-1,0,0), 10)
left_left_curve_up = trans(left_left_curve, t_up)
left_left_curve_down = trans(left_left_curve, t_down)
pt_4 = rg.Intersect.Intersection.LineCircle(left_left_curve_up, left_curves[0])[4]
pt_5 = rg.Intersect.Intersection.LineCircle(left_left_curve_down, left_curves[0])[4]
temp_geo.append(pt_4)
temp_geo.append(pt_5)

left_right_curve = rg.Line(left_curves[0].Center, middle_curves[0].Center)
left_right_curve_up = trans(left_right_curve, t_up)
left_right_curve_down = trans(left_right_curve, t_down)
pt_6 = rg.Intersect.Intersection.LineCircle(left_right_curve_up, left_curves[0])[4]
pt_7 = rg.Intersect.Intersection.LineCircle(left_right_curve_down, left_curves[0])[4]
temp_geo.append(pt_6)
temp_geo.append(pt_7)


pt_a = rg.Intersect.Intersection.CurveCurve(line_left_curve_left.ToNurbsCurve(), brick_left.ToNurbsCurve(),0,0)[0].PointA
pt_b = rg.Intersect.Intersection.CurveCurve(line_left_curve_left.ToNurbsCurve(), brick_left.ToNurbsCurve(),0,0)[1].PointA
pt_c = rg.Intersect.Intersection.CurveCurve(left_left_curve_up.ToNurbsCurve(), brick_left.ToNurbsCurve(),1,0)[0].PointA
pt_d = rg.Intersect.Intersection.CurveCurve(left_left_curve_down.ToNurbsCurve(), brick_left.ToNurbsCurve(),1,0)[0].PointA
pt_e = rg.Intersect.Intersection.LineCircle(left_right_curve_up, middle_curves[0])[2]
pt_f = rg.Intersect.Intersection.LineCircle(left_right_curve_down, middle_curves[0])[2]
pt_g = line_left_curve_right.PointAt(0)
pt_i = line_left_curve_right.PointAt(1)
temp_geo.extend([pt_a,pt_b, pt_c, pt_d, pt_e, pt_f, pt_g, pt_i])



pt_a_ = adjust_distance(pt_0, pt_a)
pt_b_ = adjust_distance(pt_4, pt_c)
pt_c_ = adjust_distance(pt_5, pt_d)
pt_d_ = adjust_distance(pt_1, pt_b)
pt_e_ = adjust_distance(pt_3, pt_i)
pt_f_ = adjust_distance(pt_7, pt_f)
pt_g_ = adjust_distance(pt_6, pt_e)
pt_i_ = adjust_distance(pt_2, pt_g)
temp_geo.extend([pt_a_, pt_b_, pt_c_, pt_d_, pt_e_, pt_f_, pt_g_, pt_i_])



arc_1 = draw_arc(pt_0, pt_4, left_curves[0].Center)
arc_2 = draw_arc(pt_5, pt_1, left_curves[0].Center)
arc_3 = draw_arc(pt_3, pt_7, left_curves[0].Center)
arc_4 = draw_arc(pt_6, pt_2, left_curves[0].Center)


o_pts.append(pt_a)
o_pts.extend(divide_arc(arc_1,division_num))
o_pts.extend([pt_b_, pt_c_])
o_pts.extend(divide_arc(arc_2,division_num))
o_pts.extend([pt_d_, pt_e_])
o_pts.extend(divide_arc(arc_3,division_num))
o_pts.extend([pt_f_, pt_g_])
o_pts.extend(divide_arc(arc_4,division_num))
o_pts.append(pt_g)


pt_m_0 = rg.Intersect.Intersection.LineCircle(line_middle_curve_left, middle_curves[0])[2]
pt_m_1 = rg.Intersect.Intersection.LineCircle(line_middle_curve_left, middle_curves[0])[4]
pt_m_2 = rg.Intersect.Intersection.LineCircle(line_middle_curve_right, middle_curves[0])[2]
pt_m_3 = rg.Intersect.Intersection.LineCircle(line_middle_curve_right, middle_curves[0])[4]
temp_geo.extend([pt_m_0, pt_m_1, pt_m_2, pt_m_3])

pt_m_a = line_middle_curve_left.PointAt(0)
pt_m_b = line_middle_curve_left.PointAt(1)
pt_m_c = line_middle_curve_right.PointAt(1)
pt_m_d = line_middle_curve_right.PointAt(0)
temp_geo.extend([pt_m_a, pt_m_b, pt_m_c, pt_m_d])

pt_m_a_ = adjust_distance(pt_m_0, pt_m_a)
pt_m_b_ = adjust_distance(pt_m_1, pt_m_b)
pt_m_c_ = adjust_distance(pt_m_2, pt_m_c)
pt_m_d_ = adjust_distance(pt_m_3, pt_m_d)
temp_geo.extend([pt_m_a_, pt_m_b_, pt_m_c_, pt_m_d_])


arc_m_1 = draw_arc(pt_m_0, pt_m_1, middle_curves[0].Center)
arc_m_2 = draw_arc(pt_m_3, pt_m_2, middle_curves[0].Center)


o_pts.append(pt_m_a)
o_pts.extend(divide_arc(arc_m_1,division_num*2))
o_pts.extend([pt_m_b_, pt_m_c_])
o_pts.extend(divide_arc(arc_m_2,division_num*2))
o_pts.append(pt_m_d)


pt_r_0 = rg.Intersect.Intersection.LineCircle(line_right_curve_left, right_curves[0])[2]
pt_r_1 = rg.Intersect.Intersection.LineCircle(line_right_curve_left, right_curves[0])[4]
pt_r_2 = rg.Intersect.Intersection.LineCircle(line_right_curve_right, right_curves[0])[2]
pt_r_3 = rg.Intersect.Intersection.LineCircle(line_right_curve_right, right_curves[0])[4]
temp_geo.extend([pt_r_0, pt_r_1, pt_r_2, pt_r_3])


right_right_curve = rg.Line(right_curves[0].Center, rg.Vector3d(1,0,0), 10)
right_right_curve_up = trans(right_right_curve, t_up)
right_right_curve_down = trans(right_right_curve, t_down)
pt_r_4 = rg.Intersect.Intersection.LineCircle(right_right_curve_up, right_curves[0])[4]
pt_r_5 = rg.Intersect.Intersection.LineCircle(right_right_curve_down, right_curves[0])[4]
temp_geo.append(pt_r_4)
temp_geo.append(pt_r_5)

right_left_curve = rg.Line(right_curves[0].Center, middle_curves[0].Center)
right_left_curve_up = trans(right_left_curve, t_up)
right_left_curve_down = trans(right_left_curve, t_down)
pt_r_6 = rg.Intersect.Intersection.LineCircle(right_left_curve_up, right_curves[0])[4]
pt_r_7 = rg.Intersect.Intersection.LineCircle(right_left_curve_down, right_curves[0])[4]
temp_geo.append(pt_r_6)
temp_geo.append(pt_r_7)


pt_r_a = rg.Intersect.Intersection.CurveCurve(line_right_curve_right.ToNurbsCurve(), brick_right.ToNurbsCurve(),0,0)[0].PointA
pt_r_b = rg.Intersect.Intersection.CurveCurve(line_right_curve_right.ToNurbsCurve(), brick_right.ToNurbsCurve(),0,0)[1].PointA
pt_r_c = rg.Intersect.Intersection.CurveCurve(right_right_curve_up.ToNurbsCurve(), brick_right.ToNurbsCurve(),1,0)[0].PointA
pt_r_d = rg.Intersect.Intersection.CurveCurve(right_right_curve_down.ToNurbsCurve(), brick_right.ToNurbsCurve(),1,0)[0].PointA
pt_r_e = rg.Intersect.Intersection.LineCircle(right_left_curve_up, middle_curves[0])[2]
pt_r_f = rg.Intersect.Intersection.LineCircle(right_left_curve_down, middle_curves[0])[2]
pt_r_g = line_right_curve_left.PointAt(0)
pt_r_i = line_right_curve_left.PointAt(1)
temp_geo.extend([pt_r_a,pt_r_b, pt_r_c, pt_r_d, pt_r_e, pt_r_f, pt_r_g, pt_r_i])


pt_r_a_ = adjust_distance(pt_r_0, pt_r_a)
pt_r_b_ = adjust_distance(pt_r_4, pt_r_c)
pt_r_c_ = adjust_distance(pt_r_5, pt_r_d)
pt_r_d_ = adjust_distance(pt_r_3, pt_r_b)
pt_r_e_ = adjust_distance(pt_r_1, pt_r_i)
pt_r_f_ = adjust_distance(pt_r_7, pt_r_f)
pt_r_g_ = adjust_distance(pt_r_6, pt_r_e)
pt_r_i_ = adjust_distance(pt_r_2, pt_r_g)
temp_geo.extend([pt_r_a_, pt_r_b_, pt_r_c_, pt_r_d_, pt_r_e_, pt_r_f_, pt_r_g_, pt_r_i_])

arc_r_1 = draw_arc(pt_r_0, pt_r_6, right_curves[0].Center)
arc_r_2 = draw_arc(pt_r_7, pt_r_1, right_curves[0].Center)
arc_r_3 = draw_arc(pt_r_3, pt_r_5, right_curves[0].Center)
arc_r_4 = draw_arc(pt_r_4, pt_r_2, right_curves[0].Center)


o_pts.append(pt_r_g)
o_pts.extend(divide_arc(arc_r_1,division_num))
o_pts.extend([pt_r_g_, pt_r_f_])
o_pts.extend(divide_arc(arc_r_2,division_num))
o_pts.extend([pt_r_e_, pt_r_d_])
o_pts.extend(divide_arc(arc_r_3,division_num))
o_pts.extend([pt_r_c_, pt_r_b_])
o_pts.extend(divide_arc(arc_r_4,division_num))
o_pts.append(pt_r_a)


#for i,c in enumerate(left_curves):
#        line_up = rg.Line(c.Center, rg.Vector3d(0,1,0),10)
#        line_left = rg.Line(c.Center, rg.Vector3d(-1,0,0),10)
#        line_right = rg.Line(c.Center, rg.Vector3d(middle_curves[0].Center.X-left_curves[0].Center.X, middle_curves[0].Center.Y-left_curves[0].Center.Y, 0),10)
#        line_down = rg.Line(c.Center, rg.Vector3d(0,-1,0),10)
#        
#        cur_1 = rg.Intersect.Intersection.LineCircle(line_left_curves, cir)[2]/[4]
#        
#        cur_2 =
# ---------- end python_8 ----------
pline = PolyLine(Vertices=python_7.o_pts, Closed=False)  # disabled
pline_2 = PolyLine(Vertices=python_7.o_pts_tree, Closed=False)  # disabled
pline_3 = PolyLine(Vertices=python_7.o_pts_tree_substract, Closed=False)  # disabled
panel_4 = Panel(python_7.out)  # disabled
