# Grasshopper definition SomethingElse.gh (Grasshopper 1.0.7)

# ---- group: Brick Geometry Generator
number_slider = Slider(2.5, range=0..10)
number_slider_2 = Slider(200, range=0..1000)
python = GhPythonScript(
    height_body=Slider(150, range=0..1000),
    height_pin=number_slider_2,
    start_height=Slider(1.4, range=0..10),
    layer_height=number_slider)  # -> out, flatten(body_heights), flatten(pin_only_heights)
# ---------- python: Python ----------
import scriptcontext as sc

# creating the heights

body_heights = []
pin_only_heights = []

height = start_height

height_body, height_pin = min(height_body, height_pin), max(height_body, height_pin)

print (height_body, height_pin)

while height < height_body:
    
    body_heights.append(height)
    
    height += layer_height
    
while height < height_pin:
    
    pin_only_heights.append(height)
    
    height += layer_height
    
sc.sticky["PrintSettings"]["height_body"]=height_body
sc.sticky["PrintSettings"]["height_pin"]=height_pin
sc.sticky["PrintSettings"]["start_height"]=start_height
sc.sticky["PrintSettings"]["layer_height"]=layer_height
sc.sticky["PrintSettings"]["layer_body_count"]=len(body_heights)
sc.sticky["PrintSettings"]["layer_pin_count"]=len(pin_only_heights)
sc.sticky["PrintSettings"]["layer_total_count"]=len(body_heights) + len(pin_only_heights)
# ---------- end python ----------

# ---- group: Brick Geometry Generator / where should we put it ?
number_slider_3 = Slider(350, range=100..450)
number_slider_4 = Slider(220, range=40..250)
number_slider_5 = Slider(250, range=40..250)

# ----
feed_rate_in_mm_s = Slider(40, range=0..100)
feed_rate_in_mm_s_2 = Slider(25, range=0..100)
line_linking_spacing = Slider(2.7, range=0..10)
inter_line_spacing = Slider(2, range=0..10)
split_distance = Slider(2, range=-10..10)
feedratesettings = GhPythonScript(
    feed_rate=feed_rate_in_mm_s_2,
    variable_feed_rate=Toggle(False),
    feed_rate_max=feed_rate_in_mm_s,
    feed_rate_max_start_start_ramp=Slider(5, range=0..25),
    feed_rate_max_end_start_ramp=Slider(10, range=0..100),
    feed_rate_max_start_end_ramp=Slider(135, range=0..1000),
    feed_rate_max_end_end_ramp=Slider(145, range=0..1000))  # -> flatten(out); inputs variable_feed_rate: Boolean
# ---------- feedratesettings: Python ----------
import scriptcontext as sc

sc.sticky["PrintSettings"]["feed_rate"] = feed_rate
sc.sticky["PrintSettings"]["feed_rate_variable"] = variable_feed_rate

if variable_feed_rate:
    
    sc.sticky["PrintSettings"]["feed_rate_max"] = feed_rate_max
    sc.sticky["PrintSettings"]["feed_rate_max_end_start_ramp"] = feed_rate_max_start_start_ramp
    sc.sticky["PrintSettings"]["feed_rate_max_end_start_ramp"] = feed_rate_max_end_start_ramp
    sc.sticky["PrintSettings"]["feed_rate_max_start_end_ramp"] = feed_rate_max_start_end_ramp
    sc.sticky["PrintSettings"]["feed_rate_max_end_end_ramp"] = feed_rate_max_end_end_ramp
    
print(True)
# ---------- end feedratesettings ----------

# ---- group: Nozzle
list = ValueList({"3.5", "5"}, selected="3.5")
nozzlesettings = GhPythonScript(x=feedratesettings, nozzle_diameter=list, layer_height=number_slider)  # -> flatten(out)
# ---------- nozzlesettings: Python ----------
import scriptcontext as sc

def linearInterpolation(input_x, val_s, x_s):

    val_a, val_b = val_s
    x_a, x_b = x_s

    x_a, x_b, val_a, val_b = float(x_a), float(x_b), float(val_a), float(val_b)

    distance_val = (input_x - x_a) / (x_b - x_a)

    output_val = (1 - distance_val) * val_a + distance_val * val_b

    return output_val

x_s = (2.5, 3.2)

val_s_5_spacing_cross_paths = (2.5, 2.0)
val_s_5_spacing_link = (3.4, 2.7)

val_s_3_5_spacing_cross_paths = (2.0, 1.6)
val_s_3_5_spacing_link = (2.7, 2.2)

if nozzle_diameter == 3.5:
    
    extrusion_rate = .64
    spacing_cross_paths = round(linearInterpolation(layer_height, val_s_3_5_spacing_cross_paths, x_s), 1)
    spacing_link = round(linearInterpolation(layer_height, val_s_3_5_spacing_link, x_s), 1)
    start_stop_retraction = 130
    start_reextrusion_rate = 40
    
if nozzle_diameter == 5.0:
    
    extrusion_rate = .8
    spacing_cross_paths = round(linearInterpolation(layer_height, val_s_3_5_spacing_cross_paths, x_s), 1)
    spacing_link = round(linearInterpolation(layer_height, val_s_5_spacing_link, x_s), 1)
    start_stop_retraction = 150
    start_reextrusion_rate = 50
    
# print(spacing_cross_paths, spacing_cross_paths, spacing_link)

sc.sticky["PrintSettings"]["print_extrusion_nozzle"] = nozzle_diameter   
sc.sticky["PrintSettings"]["print_extrusion_rate"] = extrusion_rate
sc.sticky["PrintSettings"]["print_spacing_cross"] = spacing_cross_paths
sc.sticky["PrintSettings"]["print_spacing_paths"] = spacing_cross_paths
sc.sticky["PrintSettings"]["print_spacing_link"] = spacing_link
sc.sticky["PrintSettings"]["print_spacing_start_stop_retraction"] = start_stop_retraction
sc.sticky["PrintSettings"]["print_spacing_start_reextrusion_rate"] = start_reextrusion_rate

print(True)
# ---------- end nozzlesettings ----------

# ----
line = Line([Line((-32.27841004, -1.576642047, 0), (0.6793035765, 0.08160769476, 0)), Line((-0.1498212945, -0.125673523, 0), (16.84723856, 33.45388375, 0)), Line((33.6370172, -22.92660747, 0), (-0.9789461654, 0.4961701302, 0))])
simplebrick = GhPythonScript(save_settings=Toggle(True), brick_length=number_slider_3, brick_width=number_slider_5, pin_spacing=number_slider_4)  # -> out, base_crv, pin_pts; inputs save_settings: Boolean
# ---------- simplebrick: Python ----------
import Rhino.Geometry as rg
import scriptcontext as sc

# creating the base shape and pins

brick_width, brick_length  = min(brick_width, brick_length), max(brick_width, brick_length)

print (brick_length, brick_width)

half_l = brick_length * .5
half_w = brick_width * .5

#     *       *
#   *            *
#     *       *

val_list = [(1,1), (1, -1), (-1, -1), (-1, 1)]

pt_list = []

for i in range(4):
    
    pt_list.append(rg.Point3d(half_l * val_list[i][0], half_w * val_list[i][1], 0.0))
    
    if i == 0:
        
        pt_list.append(rg.Point3d(half_l + half_w, 0, 0))
        
    elif i == 2:
        
        pt_list.append(rg.Point3d(- (half_l + half_w), 0, 0))

arc_set = [[0,1,2],[3,4,5]]
line_set = [[5,0],[2,3]]

poly_crv = rg.PolyCurve()
pin_pts = [rg.Point3d(-.5 * pin_spacing, 0, 0), rg.Point3d(.5 * pin_spacing, 0, 0)]

for i in range(2):
    
    pt_0, pt_1, pt_2, pt_3 = pt_list[-1 + i * 3], pt_list[0 + i * 3], pt_list[1 + i * 3], pt_list[2 + i * 3]
    
    line = rg.Line(pt_0, pt_1)
    
    poly_crv.Append(line)
    
    crv = rg.Arc(pt_1, pt_2, pt_3)
    
    poly_crv.Append(crv)
    
if save_settings:
    
    sc.sticky["PrintSettings"]["brick_width"]=brick_width
    sc.sticky["PrintSettings"]["brick_length"]=brick_length
    sc.sticky["PrintSettings"]["pin_spacing"]=pin_spacing
# ---------- end simplebrick ----------
number_slider_6 = Slider(10, range=1..10)
pt = Point(Point(0, 0, 0))
given_points = Point([Point(-102.3006922, 0.4886194024, 0), Point(105, 0, 0)])
given_shell = Curve(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)
manualnozzloverwrite = GhPythonScript(
    x=nozzlesettings,
    overwrite=Toggle(False),
    spacing_cross=split_distance,
    spacing_paths=inter_line_spacing,
    spacing_link=line_linking_spacing)  # -> out; inputs overwrite: Boolean
# ---------- manualnozzloverwrite: Python ----------
import scriptcontext as sc

if overwrite:
    
    sc.sticky["PrintSettings"]["print_spacing_cross"] = spacing_cross
    sc.sticky["PrintSettings"]["print_spacing_paths"] = spacing_paths
    sc.sticky["PrintSettings"]["print_spacing_link"] = spacing_link
    
print(True)
# ---------- end manualnozzloverwrite ----------
circle = CircleCNR(Center=pt, Normal=Vector(0, 0, 1), Radius=Slider(10, range=0..150))
pi = Pi(Factor=2)
X = UnitX(Factor=Slider(1, range=0..100))
pt_2 = Point(pt)
curve = Curve(<curve referenced from the Rhino model>)
point = Point([<point referenced from the Rhino model> x2])
crv = Curve(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)
python_2 = GhPythonScript()  # -> Out, A
end = EndPoints(Curve=line)  # -> Start, End
division = Division(A=pi, B=number_slider_6)
ln = Line(StartPoint=pt_2, EndPoint=X)
panel = Panel(nozzlesettings)

# ---- group: Reverse the direction of curve
# Explanation: Based on how the curve is directed, offsetting and/or splitting it will behave differently
flip = FlipCurve()  # -> Curve, Flag

# ----
series = Series(Start=0, Step=division, Count=number_slider_6)
item = ListItem(List=end.End, Index=0, Wrap=True)
crv_2 = Curve()
geometry = Geometry()
ln_2 = Line(StartPoint=end.Start, EndPoint=item)
rotate = Rotate(Geometry=X, Angle=series, Plane=PlaneXY(0, 0, 0))  # -> Geometry, Transform
pt_3 = Point(Point(-25.49595287, 36.53813949, 0))
splitting_geometry = Geometry(crv)  # disabled
python_3 = GhPythonScript()  # -> out, a
# ---------- python_3: Python ----------
import scriptcontext as sc

print(sc.sticky["PrintSettings"])
# ---------- end python_3 ----------
python_4 = GhPythonScript(x=rotate.Geometry)  # -> out, a, b; inputs x: list of Point3d
# ---------- python_4: Python ----------
import Rhino.Geometry as rg
import math

def rec_from_2_pt(pt_0, pt_1, th = 1.0):
    
    length = pt_0.DistanceTo(pt_1)
    
    th_interval = rg.Interval(-.5 * th, .5 * th)
    l_interval = rg.Interval(0, length)
    
    x_axis = rg.Vector3d(pt_1 - pt_0)
    y_axis = rg.Vector3d(x_axis.Y, - x_axis.X, 0.0)
    
    rec_pln = rg.Plane(pt_0, x_axis, y_axis)
    
    return rg.Rectangle3d(rec_pln, l_interval, th_interval).ToNurbsCurve()

def height_function(z_height, max_height):
    
    return (z_height / max_height) ** 5

def slices(layer_height, max_length, layer_count, curve_count = 5, c_r = 25.0):
    
    alfa_step = 2 * math.pi / float(curve_count)
    
    max_height = layer_count * layer_height
    
    layers = []
    non_boolean = []
    
    for i in range(layer_count):
        
        height = i * layer_height
        pt_0 = rg.Point3d(0,0,height)
        
        if i == layer_count - 1:
            
            length = max_length / float(curve_count) * .66 * (i + 1) / curve_count
            
        else:
            
            length = height_function(height, max_height) / float(curve_count) * max_length
            
        
        layer_set = [rg.Circle(pt_0, c_r).ToNurbsCurve()]
        
        for j in range(curve_count):
            
            alfa = j * alfa_step
            
            r = length + c_r
            
            pt_1 = rg.Point3d(r * math.cos(alfa), r * math.sin(alfa), height)
            
            layer_set.append(rec_from_2_pt(pt_0, pt_1))
            
        layers.extend(rg.Curve.CreateBooleanUnion(layer_set))
        non_boolean.extend(layer_set)

    return layers, non_boolean
    
a, b = slices(2.5, 100.0, 20, 5)
# ---------- end python_4 ----------
Z = UnitZ(Factor=Slider(1, range=0..10))
move = Move(Geometry=python_4.a, Motion=Z)  # -> Geometry, Transform
runion = RegionUnion(Curves=python_4.b)
crv_3 = Curve(move.Geometry)
panel_2 = Panel(python_4.out)
item_2 = ListItem(List=crv_3, Index=0, Wrap=True)  # -> Item1, Item
Z_2 = UnitZ(Factor=2.5)
move_2 = Move(Geometry=item_2.Item1, Motion=Z_2)  # -> Geometry, Transform
divide = DivideCurve(Curve=flatten([crv_3, move_2.Geometry]), Count=Slider(36, range=0..100), Kinks=True)  # -> Points, Tangents, Parameters

# ---- group: Shell Pattern / mod Based Dot Map
number_slider_7 = Slider(3, range=1..10)  # disabled
number_slider_8 = Slider(9.69, range=5..100)  # disabled
toggle = BooleanToggle(True)  # disabled
number_slider_9 = Slider(1.5708, range=0..3.1416)  # disabled
number_slider_10 = Slider(-0.2, range=-2..2)  # disabled
number_slider_11 = Slider(1.4, range=0..2)  # disabled

# ---- group: Shell Pattern / cylinder
number_slider_12 = Slider(5, range=0..10)  # disabled
number_slider_13 = Slider(10, range=0..100)  # disabled

# ----
number_slider_14 = Slider(604, range=0..1000)  # disabled
number_slider_15 = Slider(1.5, range=0.1..5)  # disabled
toggle_2 = BooleanToggle(True)  # disabled
nozzlesettings_2 = GhPythonScript(x=flatten(manualnozzloverwrite))  # -> out, extrusion_rate, spacing_cross, spacing_paths, spacing_link, start_stop_retraction, start_reextrusion_rate
# ---------- nozzlesettings_2: Python ----------
import scriptcontext as sc

extrusion_rate = sc.sticky["PrintSettings"]["print_extrusion_rate"]
spacing_cross = sc.sticky["PrintSettings"]["print_spacing_cross"]
spacing_paths = sc.sticky["PrintSettings"]["print_spacing_paths"]
spacing_link = sc.sticky["PrintSettings"]["print_spacing_link"]
start_stop_retraction = sc.sticky["PrintSettings"]["print_spacing_start_stop_retraction"]
start_reextrusion_rate = sc.sticky["PrintSettings"]["print_spacing_start_reextrusion_rate"]

print(True)
# ---------- end nozzlesettings_2 ----------
line_2 = Line(Line((-27.46198946, 138.4851678, 0), (-0.1413537679, -0.6893088134, 0)))

spacing_inter_paths = Number(nozzlesettings_2.spacing_paths)
spacing_link_exterior = Number(nozzlesettings_2.spacing_link)
spacing_cross = Number(nozzlesettings_2.spacing_cross)

pt_4 = Point(point)
pin_only_heights = Number(python.pin_only_heights)

# ---- group: Main Link connection / Offset Pins Layers
number_slider_16 = Slider(3, range=0..10)
number_slider_17 = Slider(3, range=0..10)

# ----
item_3 = ListItem(List=pin_only_heights, Index=0, Wrap=True)  # -> Item1, Item
pt_5 = Point(pt_4)
pt_6 = Point(divide.Points)
split = SplitTree(Data=pt_6, Masks=flatten("{0;0;0;0}"))  # -> Positive, Negative
item_4 = ListItem(List=split.Positive, Index=0, Wrap=True)
nozzlesettings_3 = GhPythonScript(x=flatten(nozzlesettings_2.out))  # -> out, feed_rate, variable_feed_rate, feed_rate_max, feed_rate_max_start_start_ramp, feed_rate_max_end_start_ramp, feed_rate_max_start_end_ramp, feed_rate_max_end_end_ramp
# ---------- nozzlesettings_3: Python ----------
import scriptcontext as sc

feed_rate = sc.sticky["PrintSettings"]["feed_rate"]
variable_feed_rate = sc.sticky["PrintSettings"]["feed_rate_variable"]

if variable_feed_rate:
    
    feed_rate_max = sc.sticky["PrintSettings"]["feed_rate_max"]
    feed_rate_max_start_start_ramp = sc.sticky["PrintSettings"]["feed_rate_max_end_start_ramp"]
    feed_rate_max_end_start_ramp = sc.sticky["PrintSettings"]["feed_rate_max_end_start_ramp"]
    feed_rate_max_start_end_ramp = sc.sticky["PrintSettings"]["feed_rate_max_start_end_ramp"]
    feed_rate_max_end_end_ramp = sc.sticky["PrintSettings"]["feed_rate_max_end_end_ramp"]
    
print(True)
# ---------- end nozzlesettings_3 ----------

# ---- group: Nozzle-Set@Start
nozzlesettings_4 = GhPythonScript(x=flatten(nozzlesettings_3.out))  # -> out, extrusion_rate, spacing_cross, spacing_paths, spacing_link, start_stop_retraction, start_reextrusion_rate
# ---------- nozzlesettings_4: Python ----------
import scriptcontext as sc

extrusion_rate = sc.sticky["PrintSettings"]["print_extrusion_rate"]
spacing_cross = sc.sticky["PrintSettings"]["print_spacing_cross"]
spacing_paths = sc.sticky["PrintSettings"]["print_spacing_paths"]
spacing_link = sc.sticky["PrintSettings"]["print_spacing_link"]
start_stop_retraction = sc.sticky["PrintSettings"]["print_spacing_start_stop_retraction"]
start_reextrusion_rate = sc.sticky["PrintSettings"]["print_spacing_start_reextrusion_rate"]
# ---------- end nozzlesettings_4 ----------

# ----
pt_7 = Point(flatten(divide.Points))
pt_8 = Point(Point(0, 0, 100))
savefile = Button()

# ---- group: don't remove
python_5 = GhPythonScript()  # -> out, path
# ---------- python_5: Python ----------
import os

print(os.name)
os_name = str(os.name)

ghComp = ghenv.Component
ghDoc = ghComp.OnPingDocument()

path = str(ghDoc.FilePath)

second_part = [
    "Dropbox",
    "Clay_Printing_Brick",
    "PatternBrickLibrary"
]

if "posix" == os_name:
    
    print("I am a Mac")
    
    first_part = ['/Users']
    
    string_parts = path.split("/Users/")[1]
    user_name = string_parts.split('/')[0]
    print(string_parts)
    print(user_name)

elif "nt" == os_name:

    print("I am a Pc")
    
    first_part = ['C:\\Users']
    
    string_parts = path.split("\\Users\\")[1]
    user_name = string_parts.split('\\')[0]
    print(string_parts)
    print(user_name)

parts = first_part + [user_name] + second_part

path = os.path.join(*parts)
# ---------- end python_5 ----------
defaultmap = FilePath(python_5.path)
path = FilePath()
python_6 = GhPythonScript(default_dropbox_path=defaultmap, costum_path=path)  # -> out, path
# ---------- python_6: Python ----------
import sys
import scriptcontext as sc

if costum_path == None:
    path = default_dropbox_path
    
else:
    path = costum_path

sys.path.append(path)

sc.sticky["PrintSettings"] = {"library_path": path}
sc.sticky["PrintSettings"]["_project:"] = "CCLegos"
sc.sticky["PrintSettings"]["_project_by:"] = "MarieGriesmar"
sc.sticky["PrintSettings"]["_project_gcode_generator_by:"] = "JonasWard"
print(sys.path)
# ---------- end python_6 ----------
library_path = FilePath(python_6.path)
library_path_2 = FilePath(library_path)

# ----
layer_slicing = GhPythonScript(x=library_path, geometry=curve, heights=python.body_heights)  # -> out, ori_crvs, crv_sets, a, b, c, d; inputs geometry: GeometryBase, heights: list; disabled
# ---------- layer_slicing: Python ----------
import sys

sys.path.append(x)

import brickSlicer as bs

reload(bs)

ori_crvs = bs.slicing(geometry, heights)
# crv_sets, a, b, c = bs.splitter(ori_crvs, slicing_object = slice_geo, split_type = "first_layer")
# ---------- end layer_slicing ----------
crv_4 = Curve(layer_slicing.ori_crvs)  # disabled

# ---- group: — Slicing for pattern —
number_slider_18 = Slider(0, range=0..1)  # disabled
number_slider_19 = Slider(2.5, range=0..10)  # disabled
toggle_3 = BooleanToggle(False)  # disabled
toggle_4 = BooleanToggle(False)  # disabled
toggle_5 = BooleanToggle(False)  # disabled
num = Number(100)  # disabled
slicing_structuring = GhPythonScript(
    x=library_path_2,
    ori_crvs=crv_3,
    spacing=number_slider_19,
    end_smooth=toggle_4,
    custom_crv_length=toggle_5,
    crv_l=num,
    split=toggle_3,
    slice_geo=splitting_geometry,
    split_item=number_slider_18)  # -> out, split, layers, set_tuple, crv_sets, ori_crvs, slice_geo; inputs ori_crvs: list, end_smooth: Boolean, custom_crv_length: Boolean, split: Boolean, split_item: Int32; disabled
# ---------- slicing_structuring: Python ----------
# snippet of code to make this python component look for it's   code in the parent folder of the .gh file

import sys

sys.path.append(x)

import vertexClass_v1 as vc
import brickSlicer as bs
import scriptcontext as sc

reload(bs)
reload(vc)

print(type(slice_geo))

    
if custom_crv_length:
    
    crv_l = crv_l
    
    sc.sticky["PrintSettings"]["pattern_crv_l"] = crv_l
    
else:
    
    crv_l = None


if split:

    crv_sets, vis_a, vis_b, pts_crv_a_and_b = bs.splitter(ori_crvs, slicing_object = slice_geo, split_type = "first_layer")
    
    crv_set_a = [crv_set[0] for crv_set in crv_sets]
    crv_set_b = [crv_set[1] for crv_set in crv_sets]
    
    crv_sets = [crv_set_a, crv_set_b]
    
    non_pattern_part = [vc.divideCurveByLength(crv, spacing) for crv in crv_sets[(split_item + 1) % 2]]
    
    pattern_part, set_tuple, _ = vc.moveSet(crv_sets[split_item], ori_crvs, spacing, crv_l)
    layers = [pattern_part, non_pattern_part]
    
    
else:

    layers, set_tuple = vc.singleCurve(ori_crvs, spacing, end_smooth, crv_l)
    
sc.sticky["PrintSettings"]["pattern_spacing"] = spacing
sc.sticky["PrintSettings"]["pattern_end_smooth"] = end_smooth

print(layers)
# ---------- end slicing_structuring ----------

# ----
crv_5 = Curve(slicing_structuring.split)

# ---- group: Shell Pattern
layermap = GhPythonScript()  # -> out, a; disabled
# ---------- layermap: Python ----------
a = [[2, 1, 1], [1, 2, 3], [0, 1, 2]]
# ---------- end layermap ----------
number_slider_20 = Slider(0, range=0..100)  # disabled
number_slider_21 = Slider(10, range=0..100)  # disabled
list_2 = ValueList({"dotMap": 0, "ellipsoidBumpMap": 1, "sinWarp": 2, "cylinderMap": 3, "layerMap": 4, "modulorBased": 5}, selected="cylinderMap")  # disabled
number_slider_22 = Slider(2.3, range=0..10)  # disabled
number_slider_23 = Slider(0.5, range=0..2)  # disabled
number_slider_24 = Slider(70, range=0..100)  # disabled
number_slider_25 = Slider(2, range=0..10)  # disabled
number_slider_26 = Slider(4, range=0..100)  # disabled
number_slider_27 = Slider(20, range=10..100)  # disabled
number_slider_28 = Slider(2, range=0..100)  # disabled
number_slider_29 = Slider(9, range=0..100)  # disabled
toggle_6 = BooleanToggle(True)  # disabled
toggle_7 = BooleanToggle(True)  # disabled
toggle_8 = BooleanToggle(False)  # disabled
pattern = GhPythonScript(
    x=library_path_2,
    split=slicing_structuring.split,
    layers=slicing_structuring.layers,
    set_tuple=slicing_structuring.set_tuple,
    periodic=toggle_6,
    random_dots=toggle_2,
    random_seed=number_slider_14,
    y_scale_factor=number_slider_15,
    sub_length=number_slider_25,
    layer_count=number_slider_24,
    layer_height=number_slider_22,
    edge_easing=toggle_7,
    edge_ease_zero=number_slider_20,
    edge_ease_end=number_slider_21,
    pattern_type=list_2,
    period=number_slider_28,
    phase_shift=number_slider_23,
    spacing=number_slider_27,
    radius=number_slider_29,
    max_val=number_slider_26,
    y_spacing=number_slider_8,
    layer_shift=number_slider_7,
    shift_a=number_slider_11,
    shift_b=number_slider_10,
    ellipsoid=toggle,
    rot_alfa=number_slider_9,
    height=number_slider_13,
    radius_bot=number_slider_12,
    pattern_set=layermap.a,
    direction=toggle_8)  # -> out, curve_list, pt_sets, curve_set, c; inputs split: Boolean, layers: list, set_tuple: list, periodic: Boolean, random_dots: Boolean, random_seed: Int32, layer_count: Int32, layer_height: Int32, edge_easing: Boolean, pattern_type: Int32, ellipsoid: Boolean, pattern_set: list, direction: Boolean; disabled
# ---------- pattern: Python ----------
import sys

sys.path.append(x)

print(sys.path)

import patternGenv2_2 as pm
import scriptcontext as sc

reload(pm)

if split:
    
    other_part = layers[1]
    pattern_part = layers[0]
    periodic = False
    
else:
    
    other_part = None
    pattern_part = layers
    edge_easing = False

sc.sticky["PrintSettings"]["pattern_split"] = split
sc.sticky["PrintSettings"]["pattern_periodic"] = periodic
sc.sticky["PrintSettings"]["pattern_edge_easing"] = edge_easing

pm.PatternMap.DOT_MAP_RND = random_dots
pm.PatternMap.DOT_MAP_RND_SEED = random_seed

sc.sticky["PrintSettings"]["pattern_random_dots"] = random_dots
sc.sticky["PrintSettings"]["pattern_random_seed"] = random_seed

if y_scale_factor <> 1.0:
    
    pm.PatternMap.Y_SPACING_FACTOR = y_scale_factor
    sc.sticky["PrintSettings"]["pattern_y_scale_factor"] = y_scale_factor

pattern_map = pm.PatternMap(pattern_part, set_tuple, periodic, other_set = other_part)
pattern_map.build()
# pattern_map.subdivide(sub_length)
# pattern_map.generate(layer_height, layer_count)

print("I am out 3")

if edge_easing:
    
    sc.sticky["PrintSettings"]["pattern_edge_easing_zero"] = edge_ease_zero
    sc.sticky["PrintSettings"]["pattern_edge_easing_end"] = edge_ease_end

    pattern_map.edgeEasing(edge_ease_zero, edge_ease_end)

if pattern_type == 0:
    
    sc.sticky["PrintSettings"]["pattern_type"] = "dot_map"
    sc.sticky["PrintSettings"]["pattern_type_dot_map_spacing"] = spacing
    sc.sticky["PrintSettings"]["pattern_type_dot_map_radius"] = radius
    sc.sticky["PrintSettings"]["pattern_type_dot_map_max_val"] = max_val
    sc.sticky["PrintSettings"]["pattern_type_dot_map_direction"] = direction
    
    pattern_map.dotMap(spacing, radius, max_val, direction)

elif pattern_type == 1:
    
    sc.sticky["PrintSettings"]["pattern_type"] = "ellipsoid_bump_map"
    sc.sticky["PrintSettings"]["pattern_type_ellipsoid_bump_map_spacing"] = spacing
    sc.sticky["PrintSettings"]["pattern_type_ellipsoid_bump_map_radius"] = radius
    sc.sticky["PrintSettings"]["pattern_type_ellipsoid_bump_map_val"] = max_val
    sc.sticky["PrintSettings"]["pattern_type_ellipsoid_bump_map_direction"] = direction

    pattern_map.ellipsoidBumpMap(spacing, radius, max_val, direction)

elif pattern_type == 2:
    
    sc.sticky["PrintSettings"]["pattern_type"] = "sin_warp"
    sc.sticky["PrintSettings"]["pattern_type_sin_warp_period"] = period
    sc.sticky["PrintSettings"]["pattern_type_sin_warp_max_val"] = max_val
    sc.sticky["PrintSettings"]["pattern_type_sin_warp_phase_shift"] = phase_shift
    sc.sticky["PrintSettings"]["pattern_type_sin_warp_direction"] = direction
    
    pattern_map.sinWarp(period, max_val, phase_shift, direction)

elif pattern_type == 3:

    if radius_bot < .01:

        radius_bot = radius

    else:

        radius_bot = radius_bot
        
    sc.sticky["PrintSettings"]["pattern_type"] = "cylinder_map"
    sc.sticky["PrintSettings"]["pattern_type_cylinder_map_spacing"] = spacing
    sc.sticky["PrintSettings"]["pattern_type_cylinder_map_height"] = height
    sc.sticky["PrintSettings"]["pattern_type_cylinder_map_radius"] = radius
    sc.sticky["PrintSettings"]["pattern_type_cylinder_map_max_val"] = max_val
    sc.sticky["PrintSettings"]["pattern_type_cylinder_map_radius_bot"] = radius_bot
    sc.sticky["PrintSettings"]["pattern_type_cylinder_map_direction"] = direction

    pattern_map.cylinderMap(spacing, height, radius, max_val, radius_bot, direction)

elif pattern_type == 4:
    
    sc.sticky["PrintSettings"]["pattern_type"] = "layer_map"
    sc.sticky["PrintSettings"]["pattern_type_layer_map_spacing"] = spacing
    sc.sticky["PrintSettings"]["pattern_type_layer_map_pattern_set"] = pattern_set
    sc.sticky["PrintSettings"]["pattern_type_layer_map_radius"] = radius
    sc.sticky["PrintSettings"]["pattern_type_layer_map_max_val"] = max_val
    sc.sticky["PrintSettings"]["pattern_type_layer_map_direction"] = direction

    pattern_map.layerMap(spacing, pattern_set, radius, max_val, direction)
    
elif pattern_type == 5:
    
    sc.sticky["PrintSettings"]["pattern_type"] = "mod_base_dot_map"
    sc.sticky["PrintSettings"]["pattern_type_mod_base_dot_map_spacing"] = spacing
    sc.sticky["PrintSettings"]["pattern_type_mod_base_dot_map_y_spacing"] = y_spacing
    sc.sticky["PrintSettings"]["pattern_type_mod_base_dot_map_max_val"] = max_val
    sc.sticky["PrintSettings"]["pattern_type_mod_base_dot_map_ellipsoid"] = ellipsoid
    sc.sticky["PrintSettings"]["pattern_type_mod_base_dot_map_direction"] = direction
    sc.sticky["PrintSettings"]["pattern_type_mod_base_dot_map_layer_shift"] = layer_shift
    sc.sticky["PrintSettings"]["pattern_type_mod_base_dot_map_shift_a"] = shift_a
    sc.sticky["PrintSettings"]["pattern_type_mod_base_dot_map_shift_b"] = shift_b
    sc.sticky["PrintSettings"]["pattern_type_mod_base_dot_map_rot_alfa"] = rot_alfa
    
    pattern_map.modBasedDotMap(
        x_spacing = spacing,
        y_spacing = y_spacing,
        max_val = max_val,
        ellipsoid = ellipsoid,
        direction = direction,
        layer_shift = layer_shift,
        shift_a = shift_a,
        shift_b = shift_b,
        rot_alfa = rot_alfa
    )

c = pattern_map.makeMesh()
curve_set = pattern_map.makeCurves()

pt_sets = pattern_map.pts_set
# ---------- end pattern ----------
crv_6 = Curve(pattern.curve_set)

# ----
mesh = Mesh(pattern.c)
panel_3 = Panel(pattern.out)

# ---- group: — Shell Setup —
list_3 = ValueList({"detached", "crossing"}, selected="detached")
list_4 = ValueList({"Inside": "inside", "Outside": "outside"}, selected="Outside")
# amount of layers per shell
# 
# Outside/Inside : which layer would be printed first or last
# 
# Split line = location of the seam
# 
# Side Bool = external or left or right.?
toggle_9 = BooleanToggle(True)
python_7 = GhPythonScript(
    x=library_path_2,
    crvs=pattern.curve_set,
    shell_spacing=spacing_inter_paths,
    direction=list_4,
    count=Slider(1, range=0..10),
    split_distance=spacing_cross,
    split_type=list_3,
    split_line=line_2,
    side_bool=toggle_9)  # -> out, a, b, link_inner_crvs, main_inner_crvs, outer_crvs, pt_sets; inputs crvs: list of Curve, count: Int32, side_bool: Boolean; disabled
# ---------- python_7: Python ----------
import sys
import Rhino.Geometry as rg

sys.path.append(x)

# print(sys.path)

import generalFunctions as gf
import layerFunctions as lf
import scriptcontext as sc

sc.sticky["PrintSettings"]["shell_count"] = count
sc.sticky["PrintSettings"]["shell_direction"] = direction
sc.sticky["PrintSettings"]["shell_spacing"] = shell_spacing
sc.sticky["PrintSettings"]["shell_split_distance"] = split_distance
sc.sticky["PrintSettings"]["shell_split_type"] = split_type


reload(gf)
reload(lf)

o_crv_sets = []
outer_crvs = []

if count > 1:

    for crv_i, crv in enumerate(crvs):
        
        print(crv_i)
    
        o_crv_set = gf.offsetCurveSet(crv, shell_spacing, direction, count)
        layer_set = lf.LinkingLayers(o_crv_set, split_distance, side_bool, split_type, split_line)
        layer_set.createOrganisedCurves()
        pt_set = layer_set.joinCrvs()
    
        pt_set = pt_set[1:-1] + [pt_set[1]]
    
        crv = rg.Polyline(pt_set).ToPolylineCurve()
    
        o_crv_sets.append(o_crv_set)
        outer_crvs.append(crv)
        
else:
    
    outer_crvs = crvs

o_type = rg.CurveOffsetCornerStyle.Sharp

main_inner_crvs = []
link_inner_crvs = []

if count == 1:
    
    for crv in crvs:
        
        print(crv)
    
        main_inner_crv = crv
        
        pln = rg.Plane(main_inner_crv.PointAt(0.0), rg.Vector3d(0,0,1))
        
        link_inner_crv = main_inner_crv.Offset(pln, -shell_spacing, .01, o_type)[0]
        
        main_inner_crvs.append(main_inner_crv)
        link_inner_crvs.append(link_inner_crv)

elif direction == "outside":
    
    for o_crv_set in o_crv_sets:
    
        main_inner_crv = rg.Polyline(o_crv_set[0]).ToPolylineCurve()
        
        pln = rg.Plane(main_inner_crv.PointAt(0.0), rg.Vector3d(0,0,1))
        
        link_inner_crv = main_inner_crv.Offset(pln, -shell_spacing, .01, o_type)[0]
        
        main_inner_crvs.append(main_inner_crv)
        link_inner_crvs.append(link_inner_crv)
    
else:
    
    for o_crv_set in o_crv_sets:
    
        main_inner_crv = rg.Polyline(o_crv_set[0]).ToPolylineCurve()
        
        pln = rg.Plane(main_inner_crv.PointAt(0.0), rg.Vector3d(0,0,1))
        
        link_inner_crv = main_inner_crv.Offset(pln, -shell_spacing, .01, o_type)[0]
        
        main_inner_crvs.append(main_inner_crv)
        link_inner_crvs.append(link_inner_crv)
# ---------- end python_7 ----------

# ----
library_path_3 = FilePath(library_path_2)

# ---- group: — PIN Setup —
python_8 = GhPythonScript(
    x=library_path_3,
    pin_pts=flatten(pt_4),
    connection_count=Slider(3, range=1..4),
    max_main_line=Slider(100, range=25..250),
    start_end_alfa=Slider(1.571, range=0..3.142),
    mid_alfa=Slider(0.5, range=0..3.142),
    pin_height=Slider(260, range=0..1000),
    bot_rad=Slider(35, range=0..100),
    top_rad=Slider(18, range=0..100),
    resolution=Slider(16, range=0..100),
    spacing=spacing_link_exterior)  # -> out, main_links, side_links, split_lines, pin_pt_sets, pins, mid_links, link_line_vis, pin_geo, extra_pts; inputs pin_pts: list of Point3d, connection_count: Int32, resolution: Int32
# ---------- python_8: Python ----------
import sys

sys.path.append(x)

import pinLinkingBis as pl

reload(pl)

main_links, link_lines, split_lines, pin_pt_sets, mid_links, b_mid_pts = pl.createLinks(
    pin_pts = pin_pts,
    connection_count = connection_count,
    max_main_line = max_main_line,
    start_end_alfa = start_end_alfa,
    mid_alfa = mid_alfa
)

link_line_vis = link_lines

main_links = pl.linkSetGeneration(main_links, spacing)
side_links = pl.linkSetGeneration(link_lines, spacing, 2)
mid_links = pl.linkSetGeneration(mid_links, spacing, 2)

extra_pts = []

for i, b_pt_set in enumerate(b_mid_pts):
    
    extra_pts.extend(pl.linkClosestPoints(main_links[i], b_pt_set))

pins = pl.pinMaker(pin_pts, pin_height, bot_rad, top_rad, resolution)

pin_geo = []

for pin in pins:
    
    pin_geo.append(pin.createGeometry())
# ---------- end python_8 ----------

# ----
panel_4 = Panel(python_7.out)
end_link_curve = Curve(graft(python_7.main_inner_crvs))
side_link_curve = Curve(graft(python_7.link_inner_crvs))
panel_5 = Panel(python_8.out)
python_9 = GhPythonScript(pin=python_8.pins, pin_heights=pin_only_heights)  # -> out, slices; inputs pin_heights: list
# ---------- python_9: Python ----------
slices = []

for h in pin_heights:
    
    slices.append(pin.createSlice(h))
# ---------- end python_9 ----------

# ---- group: Main Link connection
python_10 = GhPythonScript(x=flatten(end_link_curve))  # -> out, flatten(heights), flatten(index); inputs x: list of Curve
# ---------- python_10: Python ----------
heights = []
index = []

for crv_i, crv in enumerate(x):
    
    heights.append(crv.PointAt(0.0).Z)
    index.append(crv_i)
# ---------- end python_10 ----------
python_11 = GhPythonScript(
    x=library_path_3,
    main_links=flatten(python_8.main_links),
    pins=flatten(python_8.pins),
    link_set=flatten(python_8.side_links),
    heights=flatten(python_10.heights),
    count=flatten(python_10.index),
    bottom_shift_count=number_slider_16,
    bottom_max_shift=number_slider_17)  # -> out, graft(main_crv), b, c, inner_crvs, main_crv_pt_set, main_links; inputs main_links: list, pins: list, link_set: list
# ---------- python_11: Python ----------
import sys

sys.path.append(x)

import pinLinkingBis as pl

reload(pl)

if count < bottom_shift_count:
    
    print("I am shifting the bottom layer with: ")
    
    count_delta = bottom_max_shift / float(bottom_shift_count)
    
    bottom_offset = count_delta * (bottom_shift_count - count)
    print("bottom offset: %s" % bottom_offset)
    
else:
    
    bottom_offset = None

main_crv, b, main_links, inner_crvs = pl.makeMainShape(pins, main_links, heights, bottom_offset)
# ---------- end python_11 ----------

# ---- group: Interconnections - code
python_12 = GhPythonScript(side_links=python_8.side_links, end_link_index=Slider(1, range=0..100))  # -> out, flatten(side_links), flatten(end_link), end_link_vis; inputs side_links: list, end_link_index: Int32
# ---------- python_12: Python ----------
import Rhino.Geometry as rg
from copy import deepcopy as dc

side_link_count = len(side_links)

end_link_index = end_link_index % side_link_count

end_link = side_links.pop(end_link_index)

# visualisation of the end link

end_link_vis = dc(end_link.lines)

for end_link_line in end_link_vis:
    
    sc_m = rg.Transform.Scale(end_link_line.From, 100.0)
    
    end_link_line.Transform(sc_m)
# ---------- end python_12 ----------
path_mapper = PathMapper(python_11.main_crv, source="{A;B}", target="{B}")
path_mapper_2 = PathMapper(side_link_curve, source="{A;B;C;D;E}", target="{E}")
path_mapper_3 = PathMapper(end_link_curve, source="{A;B;C;D;E}", target="{E}")
midlinks = GhPythonScript(x=library_path_3, mid_links=flatten(python_8.mid_links), interior_crv=path_mapper, exterior_crv=path_mapper_2)  # -> out, output_mid_links, mid_link_lines; inputs mid_links: list, interior_crv: Curve, exterior_crv: Curve
# ---------- midlinks: Python ----------
import Rhino.Geometry as rg
from copy import deepcopy as dc

import sys

sys.path.append(x)

height_val = interior_crv.PointAt(0.0).Z

mv_m = rg.Transform.Translation(rg.Vector3d(0,0,height_val))

mid_link_lines = []

print(type(exterior_crv))

output_mid_links = []

for mid_link in mid_links:
    
    loc_link = dc(mid_link)
    loc_link.Transform(mv_m)
    
    loc_link.trimLines(exterior_crv, True)
    loc_link.trimLines(interior_crv, False)
    
    output_mid_links.append(loc_link)
    
    mid_link_lines.extend(loc_link.lines)
    
print(mid_link_lines[0].To.Z)
# ---------- end midlinks ----------
python_13 = GhPythonScript(x=library_path_3, end_link=flatten(python_12.end_link), interior_crv=path_mapper, exterior_crv=path_mapper_3)  # -> out, graft(output_end_link), side_link_lines; inputs interior_crv: Curve, exterior_crv: Curve
# ---------- python_13: Python ----------
import Rhino.Geometry as rg
from copy import deepcopy as dc

import sys

sys.path.append(x)

height_val = interior_crv.PointAt(0.0).Z

mv_m = rg.Transform.Translation(rg.Vector3d(0,0,height_val))
    
output_end_link = dc(end_link)
output_end_link.Transform(mv_m)
    
output_end_link.trimLines(exterior_crv, True)
output_end_link.trimLines(interior_crv, False)

side_link_lines = dc(output_end_link.lines)
# ---------- end python_13 ----------
python_14 = GhPythonScript(x=library_path_3, side_links=flatten(python_12.side_links), interior_crv=path_mapper, exterior_crv=path_mapper_2)  # -> out, output_side_links, side_link_lines; inputs side_links: list, interior_crv: Curve, exterior_crv: Curve
# ---------- python_14: Python ----------
import Rhino.Geometry as rg
from copy import deepcopy as dc

import sys

sys.path.append(x)

height_val = interior_crv.PointAt(0.0).Z

mv_m = rg.Transform.Translation(rg.Vector3d(0,0,height_val))

side_link_lines = []

print(type(exterior_crv))

output_side_links = []

for side_link in side_links:
    
    loc_link = dc(side_link)
    loc_link.Transform(mv_m)
    
    loc_link.trimLines(exterior_crv, True)
    loc_link.trimLines(interior_crv, False)
    
    output_side_links.append(loc_link)
    
    side_link_lines.extend(loc_link.lines)
    
print(side_link_lines[0].To.Z)
# ---------- end python_14 ----------

# ----
crv_7 = Curve(python_9.slices)
panel_6 = Panel(path_mapper_3)
panel_7 = Panel(midlinks.out)
path_mapper_4 = PathMapper(crv_7, source="{A;B;C}", target="{C}")
panel_8 = Panel(python_14.out)
panel_9 = Panel(path_mapper_4)
# PIN - INFILL
# connections...?
# 
# 
# system, if organic shell
outer_crv = Curve(graft(python_7.outer_crvs))

# ---- group: don't remove (continued)
library_path_4 = FilePath(library_path_3)
library_path_5 = FilePath(library_path_4)

# ---- group: Interior Curves
line_3 = Line(flatten(python_8.split_lines))
crv_8 = Curve(python_11.inner_crvs)
layer_count = Slider(1, range=0..10)
path_mapper_5 = PathMapper(python_11.main_links, source="{C;D}", target="{D}")
path_mapper_6 = PathMapper(python_13.output_end_link, source="{D;E}", target="{D}")
path_mapper_7 = PathMapper(midlinks.output_mid_links, source="{D;E}", target="{D}")
list_5 = ValueList({"detached", "crossing"}, selected="crossing")
list_6 = ValueList({"Inside": "inside", "Outside": "outside"}, selected="Inside")
path_mapper_8 = PathMapper(crv_8, source="{C;D}", target="{D}")
path_mapper_9 = PathMapper(python_14.output_side_links, source="{D;E}", target="{D}")
python_15 = GhPythonScript(
    x=library_path_4,
    extra_pts=flatten(python_8.extra_pts),
    main_links=path_mapper_5,
    side_links=path_mapper_9,
    end_link=path_mapper_6,
    mid_links=path_mapper_7,
    crvs=path_mapper_8,
    split_lines=line_3,
    distance=spacing_inter_paths,
    direction=list_6,
    count=layer_count,
    split_distance=spacing_cross,
    split_type=list_5,
    side_bool=Toggle(True),
    diamond_link=Toggle(True),
    safety=Toggle(True),
    main_link_length=Slider(26.1, range=0..100),
    side_length=Slider(61.3, range=0..100))  # -> out, log, b, c, d, e, pt_sets, start_and_end_pt, main_crv; inputs extra_pts: list of Point3d, main_links: list, side_links: list, mid_links: list, crvs: list of Curve, split_lines: list of Line, count: Int32, side_bool: Boolean
# ---------- python_15: Python ----------
import sys

sys.path.append(x)

# print(sys.path)

import generalFunctions as gf
import layerFunctions as lf
import Rhino.Geometry as rg
import pinLinkingBis as pl

from copy import deepcopy as dc

reload(gf)
reload(lf)
reload(pl)

log = ["new sequence start"]

diamond_settings = (diamond_link, safety, (main_link_length, side_length))

pt_sets = []

inner_crvs = []

height = crvs[0].PointAt(0.0).Z

mv_m = rg.Transform.Translation(rg.Vector3d(0,0, height))

loc_split_lines = dc(split_lines)
[line.Transform(mv_m) for line in loc_split_lines]

print loc_split_lines

crv_count = len(crvs)
print("there are %s curves in your list" % crv_count)

if count == 1:
    
    for crv in crvs:
        
        crv.Reverse()
        
    inner_crvs = crvs
    
else:
    
    for crv_i, crv in enumerate(crvs):
        
        a = gf.offsetCurveSet(crv, distance, direction, count)
        layer_set = lf.LinkingLayers(a, split_distance, side_bool, split_type, split_line = loc_split_lines[crv_i])
        # a = layer_set.split_a
        # b = layer_set.split_b
        # c = layer_set.split_line
        # d = layer_set.split_axis
        a, b, c, d, e = layer_set.createOrganisedCurves()
        
        pt_set = layer_set.joinCrvs()
        pt_set = pt_set[1:-1] + [pt_set[1]]
        
        crv = rg.Polyline(pt_set).ToPolylineCurve()
        
        inner_crvs.append(crv)

print("I passed this hurdle")

loc_extra_pts = []

for extra_pt in extra_pts:
    
    loc_pt = dc(extra_pt)
    loc_pt.Transform(mv_m)
    loc_extra_pts.append(loc_pt)
    
main_crv = pl.makeInnerCurve(inner_crvs, main_links, side_links, end_link, loc_extra_pts, mid_links, diamond_settings = diamond_settings)

print(main_crv)

start_and_end_pt = [main_crv.PointAt(main_crv.Domain[0]), main_crv.PointAt(main_crv.Domain[1])]
# ---------- end python_15 ----------

# ----
panel_10 = Panel(python_15.out)

# ---- group: Brim
# SETTINGS need to be externalized
number_slider_30 = Slider(50, range=10..100)
item_5 = ListItem(List=pattern.curve_set, Index=0, Wrap=True)
divide_2 = DivideCurve(Curve=item_5, Count=1, Kinks=True)  # -> Points, Tangents, Parameters
brim = GhPythonScript(
    x=library_path_4,
    first_pt=item_4,
    pts=split.Positive,
    offset_amount=Slider(10, range=0..10),
    start_safety_distance=number_slider_30)  # -> out, flatten(a), start_pt, outer_brim_crv, base_pt, crv; inputs first_pt: Point3d, pts: list of Point3d
# ---------- brim: Python ----------
import sys

sys.path.append(x)

import Rhino.Geometry as rg
import generalFunctions as gf
import polyline as pl

reload(pl)

crv = rg.Polyline(pts).ToPolylineCurve()
_, t_val = crv.ClosestPoint(first_pt)

print(t_val)

crv.ChangeClosedCurveSeam(t_val)

base_pt_set = list(crv.ToPolyline().ToArray())

brim_pl = pl.StructuredPolyline(base_pt_set[:-1])
brim_pl.offset(offset_amount)

pt_set = brim_pl.pointSet() + [brim_pl.pointSet()[0]]

crv = rg.Polyline(pt_set).ToPolylineCurve()
_, t_val = crv.ClosestPoint(first_pt)

base_pt = crv.PointAt(t_val)
crv.ChangeClosedCurveSeam(t_val)

# base_pt = brim_pl.v_set[0]
start_pt, first_pt = base_pt, first_pt

start_pt = first_pt + (start_pt - first_pt) * (start_safety_distance / offset_amount)

# a = [rg.Point3d(start_pt)] + brim_pt_set
a = list(crv.ToPolyline().ToArray())
# ---------- end brim ----------

# ---- group: Background process (Layer unioning Generation)
path_mapper_10 = PathMapper(outer_crv, source="{A;B;C;D;E}", target="{E}")
path_mapper_11 = PathMapper(python_15.start_and_end_pt, source="{A;B}", target="{A}")
python_16 = GhPythonScript(x=library_path_4, start_end_pts=path_mapper_11, exterior_crv=path_mapper_10, interior_crv=python_15.main_crv)  # -> out, a; inputs start_end_pts: list of Point3d, exterior_crv: Curve, interior_crv: Curve
# ---------- python_16: Python ----------
import sys

sys.path.append(x)

import generalFunctions as gf

result_crvs, _ = gf.layer2ptIntersect(exterior_crv, start_end_pts)
pt_set = list(gf.curveToPolyline(gf.longestCurve(result_crvs)).ToArray())
pt_set_2 = list(gf.curveToPolyline(interior_crv).ToArray())

pt_set_2.reverse()

a = pt_set + pt_set_2[1:-1]
# ---------- end python_16 ----------

# ----
crv_9 = Curve(brim.crv)

# ---- group: Start Point - End Point LISTS
pt_9 = Point(flatten(python_16.a))
first_point_brim = ListItem(List=pt_9, Index=0, Wrap=True)
last_point_pin = ListItem(List=pt_9, Index=0, Wrap=True)  # -> Item1, Item

# ----
endpoint = Point(last_point_pin.Item1)
helixpin = GhPythonScript(
    pins=python_8.pins,
    start_height=item_3.Item,
    start_pt=endpoint,
    end_height=number_slider_2,
    start_alfa=Slider(4.33, range=0..10),
    layer_height=number_slider)  # -> out, pin_helix_lists; inputs pins: list, start_pt: Point3d
# ---------- helixpin: Python ----------
pin_helix_lists = []

for i, pin in enumerate(pins):
    
    if i == 0:
        
        # first pin, which uses a start point
        
        helix = pin.helix(
            end_h = end_height,
            start_pt = start_pt,
            layer_h = layer_height
        )
        
        pin_helix_lists.append(helix)
        
    else:
        
        helix = pin.helix(
            end_h = end_height,
            start_h = start_height - layer_height * .5,
            layer_h = layer_height,
            start_alfa = start_alfa
        )
        
        pin_helix_lists.append(helix)
# ---------- end helixpin ----------

# ---- group: Seam
endpoint_2 = Point(last_point_pin.Item1)
splitlines = Line(flatten(line_3))
update_split_lines = GhPythonScript(end_pt=endpoint_2, split_lines=splitlines)  # -> out, split_lines; inputs end_pt: Point3d, split_lines: list of Line
# ---------- update_split_lines: Python ----------
end_pt.Z = 0.0
split_lines[0].To = end_pt
# ---------- end update_split_lines ----------

# ---- group: Pin layer curve Generation
line_4 = Line(graft(update_split_lines.split_lines))
path_mapper_12 = PathMapper(line_4, source="{A;B;C}", target="{C}")
list_7 = ValueList({"Inside": "inside", "Outside": "outside"}, selected="Inside")
python_17 = GhPythonScript(
    x=library_path_4,
    invert=Toggle(False),
    crvs=path_mapper_4,
    split_line=path_mapper_12,
    distance=spacing_inter_paths,
    direction=list_6,
    count=layer_count,
    split_distance=spacing_cross,
    split_type=list_5,
    side_bool=Toggle(True))  # -> out, log, b, c, d, e, pt_sets, start_and_end_pt, main_crv; inputs invert: Boolean, crvs: list of Curve, split_line: Line, count: Int32, side_bool: Boolean
# ---------- python_17: Python ----------
import sys

sys.path.append(x)

# print(sys.path)

import generalFunctions as gf
import layerFunctions as lf
import Rhino.Geometry as rg
import pinLinkingBis as pl

from copy import deepcopy as dc

reload(gf)
reload(lf)
reload(pl)


print(crvs)
log = ["new sequence start"]

pt_sets = []

inner_crvs = []

crv_count = len(crvs)
print("there are %s curves in your list" % crv_count)

# invert split line direction

if invert:
    
    split_line.To = rg.Point3d(-split_line.To.X, -split_line.To.Y, 0.0)

for crv in crvs:
    
    # moving the split line to the same height as the crv
    
    height = crv.PointAtEnd.Z
    
    mv_m = rg.Transform.Translation(rg.Vector3d(0,0, height))

    loc_split_line = dc(split_line)
    loc_split_line.Transform(mv_m)
    
    a = gf.offsetCurveSet(crv, distance, direction, count)
    layer_set = lf.LinkingLayers(a, split_distance, side_bool, split_type, split_line = loc_split_line)
    # a = layer_set.split_a
    # b = layer_set.split_b
    # c = layer_set.split_line
    # d = layer_set.split_axis
    a, b, c, d, e = layer_set.createOrganisedCurves()
    
    pt_set = layer_set.joinCrvs()
    # pt_set = pt_set[1:-1] + [pt_set[1]]
    
    pt_sets.extend(pt_set)
    
    crv = rg.Polyline(pt_set).ToPolylineCurve()
    
    inner_crvs.append(crv)

print("I passed this hurdle")

# main_crv = pl.makeInnerCurve(inner_crvs, main_links, side_links, end_link)

# print(main_crv)

# start_and_end_pt = [main_crv.PointAt(main_crv.Domain[0]), main_crv.PointAt(main_crv.Domain[1])]
# ---------- end python_17 ----------
pline = PolyLine(Vertices=python_17.pt_sets, Closed=False)

# ----
path_mapper_13 = PathMapper(python_17.pt_sets, source="{A;B}", target="{A}")
panel_11 = Panel(python_17.out)
python_18 = GhPythonScript(x=helixpin.pin_helix_lists)  # -> out, points
# ---------- python_18: Python ----------
import Rhino.Geometry as rg

print(len(x))

points = [rg.Point3d(pt) for pt in x]
# ---------- end python_18 ----------
item_6 = ListItem(List=helixpin.pin_helix_lists, Index=0, Wrap=True)  # -> Item, Item1
path_mapper_14 = PathMapper(python_18.points, source="{A;B;C;D}", target="{D}")
end_2 = EndPoints(Curve=crv_9)  # -> Start, End
panel_12 = Panel(brim.out)
pt_10 = Point(brim.base_pt)
pt_11 = Point(brim.start_pt)

# ----
# BRIM - BODY - 1st PIN (without Start-Stop)
merge = Merge(Data1=flatten(brim.a), Data2=pt_7)

merge_2 = Merge(Data1=merge, Data2=pt_8)  # -> flatten(Result)

# ---- group: START/STOP--> CODE
split_2 = SplitTree(Data=path_mapper_14, Masks=flatten("{0}"))  # -> Positive, Negative
item_7 = ListItem(List=pt_5, Index=0, Wrap=True)  # -> Item, Item1
pdecon = Deconstruct(Point=item_7.Item)  # -> XComponent, YComponent, ZComponent
pt_12 = Point(split_2.Negative)
extraheight = Slider(30, range=0..100)
item_8 = ListItem(List=split_2.Positive, Index=0, Wrap=True)  # -> Item1, Item
item_9 = ListItem(List=split_2.Negative, Index=0, Wrap=True)
pdecon_2 = Deconstruct(Point=item_7.Item1)  # -> XComponent, YComponent, ZComponent
pdecon_3 = Deconstruct(Point=item_8.Item1)  # -> XComponent, YComponent, ZComponent
pdecon_4 = Deconstruct(Point=item_9)  # -> XComponent, YComponent, ZComponent
addition = Addition(A=extraheight, B=pdecon_3.ZComponent)
pt_13 = ConstructPoint(XCoordinate=pdecon_2.XComponent, YCoordinate=pdecon_2.YComponent, ZCoordinate=pdecon_4.ZComponent)
pt_14 = ConstructPoint(XCoordinate=pdecon.XComponent, YCoordinate=pdecon.YComponent, ZCoordinate=addition)
dist = Distance(PointA=pt_13, PointB=item_9)
subtraction = Subtraction(A=item_9, B=pt_13)
division_2 = Division(A=subtraction, B=dist)
multiplication = Multiplication(A=division_2, B=extraheight)
addition_2 = Addition(A=multiplication, B=item_9)
pdecon_5 = Deconstruct(Point=addition_2)  # -> XComponent, YComponent, ZComponent
pt_15 = Point(brim.start_pt)
pt_16 = ConstructPoint(XCoordinate=pdecon_5.XComponent, YCoordinate=pdecon_5.YComponent, ZCoordinate=addition)
pdecon_6 = Deconstruct(Point=pt_15)  # -> XComponent, YComponent, ZComponent
merge_3 = Merge(Data1=pt_14, Data2=pt_16, Data3=addition_2, Data4=item_9)  # -> flatten(Result)
pt_17 = ConstructPoint(XCoordinate=pdecon_6.XComponent, YCoordinate=pdecon_6.YComponent, ZCoordinate=extraheight)
merge_4 = Merge(Data1=pt_17, Data2=pt_15)

# ---- group: START/STOP--> CODE / Restructure
extrusion_startstop_rate = Slider(150, range=-100..250)
feed_rate_in_mm_s_3 = Slider(25, range=0..100)
feed_rate_in_mm_s_4 = Slider(50, range=0..100)
python_19 = GhPythonScript(
    feed_rate=feed_rate_in_mm_s_3,
    extrusion_retraction=nozzlesettings_4.start_stop_retraction,
    extra_add=nozzlesettings_4.start_reextrusion_rate,
    pts=merge_3)  # -> out, a; inputs pts: list of Point3d
# ---------- python_19: Python ----------
f_rate = feed_rate * 60.0

for pt_i, pt in enumerate(pts):
    
    if pt_i == 0:
        
        e_rate = - extrusion_retraction
    
    elif pt_i == len(pts) - 1:
        
        e_rate = extrusion_retraction + extra_add
        
    else:
        
        e_rate = 0.0
    
    print("G1 F{} X{} Y{} Z{} E{}".format(f_rate, pt.X, pt.Y, pt.Z, e_rate))
# ---------- end python_19 ----------

# ----
pt_18 = Point(item_7.Item1)

# ---- group: Internalize ?
feed_rate_in_mm_s_5 = Slider(25, range=0..100)
pdecon_7 = Deconstruct(Point=pt_18)  # -> XComponent, YComponent, ZComponent
pt_19 = ConstructPoint(XCoordinate=pdecon_7.XComponent, YCoordinate=pdecon_7.YComponent, ZCoordinate=addition)
python_20 = GhPythonScript(feed_rate=feed_rate_in_mm_s_5, extrusion_rate=Slider(200, range=0..1000), pts=pt_19)  # -> out, a; inputs pts: list of Point3d
# ---------- python_20: Python ----------
f_rate = feed_rate * 60.0

for pt_i, pt in enumerate(pts):
    
    if pt_i == 0:
        
        e_rate = - extrusion_rate
    
    elif pt_i == len(pts) - 1:
        
        e_rate = extrusion_rate
        
    else:
        
        e_rate = 0.0
    
    print("G1 F{} X{} Y{} Z{} E{}".format(f_rate, pt.X, pt.Y, pt.Z, e_rate))
# ---------- end python_20 ----------

# ----
pt_20 = Point(flatten(pt_12))

# ---- group: START/STOP--> CODE (continued)
starline = GhPythonScript(
    feed_rate=feed_rate_in_mm_s_3,
    extrusion_retraction=nozzlesettings_4.start_stop_retraction,
    extra_add=nozzlesettings_4.start_reextrusion_rate,
    start_pts=merge_4)  # -> flatten(out), a; inputs start_pts: list of Point3d
# ---------- starline: Python ----------
f_rate = feed_rate * 60.0

for i, pt in enumerate(start_pts):
    
    if i == 0:
        
        e_rate = 1

        print("G1 F{} X{} Y{} Z{} E{}".format(f_rate, pt.X, pt.Y, pt.Z, e_rate))
    
    elif i == 1:
   
        e_rate = extrusion_retraction + extra_add

        print("G1 F{} X{} Y{} Z{} E{}".format(f_rate, pt.X, pt.Y, pt.Z, e_rate))
# ---------- end starline ----------

# ---- group: G-Code
start_stop_feedrate_in_mm_min = Slider(100, range=0..1000)
number_slider_31 = Slider(0, range=0..10)
number_slider_32 = Slider(0, range=0..10)
number_slider_33 = Slider(4.4, range=0..10)
number_slider_34 = Slider(0, range=0..10)
number_slider_35 = Slider(300, range=0..1000)
list_8 = ValueList({"start / stop": "start_stop", "continious"}, selected="continious")
gcodelines = GhPythonScript(
    x=library_path_5,
    pts=merge_2,
    feed_rate=nozzlesettings_3.feed_rate,
    extrusion_rate=nozzlesettings_4.extrusion_rate,
    link_type=list_8,
    global_trim_distance=number_slider_31,
    ss_trim_distance=number_slider_32,
    cull_distance=number_slider_34,
    lift_val=number_slider_33,
    ss_f_rate=start_stop_feedrate_in_mm_min,
    ss_e_rate=number_slider_35,
    variable_feed_rate=nozzlesettings_3.variable_feed_rate,
    peak_feed_rate=nozzlesettings_3.feed_rate_max,
    start_min=nozzlesettings_3.feed_rate_max_start_start_ramp,
    start_max=nozzlesettings_3.feed_rate_max_end_start_ramp,
    end_max=nozzlesettings_3.feed_rate_max_start_end_ramp,
    end_min=nozzlesettings_3.feed_rate_max_end_end_ramp)  # -> out, a, path_vis; inputs pts: list, variable_feed_rate: Boolean
# ---------- gcodelines: Python ----------
import sys

sys.path.append(x)

import Rhino.Geometry as rg
import simpleStartStop as ss

reload(ss)

# print(pts)

p_set = ss.PrintSettings(
    feed_rate = feed_rate, 
    extrusion_rate = extrusion_rate, 
    extrusion_mode = 'relative', 
    movement_mode = 'relative'
)

if variable_feed_rate:
    
    p_set.setComplexFeedrate(
        peak_feed_rate,
        min_h_ramp = (start_min, start_max),
        max_h_ramp = (end_max, end_min)
    )

l_type = ss.LinkType(
    link_type = link_type,
    global_trim_distance = global_trim_distance,
    ss_trim_distance = ss_trim_distance,
    cull_distance = cull_distance,
    lift_val = lift_val
)

l_type.ss_f_rate = ss_f_rate
l_type.ss_e_rate = ss_e_rate

gcodeset = ss.GCodeSet(pts, p_set, l_type)
a = gcodeset.generateGCode()

path_vis = gcodeset.path_vis
# ---------- end gcodelines ----------

# ---- group: 2nd PIN + safety position
gcodelines_2 = GhPythonScript(
    x=library_path_5,
    pts=pt_20,
    feed_rate=nozzlesettings_3.feed_rate,
    extrusion_rate=nozzlesettings_4.extrusion_rate,
    link_type=list_8,
    global_trim_distance=number_slider_31,
    ss_trim_distance=number_slider_32,
    cull_distance=number_slider_34,
    lift_val=number_slider_33,
    ss_f_rate=start_stop_feedrate_in_mm_min,
    ss_e_rate=number_slider_35)  # -> out, a, path_vis; inputs pts: list
# ---------- gcodelines_2: Python ----------
import sys

sys.path.append(x)

import Rhino.Geometry as rg
import simpleStartStop as ss

reload(ss)

# print(pts)

p_set = ss.PrintSettings(
    feed_rate = feed_rate, 
    extrusion_rate = extrusion_rate, 
    extrusion_mode = 'relative', 
    movement_mode = 'relative'
)

l_type = ss.LinkType(
    link_type = link_type,
    global_trim_distance = global_trim_distance,
    ss_trim_distance = ss_trim_distance,
    cull_distance = cull_distance,
    lift_val = lift_val
)

l_type.ss_f_rate = ss_f_rate
l_type.ss_e_rate = ss_e_rate

gcodeset = ss.GCodeSet(pts, p_set, l_type)
a = gcodeset.generateGCode()

path_vis = gcodeset.path_vis
# ---------- end gcodelines_2 ----------

# ----
lenghtpath_2nd_pin_check = PolyLine(Vertices=gcodelines_2.path_vis, Closed=False)

# ---- group: G-Code / LenghtPath Body + 1st PIN - check
pline_2 = PolyLine(Vertices=gcodelines.path_vis, Closed=False)

# ---- group: Visualization lines
merge_5 = Merge(
    Data1=flatten(merge_4),
    Data2=flatten(gcodelines.path_vis),
    Data3=flatten(merge_3),
    Data4=flatten(gcodelines_2.path_vis),
    Data5=flatten(pt_19))
pline_3 = PolyLine(Vertices=merge_2, Closed=False)

# ----
panel_13 = Panel(gcodelines.out)
len = Length(Curve=lenghtpath_2nd_pin_check)
len_2 = Length(Curve=pline_2)
merge_gcode_lines = Merge(Data1=flatten(starline.out), Data2=flatten(gcodelines.a))
len_3 = Length(Curve=pline_3)
addition_3 = Addition(A=len_2, B=len)
python_21 = GhPythonScript(x=len_3)  # -> out, a
# ---------- python_21: Python ----------
import scriptcontext as sc

key_list = sc.sticky["PrintSettings"]["path_length"] = x
# ---------- end python_21 ----------

# ---- group: G-Code (continued)
end_start_gcode = GhPythonScript(x=library_path_4, add_header=Toggle(True), lines=flatten(merge_gcode_lines))  # -> out, a; inputs add_header: Boolean, lines: list
# ---------- end_start_gcode: Python ----------
import os
import scriptcontext as sc

# creating the header of the gcode file

if add_header:
    key_list = sc.sticky["PrintSettings"].keys()
    key_list.sort()

    for key_item in key_list:
    
        print(";{} : {}".format(key_item, str(sc.sticky["PrintSettings"][key_item])) )

start_gcode_path = os.path.join(x, "GCodeDefinitions", "startGcode.txt")
end_gcode_path = os.path.join(x, "GCodeDefinitions", "endGcode.txt")

start_gcode = open(start_gcode_path, 'r').read()
end_gcode = open(end_gcode_path, 'r').read()

print start_gcode

for line in lines:

    print(line)

print end_gcode
# ---------- end end_start_gcode ----------

# ----
python_22 = GhPythonScript(y=savefile, x=library_path_4, extra_name=Toggle(True), extra_txt="collapses", data=flatten(end_start_gcode.out))  # -> out, a; inputs data: list
# ---------- python_22: Python ----------
import os
import scriptcontext as sc
import math
import time
import scriptcontext as sc

import sys
sys.path.append(x)

import simpleStartStop as ss

reload(ss)

try:
    
    run_timing = time.time() - sc.sticky["start_time"]
    
    if run_timing > 2.0:
    
        sc.sticky["start_time"] = time.time()
        
        run = True
        
    else:
        
        run = False
    
except:
    
    sc.sticky["start_time"] = time.time()
    
    run = True

if y and run:

    count_file = os.path.join(x, "GCodeDefinitions", "countSheet.json")

    nozzle_dia = round(sc.sticky["PrintSettings"]["print_extrusion_nozzle"], 1)

    str = ss.file_count(nozzle_dia, count_file)

    date = time.strftime("%Y%m%d")

    if extra_name:
    
        file_name = "{}_{}_{}.gcode".format(str, date, extra_txt)
    
    else:
    
        file_name = "{}_{}.gcode".format(str, date)

    save_file = os.path.join(os.path.dirname(x), "TestRuns", file_name)

    print save_file

    data = '\n'.join(data)

    open(save_file, "a").write(data)
# ---------- end python_22 ----------
panel_14 = Panel(end_start_gcode.out)
