# Grasshopper definition TrimExtendTest.gh (Grasshopper 1.0.7)

line = Line([Line((11.9443755, 2.209931349, 0), (4.892105703, 18.77456507, 0)), Line((4.892105703, -3.69429453, 0), (23.42481471, 1.717912526, 0)), Line((-11.50852174, 9.098194876, 0), (-12.00054056, -7.958457666, 0)), Line((-3.636220568, 11.88630154, 0), (-21.34889821, 18.44655252, 0))])
crv = Curve(<curve referenced from the Rhino model>)
list = ValueList({"PtDistance": "distance", "CurveCurve": "curve_curve", "LineCurve": "line_curve"}, selected="PtDistance")
crv_2 = Curve(<curve referenced from the Rhino model>)
python = GhPythonScript(line=line, crv_a=crv_2, crv_b=crv, int_type=list)  # -> out, a, b, c; inputs line: Line, crv_a: Curve, crv_b: Curve
# ---------- python: Python ----------
import sys
import time

sys.path.append("/Users/jonas/Dropbox/Clay_Printing_Brick/PatternBrickLibrary")

import Rhino.Geometry as rg
import generalFunctions as gf
import layerFunctions as lf

reload(gf)
reload(lf)

start_time = time.time()

a = gf.lineCurveIntersection(line, crv_a, int_type)
b = gf.lineCurveIntersection(line, crv_b, int_type)

print(start_time - time.time())

line_set = lf.LineSet(line, 1.1, 2)
line_set.createLines()

print(start_time - time.time())

line_set.trimLines(crv_b, extend = True)

print(start_time - time.time())

line_set.trimLines(crv_a, extend = False)

print(start_time - time.time())

c = line_set.lines
# ---------- end python ----------
panel = Panel(python.out)
