# Grasshopper definition maries-brick.gh (Grasshopper 1.0.7)

brep = Brep(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)  # disabled
brep_2 = Brep(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)  # disabled
brep_3 = Brep(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)  # disabled
brep_4 = Brep(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)  # disabled
# Brick Type I
layer_height = Slider(0.46, range=0..1)
volume = Volume(Geometry=brep_4)  # -> Volume, Centroid; disabled
list = ValueList({"middle": 0, "left_middle": 1, "right_middle": 2, "left_up": 3, "left_down": 4, "right_up": 5, "right_down": 6}, selected="left_middle")
list_2 = ValueList({"middle": 0, "left_middle": 1, "right_middle": 2, "left_up": 3, "left_down": 4, "right_up": 5, "right_down": 6}, selected="right_middle")
list_3 = ValueList({"middle": 0, "left_middle": 1, "right_middle": 2, "left_up": 3, "left_down": 4, "right_up": 5, "right_down": 6}, selected="middle")

list_4 = ValueList({"Tall_connection": 0, "Short_connection": 1, "Brick": 2}, selected="Tall_connection")
list_5 = ValueList({"Tall_connection": 0, "Short_connection": 1, "Brick": 2}, selected="Short_connection")
list_6 = ValueList({"Tall_connection": 0, "Short_connection": 1, "Brick": 2}, selected="Tall_connection")
list_7 = ValueList({"Tall_connection": 0, "Short_connection": 1, "Brick": 2}, selected="Brick")
list_8 = ValueList({"middle": 0, "left_middle": 1, "right_middle": 2, "left_up": 3, "left_down": 4, "right_up": 5, "right_down": 6}, selected="middle")
python = GhPythonScript(layer_height=layer_height, connection_type=list_4, position=list)  # -> out, curves; inputs connection_type: Int32, position: Int32
# ---------- python: Python ----------
__author__ = "Chaoyu"
__version__ = "2019.10.03"

import rhinoscriptsyntax as rs
import Rhino.Geometry as rg
import ghpythonlib.treehelpers as th
import ghpythonlib.components as gh


rad_bottom = 3.5
rad_top = 2
height = 35
layers_tall = int(height/ layer_height)
height_2 = 20
layers_short = int(height_2/ layer_height)
curves = []


if connection_type == 0:
    for i in range(layers_tall):
        rad = rad_bottom + (layer_height * i/height)*(rad_top-rad_bottom)
        cen_pt = rg.Point3d(0,0,layer_height * i)
        circle = rg.Circle(cen_pt, rad)
        curves.append(circle)
        
elif connection_type == 1:
    for i in range(layers_short):
        rad = rad_bottom + (layer_height * i/height)*(rad_top-rad_bottom)
        cen_pt = rg.Point3d(0,0,layer_height * i)
        circle = rg.Circle(cen_pt, rad)
        curves.append(circle)
        
elif connection_type ==2:
    cur = []
    for i in range(layers_short):
        z = layer_height * i
        cur_1 = rg.Line(rg.Point3d(-10,10,z), rg.Point3d(10,10,z)).ToNurbsCurve()
        cur_2 = rg.Arc(rg.Point3d(10,10,z), rg.Vector3d(1,0,0), rg.Point3d(10,-10,z)).ToNurbsCurve()
        cur_3 = rg.Line(rg.Point3d(10,-10,z), rg.Point3d(-10,-10,z)).ToNurbsCurve()
        cur_4 = rg.Arc(rg.Point3d(-10,-10,z),rg.Vector3d(-1,0,0), rg.Point3d(-10,10,z)).ToNurbsCurve()
        cur.append([cur_1, cur_2, cur_3, cur_4])
        curves = th.list_to_tree(cur, source = [0])
#        curves.append(cur)

if position == 1:
    curves = gh.Move(curves, rg.Vector3d(-10,0,0))[0]
elif position ==2:
    curves = gh.Move(curves, rg.Vector3d(10,0,0))[0]
elif position == 3:  # left up
    curves = gh.Move(curves, rg.Vector3d(-10,5,0))[0]
elif position == 4:
    curves = gh.Move(curves, rg.Vector3d(-10,-5,0))[0]
elif position ==5:
    curves = gh.Move(curves, rg.Vector3d(10,5,0))[0]
elif position ==6:
    curves = gh.Move(curves, rg.Vector3d(10,-5,0))[0]
# ---------- end python ----------
python_2 = GhPythonScript(layer_height=layer_height, connection_type=list_5, position=list_8)  # -> out, curves; inputs connection_type: Int32, position: Int32; same code as python
python_3 = GhPythonScript(layer_height=layer_height, connection_type=list_6, position=list_2)  # -> out, curves; inputs connection_type: Int32, position: Int32; same code as python
python_4 = GhPythonScript(layer_height=layer_height, connection_type=list_7, position=list_3)  # -> out, curves; inputs connection_type: Int32, position: Int32; same code as python
geo = Geometry(python_2.curves)
geo_2 = Geometry(python.curves)
geo_3 = Geometry(python_3.curves)
geo_4 = Geometry(python_4.curves)

pdecon = Deconstruct(Point=volume.Centroid)  # -> XComponent, YComponent, ZComponent; disabled
pt = ConstructPoint(XCoordinate=0, YCoordinate=0, ZCoordinate=pdecon.ZComponent)  # disabled
vec2pt = Vector2Pt(PointA=volume.Centroid, PointB=pt, Unitize=False)  # -> Vector, Length; disabled
move = Move(Geometry=brep_3, Motion=vec2pt.Vector)  # -> Geometry, Transform; disabled
move_2 = Move(Geometry=brep, Motion=vec2pt.Vector)  # -> Geometry, Transform; disabled
move_3 = Move(Geometry=brep_4, Motion=vec2pt.Vector)  # -> Geometry, Transform; disabled
move_4 = Move(Geometry=brep_2, Motion=vec2pt.Vector)  # -> Geometry, Transform; disabled
volume_2 = Volume(Geometry=move_3.Geometry)  # -> Volume, Centroid; disabled
debrep = DeconstructBrep(Brep=move_3.Geometry)  # -> Faces, Edges, Vertices; disabled
debrep_2 = DeconstructBrep(Brep=move_2.Geometry)  # -> Faces, Edges, Vertices; disabled
volume_3 = Volume(Geometry=move_2.Geometry)  # -> Volume, Centroid; disabled
debrep_3 = DeconstructBrep(Brep=move_4.Geometry)  # -> Faces, Edges, Vertices; disabled
debrep_4 = DeconstructBrep(Brep=move.Geometry)  # -> Faces, Edges, Vertices; disabled
volume_4 = Volume(Geometry=move_4.Geometry)  # -> Volume, Centroid; disabled
volume_5 = Volume(Geometry=move.Geometry)  # -> Volume, Centroid; disabled
pdecon_2 = Deconstruct(Point=volume_2.Centroid)  # -> XComponent, YComponent, ZComponent; disabled
pdecon_3 = Deconstruct(Point=volume_3.Centroid)  # -> XComponent, YComponent, ZComponent; disabled
number_slider = Slider(3, range=0..10)  # disabled
number_slider_2 = Slider(2, range=0..10)  # disabled
pdecon_4 = Deconstruct(Point=volume_4.Centroid)  # -> XComponent, YComponent, ZComponent; disabled
pdecon_5 = Deconstruct(Point=volume_5.Centroid)  # -> XComponent, YComponent, ZComponent; disabled
number_slider_3 = Slider(1, range=0..10)  # disabled
number_slider_4 = Slider(3, range=0..10)  # disabled
number_slider_5 = Slider(0, range=0..10)  # disabled
number_slider_6 = Slider(2, range=0..10)  # disabled
number_slider_7 = Slider(3, range=0..10)  # disabled
number_slider_8 = Slider(2, range=0..10)  # disabled
number_slider_9 = Slider(3, range=0..10)  # disabled
number_slider_10 = Slider(4, range=0..10)  # disabled
distance_to_border = Slider(0.52, range=0..2)
dis_between_paths = Slider(0.69, range=0..2)
number_slider_11 = Slider(9, range=0..20)
extra_shell = Slider(2, range=0..5)
pt_2 = ConstructPoint(XCoordinate=pdecon_2.XComponent, YCoordinate=pdecon_2.YComponent, ZCoordinate=0)  # disabled
pt_3 = ConstructPoint(XCoordinate=pdecon_3.XComponent, YCoordinate=pdecon_3.YComponent, ZCoordinate=0)  # disabled
pt_4 = ConstructPoint(XCoordinate=pdecon_4.XComponent, YCoordinate=pdecon_4.YComponent, ZCoordinate=0)  # disabled
pt_5 = ConstructPoint(XCoordinate=pdecon_5.XComponent, YCoordinate=pdecon_5.YComponent, ZCoordinate=0)  # disabled
item = ListItem(List=debrep.Faces, Index=[number_slider, number_slider_2], Wrap=True)  # disabled
item_2 = ListItem(List=debrep_2.Faces, Index=[number_slider_5, number_slider_6, number_slider_3, number_slider_4], Wrap=True)  # disabled
item_3 = ListItem(List=debrep_3.Faces, Index=[number_slider_7, number_slider_8], Wrap=True)  # disabled
item_4 = ListItem(List=debrep_4.Faces, Index=[number_slider_9, number_slider_10], Wrap=True)  # disabled
join = BrepJoin(Breps=item)  # -> Breps, Closed; disabled
join_2 = BrepJoin(Breps=item_2)  # -> Breps, Closed; disabled
join_3 = BrepJoin(Breps=item_3)  # -> Breps, Closed; disabled
join_4 = BrepJoin(Breps=item_4)  # -> Breps, Closed; disabled
python_5 = GhPythonScript(
    left_curves=geo_2,
    middle_curves=geo,
    right_curves=geo_3,
    outer_curves=simplify(geo_4),
    dis_to_border=distance_to_border,
    dis_between_paths=dis_between_paths,
    division_num=number_slider_11,
    layer_height=layer_height,
    extra_shell=extra_shell)  # -> pt, temp_geo, o_pts, o_pts_tree, o_pts_tree_substract; inputs left_curves: list, middle_curves: list, right_curves: list, outer_curves: tree of Guid, division_num: Int32, extra_shell: Int32
# ---------- python_5: Python ----------
__author__ = "Chaoyu"
__version__ = "2019.10.03"

import rhinoscriptsyntax as rs
import Rhino.Geometry as rg
import ghpythonlib.components as gh
import math as m
import ghpythonlib.treehelpers as th

def trans(curve, t):
    """
    transform a curve with a trasformation matrix
    curve: input curve
    t: transformation matrix
    return: a transformed curve
    """
    new_curve = curve.Clone()
    new_curve.Transform(t)
    return new_curve


def draw_arc(pt_start, pt_end, pt_center):
    tan = rg.Vector3d.Subtract(rg.Vector3d(pt_start), rg.Vector3d(pt_center))
    tan.Rotate(m.pi/2, rg.Vector3d(0,0,1))
    arc = rg.Arc(pt_start, tan, pt_end)
    return arc


def adjust_distance(pt_in, pt_out):
    dis = pt_in.DistanceTo(pt_out)
    dis_opt = dis - dis_to_border
    dir = rg.Vector3d.Subtract(rg.Vector3d(pt_out), rg.Vector3d(pt_in))
    line = rg.Line(pt_in, dir, dis_opt)
    pt = line.PointAt(1)
    return pt


def divide_arc(arc, division_num):
    arc = arc.ToNurbsCurve()
    divisions = arc.DivideByCount(division_num, True)
    pt_arc = [arc.PointAt(d) for d in divisions]
    return pt_arc


print len(left_curves), len(middle_curves), len(right_curves)
print len(outer_curves.Branches)




o_pts_list = []
temp_geo = []

for i in range(len(outer_curves.Branches)):
    z = i * layer_height
    o_pts = []
    line_left_curve = rg.Line(rg.Point3d(-10,10,z), rg.Point3d(-10,-10,z))
    line_middle_curve = rg.Line(rg.Point3d(0,10,z), rg.Point3d(0,-10,z))
    line_right_curve = rg.Line(rg.Point3d(10,10,z), rg.Point3d(10,-10,z))
    brick_left = rg.Arc(rg.Circle(rg.Point3d(-10,0,z), 10),rg.Interval(m.pi/2, m.pi*3/2))
    brick_up = rg.Line(rg.Point3d(-10,10,z), rg.Point3d(10,10,z))
    brick_down = rg.Line(rg.Point3d(-10,-10,z), rg.Point3d(10,-10,z))
    brick_right = rg.Arc(rg.Circle(rg.Point3d(10,0,z), 10),rg.Interval(-m.pi/2, m.pi/2))
    temp_geo.append(brick_left)
    temp_geo.append(brick_right)
    t_left  = rg.Transform.ChangeBasis(rg.Plane(rg.Point3d(0,0,0),rg.Vector3d(0,0,1)), rg.Plane(rg.Point3d(dis_between_paths/2, 0,0), rg.Vector3d(0,0,1)))
    t_right = rg.Transform.ChangeBasis(rg.Plane(rg.Point3d(0,0,0),rg.Vector3d(0,0,1)), rg.Plane(rg.Point3d(-dis_between_paths/2, 0,0), rg.Vector3d(0,0,1)))
    t_up    = rg.Transform.ChangeBasis(rg.Plane(rg.Point3d(0,0,0),rg.Vector3d(0,0,1)), rg.Plane(rg.Point3d(0, -dis_between_paths/2,0), rg.Vector3d(0,0,1)))
    t_down  = rg.Transform.ChangeBasis(rg.Plane(rg.Point3d(0,0,0),rg.Vector3d(0,0,1)), rg.Plane(rg.Point3d(0, dis_between_paths/2,0), rg.Vector3d(0,0,1)))
    line_left_curve_left = trans(line_left_curve, t_left)
    line_left_curve_right = trans(line_left_curve, t_right)
    line_middle_curve_left = trans(line_middle_curve, t_left)
    line_middle_curve_right = trans(line_middle_curve, t_right)
    line_right_curve_left = trans(line_right_curve, t_left)
    line_right_curve_right = trans(line_right_curve, t_right)
    
    
    pt_0 = rg.Intersect.Intersection.LineCircle(line_left_curve_left, left_curves[i])[2]
    pt_1 = rg.Intersect.Intersection.LineCircle(line_left_curve_left, left_curves[i])[4]
    pt_2 = rg.Intersect.Intersection.LineCircle(line_left_curve_right, left_curves[i])[2]
    pt_3 = rg.Intersect.Intersection.LineCircle(line_left_curve_right, left_curves[i])[4]
    temp_geo.extend([pt_0, pt_1, pt_2, pt_3])
    
    left_left_curve = rg.Line(left_curves[i].Center, rg.Vector3d(-1,0,0), 10)
    left_left_curve_up = trans(left_left_curve, t_up)
    left_left_curve_down = trans(left_left_curve, t_down)
    pt_4 = rg.Intersect.Intersection.LineCircle(left_left_curve_up, left_curves[i])[4]
    pt_5 = rg.Intersect.Intersection.LineCircle(left_left_curve_down, left_curves[i])[4]
    temp_geo.append(pt_4)
    temp_geo.append(pt_5)
    
    left_right_curve = rg.Line(left_curves[i].Center, middle_curves[i].Center)
    left_right_curve_up = trans(left_right_curve, t_up)
    left_right_curve_down = trans(left_right_curve, t_down)
    pt_6 = rg.Intersect.Intersection.LineCircle(left_right_curve_up, left_curves[i])[4]
    pt_7 = rg.Intersect.Intersection.LineCircle(left_right_curve_down, left_curves[i])[4]
    temp_geo.append(pt_6)
    temp_geo.append(pt_7)
    
    
    pt_a = rg.Intersect.Intersection.CurveCurve(line_left_curve_left.ToNurbsCurve(), brick_left.ToNurbsCurve(),0,0)[0].PointA
    pt_b = rg.Intersect.Intersection.CurveCurve(line_left_curve_left.ToNurbsCurve(), brick_left.ToNurbsCurve(),0,0)[1].PointA
    pt_c = rg.Intersect.Intersection.CurveCurve(left_left_curve_up.ToNurbsCurve(), brick_left.ToNurbsCurve(),1,0)[0].PointA
    pt_d = rg.Intersect.Intersection.CurveCurve(left_left_curve_down.ToNurbsCurve(), brick_left.ToNurbsCurve(),1,0)[0].PointA
    pt_e = rg.Intersect.Intersection.LineCircle(left_right_curve_up, middle_curves[i])[2]
    pt_f = rg.Intersect.Intersection.LineCircle(left_right_curve_down, middle_curves[i])[2]
    pt_g = line_left_curve_right.PointAt(0)
    pt_i = line_left_curve_right.PointAt(1)
    temp_geo.extend([pt_a,pt_b, pt_c, pt_d, pt_e, pt_f, pt_g, pt_i])
    
    
    
    pt_a_ = adjust_distance(pt_0, pt_a)
    pt_b_ = adjust_distance(pt_4, pt_c)
    pt_c_ = adjust_distance(pt_5, pt_d)
    pt_d_ = adjust_distance(pt_1, pt_b)
    pt_e_ = adjust_distance(pt_3, pt_i)
    pt_f_ = adjust_distance(pt_7, pt_f)
    pt_g_ = adjust_distance(pt_6, pt_e)
    pt_i_ = adjust_distance(pt_2, pt_g)
    temp_geo.extend([pt_a_, pt_b_, pt_c_, pt_d_, pt_e_, pt_f_, pt_g_, pt_i_])
    
    
    
    arc_1 = draw_arc(pt_0, pt_4, left_curves[i].Center)
    arc_2 = draw_arc(pt_5, pt_1, left_curves[i].Center)
    arc_3 = draw_arc(pt_3, pt_7, left_curves[i].Center)
    arc_4 = draw_arc(pt_6, pt_2, left_curves[i].Center)
    
    
    
    o_pts.append(pt_a)
    o_pts.extend(divide_arc(arc_1,division_num))
    o_pts.extend([pt_b_, pt_c_])
    o_pts.extend(divide_arc(arc_2,division_num))
    o_pts.extend([pt_d_, pt_e_])
    o_pts.extend(divide_arc(arc_3,division_num))
    
    if extra_shell != 0:
        for j in range(extra_shell):
            arc = rg.Arc(left_curves[i].Center, left_curves[i].Radius -(dis_between_paths*(j+1)), m.pi*2)
            o_pts.extend(divide_arc(arc,division_num*4))
            
    o_pts.extend([divide_arc(arc_3,division_num)[-1], pt_f_, pt_g_, divide_arc(arc_4,division_num)[0]])
    o_pts.extend(divide_arc(arc_4,division_num))
    o_pts.append(pt_g)
    
    
    pt_m_0 = rg.Intersect.Intersection.LineCircle(line_middle_curve_left, middle_curves[i])[2]
    pt_m_1 = rg.Intersect.Intersection.LineCircle(line_middle_curve_left, middle_curves[i])[4]
    pt_m_2 = rg.Intersect.Intersection.LineCircle(line_middle_curve_right, middle_curves[i])[2]
    pt_m_3 = rg.Intersect.Intersection.LineCircle(line_middle_curve_right, middle_curves[i])[4]
    temp_geo.extend([pt_m_0, pt_m_1, pt_m_2, pt_m_3])
    
    pt_m_a = line_middle_curve_left.PointAt(0)
    pt_m_b = line_middle_curve_left.PointAt(1)
    pt_m_c = line_middle_curve_right.PointAt(1)
    pt_m_d = line_middle_curve_right.PointAt(0)
    temp_geo.extend([pt_m_a, pt_m_b, pt_m_c, pt_m_d])
    
    pt_m_a_ = adjust_distance(pt_m_0, pt_m_a)
    pt_m_b_ = adjust_distance(pt_m_1, pt_m_b)
    pt_m_c_ = adjust_distance(pt_m_2, pt_m_c)
    pt_m_d_ = adjust_distance(pt_m_3, pt_m_d)
    temp_geo.extend([pt_m_a_, pt_m_b_, pt_m_c_, pt_m_d_])
    
    
    arc_m_1 = draw_arc(pt_m_0, pt_m_1, middle_curves[i].Center)
    arc_m_2 = draw_arc(pt_m_3, pt_m_2, middle_curves[i].Center)
    
    
    o_pts.append(pt_m_a)
    o_pts.extend(divide_arc(arc_m_1,division_num*2))
    o_pts.extend([pt_m_b_, pt_m_c_])
    o_pts.extend(divide_arc(arc_m_2,division_num*2))
    
    if extra_shell != 0:
        for j in range(extra_shell):
            arc = rg.Arc(rg.Circle(middle_curves[i].Center, middle_curves[i].Radius -(dis_between_paths*(j+1))), rg.Interval(m.pi/2, m.pi/2*5))
            o_pts.extend(divide_arc(arc,division_num*4))
    o_pts.append(divide_arc(arc_m_2,division_num*2)[-1])
    o_pts.append(pt_m_d)
    
    
    pt_r_0 = rg.Intersect.Intersection.LineCircle(line_right_curve_left, right_curves[i])[2]
    pt_r_1 = rg.Intersect.Intersection.LineCircle(line_right_curve_left, right_curves[i])[4]
    pt_r_2 = rg.Intersect.Intersection.LineCircle(line_right_curve_right, right_curves[i])[2]
    pt_r_3 = rg.Intersect.Intersection.LineCircle(line_right_curve_right, right_curves[i])[4]
    temp_geo.extend([pt_r_0, pt_r_1, pt_r_2, pt_r_3])
    
    
    right_right_curve = rg.Line(right_curves[i].Center, rg.Vector3d(1,0,0), 10)
    right_right_curve_up = trans(right_right_curve, t_up)
    right_right_curve_down = trans(right_right_curve, t_down)
    pt_r_4 = rg.Intersect.Intersection.LineCircle(right_right_curve_up, right_curves[i])[4]
    pt_r_5 = rg.Intersect.Intersection.LineCircle(right_right_curve_down, right_curves[i])[4]
    temp_geo.append(pt_r_4)
    temp_geo.append(pt_r_5)
    
    right_left_curve = rg.Line(right_curves[i].Center, middle_curves[i].Center)
    right_left_curve_up = trans(right_left_curve, t_up)
    right_left_curve_down = trans(right_left_curve, t_down)
    pt_r_6 = rg.Intersect.Intersection.LineCircle(right_left_curve_up, right_curves[i])[4]
    pt_r_7 = rg.Intersect.Intersection.LineCircle(right_left_curve_down, right_curves[i])[4]
    temp_geo.append(pt_r_6)
    temp_geo.append(pt_r_7)
    
    
    pt_r_a = rg.Intersect.Intersection.CurveCurve(line_right_curve_right.ToNurbsCurve(), brick_right.ToNurbsCurve(),0,0)[0].PointA
    pt_r_b = rg.Intersect.Intersection.CurveCurve(line_right_curve_right.ToNurbsCurve(), brick_right.ToNurbsCurve(),0,0)[1].PointA
    pt_r_c = rg.Intersect.Intersection.CurveCurve(right_right_curve_up.ToNurbsCurve(), brick_right.ToNurbsCurve(),1,0)[0].PointA
    pt_r_d = rg.Intersect.Intersection.CurveCurve(right_right_curve_down.ToNurbsCurve(), brick_right.ToNurbsCurve(),1,0)[0].PointA
    pt_r_e = rg.Intersect.Intersection.LineCircle(right_left_curve_up, middle_curves[i])[2]
    pt_r_f = rg.Intersect.Intersection.LineCircle(right_left_curve_down, middle_curves[i])[2]
    pt_r_g = line_right_curve_left.PointAt(0)
    pt_r_i = line_right_curve_left.PointAt(1)
    temp_geo.extend([pt_r_a,pt_r_b, pt_r_c, pt_r_d, pt_r_e, pt_r_f, pt_r_g, pt_r_i])
    
    
    pt_r_a_ = adjust_distance(pt_r_0, pt_r_a)
    pt_r_b_ = adjust_distance(pt_r_4, pt_r_c)
    pt_r_c_ = adjust_distance(pt_r_5, pt_r_d)
    pt_r_d_ = adjust_distance(pt_r_3, pt_r_b)
    pt_r_e_ = adjust_distance(pt_r_1, pt_r_i)
    pt_r_f_ = adjust_distance(pt_r_7, pt_r_f)
    pt_r_g_ = adjust_distance(pt_r_6, pt_r_e)
    pt_r_i_ = adjust_distance(pt_r_2, pt_r_g)
    temp_geo.extend([pt_r_a_, pt_r_b_, pt_r_c_, pt_r_d_, pt_r_e_, pt_r_f_, pt_r_g_, pt_r_i_])
    
    arc_r_1 = draw_arc(pt_r_0, pt_r_6, right_curves[i].Center)
    arc_r_2 = draw_arc(pt_r_7, pt_r_1, right_curves[i].Center)
    arc_r_3 = draw_arc(pt_r_3, pt_r_5, right_curves[i].Center)
    arc_r_4 = draw_arc(pt_r_4, pt_r_2, right_curves[i].Center)
    
    
    o_pts.append(pt_r_g)
    o_pts.extend(divide_arc(arc_r_1,division_num))
    o_pts.extend([pt_r_g_, pt_r_f_])
    o_pts.extend(divide_arc(arc_r_2,division_num))
    o_pts.extend([pt_r_e_, pt_r_d_])
    o_pts.extend(divide_arc(arc_r_3,division_num))
    
    
    if extra_shell != 0:
        for j in range(extra_shell):
            arc = rg.Arc(right_curves[i].Center, right_curves[i].Radius -(dis_between_paths*(j+1)), m.pi*2)
            o_pts.extend(divide_arc(arc,division_num*4))
            
    o_pts.extend([divide_arc(arc_r_3,division_num)[-1],pt_r_c_, pt_r_b_])
    o_pts.extend(divide_arc(arc_r_4,division_num))
    o_pts.append(pt_r_a)
    
    o_pts_list.append(o_pts)

o_pts_tree = th.list_to_tree(o_pts_list, source = [0])


o_pts_list_substract = []
for i in range(len(outer_curves.Branches), len(left_curves)):
    o_pts_left = []
    o_pts_right = []
    arc_left = rg.Arc(left_curves[i].Center, left_curves[i].Radius, m.pi *2)
    arc_right = rg.Arc(right_curves[i].Center, right_curves[i].Radius, m.pi *2)
    
    o_pts_left.extend(divide_arc(arc_left,division_num*4))
    o_pts_left.append(divide_arc(arc_left,division_num*4)[0])
    
    if extra_shell != 0:
        for j in range(extra_shell):
            arc = rg.Arc(left_curves[i].Center, left_curves[i].Radius -(dis_between_paths*(j+1)), m.pi*2)
            o_pts_left.extend(divide_arc(arc,division_num*4))
    
    
    o_pts_list_substract.append(o_pts_left)
    
    o_pts_right.extend(divide_arc(arc_right,division_num*4))
    o_pts_right.append(divide_arc(arc_right,division_num*4)[0])
    
    if extra_shell != 0:
        for j in range(extra_shell):
            arc = rg.Arc(right_curves[i].Center, right_curves[i].Radius -(dis_between_paths*(j+1)), m.pi*2)
            o_pts_right.extend(divide_arc(arc,division_num*4))
            
            
    o_pts_list_substract.append(o_pts_right)
    

o_pts_tree_substract = th.list_to_tree(o_pts_list_substract, source = [0])
# ---------- end python_5 ----------
python_6 = GhPythonScript(
    left_curves=geo_2,
    middle_curves=geo,
    right_curves=geo_3,
    outer_curves=simplify(geo_4),
    dis_to_border=distance_to_border,
    dis_between_paths=dis_between_paths,
    division_num=number_slider_11,
    layer_height=layer_height)  # -> pt, temp_geo, o_pts; inputs left_curves: list, middle_curves: list, right_curves: list, outer_curves: tree of Guid, division_num: Int32; disabled
# ---------- python_6: Python ----------
__author__ = "Chaoyu"
__version__ = "2019.10.03"

import rhinoscriptsyntax as rs
import Rhino.Geometry as rg
import ghpythonlib.components as gh
import math as m


def trans(curve, t):
    """
    transform a curve with a trasformation matrix
    curve: input curve
    t: transformation matrix
    return: a transformed curve
    """
    new_curve = curve.Clone()
    new_curve.Transform(t)
    return new_curve


def draw_arc(pt_start, pt_end, pt_center):
    tan = rg.Vector3d.Subtract(rg.Vector3d(pt_start), rg.Vector3d(pt_center))
    tan.Rotate(m.pi/2, rg.Vector3d(0,0,1))
    arc = rg.Arc(pt_start, tan, pt_end)
    return arc


def adjust_distance(pt_in, pt_out):
    dis = pt_in.DistanceTo(pt_out)
    dis_opt = dis - dis_to_border
    dir = rg.Vector3d.Subtract(rg.Vector3d(pt_out), rg.Vector3d(pt_in))
    line = rg.Line(pt_in, dir, dis_opt)
    pt = line.PointAt(1)
    return pt


def divide_arc(arc, division_num):
    arc = arc.ToNurbsCurve()
    divisions = arc.DivideByCount(division_num, True)
    pt_arc = [arc.PointAt(d) for d in divisions]
    return pt_arc


print len(left_curves), len(middle_curves), len(right_curves)
print len(outer_curves.Branches)




o_pts_tree = []
temp_geo = []

for i in range(len(outer_curves.Branches)):
    z = i * layer_height
o_pts = []
line_left_curve = rg.Line(rg.Point3d(-10,10,0), rg.Point3d(-10,-10,0))
line_middle_curve = rg.Line(rg.Point3d(0,10,0), rg.Point3d(0,-10,0))
line_right_curve = rg.Line(rg.Point3d(10,10,0), rg.Point3d(10,-10,0))
brick_left = rg.Arc(rg.Circle(rg.Point3d(-10,0,0), 10),rg.Interval(m.pi/2, m.pi*3/2))
brick_up = rg.Line(rg.Point3d(-10,10,0), rg.Point3d(10,10,0))
brick_down = rg.Line(rg.Point3d(-10,-10,0), rg.Point3d(10,-10,0))
brick_right = rg.Arc(rg.Circle(rg.Point3d(10,0,0), 10),rg.Interval(-m.pi/2, m.pi/2))
temp_geo.append(brick_left)
temp_geo.append(brick_right)
t_left  = rg.Transform.ChangeBasis(rg.Plane(rg.Point3d(0,0,0),rg.Vector3d(0,0,1)), rg.Plane(rg.Point3d(dis_between_paths/2, 0,0), rg.Vector3d(0,0,1)))
t_right = rg.Transform.ChangeBasis(rg.Plane(rg.Point3d(0,0,0),rg.Vector3d(0,0,1)), rg.Plane(rg.Point3d(-dis_between_paths/2, 0,0), rg.Vector3d(0,0,1)))
t_up    = rg.Transform.ChangeBasis(rg.Plane(rg.Point3d(0,0,0),rg.Vector3d(0,0,1)), rg.Plane(rg.Point3d(0, -dis_between_paths/2,0), rg.Vector3d(0,0,1)))
t_down  = rg.Transform.ChangeBasis(rg.Plane(rg.Point3d(0,0,0),rg.Vector3d(0,0,1)), rg.Plane(rg.Point3d(0, dis_between_paths/2,0), rg.Vector3d(0,0,1)))
line_left_curve_left = trans(line_left_curve, t_left)
line_left_curve_right = trans(line_left_curve, t_right)
line_middle_curve_left = trans(line_middle_curve, t_left)
line_middle_curve_right = trans(line_middle_curve, t_right)
line_right_curve_left = trans(line_right_curve, t_left)
line_right_curve_right = trans(line_right_curve, t_right)


pt_0 = rg.Intersect.Intersection.LineCircle(line_left_curve_left, left_curves[0])[2]
pt_1 = rg.Intersect.Intersection.LineCircle(line_left_curve_left, left_curves[0])[4]
pt_2 = rg.Intersect.Intersection.LineCircle(line_left_curve_right, left_curves[0])[2]
pt_3 = rg.Intersect.Intersection.LineCircle(line_left_curve_right, left_curves[0])[4]
temp_geo.extend([pt_0, pt_1, pt_2, pt_3])

left_left_curve = rg.Line(left_curves[0].Center, rg.Vector3d(-1,0,0), 10)
left_left_curve_up = trans(left_left_curve, t_up)
left_left_curve_down = trans(left_left_curve, t_down)
pt_4 = rg.Intersect.Intersection.LineCircle(left_left_curve_up, left_curves[0])[4]
pt_5 = rg.Intersect.Intersection.LineCircle(left_left_curve_down, left_curves[0])[4]
temp_geo.append(pt_4)
temp_geo.append(pt_5)

left_right_curve = rg.Line(left_curves[0].Center, middle_curves[0].Center)
left_right_curve_up = trans(left_right_curve, t_up)
left_right_curve_down = trans(left_right_curve, t_down)
pt_6 = rg.Intersect.Intersection.LineCircle(left_right_curve_up, left_curves[0])[4]
pt_7 = rg.Intersect.Intersection.LineCircle(left_right_curve_down, left_curves[0])[4]
temp_geo.append(pt_6)
temp_geo.append(pt_7)


pt_a = rg.Intersect.Intersection.CurveCurve(line_left_curve_left.ToNurbsCurve(), brick_left.ToNurbsCurve(),0,0)[0].PointA
pt_b = rg.Intersect.Intersection.CurveCurve(line_left_curve_left.ToNurbsCurve(), brick_left.ToNurbsCurve(),0,0)[1].PointA
pt_c = rg.Intersect.Intersection.CurveCurve(left_left_curve_up.ToNurbsCurve(), brick_left.ToNurbsCurve(),1,0)[0].PointA
pt_d = rg.Intersect.Intersection.CurveCurve(left_left_curve_down.ToNurbsCurve(), brick_left.ToNurbsCurve(),1,0)[0].PointA
pt_e = rg.Intersect.Intersection.LineCircle(left_right_curve_up, middle_curves[0])[2]
pt_f = rg.Intersect.Intersection.LineCircle(left_right_curve_down, middle_curves[0])[2]
pt_g = line_left_curve_right.PointAt(0)
pt_i = line_left_curve_right.PointAt(1)
temp_geo.extend([pt_a,pt_b, pt_c, pt_d, pt_e, pt_f, pt_g, pt_i])



pt_a_ = adjust_distance(pt_0, pt_a)
pt_b_ = adjust_distance(pt_4, pt_c)
pt_c_ = adjust_distance(pt_5, pt_d)
pt_d_ = adjust_distance(pt_1, pt_b)
pt_e_ = adjust_distance(pt_3, pt_i)
pt_f_ = adjust_distance(pt_7, pt_f)
pt_g_ = adjust_distance(pt_6, pt_e)
pt_i_ = adjust_distance(pt_2, pt_g)
temp_geo.extend([pt_a_, pt_b_, pt_c_, pt_d_, pt_e_, pt_f_, pt_g_, pt_i_])



arc_1 = draw_arc(pt_0, pt_4, left_curves[0].Center)
arc_2 = draw_arc(pt_5, pt_1, left_curves[0].Center)
arc_3 = draw_arc(pt_3, pt_7, left_curves[0].Center)
arc_4 = draw_arc(pt_6, pt_2, left_curves[0].Center)


o_pts.append(pt_a)
o_pts.extend(divide_arc(arc_1,division_num))
o_pts.extend([pt_b_, pt_c_])
o_pts.extend(divide_arc(arc_2,division_num))
o_pts.extend([pt_d_, pt_e_])
o_pts.extend(divide_arc(arc_3,division_num))
o_pts.extend([pt_f_, pt_g_])
o_pts.extend(divide_arc(arc_4,division_num))
o_pts.append(pt_g)


pt_m_0 = rg.Intersect.Intersection.LineCircle(line_middle_curve_left, middle_curves[0])[2]
pt_m_1 = rg.Intersect.Intersection.LineCircle(line_middle_curve_left, middle_curves[0])[4]
pt_m_2 = rg.Intersect.Intersection.LineCircle(line_middle_curve_right, middle_curves[0])[2]
pt_m_3 = rg.Intersect.Intersection.LineCircle(line_middle_curve_right, middle_curves[0])[4]
temp_geo.extend([pt_m_0, pt_m_1, pt_m_2, pt_m_3])

pt_m_a = line_middle_curve_left.PointAt(0)
pt_m_b = line_middle_curve_left.PointAt(1)
pt_m_c = line_middle_curve_right.PointAt(1)
pt_m_d = line_middle_curve_right.PointAt(0)
temp_geo.extend([pt_m_a, pt_m_b, pt_m_c, pt_m_d])

pt_m_a_ = adjust_distance(pt_m_0, pt_m_a)
pt_m_b_ = adjust_distance(pt_m_1, pt_m_b)
pt_m_c_ = adjust_distance(pt_m_2, pt_m_c)
pt_m_d_ = adjust_distance(pt_m_3, pt_m_d)
temp_geo.extend([pt_m_a_, pt_m_b_, pt_m_c_, pt_m_d_])


arc_m_1 = draw_arc(pt_m_0, pt_m_1, middle_curves[0].Center)
arc_m_2 = draw_arc(pt_m_3, pt_m_2, middle_curves[0].Center)


o_pts.append(pt_m_a)
o_pts.extend(divide_arc(arc_m_1,division_num*2))
o_pts.extend([pt_m_b_, pt_m_c_])
o_pts.extend(divide_arc(arc_m_2,division_num*2))
o_pts.append(pt_m_d)


pt_r_0 = rg.Intersect.Intersection.LineCircle(line_right_curve_left, right_curves[0])[2]
pt_r_1 = rg.Intersect.Intersection.LineCircle(line_right_curve_left, right_curves[0])[4]
pt_r_2 = rg.Intersect.Intersection.LineCircle(line_right_curve_right, right_curves[0])[2]
pt_r_3 = rg.Intersect.Intersection.LineCircle(line_right_curve_right, right_curves[0])[4]
temp_geo.extend([pt_r_0, pt_r_1, pt_r_2, pt_r_3])


right_right_curve = rg.Line(right_curves[0].Center, rg.Vector3d(1,0,0), 10)
right_right_curve_up = trans(right_right_curve, t_up)
right_right_curve_down = trans(right_right_curve, t_down)
pt_r_4 = rg.Intersect.Intersection.LineCircle(right_right_curve_up, right_curves[0])[4]
pt_r_5 = rg.Intersect.Intersection.LineCircle(right_right_curve_down, right_curves[0])[4]
temp_geo.append(pt_r_4)
temp_geo.append(pt_r_5)

right_left_curve = rg.Line(right_curves[0].Center, middle_curves[0].Center)
right_left_curve_up = trans(right_left_curve, t_up)
right_left_curve_down = trans(right_left_curve, t_down)
pt_r_6 = rg.Intersect.Intersection.LineCircle(right_left_curve_up, right_curves[0])[4]
pt_r_7 = rg.Intersect.Intersection.LineCircle(right_left_curve_down, right_curves[0])[4]
temp_geo.append(pt_r_6)
temp_geo.append(pt_r_7)


pt_r_a = rg.Intersect.Intersection.CurveCurve(line_right_curve_right.ToNurbsCurve(), brick_right.ToNurbsCurve(),0,0)[0].PointA
pt_r_b = rg.Intersect.Intersection.CurveCurve(line_right_curve_right.ToNurbsCurve(), brick_right.ToNurbsCurve(),0,0)[1].PointA
pt_r_c = rg.Intersect.Intersection.CurveCurve(right_right_curve_up.ToNurbsCurve(), brick_right.ToNurbsCurve(),1,0)[0].PointA
pt_r_d = rg.Intersect.Intersection.CurveCurve(right_right_curve_down.ToNurbsCurve(), brick_right.ToNurbsCurve(),1,0)[0].PointA
pt_r_e = rg.Intersect.Intersection.LineCircle(right_left_curve_up, middle_curves[0])[2]
pt_r_f = rg.Intersect.Intersection.LineCircle(right_left_curve_down, middle_curves[0])[2]
pt_r_g = line_right_curve_left.PointAt(0)
pt_r_i = line_right_curve_left.PointAt(1)
temp_geo.extend([pt_r_a,pt_r_b, pt_r_c, pt_r_d, pt_r_e, pt_r_f, pt_r_g, pt_r_i])


pt_r_a_ = adjust_distance(pt_r_0, pt_r_a)
pt_r_b_ = adjust_distance(pt_r_4, pt_r_c)
pt_r_c_ = adjust_distance(pt_r_5, pt_r_d)
pt_r_d_ = adjust_distance(pt_r_3, pt_r_b)
pt_r_e_ = adjust_distance(pt_r_1, pt_r_i)
pt_r_f_ = adjust_distance(pt_r_7, pt_r_f)
pt_r_g_ = adjust_distance(pt_r_6, pt_r_e)
pt_r_i_ = adjust_distance(pt_r_2, pt_r_g)
temp_geo.extend([pt_r_a_, pt_r_b_, pt_r_c_, pt_r_d_, pt_r_e_, pt_r_f_, pt_r_g_, pt_r_i_])

arc_r_1 = draw_arc(pt_r_0, pt_r_6, right_curves[0].Center)
arc_r_2 = draw_arc(pt_r_7, pt_r_1, right_curves[0].Center)
arc_r_3 = draw_arc(pt_r_3, pt_r_5, right_curves[0].Center)
arc_r_4 = draw_arc(pt_r_4, pt_r_2, right_curves[0].Center)


o_pts.append(pt_r_g)
o_pts.extend(divide_arc(arc_r_1,division_num))
o_pts.extend([pt_r_g_, pt_r_f_])
o_pts.extend(divide_arc(arc_r_2,division_num))
o_pts.extend([pt_r_e_, pt_r_d_])
o_pts.extend(divide_arc(arc_r_3,division_num))
o_pts.extend([pt_r_c_, pt_r_b_])
o_pts.extend(divide_arc(arc_r_4,division_num))
o_pts.append(pt_r_a)


#for i,c in enumerate(left_curves):
#        line_up = rg.Line(c.Center, rg.Vector3d(0,1,0),10)
#        line_left = rg.Line(c.Center, rg.Vector3d(-1,0,0),10)
#        line_right = rg.Line(c.Center, rg.Vector3d(middle_curves[0].Center.X-left_curves[0].Center.X, middle_curves[0].Center.Y-left_curves[0].Center.Y, 0),10)
#        line_down = rg.Line(c.Center, rg.Vector3d(0,-1,0),10)
#        
#        cur_1 = rg.Intersect.Intersection.LineCircle(line_left_curves, cir)[2]/[4]
#        
#        cur_2 =
# ---------- end python_6 ----------
ln = Line(StartPoint=pt_2, EndPoint=pt_4)  # disabled
pline = PolyLine(Vertices=python_5.o_pts, Closed=False)
pline_2 = PolyLine(Vertices=python_5.o_pts_tree, Closed=False)
pline_3 = PolyLine(Vertices=python_5.o_pts_tree_substract, Closed=False)
number_slider_12 = Slider(-0.02, range=-0.1..0.1)  # disabled
number_slider_13 = Slider(0.44, range=0..1)  # disabled
Z = UnitZ(Factor=1)  # disabled
pt_6 = ConstructPoint(XCoordinate=0, YCoordinate=0, ZCoordinate=number_slider_12)  # disabled
Y = UnitY(Factor=1)  # disabled
number_slider_14 = Slider(13, range=0..100)  # disabled
contour = Contour(Shape=join.Breps, Point=pt_6, Direction=Z, Distance=number_slider_13)  # -> simplify(Contours); disabled
contour_2 = Contour(Shape=join_4.Breps, Point=pt_6, Direction=Z, Distance=number_slider_13)  # disabled
contour_3 = Contour(Shape=join_3.Breps, Point=pt_6, Direction=Z, Distance=number_slider_13)  # disabled
item_5 = ListItem(List=flatten(contour), Index=0, Wrap=True)  # disabled
area = Area(Geometry=item_5)  # -> Area, Centroid; disabled
contour_4 = Contour(Shape=join_2.Breps, Point=area.Centroid, Direction=Z, Distance=number_slider_13)  # disabled
item_6 = ListItem(List=flatten(contour_4), Index=0, Wrap=True)  # disabled
line = LineSDL(Start=area.Centroid, Direction=Y, Length=number_slider_14)  # disabled
ccx = CurveCurve(CurveA=line, CurveB=item_5)  # -> Points, ParamsA, ParamsB; disabled
ccx_2 = CurveCurve(CurveA=line, CurveB=item_6)  # -> Points, ParamsA, ParamsB; disabled
pt_7 = Point(ccx.Points)  # disabled
pt_8 = Point(ccx_2.Points)  # disabled

# ----
# for better solution, keep this high.
points_on_each_layer = Slider(400, range=0..400)  # disabled
ghpython_script = GhPythonScript(curves=contour, nSegs=points_on_each_layer)  # -> out, simplify(pts); inputs curves: list of Curve, nSegs: Int32; disabled
# ---------- ghpython_script: Python ----------
__author__ = "Chaoyu"
__version__ = "2019.04.12"

import rhinoscriptsyntax as rs
import Rhino.Geometry as rg
import ghpythonlib.components as gh
import ghpythonlib.treehelpers as th
import Rhino


def get_points(curves):
    pts_dict = {}
    dict_list = []
    for n, c in enumerate(curves):
        divisions = c.DivideByCount(nSegs, True)
        pt_list_ori = [c.PointAt(d) for d in divisions]
        point_ori = rg.Point3d(0,0,c.PointAt(0).Z)
        point_check = rg.Point3d(50,50,c.PointAt(0).Z)
        line = rg.Line(point_ori, point_check)
        intersect = rg.Intersect.Intersection.CurveLine(c, line, 0,0)
        
        if len(intersect) <= 2:
                    for i_num, i_pt in enumerate(intersect):
                        intersect_pt = i_pt.PointA
                        if line.DistanceTo(intersect_pt, True) < 1:
                            index = gh.ClosestPoint(intersect_pt, pt_list_ori)[1]
        else:
            temp_int_list = []
            for i_num, i_pt in enumerate(intersect):
                 intersect_pt = i_pt.PointA
                 if line.DistanceTo(intersect_pt, True) < 1:
                     temp_int_list.append(intersect_pt)
            dis_list = []
            for int_pt in temp_int_list:
                dis = int_pt.DistanceTo(rg.Point3d(0,0, int_pt.Z)) 
                dis_list.append(dis)
            min_index = dis_list.index(min(dis_list))
            index = gh.ClosestPoint(temp_int_list[min_index], pt_list_ori)[1]

#        pt_index = gh.ClosestPoint(point_check, pt_list_ori)[1]
        pt_list = pt_list_ori[index:]+pt_list_ori[:index]
        
        pts_dict[n] = pt_list
        dict_list.append(pts_dict[n])
    return dict_list
    
pts = th.list_to_tree(get_points(curves), source = [0])
# ---------- end ghpython_script ----------

item_7 = ListItem(List=ghpython_script.pts, Index=0, Wrap=True)  # disabled
