# Grasshopper definition merginc_c.gh (Grasshopper 1.0.7)

# ---- group: Library Path Location
path = FilePath("/Volumes/GoogleDrive/My Drive/ClayPrinting/")
python = GhPythonScript(x=path)  # -> out, a
# ---------- python: Python ----------
import sys

sys.path.append(x)
# ---------- end python ----------

# ---- group: Pin Geometry
pt = ConstructPoint(XCoordinate=0, YCoordinate=0, ZCoordinate=0)
python_2 = GhPythonScript(
    b_pt=pt,
    height_body=Slider(150, range=0..1000),
    rad_body=Slider(50, range=0..100),
    res_body=Slider(16, range=0..100),
    height_pin=Slider(260, range=0..1000),
    bot_rad=Slider(35, range=0..100),
    top_rad=Slider(20, range=0..100),
    resolution=Slider(16, range=0..100),
    alfa=Slider(2.09, range=0..10),
    connection_line_count=Slider(4, range=0..10),
    start_height=Slider(1.4, range=0..10),
    layer_height=Slider(2.4, range=0..10))  # -> out, body_slices, connection_line_set, body_pin_slices, pin_slices; inputs b_pt: Point3d, res_body: Int32, resolution: Int32, connection_line_count: Int32
# ---------- python_2: Python ----------
import Rhino.Geometry as rg
import brickSlicer as bs
from copy import deepcopy as dc

reload(bs)

# defining the pins

body_pin = bs.Pin(b_pt, height_body, rad_body, rad_body, res_body)
center_pin = bs.Pin(b_pt, height_pin, bot_rad, top_rad, resolution)

# setting up the connection lines

axis_pt = rg.Point3d(1, 0, 0)
main_line = rg.Line(b_pt, b_pt + axis_pt)

base_line_set = []

alfa_delta = 3.1415927 * 2.0 / float(connection_line_count)

for i in range(connection_line_count):
    
    angle = alfa_delta * i + alfa
    
    rotation = rg.Transform.Rotation(angle, b_pt)
    
    tmp_line = dc(main_line)
    tmp_line.Transform(rotation)
    
    base_line_set.append(tmp_line)
    
# setting up the while loop

height = start_height

body_slices = []
body_pin_slices = []
pin_slices = []

connection_line_set = []

print("height: ", height)
print("height_body: ", height_body)

print(height < height_body)

while height < height_body:
    
    print("height: ", height)
    
    body_slices.append(body_pin.createSlice(height))
    body_pin_slices.append(center_pin.createSlice(height))
    
    # moving the lines onto the right height
    
    mv = rg.Transform.Translation(rg.Vector3d(0,0, height - b_pt.Z))
    
    tmp_line_set = []
    
    for line in base_line_set:
        
        tmp_line = dc(line)
        tmp_line.Transform(mv)
        
        tmp_line_set.append(tmp_line)
        
    connection_line_set.append(tmp_line_set)
    
    height += layer_height
    
print("height: ", height)    
    
while height < height_pin:
    
    pin_slices.append(center_pin.createSlice(height))
    
    height += layer_height
# ---------- end python_2 ----------

pt_2 = ConstructPoint(XCoordinate=0, YCoordinate=0, ZCoordinate=0)
python_3 = GhPythonScript(
    b_pt=pt_2,
    height_body=Slider(150, range=0..1000),
    rad_body=Slider(50, range=0..100),
    res_body=Slider(16, range=0..100),
    height_pin=Slider(260, range=0..1000),
    bot_rad=Slider(35, range=0..100),
    top_rad=Slider(20, range=0..100),
    resolution=Slider(16, range=0..100),
    alfa=Slider(2.09, range=0..10),
    connection_line_count=Slider(4, range=0..10),
    start_height=Slider(1.4, range=0..10),
    layer_height=Slider(2.4, range=0..10))  # -> out, body_slices, connection_line_set, body_pin_slices, pin_slices; inputs b_pt: Point3d, res_body: Int32, resolution: Int32, connection_line_count: Int32; same code as python_2

# ----
number_slider = Slider(1, range=0..1)
crv = Curve(<curve referenced from the Rhino model>)
scale = Scale(Geometry=crv, Center=Point(0, 0, 0), Factor=number_slider)  # -> Geometry, Transform
panel = Panel(python_3.out)
crv_2 = Curve(<curve referenced from the Rhino model>)
xz = XZPlane(Origin=Point(0, 0, 0))
crv_3 = Curve(scale.Geometry)
number_slider_2 = Slider(30, range=0..100)
yz = YZPlane(Origin=Point(0, 0, 0))
divide = DivideCurve(Curve=crv_2, Count=1, Kinks=True)  # -> Points, Tangents, Parameters
number_slider_3 = Slider(2, range=0..10)
number_slider_4 = Slider(2, range=0..10)
mesh = Mesh(<mesh referenced from the Rhino model>)
brep = Brep(<brep referenced from the Rhino model>)
rotate = Rotate(Geometry=yz, Angle=Slider(0, range=0..1), Plane=xz)  # -> Geometry, Transform
brep_2 = Brep(<brep referenced from the Rhino model>)
mesh_2 = Mesh(<mesh referenced from the Rhino model>)
list = ValueList({"Inside": "inside", "Outside": "outside"}, selected="Inside")
rotate_2 = Rotate(Geometry=rotate.Geometry, Angle=Slider(0, range=0..1), Plane=PlaneXY(0, 0, 0))  # -> Geometry, Transform
pt_3 = Point(<point referenced from the Rhino model>)
crv_4 = Curve(<curve referenced from the Rhino model>)
end = EndPoints(Curve=crv_4)  # -> Start, End
number_slider_5 = Slider(0, range=0..1)
move = Move(Geometry=rotate_2.Geometry, Motion=pt_3)  # -> Geometry, Transform
pt_4 = Point(Point(0, 0, 0))
rotate_3 = Rotate(Geometry=crv_3, Angle=number_slider_5, Plane=pt_4)  # -> Geometry, Transform

# ---- group: Shell Type
python_4 = GhPythonScript(crv=python_3.body_pin_slices, distance=number_slider_3, direction=list, count=number_slider_4)  # -> out, a, b; inputs count: Int32
# ---------- python_4: Python ----------
import generalFunctions as gf

reload(gf)

b = crv

a = gf.offsetCurveSet(crv, distance, direction, count)
# ---------- end python_4 ----------
python_5 = GhPythonScript(crv=python_3.body_slices, distance=number_slider_3, direction=list, count=number_slider_4)  # -> out, a, b; inputs count: Int32; same code as python_4
python_6 = GhPythonScript(crv=python_3.pin_slices, distance=number_slider_3, direction=list, count=number_slider_4)  # -> out, a, b; inputs count: Int32; same code as python_4
number_slider_6 = Slider(3.2, range=-10..10)
toggle = BooleanToggle(True)
list_2 = ValueList({"detached", "crossing"}, selected="crossing")
path_mapper = PathMapper(python_5.a, source="{A;B;C}", target="{C}")
path_mapper_2 = PathMapper(python_4.a, source="{A;B;C}", target="{C}")
path_mapper_3 = PathMapper(python_6.a, source="{A;B;C}", target="{C}")
crv_5 = Curve(python_5.b)
python_7 = GhPythonScript(crvs=path_mapper_3, split_distance=number_slider_6, split_type=list_2, side_bool=toggle)  # -> out, a, b, c, d, e, f; inputs crvs: list, side_bool: Boolean
# ---------- python_7: Python ----------
import sys

sys.path.append(x)

print sys.path

import layerFunctions as lf

reload(lf)

later_set = lf.LinkingLayers(crvs, split_distance, side_bool, split_type)
# later_set.splitLineGeneration(split_line = main_line, angle = -.05)
a, b, c, d, e = later_set.createOrganisedCurves()
f = later_set.joinCrvs()
# ---------- end python_7 ----------
python_8 = GhPythonScript(crvs=path_mapper, split_distance=number_slider_6, x=path, split_type=list_2, side_bool=toggle)  # -> out, a, b, c, d, e, f; inputs crvs: list, side_bool: Boolean
# ---------- python_8: Python ----------
import sys

sys.path.append(x)

print sys.path

import layerFunctions as lf

reload(lf)

later_set = lf.LinkingLayers(crvs, split_distance, side_bool, split_type)
# later_set.splitLineGeneration(angle = -.05)
a, b, c, d, e = later_set.createOrganisedCurves()
f = later_set.joinCrvs()
# ---------- end python_8 ----------
python_9 = GhPythonScript(crvs=path_mapper_2, split_distance=number_slider_6, x=path, split_type=list_2, side_bool=toggle)  # -> out, a, b, c, d, e, f; inputs crvs: list, side_bool: Boolean; same code as python_7

# ----
item = ListItem(List=path_mapper, Index=0, Wrap=True)  # -> Item1, Item
crv_6 = Curve(item.Item1)
crv_7 = Curve(item.Item)
python_10 = GhPythonScript(pt_1=end.Start, pt_2=end.End, count=Slider(1, range=0..10))  # -> out, a; inputs pt_1: Point3d, pt_2: Point3d, count: Int32
# ---------- python_10: Python ----------
import Rhino.Geometry as rg

def lineInterpolate(pt_0, pt_2, count):

    delta_pt = (pt_2 - pt_0) / float(count + 1.0)

    return [pt_0 + delta_pt * i for i in range(1, count + 1, 1)]
    
a = lineInterpolate(pt_1, pt_2, count)
# ---------- end python_10 ----------
circle = CircleCNR(Center=divide.Points, Normal=Vector(0, 0, 1), Radius=Slider(15, range=0..100))
claylibrarypathlocation = FilePath("/Volumes/GoogleDrive/My Drive/ClayPrinting/")
python_11 = GhPythonScript(
    x=claylibrarypathlocation,
    link_pts=divide.Points,
    connection_count=Slider(6, range=0..10),
    end_alfa=Slider(0.5, range=0..1))  # -> out, link_lines, link_line_vis, connection_lines; inputs link_pts: list of Point3d, connection_count: Int32
# ---------- python_11: Python ----------
import Rhino.Geometry as rg
import math
from copy import deepcopy as dc
import sys

sys.path.append(x)

import generalFunctions as gf

def unitized(pt_a, pt_b):
    
    distance = pt_a.DistanceTo(pt_b)
    
    end_pt = (pt_b - pt_a) / distance
    
    return rg.Point3d(pt_a + end_pt)
    

def linkGen(pt_a, pt_b):
    
    distance = pt_a.DistanceTo(pt_b)
    
    end_pt = (pt_b - pt_a) / distance
    
    return rg.Line(pt_a, pt_a + end_pt)


pt_count = len(link_pts)


pin_pt_set = [[] for i in range(pt_count)]

link_lines = []
link_line_vis = []

for i in range(pt_count - 1):
    
    link_line = linkGen(link_pts[i], link_pts[i + 1])
    
    link_lines.append(dc(link_line))
    
    scale = rg.Transform.Scale(link_pts[i], 100)
    
    link_line.Transform(scale)
    
    link_line_vis.append(link_line)

connection_lines = []
    
# start condition

work_line = dc(link_lines[0])

if connection_count == 1:
    
    pass
    
elif connection_count == 2:
    
    rotation = rg.Transform.Rotation(3.1415927, link_pts[0])
    
    work_line.Transform(rotation)
    connection_lines.append(work_line)
    
    pin_pt_set[0].append(work_line.PointAt(1.0))
    
elif connection_count > 2:
    
    end_alfa = end_alfa * 3.1415927
    alfa_delta = ( 3.1415927 - end_alfa ) * 2.0 / (connection_count - 2)
    
    for i in range(connection_count - 1):
        
        rotation = rg.Transform.Rotation(end_alfa + alfa_delta * i, link_pts[0])
        
        tmp_work_line = dc(work_line)
        
        tmp_work_line.Transform(rotation)
        connection_lines.append(tmp_work_line)
        
        pin_pt_set[0].append(work_line.PointAt(1.0))
        
pin_pt_set[0].append(link_lines[0].PointAt(1.0))

# end_condition

work_line = dc(link_lines[-1])
mv = rg.Transform.Translation(rg.Vector3d(link_pts[-1] - link_pts[-2]))
work_line.Transform(mv)

if connection_count == 1:
    
    pass
    
elif connection_count == 2:
    
    connection_lines.append(work_line)
    
elif connection_count > 2:
    
    # end positions
    
    alfa_delta = ( 3.1415927 - end_alfa ) * 2.0 / (connection_count - 2)
    
    for i in range(connection_count - 1):
        
        rotation = rg.Transform.Rotation(- end_alfa + alfa_delta * i, link_pts[-1])
        
        tmp_work_line = dc(work_line)
        
        tmp_work_line.Transform(rotation)
        connection_lines.append(tmp_work_line)
    
    # in betweenies
    
    crv_set = []
    pt_set = []
    
    extra_link_count = connection_count - 2

    for i in range(1, pt_count - 1, 1):
    
        pt_1 = unitized(link_pts[i], link_pts[i - 1])
        pt_2 = unitized(link_pts[i], link_pts[i + 1])
    
        c = rg.Circle(link_pts[i], 1.0).ToNurbsCurve()
    
        crvs, _ = gf.layer2ptIntersect(c, [pt_1, pt_2])
        crv_1 = crvs[0]
        crv_2 = crvs[1]
    
        crv_1_count = int(round(crv_1.GetLength() / 6.283185 * extra_link_count))
        crv_2_count = extra_link_count - crv_1_count
        
        print("crv counts: ", extra_link_count, crv_1_count, crv_2_count)
        
        if crv_1_count > 0:
            
            crv_1.Domain = rg.Interval(0, crv_1_count + 1)
            
            for j in range(1, crv_1_count + 1):
                
                connection_lines.append(rg.Line(link_pts[i], crv_1.PointAt(j)))
                
        if crv_2_count > 0:
            
            crv_2.Domain = rg.Interval(0, crv_2_count + 1)
            
            for j in range(1, crv_2_count + 1):
                
                connection_lines.append(rg.Line(link_pts[i], crv_2.PointAt(j)))
# ---------- end python_11 ----------
layer_slicing = GhPythonScript(
    x=claylibrarypathlocation,
    geometry=rotate_3.Geometry,
    slice_geo=move.Geometry,
    layer_height=Slider(2.2, range=0..10),
    extra_z=Slider(1.5, range=0..10),
    layer_count=number_slider_2)  # -> out, ori_crvs, crv_sets, a, b, c, d; inputs geometry: GeometryBase
# ---------- layer_slicing: Python ----------
import sys

sys.path.append(x)

import brickSlicer as bs

ori_crvs = bs.slicing(geometry, layer_height = layer_height, layer_count = layer_count, extra_z = extra_z)
crv_sets, a, b, c, d = bs.splitter(ori_crvs, slicing_object = slice_geo, split_type = "object")
# ---------- end layer_slicing ----------
python_12 = GhPythonScript(pts=divide.Points, x=claylibrarypathlocation, y=Slider(2, range=0..10))  # -> out, a, crv_set, pt_set; inputs pts: list of Point3d
# ---------- python_12: Python ----------
import Rhino.Geometry as rg
import sys

sys.path.append(x)

import generalFunctions as gf

pt_count = len(pts)


def unitized(pt_a, pt_b):
    
    distance = pt_a.DistanceTo(pt_b)
    
    end_pt = (pt_b - pt_a) / distance
    
    return rg.Point3d(pt_a + end_pt)


crv_set = []
pt_set = []

for i in range(1, pt_count - 1, 1):
    
    pt_1 = unitized(pts[i], pts[i - 1])
    pt_2 = unitized(pts[i], pts[i + 1])
    
    c = rg.Circle(pts[i], 1.0).ToNurbsCurve()
    
    crvs, _ = gf.layer2ptIntersect(c, [pt_1, pt_2])
    
    crv_set.extend(crvs)
    pt_set.extend([pt_1, pt_2])
# ---------- end python_12 ----------
line_visualization = GhPythonScript(x=pt_2, y=python_3.connection_line_set)  # -> out, a; inputs x: Point3d, y: list
# ---------- line_visualization: Python ----------
import ghpythonlib.components as gh

lines = y[0]

a = []

for line in lines:
    
    # print()
    
    a.extend(gh.Scale(line, line.PointAt(0.0), 250))
# ---------- end line_visualization ----------
line = Line(python_11.connection_lines)
crv_8 = Curve(<curve referenced from the Rhino model>)
panel_2 = Panel(python_10.out)
number_slider_7 = Slider(5, range=0.5..12)
python_13 = GhPythonScript(x=line, y=crv_8)  # -> out, pt_set, line_set; inputs x: list of Line, y: Curve
# ---------- python_13: Python ----------
import Rhino.Geometry as rg

pt_set = []
line_set = []

for line in x:
    
    print(line.PointAt(0.0).DistanceTo(line.PointAt(1.0)))
    
    int_events = rg.Intersect.Intersection.CurveLine(y, line, .01, .01)
    
    pts = [event.PointB for event in int_events]
    t_vals = [event.ParameterB for event in int_events]
    
    t_vals, pts = zip(*sorted(zip(t_vals, pts)))
    
    pt = pts[-1]
            
    pt_set.append(pt)
    
    line_set.append(rg.Line(line.PointAt(0.0), pt))
# ---------- end python_13 ----------
end_2 = EndPoints(Curve=line)  # -> Start, End
clx = CurveLine(Curve=crv_8, Line=line)  # -> Points, Params, Count
len = Length(Curve=python_12.crv_set)
pt_5 = Point(python_12.pt_set)
python_14 = GhPythonScript(x=layer_slicing.crv_sets)  # -> out, a
# ---------- python_14: Python ----------
for crv in x:
    
    print(type(crv))
    print(crv.GetLength())
# ---------- end python_14 ----------
pt_6 = ConstructPoint(XCoordinate=Slider(0, range=-1..1), YCoordinate=Slider(1, range=-1..1), ZCoordinate=0)
path_assignment = GhPythonScript(x=claylibrarypathlocation)  # -> out, a
# ---------- path_assignment: Python ----------
import sys

sys.path.append(x)

print sys.path
# ---------- end path_assignment ----------
pt_7 = Point(end_2.End)
eval = EvaluateCurve(Curve=crv_8, Parameter=clx.Params)  # -> Point, Tangent, Angle
panel_3 = Panel(python_11.out)
panel_4 = Panel(len)
panel_5 = Panel(python_13.out)
rotate_4 = Rotate(Geometry=pt_6, Angle=Slider(3.142, range=-3.142..3.142), Plane=PlaneXY(0, 0, 0))  # -> Geometry, Transform
rotate_5 = Rotate(Geometry=pt_6, Angle=Slider(3.142, range=-3.142..3.142), Plane=PlaneXY(0, 0, 0))  # -> Geometry, Transform
panel_6 = Panel(clx.Params)
layer_structure = GhPythonScript(
    x=claylibrarypathlocation,
    ori_crvs=layer_slicing.ori_crvs,
    crv_set=layer_slicing.crv_sets,
    spacing=number_slider_7,
    direction=Toggle(True),
    item=Toggle(False))  # -> out, layers, set_tuple, a; inputs ori_crvs: list, crv_set: list, direction: Boolean, item: Boolean
# ---------- layer_structure: Python ----------
import sys

sys.path.append(x)

print sys.path

import vertexClass as vc

if direction:
    
    dir = 1
    
else:
    
    dir = -1
    
if item:
    
    item = 0

else:
    
    item = 1

print(ori_crvs)

layers, set_tuple, _ = vc.moveSet(crv_set, ori_crvs, spacing, dir, item)

a = ori_crvs
# ---------- end layer_structure ----------
pline = PolyLine(Closed=False)
crv_9 = Curve(layer_slicing.ori_crvs)
pt_8 = Point(Point(5.356298394, 6.153774703, 0))
pt_9 = Point(Point(6.795797894, 9.047247831, 0))
pt_10 = Point([Point(-701.6203106, -324.489171, 0), Point(-698.3929257, -324.4943706, 0), Point(-697.4873811, -330.8429803, 0), Point(-696.1293493, -324.6575113, 0), Point(-693.7842026, -324.6371187, 0), Point(-690.0727529, -324.6779039, 0)])
python_15 = GhPythonScript()  # -> out, a
# ---------- python_15: Python ----------
a = [[2, 1, 1], [1, 2, 3], [0, 1, 2]]
# ---------- end python_15 ----------
pline_2 = PolyLine(Vertices=python_7.f, Closed=True)  # -> flatten(Polyline)
crv_10 = Curve()
pline_3 = PolyLine(Vertices=pt_10, Closed=False)
python_16 = GhPythonScript(pt=pt_9, pt_2=pt_8)  # -> out, a, vec_2; inputs pt: Point3d, pt_2: Point3d
# ---------- python_16: Python ----------
import math
import Rhino.Geometry as rg


def angleCalc(vec_1, vec_2):
    
    # vec_1 = rg.Vector3d(vec_1)
    # vec_2 = rg.Vector3d(vec_2)
    
    # vec_1.Unitize()
    # vec_2.Unitize()
    
    alfa_0 = math.atan2(vec_1.X, vec_2.Y)
    
    rotation = rg.Transform.Rotation(-alfa_0, rg.Point3d(0,0,0))
    
    print(alfa_0)
    
    vec_2.Transform(rotation)
    
    alfa = math.atan2(vec_1.X, vec_2.Y) + math.pi
    
    if alfa > 6.2827:
        
        alfa = 0.0
        
    elif alfa < 0.0001:
        
        alfa = 6.2827
        
    return alfa
    
print angleCalc(pt, pt_2)
# ---------- end python_16 ----------
layer_structure_2 = GhPythonScript(
    x=claylibrarypathlocation,
    pin_points=pt_10,
    connection_count=Slider(3, range=1..3),
    max_main_line=Slider(10, range=10..250),
    alfa=Slider(0.75, range=0..1))  # -> out, layers, set_tuple, pin_pt_sets, link_lines, main_lines, split_lines; inputs pin_points: list, connection_count: Int32
# ---------- layer_structure_2: Python ----------
import sys

sys.path.append(x)

print sys.path

import generalFunctions

# import pinLinking as pl
import pinLinkingBis as pl

reload(pl)
reload(generalFunctions)

main_lines, link_lines, split_lines, pin_pt_sets = pl.createLinks(pin_points, connection_count, max_main_line, 3.1415729 * .5, alfa)
# ---------- end layer_structure_2 ----------
offset = OffsetCurve(Curve=crv_6, Distance=Slider(-1.1, range=-10..10), Plane=PlaneXY(0, 0, 0), Corners=1)  # -> flatten(Curve)

# ---- group: Creating Body
pline_4 = PolyLine(Vertices=python_9.f, Closed=True)  # -> flatten(Polyline)
pline_5 = PolyLine(Vertices=python_8.f, Closed=False)  # -> flatten(Polyline)
python_17 = GhPythonScript(
    lines=flatten(python_3.connection_line_set),
    y=flatten(offset),
    z=flatten(pline_4),
    main_exterior_crv=flatten(crv_6),
    inner_boundary_crv=flatten(python_3.body_pin_slices),
    distance=Slider(2, range=0..10),
    count=Slider(2, range=0..10))  # -> out, a, b, c, d, e, f, z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; inputs y: Curve, z: Curve, main_exterior_crv: Polyline, inner_boundary_crv: Polyline, count: Int32
# ---------- python_17: Python ----------
import Rhino.Geometry as rg
import layerFunctions as lf
import generalFunctions as gf
import ghpythonlib.components as gh

reload(lf)
reload(gf)

exterior_curve_main = gf.curveToPolyline(y)
inner_curve = gf.curveToPolyline(z)

print("am I closed?")
print(inner_curve.IsClosed)

line_vis_set = []
pt_vis_set = []
curve_vis = []

for i in range(len(lines) - 1):

    line_set = lf.LineSet(lines[i], distance, count)
    line_set.createLines()
    line_set.trimLines(exterior_curve_main, True)
    tmp_lines = line_set.trimLines(inner_boundary_crv, False)
    
    line_vis_set.extend(tmp_lines)
    
    a = line_set.joinLines()
    line_set.lines
    c = line_set.getStartEnd()
    end_pts = line_set.getStartEnd(False)
    
    pt_vis_set.extend(c)

    
    z = gf.polylineTypesToCurve(inner_curve)

    d, _ = gf.layer2ptIntersect(z, c)

    e = gf.longestCurve(d)
    
    curve_vis.extend(d)

    e = gf.curveToPolyline(e)
    
    a.reverse()

    f = a + [pt for pt in e.ToArray()]
    
    inner_curve = gh.PolyLine(f, True)
 
    print("am I closed?")
    print(inner_curve.IsClosed)

line_set = lf.LineSet(lines[-1], distance, count)
line_set.createLines()
line_set.trimLines(exterior_curve_main, True)
tmp_lines = line_set.trimLines(inner_boundary_crv, False)

line_vis_set.extend(tmp_lines)

a = line_set.joinLines()
line_set.lines
c = line_set.getStartEnd()
end_pts = line_set.getStartEnd(False)

pt_vis_set.extend(c)


z = gf.polylineTypesToCurve(inner_curve)

d, _ = gf.layer2ptIntersect(z, c)

e = gf.longestCurve(d)

curve_vis.extend(d)

e = gf.curveToPolyline(e)

a.reverse()

f = [a[-1]] + [pt for pt in e.ToArray()] + [a[0]]

inner_curve = gh.PolyLine(f, False)

print("am I closed?")
print(inner_curve.IsClosed)
# ---------- end python_17 ----------
crv_11 = Curve(python_17.inner_curve)
crv_12 = Curve(pline_5)
panel_7 = Panel(python_17.out)
python_18 = GhPythonScript(inner_curve=crv_11, shell_curve=crv_12)  # -> out, flatten(shell_pt_set); inputs inner_curve: Curve, shell_curve: Curve
# ---------- python_18: Python ----------
import Rhino.Geometry as rg
import layerFunctions as lf
import generalFunctions as gf
import ghpythonlib.components as gh

inner_curve = gf.curveToPolyline(inner_curve)
inner_curve = [pt for pt in inner_curve.ToArray()]
shell_curve.Domain = rg.Interval(0,1)

end_pts_shell = [shell_curve.PointAt(0.0), shell_curve.PointAt(1.0)]
end_pts_inner_curve = [inner_curve[0], inner_curve[-1]]

shell_pl_set = gf.curveToPolyline(shell_curve)

shell_pt_set = [pt for pt in shell_pl_set.ToArray()]

shell_crv = gh.PolyLine(shell_pt_set, True)

y_set, _ = gf.layer2ptIntersect(shell_crv, end_pts_inner_curve)
shell_pt_set = [pt for pt in gf.curveToPolyline(gf.longestCurve(y_set)).ToArray()]

inner_curve.reverse()

total_set = shell_pt_set + inner_curve[1:-1]

total_crv = gh.PolyLine(total_set, True)

y_set, _ = gf.layer2ptIntersect(total_crv, end_pts_shell)
shell_pt_set = gf.curveToPolyline(gf.longestCurve(y_set))
# ---------- end python_18 ----------
pline_6 = PolyLine(Vertices=python_18.shell_pt_set, Closed=False)

# ----
list_3 = ValueList({"dotMap": 0, "ellipsoidBumpMap": 1, "sinWarp": 2, "cylinderMap": 3, "layerMap": 4}, selected="sinWarp")
panel_8 = Panel(python_16.out)
python_19 = GhPythonScript(x=layer_structure_2.pin_pt_sets)  # -> out, a; inputs x: list
# ---------- python_19: Python ----------
a = []

for y in x:
    
    print(len(y))
    
    a.extend(y)
# ---------- end python_19 ----------
pattern = GhPythonScript(
    layers=layer_structure.layers,
    set_tuple=layer_structure.set_tuple,
    sub_length=Slider(2, range=0..10),
    layer_count=Slider(70, range=0..100),
    layer_height=Slider(2.3, range=0..10),
    edge_easing=Toggle(True),
    edge_ease_zero=Slider(0, range=0..100),
    edge_ease_end=Slider(21.9, range=0..100),
    pattern_type=list_3,
    period=Slider(20, range=0..100),
    phase_shift=Slider(0.1, range=0..2),
    spacing=Slider(40, range=0..100),
    radius=Slider(30, range=0..100),
    max_val=Slider(5, range=0..100),
    height=Slider(26.9, range=0..100),
    radius_bot=Slider(0, range=0..10),
    pattern_set=python_15.a,
    direction=Toggle(False))  # -> out, curve_list, a, b, c; inputs layers: list, set_tuple: list, layer_count: Int32, layer_height: Int32, edge_easing: Boolean, pattern_type: Int32, pattern_set: list, direction: Boolean
# ---------- pattern: Python ----------
# snippet of code to make this python component look for it's code in the parent folder of the .gh file

import os

ghComp = ghenv.Component
ghDoc = ghComp.OnPingDocument()

file_name = "patternGenv2.py"
gh_file_location = ghDoc.FilePath
parent = os.path.dirname(os.path.realpath(gh_file_location))

file_path = os.path.join(parent, file_name)

# hacky-hacky run-fun
execfile(file_path)

pattern_map = PatternMap(layers, set_tuple)
pattern_map.build()
# pattern_map.subdivide(sub_length)
# pattern_map.generate(layer_height, layer_count)

if edge_easing:

    pattern_map.edgeEasing(edge_ease_zero, edge_ease_end)

if pattern_type == 0:
    
    pattern_map.dotMap(spacing, radius, max_val, direction)

elif pattern_type == 1:

    pattern_map.ellipsoidBumpMap(spacing, radius, max_val, direction)

elif pattern_type == 2:

    pattern_map.sinWarp(period, max_val, phase_shift, direction)

elif pattern_type == 3:

    if radius_bot < .01:

        radius_bot = radius

    else:

        radius_bot = radius_bot

    pattern_map.cylinderMap(spacing, height, radius, max_val, radius_bot, direction)

elif pattern_type == 4:

    pattern_map.layerMap(spacing, pattern_set, radius, max_val, direction)


c = pattern_map.makeMesh()
b = pattern_map.makeCurves()
# ---------- end pattern ----------
item_2 = ListItem(List=layer_structure_2.pin_pt_sets, Index=Slider(2, range=0..20), Wrap=True)
panel_9 = Panel(layer_structure_2.out)
python_20 = GhPythonScript(x=item_2)  # -> out, a
# ---------- python_20: Python ----------
import Rhino.Geometry as rg

a = []

print(x)

for y in x:
    
    print(len(y))
    
    a.append(y)
# ---------- end python_20 ----------
mesh_3 = Mesh(pattern.c)
panel_10 = Panel(python_20.out)
re_slicer = GhPythonScript(
    ori_crvs=pattern.b,
    slice_geo=move.Geometry,
    layer_count=number_slider_2,
    spacing=number_slider_7,
    direction=Toggle(False),
    item=Toggle(False))  # -> out, ori_crvs, crv_sets, a, b, c, d, layers, set_tuple; inputs ori_crvs: list, direction: Boolean, item: Boolean
# ---------- re_slicer: Python ----------
import sys
import brickSlicer as bs
import vertexClass as vc

print(sys.path)

reload(bs)
reload(vc)

crv_set, a, b, c, d = bs.splitter(ori_crvs, slicing_object = slice_geo, split_type = "object")

if direction:
    
    dir = 1
    
else:
    
    dir = -1
    
if item:
    
    item = 0

else:
    
    item = 1

print(ori_crvs)

layers, set_tuple, _ = vc.moveSet(crv_set, ori_crvs, spacing, dir, item)

a = ori_crvs
# ---------- end re_slicer ----------
panel_11 = Panel(re_slicer.out)
python_21 = GhPythonScript()  # -> out, a
# ---------- python_21: Python ----------
a = [[2, 1, 1], [1, 2, 3], [0, 1, 2],[4, 1.5,6]]
# ---------- end python_21 ----------
list_4 = ValueList({"dotMap": 0, "ellipsoidBumpMap": 1, "sinWarp": 2, "cylinderMap": 3, "layerMap": 4}, selected="layerMap")
pt_11 = Point(<point referenced from the Rhino model>)
pt_12 = Point(<point referenced from the Rhino model>)
rotate_6 = Rotate(Geometry=pt_12, Angle=number_slider_5, Plane=pt_4)  # -> Geometry, Transform
rotate_7 = Rotate(Geometry=pt_11, Angle=number_slider_5, Plane=pt_4)  # -> Geometry, Transform
pattern_2 = GhPythonScript(
    layers=re_slicer.layers,
    set_tuple=re_slicer.set_tuple,
    sub_length=Slider(2, range=0..10),
    layer_count=Slider(70, range=0..100),
    layer_height=Slider(2.3, range=0..10),
    edge_easing=Toggle(True),
    edge_ease_zero=Slider(0, range=0..100),
    edge_ease_end=Slider(21.9, range=0..100),
    pattern_type=list_4,
    period=Slider(27.9, range=0..100),
    phase_shift=Slider(0.1, range=0..2),
    spacing=Slider(30, range=0..100),
    radius=Slider(15, range=0..100),
    max_val=Slider(10, range=0..100),
    height=Slider(26.9, range=0..100),
    radius_bot=Slider(0, range=0..10),
    pattern_set=python_21.a,
    direction=Toggle(False))  # -> out, curve_list, a, b, c; inputs layers: list, set_tuple: list, layer_count: Int32, layer_height: Int32, edge_easing: Boolean, pattern_type: Int32, pattern_set: list, direction: Boolean
# ---------- pattern_2: Python ----------
# snippet of code to make this python component look for it's code in the parent folder of the .gh file

import os

ghComp = ghenv.Component
ghDoc = ghComp.OnPingDocument()

file_name = "patternGenv2.py"
gh_file_location = ghDoc.FilePath
parent = os.path.dirname(os.path.realpath(gh_file_location))

file_path = os.path.join(parent, file_name)

# hacky-hacky run-fun
execfile(file_path)

pattern_map = PatternMap(layers, set_tuple)
pattern_map.build()
# pattern_map.subdivide(sub_length)
# pattern_map.generate(layer_height, layer_count)

if edge_easing:

    pattern_map.edgeEasing(edge_ease_zero, edge_ease_end)

if pattern_type == 0:
    
    pattern_map.dotMap(spacing, radius, max_val, direction)

elif pattern_type == 1:

    pattern_map.ellipsoidBumpMap(spacing, radius, max_val, direction)

elif pattern_type == 2:

    pattern_map.sinWarp(period, max_val, phase_shift, direction)

elif pattern_type == 3:

    if radius_bot < .01:

        radius_bot = radius

    else:

        radius_bot = radius_bot

    pattern_map.cylinderMap(spacing, height, radius, max_val, radius_bot, direction)

elif pattern_type == 4:

    pattern_map.layerMap(spacing, pattern_set, radius, max_val, direction)


c = pattern_map.makeMesh()
b = pattern_map.makeCurves()
a = pattern_map.pts_set
# ---------- end pattern_2 ----------
scale_2 = Scale(Geometry=rotate_7.Geometry, Center=Point(0, 0, 0), Factor=number_slider)  # -> Geometry, Transform
scale_3 = Scale(Geometry=rotate_6.Geometry, Center=Point(0, 0, 0), Factor=number_slider)  # -> Geometry, Transform
line_2 = Line(Line((430.4850107, 65.01726778, 0), (436.8467708, 77.74078793, 0)))
crva = Curve(<curve referenced from the Rhino model>)
python_22 = GhPythonScript(x=flatten(python_7.f))  # -> out, b, a; inputs x: list
# ---------- python_22: Python ----------
b = [[pt for pt in x]]
# ---------- end python_22 ----------
python_23 = GhPythonScript(x=python_18.shell_pt_set)  # -> out, b, a, z; inputs x: list
# ---------- python_23: Python ----------
b = [[pt for pt in x]]

z = b[0][0].Z
# ---------- end python_23 ----------

# ---- group: Brim
crv_13 = Curve(<curve referenced from the Rhino model>)
divide_2 = DivideCurve(Curve=crv_13, Count=10, Kinks=True)  # -> Points, Tangents, Parameters
python_24 = GhPythonScript(x=divide_2.Points, z=python_23.z)  # -> out, b, a; inputs x: list
# ---------- python_24: Python ----------
import Rhino.Geometry as rg

b = [rg.Point3d(pt.X, pt.Y, z) for pt in x]
a = [b + [b[0]]]
# ---------- end python_24 ----------

# ----
python_25 = GhPythonScript()  # -> out, a
# ---------- python_25: Python ----------
import sys

sys.path.append("/Volumes/GoogleDrive/My Drive/ClayPrinting")

import brickSlicer as bs

reload(bs)


bs.slicing
# ---------- end python_25 ----------
re_slicer_2 = GhPythonScript(ori_crvs=pattern_2.b, slice_geo=move.Geometry, layer_count=number_slider_2)  # -> out, ori_crvs, crv_sets, a, b, c, d; inputs ori_crvs: list
# ---------- re_slicer_2: Python ----------
import brickSlicer as bs

crv_sets, a, b, c, d = bs.splitter(ori_crvs, slicing_object = slice_geo, split_type = "object")
# ---------- end re_slicer_2 ----------
mesh_4 = Mesh(pattern_2.c)
number_slider_8 = Slider(2, range=0..10)
number_slider_9 = Slider(2, range=0..10)
crv_14 = Curve(re_slicer_2.ori_crvs)
bbox = BoundingBox(Content=crv_14, Plane=PlaneXY(0, 0, 0))  # -> Box, Box_2
boxprop = BoxProperties(Box=bbox.Box)  # -> Center, Diagonal, Area, Volume, Degeneracy
pdecon = Deconstruct(Point=boxprop.Center)  # -> XComponent, YComponent, ZComponent
python_26 = GhPythonScript(
    b_pt=scale_2.Geometry,
    b_pt_2=scale_3.Geometry,
    height=Slider(300, range=0..1000),
    bot_rad=Slider(35, range=0..100),
    top_rad=Slider(15, range=0..100),
    resolution=Slider(16, range=0..100),
    alfa=Slider(2.09, range=0..10),
    heights=pdecon.ZComponent)  # -> out, a, slices_a, slices_b, main_line_set, line_set; inputs b_pt: Point3d, b_pt_2: Point3d, resolution: Int32, heights: list
# ---------- python_26: Python ----------
import Rhino.Geometry as rg
import brickSlicer as bs
from copy import deepcopy as dc

reload(bs)

b_pt = rg.Point3d(b_pt.X, b_pt.Y, 0.0)
b_pt_2 = rg.Point3d(b_pt_2.X, b_pt_2.Y, 0.0)

# defining the connections

# main connection

distance = b_pt.DistanceTo(b_pt_2)
pt_delta = (b_pt_2 - b_pt) / distance

main_line = rg.Line(b_pt, b_pt + pt_delta)

# b_pt

rot_1 = rg.Transform.Rotation(alfa, b_pt)
rot_2 = rg.Transform.Rotation(-alfa, b_pt)

# b_pt_2

mv = rg.Transform.Translation(b_pt_2 - b_pt)
rot_34 = rg.Transform.Rotation(3.1415927, b_pt_2)

line_a = dc(main_line)
line_a.Transform(rot_1)

line_b = dc(main_line)
line_b.Transform(rot_2)

line_c = dc(line_a)
line_c.Transform(mv)
line_c.Transform(rot_34)

line_d = dc(line_b)
line_d.Transform(mv)
line_d.Transform(rot_34)

# mid lines

mid_pt = (b_pt + b_pt_2) * .5
mv = rg.Transform.Translation(mid_pt - b_pt)
rot_a = rg.Transform.Rotation(1.5707963268, mid_pt)
rot_b = rg.Transform.Rotation(-1.5707963268, mid_pt)

line_e = dc(main_line)
line_e.Transform(mv)
line_e.Transform(rot_a)

line_f = dc(main_line)
line_f.Transform(mv)
line_f.Transform(rot_b)

pin_a = bs.Pin(b_pt, height, bot_rad, top_rad, resolution)
pin_b = bs.Pin(b_pt_2, height, bot_rad, top_rad, resolution)

a = [pin_a.createGeometry(), pin_b.createGeometry()]

slices_a = [pin_a.createSlice(h) for h in heights]
slices_b = [pin_b.createSlice(h) for h in heights]

lines = [line_a, line_b, line_c, line_e, line_f, line_d]

main_line_set = []
line_set = []

for h in heights:
    
    mv = rg.Transform.Translation(rg.Vector3d(0, 0, h))
    
    tmp_line_set = []
    
    loc_main_line = dc(main_line)
    loc_main_line.Transform(mv)
    
    main_line_set.append(loc_main_line)
    
    for line in lines:
        
        loc_line = dc(line)
        
        loc_line.Transform(mv)
        
        tmp_line_set.append(loc_line)
        
    line_set.append(tmp_line_set)
# ---------- end python_26 ----------
eval_2 = EvaluateCurve(Curve=python_26.main_line_set, Parameter=Slider(1, range=0..1))  # -> Point, Tangent, Angle
python_27 = GhPythonScript(x=python_26.line_set)  # -> out, a; inputs x: list
# ---------- python_27: Python ----------
a = x[0]
# ---------- end python_27 ----------
list_5 = ValueList({"Inside": "inside", "Outside": "outside"}, selected="Inside")
crv_b = Curve(python_26.slices_b)
end_3 = EndPoints(Curve=python_27.a)  # -> Start, End
list_6 = ValueList({"Inside": "inside", "Outside": "outside"}, selected="Inside")
crv_a = Curve(python_26.slices_a)
python_28 = GhPythonScript(crv=crv_a, distance=number_slider_8, direction=list_5, count=number_slider_9)  # -> out, a, b; inputs count: Int32; same code as python_4
merge = Merge(Data1=flatten(python_24.a), Data2=flatten(python_23.b), Data3=flatten(python_22.b))
number_slider_10 = Slider(3.6, range=-10..10)
python_29 = GhPythonScript(crv=crv_b, distance=number_slider_8, direction=list_5, count=number_slider_9)  # -> out, a, b; inputs count: Int32; same code as python_4
graft = GraftTree(Tree=python_26.main_line_set, IncludeEmptyLists=True, IncludeNullItems=True)

# ---- group: G-Code
start_stop_feedrate_in_mm_min = Slider(100, range=0..1000)
feed_rate_in_mm_s = Slider(25, range=0..100)
list_7 = ValueList({"start / stop": "start_stop", "continious"}, selected="continious")
gcodelines = GhPythonScript(
    x=path,
    pts=merge,
    feed_rate=feed_rate_in_mm_s,
    extrusion_rate=Slider(0.4, range=0..10),
    link_type=list_7,
    global_trim_distance=Slider(0, range=0..10),
    ss_trim_distance=Slider(5, range=0..10),
    cull_distance=Slider(0, range=0..10),
    lift_val=Slider(4.4, range=0..10),
    ss_f_rate=start_stop_feedrate_in_mm_min,
    ss_e_rate=Slider(300, range=0..1000))  # -> out, a, path_vis; inputs pts: list
# ---------- gcodelines: Python ----------
import sys

sys.path.append(x)

import Rhino.Geometry as rg
import simpleStartStop as ss

reload(ss)

# print(pts)

p_set = ss.PrintSettings(
    feed_rate = feed_rate, 
    extrusion_rate = extrusion_rate, 
    extrusion_mode = 'relative', 
    movement_mode = 'relative'
)

l_type = ss.LinkType(
    link_type = link_type,
    global_trim_distance = global_trim_distance,
    ss_trim_distance = ss_trim_distance,
    cull_distance = cull_distance,
    lift_val = lift_val
)

l_type.ss_f_rate = ss_f_rate
l_type.ss_e_rate = ss_e_rate

gcodeset = ss.GCodeSet(pts, p_set, l_type)
a = gcodeset.generateGCode()

path_vis = gcodeset.path_vis
# ---------- end gcodelines ----------

# ----
brimcrv = Curve(<curve referenced from the Rhino model>)
python_30 = GhPythonScript(crv=re_slicer_2.ori_crvs, distance=Slider(2.5, range=0..10), direction=list_6, count=Slider(2, range=0..10))  # -> out, a, b; inputs count: Int32; same code as python_4
toggle_2 = BooleanToggle(True)
list_8 = ValueList({"detached", "crossing"}, selected="crossing")
path_mapper_4 = PathMapper(python_28.a, source="{A;B;C;D;E;F;G;H;I;J}", target="{J}")
path_mapper_5 = PathMapper(graft, source="{A;B;C;D;E;F;G;H;I;J;K}", target="{K}")
path_mapper_6 = PathMapper(python_29.a, source="{A;B;C;D;E;F;G;H;I;J;K}", target="{K}")
path_mapper_7 = PathMapper(python_29.a, source="{A;B;C;D;E;F;G;H;I;J}", target="{J}")
divide_3 = DivideCurve(Curve=brimcrv, Count=10, Kinks=True)  # -> Points, Tangents, Parameters
panel_12 = Panel(python_28.out)
list_9 = ValueList({"detached", "crossing"}, selected="crossing")
line_3 = Line(Line((-12.72990472, 11.62263406, 0), (-16.16061334, 5.766407065, 0)))
number_slider_11 = Slider(1, range=0..10)
python_31 = GhPythonScript(x=divide_3.Points)  # -> out, b, a; inputs x: list
# ---------- python_31: Python ----------
b = [pt for pt in x]
a = [b + [b[0]]]
# ---------- end python_31 ----------
python_32 = GhPythonScript(
    crvs=path_mapper_4,
    split_distance=number_slider_10,
    x=claylibrarypathlocation,
    split_type=list_8,
    side_bool=toggle_2,
    main_line=path_mapper_5)  # -> out, a, b, c, d, e, f; inputs crvs: list, side_bool: Boolean, main_line: Line
# ---------- python_32: Python ----------
import sys

sys.path.append(x)

print sys.path

import layerFunctions as lf

reload(lf)

later_set = lf.LinkingLayers(crvs, split_distance, side_bool, split_type)
later_set.splitLineGeneration(split_line = main_line, angle = -.05)
a, b, c, d, e = later_set.createOrganisedCurves()
f = later_set.joinCrvs()
# ---------- end python_32 ----------
python_33 = GhPythonScript(
    crvs=python_30.a,
    split_distance=Slider(-1.1, range=-10..10),
    x=claylibrarypathlocation,
    split_type=list_9,
    side_bool=Toggle(True),
    split_axis=line_3)  # -> out, a, b, c, d, e, f; inputs crvs: list, side_bool: Boolean, split_axis: Line
# ---------- python_33: Python ----------
import sys

sys.path.append(x)

print sys.path

import layerFunctions as lf

reload(lf)

later_set = lf.LinkingLayers(crvs, split_distance, side_bool, split_type)
later_set.splitLineGeneration(split_axis)
a, b, c, d, e = later_set.createOrganisedCurves()
f = later_set.joinCrvs()
# ---------- end python_33 ----------
python_34 = GhPythonScript(
    crvs=path_mapper_7,
    split_distance=number_slider_10,
    x=claylibrarypathlocation,
    split_type=list_8,
    side_bool=toggle_2,
    main_line=path_mapper_5)  # -> out, a, b, c, d, e, f; inputs crvs: list, side_bool: Boolean, main_line: Line; same code as python_32
number_slider_12 = Slider(2, range=0..50)
number_slider_13 = Slider(2, range=0..10)
item_3 = ListItem(List=python_30.a, Index=0, Wrap=True)  # -> Item1, Item
panel_13 = Panel(python_28.a)
pline_7 = PolyLine(Vertices=python_34.f, Closed=True)  # -> flatten(Polyline)
pline_8 = PolyLine(Vertices=python_32.f, Closed=True)  # -> flatten(Polyline)
crv_15 = Curve(python_33.d)
pt_13 = Point(python_33.a)
crv_16 = Curve(python_33.b)
panel_14 = Panel(python_32.out)
pline_9 = PolyLine(Vertices=python_33.f, Closed=False)  # -> flatten(Polyline)
python_35 = GhPythonScript(
    x=python_26.main_line_set,
    y=crv_a,
    z=crv_b,
    z_offseted=pline_8,
    y_offseted=pline_7,
    distance=number_slider_12,
    count=number_slider_13)  # -> out, a, b, c, d, e, f, z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; inputs x: Line, y: Curve, z: Curve, z_offseted: Polyline, y_offseted: Polyline, count: Int32
# ---------- python_35: Python ----------
import layerFunctions as lf
import generalFunctions as gf
from copy import deepcopy as dc

reload(lf)
reload(gf)

print("---- !!! New Item !!! ----")

z_boundary = dc(z)
y_boundary = dc(y)

# y = gf.curveToPolyline(y)
# z = gf.curveToPolyline(z)

line_set = lf.LineSet(x, distance, count)
line_set.createLines()
print(line_set.lines)
print("first trim")
g = line_set.trimLines(y, False)
print("second trim")
h = line_set.trimLines(z, True)
a = line_set.joinLines()
b = line_set.lines
c = line_set.getStartEnd()
d = line_set.getStartEnd(False)
# ---------- end python_35 ----------
python_36 = GhPythonScript(
    x=python_26.main_line_set,
    y=crv_a,
    z=crv_b,
    z_offseted=pline_7,
    y_offseted=pline_8,
    distance=number_slider_12,
    count=number_slider_13)  # -> out, a, b, c, d, e, f, z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; inputs x: Line, y: Curve, z: Curve, z_offseted: Polyline, y_offseted: Polyline, count: Int32
# ---------- python_36: Python ----------
import layerFunctions as lf
import generalFunctions as gf
from copy import deepcopy as dc

reload(lf)
reload(gf)

print("---- !!! New Item !!! ----")

z_boundary = dc(z)
y_boundary = dc(y)

# y = gf.curveToPolyline(y)
# z = gf.curveToPolyline(z)

line_set = lf.LineSet(x, distance, count)
line_set.createLines()
print(line_set.lines)
print("first trim")
g = line_set.trimLines(y, False)
print("second trim")
h = line_set.trimLines(z, True)
a = line_set.joinLines()
b = line_set.lines
c = line_set.getStartEnd()
d = line_set.getStartEnd(False)

z = gf.polylineTypesToCurve(z_offseted)
y = gf.polylineTypesToCurve(y_offseted)

c = list(c)

y_set, pts = gf.layer2ptIntersect(y, c)

y = gf.longestCurve(y_set)

z_set, _ = gf.layer2ptIntersect(z, d)
z = gf.longestCurve(z_set)

y = gf.curveToPolyline(y)
z = gf.curveToPolyline(z)

y = [pt for pt in y.ToArray()]
z = [pt for pt in z.ToArray()]

f = y + z + [y[0]]

z = gf.polylineTypesToCurve(z_boundary)
y = gf.polylineTypesToCurve(y_boundary)

y_set, _ = gf.layer2ptIntersect(y, c)
y = gf.longestCurve(y_set)

z_set, _ = gf.layer2ptIntersect(z, d)
z = gf.longestCurve(z_set)

y = gf.curveToPolyline(y)
z = gf.curveToPolyline(z)

y = [pt for pt in y.ToArray()]
z = [pt for pt in z.ToArray()]

boundary_curve = y + z + [y[0]]
# ---------- end python_36 ----------
pline_10 = PolyLine(Vertices=gcodelines.path_vis, Closed=False)
end_start_gcode = GhPythonScript(lines=flatten(gcodelines.a))  # -> out, a; inputs lines: list
# ---------- end_start_gcode: Python ----------
__author__ = "JesusBarney"
__version__ = "2019.04.06"

import rhinoscriptsyntax as rs

#move_mode = "G1"
#extrusion_rate = 0.12
#extrusion_start = 0
offset_z = 0.10
#speed = 500
g_code = []

initiate_gcode = """;FLAVOR:Marlin
;TIME:0
;Filament used: 6.75709m
;Layer height: 1.1
;MINX:-47.897
;MINY:-47.91
;MINZ:1.1
;MAXX:47.895
;MAXY:47.91
;MAXZ:99
;Generated with Cura_SteamEngine 4.1.0
M104 S210
M105
M109 S210
M83 ;relative extrusion mode
G28 ;Home
G1 Z15.0 F6000 ;Move the platform down 15mm
;Prime the extruder
G92 E0
G1 F200 E3
G92 E0
G92 E0
G92 E0
G1 F1500
;LAYER_COUNT:90
;LAYER:0
M107
M203 Z50
M205 X30 Y30
G0 F1500 X30 Y-3.573 Z20
M205 X20 Y20
;TYPE:SKIRT
G1 X0 Y0 Z20 E25"""

# ;TIME_ELAPSED:751.629903
# G1 F1500 E510.30819   

end_gcode = """M205 X30 Y30 Z30 E-1
G0 F600 X-43.931 Y-19.114
G0 X-40.689 Y-17.797
M205 X20 Y20
M203 Z299792458000
M107
M104 S0
M140 S0
;Retract the filament
G92 E1
G1 E-1 F300
G28 X0 Y0
M84
M83 ;absolute extrusion mode
M104 S0"""

print initiate_gcode

for line in lines:

    print(line)

print end_gcode
# ---------- end end_start_gcode ----------
line_4 = Line(python_36.h)
path_mapper_8 = PathMapper(python_36.f, source="{A;B;C;D;E;F;G;H;I;J}", target="{J}")
path_mapper_9 = PathMapper(python_36.boundary_curve, source="{A;B;C;D;E;F;G;H;I;J}", target="{J}")
line_5 = Line(python_35.h)
pt_14 = Point(python_35.c)
crv_17 = Curve(python_35.y)
pline_11 = PolyLine(Vertices=python_35.y, Closed=False)
item_4 = ListItem(List=pline_8, Index=0, Wrap=True)
panel_15 = Panel(end_start_gcode.out)
offset_2 = OffsetCurve(Curve=item_3.Item1, Distance=Slider(-1.1, range=-10..10), Plane=PlaneXY(0, 0, 0), Corners=1)  # -> flatten(Curve)
exteriorcrv = Curve(<curve referenced from the Rhino model>)
crv_18 = Curve(flatten(item_3.Item1))
pline_12 = PolyLine(Vertices=path_mapper_8, Closed=True)  # -> flatten(Polyline)
pline_13 = PolyLine(Vertices=path_mapper_9, Closed=True)  # -> flatten(Polyline)
item_5 = ListItem(List=offset_2, Index=Slider(9, range=0..100), Wrap=True)
python_37 = GhPythonScript(
    lines=flatten(python_26.line_set),
    y=flatten(offset_2),
    z=flatten(pline_12),
    main_exterior_crv=flatten(crv_18),
    inner_boundary_crv=pline_13,
    distance=Slider(2, range=0..10),
    count=Slider(2, range=0..10))  # -> out, a, b, c, d, e, f, z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; inputs y: Curve, z: Curve, main_exterior_crv: Polyline, inner_boundary_crv: Polyline, count: Int32; same code as python_17
copyoflink_offset = GhPythonScript()  # -> out, a
# ---------- copyoflink_offset: Python ----------
z = gf.polylineTypesToCurve(z_offseted)
y = gf.polylineTypesToCurve(y_offseted)

y_set, _ = gf.layer2ptIntersect(y, c)
y = gf.longestCurve(y_set)

z_set, _ = gf.layer2ptIntersect(z, d)
z = gf.longestCurve(z_set)

y = gf.curveToPolyline(y)
z = gf.curveToPolyline(z)

y = [pt for pt in y.ToArray()]
z = [pt for pt in z.ToArray()]

f = y + z + [y[0]]
# ---------- end copyoflink_offset ----------
crv_19 = Curve(pline_9)
crv_20 = Curve(python_37.inner_curve)
python_38 = GhPythonScript(inner_curve=crv_20, shell_curve=crv_19)  # -> out, flatten(shell_pt_set); inputs inner_curve: Curve, shell_curve: Curve; same code as python_18
python_39 = GhPythonScript(x=python_38.shell_pt_set)  # -> out, b, a; inputs x: list; same code as python_22
merge_2 = Merge(Data1=flatten(python_31.a), Data2=flatten(python_39.b))

# ---- group: G-Code
start_stop_feedrate_in_mm_min_2 = Slider(100, range=0..1000)
feed_rate_in_mm_s_2 = Slider(25, range=0..100)
list_10 = ValueList({"start / stop": "start_stop", "continious"}, selected="continious")
gcodelines_2 = GhPythonScript(
    x=claylibrarypathlocation,
    pts=merge_2,
    feed_rate=feed_rate_in_mm_s_2,
    extrusion_rate=Slider(0.4, range=0..10),
    link_type=list_10,
    global_trim_distance=Slider(0, range=0..10),
    ss_trim_distance=Slider(5, range=0..10),
    cull_distance=Slider(1, range=0..10),
    lift_val=Slider(4.4, range=0..10),
    ss_f_rate=start_stop_feedrate_in_mm_min_2,
    ss_e_rate=Slider(300, range=0..1000))  # -> out, a, path_vis; inputs pts: list; same code as gcodelines

# ----
pline_14 = PolyLine(Vertices=gcodelines_2.path_vis, Closed=False)
end_start_gcode_2 = GhPythonScript(lines=flatten(gcodelines_2.a))  # -> out, a; inputs lines: list; same code as end_start_gcode
panel_16 = Panel(end_start_gcode_2.out)
panel_17 = Panel(python_37.out)
pline_15 = PolyLine(Vertices=python_38.shell_pt_set, Closed=False)
panel_18 = Panel(python_38.out)
