# Grasshopper definition pinGenerator.gh (Grasshopper 1.0.7)

# ---- group: Library Path Location
path = FilePath("/Volumes/GoogleDrive/My Drive/ClayPrinting/")
python = GhPythonScript(x=path)  # -> out, a
# ---------- python: Python ----------
import sys

sys.path.append(x)
# ---------- end python ----------

# ---- group: Pin Geometry
pt = ConstructPoint(XCoordinate=0, YCoordinate=0, ZCoordinate=0)
python_2 = GhPythonScript(
    b_pt=pt,
    height_body=Slider(150, range=0..1000),
    rad_body=Slider(50, range=0..100),
    res_body=Slider(16, range=0..100),
    height_pin=Slider(260, range=0..1000),
    bot_rad=Slider(35, range=0..100),
    top_rad=Slider(18, range=0..100),
    resolution=Slider(16, range=0..100),
    alfa=Slider(2.09, range=0..10),
    connection_line_count=Slider(4, range=0..10),
    start_height=Slider(1.4, range=0..10),
    layer_height=Slider(2.4, range=0..10))  # -> out, body_slices, connection_line_set, body_pin_slices, pin_slices; inputs b_pt: Point3d, res_body: Int32, resolution: Int32, connection_line_count: Int32
# ---------- python_2: Python ----------
import Rhino.Geometry as rg
import brickSlicer as bs
from copy import deepcopy as dc

reload(bs)

# defining the pins

body_pin = bs.Pin(b_pt, height_body, rad_body, rad_body, res_body)
center_pin = bs.Pin(b_pt, height_pin, bot_rad, top_rad, resolution)

# setting up the connection lines

axis_pt = rg.Point3d(1, 0, 0)
main_line = rg.Line(b_pt, b_pt + axis_pt)

base_line_set = []

alfa_delta = 3.1415927 * 2.0 / float(connection_line_count)

for i in range(connection_line_count):
    
    angle = alfa_delta * i + alfa
    
    rotation = rg.Transform.Rotation(angle, b_pt)
    
    tmp_line = dc(main_line)
    tmp_line.Transform(rotation)
    
    base_line_set.append(tmp_line)
    
# setting up the while loop

height = start_height

body_slices = []
body_pin_slices = []
pin_slices = []

connection_line_set = []

print("height: ", height)
print("height_body: ", height_body)

print(height < height_body)

while height < height_body:
    
    print("height: ", height)
    
    body_slices.append(body_pin.createSlice(height))
    body_pin_slices.append(center_pin.createSlice(height))
    
    # moving the lines onto the right height
    
    mv = rg.Transform.Translation(rg.Vector3d(0,0, height - b_pt.Z))
    
    tmp_line_set = []
    
    for line in base_line_set:
        
        tmp_line = dc(line)
        tmp_line.Transform(mv)
        
        tmp_line_set.append(tmp_line)
        
    connection_line_set.append(tmp_line_set)
    
    height += layer_height
    
print("height: ", height)    
    
while height < height_pin:
    
    pin_slices.append(center_pin.createSlice(height))
    
    height += layer_height
# ---------- end python_2 ----------

# ----
number_slider = Slider(2, range=0..10)
number_slider_2 = Slider(2, range=0..10)
python_3 = GhPythonScript(crvs=python_2.body_pin_slices, count=Slider(3, range=0..10), max_amount=Slider(3, range=0..10))  # -> out, flatten(a); inputs crvs: list of Curve, count: Int32
# ---------- python_3: Python ----------
import Rhino.Geometry as rg
import generalFunctions as gf

if count > 0:
    
    count_delta = max_amount / float(count)
    
    for i in range(count):
        
        active_crv = crvs[i]
        
        offset = count_delta * (count - i)
        
        crvs[i] = gf.offsetCurveSet(active_crv, offset, "outside", count = 2)[1].ToNurbsCurve()

a = crvs
# ---------- end python_3 ----------
list = ValueList({"Inside": "inside", "Outside": "outside"}, selected="Inside")

# ---- group: Shell Type
python_4 = GhPythonScript(crv=python_3.a, distance=number_slider, direction=list, count=number_slider_2)  # -> out, a, b; inputs count: Int32
# ---------- python_4: Python ----------
import generalFunctions as gf

reload(gf)

b = crv

a = gf.offsetCurveSet(crv, distance, direction, count)
# ---------- end python_4 ----------
python_5 = GhPythonScript(crv=python_2.body_slices, distance=number_slider, direction=list, count=Slider(1, range=0..10))  # -> out, a, b; inputs count: Int32; same code as python_4
python_6 = GhPythonScript(crv=python_2.pin_slices, distance=number_slider, direction=list, count=number_slider_2)  # -> out, a, b; inputs count: Int32; same code as python_4
number_slider_3 = Slider(3.2, range=-10..10)
toggle = BooleanToggle(True)
list_2 = ValueList({"detached", "crossing"}, selected="crossing")
path_mapper = PathMapper(python_5.a, source="{A;B;C}", target="{C}")
path_mapper_2 = PathMapper(python_4.a, source="{A;B}", target="{B}")
path_mapper_3 = PathMapper(python_6.a, source="{A;B;C}", target="{C}")
crv = Curve(python_5.b)
python_7 = GhPythonScript(crvs=path_mapper_3, split_distance=number_slider_3, split_type=list_2, side_bool=toggle)  # -> out, a, b, c, d, e, f; inputs crvs: list, side_bool: Boolean
# ---------- python_7: Python ----------
import sys

sys.path.append(x)

print sys.path

import layerFunctions as lf

reload(lf)

later_set = lf.LinkingLayers(crvs, split_distance, side_bool, split_type)
# later_set.splitLineGeneration(split_line = main_line, angle = -.05)
a, b, c, d, e = later_set.createOrganisedCurves()
f = later_set.joinCrvs()
# ---------- end python_7 ----------
python_8 = GhPythonScript(crvs=path_mapper, split_distance=number_slider_3, x=path, split_type=list_2, side_bool=toggle)  # -> out, a, b, c, d, e, f; inputs crvs: list, side_bool: Boolean
# ---------- python_8: Python ----------
import sys

sys.path.append(x)

print sys.path

import layerFunctions as lf

reload(lf)

later_set = lf.LinkingLayers(crvs, split_distance, side_bool, split_type)
# later_set.splitLineGeneration(angle = -.05)
a, b, c, d, e = later_set.createOrganisedCurves()
f = later_set.joinCrvs()
# ---------- end python_8 ----------
python_9 = GhPythonScript(crvs=path_mapper_2, split_distance=number_slider_3, x=path, split_type=list_2, side_bool=toggle)  # -> out, a, b, c, d, e, f; inputs crvs: list, side_bool: Boolean; same code as python_7

# ----
panel = Panel(python_4.a)
item = ListItem(List=path_mapper, Index=0, Wrap=True)  # -> Item1, Item
crv_2 = Curve(item.Item1)
crv_3 = Curve(item.Item)
line_visualization = GhPythonScript(x=pt, y=python_2.connection_line_set)  # -> out, a; inputs x: Point3d, y: list
# ---------- line_visualization: Python ----------
import ghpythonlib.components as gh

lines = y[0]

a = []

for line in lines:
    
    # print()
    
    a.extend(gh.Scale(line, line.PointAt(0.0), 250))
# ---------- end line_visualization ----------
pline = PolyLine(Vertices=python_7.f, Closed=True)  # -> flatten(Polyline)
offset = OffsetCurve(Curve=crv_2, Distance=Slider(-1.1, range=-10..10), Plane=PlaneXY(0, 0, 0), Corners=1)  # -> flatten(Curve)

# ---- group: Creating Body
pline_2 = PolyLine(Vertices=python_9.f, Closed=True)  # -> flatten(Polyline)
pline_3 = PolyLine(Vertices=python_8.f, Closed=False)  # -> flatten(Polyline)
python_10 = GhPythonScript(
    lines=flatten(python_2.connection_line_set),
    y=flatten(offset),
    z=flatten(pline_2),
    main_exterior_crv=flatten(crv_2),
    inner_boundary_crv=flatten(python_3.a),
    distance=Slider(2, range=0..10),
    count=Slider(2, range=0..10))  # -> out, a, b, c, d, e, f, z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; inputs y: Curve, z: Curve, main_exterior_crv: Polyline, inner_boundary_crv: Polyline, count: Int32
# ---------- python_10: Python ----------
import Rhino.Geometry as rg
import layerFunctions as lf
import generalFunctions as gf
import ghpythonlib.components as gh

reload(lf)
reload(gf)

exterior_curve_main = gf.curveToPolyline(y)
inner_curve = gf.curveToPolyline(z)

print("am I closed?")
print(inner_curve.IsClosed)

line_vis_set = []
pt_vis_set = []
curve_vis = []

for i in range(len(lines) - 1):

    line_set = lf.LineSet(lines[i], distance, count)
    line_set.createLines()
    line_set.trimLines(exterior_curve_main, True)
    tmp_lines = line_set.trimLines(inner_boundary_crv, False)
    
    line_vis_set.extend(tmp_lines)
    
    a = line_set.joinLines()
    line_set.lines
    c = line_set.getStartEnd()
    end_pts = line_set.getStartEnd(False)
    
    pt_vis_set.extend(c)

    
    z = gf.polylineTypesToCurve(inner_curve)

    d, _ = gf.layer2ptIntersect(z, c)

    e = gf.longestCurve(d)
    
    curve_vis.extend(d)

    e = gf.curveToPolyline(e)
    
    a.reverse()

    f = a + [pt for pt in e.ToArray()]
    
    inner_curve = gh.PolyLine(f, True)
 
    print("am I closed?")
    print(inner_curve.IsClosed)

line_set = lf.LineSet(lines[-1], distance, count)
line_set.createLines()
line_set.trimLines(exterior_curve_main, True)
tmp_lines = line_set.trimLines(inner_boundary_crv, False)

line_vis_set.extend(tmp_lines)

a = line_set.joinLines()
line_set.lines
c = line_set.getStartEnd()
end_pts = line_set.getStartEnd(False)

pt_vis_set.extend(c)


z = gf.polylineTypesToCurve(inner_curve)

d, _ = gf.layer2ptIntersect(z, c)

e = gf.longestCurve(d)

curve_vis.extend(d)

e = gf.curveToPolyline(e)

a.reverse()

f = [a[-1]] + [pt for pt in e.ToArray()] + [a[0]]

inner_curve = gh.PolyLine(f, False)

print("am I closed?")
print(inner_curve.IsClosed)
# ---------- end python_10 ----------
crv_4 = Curve(python_10.inner_curve)
crv_5 = Curve(pline_3)
panel_2 = Panel(python_10.out)
python_11 = GhPythonScript(inner_curve=crv_4, shell_curve=crv_5)  # -> out, flatten(shell_pt_set); inputs inner_curve: Curve, shell_curve: Curve
# ---------- python_11: Python ----------
import Rhino.Geometry as rg
import layerFunctions as lf
import generalFunctions as gf
import ghpythonlib.components as gh

inner_curve = gf.curveToPolyline(inner_curve)
inner_curve = [pt for pt in inner_curve.ToArray()]
shell_curve.Domain = rg.Interval(0,1)

end_pts_shell = [shell_curve.PointAt(0.0), shell_curve.PointAt(1.0)]
end_pts_inner_curve = [inner_curve[0], inner_curve[-1]]

shell_pl_set = gf.curveToPolyline(shell_curve)

shell_pt_set = [pt for pt in shell_pl_set.ToArray()]

shell_crv = gh.PolyLine(shell_pt_set, True)

y_set, _ = gf.layer2ptIntersect(shell_crv, end_pts_inner_curve)
shell_pt_set = [pt for pt in gf.curveToPolyline(gf.longestCurve(y_set)).ToArray()]

inner_curve.reverse()

total_set = shell_pt_set + inner_curve[1:-1]

total_crv = gh.PolyLine(total_set, True)

y_set, _ = gf.layer2ptIntersect(total_crv, end_pts_shell)
shell_pt_set = gf.curveToPolyline(gf.longestCurve(y_set))
# ---------- end python_11 ----------
pline_4 = PolyLine(Vertices=python_11.shell_pt_set, Closed=False)

# ----
item_2 = ListItem(List=python_2.body_slices, Index=0, Wrap=True)
brim = GhPythonScript(crv=item_2, offset_amount=Slider(10, range=0..10))  # -> out, flatten(a); inputs crv: Curve
# ---------- brim: Python ----------
import Rhino.Geometry as rg
import generalFunctions as gf
        
a = gf.offsetCurveSet(crv, offset_amount, "outside", count = 2)[1]
# ---------- end brim ----------
python_12 = GhPythonScript(x=flatten(python_7.f))  # -> out, b, a; inputs x: list
# ---------- python_12: Python ----------
b = [[pt for pt in x]]
# ---------- end python_12 ----------
python_13 = GhPythonScript(x=python_11.shell_pt_set)  # -> out, b, a, z; inputs x: list
# ---------- python_13: Python ----------
b = [[pt for pt in x]]

z = b[0][0].Z
# ---------- end python_13 ----------

# ---- group: Brim
crv_6 = Curve(<curve referenced from the Rhino model>)
divide = DivideCurve(Curve=crv_6, Count=10, Kinks=True)  # -> Points, Tangents, Parameters
python_14 = GhPythonScript(x=brim.a, z=python_13.z)  # -> out, b, a; inputs x: list
# ---------- python_14: Python ----------
import Rhino.Geometry as rg

b = [rg.Point3d(pt.X, pt.Y, z) for pt in x]
a = [b + [b[0]]]
# ---------- end python_14 ----------

# ----
merge = Merge(Data1=flatten(python_14.a), Data2=flatten(python_13.b), Data3=flatten(python_12.b))

# ---- group: G-Code
start_stop_feedrate_in_mm_min = Slider(100, range=0..1000)
feed_rate_in_mm_s = Slider(25, range=0..100)
list_3 = ValueList({"start / stop": "start_stop", "continious"}, selected="continious")
gcodelines = GhPythonScript(
    x=path,
    pts=merge,
    feed_rate=feed_rate_in_mm_s,
    extrusion_rate=Slider(0.4, range=0..10),
    link_type=list_3,
    global_trim_distance=Slider(0, range=0..10),
    ss_trim_distance=Slider(5, range=0..10),
    cull_distance=Slider(0, range=0..10),
    lift_val=Slider(4.4, range=0..10),
    ss_f_rate=start_stop_feedrate_in_mm_min,
    ss_e_rate=Slider(300, range=0..1000))  # -> out, a, path_vis; inputs pts: list
# ---------- gcodelines: Python ----------
import sys

sys.path.append(x)

import Rhino.Geometry as rg
import simpleStartStop as ss

reload(ss)

# print(pts)

p_set = ss.PrintSettings(
    feed_rate = feed_rate, 
    extrusion_rate = extrusion_rate, 
    extrusion_mode = 'relative', 
    movement_mode = 'relative'
)

l_type = ss.LinkType(
    link_type = link_type,
    global_trim_distance = global_trim_distance,
    ss_trim_distance = ss_trim_distance,
    cull_distance = cull_distance,
    lift_val = lift_val
)

l_type.ss_f_rate = ss_f_rate
l_type.ss_e_rate = ss_e_rate

gcodeset = ss.GCodeSet(pts, p_set, l_type)
a = gcodeset.generateGCode()

path_vis = gcodeset.path_vis
# ---------- end gcodelines ----------

# ----
pline_5 = PolyLine(Vertices=gcodelines.path_vis, Closed=False)
end_start_gcode = GhPythonScript(lines=flatten(gcodelines.a))  # -> out, a; inputs lines: list
# ---------- end_start_gcode: Python ----------
__author__ = "JesusBarney"
__version__ = "2019.04.06"

import rhinoscriptsyntax as rs

#move_mode = "G1"
#extrusion_rate = 0.12
#extrusion_start = 0
offset_z = 0.10
#speed = 500
g_code = []

initiate_gcode = """;FLAVOR:Marlin
;TIME:0
;Filament used: 6.75709m
;Layer height: 1.1
;MINX:-47.897
;MINY:-47.91
;MINZ:1.1
;MAXX:47.895
;MAXY:47.91
;MAXZ:99
;Generated with Cura_SteamEngine 4.1.0
M104 S210
M105
M109 S210
M83 ;relative extrusion mode
G28 ;Home
G1 Z15.0 F6000 ;Move the platform down 15mm
;Prime the extruder
G92 E0
G1 F200 E3
G92 E0
G92 E0
G92 E0
G1 F1500
;LAYER_COUNT:90
;LAYER:0
M107
M203 Z50
M205 X30 Y30
G0 F1500 X30 Y-3.573 Z20
M205 X20 Y20
;TYPE:SKIRT
G1 X0 Y0 Z20 E25"""

# ;TIME_ELAPSED:751.629903
# G1 F1500 E510.30819   

end_gcode = """M205 X30 Y30 Z30 E-1
G0 F600 X-43.931 Y-19.114
G0 X-40.689 Y-17.797
M205 X20 Y20
M203 Z299792458000
M107
M104 S0
M140 S0
;Retract the filament
G92 E1
G1 E-1 F300
G28 X0 Y0
M84
M83 ;absolute extrusion mode
M104 S0"""

print initiate_gcode

for line in lines:

    print(line)

print end_gcode
# ---------- end end_start_gcode ----------
panel_3 = Panel(end_start_gcode.out)
