# Grasshopper definition simpleGCode.gh (Grasshopper 1.0.7)

yz = YZPlane(Origin=Point(0, 0, 0))
series = Series(Start=0, Step=Slider(2, range=0..10), Count=Slider(8, range=0..10))
brep = Brep(<brep referenced from the Rhino model>)
pln = Plane(yz)
line = Line(Line((-1.263981532, -48.84175791, 0), (8.362559972, -74.03462184, 0)))
crv = Curve(<curve referenced from the Rhino model>)
crv_2 = Curve(<curve referenced from the Rhino model>)
Z = UnitZ(Factor=series)
python = GhPythonScript(x=crv_2, y=pln)  # -> out, a; inputs x: Curve
# ---------- python: Python ----------
import Rhino.Geometry as rg
from copy import deepcopy as dc

def rhinoGeometryObjectType(base_object):

    crv_type_list = ['NurbsCurve', 'Curve', 'PolylineCurve', 'LineCurve']
    brep_type = ['Brep']
    mesh_type = ['Mesh']
    plane_type = ['Plane']
    line_type = ['Line']

    types = [('brep', brep_type), ('mesh', mesh_type), ('crv', crv_type_list), ('plane', plane_type), ('line', line_type)]

    a = str(type(base_object))

    obj_type = "other"

    for type_tuple in types:

        for type_val in type_tuple[1]:

            if (str(type(base_object)).find(type_val) > 0):

                obj_type = type_tuple[0]

                break

    return obj_type
    
def moveToSameHeight(ref_object, mv_object):

    z_ref = ref_object.PointAt(ref_object.Domain[0]).Z
    
    z_mv_obj = mv_object.PointAt(ref_object.Domain[0]).Z

    mv_vec = rg.Vector3d(0 ,0 , z_ref - z_mv_obj)

    mv = rg.Transform.Translation(mv_vec)

    output_obj = dc(mv_object)

    output_obj.Transform(mv)

    return output_obj

def crvIntersector(crv, other_object):

    obj_type = rhinoGeometryObjectType(other_object)

    if obj_type == 'line':

        tmp_other_obj = moveToSameHeight(crv, other_object)

        int_events = rg.Intersect.Intersection.CurveLine(crv, tmp_other_obj, .01, .01)

        pts = [int_event.PointA for int_event in int_events]
        t_vals = [int_event.ParameterA for int_event in int_events]

    elif obj_type == 'crv':

        tmp_other_obj = moveToSameHeight(crv, other_object)

        int_events = rg.Intersect.Intersection.CurveCurve(crv, tmp_other_obj, .01, .01)

        pts = [int_event.PointA for int_event in int_events]
        t_vals = [int_event.ParameterA for int_event in int_events]

    elif obj_type == 'plane':

        int_events = rg.Intersect.Intersection.CurvePlane(crv, other_object, .01)

        pts = [int_event.PointA for int_event in int_events]
        t_vals = [int_event.ParameterA for int_event in int_events]

    elif obj_type == 'brep':

        _, t_vals = rg.Intersect.Intersection.CurveBrep(crv, other_object, .01, .001)

        pts = [crv.PointAt(t_val) for t_val in t_vals]

    else:

        print("object type %s is not supported" % obj_type)

        pts = []
        t_vals = []

    return pts, t_vals
    
a, _ = crvIntersector(x, y)
# ---------- end python ----------
python_2 = GhPythonScript()  # -> out, a
# ---------- python_2: Python ----------
print(type(.05))
print(type(1))
# ---------- end python_2 ----------
crv_3 = Curve(<curve referenced from the Rhino model>)
crv_4 = Curve([<curve referenced from the Rhino model> x2])
pt = Point(python.a)
move = Move(Geometry=graft(crv_4), Motion=Z)  # -> graft(Geometry), Transform
panel = Panel(python_2.out)
panel_2 = Panel(python.out)
path_mapper = PathMapper(move.Geometry, source="{A;B;C}", target="{C}")
xz = XZPlane(Origin=Point(0, 0, 0))
merge = Merge(Data1=crv_3, Data2=path_mapper)  # -> flatten(Result)
number_slider = Slider(16, range=0..100)
yz_2 = YZPlane(Origin=Point(0, 0, 0))
mesh = Mesh(<mesh referenced from the Rhino model>)
rotate = Rotate(Geometry=yz_2, Angle=Slider(0, range=0..1), Plane=xz)  # -> Geometry, Transform
brep_2 = Brep(<brep referenced from the Rhino model>)
mesh_2 = Mesh(<mesh referenced from the Rhino model>)
brep_3 = Brep(<brep referenced from the Rhino model>)
crv_5 = Curve(<curve referenced from the Rhino model>)
crv_to_lists = GhPythonScript(crvs=merge, divs=Slider(20, range=0..50))  # -> out, lists, pts; inputs crvs: list of Curve, divs: Int32
# ---------- crv_to_lists: Python ----------
import ghpythonlib.components as gh

lists = []

for crv in crvs:
    
    pts = gh.DivideCurve(crv, divs, True)[0]
    
    if crv.IsPeriodic:
        
        pts.append(pts[0])
    
    lists.append(pts)
# ---------- end crv_to_lists ----------
xy = XYPlane(Origin=Point(0, 0, 0))
crv_6 = Curve(<curve referenced from the Rhino model>)
brep_4 = Brep(<brep referenced from the Rhino model>)
mesh_3 = Mesh(<mesh referenced from the Rhino model>)
rotate_2 = Rotate(Geometry=rotate.Geometry, Angle=Slider(0, range=0..1), Plane=PlaneXY(0, 0, 0))  # -> Geometry, Transform
pt_2 = Point(<point referenced from the Rhino model>)
lists_to_gcode = GhPythonScript(base_object=crv_5, extrusion_rate=Slider(1.5, range=0..10))  # -> out, lines; inputs base_object: GeometryBase
# ---------- lists_to_gcode: Python ----------
# snippet of code to make this python component look for it's   code in the parent folder of the .gh file

import os

ghComp = ghenv.Component
ghDoc = ghComp.OnPingDocument()

file_name = "brickSlicer.py"
gh_file_location = ghDoc.FilePath
parent = os.path.dirname(os.path.realpath(gh_file_location))

file_path = os.path.join(parent, file_name)
print(file_path)

parent = os.path.dirname(os.path.realpath(parent))
parent = os.path.dirname(os.path.realpath(parent))
print(parent)

# hacky-hacky run-fun
execfile(file_path)

# lines = gCodeGenerator(lists, extrusion_rate)
# ---------- end lists_to_gcode ----------
lists_to_gcode_2 = GhPythonScript(lists=crv_to_lists.lists, extrusion_rate=Slider(1.5, range=0..10))  # -> out, lines; inputs lists: list
# ---------- lists_to_gcode_2: Python ----------
# snippet of code to make this python component look for it's code in the parent folder of the .gh file

import os

ghComp = ghenv.Component
ghDoc = ghComp.OnPingDocument()

file_name = "simpleStartStop.py"
gh_file_location = ghDoc.FilePath
parent = os.path.dirname(os.path.realpath(gh_file_location))

file_path = os.path.join(parent, file_name)
print(file_path)

parent = os.path.dirname(os.path.realpath(parent))
parent = os.path.dirname(os.path.realpath(parent))
print(parent)

# hacky-hacky run-fun
execfile(file_path)

lines = gCodeGenerator(lists, extrusion_rate)
# ---------- end lists_to_gcode_2 ----------
type = GhPythonScript(x=xy)  # -> out
# ---------- type: Python ----------
# snippet of code to make this python component look for it's   code in the parent folder of the .gh file

import os

ghComp = ghenv.Component
ghDoc = ghComp.OnPingDocument()

file_name = "brickSlicer.py"
gh_file_location = ghDoc.FilePath
parent = os.path.dirname(os.path.realpath(gh_file_location))

file_path = os.path.join(parent, file_name)
print(file_path)

parent = os.path.dirname(os.path.realpath(parent))
parent = os.path.dirname(os.path.realpath(parent))
print(parent)

# hacky-hacky run-fun
execfile(file_path)

print(type(x))

# lines = gCodeGenerator(lists, extrusion_rate)
# ---------- end type ----------
ghpython_script = GhPythonScript(x=xy)  # -> out
# ---------- ghpython_script: Python ----------
print(type(x))
# ---------- end ghpython_script ----------
move_2 = Move(Geometry=rotate_2.Geometry, Motion=pt_2)  # -> Geometry, Transform
end_start_gcode = GhPythonScript(lines=flatten(lists_to_gcode_2.lines))  # -> out, a; inputs lines: list
# ---------- end_start_gcode: Python ----------
__author__ = "JesusBarney"
__version__ = "2019.04.06"

import rhinoscriptsyntax as rs

#move_mode = "G1"
#extrusion_rate = 0.12
#extrusion_start = 0
offset_z = 0.10
#speed = 500
g_code = []

initiate_gcode = """;FLAVOR:Marlin
;TIME:0
;Filament used: 6.75709m
;Layer height: 1.1
;MINX:-47.897
;MINY:-47.91
;MINZ:1.1
;MAXX:47.895
;MAXY:47.91
;MAXZ:99
;Generated with Cura_SteamEngine 4.1.0
M104 S210
M105
M109 S210
M83 ;relative extrusion mode
G28 ;Home
G1 Z15.0 F6000 ;Move the platform down 15mm
;Prime the extruder
G92 E0
G1 F200 E3
G92 E0
G92 E0
G92 E0
G1 F1500 E-6.5
;LAYER_COUNT:90
;LAYER:0
M107
M203 Z50
M205 X30 Y30
G0 F1500 X30 Y-3.573 Z1.1
M205 X20 Y20
;TYPE:SKIRT
G1 F1500
G1 X0 Y0 Z20 E100"""

# ;TIME_ELAPSED:751.629903
# G1 F1500 E510.30819   

end_gcode = """M205 X30 Y30 Z30 E-100
G0 F3000 X-43.931 Y-19.114
G0 X-40.689 Y-17.797
M205 X20 Y20
M203 Z299792458000
M107
M104 S0
M140 S0
;Retract the filament
G92 E1
G1 E-1 F300
G28 X0 Y0
M84
M83 ;absolute extrusion mode
M104 S0"""

print initiate_gcode

for line in lines:
    print line

print end_gcode
# ---------- end end_start_gcode ----------
layer_slicing = GhPythonScript(
    geometry=crv_6,
    slice_geo=move_2.Geometry,
    layer_height=Slider(1.4, range=0..10),
    extra_z=Slider(1.1, range=0..10),
    layer_count=number_slider)  # -> out, ori_crvs, crv_sets, a, b, c, d; inputs geometry: GeometryBase
# ---------- layer_slicing: Python ----------
import sys
from scriptcontext import sticky

sys.path.append(sticky["clay_printing_library"])

import brickSlicer as bs

ori_crvs = bs.slicing(geometry, layer_height = layer_height, layer_count = layer_count, extra_z = extra_z)
crv_sets, a, b, c, d = bs.splitter(ori_crvs, slicing_object = slice_geo, split_type = "object")
# ---------- end layer_slicing ----------
claylibrarypathlocation = FilePath("/Volumes/GoogleDrive/My Drive/ClayPrinting/")
number_slider_2 = Slider(5, range=0.5..12)
python_3 = GhPythonScript(x=layer_slicing.crv_sets)  # -> out, a
# ---------- python_3: Python ----------
for crv in x:
    
    print(type(crv))
    print(crv.GetLength())
# ---------- end python_3 ----------
path_assignment = GhPythonScript(x=claylibrarypathlocation)  # -> out, a
# ---------- path_assignment: Python ----------
import scriptcontext as rs

rs.sticky["clay_printing_library"] = x

print(rs.sticky["clay_printing_library"])
# ---------- end path_assignment ----------
panel_3 = Panel(layer_slicing.out)
panel_4 = Panel(path_assignment.out)
layer_structure = GhPythonScript(
    ori_crvs=layer_slicing.ori_crvs,
    crv_set=layer_slicing.crv_sets,
    spacing=number_slider_2,
    direction=Toggle(True),
    item=Toggle(False))  # -> out, layers, set_tuple, a; inputs ori_crvs: list, crv_set: list, direction: Boolean, item: Boolean
# ---------- layer_structure: Python ----------
from sys import path
from scriptcontext import sticky

path.append(sticky["clay_printing_library"])

import vertexClass as vc

if direction:
    
    dir = 1
    
else:
    
    dir = -1
    
if item:
    
    item = 0

else:
    
    item = 1

print(ori_crvs)

layers, set_tuple, _ = vc.moveSet(crv_set, ori_crvs, spacing, dir, item)

a = ori_crvs
# ---------- end layer_structure ----------
pline = PolyLine(Closed=False)
crv_7 = Curve(layer_slicing.ori_crvs)
python_4 = GhPythonScript()  # -> out, a
# ---------- python_4: Python ----------
a = [[2, 1, 1], [1, 2, 3], [0, 1, 2]]
# ---------- end python_4 ----------
crv_8 = Curve()
panel_5 = Panel(layer_structure.out)
list = ValueList({"dotMap": 0, "ellipsoidBumpMap": 1, "sinWarp": 2, "cylinderMap": 3, "layerMap": 4}, selected="sinWarp")
pattern = GhPythonScript(
    layers=layer_structure.layers,
    set_tuple=layer_structure.set_tuple,
    sub_length=Slider(2, range=0..10),
    layer_count=Slider(70, range=0..100),
    layer_height=Slider(2.3, range=0..10),
    edge_easing=Toggle(True),
    edge_ease_zero=Slider(0, range=0..100),
    edge_ease_end=Slider(21.9, range=0..100),
    pattern_type=list,
    period=Slider(20, range=0..100),
    phase_shift=Slider(0.1, range=0..2),
    spacing=Slider(40, range=0..100),
    radius=Slider(30, range=0..100),
    max_val=Slider(5, range=0..100),
    height=Slider(26.9, range=0..100),
    radius_bot=Slider(0, range=0..10),
    pattern_set=python_4.a,
    direction=Toggle(False))  # -> out, curve_list, a, b, c; inputs layers: list, set_tuple: list, layer_count: Int32, layer_height: Int32, edge_easing: Boolean, pattern_type: Int32, pattern_set: list, direction: Boolean
# ---------- pattern: Python ----------
# snippet of code to make this python component look for it's code in the parent folder of the .gh file

import os

ghComp = ghenv.Component
ghDoc = ghComp.OnPingDocument()

file_name = "patternGenv2.py"
gh_file_location = ghDoc.FilePath
parent = os.path.dirname(os.path.realpath(gh_file_location))

file_path = os.path.join(parent, file_name)

# hacky-hacky run-fun
execfile(file_path)

pattern_map = PatternMap(layers, set_tuple)
pattern_map.build()
# pattern_map.subdivide(sub_length)
# pattern_map.generate(layer_height, layer_count)

if edge_easing:

    pattern_map.edgeEasing(edge_ease_zero, edge_ease_end)

if pattern_type == 0:
    
    pattern_map.dotMap(spacing, radius, max_val, direction)

elif pattern_type == 1:

    pattern_map.ellipsoidBumpMap(spacing, radius, max_val, direction)

elif pattern_type == 2:

    pattern_map.sinWarp(period, max_val, phase_shift, direction)

elif pattern_type == 3:

    if radius_bot < .01:

        radius_bot = radius

    else:

        radius_bot = radius_bot

    pattern_map.cylinderMap(spacing, height, radius, max_val, radius_bot, direction)

elif pattern_type == 4:

    pattern_map.layerMap(spacing, pattern_set, radius, max_val, direction)


c = pattern_map.makeMesh()
b = pattern_map.makeCurves()
# ---------- end pattern ----------
re_slicer = GhPythonScript(ori_crvs=pattern.b, slice_geo=move_2.Geometry, layer_count=number_slider)  # -> out, ori_crvs, crv_sets, a, b, c, d; inputs ori_crvs: list
# ---------- re_slicer: Python ----------
# snippet of code to make this python component look for it's   code in the parent folder of the .gh file

import os

ghComp = ghenv.Component
ghDoc = ghComp.OnPingDocument()

file_name = "brickSlicer.py"
gh_file_location = ghDoc.FilePath
parent = os.path.dirname(os.path.realpath(gh_file_location))

file_path = os.path.join(parent, file_name)
print(file_path)

parent = os.path.dirname(os.path.realpath(parent))
parent = os.path.dirname(os.path.realpath(parent))
print(parent)

# hacky-hacky run-fun
execfile(file_path)

print(type(slice_geo))

crv_sets, a, b, c, d = splitter(ori_crvs, slicing_object = slice_geo, split_type = "object")
# ---------- end re_slicer ----------
crv_9 = Curve(pattern.b)
mesh_4 = Mesh(pattern.c)
number_slider_3 = Slider(1.4, range=0.5..12)
panel_6 = Panel(pattern.out)
panel_7 = Panel(re_slicer.out)
layer_structure_2 = GhPythonScript(
    ori_crvs=re_slicer.ori_crvs,
    crv_set=re_slicer.crv_sets,
    spacing=number_slider_2,
    direction=Toggle(False),
    item=Toggle(True))  # -> out, layers, set_tuple, a; inputs ori_crvs: list, crv_set: list, direction: Boolean, item: Boolean
# ---------- layer_structure_2: Python ----------
# snippet of code to make this python component look for it's   code in the parent folder of the .gh file

import os

ghComp = ghenv.Component
ghDoc = ghComp.OnPingDocument()

file_name = "vertexClass.py"
gh_file_location = ghDoc.FilePath
parent = os.path.dirname(os.path.realpath(gh_file_location))

file_path = os.path.join(parent, file_name)
print(file_path)

parent = os.path.dirname(os.path.realpath(parent))
parent = os.path.dirname(os.path.realpath(parent))
print(parent)

# hacky-hacky run-fun
execfile(file_path)

if direction:
    
    dir = 1
    
else:
    
    dir = -1
    
if item:
    
    item = 0

else:
    
    item = 1

print(ori_crvs)

layers, set_tuple, _ = moveSet(crv_set, ori_crvs, spacing, dir, item)

a = ori_crvs
# ---------- end layer_structure_2 ----------
python_5 = GhPythonScript()  # -> out, a; same code as python_4
list_2 = ValueList({"dotMap": 0, "ellipsoidBumpMap": 1, "sinWarp": 2, "cylinderMap": 3, "layerMap": 4}, selected="ellipsoidBumpMap")
python_6 = GhPythonScript()  # -> out, a
# ---------- python_6: Python ----------
import sys

sys.path.append("/Volumes/GoogleDrive/My Drive/ClayPrinting")

import brickSlicer as bs

reload(bs)


bs.slicing
# ---------- end python_6 ----------
pattern_2 = GhPythonScript(
    layers=layer_structure_2.layers,
    set_tuple=layer_structure_2.set_tuple,
    sub_length=Slider(2, range=0..10),
    layer_count=Slider(70, range=0..100),
    layer_height=Slider(2.3, range=0..10),
    edge_easing=Toggle(True),
    edge_ease_zero=Slider(0, range=0..100),
    edge_ease_end=Slider(21.9, range=0..100),
    pattern_type=list_2,
    period=Slider(27.9, range=0..100),
    phase_shift=Slider(0.1, range=0..2),
    spacing=Slider(30, range=0..100),
    radius=Slider(15, range=0..100),
    max_val=Slider(10, range=0..100),
    height=Slider(26.9, range=0..100),
    radius_bot=Slider(0, range=0..10),
    pattern_set=python_5.a,
    direction=Toggle(False))  # -> out, curve_list, a, b, c; inputs layers: list, set_tuple: list, layer_count: Int32, layer_height: Int32, edge_easing: Boolean, pattern_type: Int32, pattern_set: list, direction: Boolean
# ---------- pattern_2: Python ----------
# snippet of code to make this python component look for it's code in the parent folder of the .gh file

import os

ghComp = ghenv.Component
ghDoc = ghComp.OnPingDocument()

file_name = "patternGenv2.py"
gh_file_location = ghDoc.FilePath
parent = os.path.dirname(os.path.realpath(gh_file_location))

file_path = os.path.join(parent, file_name)

# hacky-hacky run-fun
execfile(file_path)

pattern_map = PatternMap(layers, set_tuple)
pattern_map.build()
# pattern_map.subdivide(sub_length)
# pattern_map.generate(layer_height, layer_count)

if edge_easing:

    pattern_map.edgeEasing(edge_ease_zero, edge_ease_end)

if pattern_type == 0:
    
    pattern_map.dotMap(spacing, radius, max_val, direction)

elif pattern_type == 1:

    pattern_map.ellipsoidBumpMap(spacing, radius, max_val, direction)

elif pattern_type == 2:

    pattern_map.sinWarp(period, max_val, phase_shift, direction)

elif pattern_type == 3:

    if radius_bot < .01:

        radius_bot = radius

    else:

        radius_bot = radius_bot

    pattern_map.cylinderMap(spacing, height, radius, max_val, radius_bot, direction)

elif pattern_type == 4:

    pattern_map.layerMap(spacing, pattern_set, radius, max_val, direction)


c = pattern_map.makeMesh()
b = pattern_map.makeCurves()
a = pattern_map.pts_set
# ---------- end pattern_2 ----------
re_slicer_2 = GhPythonScript(ori_crvs=pattern_2.b, slice_geo=move_2.Geometry, layer_count=number_slider)  # -> out, ori_crvs, crv_sets, a, b, c, d; inputs ori_crvs: list
# ---------- re_slicer_2: Python ----------
from sys import path
from scriptcontext import sticky

path.append(sticky["clay_printing_library"])

import brickSlicer as bs

crv_sets, a, b, c, d = bs.splitter(ori_crvs, slicing_object = slice_geo, split_type = "object")
# ---------- end re_slicer_2 ----------
crv_10 = Curve(<curve referenced from the Rhino model>)
crv_11 = Curve(re_slicer_2.ori_crvs)
crv_12 = Curve(pattern_2.b)
mesh_5 = Mesh(pattern_2.c)
list_3 = ValueList({"Inside": "inside", "Outside": "outside"}, selected="Inside")
python_7 = GhPythonScript(x=pattern_2.a)  # -> out, a; inputs x: list
# ---------- python_7: Python ----------
print(x[0])
# ---------- end python_7 ----------
python_8 = GhPythonScript(x=crv_10)  # -> out, a, x; inputs x: Curve
# ---------- python_8: Python ----------
import Rhino.Geometry as rg
from copy import deepcopy as dc

pln = rg.Plane(x.PointAt(0.0), rg.Vector3d(0,0,1))

tmp_offset_crv_1 = x.Offset(pln, 1.0, .01, rg.CurveOffsetCornerStyle.Round)[0]
tmp_offset_crv_2 = x.Offset(pln, -1.0, .01, rg.CurveOffsetCornerStyle.Round)[0]

x.Domain = rg.Interval(0,1)
a = dc(x)

if tmp_offset_crv_1.GetLength() < tmp_offset_crv_2.GetLength():
    
    print("curve needed to be reversed!")

    a.Reverse()
    
a
a.Domain = rg.Interval(0,1)
# ---------- end python_8 ----------
crv_13 = Curve(crv_12)
item = ListItem(List=crv_12, Index=0, Wrap=True)
python_9 = GhPythonScript(crv=re_slicer_2.ori_crvs, distance=Slider(1.1, range=0..10), direction=list_3, count=Slider(4, range=0..10))  # -> out, a, b; inputs count: Int32
# ---------- python_9: Python ----------
from sys import path
from scriptcontext import sticky

path.append(sticky["clay_printing_library"])

import generalFunctions as gf

reload(gf)

b = crv

a = gf.offsetCurveSet(crv, distance, direction, count)
# ---------- end python_9 ----------
number_slider_4 = Slider(300, range=0..1000)
eval = EvaluateCurve(Curve=[python_8.a, python_8.x], Parameter=Slider(0.51, range=0..1))  # -> Point, Tangent, Angle
python_10 = GhPythonScript(x=item)  # -> out, a; inputs x: Curve
# ---------- python_10: Python ----------
import Rhino.Geometry as rg
import math

def crvOrienter(crv):

    x_or_y = True
    rot_angle = 0.0
    area = 9999999

    for i in range(90):

        angle = math.pi * i / 180

        # bounding box translation
        x_vec = rg.Vector3d(math.cos(angle), math.sin(angle), 0.0)
        y_vec = rg.Vector3d(- math.sin(angle), math.cos(angle), 0.0)
        b_box = crv.GetBoundingBox(rg.Plane(rg.Point3d(0,0,0), x_vec, y_vec))

        x_delta = b_box.Max.X - b_box.Min.X
        y_delta = b_box.Max.Y - b_box.Min.Y

        loc_are = x_delta * y_delta

        if loc_are < area:

            rot_angle = angle

            area = loc_are

            if x_delta < y_delta:

                x_or_y = False

            else:

                x_or_y = True

    if x_or_y:

        x_vec = rg.Vector3d(1, 0, 0)
        y_vec = rg.Vector3d(0, 1, 0)

    else:

        x_vec = rg.Vector3d(0, 1, 0)
        y_vec = rg.Vector3d(-1, 0, 0)

    x_vec.Transform(rg.Transform.Rotation(rot_angle, rg.Point3d(0,0,0)))
    y_vec.Transform(rg.Transform.Rotation(rot_angle, rg.Point3d(0,0,0)))

    tmp_pln = rg.Plane(rg.Point3d(0,0,0), x_vec, y_vec)
    
    b_box = crv.GetBoundingBox(tmp_pln)
    
    x0, x1 = b_box.Min.X, b_box.Max.X
    y1, y0 = b_box.Max.Y, b_box.Min.Y
    
    crv = rg.Rectangle3d(tmp_pln, rg.Interval(x0,x1), rg.Interval(y0,y1))
    
    return crv
    
a = crvOrienter(x)
# ---------- end python_10 ----------
panel_8 = Panel(python_8.out)
crv_14 = Curve()
list_4 = ValueList({"detached", "crossing"}, selected="detached")
item_2 = ListItem(List=crv_11, Index=Slider(34, range=0..100), Wrap=True)
cls = Closed(Curve=python_9.a)  # -> Closed, Periodic
offset = OffsetCurve(Curve=python_10.a, Distance=Slider(20, range=0..25), Plane=PlaneXY(0, 0, 0), Corners=1)
python_11 = GhPythonScript(crvs=python_9.a, split_distance=Slider(-1.1, range=-10..10), split_type=list_4, side_bool=Toggle(True))  # -> out, a, b, c, d, e, f; inputs crvs: list, side_bool: Boolean
# ---------- python_11: Python ----------
import sys
from scriptcontext import sticky

sys.path.append(sticky["clay_printing_library"])

import layerFunctions as lf

reload(lf)

later_set = lf.LinkingLayers(crvs, split_distance, side_bool, split_type)
a, b, c, d, e = later_set.createOrganisedCurves()
f = later_set.joinCrvs()
# ---------- end python_11 ----------
panel_9 = Panel(python_7.out)
divide = DivideCurve(Curve=offset, Count=1, Kinks=True)  # -> Points, Tangents, Parameters
sift = SiftPattern(List=python_9.a, SiftPattern=cls.Closed)  # -> Output0, Output1
panel_10 = Panel(python_10.out)
clean = CleanTree(RemoveNulls=True, RemoveInvalid=True, RemoveEmpty=False, Tree=sift.Output0)
python_12 = GhPythonScript(x=divide.Points)  # -> out, a; inputs x: list
# ---------- python_12: Python ----------
a = [[pt for pt in x]]
# ---------- end python_12 ----------
merge_2 = Merge(Data1=flatten(python_12.a), Data2=flatten(pattern_2.a))
lists_to_gcode_3 = GhPythonScript(lists=merge_2, extrusion_rate=Slider(0.5, range=0..10), extra_z=Slider(1.5, range=0..10))  # -> out, lines; inputs lists: list
# ---------- lists_to_gcode_3: Python ----------
# snippet of code to make this python component look for it's code in the parent folder of the .gh file

import os

ghComp = ghenv.Component
ghDoc = ghComp.OnPingDocument()

file_name = "simpleStartStop.py"
gh_file_location = ghDoc.FilePath
parent = os.path.dirname(os.path.realpath(gh_file_location))

file_path = os.path.join(parent, file_name)
print(file_path)

parent = os.path.dirname(os.path.realpath(parent))
parent = os.path.dirname(os.path.realpath(parent))
print(parent)

# hacky-hacky run-fun
execfile(file_path)

lines = gCodeGenerator(lists, extrusion_rate, extra_z)
# ---------- end lists_to_gcode_3 ----------
crv_15 = Curve(python_11.d)
crv_16 = Curve(clean)
pt_3 = Point(python_11.a)
crv_17 = Curve(python_11.b)
end_start_gcode_2 = GhPythonScript(lines=flatten(lists_to_gcode_3.lines))  # -> out, a; inputs lines: list
# ---------- end_start_gcode_2: Python ----------
__author__ = "JesusBarney"
__version__ = "2019.04.06"

import rhinoscriptsyntax as rs

#move_mode = "G1"
#extrusion_rate = 0.12
#extrusion_start = 0
offset_z = 0.10
#speed = 500
g_code = []

initiate_gcode = """;FLAVOR:Marlin
;TIME:0
;Filament used: 6.75709m
;Layer height: 1.1
;MINX:-47.897
;MINY:-47.91
;MINZ:1.1
;MAXX:47.895
;MAXY:47.91
;MAXZ:99
;Generated with Cura_SteamEngine 4.1.0
M104 S210
M105
M109 S210
M83 ;relative extrusion mode
G28 ;Home
G1 Z15.0 F6000 ;Move the platform down 15mm
;Prime the extruder
G92 E0
G1 F200 E3
G92 E0
G92 E0
G92 E0
G1 F1500 E-6.5
;LAYER_COUNT:90
;LAYER:0
M107
M203 Z50
M205 X30 Y30
G0 F1500 X30 Y-3.573 Z20
M205 X20 Y20
;TYPE:SKIRT
G1 X0 Y0 Z20 E1"""

# ;TIME_ELAPSED:751.629903
# G1 F1500 E510.30819   

end_gcode = """M205 X30 Y30 Z30 E-1
G0 F3000 X-43.931 Y-19.114
G0 X-40.689 Y-17.797
M205 X20 Y20
M203 Z299792458000
M107
M104 S0
M140 S0
;Retract the filament
G92 E1
G1 E-1 F300
G28 X0 Y0
M84
M83 ;absolute extrusion mode
M104 S0"""

print initiate_gcode

print lines[0]
print "G1 F300"

line_count = len(lines)

for i in range(1, line_count, 1):

    print lines[i]

print end_gcode
# ---------- end end_start_gcode_2 ----------
pline_2 = PolyLine(Vertices=python_11.f, Closed=False)  # -> flatten(Polyline)
domain = Domain(crv_16)
item_3 = ListItem(List=pline_2, Index=0, Wrap=True)
eval_2 = EvaluateCurve(Curve=crv_16, Parameter=Slider(0, range=0..1))  # -> Point, Tangent, Angle
eval_3 = EvaluateCurve(Curve=crv_16, Parameter=Slider(1, range=0..1))  # -> Point, Tangent, Angle
panel_11 = Panel(python_11.out)
eval_4 = EvaluateCurve(Curve=item_3, Parameter=Slider(256, range=0..1000))  # -> Point, Tangent, Angle
panel_12 = Panel(python_9.a)
panel_13 = Panel(end_start_gcode_2.out)
crv_18 = Curve(<curve referenced from the Rhino model>)
list_5 = ValueList({"Inside": "inside", "Outside": "outside"}, selected="Inside")
offset_2 = OffsetCurve(Curve=crv_18, Distance=1, Plane=PlaneXY(0, 0, 0), Corners=1)
crv_19 = Curve(<curve referenced from the Rhino model>)
python_13 = GhPythonScript(x=offset_2)  # -> out, a; same code as ghpython_script
python_14 = GhPythonScript(crv=crv_18, distance=Slider(0.4, range=0..10), direction=list_5, count=Slider(1, range=0..10))  # -> out, a; inputs count: Int32
# ---------- python_14: Python ----------
from sys import path
from scriptcontext import sticky

path.append(sticky["clay_printing_library"])

import generalFunctions as gf

reload(gf)

a = gf.offsetCurveSet(crv, distance, direction, count)

for crv in a:
    
    gf.polylinePeriodicizer(crv)
# ---------- end python_14 ----------
python_15 = GhPythonScript(crv=crv_19, count=Slider(110, range=0..1000))  # -> out, a; inputs crv: Curve, count: Int32
# ---------- python_15: Python ----------
import Rhino.Geometry as rg

crv.Domain = rg.Interval(0, count - 1)

a = [crv.PointAt(t) for t in range(count)]
# ---------- end python_15 ----------
crv_20 = Curve(<curve referenced from the Rhino model>)
list_6 = ValueList({"start", "end", "both"}, selected="both")
eval_5 = Evaluate()
list_7 = ValueList({"start", "end", "both"}, selected="both")
panel_15 = Panel(python_14.out)
divide_2 = DivideCurve(Curve=crv_20, Count=Slider(110, range=0..1000), Kinks=False)  # -> Points, Tangents, Parameters
python_16 = GhPythonScript(pts=python_15.a, distance=Slider(10, range=0..10), location=list_6, count=Slider(1, range=0..10))  # -> out, a; inputs pts: list, count: Int32
# ---------- python_16: Python ----------
from sys import path
from scriptcontext import sticky

path.append(sticky["clay_printing_library"])

import generalFunctions as gf

reload(gf)

# print(pts)

a = gf.collapsePolylinePts(pts, distance)
# ---------- end python_16 ----------
python_17 = GhPythonScript(x=python_16.a)  # -> out, a; inputs x: list of Point3d
# ---------- python_17: Python ----------
from sys import path
from scriptcontext import sticky

path.append(sticky["clay_printing_library"])

import simpleStartStop as ss

reload(ss)

# print(pts)

gcodeset = ss.GCodeSet(x)
a = gcodeset.generateGCode()
# ---------- end python_17 ----------
pline_3 = PolyLine(Vertices=divide_2.Points, Closed=False)
python_18 = GhPythonScript(pts=divide_2.Points, distance=Slider(0, range=0..10), location=list_7, count=Slider(1, range=0..10))  # -> out, a; inputs pts: list, count: Int32
# ---------- python_18: Python ----------
from sys import path
from scriptcontext import sticky

path.append(sticky["clay_printing_library"])

import simpleStartStop as sSS

reload(sSS)

# print(pts)

a = sSS.shortenPolylineSet(pts, distance, location)
# ---------- end python_18 ----------
panel_16 = Panel(python_18.a)
pline_4 = PolyLine(Vertices=python_18.a, Closed=False)
panel_17 = Panel(python_17.a)
panel_18 = Panel(python_18.out)
len = Length(Curve=pline_3)
panel_19 = Panel(python_16.out)
len_2 = Length(Curve=pline_4)
panel_20 = Panel(python_9.out)
subtraction = Subtraction(A=len, B=len_2)
panel_22 = Panel(subtraction)
