# Grasshopper definition 210609_clean_file_scale.gh (Grasshopper 1.0.7)
# plug-ins: Axolotl Info, Pufferfish

feed_rate_in_mm_s = Slider(75, range=0..100)

# ---- group: Brick Geometry Generator
number_slider = Slider(2.5, range=0..10)
number_slider_2 = Slider(260, range=0..1000)
python = GhPythonScript(
    height_body=Slider(150, range=0..1000),
    height_pin=number_slider_2,
    start_height=Slider(2.5, range=0..10),
    layer_height=number_slider)  # -> out, flatten(body_heights), flatten(pin_only_heights)
# ---------- python: Python ----------
import scriptcontext as sc

# creating the heights

body_heights = []
pin_only_heights = []

height = start_height

height_body, height_pin = min(height_body, height_pin), max(height_body, height_pin)

print (height_body, height_pin)

while height < height_body:
    
    body_heights.append(height)
    
    height += layer_height
    
while height < height_pin:
    
    pin_only_heights.append(height)
    
    height += layer_height

try:
    sc.sticky["PrintSettings"]["height_body"]=height_body
except:
    print("had to initialize the PrintSettings dict")
    sc.sticky["PrintSettings"]={"height_body":height_body}
sc.sticky["PrintSettings"]["height_pin"]=height_pin
sc.sticky["PrintSettings"]["start_height"]=start_height
sc.sticky["PrintSettings"]["layer_height"]=layer_height
sc.sticky["PrintSettings"]["layer_body_count"]=len(body_heights)
sc.sticky["PrintSettings"]["layer_pin_count"]=len(pin_only_heights)
sc.sticky["PrintSettings"]["layer_total_count"]=len(body_heights) + len(pin_only_heights)
# ---------- end python ----------

# ---- group: Brick Geometry Generator / where should we put it ?
number_slider_3 = Slider(220, range=40..250)
number_slider_4 = Slider(350, range=100..450)
number_slider_5 = Slider(250, range=40..250)

# ----
feed_rate_in_mm_s_2 = Slider(75, range=0..100)
line_linking_spacing = Slider(2.7, range=0..10)
inter_line_spacing = Slider(2, range=0..10)
split_distance = Slider(2, range=-10..10)
path = FilePath()

# ---- group: shrinkage scaling
multiplication = Multiplication(A=1, B=feed_rate_in_mm_s)

# ----
python_2 = GhPythonScript(default_dropbox_path=Toggle(True), custom_path=path)  # -> out, path, clean_code_path; inputs default_dropbox_path: Boolean
# ---------- python_2: Python ----------
import sys

import os
import Grasshopper

path=os.path.dirname(Grasshopper.Instances.ActiveCanvas.Document.FilePath)
base_path=os.path.dirname(path)
path=os.path.join(base_path, "PatternBrickLibrary")
clean_code_path=os.path.join(base_path, "clean_code")
sys.path.append(path)
# ---------- end python_2 ----------
feedratesettings = GhPythonScript(
    feed_rate=multiplication,
    variable_feed_rate=Toggle(False),
    feed_rate_max=feed_rate_in_mm_s_2,
    feed_rate_max_start_start_ramp=Slider(25, range=0..25),
    feed_rate_max_end_start_ramp=Slider(30, range=0..100),
    feed_rate_max_start_end_ramp=Slider(135, range=0..1000),
    feed_rate_max_end_end_ramp=Slider(145, range=0..1000))  # -> flatten(out); inputs variable_feed_rate: Boolean
# ---------- feedratesettings: Python ----------
import scriptcontext as sc

try:
    sc.sticky["PrintSettings"]["feed_rate"] = feed_rate
except:
    sc.sticky["PrintSettings"]={"feed_rate":feed_rate}
sc.sticky["PrintSettings"]["feed_rate_variable"] = variable_feed_rate

if variable_feed_rate:
    
    sc.sticky["PrintSettings"]["feed_rate_max"] = feed_rate_max
    sc.sticky["PrintSettings"]["feed_rate_max_end_start_ramp"] = feed_rate_max_start_start_ramp
    sc.sticky["PrintSettings"]["feed_rate_max_end_start_ramp"] = feed_rate_max_end_start_ramp
    sc.sticky["PrintSettings"]["feed_rate_max_start_end_ramp"] = feed_rate_max_start_end_ramp
    sc.sticky["PrintSettings"]["feed_rate_max_end_end_ramp"] = feed_rate_max_end_end_ramp
    
print(True)
# ---------- end feedratesettings ----------

# ---- group: Nozzle
list = ValueList({"3.5", "5"}, selected="5")
nozzlesettings = GhPythonScript(x=feedratesettings, nozzle_diameter=list, layer_height=number_slider)  # -> flatten(out)
# ---------- nozzlesettings: Python ----------
import scriptcontext as sc

def linearInterpolation(input_x, val_s, x_s):

    val_a, val_b = val_s
    x_a, x_b = x_s

    x_a, x_b, val_a, val_b = float(x_a), float(x_b), float(val_a), float(val_b)

    distance_val = (input_x - x_a) / (x_b - x_a)

    output_val = (1 - distance_val) * val_a + distance_val * val_b

    return output_val

x_s = (2.5, 3.2)

val_s_5_spacing_cross_paths = (2.5, 2.0)
val_s_5_spacing_link = (3.4, 2.7)

val_s_3_5_spacing_cross_paths = (2.0, 1.6)
val_s_3_5_spacing_link = (2.7, 2.2)

if nozzle_diameter == 3.5:
    
    extrusion_rate = .64
    spacing_cross_paths = round(linearInterpolation(layer_height, val_s_3_5_spacing_cross_paths, x_s), 1)
    spacing_link = round(linearInterpolation(layer_height, val_s_3_5_spacing_link, x_s), 1)
    start_stop_retraction = 130
    start_reextrusion_rate = 40
    
if nozzle_diameter == 5.0:
    
    extrusion_rate = .8
    spacing_cross_paths = round(linearInterpolation(layer_height, val_s_3_5_spacing_cross_paths, x_s), 1)
    spacing_link = round(linearInterpolation(layer_height, val_s_5_spacing_link, x_s), 1)
    start_stop_retraction = 150
    start_reextrusion_rate = 50
    
# print(spacing_cross_paths, spacing_cross_paths, spacing_link)

sc.sticky["PrintSettings"]["print_extrusion_nozzle"] = nozzle_diameter   
sc.sticky["PrintSettings"]["print_extrusion_rate"] = extrusion_rate
sc.sticky["PrintSettings"]["print_spacing_cross"] = spacing_cross_paths
sc.sticky["PrintSettings"]["print_spacing_paths"] = spacing_cross_paths
sc.sticky["PrintSettings"]["print_spacing_link"] = spacing_link
sc.sticky["PrintSettings"]["print_spacing_start_stop_retraction"] = start_stop_retraction
sc.sticky["PrintSettings"]["print_spacing_start_reextrusion_rate"] = start_reextrusion_rate

print(True)
# ---------- end nozzlesettings ----------

# ----
simplebrick = GhPythonScript(save_settings=Toggle(True), brick_length=number_slider_4, brick_width=number_slider_5, pin_spacing=number_slider_3)  # -> out, poly_crv, pin_pts; inputs save_settings: Boolean
# ---------- simplebrick: Python ----------
import Rhino.Geometry as rg
import scriptcontext as sc

# creating the base shape and pins

brick_width, brick_length  = min(brick_width, brick_length), max(brick_width, brick_length)

print (brick_length, brick_width)

half_l = brick_length * .5
half_w = brick_width * .5

#     *       *
#   *            *
#     *       *

val_list = [(1,1), (1, -1), (-1, -1), (-1, 1)]

pt_list = []

for i in range(4):
    
    pt_list.append(rg.Point3d(half_l * val_list[i][0], half_w * val_list[i][1], 0.0))
    
    if i == 0:
        
        pt_list.append(rg.Point3d(half_l + half_w, 0, 0))
        
    elif i == 2:
        
        pt_list.append(rg.Point3d(- (half_l + half_w), 0, 0))

arc_set = [[0,1,2],[3,4,5]]
line_set = [[5,0],[2,3]]

poly_crv = rg.PolyCurve()
pin_pts = [rg.Point3d(-.5 * pin_spacing, 0, 0), rg.Point3d(.5 * pin_spacing, 0, 0)]

for i in range(2):
    
    pt_0, pt_1, pt_2, pt_3 = pt_list[-1 + i * 3], pt_list[0 + i * 3], pt_list[1 + i * 3], pt_list[2 + i * 3]
    
    line = rg.Line(pt_0, pt_1)
    
    poly_crv.Append(line)
    
    crv = rg.Arc(pt_1, pt_2, pt_3)
    
    poly_crv.Append(crv)
    
if save_settings:
    
    try:
        sc.sticky["PrintSettings"]["brick_width"]=brick_width
    except:
        print("had to initialize the PrintSettings dict")
        sc.sticky["PrintSettings"]={"brick_width":brick_width}
    
    sc.sticky["PrintSettings"]["brick_length"]=brick_length
    sc.sticky["PrintSettings"]["pin_spacing"]=pin_spacing
# ---------- end simplebrick ----------
shrinkage = GhPythonScript(your_clay_shrinkage=Slider(8, range=-100..100))  # -> out, scale_value
# ---------- shrinkage: Python ----------
our_clay_shrinkage = 8.7

scale_value = (100. - our_clay_shrinkage) / (100. - your_clay_shrinkage)
# ---------- end shrinkage ----------
manualnozzloverwrite = GhPythonScript(
    x=nozzlesettings,
    overwrite=Toggle(False),
    spacing_cross=split_distance,
    spacing_paths=inter_line_spacing,
    spacing_link=line_linking_spacing)  # -> out; inputs overwrite: Boolean
# ---------- manualnozzloverwrite: Python ----------
import scriptcontext as sc

if overwrite:
    
    sc.sticky["PrintSettings"]["print_spacing_cross"] = spacing_cross
    sc.sticky["PrintSettings"]["print_spacing_paths"] = spacing_paths
    sc.sticky["PrintSettings"]["print_spacing_link"] = spacing_link
    
print(True)
# ---------- end manualnozzloverwrite ----------
given_points = Point([Point(-105, 0, 0), Point(105, 0, 0)])
given_shell = Curve(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)
curve = Curve(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)
crv = Curve(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)
point = Point([Point(104.9999408, 0, 0), Point(-104.9999408, 0, 0)])
panel = Panel(nozzlesettings)

# ---- group: Reverse the direction of curve
# Explanation: Based on how the curve is directed, offsetting and/or splitting it will behave differently
flip = FlipCurve()  # -> Curve, Flag

# ----
splitting_geometry = Geometry(crv)
python_3 = GhPythonScript()  # -> out, a
# ---------- python_3: Python ----------
import scriptcontext as sc

print(sc.sticky["PrintSettings"])
# ---------- end python_3 ----------
panel_2 = Panel(python_3.out)
library_path = FilePath(python_2.path)
layer_slicing = GhPythonScript(x=library_path, geometry=given_shell, heights=python.body_heights)  # -> out, ori_crvs, crv_sets, a, b, c, d; inputs geometry: GeometryBase, heights: list
# ---------- layer_slicing: Python ----------
import sys

sys.path.append(x)

import brickSlicer as bs

reload(bs)

ori_crvs = bs.slicing(geometry, heights)
# crv_sets, a, b, c = bs.splitter(ori_crvs, slicing_object = slice_geo, split_type = "first_layer")
# ---------- end layer_slicing ----------
crv_2 = Curve(layer_slicing.ori_crvs)
random = Random(Range=Domain(0, 1000), Number=Slider(6, range=0..10), Seed=2)
panel_3 = Panel(layer_slicing.out)
item = ListItem(List=random, Index=0, Wrap=True)  # -> Item, Item1, Item2, Item3, Item4, Item5
num = Number(Slider(10, range=0..100000))
clean_code_path = FilePath(python_2.clean_code_path)
random_2 = Random(Range=Domain(0, 1000), Number=num, Seed=item.Item)
random_3 = Random(Range=Domain(0, 1000), Number=num, Seed=item.Item1)
random_4 = Random(Range=Domain(0, 1000), Number=num, Seed=item.Item2)
random_5 = Random(Range=Domain(0, 1000), Number=num, Seed=item.Item3)
random_6 = Random(Range=Domain(0, 1000), Number=num, Seed=item.Item4)
random_7 = Random(Range=Domain(0, 1000), Number=num, Seed=item.Item5)
pt = ConstructPoint(XCoordinate=random_2, YCoordinate=random_3, ZCoordinate=random_4)
pt_2 = ConstructPoint(XCoordinate=random_5, YCoordinate=random_6, ZCoordinate=random_7)
subtraction = Subtraction(A=pt_2, B=pt)
ln = Line(StartPoint=pt, EndPoint=pt_2)
dist = Distance(PointA=pt, PointB=pt_2)
python_4 = GhPythonScript(x=pt, y=pt_2)  # -> out, a; inputs x: list of Point3d, y: list of Point3d
# ---------- python_4: Python ----------
from Rhino.Geometry import Polyline, Vector3d, Point3d
import math

def interpolate(p0, p1, p2, divLength):
    # subdivide
    totalLength = p0.DistanceTo(p1) + p1.DistanceTo(p2)
    totalDivisions = int(math.ceil(totalLength / divLength))
    
    tDelta = 1. / totalDivisions
    t = 0
    
    pts = []
    
    dirA = p2 - p1
    dirB = p0 - p1
    for i in range(totalDivisions - 1):
        t += tDelta
        
        t2 = (t) ** 2.
        tmin2 = (1 - t) ** 2.
        
        pts.append(p1 + t2 * dirA + tmin2 * dirB)
            
    return pts


def loop_method(a, b, dirX, dirY, r, w):
    r0 = .5
    w0 = 1.
    mid_point = (a + b) * .5

    a
    p0 = mid_point - dirX * w0 * .5
    p1 = mid_point + dirX * w0 * .5 + dirY * r0
    p2 = mid_point + dirX * w * .5 + dirY * r0
    p3 = mid_point + dirX * w * .5 + dirY * r * .15
    p4 = mid_point + dirX * w * .5 + dirY * r
    p5 = mid_point + dirY * r
    p6 = mid_point - dirX * w * .5 + dirY * r
    p7 = mid_point - dirX * w * .5 + dirY * r * .15
    p8 = mid_point - dirX * w * .5 + dirY * r0
    p9 = mid_point - dirX * w0 * .5 + dirY * r0
    p10 = mid_point + dirX * w0 * .5
    b
    
    pts = [a, p0, p1]
    # pts.extend(interpolate(p1, p2, p3, .2))
    pts.extend([p2, p3])
    # pts.append(p3)
    pts.extend(interpolate(p3, p4, p5, 20.))
    pts.append(p5)
    pts.extend(interpolate(p5, p6, p7, 20.))
    # pts.append(p7)
    # pts.extend(interpolate(p7, p8, p9, .2))
    pts.extend([p7, p8])
    pts.extend([p9, p10, b])
    
    return pts
    

pls = []

for (a, b) in zip(x,y):
    xDir = (b-a)
    yDir = Vector3d.CrossProduct(xDir, Vector3d.CrossProduct(xDir, Vector3d.ZAxis))
    
    xDir.Unitize()
    yDir.Unitize()
    
    loc_pts = loop_method(a, b, xDir, yDir, 100, 50)
    
    pls.append(Polyline(loc_pts))
    
    
a = pls
# ---------- end python_4 ----------
python_5 = GhPythonScript()  # -> out, a
# ---------- python_5: Python ----------
from Rhino.Geometry import Vector3d

a = Vector3d(
    0,
    -0.808972580374099,
    -0.5878463780639225
)
print(a.Length)
# ---------- end python_5 ----------
Z = UnitZ(Factor=1)
series = Series(Start=0, Step=Slider(2.5, range=0..10), Count=Slider(20, range=0..100))
vec = Vector(subtraction)
library_path_2 = FilePath(library_path)

# ---- group: — Slicing for pattern —
num_2 = Number(100)
slicing_structuring = GhPythonScript(
    x=library_path_2,
    ori_crvs=layer_slicing.ori_crvs,
    spacing=Slider(2.5, range=0..10),
    end_smooth=Toggle(False),
    custom_crv_length=Toggle(False),
    crv_l=num_2,
    split=Toggle(True),
    slice_geo=splitting_geometry,
    split_item=Slider(0, range=0..1))  # -> out, split, layers, set_tuple, crv_sets, ori_crvs, slice_geo; inputs ori_crvs: list, end_smooth: Boolean, custom_crv_length: Boolean, split: Boolean, split_item: Int32
# ---------- slicing_structuring: Python ----------
# snippet of code to make this python component look for it's   code in the parent folder of the .gh file

import sys

sys.path.append(x)

import vertexClass_v1 as vc
import brickSlicer as bs
import scriptcontext as sc

reload(bs)
reload(vc)

print(type(slice_geo))

    
if custom_crv_length:
    
    crv_l = crv_l
    
    sc.sticky["PrintSettings"]["pattern_crv_l"] = crv_l
    
else:
    
    crv_l = None


if split:

    crv_sets, vis_a, vis_b, pts_crv_a_and_b = bs.splitter(ori_crvs, slicing_object = slice_geo, split_type = "first_layer")
    
    crv_set_a = [crv_set[0] for crv_set in crv_sets]
    crv_set_b = [crv_set[1] for crv_set in crv_sets]
    
    crv_sets = [crv_set_a, crv_set_b]
    
    non_pattern_part = [vc.divideCurveByLength(crv, spacing) for crv in crv_sets[(split_item + 1) % 2]]
    
    pattern_part, set_tuple, _ = vc.moveSet(crv_sets[split_item], ori_crvs, spacing, crv_l)
    layers = [pattern_part, non_pattern_part]
    
    
else:

    layers, set_tuple = vc.singleCurve(ori_crvs, spacing, end_smooth, crv_l)
    
sc.sticky["PrintSettings"]["pattern_spacing"] = spacing
sc.sticky["PrintSettings"]["pattern_end_smooth"] = end_smooth
# ---------- end slicing_structuring ----------

# ----
item_2 = ListItem(List=slicing_structuring.set_tuple, Index=0, Wrap=True)  # -> Item, Item1, Item2
pt_3 = Point([Point(30.34420882, -43.83674715, 0), Point(34.13854848, -44.19161345, 0), Point(33.01935476, -32.56291781, 0), Point(35.06666033, -24.18261367, 0), Point(44.07480485, -19.18718808, 0), Point(49.86185526, -20.16989475, 0), Point(49.69807081, -28.76857815, 0), Point(43.28318003, -42.38998455, 0), Point(48.98833822, -43.6729627, 0), Point(57.09566828, -37.06699006, 0), Point(56.27674605, -28.14073777, 0), Point(58.02378013, -20.38827401, 0)])
pt_4 = Point([Point(31.66403742, -40.87957673, 0), Point(35.16395518, -36.37006731, 0), Point(39.23597488, -33.71147594, 0), Point(44.65411679, -32.36535372, 0), Point(49.7020751, -32.39900678, 0), Point(54.17793146, -33.87974121, 0)])
crv_l = Number(item_2.Item)

# ---- group: general pattern settings
pt_5 = ConstructPoint(XCoordinate=Slider(24, range=0..100), YCoordinate=Slider(0, range=0..100), ZCoordinate=0)
pt_6 = Point(pt_5)
pyramidpattern = GhPythonScript(lib_path=clean_code_path, zero_end=Slider(0, range=0..100), ramp_end=Slider(49.292, range=0..100), length=crv_l)  # -> out, edge_easing
# ---------- pyramidpattern: Python ----------
import sys

sys.path.append(lib_path)

import patterns as pt
reload(pt)

edge_easing = pt.EdgeEasing(
    min(zero_end, ramp_end),
    max(zero_end, ramp_end),
    length
)
# ---------- end pyramidpattern ----------
inout = GhPythonScript(lib_path=clean_code_path, percentage=Slider(47.629, range=0..100), seed=Slider(1000, range=0..1000), length=crv_l)  # -> out, in_out; inputs seed: Int32
# ---------- inout: Python ----------
import sys

sys.path.append(lib_path)

import patterns as pt
reload(pt)

in_out = pt.InOut(
    percentage * .01,
    seed
)
# ---------- end inout ----------
dotmap = GhPythonScript(
    lib_path=clean_code_path,
    x_spacing=Slider(90, range=0..100),
    y_spacing=Slider(50, range=0..100),
    half_spacing=Toggle(True),
    b_pt=pt_6,
    with_in_out=Toggle(True),
    in_out_class=inout.in_out,
    direction=Toggle(True))  # -> out, dot_map; inputs half_spacing: Boolean, b_pt: Point3d, with_in_out: Boolean, direction: Boolean
# ---------- dotmap: Python ----------
import sys

sys.path.append(lib_path)

import patterns as pt
reload(pt)

dot_map = pt.DotMap(
    x_spacing = y_spacing,
    y_spacing = y_spacing,
    half_spacing = half_spacing,
    b_pt = b_pt,
    in_out_class = in_out_class if with_in_out else None,
    direction = direction
)
# ---------- end dotmap ----------

# ----
div_l = Number(item_2.Item1)
lay_h = Number(item_2.Item2)
divide = DivideCurve(Count=10, Kinks=False)  # -> Points, Tangents, Parameters
Z_2 = UnitZ(Factor=series)
X = UnitX(Factor=Slider(100, range=0..100))
python_6 = GhPythonScript()  # -> out, a
# ---------- python_6: Python ----------
from Rhino.Geometry import Point3d

data = [
    {
        "elements": [
            4.629,
            -1.5899999999999999,
            3.8489467315649546
        ]
    },
    {
        "elements": [
            4.629,
            -1.9128021593075806,
            3.614379967766331
        ]
    },
    {
        "elements": [
            4.629,
            -2.168510492640914,
            3.428567467766331
        ]
    },
    {
        "elements": [
            4.629,
            -2.424218825974247,
            3.242754967766331
        ]
    },
    {
        "elements": [
            4.629,
            -2.67992715930758,
            3.0569424677663313
        ]
    },
    {
        "elements": [
            4.629,
            -2.9356354926409134,
            2.8711299677663313
        ]
    },
    {
        "elements": [
            4.629,
            -3.1913438259742466,
            2.685317467766331
        ]
    },
    {
        "elements": [
            4.629,
            -3.44705215930758,
            2.499504967766331
        ]
    },
    {
        "elements": [
            4.628999999999999,
            -3.7027604926409126,
            2.313692467766331
        ]
    },
    {
        "elements": [
            4.628999999999999,
            -3.958468825974246,
            2.127879967766331
        ]
    },
    {
        "elements": [
            4.628999999999999,
            -4.21417715930758,
            1.9420674677663312
        ]
    },
    {
        "elements": [
            4.628999999999999,
            -4.4698854926409135,
            1.756254967766331
        ]
    },
    {
        "elements": [
            4.628999999999999,
            -4.725593825974247,
            1.570442467766331
        ]
    },
    {
        "elements": [
            4.628999999999999,
            -4.981302159307581,
            1.3846299677663307
        ]
    },
    {
        "elements": [
            4.628999999999999,
            -5.2370104926409144,
            1.1988174677663308
        ]
    },
    {
        "elements": [
            4.628999999999999,
            -5.575625000000001,
            0.9527605351334735
        ]
    }
]

a = [Point3d(entry["elements"][0], entry["elements"][1], entry["elements"][2]) for entry in data]
# ---------- end python_6 ----------
xprod = CrossProduct(VectorA=vec, VectorB=Z, Unitize=False)  # -> Vector, Length
pt_7 = ConstructPoint(XCoordinate=Slider(0, range=0..100), YCoordinate=Slider(0, range=0..100), ZCoordinate=0)
pt_8 = ConstructPoint(XCoordinate=Slider(0, range=0..100), YCoordinate=Slider(0, range=0..100), ZCoordinate=0)
xprod_2 = CrossProduct(VectorA=xprod.Vector, VectorB=vec, Unitize=False)  # -> Vector, Length
python_7 = GhPythonScript(
    pts=pt_3,
    r=Slider(20, range=0..100),
    w=Slider(20, range=0..100),
    r0=Slider(5, range=0..100),
    w0=Slider(10, range=0..100))  # -> out, a, b, c; inputs pts: list of Vector3d
# ---------- python_7: Python ----------
import math

def getValue(p, x):
    return p[1] + 0.5 * x*(p[2] - p[0] + x*(2.0*p[0] - 5.0*p[1] + 4.0*p[2] - p[3] + x*(3.0*(p[1] - p[2]) + p[3] - p[0])))


def cubicInterpolate(pts, steps = 25):
    if (len(pts) < 4):
        raise Exception('not enough vertices given')
    
    new_pts = []
    
    step_multiplier = 1. / steps;
    
    for i in range(1, len(pts) - 1, 1):
        if (i > 1 and i < len(pts) - 2):
            loc_pts = [pts[i-2], pts[i-1], pts[i], pts[i+1]]
            for i in range(steps):
                new_pts.append(getValue(loc_pts, step_multiplier * i))
        elif (i == 1):
            loc_pts = [pts[0]] + pts[:3]
            for i in range(steps):
                new_pts.append(getValue(loc_pts, step_multiplier * i))
        elif (i == len(pts) - 2):
            loc_pts = pts[-3:] + [pts[-1]]
            for i in range(steps):
                new_pts.append(getValue(loc_pts, step_multiplier * i))
        else:
            print(i, len(pts))
            
                
    return new_pts

def cubicInerpolateAtT(pts, t):
    if (len(pts) < 4):
        raise Exception('not enough vertices given')
    
    i = int(math.floor(t))
    
    if (i > 1 and i < len(pts) - 2):
        loc_pts = [pts[i-2], pts[i-1], pts[i], pts[i+1]]
        return getValue(loc_pts, t - i)
    elif (i == 1):
        loc_pts = [pts[0]] + pts[:3]
        return getValue(loc_pts, t - i )
    elif (i == len(pts) - 2):
        loc_pts = pts[-3:] + [pts[-1]]
        return getValue(loc_pts, t - i )
    else:
        print(i, len(pts))
    

def cubicInterpolateTangentAtT(pts, t):
    p_prev = cubicInterpolateTangentAtT(pts, t - 0.000001)
    p_next = cubicInterpolateTangentAtT(pts, t + 0.000001)
    
    return (p_prev - p_next).ToUnit()


a = cubicInterpolate(pts)
b = [cubicInerpolateAtT(pts, t * .1) for t in range(100)]
c = [cubicInerpolateAtT(pts, t * .1) for t in range(100)]
# ---------- end python_7 ----------
intcrv = Interpolate(Vertices=pt_4, Degree=3, Periodic=False, KnotStyle=1)  # -> Curve, Length, Domain
intcrv_2 = Interpolate(Vertices=pt_3, Degree=2, Periodic=False, KnotStyle=1)  # -> Curve, Length, Domain
move = Move(Geometry=Z_2, Motion=X)  # -> Geometry, Transform

# ---- group: pattern settings
python_8 = GhPythonScript()  # -> out, a
# ---------- python_8: Python ----------
a = [[2, 1, 1], [1, 2, 3], [0, 1, 2]]
# ---------- end python_8 ----------

# ----
unit = UnitVector(Vector=xprod_2.Vector)

rad = Radians(Degrees=Slider(30, range=0..1000))
pt_9 = Point(pt_8)
sinwave = GhPythonScript(
    lib_path=clean_code_path,
    period=Slider(50, range=0..100),
    amplitude=Slider(15, range=0..100),
    dir_angle=rad,
    b_pt=pt_9,
    edge_easing=pyramidpattern.edge_easing)  # -> out, sin_wave; inputs b_pt: Point3d
# ---------- sinwave: Python ----------
import sys

sys.path.append(lib_path)

import patterns as pt
reload(pt)

sin_wave = pt.SinWave(
    period, 
    amplitude, 
    dir_angle,
    b_pt,
    edge_easing
)
# ---------- end sinwave ----------

python_9 = GhPythonScript()  # -> Out, A
rebcrv = RebuildCurve(Curve=intcrv.Curve, Domain=Domain(0, 1), EndTangents=False)
multiplication_2 = Multiplication(A=unit, B=Slider(0, range=0..100))
pline = PolyLine(Vertices=python_7.a, Closed=False)

ellipsoidpattern = GhPythonScript(
    lib_path=clean_code_path,
    radius=Slider(10, range=0..100),
    amplitude=Slider(10, range=0..100),
    y_scale=Slider(2, range=0.01..10),
    dot_map=dotmap.dot_map,
    edge_easing=pyramidpattern.edge_easing)  # -> out, ellipsoid_pattern
# ---------- ellipsoidpattern: Python ----------
import sys

sys.path.append(lib_path)

import patterns as pt
reload(pt)

ellipsoid_pattern = pt.EllipsoidPattern(
    radius,
    amplitude,
    y_scale,
    dot_map,
    edge_easing
)
# ---------- end ellipsoidpattern ----------

pline_2 = PolyLine(Vertices=python_7.b, Closed=False)
python_10 = GhPythonScript(x=move.Geometry, y=Z_2)  # -> out, a; inputs x: list of Point3d, y: list of Point3d
# ---------- python_10: Python ----------
from Rhino.Geometry import Polyline, Vector3d, Point3d
import math

def interpolate(p0, p1, p2, divLength):
    # subdivide
    totalLength = p0.DistanceTo(p1) + p1.DistanceTo(p2)
    totalDivisions = int(math.ceil(totalLength / divLength))
    
    tDelta = 1. / totalDivisions
    t = 0
    
    pts = []
    
    dirA = p2 - p1
    dirB = p0 - p1
    for i in range(totalDivisions - 1):
        t += tDelta
        
        t2 = (t) ** 2.
        tmin2 = (1 - t) ** 2.
        
        pts.append(p1 + t2 * dirA + tmin2 * dirB)
            
    return pts


def loop_method(a, b, dirX, dirY, r, w):
    r0 = 5
    w0 = 10.
    
    mid_point = (a + b) * .5
    
    if (w0 >= w):
            w0 = w
    
    if r > r0:
        
        

        a
        p0 = mid_point - dirX * w0 * .5
        p1 = mid_point + dirX * w0 * .5 - dirY * r0
        p2 = mid_point + dirX * w * .5 - dirY * r0
        p3 = mid_point + dirX * w * .5 + dirY * r * .15
        p4 = mid_point + dirX * w * .5 + dirY * r
        p5 = mid_point + dirY * r
        p6 = mid_point - dirX * w * .5 + dirY * r
        p7 = mid_point - dirX * w * .5 + dirY * r * .15
        p8 = mid_point - dirX * w * .5 - dirY * r0
        p9 = mid_point - dirX * w0 * .5 - dirY * r0
        p10 = mid_point + dirX * w0 * .5
        b
        
        pts = [a, p0, p1]
        # pts.extend(interpolate(p1, p2, p3, .2))
        pts.extend([p2, p3])
        # pts.append(p3)
        pts.extend(interpolate(p3, p4, p5, 2.))
        pts.append(p5)
        pts.extend(interpolate(p5, p6, p7, 2.))
        # pts.append(p7)
        # pts.extend(interpolate(p7, p8, p9, .2))
        pts.extend([p7, p8])
        pts.extend([p9, p10, b])
    else:
        if (r0 >= r):
            r0 = r0 - r
            
        pts = [
            a,
            mid_point - dirX * w0 * .5,
            mid_point + dirX * w0 * .5 - dirY * r,
            mid_point - dirX * w0 * .5 + dirY * r,
            mid_point + dirX * w0 * .5 + dirY * r,
            mid_point - dirX * w0 * .5 - dirY * r,
            mid_point + dirX * w0 * .5,
            b
        ]
        
    
    return pts
    

pls = []

for i, (a, b) in enumerate(zip(x,y)):
    xDir = (b-a)
    yDir = Vector3d.CrossProduct(xDir, Vector3d.ZAxis)
    
    xDir.Unitize()
    yDir.Unitize()
    
    loc_pts = loop_method(a, b, xDir, yDir, i * .75 + 1, 1.5 * i + 1)
    
    pls.append(Polyline(loc_pts))
    
    
a = pls
# ---------- end python_10 ----------

cylinderpattern = GhPythonScript(
    lib_path=clean_code_path,
    radius_a=Slider(10, range=0..100),
    radius_b=Slider(20, range=0..100),
    height=Slider(30, range=0..100),
    amplitude=Slider(10, range=0..100),
    dot_map=dotmap.dot_map,
    edge_easing=pyramidpattern.edge_easing)  # -> out, cylinder_pattern
# ---------- cylinderpattern: Python ----------
import sys

sys.path.append(lib_path)

import patterns as pt
reload(pt)

cylinder_pattern = pt.CylinderPattern(
    radius_a,
    radius_b,
    height,
    amplitude,
    dot_map,
    edge_easing
)
# ---------- end cylinderpattern ----------

pyramidpattern_2 = GhPythonScript(
    lib_path=clean_code_path,
    radius=Slider(10, range=0..100),
    amplitude=Slider(10, range=0..100),
    y_scale=Slider(1, range=0.01..10),
    dot_map=dotmap.dot_map,
    edge_easing=pyramidpattern.edge_easing)  # -> out, pyramid_pattern
# ---------- pyramidpattern_2: Python ----------
import sys

sys.path.append(lib_path)

import patterns as pt
reload(pt)

pyramid_pattern = pt.PyramidPattern(
    radius,
    amplitude,
    y_scale,
    dot_map,
    edge_easing
)
# ---------- end pyramidpattern_2 ----------

pline_3 = PolyLine(Vertices=python_7.c, Closed=False)

layermap = GhPythonScript(
    lib_path=clean_code_path,
    spacing=Slider(50, range=0..100),
    pattern_set=python_8.a,
    radius=Slider(20, range=0..100),
    amplitude=Slider(20, range=0..100),
    length=crv_l,
    layer_spacing=lay_h,
    direction=Toggle(False),
    periodic=Toggle(False),
    b_pt=pt_7,
    edge_easing=pyramidpattern.edge_easing)  # -> out, layer_map; inputs pattern_set: list, direction: Boolean, b_pt: Point3d
# ---------- layermap: Python ----------
import sys

sys.path.append(lib_path)

import patterns as pt
reload(pt)

layer_map = pt.LayerMap(
    spacing,
    pattern_set,
    length,
    layer_spacing,
    radius,
    amplitude,
    direction,
    periodic,
    b_pt,
    edge_easing
)
# ---------- end layermap ----------

tpms = TPMS(Wavelength=Slider(98, range=0..100))
move_2 = Move(Geometry=ln, Motion=multiplication_2)  # -> Geometry, Transform
panel_4 = Panel(python_6.a)
add = Add(DistanceObject=tpms, Addend=Slider(2, range=0..10))
toggle = BooleanToggle(True)
toggle_2 = BooleanToggle(True)
eval = EvaluateCurve(Curve=rebcrv, Parameter=0.5)  # -> Point, Tangent, Angle
tpms_distance_object_modifier = TPMSD(Wavelength=Slider(25, range=0..100), Modulator=add)

number_slider_6 = Slider(6, range=0..100)
pt_10 = Point(pt_8)
axolotlflat = GhPythonScript(
    lib_path=clean_code_path,
    sdf=tpms_distance_object_modifier,
    amplitude=number_slider_6,
    direction=toggle_2,
    b_pt=pt_10,
    edge_easing=pyramidpattern.edge_easing)  # -> out, axolotl_flat; inputs direction: Boolean, b_pt: Point3d
# ---------- axolotlflat: Python ----------
import sys

sys.path.append(lib_path)

import patterns as pt
reload(pt)

axolotl_flat = pt.AxolotlFlat(
    sdf, 
    amplitude, 
    direction,
    b_pt,
    edge_easing
)
# ---------- end axolotlflat ----------

number_slider_7 = Slider(6, range=0..100)
pt_11 = Point(pt_8)
axolotlspatial = GhPythonScript(
    lib_path=clean_code_path,
    sdf=tpms_distance_object_modifier,
    amplitude=number_slider_6,
    direction=toggle_2,
    b_pt=pt_11,
    edge_easing=pyramidpattern.edge_easing)  # -> out, axolotl_spatial; inputs direction: Boolean, b_pt: Point3d
# ---------- axolotlspatial: Python ----------
import sys

sys.path.append(lib_path)

import patterns as pt
reload(pt)

axolotl_spatial = pt.AxolotlSpatial(
    sdf, 
    amplitude, 
    direction,
    b_pt,
    edge_easing
)
# ---------- end axolotlspatial ----------

# ---- group: connect patterns here!
python_11 = GhPythonScript(x=slicing_structuring.layers, pattern=cylinderpattern.cylinder_pattern)  # -> out, crvs; inputs x: list
# ---------- python_11: Python ----------
import Rhino.Geometry as rg

a_list, b_list = x

crvs = []

for i, vs in enumerate(a_list):
    
    pts = []
    
    for v in vs:
        pts.append(pattern.apply(v))
    
    pts.extend(b_list[i])
    
    crvs.append(rg.Polyline(pts + [pts[0]]))
# ---------- end python_11 ----------
crv_3 = Curve(python_11.crvs)

# ----
nozzlesettings_2 = GhPythonScript(x=flatten(manualnozzloverwrite))  # -> out, extrusion_rate, spacing_cross, spacing_paths, spacing_link, start_stop_retraction, start_reextrusion_rate
# ---------- nozzlesettings_2: Python ----------
import scriptcontext as sc

extrusion_rate = sc.sticky["PrintSettings"]["print_extrusion_rate"]
spacing_cross = sc.sticky["PrintSettings"]["print_spacing_cross"]
spacing_paths = sc.sticky["PrintSettings"]["print_spacing_paths"]
spacing_link = sc.sticky["PrintSettings"]["print_spacing_link"]
start_stop_retraction = sc.sticky["PrintSettings"]["print_spacing_start_stop_retraction"]
start_reextrusion_rate = sc.sticky["PrintSettings"]["print_spacing_start_reextrusion_rate"]

print(True)
# ---------- end nozzlesettings_2 ----------
panel_5 = Panel(python_11.out)
path_mapper = PathMapper(crv_3, source="{A;B;C;D}", target="{A;B;C}")

spacing_inter_paths = Number(nozzlesettings_2.spacing_paths)
spacing_link_exterior = Number(nozzlesettings_2.spacing_link)
spacing_cross = Number(nozzlesettings_2.spacing_cross)

line = Line(Line((-27.46198946, 138.4851678, 0), (-0.1413537679, -0.6893088134, 0)))

# ---- group: — Shell Setup —
list_2 = ValueList({"detached", "crossing"}, selected="detached")
list_3 = ValueList({"Inside": "inside", "Outside": "outside"}, selected="Outside")
# amount of layers per shell
# 
# Outside/Inside : which layer would be printed first or last
# 
# Split line = location of the seam
# 
# Side Bool = external or left or right.?
toggle_3 = BooleanToggle(True)
python_12 = GhPythonScript(
    x=library_path_2,
    crvs=path_mapper,
    shell_spacing=spacing_inter_paths,
    direction=list_3,
    count=Slider(1, range=0..10),
    split_distance=spacing_cross,
    split_type=list_2,
    split_line=line,
    side_bool=toggle_3)  # -> out, a, b, link_inner_crvs, main_inner_crvs, outer_crvs, pt_sets; inputs crvs: list of Curve, count: Int32, side_bool: Boolean
# ---------- python_12: Python ----------
import sys
import Rhino.Geometry as rg

sys.path.append(x)

# print(sys.path)

import generalFunctions as gf
import layerFunctions as lf
import scriptcontext as sc

sc.sticky["PrintSettings"]["shell_count"] = count
sc.sticky["PrintSettings"]["shell_direction"] = direction
sc.sticky["PrintSettings"]["shell_spacing"] = shell_spacing
sc.sticky["PrintSettings"]["shell_split_distance"] = split_distance
sc.sticky["PrintSettings"]["shell_split_type"] = split_type


reload(gf)
reload(lf)

o_crv_sets = []
outer_crvs = []

if count > 1:

    for crv_i, crv in enumerate(crvs):
        
        print(crv_i)
    
        o_crv_set = gf.offsetCurveSet(crv, shell_spacing, direction, count)
        layer_set = lf.LinkingLayers(o_crv_set, split_distance, side_bool, split_type, split_line)
        layer_set.createOrganisedCurves()
        pt_set = layer_set.joinCrvs()
    
        pt_set = pt_set[1:-1] + [pt_set[1]]
    
        crv = rg.Polyline(pt_set).ToPolylineCurve()
    
        o_crv_sets.append(o_crv_set)
        outer_crvs.append(crv)
        
else:
    
    outer_crvs = crvs

o_type = rg.CurveOffsetCornerStyle.Sharp

main_inner_crvs = []
link_inner_crvs = []

if count == 1:
    
    for crv in crvs:
        
        print(crv)
    
        main_inner_crv = crv
        
        pln = rg.Plane(main_inner_crv.PointAt(0.0), rg.Vector3d(0,0,1))
        
        sim = rg.CurveSimplifyOptions.All
        main_inner_crv = main_inner_crv.Simplify(sim, 10., 1.)
        
        try:
            link_inner_crv = main_inner_crv.Offset(pln, -shell_spacing, .01, o_type)[0]
        except:
            print("I Failed :/")
            print(main_inner_crv)
        
        main_inner_crvs.append(main_inner_crv)
        link_inner_crvs.append(link_inner_crv)

elif direction == "outside":
    
    for o_crv_set in o_crv_sets:
    
        main_inner_crv = rg.Polyline(o_crv_set[0]).ToPolylineCurve()
        
        pln = rg.Plane(main_inner_crv.PointAt(0.0), rg.Vector3d(0,0,1))
        
        link_inner_crv = main_inner_crv.Offset(pln, -shell_spacing, .01, o_type)[0]
        
        main_inner_crvs.append(main_inner_crv)
        link_inner_crvs.append(link_inner_crv)
    
else:
    
    for o_crv_set in o_crv_sets:
    
        main_inner_crv = rg.Polyline(o_crv_set[0]).ToPolylineCurve()
        
        pln = rg.Plane(main_inner_crv.PointAt(0.0), rg.Vector3d(0,0,1))
        
        link_inner_crv = main_inner_crv.Offset(pln, -shell_spacing, .01, o_type)[0]
        
        main_inner_crvs.append(main_inner_crv)
        link_inner_crvs.append(link_inner_crv)
# ---------- end python_12 ----------

# ----
pt_12 = Point(given_points)
pin_only_heights = Number(python.pin_only_heights)
library_path_3 = FilePath(library_path_2)

# ---- group: — PIN Setup —
python_13 = GhPythonScript(
    x=library_path_3,
    pin_pts=flatten(pt_12),
    connection_count=Slider(3, range=1..4),
    max_main_line=Slider(100, range=25..250),
    start_end_alfa=Slider(1.571, range=0..3.142),
    mid_alfa=Slider(0.5, range=0..3.142),
    pin_height=Slider(260, range=0..1000),
    bot_rad=Slider(35, range=0..100),
    top_rad=Slider(18, range=0..100),
    resolution=Slider(16, range=0..100),
    spacing=spacing_link_exterior)  # -> out, main_links, side_links, split_lines, pin_pt_sets, pins, mid_links, link_line_vis, pin_geo, extra_pts; inputs pin_pts: list of Point3d, connection_count: Int32, resolution: Int32
# ---------- python_13: Python ----------
import sys

sys.path.append(x)

import pinLinkingBis as pl

reload(pl)

main_links, link_lines, split_lines, pin_pt_sets, mid_links, b_mid_pts = pl.createLinks(
    pin_pts = pin_pts,
    connection_count = connection_count,
    max_main_line = max_main_line,
    start_end_alfa = start_end_alfa,
    mid_alfa = mid_alfa
)

link_line_vis = link_lines

main_links = pl.linkSetGeneration(main_links, spacing)
side_links = pl.linkSetGeneration(link_lines, spacing, 2)
mid_links = pl.linkSetGeneration(mid_links, spacing, 2)

extra_pts = []

for i, b_pt_set in enumerate(b_mid_pts):
    
    extra_pts.extend(pl.linkClosestPoints(main_links[i], b_pt_set))

pins = pl.pinMaker(pin_pts, pin_height, bot_rad, top_rad, resolution)

pin_geo = []

for pin in pins:
    
    pin_geo.append(pin.createGeometry())
# ---------- end python_13 ----------

# ----
panel_6 = Panel(python_12.out)
end_link_curve = Curve(graft(python_12.main_inner_crvs))
side_link_curve = Curve(graft(python_12.link_inner_crvs))
mesh = Mesh(python_13.pin_geo)

# ---- group: visualization
loft = Loft(Curves=python_11.crvs, Options={Adjust=False, Closed=False, LoftEnds=0, LoftSimp=0, LoftType=0, Rebuild=10, Refit=0.01})
col = Colour(RGB(230, 136, 37))
merge = Merge(Data1=loft, Data2=mesh)  # -> flatten(Result)
gate = StreamGate(Stream=merge, Gate=Toggle(True))  # -> Target0, Target1
preview = CustomPreview(Geometry=gate.Target1, Material=col)

# ----
panel_7 = Panel(python_13.out)

# ---- group: Main Link connection / Offset Pins Layers
number_slider_8 = Slider(3, range=0..10)
number_slider_9 = Slider(3, range=0..10)

# ----
python_14 = GhPythonScript(pin=python_13.pins, pin_heights=pin_only_heights)  # -> out, slices; inputs pin_heights: list
# ---------- python_14: Python ----------
slices = []

for h in pin_heights:
    
    slices.append(pin.createSlice(h))
# ---------- end python_14 ----------

# ---- group: Main Link connection
python_15 = GhPythonScript(x=flatten(end_link_curve))  # -> out, flatten(heights), flatten(index); inputs x: list of Curve
# ---------- python_15: Python ----------
heights = []
index = []

for crv_i, crv in enumerate(x):
    
    heights.append(crv.PointAt(0.0).Z)
    index.append(crv_i)
# ---------- end python_15 ----------
python_16 = GhPythonScript(
    x=library_path_3,
    main_links=flatten(python_13.main_links),
    pins=flatten(python_13.pins),
    link_set=flatten(python_13.side_links),
    heights=flatten(python_15.heights),
    count=flatten(python_15.index),
    bottom_shift_count=number_slider_8,
    bottom_max_shift=number_slider_9)  # -> out, graft(main_crv), b, c, inner_crvs, main_crv_pt_set, main_links; inputs main_links: list, pins: list, link_set: list
# ---------- python_16: Python ----------
import sys

sys.path.append(x)

import pinLinkingBis as pl

reload(pl)

if count < bottom_shift_count:
    
    print("I am shifting the bottom layer with: ")
    
    count_delta = bottom_max_shift / float(bottom_shift_count)
    
    bottom_offset = count_delta * (bottom_shift_count - count)
    print("bottom offset: %s" % bottom_offset)
    
else:
    
    bottom_offset = None

main_crv, b, main_links, inner_crvs = pl.makeMainShape(pins, main_links, heights, bottom_offset)
# ---------- end python_16 ----------

# ---- group: Interconnections - code
python_17 = GhPythonScript(side_links=python_13.side_links, end_link_index=Slider(1, range=0..100))  # -> out, flatten(side_links), flatten(end_link), end_link_vis; inputs side_links: list, end_link_index: Int32
# ---------- python_17: Python ----------
import Rhino.Geometry as rg
from copy import deepcopy as dc

side_link_count = len(side_links)

end_link_index = end_link_index % side_link_count

end_link = side_links.pop(end_link_index)

# visualisation of the end link

end_link_vis = dc(end_link.lines)

for end_link_line in end_link_vis:
    
    sc_m = rg.Transform.Scale(end_link_line.From, 100.0)
    
    end_link_line.Transform(sc_m)
# ---------- end python_17 ----------
path_mapper_2 = PathMapper(end_link_curve, source="{A;B;C;D;E}", target="{E}")
path_mapper_3 = PathMapper(python_16.main_crv, source="{A;B}", target="{B}")
path_mapper_4 = PathMapper(side_link_curve, source="{A;B;C;D;E}", target="{E}")
python_18 = GhPythonScript(x=library_path_3, end_link=flatten(python_17.end_link), interior_crv=path_mapper_3, exterior_crv=path_mapper_2)  # -> out, graft(output_end_link), side_link_lines; inputs interior_crv: Curve, exterior_crv: Curve
# ---------- python_18: Python ----------
import Rhino.Geometry as rg
from copy import deepcopy as dc

import sys

sys.path.append(x)

height_val = interior_crv.PointAt(0.0).Z

mv_m = rg.Transform.Translation(rg.Vector3d(0,0,height_val))
    
output_end_link = dc(end_link)
output_end_link.Transform(mv_m)
    
output_end_link.trimLines(exterior_crv, True)
output_end_link.trimLines(interior_crv, False)

side_link_lines = dc(output_end_link.lines)
# ---------- end python_18 ----------
python_19 = GhPythonScript(x=library_path_3, side_links=flatten(python_17.side_links), interior_crv=path_mapper_3, exterior_crv=path_mapper_4)  # -> out, output_side_links, side_link_lines; inputs side_links: list, interior_crv: Curve, exterior_crv: Curve
# ---------- python_19: Python ----------
import Rhino.Geometry as rg
from copy import deepcopy as dc

import sys

sys.path.append(x)

height_val = interior_crv.PointAt(0.0).Z

mv_m = rg.Transform.Translation(rg.Vector3d(0,0,height_val))

side_link_lines = []

print(type(exterior_crv))

output_side_links = []

for side_link in side_links:
    
    loc_link = dc(side_link)
    loc_link.Transform(mv_m)
    
    loc_link.trimLines(exterior_crv, True)
    loc_link.trimLines(interior_crv, False)
    
    output_side_links.append(loc_link)
    
    side_link_lines.extend(loc_link.lines)
    
print(side_link_lines[0].To.Z)
# ---------- end python_19 ----------
midlinks = GhPythonScript(x=library_path_3, mid_links=flatten(python_13.mid_links), interior_crv=path_mapper_3, exterior_crv=path_mapper_4)  # -> out, output_mid_links, mid_link_lines; inputs mid_links: list, interior_crv: Curve, exterior_crv: Curve
# ---------- midlinks: Python ----------
import Rhino.Geometry as rg
from copy import deepcopy as dc

import sys

sys.path.append(x)

height_val = interior_crv.PointAt(0.0).Z

mv_m = rg.Transform.Translation(rg.Vector3d(0,0,height_val))

mid_link_lines = []

print(type(exterior_crv))

output_mid_links = []

for mid_link in mid_links:
    
    loc_link = dc(mid_link)
    loc_link.Transform(mv_m)
    
    loc_link.trimLines(exterior_crv, True)
    loc_link.trimLines(interior_crv, False)
    
    output_mid_links.append(loc_link)
    
    mid_link_lines.extend(loc_link.lines)
    
print(mid_link_lines[0].To.Z)
# ---------- end midlinks ----------

# ----
item_3 = ListItem(List=pin_only_heights, Index=0, Wrap=True)  # -> Item1, Item
crv_4 = Curve(python_14.slices)
panel_8 = Panel(path_mapper_2)
panel_9 = Panel(midlinks.out)
path_mapper_5 = PathMapper(crv_4, source="{A;B;C}", target="{C}")
panel_10 = Panel(python_19.out)
panel_11 = Panel(path_mapper_5)
library_path_4 = FilePath(library_path_3)

# ---- group: Interior Curves
line_2 = Line(flatten(python_13.split_lines))
crv_5 = Curve(python_16.inner_crvs)
layer_count = Slider(1, range=0..10)
path_mapper_6 = PathMapper(python_16.main_links, source="{C;D}", target="{D}")
path_mapper_7 = PathMapper(python_18.output_end_link, source="{D;E}", target="{D}")
path_mapper_8 = PathMapper(midlinks.output_mid_links, source="{D;E}", target="{D}")
list_4 = ValueList({"detached", "crossing"}, selected="crossing")
list_5 = ValueList({"Inside": "inside", "Outside": "outside"}, selected="Inside")
path_mapper_9 = PathMapper(python_19.output_side_links, source="{D;E}", target="{D}")
path_mapper_10 = PathMapper(crv_5, source="{C;D}", target="{D}")
python_20 = GhPythonScript(
    x=library_path_4,
    extra_pts=flatten(python_13.extra_pts),
    main_links=path_mapper_6,
    side_links=path_mapper_9,
    end_link=path_mapper_7,
    mid_links=path_mapper_8,
    crvs=path_mapper_10,
    split_lines=line_2,
    distance=spacing_inter_paths,
    direction=list_5,
    count=layer_count,
    split_distance=spacing_cross,
    split_type=list_4,
    side_bool=Toggle(True),
    diamond_link=Toggle(True),
    safety=Toggle(True),
    main_link_length=Slider(26.1, range=0..100),
    side_length=Slider(61.3, range=0..100))  # -> out, log, b, c, d, e, pt_sets, start_and_end_pt, main_crv; inputs extra_pts: list of Point3d, main_links: list, side_links: list, mid_links: list, crvs: list of Curve, split_lines: list of Line, count: Int32, side_bool: Boolean
# ---------- python_20: Python ----------
import sys

sys.path.append(x)

# print(sys.path)

import generalFunctions as gf
import layerFunctions as lf
import Rhino.Geometry as rg
import pinLinkingBis as pl

from copy import deepcopy as dc

reload(gf)
reload(lf)
reload(pl)

log = ["new sequence start"]

diamond_settings = (diamond_link, safety, (main_link_length, side_length))

pt_sets = []

inner_crvs = []

height = crvs[0].PointAt(0.0).Z

mv_m = rg.Transform.Translation(rg.Vector3d(0,0, height))

loc_split_lines = dc(split_lines)
[line.Transform(mv_m) for line in loc_split_lines]

print loc_split_lines

crv_count = len(crvs)
print("there are %s curves in your list" % crv_count)

if count == 1:
    
    for crv in crvs:
        
        crv.Reverse()
        
    inner_crvs = crvs
    
else:
    
    for crv_i, crv in enumerate(crvs):
        
        a = gf.offsetCurveSet(crv, distance, direction, count)
        layer_set = lf.LinkingLayers(a, split_distance, side_bool, split_type, split_line = loc_split_lines[crv_i])
        # a = layer_set.split_a
        # b = layer_set.split_b
        # c = layer_set.split_line
        # d = layer_set.split_axis
        a, b, c, d, e = layer_set.createOrganisedCurves()
        
        pt_set = layer_set.joinCrvs()
        pt_set = pt_set[1:-1] + [pt_set[1]]
        
        crv = rg.Polyline(pt_set).ToPolylineCurve()
        
        inner_crvs.append(crv)

print("I passed this hurdle")

loc_extra_pts = []

for extra_pt in extra_pts:
    
    loc_pt = dc(extra_pt)
    loc_pt.Transform(mv_m)
    loc_extra_pts.append(loc_pt)
    
main_crv = pl.makeInnerCurve(inner_crvs, main_links, side_links, end_link, loc_extra_pts, mid_links, diamond_settings = diamond_settings)

print(main_crv)

start_and_end_pt = [main_crv.PointAt(main_crv.Domain[0]), main_crv.PointAt(main_crv.Domain[1])]
# ---------- end python_20 ----------

# ----
# PIN - INFILL
# connections...?
# 
# 
# system, if organic shell
outer_crv = Curve(graft(python_12.outer_crvs))
pt_13 = Point(pt_12)
path_mapper_11 = PathMapper(source="{A;B}", target="{A}")
pline_4 = PolyLine(Closed=False)
panel_12 = Panel(python_20.out)

# ---- group: Background process (Layer unioning Generation)
path_mapper_12 = PathMapper(outer_crv, source="{A;B;C;D;E}", target="{E}")
path_mapper_13 = PathMapper(python_20.start_and_end_pt, source="{A;B}", target="{A}")
python_21 = GhPythonScript(x=library_path_4, start_end_pts=path_mapper_13, exterior_crv=path_mapper_12, interior_crv=python_20.main_crv)  # -> out, a; inputs start_end_pts: list of Point3d, exterior_crv: Curve, interior_crv: Curve
# ---------- python_21: Python ----------
import sys

sys.path.append(x)

import generalFunctions as gf

result_crvs, _ = gf.layer2ptIntersect(exterior_crv, start_end_pts)
pt_set = list(gf.curveToPolyline(gf.longestCurve(result_crvs)).ToArray())
pt_set_2 = list(gf.curveToPolyline(interior_crv).ToArray())

pt_set_2.reverse()

a = pt_set + pt_set_2[1:-1]
# ---------- end python_21 ----------

# ---- group: Start Point - End Point LISTS
pt_14 = Point(flatten(python_21.a))
first_point_brim = ListItem(List=pt_14, Index=0, Wrap=True)
last_point_pin = ListItem(List=pt_14, Index=0, Wrap=True)  # -> Item1, Item

# ----
endpoint = Point(last_point_pin.Item1)
helixpin = GhPythonScript(
    pins=python_13.pins,
    start_height=item_3.Item,
    start_pt=endpoint,
    end_height=number_slider_2,
    start_alfa=Slider(4.33, range=0..10),
    layer_height=number_slider)  # -> out, pin_helix_lists; inputs pins: list, start_pt: Point3d
# ---------- helixpin: Python ----------
pin_helix_lists = []

for i, pin in enumerate(pins):
    
    if i == 0:
        
        # first pin, which uses a start point
        
        helix = pin.helix(
            end_h = end_height,
            start_pt = start_pt,
            layer_h = layer_height
        )
        
        pin_helix_lists.append(helix)
        
    else:
        
        helix = pin.helix(
            end_h = end_height,
            start_h = start_height - layer_height * .5,
            layer_h = layer_height,
            start_alfa = start_alfa
        )
        
        pin_helix_lists.append(helix)
# ---------- end helixpin ----------

# ---- group: Seam
endpoint_2 = Point(last_point_pin.Item1)
splitlines = Line(flatten(line_2))
update_split_lines = GhPythonScript(end_pt=endpoint_2, split_lines=splitlines)  # -> out, split_lines; inputs end_pt: Point3d, split_lines: list of Line
# ---------- update_split_lines: Python ----------
end_pt.Z = 0.0
split_lines[0].To = end_pt
# ---------- end update_split_lines ----------

# ----
python_22 = GhPythonScript(x=helixpin.pin_helix_lists)  # -> out, points
# ---------- python_22: Python ----------
import Rhino.Geometry as rg

print(len(x))

points = [rg.Point3d(pt) for pt in x]
# ---------- end python_22 ----------
item_4 = ListItem(List=helixpin.pin_helix_lists, Index=0, Wrap=True)  # -> Item, Item1
path_mapper_14 = PathMapper(python_22.points, source="{A;B;C;D}", target="{D}")
nozzlesettings_3 = GhPythonScript(x=flatten(nozzlesettings_2.out))  # -> out, feed_rate, variable_feed_rate, feed_rate_max, feed_rate_max_start_start_ramp, feed_rate_max_end_start_ramp, feed_rate_max_start_end_ramp, feed_rate_max_end_end_ramp
# ---------- nozzlesettings_3: Python ----------
import scriptcontext as sc

feed_rate = sc.sticky["PrintSettings"]["feed_rate"]
variable_feed_rate = sc.sticky["PrintSettings"]["feed_rate_variable"]

if variable_feed_rate:
    
    feed_rate_max = sc.sticky["PrintSettings"]["feed_rate_max"]
    feed_rate_max_start_start_ramp = sc.sticky["PrintSettings"]["feed_rate_max_end_start_ramp"]
    feed_rate_max_end_start_ramp = sc.sticky["PrintSettings"]["feed_rate_max_end_start_ramp"]
    feed_rate_max_start_end_ramp = sc.sticky["PrintSettings"]["feed_rate_max_start_end_ramp"]
    feed_rate_max_end_end_ramp = sc.sticky["PrintSettings"]["feed_rate_max_end_end_ramp"]
    
print(True)
# ---------- end nozzlesettings_3 ----------

# ---- group: Nozzle-Set@Start
nozzlesettings_4 = GhPythonScript(x=flatten(nozzlesettings_3.out))  # -> out, extrusion_rate, spacing_cross, spacing_paths, spacing_link, start_stop_retraction, start_reextrusion_rate
# ---------- nozzlesettings_4: Python ----------
import scriptcontext as sc

extrusion_rate = sc.sticky["PrintSettings"]["print_extrusion_rate"]
spacing_cross = sc.sticky["PrintSettings"]["print_spacing_cross"]
spacing_paths = sc.sticky["PrintSettings"]["print_spacing_paths"]
spacing_link = sc.sticky["PrintSettings"]["print_spacing_link"]
start_stop_retraction = sc.sticky["PrintSettings"]["print_spacing_start_stop_retraction"]
start_reextrusion_rate = sc.sticky["PrintSettings"]["print_spacing_start_reextrusion_rate"]
# ---------- end nozzlesettings_4 ----------

# ----
library_path_5 = FilePath(library_path_4)
num_3 = Number(number_slider)
number_slider_10 = Slider(3.5, range=0..10)
addition = Addition(A=num_3, B=0.001)
value_list = ValueList({"marieGriesmar": "", "lehmHuus": "_lehmHuus", "WASP": "_deltaWasp"}, selected="marieGriesmar")
col_2 = Colour(RGB(230, 136, 37))
savefile = Button()

# ---- group: Brim
# SETTINGS need to be externalized
number_slider_11 = Slider(25, range=10..100)
item_5 = ListItem(List=path_mapper, Index=0, Wrap=True)

# ----
simplify = SimplifyCurve(Curve=item_5)  # -> Curve, Simplified

# ---- group: Brim (continued)
divide_2 = DivideCurve(Curve=simplify.Curve, Count=1, Kinks=True)  # -> Points, Tangents, Parameters
brim = GhPythonScript(
    x=library_path_4,
    first_pt=first_point_brim,
    pts=divide_2.Points,
    offset_amount=Slider(10, range=0..10),
    start_safety_distance=number_slider_11)  # -> out, flatten(a), start_pt, outer_brim_crv, base_pt, crv; inputs first_pt: Point3d, pts: list of Point3d
# ---------- brim: Python ----------
import sys

sys.path.append(x)

import Rhino.Geometry as rg
import generalFunctions as gf
import polyline as pl

reload(pl)

crv = rg.Polyline(pts).ToPolylineCurve()
_, t_val = crv.ClosestPoint(first_pt)

print(t_val)

crv.ChangeClosedCurveSeam(t_val)

base_pt_set = list(crv.ToPolyline().ToArray())

brim_pl = pl.StructuredPolyline(base_pt_set[:-1])
brim_pl.offset(offset_amount)

pt_set = brim_pl.pointSet() + [brim_pl.pointSet()[0]]

crv = rg.Polyline(pt_set).ToPolylineCurve()
_, t_val = crv.ClosestPoint(first_pt)

print(t_val)

base_pt = crv.PointAt(t_val)
crv.ChangeClosedCurveSeam(t_val)

# base_pt = brim_pl.v_set[0]
start_pt, first_pt = base_pt, first_pt

start_pt = first_pt + (start_pt - first_pt) * (start_safety_distance / offset_amount)

# a = [rg.Point3d(start_pt)] + brim_pt_set
a = list(crv.ToPolyline().ToArray())
# ---------- end brim ----------

# ----
panel_13 = Panel(brim.out)
clean = CleanTree(RemoveNulls=True, RemoveInvalid=True, RemoveEmpty=False, Tree=brim.a)
clean_2 = CleanTree(RemoveNulls=True, RemoveInvalid=True, RemoveEmpty=False, Tree=brim.start_pt)

# ---- group: START/STOP--> CODE
split = SplitTree(Data=path_mapper_14, Masks=flatten("{0}"))  # -> Positive, Negative
item_6 = ListItem(List=pt_13, Index=0, Wrap=True)  # -> Item, Item1
pdecon = Deconstruct(Point=item_6.Item)  # -> XComponent, YComponent, ZComponent
pt_15 = Point(split.Negative)
extraheight = Slider(30, range=0..100)
item_7 = ListItem(List=split.Positive, Index=0, Wrap=True)  # -> Item1, Item
item_8 = ListItem(List=split.Negative, Index=0, Wrap=True)
pdecon_2 = Deconstruct(Point=item_6.Item1)  # -> XComponent, YComponent, ZComponent
pdecon_3 = Deconstruct(Point=item_7.Item1)  # -> XComponent, YComponent, ZComponent
pdecon_4 = Deconstruct(Point=item_8)  # -> XComponent, YComponent, ZComponent
addition_2 = Addition(A=extraheight, B=pdecon_3.ZComponent)
pt_16 = ConstructPoint(XCoordinate=pdecon_2.XComponent, YCoordinate=pdecon_2.YComponent, ZCoordinate=pdecon_4.ZComponent)
pt_17 = ConstructPoint(XCoordinate=pdecon.XComponent, YCoordinate=pdecon.YComponent, ZCoordinate=addition_2)
dist_2 = Distance(PointA=pt_16, PointB=item_8)
subtraction_2 = Subtraction(A=item_8, B=pt_16)
division = Division(A=subtraction_2, B=dist_2)
multiplication_3 = Multiplication(A=division, B=extraheight)
addition_3 = Addition(A=multiplication_3, B=item_8)
pdecon_5 = Deconstruct(Point=addition_3)  # -> XComponent, YComponent, ZComponent
pt_18 = Point(clean_2)
pt_19 = ConstructPoint(XCoordinate=pdecon_5.XComponent, YCoordinate=pdecon_5.YComponent, ZCoordinate=addition_2)
pdecon_6 = Deconstruct(Point=pt_18)  # -> XComponent, YComponent, ZComponent
merge_2 = Merge(Data1=pt_17, Data2=pt_19, Data3=addition_3, Data4=item_8)  # -> flatten(Result)
pt_20 = ConstructPoint(XCoordinate=pdecon_6.XComponent, YCoordinate=pdecon_6.YComponent, ZCoordinate=extraheight)
merge_3 = Merge(Data1=pt_20, Data2=pt_18)

# ----
# BRIM - BODY - 1st PIN (without Start-Stop)
merge_4 = Merge(Data1=flatten(clean), Data2=flatten(pt_14), Data3=flatten(split.Positive))

pt_21 = Point(item_6.Item1)

# ---- group: Internalize ?
feed_rate_in_mm_s_3 = Slider(25, range=0..100)
pdecon_7 = Deconstruct(Point=pt_21)  # -> XComponent, YComponent, ZComponent
pt_22 = ConstructPoint(XCoordinate=pdecon_7.XComponent, YCoordinate=pdecon_7.YComponent, ZCoordinate=addition_2)
python_23 = GhPythonScript(feed_rate=feed_rate_in_mm_s_3, extrusion_rate=Slider(200, range=0..1000), pts=pt_22)  # -> out, a; inputs pts: list of Point3d
# ---------- python_23: Python ----------
f_rate = feed_rate * 60.0

for pt_i, pt in enumerate(pts):
    
    if pt_i == 0:
        
        e_rate = - extrusion_rate
    
    elif pt_i == len(pts) - 1:
        
        e_rate = extrusion_rate
        
    else:
        
        e_rate = 0.0
    
    print("G1 F{} X{} Y{} Z{} E{}".format(f_rate, pt.X, pt.Y, pt.Z, e_rate))
# ---------- end python_23 ----------

# ----
pt_23 = Point(flatten(merge_4))

# ---- group: shrinkage scaling
scale = Scale(Geometry=pt_23, Center=Point(0, 0, 0), Factor=shrinkage.scale_value)  # -> Geometry, Transform

scale_2 = Scale(Geometry=merge_2, Center=Point(0, 0, 0), Factor=shrinkage.scale_value)  # -> Geometry, Transform

# ---- group: START/STOP--> CODE / Restructure
extrusion_startstop_rate = Slider(150, range=-100..250)
feed_rate_in_mm_s_4 = Slider(50, range=0..100)
python_24 = GhPythonScript(
    feed_rate=nozzlesettings_3.feed_rate,
    extrusion_retraction=nozzlesettings_4.start_stop_retraction,
    extra_add=nozzlesettings_4.start_reextrusion_rate,
    pts=scale_2.Geometry)  # -> out, a; inputs pts: list of Point3d
# ---------- python_24: Python ----------
f_rate = feed_rate * 60.0

for pt_i, pt in enumerate(pts):
    
    if pt_i == 0:
        
        e_rate = - extrusion_retraction
    
    elif pt_i == len(pts) - 1:
        
        e_rate = extrusion_retraction + extra_add
        
    else:
        
        e_rate = 0.0
    
    print("G1 F{} X{} Y{} Z{} E{}".format(f_rate, pt.X, pt.Y, pt.Z, e_rate))
# ---------- end python_24 ----------

# ----
pt_24 = Point(flatten(pt_15))

# ---- group: shrinkage scaling
scale_3 = Scale(Geometry=pt_24, Center=Point(0, 0, 0), Factor=shrinkage.scale_value)  # -> Geometry, Transform

scale_4 = Scale(Geometry=merge_3, Center=Point(0, 0, 0), Factor=shrinkage.scale_value)  # -> Geometry, Transform

# ---- group: START/STOP--> CODE (continued)
starline = GhPythonScript(
    feed_rate=nozzlesettings_3.feed_rate,
    extrusion_retraction=nozzlesettings_4.start_stop_retraction,
    extra_add=nozzlesettings_4.start_reextrusion_rate,
    start_pts=scale_4.Geometry)  # -> flatten(out), a; inputs start_pts: list of Point3d
# ---------- starline: Python ----------
f_rate = feed_rate * 60.0

for i, pt in enumerate(start_pts):
    
    if i == 0:
        
        e_rate = 1

        print("G1 F{} X{} Y{} Z{} E{}".format(f_rate, pt.X, pt.Y, pt.Z, e_rate))
    
    elif i == 1:
   
        e_rate = extrusion_retraction + extra_add

        print("G1 F{} X{} Y{} Z{} E{}".format(f_rate, pt.X, pt.Y, pt.Z, e_rate))
# ---------- end starline ----------

# ---- group: G-Code
start_stop_feedrate_in_mm_min = Slider(100, range=0..1000)
number_slider_12 = Slider(0, range=0..10)
number_slider_13 = Slider(0, range=0..10)
number_slider_14 = Slider(4.4, range=0..10)
number_slider_15 = Slider(0, range=0..10)
number_slider_16 = Slider(300, range=0..1000)
list_6 = ValueList({"start / stop": "start_stop", "continious"}, selected="continious")
gcodelines = GhPythonScript(
    x=library_path_5,
    pts=scale.Geometry,
    feed_rate=nozzlesettings_3.feed_rate,
    extrusion_rate=nozzlesettings_4.extrusion_rate,
    link_type=list_6,
    global_trim_distance=number_slider_12,
    ss_trim_distance=number_slider_13,
    cull_distance=number_slider_15,
    lift_val=number_slider_14,
    ss_f_rate=start_stop_feedrate_in_mm_min,
    ss_e_rate=number_slider_16,
    variable_feed_rate=nozzlesettings_3.variable_feed_rate,
    peak_feed_rate=nozzlesettings_3.feed_rate_max,
    start_min=nozzlesettings_3.feed_rate_max_start_start_ramp,
    start_max=nozzlesettings_3.feed_rate_max_end_start_ramp,
    end_max=nozzlesettings_3.feed_rate_max_start_end_ramp,
    end_min=nozzlesettings_3.feed_rate_max_end_end_ramp)  # -> out, a, path_vis; inputs pts: list, variable_feed_rate: Boolean
# ---------- gcodelines: Python ----------
import sys

sys.path.append(x)

import Rhino.Geometry as rg
import simpleStartStop as ss

reload(ss)

# print(pts)

p_set = ss.PrintSettings(
    feed_rate = feed_rate, 
    extrusion_rate = extrusion_rate, 
    extrusion_mode = 'relative', 
    movement_mode = 'relative'
)

if variable_feed_rate:
    
    p_set.setComplexFeedrate(
        peak_feed_rate,
        min_h_ramp = (start_min, start_max),
        max_h_ramp = (end_max, end_min)
    )

l_type = ss.LinkType(
    link_type = link_type,
    global_trim_distance = global_trim_distance,
    ss_trim_distance = ss_trim_distance,
    cull_distance = cull_distance,
    lift_val = lift_val
)

l_type.ss_f_rate = ss_f_rate
l_type.ss_e_rate = ss_e_rate

gcodeset = ss.GCodeSet(pts, p_set, l_type)
a = gcodeset.generateGCode()

path_vis = gcodeset.path_vis
# ---------- end gcodelines ----------

# ---- group: 2nd PIN + safety position
gcodelines_2 = GhPythonScript(
    x=library_path_5,
    pts=scale_3.Geometry,
    feed_rate=nozzlesettings_3.feed_rate,
    extrusion_rate=nozzlesettings_4.extrusion_rate,
    link_type=list_6,
    global_trim_distance=number_slider_12,
    ss_trim_distance=number_slider_13,
    cull_distance=number_slider_15,
    lift_val=number_slider_14,
    ss_f_rate=start_stop_feedrate_in_mm_min,
    ss_e_rate=number_slider_16)  # -> out, a, path_vis; inputs pts: list
# ---------- gcodelines_2: Python ----------
import sys

sys.path.append(x)

import Rhino.Geometry as rg
import simpleStartStop as ss

reload(ss)

# print(pts)

p_set = ss.PrintSettings(
    feed_rate = feed_rate, 
    extrusion_rate = extrusion_rate, 
    extrusion_mode = 'relative', 
    movement_mode = 'relative'
)

l_type = ss.LinkType(
    link_type = link_type,
    global_trim_distance = global_trim_distance,
    ss_trim_distance = ss_trim_distance,
    cull_distance = cull_distance,
    lift_val = lift_val
)

l_type.ss_f_rate = ss_f_rate
l_type.ss_e_rate = ss_e_rate

gcodeset = ss.GCodeSet(pts, p_set, l_type)
a = gcodeset.generateGCode()

path_vis = gcodeset.path_vis
# ---------- end gcodelines_2 ----------

# ---- group: G-Code / LenghtPath Body + 1st PIN - check
pline_5 = PolyLine(Vertices=gcodelines.path_vis, Closed=False)

# ----
pt_25 = Point(gcodelines.path_vis)
pt_26 = Point(gcodelines_2.path_vis)
lenghtpath_2nd_pin_check = PolyLine(Vertices=gcodelines_2.path_vis, Closed=False)

# ---- group: Visualization lines
merge_5 = Merge(
    Data1=flatten(merge_3),
    Data2=flatten(gcodelines.path_vis),
    Data3=flatten(merge_2),
    Data4=flatten(gcodelines_2.path_vis),
    Data5=flatten(pt_22))
pline_6 = PolyLine(Vertices=merge_5, Closed=False)

# ----
merge_gcode_lines = Merge(
    Data1=flatten(starline.out),
    Data2=flatten(gcodelines.a),
    Data3=flatten(python_24.out),
    Data4=flatten(gcodelines_2.a),
    Data5=flatten(python_23.out))
panel_14 = Panel(gcodelines.out)
len = Length(Curve=lenghtpath_2nd_pin_check)
len_2 = Length(Curve=pline_5)
python_25 = GhPythonScript(pts=pt_25, h=addition, spacing=num_3)  # -> out, msh; inputs pts: list of Point3d, is_closed: Boolean
# ---------- python_25: Python ----------
import Rhino.Geometry as rg
from math import ceil

h_delta = spacing

msh = rg.Mesh()

for i in range(2):
    z = i * h_delta
    for p in pts:
        msh.Vertices.Add(p.X, p.Y, p.Z + z)

x_cnt = len(pts)
y_cnt = 2

for i in range(y_cnt - 1):
    base_a = i * x_cnt
    base_b = (i + 1) * x_cnt
    for j in range(x_cnt - 1):
        a = base_a + j
        b = base_a + j + 1
        c = base_b + j + 1
        d = base_b + j
        
        msh.Faces.AddFace(a, b, c, d)
    
    if is_closed:
        a = base_a + j + 1
        b = base_a
        c = base_b
        d = base_b + j + 1
        
        msh.Faces.AddFace(a, b, c, d)
# ---------- end python_25 ----------
python_26 = GhPythonScript(pts=pt_26, h=addition, spacing=num_3)  # -> out, msh; inputs pts: list of Point3d, is_closed: Boolean; same code as python_25
len_3 = Length(Curve=pline_6)
addition_4 = Addition(A=len_2, B=len)
python_27 = GhPythonScript(x=len_3)  # -> out, a
# ---------- python_27: Python ----------
import scriptcontext as sc

key_list = sc.sticky["PrintSettings"]["path_length"] = x
# ---------- end python_27 ----------
mesh_2 = Mesh(python_25.msh)
mesh_3 = Mesh(python_26.msh)
panel_15 = Panel(python_27.out)

# ---- group: G-Code (continued)
end_start_gcode = GhPythonScript(x=library_path_5, add_header=Toggle(True), lines=flatten(merge_gcode_lines), gcodeFiles=value_list)  # -> out, a; inputs add_header: Boolean, lines: list
# ---------- end_start_gcode: Python ----------
import os
import scriptcontext as sc

# creating the header of the gcode file

if add_header:
    key_list = sc.sticky["PrintSettings"].keys()
    key_list.sort()

    for key_item in key_list:
    
        print(";{} : {}".format(key_item, str(sc.sticky["PrintSettings"][key_item])) )

start_gcode_path = os.path.join(x, "GCodeDefinitions", "startGcode" + gcodeFiles + ".txt")
end_gcode_path = os.path.join(x, "GCodeDefinitions", "endGcode" + gcodeFiles + ".txt")

start_gcode = open(start_gcode_path, 'r').read()
end_gcode = open(end_gcode_path, 'r').read()

print start_gcode

for line in lines:

    print(line)

print end_gcode
# ---------- end end_start_gcode ----------

# ----
mesh_pipe = CSharpScript(pts=merge_5, r=Slider(1, range=0..1), d=Slider(16, range=0..100), max_angle=Slider(0.1, range=0..1))  # -> out, A; inputs pts: list of Point3d, r: Double, d: Int32, max_angle: Double
# ---------- mesh_pipe: C# ----------
    List<Vector3d> tangents = new List<Vector3d>();

    // constructing all the tangent vectors
    for (int i = 1; i < pts.Count; i++) {
      Point3d p0 = pts[i - 1];
      Point3d p1 = pts[i];

      tangents.Add(p1 - p0);
    }

    tangents.Add(tangents[tangents.Count - 1]);

    // getting the first normal & binormal
    Vector3d t = tangents[0];
    Vector3d n;
    if (Math.Abs(t.Y) > Math.Abs(t.X)) {
      if (Math.Abs(t.Z) > Math.Abs(t.Y)) {
        n = new Vector3d(0, t.Z, -t.Y);
      } else if (Math.Abs(t.Z) >= Math.Abs(t.X)) {
        n = new Vector3d(0, -t.Z, t.Y);
      } else {
        n = new Vector3d(t.Y, -t.Y, 0);
      }
    } else if (Math.Abs(t.Z) > Math.Abs(t.X)) {
      n = new Vector3d(t.Z, 0, -t.X);
    } else if (Math.Abs(t.Z) > Math.Abs(t.Y)) {
      n = new Vector3d(-t.Z, 0, t.X);
    } else {
      n = new Vector3d(-t.Y, t.X, 0.0);
    }
    Vector3d bn = Vector3d.CrossProduct(t, n);

    n.Unitize();
    bn.Unitize();

    // populating the end and start frames of every plane
    List<Plane> frames = new List<Plane>();

    for (int i = 1; i < pts.Count; i++) {
      Point3d p0 = pts[i - 1];
      Point3d p1 = pts[i];

      frames.Add(new Plane(p0, n, bn));
      frames.Add(new Plane(p1, n, bn));

        if (i < pts.Count - 1) {
            t = tangents[i];
            n = Vector3d.CrossProduct(bn, t);
            bn = Vector3d.CrossProduct(t, n);

            n.Unitize();
            bn.Unitize();
        }
    }

    // when the angle between previous end and next start plane is larger than max angle
    // add interpolation planes (rounded ends)
    List<Plane> interpolatedFrames = new List<Plane>();
    interpolatedFrames.Add(frames[0]);
    for (int i = 1; i < frames.Count - 2; i += 2) {
        Plane pln0 = frames[i];
        Plane pln1 = frames[i+1];

        double angle = Vector3d.VectorAngle(pln0.Normal, pln1.Normal);

        interpolatedFrames.Add(pln0);
        if (angle > max_angle) {
            double steps = Math.Ceiling(angle / max_angle);
            for (double j = 1; j < steps; j++) {
                double multiplier = j / steps;
                Plane intPlane = new Plane(
                    pln0.Origin,
                    pln0.XAxis * (1 - multiplier) + pln1.XAxis * multiplier,
                    pln0.YAxis * (1 - multiplier) + pln1.YAxis * multiplier
                    );
                interpolatedFrames.Add(intPlane);
             }
        }
        interpolatedFrames.Add(pln1);
    }

    interpolatedFrames.Add(frames[frames.Count - 1]);

    // constructing the uv parameters
    List<Vector2d> uvParameters = new List<Vector2d>();
    for (int i = 0; i < d; i++) {
      double angle = i * (Math.PI * 2.0) / d;
      uvParameters.Add(new Vector2d(r * Math.Cos(angle), r * Math.Sin(angle)));
    }

    // constructing the mesh
    Mesh pipeMesh = new Mesh();
    foreach (Plane f in interpolatedFrames) {
      foreach (Vector2d v in uvParameters) {
        pipeMesh.Vertices.Add(f.Origin + f.XAxis * v.X + f.YAxis * v.Y);
      }
    }

    for (int i = 1 ; i < interpolatedFrames.Count ; i++) {
        int idxA = (i - 1) * uvParameters.Count;
        int idxB = i * uvParameters.Count;
      for (int j = 1; j < uvParameters.Count; j++) {
          int iA = idxA + j-1;
          int iB = idxB + j-1;
          int iC = idxB + j;
          int iD = idxA + j;
        pipeMesh.Faces.AddFace(iA, iB, iC, iD);
      }

      pipeMesh.Faces.AddFace(idxA + uvParameters.Count - 1, idxB + uvParameters.Count - 1, idxB, idxA);
    }

    A = pipeMesh;
# ---------- end mesh_pipe ----------
mjoin = MeshJoin(Meshes=[mesh_2, mesh_3])
preview_2 = CustomPreview(Geometry=mesh_pipe.A, Material=col_2)
python_28 = GhPythonScript(
    y=savefile,
    x=library_path_5,
    extra_name=Toggle(False),
    extra_txt="layerHeight2.5_eRate*3",
    data=flatten(end_start_gcode.out),
    extra_tag=value_list)  # -> out, a; inputs data: list
# ---------- python_28: Python ----------
import os
import scriptcontext as sc
import math
import time
import scriptcontext as sc

import sys
sys.path.append(x)

import simpleStartStop as ss

reload(ss)

try:
    
    run_timing = time.time() - sc.sticky["start_time"]
    
    if run_timing > 2.0:
    
        sc.sticky["start_time"] = time.time()
        
        run = True
        
    else:
        
        run = False
    
except:
    
    sc.sticky["start_time"] = time.time()
    
    run = True

if y and run:
    
    count_file = None
    
    try:
        count_file = os.path.join(x, "GCodeDefinitions", "countSheet.json")
    except:
        print("count file not found, it's fine")
    
    nozzle_dia = round(sc.sticky["PrintSettings"]["print_extrusion_nozzle"], 1)
    
    if not(count_file == None):
        str = ss.file_count(nozzle_dia, count_file)

    date = time.strftime("%Y%m%d")

    if extra_name:
    
        file_name = "{}_{}_{}.gcode".format(str, date, extra_txt)
    
    else:
    
        file_name = "{}_{}{}.gcode".format(str, date, extra_tag)

    save_file = os.path.join(os.path.dirname(x), "GCode", file_name)

    print save_file

    data = '\n'.join(data)

    open(save_file, "a").write(data)
# ---------- end python_28 ----------
panel_16 = Panel(python_28.out)
