# Grasshopper definition 210618_pattern_slicer_different_gcodes.gh (Grasshopper 1.0.7)
# plug-ins: Weaverbird, Axolotl Info, PTComponentLibrary

feed_rate_in_mm_s = Slider(25, range=0..100)

# ---- group: Brick Geometry Generator
number_slider = Slider(150, range=0..1000)
number_slider_2 = Slider(3.2, range=0..10)
number_slider_3 = Slider(1.4, range=0..10)
number_slider_4 = Slider(260, range=0..1000)
python = GhPythonScript(height_body=number_slider, height_pin=number_slider_4, start_height=number_slider_3, layer_height=number_slider_2)  # -> out, flatten(body_heights), flatten(pin_only_heights)
# ---------- python: Python ----------
import scriptcontext as sc

# creating the heights

body_heights = []
pin_only_heights = []

height = start_height

height_body, height_pin = min(height_body, height_pin), max(height_body, height_pin)

print (height_body, height_pin)

while height < height_body:
    
    body_heights.append(height)
    
    height += layer_height
    
while height < height_pin:
    
    pin_only_heights.append(height)
    
    height += layer_height

try:
    sc.sticky["PrintSettings"]["height_body"]=height_body
except:
    print("had to initialize the PrintSettings dict")
    sc.sticky["PrintSettings"]={"height_body":height_body}
sc.sticky["PrintSettings"]["height_pin"]=height_pin
sc.sticky["PrintSettings"]["start_height"]=start_height
sc.sticky["PrintSettings"]["layer_height"]=layer_height
sc.sticky["PrintSettings"]["layer_body_count"]=len(body_heights)
sc.sticky["PrintSettings"]["layer_pin_count"]=len(pin_only_heights)
sc.sticky["PrintSettings"]["layer_total_count"]=len(body_heights) + len(pin_only_heights)
# ---------- end python ----------

# ---- group: Brick Geometry Generator / where should we put it ?
number_slider_5 = Slider(220, range=40..250)
number_slider_6 = Slider(350, range=100..450)
number_slider_7 = Slider(250, range=40..250)

# ----
feed_rate_in_mm_s_2 = Slider(40, range=0..100)
line_linking_spacing = Slider(2.7, range=0..10)
inter_line_spacing = Slider(2, range=0..10)
split_distance = Slider(2, range=-10..10)
path = FilePath()

# ---- group: shrinkage scaling
multiplication = Multiplication(A=1, B=feed_rate_in_mm_s)

# ----
python_2 = GhPythonScript(default_dropbox_path=Toggle(True), custom_path=path)  # -> out, path, clean_code_path; inputs default_dropbox_path: Boolean
# ---------- python_2: Python ----------
import sys

import os
import Grasshopper

path=os.path.dirname(Grasshopper.Instances.ActiveCanvas.Document.FilePath)
base_path=os.path.dirname(path)
path=os.path.join(base_path, "PatternBrickLibrary")
clean_code_path=os.path.join(base_path, "clean_code")
sys.path.append(path)
# ---------- end python_2 ----------
feedratesettings = GhPythonScript(
    feed_rate=multiplication,
    variable_feed_rate=Toggle(False),
    feed_rate_max=feed_rate_in_mm_s_2,
    feed_rate_max_start_start_ramp=Slider(5, range=0..25),
    feed_rate_max_end_start_ramp=Slider(10, range=0..100),
    feed_rate_max_start_end_ramp=Slider(135, range=0..1000),
    feed_rate_max_end_end_ramp=Slider(145, range=0..1000))  # -> flatten(out); inputs variable_feed_rate: Boolean
# ---------- feedratesettings: Python ----------
import scriptcontext as sc

try:
    sc.sticky["PrintSettings"]["feed_rate"] = feed_rate
except:
    sc.sticky["PrintSettings"]={"feed_rate":feed_rate}
sc.sticky["PrintSettings"]["feed_rate_variable"] = variable_feed_rate

if variable_feed_rate:
    
    sc.sticky["PrintSettings"]["feed_rate_max"] = feed_rate_max
    sc.sticky["PrintSettings"]["feed_rate_max_end_start_ramp"] = feed_rate_max_start_start_ramp
    sc.sticky["PrintSettings"]["feed_rate_max_end_start_ramp"] = feed_rate_max_end_start_ramp
    sc.sticky["PrintSettings"]["feed_rate_max_start_end_ramp"] = feed_rate_max_start_end_ramp
    sc.sticky["PrintSettings"]["feed_rate_max_end_end_ramp"] = feed_rate_max_end_end_ramp
    
print(True)
# ---------- end feedratesettings ----------

# ---- group: Nozzle
list = ValueList({"3.5", "5"}, selected="5")
nozzlesettings = GhPythonScript(x=feedratesettings, nozzle_diameter=list, layer_height=number_slider_2)  # -> flatten(out)
# ---------- nozzlesettings: Python ----------
import scriptcontext as sc

def linearInterpolation(input_x, val_s, x_s):

    val_a, val_b = val_s
    x_a, x_b = x_s

    x_a, x_b, val_a, val_b = float(x_a), float(x_b), float(val_a), float(val_b)

    distance_val = (input_x - x_a) / (x_b - x_a)

    output_val = (1 - distance_val) * val_a + distance_val * val_b

    return output_val

x_s = (2.5, 3.2)

val_s_5_spacing_cross_paths = (2.5, 2.0)
val_s_5_spacing_link = (3.4, 2.7)

val_s_3_5_spacing_cross_paths = (2.0, 1.6)
val_s_3_5_spacing_link = (2.7, 2.2)

if nozzle_diameter == 3.5:
    
    extrusion_rate = .64
    spacing_cross_paths = round(linearInterpolation(layer_height, val_s_3_5_spacing_cross_paths, x_s), 1)
    spacing_link = round(linearInterpolation(layer_height, val_s_3_5_spacing_link, x_s), 1)
    start_stop_retraction = 130
    start_reextrusion_rate = 40
    
if nozzle_diameter == 5.0:
    
    extrusion_rate = .8
    spacing_cross_paths = round(linearInterpolation(layer_height, val_s_3_5_spacing_cross_paths, x_s), 1)
    spacing_link = round(linearInterpolation(layer_height, val_s_5_spacing_link, x_s), 1)
    start_stop_retraction = 150
    start_reextrusion_rate = 50
    
# print(spacing_cross_paths, spacing_cross_paths, spacing_link)

sc.sticky["PrintSettings"]["print_extrusion_nozzle"] = nozzle_diameter   
sc.sticky["PrintSettings"]["print_extrusion_rate"] = extrusion_rate
sc.sticky["PrintSettings"]["print_spacing_cross"] = spacing_cross_paths
sc.sticky["PrintSettings"]["print_spacing_paths"] = spacing_cross_paths
sc.sticky["PrintSettings"]["print_spacing_link"] = spacing_link
sc.sticky["PrintSettings"]["print_spacing_start_stop_retraction"] = start_stop_retraction
sc.sticky["PrintSettings"]["print_spacing_start_reextrusion_rate"] = start_reextrusion_rate

print(True)
# ---------- end nozzlesettings ----------

# ----
simplebrick = GhPythonScript(save_settings=Toggle(True), brick_length=number_slider_6, brick_width=number_slider_7, pin_spacing=number_slider_5)  # -> out, poly_crv, pin_pts; inputs save_settings: Boolean
# ---------- simplebrick: Python ----------
import Rhino.Geometry as rg
import scriptcontext as sc

# creating the base shape and pins

brick_width, brick_length  = min(brick_width, brick_length), max(brick_width, brick_length)

print (brick_length, brick_width)

half_l = brick_length * .5
half_w = brick_width * .5

#     *       *
#   *            *
#     *       *

val_list = [(1,1), (1, -1), (-1, -1), (-1, 1)]

pt_list = []

for i in range(4):
    
    pt_list.append(rg.Point3d(half_l * val_list[i][0], half_w * val_list[i][1], 0.0))
    
    if i == 0:
        
        pt_list.append(rg.Point3d(half_l + half_w, 0, 0))
        
    elif i == 2:
        
        pt_list.append(rg.Point3d(- (half_l + half_w), 0, 0))

arc_set = [[0,1,2],[3,4,5]]
line_set = [[5,0],[2,3]]

poly_crv = rg.PolyCurve()
pin_pts = [rg.Point3d(-.5 * pin_spacing, 0, 0), rg.Point3d(.5 * pin_spacing, 0, 0)]

for i in range(2):
    
    pt_0, pt_1, pt_2, pt_3 = pt_list[-1 + i * 3], pt_list[0 + i * 3], pt_list[1 + i * 3], pt_list[2 + i * 3]
    
    line = rg.Line(pt_0, pt_1)
    
    poly_crv.Append(line)
    
    crv = rg.Arc(pt_1, pt_2, pt_3)
    
    poly_crv.Append(crv)
    
if save_settings:
    
    try:
        sc.sticky["PrintSettings"]["brick_width"]=brick_width
    except:
        print("had to initialize the PrintSettings dict")
        sc.sticky["PrintSettings"]={"brick_width":brick_width}
    
    sc.sticky["PrintSettings"]["brick_length"]=brick_length
    sc.sticky["PrintSettings"]["pin_spacing"]=pin_spacing
# ---------- end simplebrick ----------
shrinkage = GhPythonScript(your_clay_shrinkage=Slider(8.7, range=-100..100))  # -> out, scale_value
# ---------- shrinkage: Python ----------
our_clay_shrinkage = 8.7

scale_value = (100. - our_clay_shrinkage) / (100. - your_clay_shrinkage)
# ---------- end shrinkage ----------
manualnozzloverwrite = GhPythonScript(
    x=nozzlesettings,
    overwrite=Toggle(False),
    spacing_cross=split_distance,
    spacing_paths=inter_line_spacing,
    spacing_link=line_linking_spacing)  # -> out; inputs overwrite: Boolean
# ---------- manualnozzloverwrite: Python ----------
import scriptcontext as sc

if overwrite:
    
    sc.sticky["PrintSettings"]["print_spacing_cross"] = spacing_cross
    sc.sticky["PrintSettings"]["print_spacing_paths"] = spacing_paths
    sc.sticky["PrintSettings"]["print_spacing_link"] = spacing_link
    
print(True)
# ---------- end manualnozzloverwrite ----------
given_points = Point([Point(-102.3006922, 0.4886194024, 0), Point(105, 0, 0)])
given_shell = Curve(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)
curve = Curve(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)
crv = Curve(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)
point = Point([Point(104.9999408, 0, 0), Point(-104.9999408, 0, 0)])
panel = Panel(nozzlesettings)

# ---- group: Reverse the direction of curve
# Explanation: Based on how the curve is directed, offsetting and/or splitting it will behave differently
flip = FlipCurve()  # -> Curve, Flag

# ----
Z = UnitZ(Factor=number_slider)
crv_2 = Curve(given_shell)
splitting_geometry = Geometry(crv)
python_3 = GhPythonScript()  # -> out, a
# ---------- python_3: Python ----------
import scriptcontext as sc

print(sc.sticky["PrintSettings"])
# ---------- end python_3 ----------
extr = Extrude(Base=crv_2, Direction=Z)
panel_2 = Panel(python_3.out)
library_path = FilePath(python_2.path)
layer_slicing = GhPythonScript(x=library_path, geometry=given_shell, heights=python.body_heights)  # -> out, ori_crvs, crv_sets, a, b, c, d; inputs geometry: GeometryBase, heights: list
# ---------- layer_slicing: Python ----------
import sys

sys.path.append(x)

import brickSlicer as bs

reload(bs)

ori_crvs = bs.slicing(geometry, heights)
# crv_sets, a, b, c = bs.splitter(ori_crvs, slicing_object = slice_geo, split_type = "first_layer")
# ---------- end layer_slicing ----------
crv_3 = Curve(layer_slicing.ori_crvs)
cap = CapHoles(Brep=extr)
panel_3 = Panel(layer_slicing.out)
clean_code_path = FilePath(python_2.clean_code_path)
offset = OffsetCurve(Curve=given_shell, Distance=Slider(5, range=0..10), Plane=PlaneXY(0, 0, 0), Corners=1)
offset_2 = OffsetCurve(Curve=given_shell, Distance=Slider(10, range=0..10), Plane=PlaneXY(0, 0, 0), Corners=1)
python_4 = GhPythonScript()  # -> out, a
# ---------- python_4: Python ----------
from Rhino.Geometry import Point3d

vs = [(-135.68763732910156, 22.979591369628906, 134.0), (-136.6048583984375, 21.005922317504883, 134.0), (-138.0771484375, 19.4432315826416, 134.0), (-140.15708923339844, 18.477264404296875, 134.0), (-142.6437530517578, 17.860191345214844, 134.0), (-145.2830352783203, 17.24613380432129, 134.0),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
a = []

for x,y,z in vs:
    a.append(Point3d(x, y, z))
# ---------- end python_4 ----------
start_height = Number(number_slider_3)
project = Project(Geometry=python_4.a, Plane=PlaneXY(0, 0, 0))  # -> Geometry, Transform
Z_2 = UnitZ(Factor=start_height)
ptdividelen = DivideLength(Curve=offset, Distance=Slider(2.5, range=0..10), RoundUp=False, RoundDn=False)
ptdividelen_2 = DivideLength(Curve=offset_2, Distance=Slider(2.5, range=0..10), RoundUp=False, RoundDn=False)
project_2 = Project(Geometry=ptdividelen_2, Plane=PlaneXY(0, 0, 0))  # -> Geometry, Transform
pt = Point(python_4.a)
move = Move(Geometry=project_2.Geometry, Motion=Z_2)  # -> Geometry, Transform
move_2 = Move(Geometry=project.Geometry, Motion=Z_2)  # -> Geometry, Transform
library_path_2 = FilePath(library_path)

# ---- group: — Slicing for pattern —
num = Number(100)
slicing_structuring = GhPythonScript(
    x=library_path_2,
    ori_crvs=layer_slicing.ori_crvs,
    spacing=Slider(2.5, range=0..10),
    end_smooth=Toggle(False),
    custom_crv_length=Toggle(False),
    crv_l=num,
    split=Toggle(True),
    slice_geo=splitting_geometry,
    split_item=Slider(0, range=0..1))  # -> out, split, layers, set_tuple, crv_sets, ori_crvs, slice_geo; inputs ori_crvs: list, end_smooth: Boolean, custom_crv_length: Boolean, split: Boolean, split_item: Int32
# ---------- slicing_structuring: Python ----------
# snippet of code to make this python component look for it's   code in the parent folder of the .gh file

import sys

sys.path.append(x)

import vertexClass_v1 as vc
import brickSlicer as bs
import scriptcontext as sc

reload(bs)
reload(vc)

print(type(slice_geo))

    
if custom_crv_length:
    
    crv_l = crv_l
    
    sc.sticky["PrintSettings"]["pattern_crv_l"] = crv_l
    
else:
    
    crv_l = None


if split:

    crv_sets, vis_a, vis_b, pts_crv_a_and_b = bs.splitter(ori_crvs, slicing_object = slice_geo, split_type = "first_layer")
    
    crv_set_a = [crv_set[0] for crv_set in crv_sets]
    crv_set_b = [crv_set[1] for crv_set in crv_sets]
    
    crv_sets = [crv_set_a, crv_set_b]
    
    non_pattern_part = [vc.divideCurveByLength(crv, spacing) for crv in crv_sets[(split_item + 1) % 2]]
    
    pattern_part, set_tuple, _ = vc.moveSet(crv_sets[split_item], ori_crvs, spacing, crv_l)
    layers = [pattern_part, non_pattern_part]
    
    
else:

    layers, set_tuple = vc.singleCurve(ori_crvs, spacing, end_smooth, crv_l)
    
sc.sticky["PrintSettings"]["pattern_spacing"] = spacing
sc.sticky["PrintSettings"]["pattern_end_smooth"] = end_smooth
# ---------- end slicing_structuring ----------

# ----
item = ListItem(List=slicing_structuring.set_tuple, Index=0, Wrap=True)  # -> Item, Item1, Item2
pline = PolyLine(Vertices=pt, Closed=True)
pline_2 = PolyLine(Vertices=move.Geometry, Closed=True)
pline_3 = PolyLine(Vertices=move_2.Geometry, Closed=True)
crv_l = Number(item.Item)

# ---- group: general pattern settings
pt_2 = ConstructPoint(XCoordinate=Slider(12, range=0..100), YCoordinate=Slider(0, range=0..100), ZCoordinate=0)
pt_3 = Point(pt_2)
pyramidpattern = GhPythonScript(lib_path=clean_code_path, zero_end=Slider(0, range=0..100), ramp_end=Slider(49.292, range=0..100), length=crv_l)  # -> out, edge_easing
# ---------- pyramidpattern: Python ----------
import sys

sys.path.append(lib_path)

import patterns as pt
reload(pt)

edge_easing = pt.EdgeEasing(
    min(zero_end, ramp_end),
    max(zero_end, ramp_end),
    length
)
# ---------- end pyramidpattern ----------
inout = GhPythonScript(lib_path=clean_code_path, percentage=Slider(47.629, range=0..100), seed=Slider(1000, range=0..1000), length=crv_l)  # -> out, in_out; inputs seed: Int32
# ---------- inout: Python ----------
import sys

sys.path.append(lib_path)

import patterns as pt
reload(pt)

in_out = pt.InOut(
    percentage * .01,
    seed
)
# ---------- end inout ----------
dotmap = GhPythonScript(
    lib_path=clean_code_path,
    x_spacing=Slider(45, range=0..100),
    y_spacing=Slider(45, range=0..100),
    half_spacing=Toggle(True),
    b_pt=pt_3,
    with_in_out=Toggle(True),
    in_out_class=inout.in_out,
    direction=Toggle(True))  # -> out, dot_map; inputs half_spacing: Boolean, b_pt: Point3d, with_in_out: Boolean, direction: Boolean
# ---------- dotmap: Python ----------
import sys

sys.path.append(lib_path)

import patterns as pt
reload(pt)

dot_map = pt.DotMap(
    x_spacing = y_spacing,
    y_spacing = y_spacing,
    half_spacing = half_spacing,
    b_pt = b_pt,
    in_out_class = in_out_class if with_in_out else None,
    direction = direction
)
# ---------- end dotmap ----------

# ----
div_l = Number(item.Item1)
lay_h = Number(item.Item2)
pt_4 = ConstructPoint(XCoordinate=Slider(0, range=0..100), YCoordinate=Slider(0, range=0..100), ZCoordinate=0)
pt_5 = ConstructPoint(XCoordinate=Slider(0, range=0..100), YCoordinate=Slider(0, range=0..100), ZCoordinate=0)
end = EndPoints(Curve=pline_2)  # -> Start, End

# ---- group: pattern settings
python_5 = GhPythonScript()  # -> out, a
# ---------- python_5: Python ----------
a = [[2, 1, 1], [1, 2, 3], [0, 1, 2]]
# ---------- end python_5 ----------

# ----
crv_cp = CurveClosestPoint(Point=end.Start, Curve=pline_3)  # -> Point, Parameter, Distance
layer_height = Number(number_slider_2)
number_slider_8 = Slider(3, range=0..10)

rad = Radians(Degrees=Slider(30, range=0..1000))
pt_6 = Point(pt_5)
sinwave = GhPythonScript(
    lib_path=clean_code_path,
    period=Slider(50, range=0..100),
    amplitude=Slider(15, range=0..100),
    dir_angle=rad,
    b_pt=pt_6,
    edge_easing=pyramidpattern.edge_easing)  # -> out, sin_wave; inputs b_pt: Point3d
# ---------- sinwave: Python ----------
import sys

sys.path.append(lib_path)

import patterns as pt
reload(pt)

sin_wave = pt.SinWave(
    period, 
    amplitude, 
    dir_angle,
    b_pt,
    edge_easing
)
# ---------- end sinwave ----------

ellipsoidpattern = GhPythonScript(
    lib_path=clean_code_path,
    radius=Slider(10, range=0..100),
    amplitude=Slider(10, range=0..100),
    y_scale=Slider(2, range=0.01..10),
    dot_map=dotmap.dot_map,
    edge_easing=pyramidpattern.edge_easing)  # -> out, ellipsoid_pattern
# ---------- ellipsoidpattern: Python ----------
import sys

sys.path.append(lib_path)

import patterns as pt
reload(pt)

ellipsoid_pattern = pt.EllipsoidPattern(
    radius,
    amplitude,
    y_scale,
    dot_map,
    edge_easing
)
# ---------- end ellipsoidpattern ----------

cylinderpattern = GhPythonScript(
    lib_path=clean_code_path,
    radius_a=Slider(10, range=0..100),
    radius_b=Slider(22.812, range=0..100),
    height=Slider(40.644, range=0..100),
    amplitude=Slider(25, range=0..100),
    dot_map=dotmap.dot_map,
    edge_easing=pyramidpattern.edge_easing)  # -> out, cylinder_pattern
# ---------- cylinderpattern: Python ----------
import sys

sys.path.append(lib_path)

import patterns as pt
reload(pt)

cylinder_pattern = pt.CylinderPattern(
    radius_a,
    radius_b,
    height,
    amplitude,
    dot_map,
    edge_easing
)
# ---------- end cylinderpattern ----------

pyramidpattern_2 = GhPythonScript(
    lib_path=clean_code_path,
    radius=Slider(10, range=0..100),
    amplitude=Slider(10, range=0..100),
    y_scale=Slider(1, range=0.01..10),
    dot_map=dotmap.dot_map,
    edge_easing=pyramidpattern.edge_easing)  # -> out, pyramid_pattern
# ---------- pyramidpattern_2: Python ----------
import sys

sys.path.append(lib_path)

import patterns as pt
reload(pt)

pyramid_pattern = pt.PyramidPattern(
    radius,
    amplitude,
    y_scale,
    dot_map,
    edge_easing
)
# ---------- end pyramidpattern_2 ----------

layermap = GhPythonScript(
    lib_path=clean_code_path,
    spacing=Slider(50, range=0..100),
    pattern_set=python_5.a,
    radius=Slider(20, range=0..100),
    amplitude=Slider(20, range=0..100),
    length=crv_l,
    layer_spacing=lay_h,
    direction=Toggle(False),
    periodic=Toggle(False),
    b_pt=pt_4,
    edge_easing=pyramidpattern.edge_easing)  # -> out, layer_map; inputs pattern_set: list, direction: Boolean, b_pt: Point3d
# ---------- layermap: Python ----------
import sys

sys.path.append(lib_path)

import patterns as pt
reload(pt)

layer_map = pt.LayerMap(
    spacing,
    pattern_set,
    length,
    layer_spacing,
    radius,
    amplitude,
    direction,
    periodic,
    b_pt,
    edge_easing
)
# ---------- end layermap ----------

tpms = TPMS(Wavelength=Slider(98, range=0..100), type=0)
crv_cp_2 = CurveClosestPoint(Point=crv_cp.Point, Curve=pline_2)  # -> Point, Parameter, Distance
python_6 = GhPythonScript(t=crv_cp.Parameter, crv=pline_3)  # -> out, crv; inputs crv: Curve
# ---------- python_6: Python ----------
crv.ChangeClosedCurveSeam(t)
# ---------- end python_6 ----------
series = Series(Start=start_height, Step=layer_height, Count=Slider(1, range=1..15))
add = Add(DistanceObject=tpms, Addend=Slider(2, range=0..10))
addition = Addition(A=crv_cp.Point, B=crv_cp_2.Point)
ln = Line(StartPoint=crv_cp.Point, EndPoint=crv_cp_2.Point)
toggle = BooleanToggle(True)
toggle_2 = BooleanToggle(True)
neg = Negative(Value=number_slider_8)
Z_3 = UnitZ(Factor=series)
move_3 = Move(Geometry=python_6.crv, Motion=Z_3)  # -> Geometry, Transform
neg_2 = Negative(Value=number_slider_8)
multiplication_2 = Multiplication(A=addition, B=0.5)
tpms_distance_object_modifier = TPMSD(Wavelength=Slider(25, range=0..100), Modulator=add, type=0)

number_slider_9 = Slider(6, range=0..100)
pt_7 = Point(pt_5)
axolotlflat = GhPythonScript(
    lib_path=clean_code_path,
    sdf=tpms_distance_object_modifier,
    amplitude=number_slider_9,
    direction=toggle_2,
    b_pt=pt_7,
    edge_easing=pyramidpattern.edge_easing)  # -> out, axolotl_flat; inputs direction: Boolean, b_pt: Point3d
# ---------- axolotlflat: Python ----------
import sys

sys.path.append(lib_path)

import patterns as pt
reload(pt)

axolotl_flat = pt.AxolotlFlat(
    sdf, 
    amplitude, 
    direction,
    b_pt,
    edge_easing
)
# ---------- end axolotlflat ----------

number_slider_10 = Slider(6, range=0..100)
pt_8 = Point(pt_5)
axolotlspatial = GhPythonScript(
    lib_path=clean_code_path,
    sdf=tpms_distance_object_modifier,
    amplitude=number_slider_9,
    direction=toggle_2,
    b_pt=pt_8,
    edge_easing=pyramidpattern.edge_easing)  # -> out, axolotl_spatial; inputs direction: Boolean, b_pt: Point3d
# ---------- axolotlspatial: Python ----------
import sys

sys.path.append(lib_path)

import patterns as pt
reload(pt)

axolotl_spatial = pt.AxolotlSpatial(
    sdf, 
    amplitude, 
    direction,
    b_pt,
    edge_easing
)
# ---------- end axolotlspatial ----------

divide = DivideCurve(Curve=move_3.Geometry, Count=1, Kinks=True)  # -> flatten(Points), Tangents, Parameters
scale = Scale(Geometry=ln, Center=multiplication_2, Factor=0.5)  # -> Geometry, Transform
item_2 = ListItem(List=divide.Points, Index=0, Wrap=True)
merge = Merge(Data1=flatten(move.Geometry), Data2=flatten(divide.Points), Data3=flatten(item_2))
clean = CleanTree(RemoveNulls=True, RemoveInvalid=True, RemoveEmpty=False, Tree=end.Start)
offset_3 = OffsetCurve(Curve=scale.Geometry, Distance=1, Plane=PlaneXY(0, 0, 0), Corners=1)

# ---- group: connect patterns here!
python_7 = GhPythonScript(x=slicing_structuring.layers, pattern=axolotlspatial.axolotl_spatial)  # -> out, crvs; inputs x: list
# ---------- python_7: Python ----------
import Rhino.Geometry as rg

a_list, b_list = x

crvs = []

for i, vs in enumerate(a_list):
    
    pts = []
    
    for v in vs:
        pts.append(pattern.apply(v))
    
    pts.extend(b_list[i])
    
    crvs.append(rg.Polyline(pts + [pts[0]]))
# ---------- end python_7 ----------
crv_4 = Curve(python_7.crvs)

# ----
pline_4 = PolyLine(Vertices=merge, Closed=False)
nozzlesettings_2 = GhPythonScript(x=flatten(manualnozzloverwrite))  # -> out, extrusion_rate, spacing_cross, spacing_paths, spacing_link, start_stop_retraction, start_reextrusion_rate
# ---------- nozzlesettings_2: Python ----------
import scriptcontext as sc

extrusion_rate = sc.sticky["PrintSettings"]["print_extrusion_rate"]
spacing_cross = sc.sticky["PrintSettings"]["print_spacing_cross"]
spacing_paths = sc.sticky["PrintSettings"]["print_spacing_paths"]
spacing_link = sc.sticky["PrintSettings"]["print_spacing_link"]
start_stop_retraction = sc.sticky["PrintSettings"]["print_spacing_start_stop_retraction"]
start_reextrusion_rate = sc.sticky["PrintSettings"]["print_spacing_start_reextrusion_rate"]

print(True)
# ---------- end nozzlesettings_2 ----------
pt_9 = Point(clean)
panel_4 = Panel(python_7.out)
pdecon = Deconstruct(Point=pt_9)  # -> XComponent, YComponent, ZComponent
path_mapper = PathMapper(crv_4, source="{A;B;C;D}", target="{A;B;C}")

spacing_inter_paths = Number(nozzlesettings_2.spacing_paths)
spacing_link_exterior = Number(nozzlesettings_2.spacing_link)
spacing_cross = Number(nozzlesettings_2.spacing_cross)

line = Line(Line((-27.46198946, 138.4851678, 0), (-0.1413537679, -0.6893088134, 0)))

# ---- group: — Shell Setup —
list_2 = ValueList({"detached", "crossing"}, selected="detached")
list_3 = ValueList({"Inside": "inside", "Outside": "outside"}, selected="Outside")
# amount of layers per shell
# 
# Outside/Inside : which layer would be printed first or last
# 
# Split line = location of the seam
# 
# Side Bool = external or left or right.?
toggle_3 = BooleanToggle(True)
python_8 = GhPythonScript(
    x=library_path_2,
    crvs=path_mapper,
    shell_spacing=spacing_inter_paths,
    direction=list_3,
    count=Slider(1, range=0..10),
    split_distance=spacing_cross,
    split_type=list_2,
    split_line=line,
    side_bool=toggle_3)  # -> out, a, b, link_inner_crvs, main_inner_crvs, outer_crvs, pt_sets; inputs crvs: list of Curve, count: Int32, side_bool: Boolean
# ---------- python_8: Python ----------
import sys
import Rhino.Geometry as rg

sys.path.append(x)

# print(sys.path)

import generalFunctions as gf
import layerFunctions as lf
import scriptcontext as sc

sc.sticky["PrintSettings"]["shell_count"] = count
sc.sticky["PrintSettings"]["shell_direction"] = direction
sc.sticky["PrintSettings"]["shell_spacing"] = shell_spacing
sc.sticky["PrintSettings"]["shell_split_distance"] = split_distance
sc.sticky["PrintSettings"]["shell_split_type"] = split_type


reload(gf)
reload(lf)

o_crv_sets = []
outer_crvs = []

if count > 1:

    for crv_i, crv in enumerate(crvs):
        
        print(crv_i)
    
        o_crv_set = gf.offsetCurveSet(crv, shell_spacing, direction, count)
        layer_set = lf.LinkingLayers(o_crv_set, split_distance, side_bool, split_type, split_line)
        layer_set.createOrganisedCurves()
        pt_set = layer_set.joinCrvs()
    
        pt_set = pt_set[1:-1] + [pt_set[1]]
    
        crv = rg.Polyline(pt_set).ToPolylineCurve()
    
        o_crv_sets.append(o_crv_set)
        outer_crvs.append(crv)
        
else:
    
    outer_crvs = crvs

o_type = rg.CurveOffsetCornerStyle.Sharp

main_inner_crvs = []
link_inner_crvs = []

if count == 1:
    
    for crv in crvs:
        
        print(crv)
    
        main_inner_crv = crv
        
        pln = rg.Plane(main_inner_crv.PointAt(0.0), rg.Vector3d(0,0,1))
        
        sim = rg.CurveSimplifyOptions.All
        main_inner_crv = main_inner_crv.Simplify(sim, 10., 1.)
        
        try:
            link_inner_crv = main_inner_crv.Offset(pln, -shell_spacing, .01, o_type)[0]
        except:
            print("I Failed :/")
            print(main_inner_crv)
        
        main_inner_crvs.append(main_inner_crv)
        link_inner_crvs.append(link_inner_crv)

elif direction == "outside":
    
    for o_crv_set in o_crv_sets:
    
        main_inner_crv = rg.Polyline(o_crv_set[0]).ToPolylineCurve()
        
        pln = rg.Plane(main_inner_crv.PointAt(0.0), rg.Vector3d(0,0,1))
        
        link_inner_crv = main_inner_crv.Offset(pln, -shell_spacing, .01, o_type)[0]
        
        main_inner_crvs.append(main_inner_crv)
        link_inner_crvs.append(link_inner_crv)
    
else:
    
    for o_crv_set in o_crv_sets:
    
        main_inner_crv = rg.Polyline(o_crv_set[0]).ToPolylineCurve()
        
        pln = rg.Plane(main_inner_crv.PointAt(0.0), rg.Vector3d(0,0,1))
        
        link_inner_crv = main_inner_crv.Offset(pln, -shell_spacing, .01, o_type)[0]
        
        main_inner_crvs.append(main_inner_crv)
        link_inner_crvs.append(link_inner_crv)
# ---------- end python_8 ----------

# ----
start_stop_feedrate_in_mm_min = Slider(100, range=0..1000)
number_slider_11 = Slider(1, range=0..1)  # disabled
number_slider_12 = Slider(0.5, range=0..1)  # disabled
pt_10 = Point(given_points)
number_slider_13 = Slider(1, range=0..10)  # disabled
list_4 = ValueList({"start / stop": "start_stop", "continious"}, selected="continious")
scale_2 = Scale(Geometry=merge, Center=Point(0, 0, 0), Factor=shrinkage.scale_value)  # -> Geometry, Transform
brep = Brep(extr)  # disabled
number_slider_14 = Slider(0.5, range=0..1)  # disabled
pin_only_heights = Number(python.pin_only_heights)
library_path_3 = FilePath(library_path_2)

# ---- group: — PIN Setup —
python_9 = GhPythonScript(
    x=library_path_3,
    pin_pts=flatten(pt_10),
    connection_count=Slider(3, range=1..4),
    max_main_line=Slider(100, range=25..250),
    start_end_alfa=Slider(1.571, range=0..3.142),
    mid_alfa=Slider(0.5, range=0..3.142),
    pin_height=Slider(260, range=0..1000),
    bot_rad=Slider(35, range=0..100),
    top_rad=Slider(18, range=0..100),
    resolution=Slider(16, range=0..100),
    spacing=spacing_link_exterior)  # -> out, main_links, side_links, split_lines, pin_pt_sets, pins, mid_links, link_line_vis, pin_geo, extra_pts; inputs pin_pts: list of Point3d, connection_count: Int32, resolution: Int32
# ---------- python_9: Python ----------
import sys

sys.path.append(x)

import pinLinkingBis as pl

reload(pl)

main_links, link_lines, split_lines, pin_pt_sets, mid_links, b_mid_pts = pl.createLinks(
    pin_pts = pin_pts,
    connection_count = connection_count,
    max_main_line = max_main_line,
    start_end_alfa = start_end_alfa,
    mid_alfa = mid_alfa
)

link_line_vis = link_lines

main_links = pl.linkSetGeneration(main_links, spacing)
side_links = pl.linkSetGeneration(link_lines, spacing, 2)
mid_links = pl.linkSetGeneration(mid_links, spacing, 2)

extra_pts = []

for i, b_pt_set in enumerate(b_mid_pts):
    
    extra_pts.extend(pl.linkClosestPoints(main_links[i], b_pt_set))

pins = pl.pinMaker(pin_pts, pin_height, bot_rad, top_rad, resolution)

pin_geo = []

for pin in pins:
    
    pin_geo.append(pin.createGeometry())
# ---------- end python_9 ----------

# ----
python_10 = GhPythonScript(x=python_9.pins, y=Slider(160, range=0..250))  # -> out, a
# ---------- python_10: Python ----------
x.res_delta = 6.2831852 / 60
a = x.createSlice(100.)
# ---------- end python_10 ----------
project_3 = Project(Geometry=flatten([python_10.a, ptdividelen]), Plane=PlaneXY(0, 0, 0))  # -> Geometry, Transform
python_11 = GhPythonScript(x=project_3.Geometry)  # -> out, a; inputs x: list of Point3d
# ---------- python_11: Python ----------
v_string_list = []

for v in x:
    v_string_list.append((v.X, v.Y, v.Z))
    
print(v_string_list)
# ---------- end python_11 ----------
panel_5 = Panel(python_11.out)
panel_6 = Panel(python_8.out)
dist = Distance()  # disabled
bbox = BoundingBox(Content=brep, Plane=PlaneXY(0, 0, 0))  # -> Box, Box_2; disabled
end_link_curve = Curve(graft(python_8.main_inner_crvs))
side_link_curve = Curve(graft(python_8.link_inner_crvs))
debox = DeconstructBox(Box=bbox.Box_2)  # -> Plane, X, Y, Z; disabled
dedomain = DeconstructDomain(Domain=debox.Z)  # -> Start, End; disabled
subtraction = Subtraction(A=dedomain.End, B=dedomain.Start)  # disabled
value_list = ValueList({"marieGriesmar": "", "lehmHuus": "_lehmHuus"}, selected="marieGriesmar")
Z_4 = UnitZ(Factor=subtraction)  # disabled
pt_11 = Point()  # disabled
python_12 = GhPythonScript(x=slicing_structuring.layers)  # -> out, a; inputs x: list; disabled
# ---------- python_12: Python ----------
a, b = x

first_layer = a[0]

a = [v.v for v in first_layer]
# ---------- end python_12 ----------
python_13 = GhPythonScript(x=slicing_structuring.layers, pattern=cylinderpattern.cylinder_pattern)  # -> out, crvs; inputs x: list; disabled; same code as python_7
number_slider_15 = Slider(0.5, range=0..1)  # disabled
project_4 = Project(Geometry=python_12.a, Plane=PlaneXY(0, 0, 0))  # -> Geometry, Transform; disabled
intcrv = Interpolate(Vertices=project_4.Geometry, Degree=3, Periodic=False, KnotStyle=1)  # -> Curve, Length, Domain; disabled
extr_2 = Extrude(Base=intcrv.Curve, Direction=Z_4)  # disabled
pline_5 = PolyLine(Vertices=project_4.Geometry, Closed=False)  # disabled
len = Length(Curve=pline_5)  # disabled
savefile = Button()
mesh = Mesh(python_9.pin_geo)
mesh_2 = Mesh(graft(mesh))
bbox_2 = BoundingBox(Content=mesh_2, Plane=PlaneXY(0, 0, 0))  # -> Box, Box_2
debox_2 = DeconstructBox(Box=bbox_2.Box)  # -> Plane, X, Y, Z
dedomain_2 = DeconstructDomain(Domain=debox_2.Z)  # -> Start, End
Z_5 = UnitZ(Factor=dedomain_2.Start)
Z_6 = UnitZ(Factor=dedomain_2.End)
xy = XYPlane(Origin=Z_5)
xy_2 = XYPlane(Origin=Z_6)
sec = MeshPlane(Mesh=mesh_2, Plane=xy_2)
sec_2 = MeshPlane(Mesh=mesh_2, Plane=xy)
bbox_3 = BoundingBox(Content=sec_2, Plane=PlaneXY(0, 0, 0))  # -> Box, Box_2
bbox_4 = BoundingBox(Content=sec, Plane=PlaneXY(0, 0, 0))  # -> Box, Box_2
debox_3 = DeconstructBox(Box=bbox_3.Box)  # -> Plane, X, Y, Z
debox_4 = DeconstructBox(Box=bbox_4.Box)  # -> Plane, X, Y, Z
dedomain_3 = DeconstructDomain(Domain=debox_3.Z)  # -> Start, End
dedomain_4 = DeconstructDomain(Domain=debox_3.X)  # -> Start, End
dedomain_5 = DeconstructDomain(Domain=debox_3.Y)  # -> Start, End
dedomain_6 = DeconstructDomain(Domain=debox_4.Z)  # -> Start, End
dedomain_7 = DeconstructDomain(Domain=debox_4.X)  # -> Start, End
dedomain_8 = DeconstructDomain(Domain=debox_4.Y)  # -> Start, End
subtraction_2 = Subtraction(A=dedomain_4.End, B=dedomain_4.Start)
addition_2 = Addition(A=dedomain_4.Start, B=dedomain_4.End)
addition_3 = Addition(A=dedomain_5.Start, B=dedomain_5.End)
subtraction_3 = Subtraction(A=dedomain_7.End, B=dedomain_7.Start)
addition_4 = Addition(A=dedomain_7.Start, B=dedomain_7.End)
addition_5 = Addition(A=dedomain_8.Start, B=dedomain_8.End)
division = Division(A=addition_2, B=2)
division_2 = Division(A=addition_3, B=2)
division_3 = Division(A=addition_4, B=2)
division_4 = Division(A=addition_5, B=2)
division_5 = Division(A=subtraction_2, B=2)
division_6 = Division(A=subtraction_3, B=2)
pt_12 = ConstructPoint(XCoordinate=division, YCoordinate=division_2, ZCoordinate=dedomain_3.Start)
pt_13 = ConstructPoint(XCoordinate=division_3, YCoordinate=division_4, ZCoordinate=dedomain_6.Start)
cir = Circle(Plane=pt_12, Radius=division_5)
cir_2 = Circle(Plane=pt_13, Radius=division_6)
offset_4 = OffsetCurve(Curve=cir, Distance=neg, Plane=PlaneXY(0, 0, 0), Corners=1)
offset_5 = OffsetCurve(Curve=cir, Distance=number_slider_8, Plane=PlaneXY(0, 0, 0), Corners=1)
offset_6 = OffsetCurve(Curve=cir_2, Distance=neg_2, Plane=PlaneXY(0, 0, 0), Corners=1)
offset_7 = OffsetCurve(Curve=cir_2, Distance=number_slider_8, Plane=PlaneXY(0, 0, 0), Corners=1)
merge_2 = Merge(Data1=offset_4, Data2=offset_6)
merge_3 = Merge(Data1=offset_5, Data2=offset_7)
loft = Loft(Curves=merge_2, Options={Adjust=False, Closed=False, LoftEnds=0, LoftSimp=0, LoftType=0, Rebuild=10, Refit=0.01})
loft_2 = Loft(Curves=merge_3, Options={Adjust=False, Closed=False, LoftEnds=0, LoftSimp=0, LoftType=0, Rebuild=10, Refit=0.01})
cap_2 = CapHoles(Brep=loft_2)
cap_3 = CapHoles(Brep=loft)
merge_4 = Merge(Data1=flatten(cap_2), Data2=cap)
sunion = SolidUnion(Breps=merge_4)  # disabled
sdiff = SolidDifference(BrepsA=sunion, BrepsB=flatten(cap_3))  # disabled

# ---- group: visualization
loft_3 = Loft(Curves=python_7.crvs, Options={Adjust=False, Closed=False, LoftEnds=0, LoftSimp=0, LoftType=0, Rebuild=10, Refit=0.01})
col = Colour(RGB(230, 136, 37))
merge_5 = Merge(Data1=loft_3, Data2=mesh)  # -> flatten(Result)
gate = StreamGate(Stream=merge_5, Gate=Toggle(True))  # -> Target0, Target1
preview = CustomPreview(Geometry=gate.Target1, Material=col)

# ----
mesh_3 = Mesh(sdiff)  # disabled
cluster = Cluster(M=mesh_3, L=number_slider_13, B=brep, B_2=number_slider_11)  # disabled
cluster_2 = Cluster(M=cluster, L=number_slider_13, B=brep, B_2=number_slider_12)  # disabled
wbsplitquads = WeaverbirdsConstantQuadsSplitSubdivision(MeshCurves=cluster_2, Level=number_slider_13, SmoothNakedEdges=1)  # disabled
demesh = DeconstructMesh(Mesh=wbsplitquads)  # -> Vertices, Faces, Colours, Normals; disabled
brep_cp = BrepClosestPoint(Point=demesh.Vertices, Brep=extr_2)  # -> Point, Normal, Distance; disabled
pt_14 = Point(demesh.Vertices)  # disabled
merge_6 = Merge(Data1=graft(demesh.Vertices), Data2=graft(brep_cp.Point))  # disabled
project_5 = Project(Geometry=pt_14, Plane=PlaneXY(0, 0, 0))  # -> Geometry, Transform; disabled
item_3 = ListItem(List=merge_6, Index=0, Wrap=True)  # -> flatten(Item); disabled
conmesh = ConstructMesh(Vertices=item_3, Faces=demesh.Faces)  # disabled
panel_7 = Panel(python_9.out)
crvdom = CurveDomain(Curve=pline_5, Domain=len)  # -> Curve, Domain; disabled
medges = MeshEdges(Mesh=conmesh)  # -> NakedEdges, InteriorEdges, NonManifoldEdges; disabled
crv_cp_3 = CurveClosestPoint(Point=project_5.Geometry, Curve=crvdom.Curve)  # -> Point, Parameter, Distance; disabled
pdecon_2 = Deconstruct(Point=pt_14)  # -> XComponent, YComponent, ZComponent; disabled

# ---- group: Main Link connection / Offset Pins Layers
number_slider_16 = Slider(3, range=0..10)
number_slider_17 = Slider(3, range=0..10)

# ----
python_14 = GhPythonScript(pin=python_9.pins, pin_heights=pin_only_heights)  # -> out, slices; inputs pin_heights: list
# ---------- python_14: Python ----------
slices = []

for h in pin_heights:
    
    slices.append(pin.createSlice(h))
# ---------- end python_14 ----------
item_4 = ListItem(List=pin_only_heights, Index=0, Wrap=True)  # -> Item1, Item

# ---- group: Main Link connection
python_15 = GhPythonScript(x=flatten(end_link_curve))  # -> out, flatten(heights), flatten(index); inputs x: list of Curve
# ---------- python_15: Python ----------
heights = []
index = []

for crv_i, crv in enumerate(x):
    
    heights.append(crv.PointAt(0.0).Z)
    index.append(crv_i)
# ---------- end python_15 ----------
python_16 = GhPythonScript(
    x=library_path_3,
    main_links=flatten(python_9.main_links),
    pins=flatten(python_9.pins),
    link_set=flatten(python_9.side_links),
    heights=flatten(python_15.heights),
    count=flatten(python_15.index),
    bottom_shift_count=number_slider_16,
    bottom_max_shift=number_slider_17)  # -> out, graft(main_crv), b, c, inner_crvs, main_crv_pt_set, main_links; inputs main_links: list, pins: list, link_set: list
# ---------- python_16: Python ----------
import sys

sys.path.append(x)

import pinLinkingBis as pl

reload(pl)

if count < bottom_shift_count:
    
    print("I am shifting the bottom layer with: ")
    
    count_delta = bottom_max_shift / float(bottom_shift_count)
    
    bottom_offset = count_delta * (bottom_shift_count - count)
    print("bottom offset: %s" % bottom_offset)
    
else:
    
    bottom_offset = None

main_crv, b, main_links, inner_crvs = pl.makeMainShape(pins, main_links, heights, bottom_offset)
# ---------- end python_16 ----------

# ---- group: Interconnections - code
python_17 = GhPythonScript(side_links=python_9.side_links, end_link_index=Slider(1, range=0..100))  # -> out, flatten(side_links), flatten(end_link), end_link_vis; inputs side_links: list, end_link_index: Int32
# ---------- python_17: Python ----------
import Rhino.Geometry as rg
from copy import deepcopy as dc

side_link_count = len(side_links)

end_link_index = end_link_index % side_link_count

end_link = side_links.pop(end_link_index)

# visualisation of the end link

end_link_vis = dc(end_link.lines)

for end_link_line in end_link_vis:
    
    sc_m = rg.Transform.Scale(end_link_line.From, 100.0)
    
    end_link_line.Transform(sc_m)
# ---------- end python_17 ----------
path_mapper_2 = PathMapper(python_16.main_crv, source="{A;B}", target="{B}")
path_mapper_3 = PathMapper(side_link_curve, source="{A;B;C;D;E}", target="{E}")
path_mapper_4 = PathMapper(end_link_curve, source="{A;B;C;D;E}", target="{E}")
midlinks = GhPythonScript(x=library_path_3, mid_links=flatten(python_9.mid_links), interior_crv=path_mapper_2, exterior_crv=path_mapper_3)  # -> out, output_mid_links, mid_link_lines; inputs mid_links: list, interior_crv: Curve, exterior_crv: Curve
# ---------- midlinks: Python ----------
import Rhino.Geometry as rg
from copy import deepcopy as dc

import sys

sys.path.append(x)

height_val = interior_crv.PointAt(0.0).Z

mv_m = rg.Transform.Translation(rg.Vector3d(0,0,height_val))

mid_link_lines = []

print(type(exterior_crv))

output_mid_links = []

for mid_link in mid_links:
    
    loc_link = dc(mid_link)
    loc_link.Transform(mv_m)
    
    loc_link.trimLines(exterior_crv, True)
    loc_link.trimLines(interior_crv, False)
    
    output_mid_links.append(loc_link)
    
    mid_link_lines.extend(loc_link.lines)
    
print(mid_link_lines[0].To.Z)
# ---------- end midlinks ----------
python_18 = GhPythonScript(x=library_path_3, end_link=flatten(python_17.end_link), interior_crv=path_mapper_2, exterior_crv=path_mapper_4)  # -> out, graft(output_end_link), side_link_lines; inputs interior_crv: Curve, exterior_crv: Curve
# ---------- python_18: Python ----------
import Rhino.Geometry as rg
from copy import deepcopy as dc

import sys

sys.path.append(x)

height_val = interior_crv.PointAt(0.0).Z

mv_m = rg.Transform.Translation(rg.Vector3d(0,0,height_val))
    
output_end_link = dc(end_link)
output_end_link.Transform(mv_m)
    
output_end_link.trimLines(exterior_crv, True)
output_end_link.trimLines(interior_crv, False)

side_link_lines = dc(output_end_link.lines)
# ---------- end python_18 ----------
python_19 = GhPythonScript(x=library_path_3, side_links=flatten(python_17.side_links), interior_crv=path_mapper_2, exterior_crv=path_mapper_3)  # -> out, output_side_links, side_link_lines; inputs side_links: list, interior_crv: Curve, exterior_crv: Curve
# ---------- python_19: Python ----------
import Rhino.Geometry as rg
from copy import deepcopy as dc

import sys

sys.path.append(x)

height_val = interior_crv.PointAt(0.0).Z

mv_m = rg.Transform.Translation(rg.Vector3d(0,0,height_val))

side_link_lines = []

print(type(exterior_crv))

output_side_links = []

for side_link in side_links:
    
    loc_link = dc(side_link)
    loc_link.Transform(mv_m)
    
    loc_link.trimLines(exterior_crv, True)
    loc_link.trimLines(interior_crv, False)
    
    output_side_links.append(loc_link)
    
    side_link_lines.extend(loc_link.lines)
    
print(side_link_lines[0].To.Z)
# ---------- end python_19 ----------

# ----
pt_15 = ConstructPoint(XCoordinate=crv_cp_3.Parameter, YCoordinate=pdecon_2.ZComponent, ZCoordinate=0)  # disabled
subtraction_4 = Subtraction()  # disabled
python_20 = GhPythonScript(o=item_3, n=brep_cp.Normal, v=pt_15)  # -> out, vs; inputs o: list of Point3d, n: list of Point3d, v: list of Point3d; disabled
# ---------- python_20: Python ----------
class Vrtx:
    def __init__(self, o, n, v, is_neg=False):

        self.o = o
        self.v = o
        
        self.n = n
        self.n_scale = 1.0

        self.x_val = v.X
        self.y_val = v.Y

        self.vec_version = v

        self.is_neg = is_neg
        
        
        
vs = []
for loc_o, loc_n, loc_v in zip(o, n, v):
    vs.append(Vrtx(loc_o, loc_n, loc_v))
# ---------- end python_20 ----------
number_slider_18 = Slider(50, range=0..100)  # disabled
number_slider_19 = Slider(2, range=0..10)  # disabled
crv_5 = Curve(python_14.slices)
panel_8 = Panel(path_mapper_4)
python_21 = GhPythonScript(vs=python_20.vs, pattern=sinwave.sin_wave)  # -> out, pts; inputs vs: list; disabled
# ---------- python_21: Python ----------
pts = []
for v in vs:
    pts.append(pattern.apply(v))
# ---------- end python_21 ----------
num_2 = Number(brep_cp.Distance)  # disabled
panel_9 = Panel(midlinks.out)
path_mapper_5 = PathMapper(crv_5, source="{A;B;C}", target="{C}")
pt_16 = Point(item_3)  # disabled
pt_17 = Point(python_21.pts)  # disabled
subtraction_5 = Subtraction(A=number_slider_18, B=num_2)  # disabled
multiplication_3 = Multiplication(A=number_slider_18, B=number_slider_19)  # disabled
panel_10 = Panel(python_19.out)
subtraction_6 = Subtraction(A=pt_17, B=pt_16)  # disabled
division_7 = Division(A=subtraction_5, B=multiplication_3)  # disabled
panel_11 = Panel(path_mapper_5)
abs = Absolute(Value=division_7)  # disabled
library_path_4 = FilePath(library_path_3)

# ---- group: Interior Curves
line_2 = Line(flatten(python_9.split_lines))
crv_6 = Curve(python_16.inner_crvs)
layer_count = Slider(1, range=0..10)
path_mapper_6 = PathMapper(python_16.main_links, source="{C;D}", target="{D}")
path_mapper_7 = PathMapper(python_18.output_end_link, source="{D;E}", target="{D}")
path_mapper_8 = PathMapper(midlinks.output_mid_links, source="{D;E}", target="{D}")
list_5 = ValueList({"detached", "crossing"}, selected="crossing")
list_6 = ValueList({"Inside": "inside", "Outside": "outside"}, selected="Inside")
path_mapper_9 = PathMapper(python_19.output_side_links, source="{D;E}", target="{D}")
path_mapper_10 = PathMapper(crv_6, source="{C;D}", target="{D}")
python_22 = GhPythonScript(
    x=library_path_4,
    extra_pts=flatten(python_9.extra_pts),
    main_links=path_mapper_6,
    side_links=path_mapper_9,
    end_link=path_mapper_7,
    mid_links=path_mapper_8,
    crvs=path_mapper_10,
    split_lines=line_2,
    distance=spacing_inter_paths,
    direction=list_6,
    count=layer_count,
    split_distance=spacing_cross,
    split_type=list_5,
    side_bool=Toggle(True),
    diamond_link=Toggle(True),
    safety=Toggle(True),
    main_link_length=Slider(26.1, range=0..100),
    side_length=Slider(61.3, range=0..100))  # -> out, log, b, c, d, e, pt_sets, start_and_end_pt, main_crv; inputs extra_pts: list of Point3d, main_links: list, side_links: list, mid_links: list, crvs: list of Curve, split_lines: list of Line, count: Int32, side_bool: Boolean
# ---------- python_22: Python ----------
import sys

sys.path.append(x)

# print(sys.path)

import generalFunctions as gf
import layerFunctions as lf
import Rhino.Geometry as rg
import pinLinkingBis as pl

from copy import deepcopy as dc

reload(gf)
reload(lf)
reload(pl)

log = ["new sequence start"]

diamond_settings = (diamond_link, safety, (main_link_length, side_length))

pt_sets = []

inner_crvs = []

height = crvs[0].PointAt(0.0).Z

mv_m = rg.Transform.Translation(rg.Vector3d(0,0, height))

loc_split_lines = dc(split_lines)
[line.Transform(mv_m) for line in loc_split_lines]

print loc_split_lines

crv_count = len(crvs)
print("there are %s curves in your list" % crv_count)

if count == 1:
    
    for crv in crvs:
        
        crv.Reverse()
        
    inner_crvs = crvs
    
else:
    
    for crv_i, crv in enumerate(crvs):
        
        a = gf.offsetCurveSet(crv, distance, direction, count)
        layer_set = lf.LinkingLayers(a, split_distance, side_bool, split_type, split_line = loc_split_lines[crv_i])
        # a = layer_set.split_a
        # b = layer_set.split_b
        # c = layer_set.split_line
        # d = layer_set.split_axis
        a, b, c, d, e = layer_set.createOrganisedCurves()
        
        pt_set = layer_set.joinCrvs()
        pt_set = pt_set[1:-1] + [pt_set[1]]
        
        crv = rg.Polyline(pt_set).ToPolylineCurve()
        
        inner_crvs.append(crv)

print("I passed this hurdle")

loc_extra_pts = []

for extra_pt in extra_pts:
    
    loc_pt = dc(extra_pt)
    loc_pt.Transform(mv_m)
    loc_extra_pts.append(loc_pt)
    
main_crv = pl.makeInnerCurve(inner_crvs, main_links, side_links, end_link, loc_extra_pts, mid_links, diamond_settings = diamond_settings)

print(main_crv)

start_and_end_pt = [main_crv.PointAt(main_crv.Domain[0]), main_crv.PointAt(main_crv.Domain[1])]
# ---------- end python_22 ----------

# ----
addition_6 = Addition(A=division_7, B=abs)  # disabled
multiplication_4 = Multiplication(A=addition_6, B=subtraction_6)  # disabled
# PIN - INFILL
# connections...?
# 
# 
# system, if organic shell
outer_crv = Curve(graft(python_8.outer_crvs))
addition_7 = Addition(A=multiplication_4, B=pt_16)  # disabled
pt_18 = Point(addition_7)  # disabled
conmesh_2 = ConstructMesh(Vertices=pt_18, Faces=demesh.Faces)  # disabled
preview_2 = CustomPreview(
    Geometry=conmesh_2,
    Material={diffuse=RGB(221, 160, 221), emission=RGB(66, 48, 66), shine=0.5, specular=RGB(255, 255, 255), transparency=0})  # disabled
path_mapper_11 = PathMapper(source="{A;B}", target="{A}")
pt_19 = Point(pt_10)
medges_2 = MeshEdges(Mesh=conmesh_2)  # -> NakedEdges, InteriorEdges, NonManifoldEdges; disabled
pline_6 = PolyLine(Closed=False)
panel_12 = Panel(python_22.out)

# ---- group: Background process (Layer unioning Generation)
path_mapper_12 = PathMapper(outer_crv, source="{A;B;C;D;E}", target="{E}")
path_mapper_13 = PathMapper(python_22.start_and_end_pt, source="{A;B}", target="{A}")
python_23 = GhPythonScript(x=library_path_4, start_end_pts=path_mapper_13, exterior_crv=path_mapper_12, interior_crv=python_22.main_crv)  # -> out, a; inputs start_end_pts: list of Point3d, exterior_crv: Curve, interior_crv: Curve
# ---------- python_23: Python ----------
import sys

sys.path.append(x)

import generalFunctions as gf

result_crvs, _ = gf.layer2ptIntersect(exterior_crv, start_end_pts)
pt_set = list(gf.curveToPolyline(gf.longestCurve(result_crvs)).ToArray())
pt_set_2 = list(gf.curveToPolyline(interior_crv).ToArray())

pt_set_2.reverse()

a = pt_set + pt_set_2[1:-1]
# ---------- end python_23 ----------

# ---- group: Start Point - End Point LISTS
pt_20 = Point(flatten(python_23.a))
first_point_brim = ListItem(List=pt_20, Index=0, Wrap=True)
last_point_pin = ListItem(List=pt_20, Index=0, Wrap=True)  # -> Item1, Item

# ----
endpoint = Point(last_point_pin.Item1)
helixpin = GhPythonScript(
    pins=python_9.pins,
    start_height=item_4.Item,
    start_pt=endpoint,
    end_height=number_slider_4,
    start_alfa=Slider(4.33, range=0..10),
    layer_height=number_slider_2)  # -> out, pin_helix_lists; inputs pins: list, start_pt: Point3d
# ---------- helixpin: Python ----------
pin_helix_lists = []

for i, pin in enumerate(pins):
    
    if i == 0:
        
        # first pin, which uses a start point
        
        helix = pin.helix(
            end_h = end_height,
            start_pt = start_pt,
            layer_h = layer_height
        )
        
        pin_helix_lists.append(helix)
        
    else:
        
        helix = pin.helix(
            end_h = end_height,
            start_h = start_height - layer_height * .5,
            layer_h = layer_height,
            start_alfa = start_alfa
        )
        
        pin_helix_lists.append(helix)
# ---------- end helixpin ----------

# ---- group: Seam
endpoint_2 = Point(last_point_pin.Item1)
splitlines = Line(flatten(line_2))
update_split_lines = GhPythonScript(end_pt=endpoint_2, split_lines=splitlines)  # -> out, split_lines; inputs end_pt: Point3d, split_lines: list of Line
# ---------- update_split_lines: Python ----------
end_pt.Z = 0.0
split_lines[0].To = end_pt
# ---------- end update_split_lines ----------

# ----
python_24 = GhPythonScript(x=helixpin.pin_helix_lists)  # -> out, points
# ---------- python_24: Python ----------
import Rhino.Geometry as rg

print(len(x))

points = [rg.Point3d(pt) for pt in x]
# ---------- end python_24 ----------
item_5 = ListItem(List=helixpin.pin_helix_lists, Index=0, Wrap=True)  # -> Item, Item1
path_mapper_14 = PathMapper(python_24.points, source="{A;B;C;D}", target="{D}")
nozzlesettings_3 = GhPythonScript(x=flatten(nozzlesettings_2.out))  # -> out, feed_rate, variable_feed_rate, feed_rate_max, feed_rate_max_start_start_ramp, feed_rate_max_end_start_ramp, feed_rate_max_start_end_ramp, feed_rate_max_end_end_ramp
# ---------- nozzlesettings_3: Python ----------
import scriptcontext as sc

feed_rate = sc.sticky["PrintSettings"]["feed_rate"]
variable_feed_rate = sc.sticky["PrintSettings"]["feed_rate_variable"]

if variable_feed_rate:
    
    feed_rate_max = sc.sticky["PrintSettings"]["feed_rate_max"]
    feed_rate_max_start_start_ramp = sc.sticky["PrintSettings"]["feed_rate_max_end_start_ramp"]
    feed_rate_max_end_start_ramp = sc.sticky["PrintSettings"]["feed_rate_max_end_start_ramp"]
    feed_rate_max_start_end_ramp = sc.sticky["PrintSettings"]["feed_rate_max_start_end_ramp"]
    feed_rate_max_end_end_ramp = sc.sticky["PrintSettings"]["feed_rate_max_end_end_ramp"]
    
print(True)
# ---------- end nozzlesettings_3 ----------

# ---- group: Nozzle-Set@Start
nozzlesettings_4 = GhPythonScript(x=flatten(nozzlesettings_3.out))  # -> out, extrusion_rate, spacing_cross, spacing_paths, spacing_link, start_stop_retraction, start_reextrusion_rate
# ---------- nozzlesettings_4: Python ----------
import scriptcontext as sc

extrusion_rate = sc.sticky["PrintSettings"]["print_extrusion_rate"]
spacing_cross = sc.sticky["PrintSettings"]["print_spacing_cross"]
spacing_paths = sc.sticky["PrintSettings"]["print_spacing_paths"]
spacing_link = sc.sticky["PrintSettings"]["print_spacing_link"]
start_stop_retraction = sc.sticky["PrintSettings"]["print_spacing_start_stop_retraction"]
start_reextrusion_rate = sc.sticky["PrintSettings"]["print_spacing_start_reextrusion_rate"]
# ---------- end nozzlesettings_4 ----------

# ----
library_path_5 = FilePath(library_path_4)
gcodelines = GhPythonScript(
    x=library_path_5,
    pts=scale_2.Geometry,
    feed_rate=nozzlesettings_3.feed_rate,
    extrusion_rate=nozzlesettings_4.extrusion_rate,
    link_type=list_4,
    global_trim_distance=Slider(0, range=0..10),
    ss_trim_distance=Slider(0, range=0..10),
    cull_distance=Slider(0, range=0..10),
    lift_val=Slider(4.4, range=0..10),
    ss_f_rate=start_stop_feedrate_in_mm_min,
    ss_e_rate=Slider(300, range=0..1000),
    variable_feed_rate=nozzlesettings_3.variable_feed_rate,
    peak_feed_rate=nozzlesettings_3.feed_rate_max,
    start_min=nozzlesettings_3.feed_rate_max_start_start_ramp,
    start_max=nozzlesettings_3.feed_rate_max_end_start_ramp,
    end_max=nozzlesettings_3.feed_rate_max_start_end_ramp,
    end_min=nozzlesettings_3.feed_rate_max_end_end_ramp)  # -> out, a, path_vis; inputs pts: list, variable_feed_rate: Boolean
# ---------- gcodelines: Python ----------
import sys

sys.path.append(x)

import Rhino.Geometry as rg
import simpleStartStop as ss

reload(ss)

# print(pts)

p_set = ss.PrintSettings(
    feed_rate = feed_rate, 
    extrusion_rate = extrusion_rate, 
    extrusion_mode = 'relative', 
    movement_mode = 'relative'
)

if variable_feed_rate:
    
    p_set.setComplexFeedrate(
        peak_feed_rate,
        min_h_ramp = (start_min, start_max),
        max_h_ramp = (end_max, end_min)
    )

l_type = ss.LinkType(
    link_type = link_type,
    global_trim_distance = global_trim_distance,
    ss_trim_distance = ss_trim_distance,
    cull_distance = cull_distance,
    lift_val = lift_val
)

l_type.ss_f_rate = ss_f_rate
l_type.ss_e_rate = ss_e_rate

gcodeset = ss.GCodeSet(pts, p_set, l_type)
a = gcodeset.generateGCode()

path_vis = gcodeset.path_vis
# ---------- end gcodelines ----------
num_3 = Number(number_slider_2)
number_slider_20 = Slider(3.5, range=0..10)
addition_8 = Addition(A=num_3, B=0.001)
value_list_2 = ValueList({"marieGriesmar": "", "lehmHuus": "_lehmHuus"}, selected="lehmHuus")
savefile_2 = Button()

# ---- group: Brim
# SETTINGS need to be externalized
number_slider_21 = Slider(25, range=10..100)
item_6 = ListItem(List=path_mapper, Index=0, Wrap=True)

# ----
simplify = SimplifyCurve(Curve=item_6)  # -> Curve, Simplified

# ---- group: Brim (continued)
divide_2 = DivideCurve(Curve=simplify.Curve, Count=1, Kinks=True)  # -> Points, Tangents, Parameters
brim = GhPythonScript(
    x=library_path_4,
    first_pt=first_point_brim,
    pts=divide_2.Points,
    offset_amount=Slider(10, range=0..10),
    start_safety_distance=number_slider_21)  # -> out, flatten(a), start_pt, outer_brim_crv, base_pt, crv; inputs first_pt: Point3d, pts: list of Point3d
# ---------- brim: Python ----------
import sys

sys.path.append(x)

import Rhino.Geometry as rg
import generalFunctions as gf
import polyline as pl

reload(pl)

crv = rg.Polyline(pts).ToPolylineCurve()
_, t_val = crv.ClosestPoint(first_pt)

print(t_val)

crv.ChangeClosedCurveSeam(t_val)

base_pt_set = list(crv.ToPolyline().ToArray())

brim_pl = pl.StructuredPolyline(base_pt_set[:-1])
brim_pl.offset(offset_amount)

pt_set = brim_pl.pointSet() + [brim_pl.pointSet()[0]]

crv = rg.Polyline(pt_set).ToPolylineCurve()
_, t_val = crv.ClosestPoint(first_pt)

print(t_val)

base_pt = crv.PointAt(t_val)
crv.ChangeClosedCurveSeam(t_val)

# base_pt = brim_pl.v_set[0]
start_pt, first_pt = base_pt, first_pt

start_pt = first_pt + (start_pt - first_pt) * (start_safety_distance / offset_amount)

# a = [rg.Point3d(start_pt)] + brim_pt_set
a = list(crv.ToPolyline().ToArray())
# ---------- end brim ----------

# ----
panel_13 = Panel(brim.out)
clean_2 = CleanTree(RemoveNulls=True, RemoveInvalid=True, RemoveEmpty=False, Tree=brim.a)
clean_3 = CleanTree(RemoveNulls=True, RemoveInvalid=True, RemoveEmpty=False, Tree=brim.start_pt)

# ---- group: START/STOP--> CODE
split = SplitTree(Data=path_mapper_14, Masks=flatten("{0}"))  # -> Positive, Negative
item_7 = ListItem(List=pt_19, Index=0, Wrap=True)  # -> Item, Item1
pdecon_3 = Deconstruct(Point=item_7.Item)  # -> XComponent, YComponent, ZComponent
pt_21 = Point(split.Negative)
extraheight = Slider(30, range=0..100)
item_8 = ListItem(List=split.Positive, Index=0, Wrap=True)  # -> Item1, Item
item_9 = ListItem(List=split.Negative, Index=0, Wrap=True)
pdecon_4 = Deconstruct(Point=item_7.Item1)  # -> XComponent, YComponent, ZComponent
pdecon_5 = Deconstruct(Point=item_8.Item1)  # -> XComponent, YComponent, ZComponent
pdecon_6 = Deconstruct(Point=item_9)  # -> XComponent, YComponent, ZComponent
addition_9 = Addition(A=extraheight, B=pdecon_5.ZComponent)
pt_22 = ConstructPoint(XCoordinate=pdecon_4.XComponent, YCoordinate=pdecon_4.YComponent, ZCoordinate=pdecon_6.ZComponent)
pt_23 = ConstructPoint(XCoordinate=pdecon_3.XComponent, YCoordinate=pdecon_3.YComponent, ZCoordinate=addition_9)
dist_2 = Distance(PointA=pt_22, PointB=item_9)
subtraction_7 = Subtraction(A=item_9, B=pt_22)
division_8 = Division(A=subtraction_7, B=dist_2)
multiplication_5 = Multiplication(A=division_8, B=extraheight)
addition_10 = Addition(A=multiplication_5, B=item_9)
pdecon_7 = Deconstruct(Point=addition_10)  # -> XComponent, YComponent, ZComponent
pt_24 = Point(clean_3)
pt_25 = ConstructPoint(XCoordinate=pdecon_7.XComponent, YCoordinate=pdecon_7.YComponent, ZCoordinate=addition_9)
pdecon_8 = Deconstruct(Point=pt_24)  # -> XComponent, YComponent, ZComponent
merge_7 = Merge(Data1=pt_23, Data2=pt_25, Data3=addition_10, Data4=item_9)  # -> flatten(Result)
pt_26 = ConstructPoint(XCoordinate=pdecon_8.XComponent, YCoordinate=pdecon_8.YComponent, ZCoordinate=extraheight)
merge_8 = Merge(Data1=pt_26, Data2=pt_24)

# ----
pt_27 = ConstructPoint(XCoordinate=pdecon.XComponent, YCoordinate=pdecon.YComponent, ZCoordinate=extraheight)
merge_9 = Merge(Data1=pt_27, Data2=pt_9)
scale_3 = Scale(Geometry=merge_9, Center=Point(0, 0, 0), Factor=shrinkage.scale_value)  # -> Geometry, Transform
starline = GhPythonScript(
    feed_rate=nozzlesettings_3.feed_rate,
    extrusion_retraction=nozzlesettings_4.start_stop_retraction,
    extra_add=nozzlesettings_4.start_reextrusion_rate,
    start_pts=scale_3.Geometry)  # -> flatten(out), a; inputs start_pts: list of Point3d
# ---------- starline: Python ----------
f_rate = feed_rate * 60.0

for i, pt in enumerate(start_pts):
    
    if i == 0:
        
        e_rate = 1

        print("G1 F{} X{} Y{} Z{} E{}".format(f_rate, pt.X, pt.Y, pt.Z, e_rate))
    
    elif i == 1:
   
        e_rate = extrusion_retraction + extra_add

        print("G1 F{} X{} Y{} Z{} E{}".format(f_rate, pt.X, pt.Y, pt.Z, e_rate))
# ---------- end starline ----------
merge_10 = Merge(Data1=flatten(starline.out), Data2=flatten(gcodelines.a))
end_start_gcode = GhPythonScript(x=library_path_5, add_header=Toggle(True), lines=flatten(merge_10), gcodeFiles=value_list)  # -> out, a; inputs add_header: Boolean, lines: list
# ---------- end_start_gcode: Python ----------
import os
import scriptcontext as sc

# creating the header of the gcode file

if add_header:
    key_list = sc.sticky["PrintSettings"].keys()
    key_list.sort()

    for key_item in key_list:
    
        print(";{} : {}".format(key_item, str(sc.sticky["PrintSettings"][key_item])) )

start_gcode_path = os.path.join(x, "GCodeDefinitions", "startGcode" + gcodeFiles + ".txt")
end_gcode_path = os.path.join(x, "GCodeDefinitions", "endGcode" + gcodeFiles + ".txt")

start_gcode = open(start_gcode_path, 'r').read()
end_gcode = open(end_gcode_path, 'r').read()

print start_gcode

for line in lines:

    print(line)

print end_gcode
# ---------- end end_start_gcode ----------
python_25 = GhPythonScript(
    y=savefile,
    x=library_path_5,
    extra_name=Toggle(False),
    extra_txt="something",
    data=flatten(end_start_gcode.out),
    extra_tag=value_list)  # -> out, a; inputs data: list
# ---------- python_25: Python ----------
import os
import scriptcontext as sc
import math
import time
import scriptcontext as sc

import sys
sys.path.append(x)

import simpleStartStop as ss

reload(ss)

try:
    
    run_timing = time.time() - sc.sticky["start_time"]
    
    if run_timing > 2.0:
    
        sc.sticky["start_time"] = time.time()
        
        run = True
        
    else:
        
        run = False
    
except:
    
    sc.sticky["start_time"] = time.time()
    
    run = True

if y and run:
    
    count_file = None
    
    try:
        count_file = os.path.join(x, "GCodeDefinitions", "countSheet.json")
    except:
        print("count file not found, it's fine")
    
    nozzle_dia = round(sc.sticky["PrintSettings"]["print_extrusion_nozzle"], 1)
    
    if not(count_file == None):
        str = ss.file_count(nozzle_dia, count_file)

    date = time.strftime("%Y%m%d")

    if extra_name:
    
        file_name = "{}_{}_{}.gcode".format(str, date, extra_txt)
    
    else:
    
        file_name = "{}_{}{}.gcode".format(str, date, extra_tag)

    save_file = os.path.join(os.path.dirname(x), "GCode", file_name)

    print save_file

    data = '\n'.join(data)

    open(save_file, "a").write(data)
# ---------- end python_25 ----------

# ----
# BRIM - BODY - 1st PIN (without Start-Stop)
merge_11 = Merge(Data1=flatten(clean_2), Data2=flatten(pt_20), Data3=flatten(split.Positive))

pt_28 = Point(item_7.Item1)

# ---- group: Internalize ?
feed_rate_in_mm_s_3 = Slider(25, range=0..100)
pdecon_9 = Deconstruct(Point=pt_28)  # -> XComponent, YComponent, ZComponent
pt_29 = ConstructPoint(XCoordinate=pdecon_9.XComponent, YCoordinate=pdecon_9.YComponent, ZCoordinate=addition_9)
python_26 = GhPythonScript(feed_rate=feed_rate_in_mm_s_3, extrusion_rate=Slider(200, range=0..1000), pts=pt_29)  # -> out, a; inputs pts: list of Point3d
# ---------- python_26: Python ----------
f_rate = feed_rate * 60.0

for pt_i, pt in enumerate(pts):
    
    if pt_i == 0:
        
        e_rate = - extrusion_rate
    
    elif pt_i == len(pts) - 1:
        
        e_rate = extrusion_rate
        
    else:
        
        e_rate = 0.0
    
    print("G1 F{} X{} Y{} Z{} E{}".format(f_rate, pt.X, pt.Y, pt.Z, e_rate))
# ---------- end python_26 ----------

# ----
pt_30 = Point(flatten(merge_11))

# ---- group: shrinkage scaling
scale_4 = Scale(Geometry=pt_30, Center=Point(0, 0, 0), Factor=shrinkage.scale_value)  # -> Geometry, Transform

scale_5 = Scale(Geometry=merge_7, Center=Point(0, 0, 0), Factor=shrinkage.scale_value)  # -> Geometry, Transform

# ---- group: START/STOP--> CODE / Restructure
extrusion_startstop_rate = Slider(150, range=-100..250)
feed_rate_in_mm_s_4 = Slider(50, range=0..100)
python_27 = GhPythonScript(
    feed_rate=nozzlesettings_3.feed_rate,
    extrusion_retraction=nozzlesettings_4.start_stop_retraction,
    extra_add=nozzlesettings_4.start_reextrusion_rate,
    pts=scale_5.Geometry)  # -> out, a; inputs pts: list of Point3d
# ---------- python_27: Python ----------
f_rate = feed_rate * 60.0

for pt_i, pt in enumerate(pts):
    
    if pt_i == 0:
        
        e_rate = - extrusion_retraction
    
    elif pt_i == len(pts) - 1:
        
        e_rate = extrusion_retraction + extra_add
        
    else:
        
        e_rate = 0.0
    
    print("G1 F{} X{} Y{} Z{} E{}".format(f_rate, pt.X, pt.Y, pt.Z, e_rate))
# ---------- end python_27 ----------

# ----
pt_31 = Point(flatten(pt_21))

# ---- group: shrinkage scaling
scale_6 = Scale(Geometry=pt_31, Center=Point(0, 0, 0), Factor=shrinkage.scale_value)  # -> Geometry, Transform

scale_7 = Scale(Geometry=merge_8, Center=Point(0, 0, 0), Factor=shrinkage.scale_value)  # -> Geometry, Transform

# ---- group: START/STOP--> CODE (continued)
starline_2 = GhPythonScript(
    feed_rate=nozzlesettings_3.feed_rate,
    extrusion_retraction=nozzlesettings_4.start_stop_retraction,
    extra_add=nozzlesettings_4.start_reextrusion_rate,
    start_pts=scale_7.Geometry)  # -> flatten(out), a; inputs start_pts: list of Point3d; same code as starline

# ---- group: G-Code
start_stop_feedrate_in_mm_min_2 = Slider(100, range=0..1000)
number_slider_22 = Slider(0, range=0..10)
number_slider_23 = Slider(0, range=0..10)
number_slider_24 = Slider(4.4, range=0..10)
number_slider_25 = Slider(0, range=0..10)
number_slider_26 = Slider(300, range=0..1000)
list_7 = ValueList({"start / stop": "start_stop", "continious"}, selected="continious")
gcodelines_2 = GhPythonScript(
    x=library_path_5,
    pts=scale_4.Geometry,
    feed_rate=nozzlesettings_3.feed_rate,
    extrusion_rate=nozzlesettings_4.extrusion_rate,
    link_type=list_7,
    global_trim_distance=number_slider_22,
    ss_trim_distance=number_slider_23,
    cull_distance=number_slider_25,
    lift_val=number_slider_24,
    ss_f_rate=start_stop_feedrate_in_mm_min_2,
    ss_e_rate=number_slider_26,
    variable_feed_rate=nozzlesettings_3.variable_feed_rate,
    peak_feed_rate=nozzlesettings_3.feed_rate_max,
    start_min=nozzlesettings_3.feed_rate_max_start_start_ramp,
    start_max=nozzlesettings_3.feed_rate_max_end_start_ramp,
    end_max=nozzlesettings_3.feed_rate_max_start_end_ramp,
    end_min=nozzlesettings_3.feed_rate_max_end_end_ramp)  # -> out, a, path_vis; inputs pts: list, variable_feed_rate: Boolean; same code as gcodelines

# ---- group: 2nd PIN + safety position
gcodelines_3 = GhPythonScript(
    x=library_path_5,
    pts=scale_6.Geometry,
    feed_rate=nozzlesettings_3.feed_rate,
    extrusion_rate=nozzlesettings_4.extrusion_rate,
    link_type=list_7,
    global_trim_distance=number_slider_22,
    ss_trim_distance=number_slider_23,
    cull_distance=number_slider_25,
    lift_val=number_slider_24,
    ss_f_rate=start_stop_feedrate_in_mm_min_2,
    ss_e_rate=number_slider_26)  # -> out, a, path_vis; inputs pts: list
# ---------- gcodelines_3: Python ----------
import sys

sys.path.append(x)

import Rhino.Geometry as rg
import simpleStartStop as ss

reload(ss)

# print(pts)

p_set = ss.PrintSettings(
    feed_rate = feed_rate, 
    extrusion_rate = extrusion_rate, 
    extrusion_mode = 'relative', 
    movement_mode = 'relative'
)

l_type = ss.LinkType(
    link_type = link_type,
    global_trim_distance = global_trim_distance,
    ss_trim_distance = ss_trim_distance,
    cull_distance = cull_distance,
    lift_val = lift_val
)

l_type.ss_f_rate = ss_f_rate
l_type.ss_e_rate = ss_e_rate

gcodeset = ss.GCodeSet(pts, p_set, l_type)
a = gcodeset.generateGCode()

path_vis = gcodeset.path_vis
# ---------- end gcodelines_3 ----------

# ---- group: G-Code / LenghtPath Body + 1st PIN - check
pline_7 = PolyLine(Vertices=gcodelines_2.path_vis, Closed=False)

# ----
pt_32 = Point(gcodelines_2.path_vis)
pt_33 = Point(gcodelines_3.path_vis)
lenghtpath_2nd_pin_check = PolyLine(Vertices=gcodelines_3.path_vis, Closed=False)

# ---- group: Visualization lines
merge_12 = Merge(
    Data1=flatten(merge_8),
    Data2=flatten(gcodelines_2.path_vis),
    Data3=flatten(merge_7),
    Data4=flatten(gcodelines_3.path_vis),
    Data5=flatten(pt_29))
pline_8 = PolyLine(Vertices=merge_12, Closed=False)

# ----
merge_gcode_lines = Merge(
    Data1=flatten(starline_2.out),
    Data2=flatten(gcodelines_2.a),
    Data3=flatten(python_27.out),
    Data4=flatten(gcodelines_3.a),
    Data5=flatten(python_26.out))
panel_14 = Panel(gcodelines_2.out)
len_2 = Length(Curve=lenghtpath_2nd_pin_check)
len_3 = Length(Curve=pline_7)
python_28 = GhPythonScript(pts=pt_32, h=addition_8, spacing=num_3)  # -> out, msh; inputs pts: list of Point3d, is_closed: Boolean
# ---------- python_28: Python ----------
import Rhino.Geometry as rg
from math import ceil

h_delta = spacing

msh = rg.Mesh()

for i in range(2):
    z = i * h_delta
    for p in pts:
        msh.Vertices.Add(p.X, p.Y, p.Z + z)

x_cnt = len(pts)
y_cnt = 2

for i in range(y_cnt - 1):
    base_a = i * x_cnt
    base_b = (i + 1) * x_cnt
    for j in range(x_cnt - 1):
        a = base_a + j
        b = base_a + j + 1
        c = base_b + j + 1
        d = base_b + j
        
        msh.Faces.AddFace(a, b, c, d)
    
    if is_closed:
        a = base_a + j + 1
        b = base_a
        c = base_b
        d = base_b + j + 1
        
        msh.Faces.AddFace(a, b, c, d)
# ---------- end python_28 ----------
python_29 = GhPythonScript(pts=pt_33, h=addition_8, spacing=num_3)  # -> out, msh; inputs pts: list of Point3d, is_closed: Boolean; same code as python_28
len_4 = Length(Curve=pline_8)
addition_11 = Addition(A=len_3, B=len_2)
python_30 = GhPythonScript(x=len_4)  # -> out, a
# ---------- python_30: Python ----------
import scriptcontext as sc

key_list = sc.sticky["PrintSettings"]["path_length"] = x
# ---------- end python_30 ----------
mesh_4 = Mesh(python_28.msh)
mesh_5 = Mesh(python_29.msh)
panel_15 = Panel(python_30.out)

# ---- group: G-Code (continued)
end_start_gcode_2 = GhPythonScript(x=library_path_5, add_header=Toggle(True), lines=flatten(merge_gcode_lines), gcodeFiles=value_list_2)  # -> out, a; inputs add_header: Boolean, lines: list; same code as end_start_gcode

# ----
mjoin = MeshJoin(Meshes=[mesh_4, mesh_5])
python_31 = GhPythonScript(
    y=savefile_2,
    x=library_path_5,
    extra_name=Toggle(False),
    extra_txt="something",
    data=flatten(end_start_gcode_2.out),
    extra_tag=value_list_2)  # -> out, a; inputs data: list; same code as python_25
panel_16 = Panel(python_31.out)

# ==== cluster Cluster
M = ClusterInput()
L = ClusterInput()
wbsplitquads = WeaverbirdsConstantQuadsSplitSubdivision(MeshCurves=M, Level=L, SmoothNakedEdges=1)
demesh = DeconstructMesh(Mesh=wbsplitquads)  # -> Vertices, Faces, Colours, Normals
B = ClusterInput()
brep_cp = BrepClosestPoint(Point=demesh.Vertices, Brep=B)  # -> Point, Normal, Distance
B_2 = ClusterInput()
conmesh = ConstructMesh(Vertices=brep_cp.Point, Faces=demesh.Faces)
smaller = SmallerThan(FirstNumber=brep_cp.Distance, SecondNumber=B_2)  # -> SmallerThan, graft(OrEqualTo)
merge = Merge(Data1=graft(demesh.Vertices), Data2=graft(brep_cp.Point))
item = ListItem(List=merge, Index=smaller.OrEqualTo, Wrap=True)  # -> flatten(Item)
conmesh_2 = ConstructMesh(Vertices=item, Faces=demesh.Faces)
M_2 = ClusterOutput(conmesh_2)
