# Grasshopper definition 210628_pin_input.gh (Grasshopper 1.0.7)
# plug-ins: Weaverbird, Axolotl Info, PTComponentLibrary

number_slider = Slider(6, range=0..10)
number_slider_2 = Slider(1.5, range=0..10)
feed_rate_in_mm_s = Slider(25, range=0..100)
number_slider_3 = Slider(36, range=0..100)
number_slider_4 = Slider(39, range=0..100)
number_slider_5 = Slider(44, range=0..100)
number_slider_6 = Slider(30, range=0..100)

# ---- group: Brick Geometry Generator
number_slider_7 = Slider(150, range=0..1000)
number_slider_8 = Slider(3.2, range=0..10)
number_slider_9 = Slider(1.4, range=0..10)
number_slider_10 = Slider(260, range=0..1000)
python = GhPythonScript(height_body=number_slider_7, height_pin=number_slider_10, start_height=number_slider_9, layer_height=number_slider_8)  # -> out, flatten(body_heights), flatten(pin_only_heights)
# ---------- python: Python ----------
import scriptcontext as sc

# creating the heights

body_heights = []
pin_only_heights = []

height = start_height

height_body, height_pin = min(height_body, height_pin), max(height_body, height_pin)

print (height_body, height_pin)

while height < height_body:
    
    body_heights.append(height)
    
    height += layer_height
    
while height < height_pin:
    
    pin_only_heights.append(height)
    
    height += layer_height

try:
    sc.sticky["PrintSettings"]["height_body"]=height_body
except:
    print("had to initialize the PrintSettings dict")
    sc.sticky["PrintSettings"]={"height_body":height_body}
sc.sticky["PrintSettings"]["height_pin"]=height_pin
sc.sticky["PrintSettings"]["start_height"]=start_height
sc.sticky["PrintSettings"]["layer_height"]=layer_height
sc.sticky["PrintSettings"]["layer_body_count"]=len(body_heights)
sc.sticky["PrintSettings"]["layer_pin_count"]=len(pin_only_heights)
sc.sticky["PrintSettings"]["layer_total_count"]=len(body_heights) + len(pin_only_heights)
# ---------- end python ----------

# ---- group: Brick Geometry Generator / where should we put it ?
number_slider_11 = Slider(220, range=40..250)
number_slider_12 = Slider(350, range=100..450)
number_slider_13 = Slider(250, range=40..250)

# ----
feed_rate_in_mm_s_2 = Slider(40, range=0..100)
neg = Negative(Value=number_slider)
neg_2 = Negative(Value=number_slider_2)
line_linking_spacing = Slider(2.7, range=0..10)
inter_line_spacing = Slider(2, range=0..10)
split_distance = Slider(2, range=-10..10)
path = FilePath()
addition = Addition(A=neg_2, B=neg)
addition_2 = Addition(A=number_slider_2, B=number_slider)

# ---- group: shrinkage scaling
multiplication = Multiplication(A=1, B=feed_rate_in_mm_s)

# ----
python_2 = GhPythonScript(default_dropbox_path=Toggle(True), custom_path=path)  # -> out, path, clean_code_path; inputs default_dropbox_path: Boolean
# ---------- python_2: Python ----------
import sys

import os
import Grasshopper

path=os.path.dirname(Grasshopper.Instances.ActiveCanvas.Document.FilePath)
base_path=os.path.dirname(path)
path=os.path.join(base_path, "PatternBrickLibrary")
clean_code_path=os.path.join(base_path, "clean_code")
sys.path.append(path)
# ---------- end python_2 ----------
merge = Merge(Data1=addition, Data2=neg_2, Data3=number_slider_2, Data4=addition_2)
feedratesettings = GhPythonScript(
    feed_rate=multiplication,
    variable_feed_rate=Toggle(False),
    feed_rate_max=feed_rate_in_mm_s_2,
    feed_rate_max_start_start_ramp=Slider(5, range=0..25),
    feed_rate_max_end_start_ramp=Slider(10, range=0..100),
    feed_rate_max_start_end_ramp=Slider(135, range=0..1000),
    feed_rate_max_end_end_ramp=Slider(145, range=0..1000))  # -> flatten(out); inputs variable_feed_rate: Boolean
# ---------- feedratesettings: Python ----------
import scriptcontext as sc

try:
    sc.sticky["PrintSettings"]["feed_rate"] = feed_rate
except:
    sc.sticky["PrintSettings"]={"feed_rate":feed_rate}
sc.sticky["PrintSettings"]["feed_rate_variable"] = variable_feed_rate

if variable_feed_rate:
    
    sc.sticky["PrintSettings"]["feed_rate_max"] = feed_rate_max
    sc.sticky["PrintSettings"]["feed_rate_max_end_start_ramp"] = feed_rate_max_start_start_ramp
    sc.sticky["PrintSettings"]["feed_rate_max_end_start_ramp"] = feed_rate_max_end_start_ramp
    sc.sticky["PrintSettings"]["feed_rate_max_start_end_ramp"] = feed_rate_max_start_end_ramp
    sc.sticky["PrintSettings"]["feed_rate_max_end_end_ramp"] = feed_rate_max_end_end_ramp
    
print(True)
# ---------- end feedratesettings ----------

# ---- group: Nozzle
list = ValueList({"3.5", "5"}, selected="5")
nozzlesettings = GhPythonScript(x=feedratesettings, nozzle_diameter=list, layer_height=number_slider_8)  # -> flatten(out)
# ---------- nozzlesettings: Python ----------
import scriptcontext as sc

def linearInterpolation(input_x, val_s, x_s):

    val_a, val_b = val_s
    x_a, x_b = x_s

    x_a, x_b, val_a, val_b = float(x_a), float(x_b), float(val_a), float(val_b)

    distance_val = (input_x - x_a) / (x_b - x_a)

    output_val = (1 - distance_val) * val_a + distance_val * val_b

    return output_val

x_s = (2.5, 3.2)

val_s_5_spacing_cross_paths = (2.5, 2.0)
val_s_5_spacing_link = (3.4, 2.7)

val_s_3_5_spacing_cross_paths = (2.0, 1.6)
val_s_3_5_spacing_link = (2.7, 2.2)

if nozzle_diameter == 3.5:
    
    extrusion_rate = .64
    spacing_cross_paths = round(linearInterpolation(layer_height, val_s_3_5_spacing_cross_paths, x_s), 1)
    spacing_link = round(linearInterpolation(layer_height, val_s_3_5_spacing_link, x_s), 1)
    start_stop_retraction = 130
    start_reextrusion_rate = 40
    
if nozzle_diameter == 5.0:
    
    extrusion_rate = .8
    spacing_cross_paths = round(linearInterpolation(layer_height, val_s_3_5_spacing_cross_paths, x_s), 1)
    spacing_link = round(linearInterpolation(layer_height, val_s_5_spacing_link, x_s), 1)
    start_stop_retraction = 150
    start_reextrusion_rate = 50
    
# print(spacing_cross_paths, spacing_cross_paths, spacing_link)

sc.sticky["PrintSettings"]["print_extrusion_nozzle"] = nozzle_diameter   
sc.sticky["PrintSettings"]["print_extrusion_rate"] = extrusion_rate
sc.sticky["PrintSettings"]["print_spacing_cross"] = spacing_cross_paths
sc.sticky["PrintSettings"]["print_spacing_paths"] = spacing_cross_paths
sc.sticky["PrintSettings"]["print_spacing_link"] = spacing_link
sc.sticky["PrintSettings"]["print_spacing_start_stop_retraction"] = start_stop_retraction
sc.sticky["PrintSettings"]["print_spacing_start_reextrusion_rate"] = start_reextrusion_rate

print(True)
# ---------- end nozzlesettings ----------

# ----
simplebrick = GhPythonScript(save_settings=Toggle(True), brick_length=number_slider_12, brick_width=number_slider_13, pin_spacing=number_slider_11)  # -> out, poly_crv, pin_pts; inputs save_settings: Boolean
# ---------- simplebrick: Python ----------
import Rhino.Geometry as rg
import scriptcontext as sc

# creating the base shape and pins

brick_width, brick_length  = min(brick_width, brick_length), max(brick_width, brick_length)

print (brick_length, brick_width)

half_l = brick_length * .5
half_w = brick_width * .5

#     *       *
#   *            *
#     *       *

val_list = [(1,1), (1, -1), (-1, -1), (-1, 1)]

pt_list = []

for i in range(4):
    
    pt_list.append(rg.Point3d(half_l * val_list[i][0], half_w * val_list[i][1], 0.0))
    
    if i == 0:
        
        pt_list.append(rg.Point3d(half_l + half_w, 0, 0))
        
    elif i == 2:
        
        pt_list.append(rg.Point3d(- (half_l + half_w), 0, 0))

arc_set = [[0,1,2],[3,4,5]]
line_set = [[5,0],[2,3]]

poly_crv = rg.PolyCurve()
pin_pts = [rg.Point3d(-.5 * pin_spacing, 0, 0), rg.Point3d(.5 * pin_spacing, 0, 0)]

for i in range(2):
    
    pt_0, pt_1, pt_2, pt_3 = pt_list[-1 + i * 3], pt_list[0 + i * 3], pt_list[1 + i * 3], pt_list[2 + i * 3]
    
    line = rg.Line(pt_0, pt_1)
    
    poly_crv.Append(line)
    
    crv = rg.Arc(pt_1, pt_2, pt_3)
    
    poly_crv.Append(crv)
    
if save_settings:
    
    try:
        sc.sticky["PrintSettings"]["brick_width"]=brick_width
    except:
        print("had to initialize the PrintSettings dict")
        sc.sticky["PrintSettings"]={"brick_width":brick_width}
    
    sc.sticky["PrintSettings"]["brick_length"]=brick_length
    sc.sticky["PrintSettings"]["pin_spacing"]=pin_spacing
# ---------- end simplebrick ----------
shrinkage = GhPythonScript(your_clay_shrinkage=Slider(8.7, range=-100..100))  # -> out, scale_value
# ---------- shrinkage: Python ----------
our_clay_shrinkage = 8.7

scale_value = (100. - our_clay_shrinkage) / (100. - your_clay_shrinkage)
# ---------- end shrinkage ----------
manualnozzloverwrite = GhPythonScript(
    x=nozzlesettings,
    overwrite=Toggle(False),
    spacing_cross=split_distance,
    spacing_paths=inter_line_spacing,
    spacing_link=line_linking_spacing)  # -> out; inputs overwrite: Boolean
# ---------- manualnozzloverwrite: Python ----------
import scriptcontext as sc

if overwrite:
    
    sc.sticky["PrintSettings"]["print_spacing_cross"] = spacing_cross
    sc.sticky["PrintSettings"]["print_spacing_paths"] = spacing_paths
    sc.sticky["PrintSettings"]["print_spacing_link"] = spacing_link
    
print(True)
# ---------- end manualnozzloverwrite ----------
given_points = Point([Point(-102.3006922, 0.4886194024, 0), Point(105, 0, 0)])
given_shell = Curve(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)
addition_3 = Addition(A=Slider(23.201, range=0..100), B=merge)
curve = Curve(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)
crv = Curve(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)
point = Point([Point(104.9999408, 0, 0), Point(-104.9999408, 0, 0)])
item = ListItem(List=addition_3, Index=0, Wrap=True)  # -> Item, Item1, Item2, Item3
number_slider_14 = Slider(20, range=0..100)
panel = Panel(nozzlesettings)

# ---- group: Reverse the direction of curve
# Explanation: Based on how the curve is directed, offsetting and/or splitting it will behave differently
flip = FlipCurve()  # -> Curve, Flag

# ----
Z = UnitZ(Factor=number_slider_7)
number_slider_15 = Slider(17, range=0..100)
number_slider_16 = Slider(-0.5, range=-10..10)
number_slider_17 = Slider(3, range=0..10)
number_slider_18 = Slider(3.5, range=0..10)
number_slider_19 = Slider(3, range=0..10)
number_slider_20 = Slider(0, range=0..10)
crv_2 = Curve(given_shell)
splitting_geometry = Geometry(crv)
Z_2 = UnitZ(Factor=Slider(0, range=0..100))
num = Number(number_slider_15)
python_3 = GhPythonScript()  # -> out, a
# ---------- python_3: Python ----------
import scriptcontext as sc

print(sc.sticky["PrintSettings"])
# ---------- end python_3 ----------
addition_4 = Addition(A=Slider(5, range=0..10), B=num)
subtraction = Subtraction(A=num, B=Slider(8.763, range=0..15))
addition_5 = Addition(A=number_slider_16, B=num)
merge_2 = Merge(
    Data1=Slider(17, range=0..100),
    Data2=number_slider_15,
    Data3=Slider(22, range=0..100),
    Data4=Slider(22, range=0..100),
    Data5=Slider(18, range=0..100),
    Data6=Slider(13, range=0..100))
extr = Extrude(Base=crv_2, Direction=Z)
panel_2 = Panel(python_3.out)
crv_3 = Curve()
crv_4 = Curve(<curve referenced from the Rhino model>)
series = Series(Start=number_slider_20, Step=number_slider_17, Count=number_slider_19)
series_2 = Series(Start=addition_5, Step=number_slider_16, Count=number_slider_19)
X = UnitX(Factor=addition_4)
division = Division(A=subtraction, B=number_slider_18)
library_path = FilePath(python_2.path)
layer_slicing = GhPythonScript(x=library_path, geometry=given_shell, heights=python.body_heights)  # -> out, ori_crvs, crv_sets, a, b, c, d; inputs geometry: GeometryBase, heights: list
# ---------- layer_slicing: Python ----------
import sys

sys.path.append(x)

import brickSlicer as bs

reload(bs)

ori_crvs = bs.slicing(geometry, heights)
# crv_sets, a, b, c = bs.splitter(ori_crvs, slicing_object = slice_geo, split_type = "first_layer")
# ---------- end layer_slicing ----------
crv_5 = Curve(layer_slicing.ori_crvs)
cap = CapHoles(Brep=extr)
item_2 = ListItem(List=series, Index=0, Wrap=True)  # -> Item1, Item
addition_6 = Addition(A=item_2.Item1, B=Slider(1.5, range=0..10))
merge_3 = Merge(
    Data2=flatten(addition_6),
    Data3=item.Item,
    Data4=item.Item1,
    Data5=item.Item2,
    Data6=item.Item3,
    Data7=Slider(75, range=0..1000))
round = Round(Number=division)  # -> Nearest, Floor, Ceiling
rev = ReverseList(List=series_2)
neg_3 = Negative(Value=number_slider_18)
Z_3 = UnitZ(Factor=number_slider_20)
crv_6 = Curve(crv_4)
python_4 = GhPythonScript()  # -> out, a
# ---------- python_4: Python ----------
from Rhino.Geometry import Point3d, Polyline

vss = [[(135.22426909684023, -31.209916990481627, 0.0), (133.4433651680265, -28.340520014320656, 0.0), (132.8471361664108, -25.203803763354557, 0.0), (133.58397203138392, -22.046003178624506, 0.0), (135.0282365277091, -19.060823010857654, 0.0), (136.6838355345756, -16.187183467850723, 0.0),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


a = []

for vs in vss:
    b = []
    for x,y,z in vs:
        b.append(Point3d(x, y, z))
    
    a.append(Polyline(b+[b[0]]))
# ---------- end python_4 ----------
number_slider_21 = Slider(2.5, range=0..10)
number_slider_22 = Slider(100, range=0..100)
panel_3 = Panel(layer_slicing.out)
python_5 = GhPythonScript()  # -> out, a
# ---------- python_5: Python ----------
from Rhino.Geometry import Point3d

vs = [(-135.68763732910156, 22.979591369628906, 134.0), (-136.6048583984375, 21.005922317504883, 134.0), (-138.0771484375, 19.4432315826416, 134.0), (-140.15708923339844, 18.477264404296875, 134.0), (-142.6437530517578, 17.860191345214844, 134.0), (-145.2830352783203, 17.24613380432129, 134.0),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
a = []

for x,y,z in vs:
    a.append(Point3d(x, y, z))
# ---------- end python_5 ----------
number_slider_23 = Slider(10, range=0..10)
ln = Line(StartPoint=Z_2, EndPoint=X)
series_3 = Series(Start=rev, Step=neg_3, Count=round.Floor)
multiplication_2 = Multiplication(A=number_slider_18, B=0.5)
start_height = Number(Slider(1.4, range=0..10))
rev_2 = Reverse()
neg_4 = Negative(Value=multiplication_2)
merge_4 = Merge()
rev_3 = Reverse(Vector=python_4.a)
circle = CircleCNR(Center=Z_2, Normal=Vector(0, 0, 1), Radius=series_3)  # -> graft(Circle)
item_3 = ListItem(List=flatten(circle), Index=0, Wrap=True)
offset = OffsetCurve(Curve=item_3, Distance=Slider(5, range=0..10), Plane=PlaneXY(0, 0, 0), Corners=1)
offset_2 = OffsetCurve(Curve=item_3, Distance=Slider(10, range=0..10), Plane=PlaneXY(0, 0, 0), Corners=1)
divlength = DivideLength(Curve=offset_2, Length=Slider(2.5, range=0..10))  # -> Points, Tangents, Parameters
pt = Point(given_points)
crv_7 = Curve(given_shell)
project = Project(Geometry=divlength.Points, Plane=PlaneXY(0, 0, 0))  # -> Geometry, Transform
clean_code_path = FilePath(python_2.clean_code_path)
Z_4 = UnitZ(Factor=start_height)
number_slider_24 = Slider(1.9, range=0..10)
merge_5 = Merge(Data1=neg_4, Data2=multiplication_2)
offset_3 = OffsetCurve(Curve=given_shell, Distance=Slider(5, range=0..10), Plane=PlaneXY(0, 0, 0), Corners=1)
start_height_2 = Number(number_slider_9)
rev_4 = ReverseList(List=python_4.a)
neg_5 = Negative(Value=number_slider_22)
scale = Scale(Geometry=project.Geometry, Center=Point(0, 0, 0), Factor=Slider(2, range=0..10))  # -> Geometry, Transform
circle_2 = CircleCNR(Center=pt, Normal=Vector(0, 0, 1), Radius=Slider(27, range=0..100))
offset_4 = OffsetCurve(Curve=given_shell, Distance=Slider(20, range=0..100), Plane=PlaneXY(0, 0, 0), Corners=1)
offset_5 = OffsetCurve(Curve=ln, Distance=merge_5, Plane=PlaneXY(0, 0, 0), Corners=1)  # -> flatten(Curve)
number_slider_25 = Slider(2.5, range=0..10)
move = Move(Geometry=scale.Geometry, Motion=Z_4)  # -> Geometry, Transform
pt_2 = Point(graft([Point(144.2063759, 15.45654561, 0), Point(100.8684096, 69.68242377, 0), Point(-65.1357437, 6.674305413, 0), Point(-129.0543697, -50.72205221, 0), Point(-138.5050168, 5.749952692, 0), Point(-104.6158494, 68.68208251, 0), Point(-13.89713813, 73.35234938, 0), Point(-8.584700174, 35.6038333, 0), Point(6.520875153, 3.072140081, 0), Point(11.16775599, -62.88366702, 0), Point(-21.91185429, -73.67824015, 0), Point(34.80929869, -74.30637983, 0), Point(92.22836238, -61.65548003, 0), Point(116.2380157, -46.22024703, 0), Point(53.88665591, 38.42288084, 0)]))
python_6 = GhPythonScript()  # -> out, a
# ---------- python_6: Python ----------
from Rhino.Geometry import Point3d

vs = [(-74.18636535821155, 47.03259912059491, 0.0), (-74.89315520519625, 50.464191778065654, 0.0), (-75.00982998345349, 54.021063117796324, 0.0), (-74.94654151092558, 57.59902692570399, 0.0), (-74.85440084441144, 61.1960441937367, 0.0), (-74.7561767998909, 64.83311585463017, 0.0),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
a = []

for x,y,z in vs:
    a.append(Point3d(x, y, z))
# ---------- end python_6 ----------
item_4 = ListItem(List=pt, Index=0, Wrap=True)  # -> Item, Item1
pt_3 = ConstructPoint(XCoordinate=[number_slider_22, neg_5], YCoordinate=0, ZCoordinate=0)
divlength_2 = DivideLength(Curve=offset_4, Length=Slider(5, range=0..10))  # -> Points, Tangents, Parameters
crvprox = CurveProximity(CurveA=offset_3, CurveB=circle_2)  # -> PointA, PointB, Distance
end = EndPoints(Curve=offset_5)  # -> Start, End
path_mapper = PathMapper(circle, source="{A;B;C;D}", target="{C;D}")
path_mapper_2 = PathMapper(pt_2, source="{A;B}", target="{B}")
number_slider_26 = Slider(5, range=0..10)
pline = PolyLine(Vertices=move.Geometry, Closed=True)
item_5 = ListItem(Index=0, Wrap=True)
division_2 = Division(A=crvprox.Distance, B=2)
project_2 = Project(Geometry=divlength_2.Points, Plane=PlaneXY(0, 0, 0))  # -> Geometry, Transform
project_3 = Project(Geometry=python_6.a, Plane=PlaneXY(0, 0, 0))  # -> Geometry, Transform
pline_2 = PolyLine(Vertices=project_3.Geometry, Closed=False)
Z_5 = UnitZ(Factor=number_slider_24)
crv_8 = Curve(given_shell)
item_6 = ListItem(List=end.End, Index=0, Wrap=True)  # -> Item, Item1
item_7 = ListItem(List=end.Start, Index=0, Wrap=True)  # -> Item, Item1
ln_2 = Line(StartPoint=item_4.Item, EndPoint=item_4.Item1)
circle_3 = CircleCNR(Center=pt_3, Normal=Vector(0, 0, 1), Radius=Slider(30, range=0..100))
neg_6 = Negative(Value=number_slider_26)
end_2 = EndPoints(Curve=pline)  # -> Start, End
cps = ClosestPoints(Point=path_mapper_2, Cloud=project_3.Geometry, Count=Slider(20, range=0..100))  # -> ClosestPoint, CPIndex, Distance
offset_6 = OffsetCurve(Curve=circle_2, Distance=division_2, Plane=PlaneXY(0, 0, 0), Corners=1)
merge_6 = Merge(Data1=item_7.Item, Data2=item_7.Item1, Data3=item_6.Item1, Data4=item_6.Item)
pt_4 = Point(python_6.a)
move_2 = Move(Geometry=project_2.Geometry, Motion=Z_5)  # -> Geometry, Transform
panel_4 = Panel(circle)
layer_height = Number(number_slider_8)
offset_7 = OffsetCurve(Curve=ln_2, Distance=[number_slider_26, neg_6], Plane=PlaneXY(0, 0, 0), Corners=1)  # -> flatten(Curve)
path_mapper_3 = PathMapper(cps.ClosestPoint, source="{A;B}", target="{A}")
offset_8 = OffsetCurve(Curve=crv_7, Distance=Slider(10, range=0..10), Plane=PlaneXY(0, 0, 0), Corners=1)
pline_3 = PolyLine(Vertices=merge_6, Closed=True)
library_path_2 = FilePath(library_path)

# ---- group: — Slicing for pattern —
num_2 = Number(100)
slicing_structuring = GhPythonScript(
    x=library_path_2,
    ori_crvs=layer_slicing.ori_crvs,
    spacing=Slider(2.5, range=0..10),
    end_smooth=Toggle(False),
    custom_crv_length=Toggle(False),
    crv_l=num_2,
    split=Toggle(True),
    slice_geo=splitting_geometry,
    split_item=Slider(0, range=0..1))  # -> out, split, layers, set_tuple, crv_sets, ori_crvs, slice_geo; inputs ori_crvs: list, end_smooth: Boolean, custom_crv_length: Boolean, split: Boolean, split_item: Int32
# ---------- slicing_structuring: Python ----------
# snippet of code to make this python component look for it's   code in the parent folder of the .gh file

import sys

sys.path.append(x)

import vertexClass_v1 as vc
import brickSlicer as bs
import scriptcontext as sc

reload(bs)
reload(vc)

print(type(slice_geo))

    
if custom_crv_length:
    
    crv_l = crv_l
    
    sc.sticky["PrintSettings"]["pattern_crv_l"] = crv_l
    
else:
    
    crv_l = None


if split:

    crv_sets, vis_a, vis_b, pts_crv_a_and_b = bs.splitter(ori_crvs, slicing_object = slice_geo, split_type = "first_layer")
    
    crv_set_a = [crv_set[0] for crv_set in crv_sets]
    crv_set_b = [crv_set[1] for crv_set in crv_sets]
    
    crv_sets = [crv_set_a, crv_set_b]
    
    non_pattern_part = [vc.divideCurveByLength(crv, spacing) for crv in crv_sets[(split_item + 1) % 2]]
    
    pattern_part, set_tuple, _ = vc.moveSet(crv_sets[split_item], ori_crvs, spacing, crv_l)
    layers = [pattern_part, non_pattern_part]
    
    
else:

    layers, set_tuple = vc.singleCurve(ori_crvs, spacing, end_smooth, crv_l)
    
sc.sticky["PrintSettings"]["pattern_spacing"] = spacing
sc.sticky["PrintSettings"]["pattern_end_smooth"] = end_smooth
# ---------- end slicing_structuring ----------

# ----
item_8 = ListItem(List=slicing_structuring.set_tuple, Index=0, Wrap=True)  # -> Item, Item1, Item2
pline_4 = PolyLine(Vertices=pt_4, Closed=True)
trim = TrimWithRegion(Curve=path_mapper, Region=pline_3)  # -> Inside, Outside
pline_5 = PolyLine(Vertices=move_2.Geometry, Closed=True)
pline_6 = PolyLine(Vertices=project_3.Geometry, Closed=True)
merge_7 = Merge(Data1=offset_8, Data2=circle_2)
end_3 = EndPoints(Curve=offset_7)  # -> Start, End
crv_l = Number(item_8.Item)

# ---- group: general pattern settings
pt_5 = ConstructPoint(XCoordinate=Slider(12, range=0..100), YCoordinate=Slider(0, range=0..100), ZCoordinate=0)
pt_6 = Point(pt_5)
pyramidpattern = GhPythonScript(lib_path=clean_code_path, zero_end=Slider(0, range=0..100), ramp_end=Slider(49.292, range=0..100), length=crv_l)  # -> out, edge_easing
# ---------- pyramidpattern: Python ----------
import sys

sys.path.append(lib_path)

import patterns as pt
reload(pt)

edge_easing = pt.EdgeEasing(
    min(zero_end, ramp_end),
    max(zero_end, ramp_end),
    length
)
# ---------- end pyramidpattern ----------
inout = GhPythonScript(lib_path=clean_code_path, percentage=Slider(47.629, range=0..100), seed=Slider(1000, range=0..1000), length=crv_l)  # -> out, in_out; inputs seed: Int32
# ---------- inout: Python ----------
import sys

sys.path.append(lib_path)

import patterns as pt
reload(pt)

in_out = pt.InOut(
    percentage * .01,
    seed
)
# ---------- end inout ----------
dotmap = GhPythonScript(
    lib_path=clean_code_path,
    x_spacing=Slider(45, range=0..100),
    y_spacing=Slider(45, range=0..100),
    half_spacing=Toggle(True),
    b_pt=pt_6,
    with_in_out=Toggle(True),
    in_out_class=inout.in_out,
    direction=Toggle(True))  # -> out, dot_map; inputs half_spacing: Boolean, b_pt: Point3d, with_in_out: Boolean, direction: Boolean
# ---------- dotmap: Python ----------
import sys

sys.path.append(lib_path)

import patterns as pt
reload(pt)

dot_map = pt.DotMap(
    x_spacing = y_spacing,
    y_spacing = y_spacing,
    half_spacing = half_spacing,
    b_pt = b_pt,
    in_out_class = in_out_class if with_in_out else None,
    direction = direction
)
# ---------- end dotmap ----------

# ----
div_l = Number(item_8.Item1)
lay_h = Number(item_8.Item2)
series_4 = Series(Start=start_height, Step=layer_height, Count=Slider(1, range=1..15))
subtraction_2 = Subtraction(A=path_mapper_3, B=path_mapper_2)
item_9 = ListItem(List=end_3.Start, Index=0, Wrap=True)  # -> Item, Item1
crv_9 = Curve(trim.Outside)
pt_7 = ConstructPoint(XCoordinate=Slider(0, range=0..100), YCoordinate=Slider(0, range=0..100), ZCoordinate=0)
pt_8 = ConstructPoint(XCoordinate=Slider(0, range=0..100), YCoordinate=Slider(0, range=0..100), ZCoordinate=0)
item_10 = ListItem(List=end_3.End, Index=0, Wrap=True)  # -> Item, Item1
end_4 = EndPoints(Curve=pline_5)  # -> Start, End
dist = Distance(PointA=path_mapper_3, PointB=pt_2)
division_3 = Division(A=dist, B=Slider(7.859, range=0..10))
graph = GraphMapper(
    division_3,
    x0=0,
    x1=1,
    y0=0,
    y1=1,
    container_name="Bezier",
    cpx=[0, 0.05797101557, 0.3260869682, 1],
    cpy=[1, 0.3115941882, 0.4202898741, 0])
Z_6 = UnitZ(Factor=series_4)
unit = UnitVector(Vector=subtraction_2)
flip_2 = FlipCurve(Curve=crv_9)  # -> Curve, Flag
Z_7 = UnitZ(Factor=series)  # -> graft(UnitVector)
rdiff = RegionDifference()

# ---- group: pattern settings
python_7 = GhPythonScript()  # -> out, a
# ---------- python_7: Python ----------
a = [[2, 1, 1], [1, 2, 3], [0, 1, 2]]
# ---------- end python_7 ----------

# ----
ln_3 = Line(StartPoint=item_9.Item, EndPoint=item_9.Item1)
flatten = FlattenTree(Tree=cps.CPIndex, Path="{0}")
crv_cp = CurveClosestPoint(Point=end_4.Start, Curve=rev_4)  # -> Point, Parameter, Distance
layer_height_2 = Number(number_slider_8)
ptdividelen = DivideLength(Curve=merge_7, Distance=Slider(4, range=0..10), RoundUp=False, RoundDn=False)
multiplication_3 = Multiplication(A=Slider(10, range=0..10), B=graph)
number_slider_27 = Slider(3, range=0..10)
ln_4 = Line(StartPoint=item_10.Item, EndPoint=item_10.Item1)
merge_8 = Merge(Data1=crv_9, Data2=flip_2.Curve)  # -> flatten(Result)
path_mapper_4 = PathMapper(crv_9, source="{A;B;C}", target="{A}")

rad = Radians(Degrees=Slider(30, range=0..1000))
pt_9 = Point(pt_8)
sinwave = GhPythonScript(
    lib_path=clean_code_path,
    period=Slider(50, range=0..100),
    amplitude=Slider(15, range=0..100),
    dir_angle=rad,
    b_pt=pt_9,
    edge_easing=pyramidpattern.edge_easing)  # -> out, sin_wave; inputs b_pt: Point3d
# ---------- sinwave: Python ----------
import sys

sys.path.append(lib_path)

import patterns as pt
reload(pt)

sin_wave = pt.SinWave(
    period, 
    amplitude, 
    dir_angle,
    b_pt,
    edge_easing
)
# ---------- end sinwave ----------

multiplication_4 = Multiplication(A=unit, B=multiplication_3)
merge_9 = Merge(Data1=ln_3, Data2=ln_4, Data3=offset_7)
path_mapper_5 = PathMapper(Z_7, source="{A;B;C}", target="{C}")

ellipsoidpattern = GhPythonScript(
    lib_path=clean_code_path,
    radius=Slider(10, range=0..100),
    amplitude=Slider(10, range=0..100),
    y_scale=Slider(2, range=0.01..10),
    dot_map=dotmap.dot_map,
    edge_easing=pyramidpattern.edge_easing)  # -> out, ellipsoid_pattern
# ---------- ellipsoidpattern: Python ----------
import sys

sys.path.append(lib_path)

import patterns as pt
reload(pt)

ellipsoid_pattern = pt.EllipsoidPattern(
    radius,
    amplitude,
    y_scale,
    dot_map,
    edge_easing
)
# ---------- end ellipsoidpattern ----------

cylinderpattern = GhPythonScript(
    lib_path=clean_code_path,
    radius_a=Slider(10, range=0..100),
    radius_b=Slider(22.812, range=0..100),
    height=Slider(40.644, range=0..100),
    amplitude=Slider(25, range=0..100),
    dot_map=dotmap.dot_map,
    edge_easing=pyramidpattern.edge_easing)  # -> out, cylinder_pattern
# ---------- cylinderpattern: Python ----------
import sys

sys.path.append(lib_path)

import patterns as pt
reload(pt)

cylinder_pattern = pt.CylinderPattern(
    radius_a,
    radius_b,
    height,
    amplitude,
    dot_map,
    edge_easing
)
# ---------- end cylinderpattern ----------

pyramidpattern_2 = GhPythonScript(
    lib_path=clean_code_path,
    radius=Slider(10, range=0..100),
    amplitude=Slider(10, range=0..100),
    y_scale=Slider(1, range=0.01..10),
    dot_map=dotmap.dot_map,
    edge_easing=pyramidpattern.edge_easing)  # -> out, pyramid_pattern
# ---------- pyramidpattern_2: Python ----------
import sys

sys.path.append(lib_path)

import patterns as pt
reload(pt)

pyramid_pattern = pt.PyramidPattern(
    radius,
    amplitude,
    y_scale,
    dot_map,
    edge_easing
)
# ---------- end pyramidpattern_2 ----------

layermap = GhPythonScript(
    lib_path=clean_code_path,
    spacing=Slider(50, range=0..100),
    pattern_set=python_7.a,
    radius=Slider(20, range=0..100),
    amplitude=Slider(20, range=0..100),
    length=crv_l,
    layer_spacing=lay_h,
    direction=Toggle(False),
    periodic=Toggle(False),
    b_pt=pt_7,
    edge_easing=pyramidpattern.edge_easing)  # -> out, layer_map; inputs pattern_set: list, direction: Boolean, b_pt: Point3d
# ---------- layermap: Python ----------
import sys

sys.path.append(lib_path)

import patterns as pt
reload(pt)

layer_map = pt.LayerMap(
    spacing,
    pattern_set,
    length,
    layer_spacing,
    radius,
    amplitude,
    direction,
    periodic,
    b_pt,
    edge_easing
)
# ---------- end layermap ----------

tpms = TPMS(Wavelength=Slider(98, range=0..100), type=0)
crv_cp_2 = CurveClosestPoint(Point=crv_cp.Point, Curve=pline_5)  # -> Point, Parameter, Distance
addition_7 = Addition(A=cps.ClosestPoint, B=multiplication_4)
python_8 = GhPythonScript(t=crv_cp.Parameter, crv=rev_4)  # -> out, crv; inputs crv: Curve
# ---------- python_8: Python ----------
crv.ChangeClosedCurveSeam(t)
# ---------- end python_8 ----------
sift = SiftPattern(List=merge_8, SiftPattern=[0, 1, 1, 0])  # -> Output0, Output1
series_5 = Series(Start=number_slider_24, Step=layer_height_2, Count=Slider(1, range=1..15))
flatten_2 = FlattenTree(Tree=addition_7, Path="{0}")
join = JoinCurves(Curves=merge_9, Preserve=False)
trim_2 = TrimWithRegions(Curve=offset_6, Regions=join)  # -> Inside, Outside
runion = RegionUnion(Curves=flatten([offset_6, join]))
divide = DivideCurve(Curve=trim_2.Outside, Count=10, Kinks=False)  # -> flatten(Points), Tangents, Parameters
ptdividelen_2 = DivideLength(Curve=runion, Distance=Slider(10, range=0..10), RoundUp=False, RoundDn=False)
pt_10 = Point(flatten(divide.Points))
add = Add(DistanceObject=tpms, Addend=Slider(2, range=0..10))
move_3 = Move(Geometry=path_mapper_4, Motion=path_mapper_5)  # -> Geometry, Transform
Z_8 = UnitZ(Factor=Slider(20, range=0..100))
addition_8 = Addition(A=crv_cp.Point, B=crv_cp_2.Point)
ln_5 = Line(StartPoint=crv_cp.Point, EndPoint=crv_cp_2.Point)
clean = CleanTree(RemoveNulls=True, RemoveInvalid=True, RemoveEmpty=False, Tree=sift.Output0)
nurbs = NurbsCurve(Vertices=pt_10, Degree=Slider(10, range=0..10), Periodic=True)  # -> Curve, Length, Domain
clean_2 = CleanTree(RemoveNulls=True, RemoveInvalid=True, RemoveEmpty=False, Tree=end_2.Start)
toggle = BooleanToggle(True)
number_slider_28 = Slider(3, range=0..10)
toggle_2 = BooleanToggle(True)
pline_7 = PolyLine(Vertices=pt_10, Closed=False)
lng = ListLength(List=series)
neg_7 = Negative(Value=number_slider_27)
Z_9 = UnitZ(Factor=series_5)
move_4 = Move(Geometry=python_8.crv, Motion=Z_9)  # -> Geometry, Transform
replace = ReplaceItems(List=project_3.Geometry, Item=flatten_2, Indices=flatten, Wrap=False)
move_5 = Move(Geometry=replace, Motion=Z_5)  # -> Geometry, Transform
neg_8 = Negative(Value=number_slider_27)
multiplication_5 = Multiplication(A=addition_8, B=0.5)
tpms_distance_object_modifier = TPMSD(Wavelength=Slider(25, range=0..100), Modulator=add, type=0)

number_slider_29 = Slider(6, range=0..100)
pt_11 = Point(pt_8)
axolotlflat = GhPythonScript(
    lib_path=clean_code_path,
    sdf=tpms_distance_object_modifier,
    amplitude=number_slider_29,
    direction=toggle_2,
    b_pt=pt_11,
    edge_easing=pyramidpattern.edge_easing)  # -> out, axolotl_flat; inputs direction: Boolean, b_pt: Point3d
# ---------- axolotlflat: Python ----------
import sys

sys.path.append(lib_path)

import patterns as pt
reload(pt)

axolotl_flat = pt.AxolotlFlat(
    sdf, 
    amplitude, 
    direction,
    b_pt,
    edge_easing
)
# ---------- end axolotlflat ----------

number_slider_30 = Slider(6, range=0..100)
pt_12 = Point(pt_8)
axolotlspatial = GhPythonScript(
    lib_path=clean_code_path,
    sdf=tpms_distance_object_modifier,
    amplitude=number_slider_29,
    direction=toggle_2,
    b_pt=pt_12,
    edge_easing=pyramidpattern.edge_easing)  # -> out, axolotl_spatial; inputs direction: Boolean, b_pt: Point3d
# ---------- axolotlspatial: Python ----------
import sys

sys.path.append(lib_path)

import patterns as pt
reload(pt)

axolotl_spatial = pt.AxolotlSpatial(
    sdf, 
    amplitude, 
    direction,
    b_pt,
    edge_easing
)
# ---------- end axolotlspatial ----------

divide_2 = DivideCurve(Curve=move_3.Geometry, Count=Slider(50, range=0..100), Kinks=False)  # -> Points, Tangents, Parameters
divide_3 = DivideCurve(Curve=move_4.Geometry, Count=1, Kinks=True)  # -> Points, Tangents, Parameters
end_5 = EndPoints(Curve=clean)  # -> Start, End
lng_2 = ListLength(List=python_6.a)
series_6 = Series(Start=Toggle(True), Step=1, Count=lng)
pline_8 = PolyLine(Vertices=replace, Closed=False)
lng_3 = ListLength(List=end_5.End)  # -> expr("x-1", Length)
ptdividelen_3 = DivideLength(Curve=nurbs.Curve, Distance=Slider(4, range=0..10), RoundUp=False, RoundDn=False)
python_9 = GhPythonScript(x=ptdividelen_3)  # -> out, a; inputs x: list of Point3d
# ---------- python_9: Python ----------
vs = []

for p in x:
    vs.append((p.X, p.Y, p.Z))
    
print(vs)
# ---------- end python_9 ----------
panel_5 = Panel(python_9.out)
item_11 = ListItem(List=divide_3.Points, Index=0, Wrap=True)
scale_2 = Scale(Geometry=ln_5, Center=multiplication_5, Factor=0.5)  # -> Geometry, Transform
mod = Modulus(A=series_6, B=2)
split = SplitList(List=end_5.End, Index=lng_3)  # -> ListA, ListB
split_2 = SplitList(List=end_5.Start, Index=1)  # -> ListA, ListB
series_7 = Series(Start=series_5, Step=Slider(2, range=0..10), Count=lng_2)
pt_13 = Point(clean_2)
panel_6 = Panel(divide_2.Points)
rev_5 = ReverseList(List=divide_2.Points)
lng_4 = ListLength(List=divide_2.Points)
Z_10 = UnitZ(Factor=series_7)  # -> graft(UnitVector)
move_6 = Move(Geometry=divide_3.Points, Motion=Z_10)  # -> flatten(Geometry), Transform; disabled
ln_6 = Line(StartPoint=split_2.ListB, EndPoint=split.ListA)
clean_3 = CleanTree(RemoveNulls=True, RemoveInvalid=True, RemoveEmpty=False, Tree=end_4.Start)
offset_9 = OffsetCurve(Curve=scale_2.Geometry, Distance=1, Plane=PlaneXY(0, 0, 0), Corners=1)
pdecon = Deconstruct(Point=pt_13)  # -> XComponent, YComponent, ZComponent
merge_10 = Merge(Data1=flatten(move_2.Geometry), Data2=flatten(move_6.Geometry), Data3=flatten(item_11))
graft = GraftTree(Tree=divide_2.Points, IncludeEmptyLists=True, IncludeNullItems=True)
graft_2 = GraftTree(Tree=rev_5, IncludeEmptyLists=True, IncludeNullItems=True)

# ---- group: connect patterns here!
python_10 = GhPythonScript(x=slicing_structuring.layers, pattern=axolotlspatial.axolotl_spatial)  # -> out, crvs; inputs x: list
# ---------- python_10: Python ----------
import Rhino.Geometry as rg

a_list, b_list = x

crvs = []

for i, vs in enumerate(a_list):
    
    pts = []
    
    for v in vs:
        pts.append(pattern.apply(v))
    
    pts.extend(b_list[i])
    
    crvs.append(rg.Polyline(pts + [pts[0]]))
# ---------- end python_10 ----------
crv_10 = Curve(python_10.crvs)

# ----
series_8 = Series(Start=mod, Step=0, Count=lng_4)  # -> graft(Series)
graft_3 = GraftTree(IncludeEmptyLists=True, IncludeNullItems=True)
pline_9 = PolyLine(Vertices=merge_10, Closed=False)
merge_11 = Merge(Data1=graft, Data2=graft_2)
nozzlesettings_2 = GhPythonScript(x=flatten(manualnozzloverwrite))  # -> out, extrusion_rate, spacing_cross, spacing_paths, spacing_link, start_stop_retraction, start_reextrusion_rate
# ---------- nozzlesettings_2: Python ----------
import scriptcontext as sc

extrusion_rate = sc.sticky["PrintSettings"]["print_extrusion_rate"]
spacing_cross = sc.sticky["PrintSettings"]["print_spacing_cross"]
spacing_paths = sc.sticky["PrintSettings"]["print_spacing_paths"]
spacing_link = sc.sticky["PrintSettings"]["print_spacing_link"]
start_stop_retraction = sc.sticky["PrintSettings"]["print_spacing_start_stop_retraction"]
start_reextrusion_rate = sc.sticky["PrintSettings"]["print_spacing_start_reextrusion_rate"]

print(True)
# ---------- end nozzlesettings_2 ----------
pt_14 = Point(clean_3)
path_mapper_6 = PathMapper(series_8, source="{A;B;C;D;E}", target="{D;E}")
start_stop_feedrate_in_mm_min = Slider(100, range=0..1000)
path_mapper_7 = PathMapper(merge_11, source="{A;B;C;D}", target="{C;D}")
panel_7 = Panel(python_10.out)
pdecon_2 = Deconstruct(Point=pt_14)  # -> XComponent, YComponent, ZComponent
path_mapper_8 = PathMapper(crv_10, source="{A;B;C;D}", target="{A;B;C}")
list_2 = ValueList({"start / stop": "start_stop", "continious"}, selected="continious")

spacing_inter_paths = Number(nozzlesettings_2.spacing_paths)
spacing_link_exterior = Number(nozzlesettings_2.spacing_link)
spacing_cross = Number(nozzlesettings_2.spacing_cross)

line = Line(Line((-27.46198946, 138.4851678, 0), (-0.1413537679, -0.6893088134, 0)))
item_12 = ListItem(List=path_mapper_7, Index=path_mapper_6, Wrap=True)
path_mapper_9 = PathMapper(item_12, source="{A;B}", target="{A}")

# ---- group: — Shell Setup —
list_3 = ValueList({"detached", "crossing"}, selected="detached")
list_4 = ValueList({"Inside": "inside", "Outside": "outside"}, selected="Outside")
# amount of layers per shell
# 
# Outside/Inside : which layer would be printed first or last
# 
# Split line = location of the seam
# 
# Side Bool = external or left or right.?
toggle_3 = BooleanToggle(True)
python_11 = GhPythonScript(
    x=library_path_2,
    crvs=path_mapper_8,
    shell_spacing=spacing_inter_paths,
    direction=list_4,
    count=Slider(1, range=0..10),
    split_distance=spacing_cross,
    split_type=list_3,
    split_line=line,
    side_bool=toggle_3)  # -> out, a, b, link_inner_crvs, main_inner_crvs, outer_crvs, pt_sets; inputs crvs: list of Curve, count: Int32, side_bool: Boolean
# ---------- python_11: Python ----------
import sys
import Rhino.Geometry as rg

sys.path.append(x)

# print(sys.path)

import generalFunctions as gf
import layerFunctions as lf
import scriptcontext as sc

sc.sticky["PrintSettings"]["shell_count"] = count
sc.sticky["PrintSettings"]["shell_direction"] = direction
sc.sticky["PrintSettings"]["shell_spacing"] = shell_spacing
sc.sticky["PrintSettings"]["shell_split_distance"] = split_distance
sc.sticky["PrintSettings"]["shell_split_type"] = split_type


reload(gf)
reload(lf)

o_crv_sets = []
outer_crvs = []

if count > 1:

    for crv_i, crv in enumerate(crvs):
        
        print(crv_i)
    
        o_crv_set = gf.offsetCurveSet(crv, shell_spacing, direction, count)
        layer_set = lf.LinkingLayers(o_crv_set, split_distance, side_bool, split_type, split_line)
        layer_set.createOrganisedCurves()
        pt_set = layer_set.joinCrvs()
    
        pt_set = pt_set[1:-1] + [pt_set[1]]
    
        crv = rg.Polyline(pt_set).ToPolylineCurve()
    
        o_crv_sets.append(o_crv_set)
        outer_crvs.append(crv)
        
else:
    
    outer_crvs = crvs

o_type = rg.CurveOffsetCornerStyle.Sharp

main_inner_crvs = []
link_inner_crvs = []

if count == 1:
    
    for crv in crvs:
        
        print(crv)
    
        main_inner_crv = crv
        
        pln = rg.Plane(main_inner_crv.PointAt(0.0), rg.Vector3d(0,0,1))
        
        sim = rg.CurveSimplifyOptions.All
        main_inner_crv = main_inner_crv.Simplify(sim, 10., 1.)
        
        try:
            link_inner_crv = main_inner_crv.Offset(pln, -shell_spacing, .01, o_type)[0]
        except:
            print("I Failed :/")
            print(main_inner_crv)
        
        main_inner_crvs.append(main_inner_crv)
        link_inner_crvs.append(link_inner_crv)

elif direction == "outside":
    
    for o_crv_set in o_crv_sets:
    
        main_inner_crv = rg.Polyline(o_crv_set[0]).ToPolylineCurve()
        
        pln = rg.Plane(main_inner_crv.PointAt(0.0), rg.Vector3d(0,0,1))
        
        link_inner_crv = main_inner_crv.Offset(pln, -shell_spacing, .01, o_type)[0]
        
        main_inner_crvs.append(main_inner_crv)
        link_inner_crvs.append(link_inner_crv)
    
else:
    
    for o_crv_set in o_crv_sets:
    
        main_inner_crv = rg.Polyline(o_crv_set[0]).ToPolylineCurve()
        
        pln = rg.Plane(main_inner_crv.PointAt(0.0), rg.Vector3d(0,0,1))
        
        link_inner_crv = main_inner_crv.Offset(pln, -shell_spacing, .01, o_type)[0]
        
        main_inner_crvs.append(main_inner_crv)
        link_inner_crvs.append(link_inner_crv)
# ---------- end python_11 ----------

# ----
start_stop_feedrate_in_mm_min_2 = Slider(100, range=0..1000)
number_slider_31 = Slider(1, range=0..1)  # disabled
number_slider_32 = Slider(0.5, range=0..1)  # disabled
pt_15 = Point(given_points)
number_slider_33 = Slider(1, range=0..10)  # disabled
list_5 = ValueList({"start / stop": "start_stop", "continious"}, selected="continious")
pline_10 = PolyLine(Vertices=flatten(divide_2.Points), Closed=False)
scale_3 = Scale(Geometry=merge_10, Center=Point(0, 0, 0), Factor=shrinkage.scale_value)  # -> Geometry, Transform
brep = Brep(extr)  # disabled
number_slider_34 = Slider(0.5, range=0..1)  # disabled
pin_only_heights = Number(python.pin_only_heights)
end_6 = EndPoints(Curve=pline_10)  # -> Start, End
xy = XYPlane(Origin=Point(0, 0, 0))
preview = CustomPreview(Geometry=pline_10, Material=ColourSwatch(SwatchColor=RGB(81, 232, 30)))
library_path_3 = FilePath(library_path_2)

# ---- group: — PIN Setup —
python_12 = GhPythonScript(
    x=library_path_3,
    pin_pts=flatten(pt_15),
    connection_count=Slider(3, range=1..4),
    max_main_line=Slider(100, range=25..250),
    start_end_alfa=Slider(1.571, range=0..3.142),
    mid_alfa=Slider(0.5, range=0..3.142),
    pin_height=Slider(260, range=0..1000),
    bot_rad=Slider(35, range=0..100),
    top_rad=Slider(18, range=0..100),
    resolution=Slider(16, range=0..100),
    spacing=spacing_link_exterior)  # -> out, main_links, side_links, split_lines, pin_pt_sets, pins, mid_links, link_line_vis, pin_geo, extra_pts; inputs pin_pts: list of Point3d, connection_count: Int32, resolution: Int32
# ---------- python_12: Python ----------
import sys

sys.path.append(x)

import pinLinkingBis as pl

reload(pl)

main_links, link_lines, split_lines, pin_pt_sets, mid_links, b_mid_pts = pl.createLinks(
    pin_pts = pin_pts,
    connection_count = connection_count,
    max_main_line = max_main_line,
    start_end_alfa = start_end_alfa,
    mid_alfa = mid_alfa
)

link_line_vis = link_lines

main_links = pl.linkSetGeneration(main_links, spacing)
side_links = pl.linkSetGeneration(link_lines, spacing, 2)
mid_links = pl.linkSetGeneration(mid_links, spacing, 2)

extra_pts = []

for i, b_pt_set in enumerate(b_mid_pts):
    
    extra_pts.extend(pl.linkClosestPoints(main_links[i], b_pt_set))

pins = pl.pinMaker(pin_pts, pin_height, bot_rad, top_rad, resolution)

pin_geo = []

for pin in pins:
    
    pin_geo.append(pin.createGeometry())
# ---------- end python_12 ----------

# ----
python_13 = GhPythonScript(x=python_12.pins, y=Slider(160, range=0..250))  # -> out, a
# ---------- python_13: Python ----------
x.res_delta = 6.2831852 / 60
a = x.createSlice(100.)
# ---------- end python_13 ----------
project_4 = Project(Geometry=flatten(python_13.a), Plane=PlaneXY(0, 0, 0))  # -> Geometry, Transform
python_14 = GhPythonScript(x=project_4.Geometry)  # -> out, a; inputs x: list of Point3d
# ---------- python_14: Python ----------
v_string_list = []

for v in x:
    v_string_list.append((v.X, v.Y, v.Z))
    
print(v_string_list)
# ---------- end python_14 ----------
python_15 = GhPythonScript(x=python_12.pins, y=Slider(160, range=0..250))  # -> out, a; same code as python_13
panel_8 = Panel(python_14.out)
project_5 = Project(Geometry=flatten(python_15.a), Plane=PlaneXY(0, 0, 0))  # -> Geometry, Transform
python_16 = GhPythonScript(x=project_5.Geometry)  # -> out, a; inputs x: list of Point3d; same code as python_14
panel_9 = Panel(python_16.out)
circle_4 = CircleCNR(Center=xy, Normal=Vector(0, 0, 1), Radius=Slider(1, range=0..1))
pi = Pi(Factor=2)
panel_10 = Panel(python_11.out)
dist_2 = Distance()  # disabled
crvdom = CurveDomain(Curve=circle_4, Domain=pi)  # -> Curve, Domain
value_list = ValueList({"marieGriesmar": "", "lehmHuus": "_lehmHuus"}, selected="marieGriesmar")
bbox = BoundingBox(Content=brep, Plane=PlaneXY(0, 0, 0))  # -> Box, Box_2; disabled
end_link_curve = Curve(graft(python_11.main_inner_crvs))
side_link_curve = Curve(graft(python_11.link_inner_crvs))
crv_cp_3 = CurveClosestPoint(Point=end_6.End, Curve=crvdom.Curve)  # -> Point, Parameter, Distance
python_17 = GhPythonScript(
    height_list=merge_3,
    width_list=merge_2,
    phase=crv_cp_3.Parameter,
    direction=Toggle(True),
    resolution=Slider(100, range=0..1000),
    layer_height=number_slider_17)  # -> out, pts; inputs height_list: list, width_list: list, direction: Boolean, resolution: Int32
# ---------- python_17: Python ----------
from Rhino.Geometry import Point3d
from math import cos, sin

delta = 3.1415927 * 2. / resolution
h_delta = layer_height / resolution

h = height_list[0]
alfa = phase

pts = []

keep_adding = True

def radius(hs, rs, h):
    for i, h_set in enumerate(hs[1:]):
        # print(h_set, h, hs[i])
        if h < h_set and h > hs[i]:
            return rs[i] + (rs[i+1] - rs[i]) / (h_set - hs[i]) * (h - hs[i])
        elif h_set == h:
            return rs[i+1]
        elif hs[i] == h:
            return rs[i]
            
    print("don't have anything for you mate")

while keep_adding:
    r = radius(height_list, width_list, h)
    
    x = cos(alfa) * r
    y = sin(alfa) * r
    
    if direction:
        alfa += delta
    else:
        alfa -= delta
    
    pts.append(Point3d(x, y, h))
    
    h += h_delta
    
    keep_adding = h < height_list[-1]
# ---------- end python_17 ----------
pt_16 = Point(python_17.pts)
panel_11 = Panel(python_17.out)
merge_12 = Merge(Data1=flatten(divide_2.Points), Data2=python_17.pts)
pline_11 = PolyLine(Vertices=flatten(merge_12), Closed=False)
crv_11 = Curve(pline_11)
move_7 = Move(Geometry=pline_11, Motion=Z_4)  # -> Geometry, Transform
crv_cp_4 = CurveClosestPoint(Point=end_2.Start, Curve=crv_11)  # -> Point, Parameter, Distance
crv_cp_5 = CurveClosestPoint(Point=crv_cp_4.Point, Curve=pline)  # -> Point, Parameter, Distance
python_18 = GhPythonScript(t=crv_cp_4.Parameter, crv=crv_11)  # -> out, crv; inputs crv: Curve; same code as python_8
addition_9 = Addition(A=crv_cp_4.Point, B=crv_cp_5.Point)
ln_7 = Line(StartPoint=crv_cp_4.Point, EndPoint=crv_cp_5.Point)
move_8 = Move(Geometry=python_18.crv, Motion=Z_6)  # -> Geometry, Transform
multiplication_6 = Multiplication(A=addition_9, B=0.5)
divide_4 = DivideCurve(Curve=move_8.Geometry, Count=1, Kinks=True)  # -> flatten(Points), Tangents, Parameters
item_13 = ListItem(List=divide_4.Points, Index=0, Wrap=True)  # -> Item1, Item
scale_4 = Scale(Geometry=ln_7, Center=multiplication_6, Factor=0.5)  # -> Geometry, Transform
offset_10 = OffsetCurve(Curve=scale_4.Geometry, Distance=1, Plane=PlaneXY(0, 0, 0), Corners=1)
move_9 = Move(Geometry=item_13.Item1, Motion=Z_8)  # -> Geometry, Transform
merge_13 = Merge(Data1=flatten(move.Geometry), Data2=flatten(divide_4.Points), Data3=flatten(move_9.Geometry))
pline_12 = PolyLine(Vertices=merge_13, Closed=False)
scale_5 = Scale(Geometry=merge_13, Center=Point(0, 0, 0), Factor=shrinkage.scale_value)  # -> Geometry, Transform
debox = DeconstructBox(Box=bbox.Box_2)  # -> Plane, X, Y, Z; disabled
ln_8 = Line(StartPoint=end_6.End, EndPoint=crv_cp_3.Point)
dedomain = DeconstructDomain(Domain=debox.Z)  # -> Start, End; disabled
subtraction_3 = Subtraction(A=dedomain.End, B=dedomain.Start)  # disabled
value_list_2 = ValueList({"marieGriesmar": "", "lehmHuus": "_lehmHuus"}, selected="marieGriesmar")
Z_11 = UnitZ(Factor=subtraction_3)  # disabled
pt_17 = Point()  # disabled
python_19 = GhPythonScript(x=slicing_structuring.layers)  # -> out, a; inputs x: list; disabled
# ---------- python_19: Python ----------
a, b = x

first_layer = a[0]

a = [v.v for v in first_layer]
# ---------- end python_19 ----------
savefile = Button()
python_20 = GhPythonScript(x=slicing_structuring.layers, pattern=cylinderpattern.cylinder_pattern)  # -> out, crvs; inputs x: list; disabled; same code as python_10
number_slider_35 = Slider(0.5, range=0..1)  # disabled
project_6 = Project(Geometry=python_19.a, Plane=PlaneXY(0, 0, 0))  # -> Geometry, Transform; disabled
intcrv = Interpolate(Vertices=project_6.Geometry, Degree=3, Periodic=False, KnotStyle=1)  # -> Curve, Length, Domain; disabled
extr_2 = Extrude(Base=intcrv.Curve, Direction=Z_11)  # disabled
pline_13 = PolyLine(Vertices=project_6.Geometry, Closed=False)  # disabled
len = Length(Curve=pline_13)  # disabled
savefile_2 = Button()
mesh = Mesh(python_12.pin_geo)
mesh_2 = Mesh(graft(mesh))
bbox_2 = BoundingBox(Content=mesh_2, Plane=PlaneXY(0, 0, 0))  # -> Box, Box_2
debox_2 = DeconstructBox(Box=bbox_2.Box)  # -> Plane, X, Y, Z
dedomain_2 = DeconstructDomain(Domain=debox_2.Z)  # -> Start, End
Z_12 = UnitZ(Factor=dedomain_2.Start)
Z_13 = UnitZ(Factor=dedomain_2.End)
xy_2 = XYPlane(Origin=Z_12)
xy_3 = XYPlane(Origin=Z_13)
sec = MeshPlane(Mesh=mesh_2, Plane=xy_3)
sec_2 = MeshPlane(Mesh=mesh_2, Plane=xy_2)
bbox_3 = BoundingBox(Content=sec_2, Plane=PlaneXY(0, 0, 0))  # -> Box, Box_2
bbox_4 = BoundingBox(Content=sec, Plane=PlaneXY(0, 0, 0))  # -> Box, Box_2
debox_3 = DeconstructBox(Box=bbox_3.Box)  # -> Plane, X, Y, Z
debox_4 = DeconstructBox(Box=bbox_4.Box)  # -> Plane, X, Y, Z
dedomain_3 = DeconstructDomain(Domain=debox_3.Z)  # -> Start, End
dedomain_4 = DeconstructDomain(Domain=debox_3.X)  # -> Start, End
dedomain_5 = DeconstructDomain(Domain=debox_3.Y)  # -> Start, End
dedomain_6 = DeconstructDomain(Domain=debox_4.Z)  # -> Start, End
dedomain_7 = DeconstructDomain(Domain=debox_4.X)  # -> Start, End
dedomain_8 = DeconstructDomain(Domain=debox_4.Y)  # -> Start, End
subtraction_4 = Subtraction(A=dedomain_4.End, B=dedomain_4.Start)
addition_10 = Addition(A=dedomain_4.Start, B=dedomain_4.End)
addition_11 = Addition(A=dedomain_5.Start, B=dedomain_5.End)
subtraction_5 = Subtraction(A=dedomain_7.End, B=dedomain_7.Start)
addition_12 = Addition(A=dedomain_7.Start, B=dedomain_7.End)
addition_13 = Addition(A=dedomain_8.Start, B=dedomain_8.End)
division_4 = Division(A=addition_10, B=2)
division_5 = Division(A=addition_11, B=2)
division_6 = Division(A=addition_12, B=2)
division_7 = Division(A=addition_13, B=2)
division_8 = Division(A=subtraction_4, B=2)
division_9 = Division(A=subtraction_5, B=2)
pt_18 = ConstructPoint(XCoordinate=division_4, YCoordinate=division_5, ZCoordinate=dedomain_3.Start)
pt_19 = ConstructPoint(XCoordinate=division_6, YCoordinate=division_7, ZCoordinate=dedomain_6.Start)
cir = Circle(Plane=pt_18, Radius=division_8)
cir_2 = Circle(Plane=pt_19, Radius=division_9)
offset_11 = OffsetCurve(Curve=cir, Distance=neg_7, Plane=PlaneXY(0, 0, 0), Corners=1)
offset_12 = OffsetCurve(Curve=cir, Distance=number_slider_27, Plane=PlaneXY(0, 0, 0), Corners=1)
offset_13 = OffsetCurve(Curve=cir_2, Distance=neg_8, Plane=PlaneXY(0, 0, 0), Corners=1)
offset_14 = OffsetCurve(Curve=cir_2, Distance=number_slider_27, Plane=PlaneXY(0, 0, 0), Corners=1)
merge_14 = Merge(Data1=offset_11, Data2=offset_13)
merge_15 = Merge(Data1=offset_12, Data2=offset_14)
loft = Loft(Curves=merge_14, Options={Adjust=False, Closed=False, LoftEnds=0, LoftSimp=0, LoftType=0, Rebuild=10, Refit=0.01})
loft_2 = Loft(Curves=merge_15, Options={Adjust=False, Closed=False, LoftEnds=0, LoftSimp=0, LoftType=0, Rebuild=10, Refit=0.01})
cap_2 = CapHoles(Brep=loft_2)
cap_3 = CapHoles(Brep=loft)
merge_16 = Merge(Data1=flatten(cap_2), Data2=cap)
sunion = SolidUnion(Breps=merge_16)  # disabled
sdiff = SolidDifference(BrepsA=sunion, BrepsB=flatten(cap_3))  # disabled

# ---- group: visualization
loft_3 = Loft(Curves=python_10.crvs, Options={Adjust=False, Closed=False, LoftEnds=0, LoftSimp=0, LoftType=0, Rebuild=10, Refit=0.01})
col = Colour(RGB(230, 136, 37))
merge_17 = Merge(Data1=loft_3, Data2=mesh)  # -> flatten(Result)
gate = StreamGate(Stream=merge_17, Gate=Toggle(True))  # -> Target0, Target1
preview_2 = CustomPreview(Geometry=gate.Target1, Material=col)

# ----
mesh_3 = Mesh(sdiff)  # disabled
cluster = Cluster(M=mesh_3, L=number_slider_33, B=brep, B_2=number_slider_31)  # disabled
cluster_2 = Cluster(M=cluster, L=number_slider_33, B=brep, B_2=number_slider_32)  # disabled
wbsplitquads = WeaverbirdsConstantQuadsSplitSubdivision(MeshCurves=cluster_2, Level=number_slider_33, SmoothNakedEdges=1)  # disabled
demesh = DeconstructMesh(Mesh=wbsplitquads)  # -> Vertices, Faces, Colours, Normals; disabled
brep_cp = BrepClosestPoint(Point=demesh.Vertices, Brep=extr_2)  # -> Point, Normal, Distance; disabled
pt_20 = Point(demesh.Vertices)  # disabled
merge_18 = Merge(Data1=graft(demesh.Vertices), Data2=graft(brep_cp.Point))  # disabled
project_7 = Project(Geometry=pt_20, Plane=PlaneXY(0, 0, 0))  # -> Geometry, Transform; disabled
item_14 = ListItem(List=merge_18, Index=0, Wrap=True)  # -> flatten(Item); disabled
conmesh = ConstructMesh(Vertices=item_14, Faces=demesh.Faces)  # disabled
panel_12 = Panel(python_12.out)
crvdom_2 = CurveDomain(Curve=pline_13, Domain=len)  # -> Curve, Domain; disabled
medges = MeshEdges(Mesh=conmesh)  # -> NakedEdges, InteriorEdges, NonManifoldEdges; disabled
crv_cp_6 = CurveClosestPoint(Point=project_7.Geometry, Curve=crvdom_2.Curve)  # -> Point, Parameter, Distance; disabled
pdecon_3 = Deconstruct(Point=pt_20)  # -> XComponent, YComponent, ZComponent; disabled

# ---- group: Main Link connection / Offset Pins Layers
number_slider_36 = Slider(3, range=0..10)
number_slider_37 = Slider(3, range=0..10)

# ----
python_21 = GhPythonScript(pin=python_12.pins, pin_heights=pin_only_heights)  # -> out, slices; inputs pin_heights: list
# ---------- python_21: Python ----------
slices = []

for h in pin_heights:
    
    slices.append(pin.createSlice(h))
# ---------- end python_21 ----------
item_15 = ListItem(List=pin_only_heights, Index=0, Wrap=True)  # -> Item1, Item

# ---- group: Main Link connection
python_22 = GhPythonScript(x=flatten(end_link_curve))  # -> out, flatten(heights), flatten(index); inputs x: list of Curve
# ---------- python_22: Python ----------
heights = []
index = []

for crv_i, crv in enumerate(x):
    
    heights.append(crv.PointAt(0.0).Z)
    index.append(crv_i)
# ---------- end python_22 ----------
python_23 = GhPythonScript(
    x=library_path_3,
    main_links=flatten(python_12.main_links),
    pins=flatten(python_12.pins),
    link_set=flatten(python_12.side_links),
    heights=flatten(python_22.heights),
    count=flatten(python_22.index),
    bottom_shift_count=number_slider_36,
    bottom_max_shift=number_slider_37)  # -> out, graft(main_crv), b, c, inner_crvs, main_crv_pt_set, main_links; inputs main_links: list, pins: list, link_set: list
# ---------- python_23: Python ----------
import sys

sys.path.append(x)

import pinLinkingBis as pl

reload(pl)

if count < bottom_shift_count:
    
    print("I am shifting the bottom layer with: ")
    
    count_delta = bottom_max_shift / float(bottom_shift_count)
    
    bottom_offset = count_delta * (bottom_shift_count - count)
    print("bottom offset: %s" % bottom_offset)
    
else:
    
    bottom_offset = None

main_crv, b, main_links, inner_crvs = pl.makeMainShape(pins, main_links, heights, bottom_offset)
# ---------- end python_23 ----------

# ---- group: Interconnections - code
python_24 = GhPythonScript(side_links=python_12.side_links, end_link_index=Slider(1, range=0..100))  # -> out, flatten(side_links), flatten(end_link), end_link_vis; inputs side_links: list, end_link_index: Int32
# ---------- python_24: Python ----------
import Rhino.Geometry as rg
from copy import deepcopy as dc

side_link_count = len(side_links)

end_link_index = end_link_index % side_link_count

end_link = side_links.pop(end_link_index)

# visualisation of the end link

end_link_vis = dc(end_link.lines)

for end_link_line in end_link_vis:
    
    sc_m = rg.Transform.Scale(end_link_line.From, 100.0)
    
    end_link_line.Transform(sc_m)
# ---------- end python_24 ----------
path_mapper_10 = PathMapper(end_link_curve, source="{A;B;C;D;E}", target="{E}")
path_mapper_11 = PathMapper(python_23.main_crv, source="{A;B}", target="{B}")
path_mapper_12 = PathMapper(side_link_curve, source="{A;B;C;D;E}", target="{E}")
python_25 = GhPythonScript(x=library_path_3, end_link=flatten(python_24.end_link), interior_crv=path_mapper_11, exterior_crv=path_mapper_10)  # -> out, graft(output_end_link), side_link_lines; inputs interior_crv: Curve, exterior_crv: Curve
# ---------- python_25: Python ----------
import Rhino.Geometry as rg
from copy import deepcopy as dc

import sys

sys.path.append(x)

height_val = interior_crv.PointAt(0.0).Z

mv_m = rg.Transform.Translation(rg.Vector3d(0,0,height_val))
    
output_end_link = dc(end_link)
output_end_link.Transform(mv_m)
    
output_end_link.trimLines(exterior_crv, True)
output_end_link.trimLines(interior_crv, False)

side_link_lines = dc(output_end_link.lines)
# ---------- end python_25 ----------
python_26 = GhPythonScript(x=library_path_3, side_links=flatten(python_24.side_links), interior_crv=path_mapper_11, exterior_crv=path_mapper_12)  # -> out, output_side_links, side_link_lines; inputs side_links: list, interior_crv: Curve, exterior_crv: Curve
# ---------- python_26: Python ----------
import Rhino.Geometry as rg
from copy import deepcopy as dc

import sys

sys.path.append(x)

height_val = interior_crv.PointAt(0.0).Z

mv_m = rg.Transform.Translation(rg.Vector3d(0,0,height_val))

side_link_lines = []

print(type(exterior_crv))

output_side_links = []

for side_link in side_links:
    
    loc_link = dc(side_link)
    loc_link.Transform(mv_m)
    
    loc_link.trimLines(exterior_crv, True)
    loc_link.trimLines(interior_crv, False)
    
    output_side_links.append(loc_link)
    
    side_link_lines.extend(loc_link.lines)
    
print(side_link_lines[0].To.Z)
# ---------- end python_26 ----------
midlinks = GhPythonScript(x=library_path_3, mid_links=flatten(python_12.mid_links), interior_crv=path_mapper_11, exterior_crv=path_mapper_12)  # -> out, output_mid_links, mid_link_lines; inputs mid_links: list, interior_crv: Curve, exterior_crv: Curve
# ---------- midlinks: Python ----------
import Rhino.Geometry as rg
from copy import deepcopy as dc

import sys

sys.path.append(x)

height_val = interior_crv.PointAt(0.0).Z

mv_m = rg.Transform.Translation(rg.Vector3d(0,0,height_val))

mid_link_lines = []

print(type(exterior_crv))

output_mid_links = []

for mid_link in mid_links:
    
    loc_link = dc(mid_link)
    loc_link.Transform(mv_m)
    
    loc_link.trimLines(exterior_crv, True)
    loc_link.trimLines(interior_crv, False)
    
    output_mid_links.append(loc_link)
    
    mid_link_lines.extend(loc_link.lines)
    
print(mid_link_lines[0].To.Z)
# ---------- end midlinks ----------

# ----
pt_21 = ConstructPoint(XCoordinate=crv_cp_6.Parameter, YCoordinate=pdecon_3.ZComponent, ZCoordinate=0)  # disabled
subtraction_6 = Subtraction()  # disabled
python_27 = GhPythonScript(o=item_14, n=brep_cp.Normal, v=pt_21)  # -> out, vs; inputs o: list of Point3d, n: list of Point3d, v: list of Point3d; disabled
# ---------- python_27: Python ----------
class Vrtx:
    def __init__(self, o, n, v, is_neg=False):

        self.o = o
        self.v = o
        
        self.n = n
        self.n_scale = 1.0

        self.x_val = v.X
        self.y_val = v.Y

        self.vec_version = v

        self.is_neg = is_neg
        
        
        
vs = []
for loc_o, loc_n, loc_v in zip(o, n, v):
    vs.append(Vrtx(loc_o, loc_n, loc_v))
# ---------- end python_27 ----------
number_slider_38 = Slider(50, range=0..100)  # disabled
number_slider_39 = Slider(2, range=0..10)  # disabled
crv_12 = Curve(python_21.slices)
panel_13 = Panel(path_mapper_10)
python_28 = GhPythonScript(vs=python_27.vs, pattern=sinwave.sin_wave)  # -> out, pts; inputs vs: list; disabled
# ---------- python_28: Python ----------
pts = []
for v in vs:
    pts.append(pattern.apply(v))
# ---------- end python_28 ----------
num_3 = Number(brep_cp.Distance)  # disabled
panel_14 = Panel(midlinks.out)
path_mapper_13 = PathMapper(crv_12, source="{A;B;C}", target="{C}")
pt_22 = Point(item_14)  # disabled
pt_23 = Point(python_28.pts)  # disabled
subtraction_7 = Subtraction(A=number_slider_38, B=num_3)  # disabled
multiplication_7 = Multiplication(A=number_slider_38, B=number_slider_39)  # disabled
panel_15 = Panel(python_26.out)
subtraction_8 = Subtraction(A=pt_23, B=pt_22)  # disabled
division_10 = Division(A=subtraction_7, B=multiplication_7)  # disabled
panel_16 = Panel(path_mapper_13)
abs = Absolute(Value=division_10)  # disabled
library_path_4 = FilePath(library_path_3)

# ---- group: Interior Curves
line_2 = Line(flatten(python_12.split_lines))
crv_13 = Curve(python_23.inner_crvs)
layer_count = Slider(1, range=0..10)
path_mapper_14 = PathMapper(python_23.main_links, source="{C;D}", target="{D}")
path_mapper_15 = PathMapper(python_25.output_end_link, source="{D;E}", target="{D}")
path_mapper_16 = PathMapper(midlinks.output_mid_links, source="{D;E}", target="{D}")
list_6 = ValueList({"detached", "crossing"}, selected="crossing")
list_7 = ValueList({"Inside": "inside", "Outside": "outside"}, selected="Inside")
path_mapper_17 = PathMapper(python_26.output_side_links, source="{D;E}", target="{D}")
path_mapper_18 = PathMapper(crv_13, source="{C;D}", target="{D}")
python_29 = GhPythonScript(
    x=library_path_4,
    extra_pts=flatten(python_12.extra_pts),
    main_links=path_mapper_14,
    side_links=path_mapper_17,
    end_link=path_mapper_15,
    mid_links=path_mapper_16,
    crvs=path_mapper_18,
    split_lines=line_2,
    distance=spacing_inter_paths,
    direction=list_7,
    count=layer_count,
    split_distance=spacing_cross,
    split_type=list_6,
    side_bool=Toggle(True),
    diamond_link=Toggle(True),
    safety=Toggle(True),
    main_link_length=Slider(26.1, range=0..100),
    side_length=Slider(61.3, range=0..100))  # -> out, log, b, c, d, e, pt_sets, start_and_end_pt, main_crv; inputs extra_pts: list of Point3d, main_links: list, side_links: list, mid_links: list, crvs: list of Curve, split_lines: list of Line, count: Int32, side_bool: Boolean
# ---------- python_29: Python ----------
import sys

sys.path.append(x)

# print(sys.path)

import generalFunctions as gf
import layerFunctions as lf
import Rhino.Geometry as rg
import pinLinkingBis as pl

from copy import deepcopy as dc

reload(gf)
reload(lf)
reload(pl)

log = ["new sequence start"]

diamond_settings = (diamond_link, safety, (main_link_length, side_length))

pt_sets = []

inner_crvs = []

height = crvs[0].PointAt(0.0).Z

mv_m = rg.Transform.Translation(rg.Vector3d(0,0, height))

loc_split_lines = dc(split_lines)
[line.Transform(mv_m) for line in loc_split_lines]

print loc_split_lines

crv_count = len(crvs)
print("there are %s curves in your list" % crv_count)

if count == 1:
    
    for crv in crvs:
        
        crv.Reverse()
        
    inner_crvs = crvs
    
else:
    
    for crv_i, crv in enumerate(crvs):
        
        a = gf.offsetCurveSet(crv, distance, direction, count)
        layer_set = lf.LinkingLayers(a, split_distance, side_bool, split_type, split_line = loc_split_lines[crv_i])
        # a = layer_set.split_a
        # b = layer_set.split_b
        # c = layer_set.split_line
        # d = layer_set.split_axis
        a, b, c, d, e = layer_set.createOrganisedCurves()
        
        pt_set = layer_set.joinCrvs()
        pt_set = pt_set[1:-1] + [pt_set[1]]
        
        crv = rg.Polyline(pt_set).ToPolylineCurve()
        
        inner_crvs.append(crv)

print("I passed this hurdle")

loc_extra_pts = []

for extra_pt in extra_pts:
    
    loc_pt = dc(extra_pt)
    loc_pt.Transform(mv_m)
    loc_extra_pts.append(loc_pt)
    
main_crv = pl.makeInnerCurve(inner_crvs, main_links, side_links, end_link, loc_extra_pts, mid_links, diamond_settings = diamond_settings)

print(main_crv)

start_and_end_pt = [main_crv.PointAt(main_crv.Domain[0]), main_crv.PointAt(main_crv.Domain[1])]
# ---------- end python_29 ----------

# ----
addition_14 = Addition(A=division_10, B=abs)  # disabled
multiplication_8 = Multiplication(A=addition_14, B=subtraction_8)  # disabled
# PIN - INFILL
# connections...?
# 
# 
# system, if organic shell
outer_crv = Curve(graft(python_11.outer_crvs))
addition_15 = Addition(A=multiplication_8, B=pt_22)  # disabled
pt_24 = Point(addition_15)  # disabled
conmesh_2 = ConstructMesh(Vertices=pt_24, Faces=demesh.Faces)  # disabled
preview_3 = CustomPreview(
    Geometry=conmesh_2,
    Material={diffuse=RGB(221, 160, 221), emission=RGB(66, 48, 66), shine=0.5, specular=RGB(255, 255, 255), transparency=0})  # disabled
path_mapper_19 = PathMapper(source="{A;B}", target="{A}")
pt_25 = Point(pt_15)
medges_2 = MeshEdges(Mesh=conmesh_2)  # -> NakedEdges, InteriorEdges, NonManifoldEdges; disabled
pline_14 = PolyLine(Closed=False)
panel_17 = Panel(python_29.out)

# ---- group: Background process (Layer unioning Generation)
path_mapper_20 = PathMapper(outer_crv, source="{A;B;C;D;E}", target="{E}")
path_mapper_21 = PathMapper(python_29.start_and_end_pt, source="{A;B}", target="{A}")
python_30 = GhPythonScript(x=library_path_4, start_end_pts=path_mapper_21, exterior_crv=path_mapper_20, interior_crv=python_29.main_crv)  # -> out, a; inputs start_end_pts: list of Point3d, exterior_crv: Curve, interior_crv: Curve
# ---------- python_30: Python ----------
import sys

sys.path.append(x)

import generalFunctions as gf

result_crvs, _ = gf.layer2ptIntersect(exterior_crv, start_end_pts)
pt_set = list(gf.curveToPolyline(gf.longestCurve(result_crvs)).ToArray())
pt_set_2 = list(gf.curveToPolyline(interior_crv).ToArray())

pt_set_2.reverse()

a = pt_set + pt_set_2[1:-1]
# ---------- end python_30 ----------

# ---- group: Start Point - End Point LISTS
pt_26 = Point(flatten(python_30.a))
first_point_brim = ListItem(List=pt_26, Index=0, Wrap=True)
last_point_pin = ListItem(List=pt_26, Index=0, Wrap=True)  # -> Item1, Item

# ----
endpoint = Point(last_point_pin.Item1)
helixpin = GhPythonScript(
    pins=python_12.pins,
    start_height=item_15.Item,
    start_pt=endpoint,
    end_height=number_slider_10,
    start_alfa=Slider(4.33, range=0..10),
    layer_height=number_slider_8)  # -> out, pin_helix_lists; inputs pins: list, start_pt: Point3d
# ---------- helixpin: Python ----------
pin_helix_lists = []

for i, pin in enumerate(pins):
    
    if i == 0:
        
        # first pin, which uses a start point
        
        helix = pin.helix(
            end_h = end_height,
            start_pt = start_pt,
            layer_h = layer_height
        )
        
        pin_helix_lists.append(helix)
        
    else:
        
        helix = pin.helix(
            end_h = end_height,
            start_h = start_height - layer_height * .5,
            layer_h = layer_height,
            start_alfa = start_alfa
        )
        
        pin_helix_lists.append(helix)
# ---------- end helixpin ----------

# ---- group: Seam
endpoint_2 = Point(last_point_pin.Item1)
splitlines = Line(flatten(line_2))
update_split_lines = GhPythonScript(end_pt=endpoint_2, split_lines=splitlines)  # -> out, split_lines; inputs end_pt: Point3d, split_lines: list of Line
# ---------- update_split_lines: Python ----------
end_pt.Z = 0.0
split_lines[0].To = end_pt
# ---------- end update_split_lines ----------

# ----
python_31 = GhPythonScript(x=helixpin.pin_helix_lists)  # -> out, points
# ---------- python_31: Python ----------
import Rhino.Geometry as rg

print(len(x))

points = [rg.Point3d(pt) for pt in x]
# ---------- end python_31 ----------
item_16 = ListItem(List=helixpin.pin_helix_lists, Index=0, Wrap=True)  # -> Item, Item1
path_mapper_22 = PathMapper(python_31.points, source="{A;B;C;D}", target="{D}")
nozzlesettings_3 = GhPythonScript(x=flatten(nozzlesettings_2.out))  # -> out, feed_rate, variable_feed_rate, feed_rate_max, feed_rate_max_start_start_ramp, feed_rate_max_end_start_ramp, feed_rate_max_start_end_ramp, feed_rate_max_end_end_ramp
# ---------- nozzlesettings_3: Python ----------
import scriptcontext as sc

feed_rate = sc.sticky["PrintSettings"]["feed_rate"]
variable_feed_rate = sc.sticky["PrintSettings"]["feed_rate_variable"]

if variable_feed_rate:
    
    feed_rate_max = sc.sticky["PrintSettings"]["feed_rate_max"]
    feed_rate_max_start_start_ramp = sc.sticky["PrintSettings"]["feed_rate_max_end_start_ramp"]
    feed_rate_max_end_start_ramp = sc.sticky["PrintSettings"]["feed_rate_max_end_start_ramp"]
    feed_rate_max_start_end_ramp = sc.sticky["PrintSettings"]["feed_rate_max_start_end_ramp"]
    feed_rate_max_end_end_ramp = sc.sticky["PrintSettings"]["feed_rate_max_end_end_ramp"]
    
print(True)
# ---------- end nozzlesettings_3 ----------

# ---- group: Nozzle-Set@Start
nozzlesettings_4 = GhPythonScript(x=flatten(nozzlesettings_3.out))  # -> out, extrusion_rate, spacing_cross, spacing_paths, spacing_link, start_stop_retraction, start_reextrusion_rate
# ---------- nozzlesettings_4: Python ----------
import scriptcontext as sc

extrusion_rate = sc.sticky["PrintSettings"]["print_extrusion_rate"]
spacing_cross = sc.sticky["PrintSettings"]["print_spacing_cross"]
spacing_paths = sc.sticky["PrintSettings"]["print_spacing_paths"]
spacing_link = sc.sticky["PrintSettings"]["print_spacing_link"]
start_stop_retraction = sc.sticky["PrintSettings"]["print_spacing_start_stop_retraction"]
start_reextrusion_rate = sc.sticky["PrintSettings"]["print_spacing_start_reextrusion_rate"]
# ---------- end nozzlesettings_4 ----------

# ----
library_path_5 = FilePath(library_path_4)
gcodelines = GhPythonScript(
    x=library_path_5,
    pts=scale_5.Geometry,
    feed_rate=nozzlesettings_3.feed_rate,
    extrusion_rate=nozzlesettings_4.extrusion_rate,
    link_type=list_2,
    global_trim_distance=Slider(0, range=0..10),
    ss_trim_distance=Slider(0, range=0..10),
    cull_distance=Slider(0, range=0..10),
    lift_val=Slider(4.4, range=0..10),
    ss_f_rate=start_stop_feedrate_in_mm_min,
    ss_e_rate=Slider(300, range=0..1000),
    variable_feed_rate=nozzlesettings_3.variable_feed_rate,
    peak_feed_rate=nozzlesettings_3.feed_rate_max,
    start_min=nozzlesettings_3.feed_rate_max_start_start_ramp,
    start_max=nozzlesettings_3.feed_rate_max_end_start_ramp,
    end_max=nozzlesettings_3.feed_rate_max_start_end_ramp,
    end_min=nozzlesettings_3.feed_rate_max_end_end_ramp)  # -> out, a, path_vis; inputs pts: list, variable_feed_rate: Boolean
# ---------- gcodelines: Python ----------
import sys

sys.path.append(x)

import Rhino.Geometry as rg
import simpleStartStop as ss

reload(ss)

# print(pts)

p_set = ss.PrintSettings(
    feed_rate = feed_rate, 
    extrusion_rate = extrusion_rate, 
    extrusion_mode = 'relative', 
    movement_mode = 'relative'
)

if variable_feed_rate:
    
    p_set.setComplexFeedrate(
        peak_feed_rate,
        min_h_ramp = (start_min, start_max),
        max_h_ramp = (end_max, end_min)
    )

l_type = ss.LinkType(
    link_type = link_type,
    global_trim_distance = global_trim_distance,
    ss_trim_distance = ss_trim_distance,
    cull_distance = cull_distance,
    lift_val = lift_val
)

l_type.ss_f_rate = ss_f_rate
l_type.ss_e_rate = ss_e_rate

gcodeset = ss.GCodeSet(pts, p_set, l_type)
a = gcodeset.generateGCode()

path_vis = gcodeset.path_vis
# ---------- end gcodelines ----------
gcodelines_2 = GhPythonScript(
    x=library_path_5,
    pts=scale_3.Geometry,
    feed_rate=nozzlesettings_3.feed_rate,
    extrusion_rate=nozzlesettings_4.extrusion_rate,
    link_type=list_5,
    global_trim_distance=Slider(0, range=0..10),
    ss_trim_distance=Slider(0, range=0..10),
    cull_distance=Slider(0, range=0..10),
    lift_val=Slider(4.4, range=0..10),
    ss_f_rate=start_stop_feedrate_in_mm_min_2,
    ss_e_rate=Slider(300, range=0..1000),
    variable_feed_rate=nozzlesettings_3.variable_feed_rate,
    peak_feed_rate=nozzlesettings_3.feed_rate_max,
    start_min=nozzlesettings_3.feed_rate_max_start_start_ramp,
    start_max=nozzlesettings_3.feed_rate_max_end_start_ramp,
    end_max=nozzlesettings_3.feed_rate_max_start_end_ramp,
    end_min=nozzlesettings_3.feed_rate_max_end_end_ramp)  # -> out, a, path_vis; inputs pts: list, variable_feed_rate: Boolean; same code as gcodelines
num_4 = Number(number_slider_8)
number_slider_40 = Slider(3.5, range=0..10)
addition_16 = Addition(A=num_4, B=0.001)
value_list_3 = ValueList({"marieGriesmar": "", "lehmHuus": "_lehmHuus"}, selected="lehmHuus")
savefile_3 = Button()

# ---- group: Brim
# SETTINGS need to be externalized
number_slider_41 = Slider(25, range=10..100)
item_17 = ListItem(List=path_mapper_8, Index=0, Wrap=True)

# ----
simplify = SimplifyCurve(Curve=item_17)  # -> Curve, Simplified

# ---- group: Brim (continued)
divide_5 = DivideCurve(Curve=simplify.Curve, Count=1, Kinks=True)  # -> Points, Tangents, Parameters
brim = GhPythonScript(
    x=library_path_4,
    first_pt=first_point_brim,
    pts=divide_5.Points,
    offset_amount=Slider(10, range=0..10),
    start_safety_distance=number_slider_41)  # -> out, flatten(a), start_pt, outer_brim_crv, base_pt, crv; inputs first_pt: Point3d, pts: list of Point3d
# ---------- brim: Python ----------
import sys

sys.path.append(x)

import Rhino.Geometry as rg
import generalFunctions as gf
import polyline as pl

reload(pl)

crv = rg.Polyline(pts).ToPolylineCurve()
_, t_val = crv.ClosestPoint(first_pt)

print(t_val)

crv.ChangeClosedCurveSeam(t_val)

base_pt_set = list(crv.ToPolyline().ToArray())

brim_pl = pl.StructuredPolyline(base_pt_set[:-1])
brim_pl.offset(offset_amount)

pt_set = brim_pl.pointSet() + [brim_pl.pointSet()[0]]

crv = rg.Polyline(pt_set).ToPolylineCurve()
_, t_val = crv.ClosestPoint(first_pt)

print(t_val)

base_pt = crv.PointAt(t_val)
crv.ChangeClosedCurveSeam(t_val)

# base_pt = brim_pl.v_set[0]
start_pt, first_pt = base_pt, first_pt

start_pt = first_pt + (start_pt - first_pt) * (start_safety_distance / offset_amount)

# a = [rg.Point3d(start_pt)] + brim_pt_set
a = list(crv.ToPolyline().ToArray())
# ---------- end brim ----------

# ----
panel_18 = Panel(brim.out)
clean_4 = CleanTree(RemoveNulls=True, RemoveInvalid=True, RemoveEmpty=False, Tree=brim.a)
clean_5 = CleanTree(RemoveNulls=True, RemoveInvalid=True, RemoveEmpty=False, Tree=brim.start_pt)

# ---- group: START/STOP--> CODE
split_3 = SplitTree(Data=path_mapper_22, Masks=flatten("{0}"))  # -> Positive, Negative
item_18 = ListItem(List=pt_25, Index=0, Wrap=True)  # -> Item, Item1
pdecon_4 = Deconstruct(Point=item_18.Item)  # -> XComponent, YComponent, ZComponent
pt_27 = Point(split_3.Negative)
extraheight = Slider(30, range=0..100)
item_19 = ListItem(List=split_3.Positive, Index=0, Wrap=True)  # -> Item1, Item
item_20 = ListItem(List=split_3.Negative, Index=0, Wrap=True)
pdecon_5 = Deconstruct(Point=item_18.Item1)  # -> XComponent, YComponent, ZComponent
pdecon_6 = Deconstruct(Point=item_19.Item1)  # -> XComponent, YComponent, ZComponent
pdecon_7 = Deconstruct(Point=item_20)  # -> XComponent, YComponent, ZComponent
addition_17 = Addition(A=extraheight, B=pdecon_6.ZComponent)
pt_28 = ConstructPoint(XCoordinate=pdecon_5.XComponent, YCoordinate=pdecon_5.YComponent, ZCoordinate=pdecon_7.ZComponent)
pt_29 = ConstructPoint(XCoordinate=pdecon_4.XComponent, YCoordinate=pdecon_4.YComponent, ZCoordinate=addition_17)
dist_3 = Distance(PointA=pt_28, PointB=item_20)
subtraction_9 = Subtraction(A=item_20, B=pt_28)
division_11 = Division(A=subtraction_9, B=dist_3)
multiplication_9 = Multiplication(A=division_11, B=extraheight)
addition_18 = Addition(A=multiplication_9, B=item_20)
pdecon_8 = Deconstruct(Point=addition_18)  # -> XComponent, YComponent, ZComponent
pt_30 = Point(clean_5)
pt_31 = ConstructPoint(XCoordinate=pdecon_8.XComponent, YCoordinate=pdecon_8.YComponent, ZCoordinate=addition_17)
pdecon_9 = Deconstruct(Point=pt_30)  # -> XComponent, YComponent, ZComponent
merge_19 = Merge(Data1=pt_29, Data2=pt_31, Data3=addition_18, Data4=item_20)  # -> flatten(Result)
pt_32 = ConstructPoint(XCoordinate=pdecon_9.XComponent, YCoordinate=pdecon_9.YComponent, ZCoordinate=extraheight)
merge_20 = Merge(Data1=pt_32, Data2=pt_30)

# ----
pt_33 = ConstructPoint(XCoordinate=pdecon.XComponent, YCoordinate=pdecon.YComponent, ZCoordinate=extraheight)
merge_21 = Merge(Data1=pt_33, Data2=pt_13)
scale_6 = Scale(Geometry=merge_21, Center=Point(0, 0, 0), Factor=shrinkage.scale_value)  # -> Geometry, Transform
pt_34 = ConstructPoint(XCoordinate=pdecon_2.XComponent, YCoordinate=pdecon_2.YComponent, ZCoordinate=extraheight)
merge_22 = Merge(Data1=pt_34, Data2=pt_14)
starline = GhPythonScript(
    feed_rate=nozzlesettings_3.feed_rate,
    extrusion_retraction=nozzlesettings_4.start_stop_retraction,
    extra_add=nozzlesettings_4.start_reextrusion_rate,
    start_pts=scale_6.Geometry)  # -> flatten(out), a; inputs start_pts: list of Point3d
# ---------- starline: Python ----------
f_rate = feed_rate * 60.0

for i, pt in enumerate(start_pts):
    
    if i == 0:
        
        e_rate = 1

        print("G1 F{} X{} Y{} Z{} E{}".format(f_rate, pt.X, pt.Y, pt.Z, e_rate))
    
    elif i == 1:
   
        e_rate = extrusion_retraction + extra_add

        print("G1 F{} X{} Y{} Z{} E{}".format(f_rate, pt.X, pt.Y, pt.Z, e_rate))
# ---------- end starline ----------
scale_7 = Scale(Geometry=merge_22, Center=Point(0, 0, 0), Factor=shrinkage.scale_value)  # -> Geometry, Transform
merge_23 = Merge(Data1=flatten(starline.out), Data2=flatten(gcodelines.a))
starline_2 = GhPythonScript(
    feed_rate=nozzlesettings_3.feed_rate,
    extrusion_retraction=nozzlesettings_4.start_stop_retraction,
    extra_add=nozzlesettings_4.start_reextrusion_rate,
    start_pts=scale_7.Geometry)  # -> flatten(out), a; inputs start_pts: list of Point3d; same code as starline
merge_24 = Merge(Data1=flatten(starline_2.out), Data2=flatten(gcodelines_2.a))
end_start_gcode = GhPythonScript(x=library_path_5, add_header=Toggle(True), lines=flatten(merge_23), gcodeFiles=value_list)  # -> out, a; inputs add_header: Boolean, lines: list
# ---------- end_start_gcode: Python ----------
import os
import scriptcontext as sc

# creating the header of the gcode file

if add_header:
    key_list = sc.sticky["PrintSettings"].keys()
    key_list.sort()

    for key_item in key_list:
    
        print(";{} : {}".format(key_item, str(sc.sticky["PrintSettings"][key_item])) )

start_gcode_path = os.path.join(x, "GCodeDefinitions", "startGcode" + gcodeFiles + ".txt")
end_gcode_path = os.path.join(x, "GCodeDefinitions", "endGcode" + gcodeFiles + ".txt")

start_gcode = open(start_gcode_path, 'r').read()
end_gcode = open(end_gcode_path, 'r').read()

print start_gcode

for line in lines:

    print(line)

print end_gcode
# ---------- end end_start_gcode ----------
end_start_gcode_2 = GhPythonScript(x=library_path_5, add_header=Toggle(True), lines=flatten(merge_24), gcodeFiles=value_list_2)  # -> out, a; inputs add_header: Boolean, lines: list; same code as end_start_gcode
python_32 = GhPythonScript(
    y=savefile,
    x=library_path_5,
    extra_name=Toggle(False),
    extra_txt="something",
    data=flatten(end_start_gcode.out),
    extra_tag=value_list)  # -> out, a; inputs data: list
# ---------- python_32: Python ----------
import os
import scriptcontext as sc
import math
import time
import scriptcontext as sc

import sys
sys.path.append(x)

import simpleStartStop as ss

reload(ss)

try:
    
    run_timing = time.time() - sc.sticky["start_time"]
    
    if run_timing > 2.0:
    
        sc.sticky["start_time"] = time.time()
        
        run = True
        
    else:
        
        run = False
    
except:
    
    sc.sticky["start_time"] = time.time()
    
    run = True

if y and run:
    
    count_file = None
    
    try:
        count_file = os.path.join(x, "GCodeDefinitions", "countSheet.json")
    except:
        print("count file not found, it's fine")
    
    nozzle_dia = round(sc.sticky["PrintSettings"]["print_extrusion_nozzle"], 1)
    
    if not(count_file == None):
        str = ss.file_count(nozzle_dia, count_file)

    date = time.strftime("%Y%m%d")

    if extra_name:
    
        file_name = "{}_{}_{}.gcode".format(str, date, extra_txt)
    
    else:
    
        file_name = "{}_{}{}.gcode".format(str, date, extra_tag)

    save_file = os.path.join(os.path.dirname(x), "GCode", file_name)

    print save_file

    data = '\n'.join(data)

    f = open(save_file, "a")
    f.write(data)

    f.close()
# ---------- end python_32 ----------
panel_19 = Panel(python_32.out)
python_33 = GhPythonScript(
    y=savefile_2,
    x=library_path_5,
    extra_name=Toggle(False),
    extra_txt="something",
    data=flatten(end_start_gcode_2.out),
    extra_tag=value_list_2)  # -> out, a; inputs data: list
# ---------- python_33: Python ----------
import os
import scriptcontext as sc
import math
import time
import scriptcontext as sc

import sys
sys.path.append(x)

import simpleStartStop as ss

reload(ss)

try:
    
    run_timing = time.time() - sc.sticky["start_time"]
    
    if run_timing > 2.0:
    
        sc.sticky["start_time"] = time.time()
        
        run = True
        
    else:
        
        run = False
    
except:
    
    sc.sticky["start_time"] = time.time()
    
    run = True

if y and run:
    
    count_file = None
    
    try:
        count_file = os.path.join(x, "GCodeDefinitions", "countSheet.json")
    except:
        print("count file not found, it's fine")
    
    nozzle_dia = round(sc.sticky["PrintSettings"]["print_extrusion_nozzle"], 1)
    
    if not(count_file == None):
        str = ss.file_count(nozzle_dia, count_file)

    date = time.strftime("%Y%m%d")

    if extra_name:
    
        file_name = "{}_{}_{}.gcode".format(str, date, extra_txt)
    
    else:
    
        file_name = "{}_{}{}.gcode".format(str, date, extra_tag)

    save_file = os.path.join(os.path.dirname(x), "GCode", file_name)

    print save_file

    data = '\n'.join(data)

    f = open(save_file, "a")
    f.write(data)
    
    f.close()
# ---------- end python_33 ----------

# ----
# BRIM - BODY - 1st PIN (without Start-Stop)
merge_25 = Merge(Data1=flatten(clean_4), Data2=flatten(pt_26), Data3=flatten(split_3.Positive))

pt_35 = Point(item_18.Item1)

# ---- group: Internalize ?
feed_rate_in_mm_s_3 = Slider(25, range=0..100)
pdecon_10 = Deconstruct(Point=pt_35)  # -> XComponent, YComponent, ZComponent
pt_36 = ConstructPoint(XCoordinate=pdecon_10.XComponent, YCoordinate=pdecon_10.YComponent, ZCoordinate=addition_17)
python_34 = GhPythonScript(feed_rate=feed_rate_in_mm_s_3, extrusion_rate=Slider(200, range=0..1000), pts=pt_36)  # -> out, a; inputs pts: list of Point3d
# ---------- python_34: Python ----------
f_rate = feed_rate * 60.0

for pt_i, pt in enumerate(pts):
    
    if pt_i == 0:
        
        e_rate = - extrusion_rate
    
    elif pt_i == len(pts) - 1:
        
        e_rate = extrusion_rate
        
    else:
        
        e_rate = 0.0
    
    print("G1 F{} X{} Y{} Z{} E{}".format(f_rate, pt.X, pt.Y, pt.Z, e_rate))
# ---------- end python_34 ----------

# ----
pt_37 = Point(flatten(merge_25))

# ---- group: shrinkage scaling
scale_8 = Scale(Geometry=pt_37, Center=Point(0, 0, 0), Factor=shrinkage.scale_value)  # -> Geometry, Transform

scale_9 = Scale(Geometry=merge_19, Center=Point(0, 0, 0), Factor=shrinkage.scale_value)  # -> Geometry, Transform

# ---- group: START/STOP--> CODE / Restructure
extrusion_startstop_rate = Slider(150, range=-100..250)
feed_rate_in_mm_s_4 = Slider(50, range=0..100)
python_35 = GhPythonScript(
    feed_rate=nozzlesettings_3.feed_rate,
    extrusion_retraction=nozzlesettings_4.start_stop_retraction,
    extra_add=nozzlesettings_4.start_reextrusion_rate,
    pts=scale_9.Geometry)  # -> out, a; inputs pts: list of Point3d
# ---------- python_35: Python ----------
f_rate = feed_rate * 60.0

for pt_i, pt in enumerate(pts):
    
    if pt_i == 0:
        
        e_rate = - extrusion_retraction
    
    elif pt_i == len(pts) - 1:
        
        e_rate = extrusion_retraction + extra_add
        
    else:
        
        e_rate = 0.0
    
    print("G1 F{} X{} Y{} Z{} E{}".format(f_rate, pt.X, pt.Y, pt.Z, e_rate))
# ---------- end python_35 ----------

# ----
pt_38 = Point(flatten(pt_27))

# ---- group: shrinkage scaling
scale_10 = Scale(Geometry=pt_38, Center=Point(0, 0, 0), Factor=shrinkage.scale_value)  # -> Geometry, Transform

scale_11 = Scale(Geometry=merge_20, Center=Point(0, 0, 0), Factor=shrinkage.scale_value)  # -> Geometry, Transform

# ---- group: START/STOP--> CODE (continued)
starline_3 = GhPythonScript(
    feed_rate=nozzlesettings_3.feed_rate,
    extrusion_retraction=nozzlesettings_4.start_stop_retraction,
    extra_add=nozzlesettings_4.start_reextrusion_rate,
    start_pts=scale_11.Geometry)  # -> flatten(out), a; inputs start_pts: list of Point3d; same code as starline

# ---- group: G-Code
start_stop_feedrate_in_mm_min_3 = Slider(100, range=0..1000)
number_slider_42 = Slider(0, range=0..10)
number_slider_43 = Slider(0, range=0..10)
number_slider_44 = Slider(4.4, range=0..10)
number_slider_45 = Slider(0, range=0..10)
number_slider_46 = Slider(300, range=0..1000)
list_8 = ValueList({"start / stop": "start_stop", "continious"}, selected="continious")
gcodelines_3 = GhPythonScript(
    x=library_path_5,
    pts=scale_8.Geometry,
    feed_rate=nozzlesettings_3.feed_rate,
    extrusion_rate=nozzlesettings_4.extrusion_rate,
    link_type=list_8,
    global_trim_distance=number_slider_42,
    ss_trim_distance=number_slider_43,
    cull_distance=number_slider_45,
    lift_val=number_slider_44,
    ss_f_rate=start_stop_feedrate_in_mm_min_3,
    ss_e_rate=number_slider_46,
    variable_feed_rate=nozzlesettings_3.variable_feed_rate,
    peak_feed_rate=nozzlesettings_3.feed_rate_max,
    start_min=nozzlesettings_3.feed_rate_max_start_start_ramp,
    start_max=nozzlesettings_3.feed_rate_max_end_start_ramp,
    end_max=nozzlesettings_3.feed_rate_max_start_end_ramp,
    end_min=nozzlesettings_3.feed_rate_max_end_end_ramp)  # -> out, a, path_vis; inputs pts: list, variable_feed_rate: Boolean; same code as gcodelines

# ---- group: 2nd PIN + safety position
gcodelines_4 = GhPythonScript(
    x=library_path_5,
    pts=scale_10.Geometry,
    feed_rate=nozzlesettings_3.feed_rate,
    extrusion_rate=nozzlesettings_4.extrusion_rate,
    link_type=list_8,
    global_trim_distance=number_slider_42,
    ss_trim_distance=number_slider_43,
    cull_distance=number_slider_45,
    lift_val=number_slider_44,
    ss_f_rate=start_stop_feedrate_in_mm_min_3,
    ss_e_rate=number_slider_46)  # -> out, a, path_vis; inputs pts: list
# ---------- gcodelines_4: Python ----------
import sys

sys.path.append(x)

import Rhino.Geometry as rg
import simpleStartStop as ss

reload(ss)

# print(pts)

p_set = ss.PrintSettings(
    feed_rate = feed_rate, 
    extrusion_rate = extrusion_rate, 
    extrusion_mode = 'relative', 
    movement_mode = 'relative'
)

l_type = ss.LinkType(
    link_type = link_type,
    global_trim_distance = global_trim_distance,
    ss_trim_distance = ss_trim_distance,
    cull_distance = cull_distance,
    lift_val = lift_val
)

l_type.ss_f_rate = ss_f_rate
l_type.ss_e_rate = ss_e_rate

gcodeset = ss.GCodeSet(pts, p_set, l_type)
a = gcodeset.generateGCode()

path_vis = gcodeset.path_vis
# ---------- end gcodelines_4 ----------

# ---- group: G-Code / LenghtPath Body + 1st PIN - check
pline_15 = PolyLine(Vertices=gcodelines_3.path_vis, Closed=False)

# ----
pt_39 = Point(gcodelines_3.path_vis)
pt_40 = Point(gcodelines_4.path_vis)
lenghtpath_2nd_pin_check = PolyLine(Vertices=gcodelines_4.path_vis, Closed=False)

# ---- group: Visualization lines
merge_26 = Merge(
    Data1=flatten(merge_20),
    Data2=flatten(gcodelines_3.path_vis),
    Data3=flatten(merge_19),
    Data4=flatten(gcodelines_4.path_vis),
    Data5=flatten(pt_36))
pline_16 = PolyLine(Vertices=merge_26, Closed=False)

# ----
merge_gcode_lines = Merge(
    Data1=flatten(starline_3.out),
    Data2=flatten(gcodelines_3.a),
    Data3=flatten(python_35.out),
    Data4=flatten(gcodelines_4.a),
    Data5=flatten(python_34.out))
panel_20 = Panel(gcodelines_3.out)
len_2 = Length(Curve=lenghtpath_2nd_pin_check)
len_3 = Length(Curve=pline_15)
python_36 = GhPythonScript(pts=pt_39, h=addition_16, spacing=num_4)  # -> out, msh; inputs pts: list of Point3d, is_closed: Boolean
# ---------- python_36: Python ----------
import Rhino.Geometry as rg
from math import ceil

h_delta = spacing

msh = rg.Mesh()

for i in range(2):
    z = i * h_delta
    for p in pts:
        msh.Vertices.Add(p.X, p.Y, p.Z + z)

x_cnt = len(pts)
y_cnt = 2

for i in range(y_cnt - 1):
    base_a = i * x_cnt
    base_b = (i + 1) * x_cnt
    for j in range(x_cnt - 1):
        a = base_a + j
        b = base_a + j + 1
        c = base_b + j + 1
        d = base_b + j
        
        msh.Faces.AddFace(a, b, c, d)
    
    if is_closed:
        a = base_a + j + 1
        b = base_a
        c = base_b
        d = base_b + j + 1
        
        msh.Faces.AddFace(a, b, c, d)
# ---------- end python_36 ----------
python_37 = GhPythonScript(pts=pt_40, h=addition_16, spacing=num_4)  # -> out, msh; inputs pts: list of Point3d, is_closed: Boolean; same code as python_36
len_4 = Length(Curve=pline_16)
addition_19 = Addition(A=len_3, B=len_2)
python_38 = GhPythonScript(x=len_4)  # -> out, a
# ---------- python_38: Python ----------
import scriptcontext as sc

key_list = sc.sticky["PrintSettings"]["path_length"] = x
# ---------- end python_38 ----------
mesh_4 = Mesh(python_36.msh)
mesh_5 = Mesh(python_37.msh)
panel_21 = Panel(python_38.out)

# ---- group: G-Code (continued)
end_start_gcode_3 = GhPythonScript(x=library_path_5, add_header=Toggle(True), lines=flatten(merge_gcode_lines), gcodeFiles=value_list_3)  # -> out, a; inputs add_header: Boolean, lines: list; same code as end_start_gcode

# ----
mjoin = MeshJoin(Meshes=[mesh_4, mesh_5])
python_39 = GhPythonScript(
    y=savefile_3,
    x=library_path_5,
    extra_name=Toggle(False),
    extra_txt="something",
    data=flatten(end_start_gcode_3.out),
    extra_tag=value_list_3)  # -> out, a; inputs data: list
# ---------- python_39: Python ----------
import os
import scriptcontext as sc
import math
import time
import scriptcontext as sc

import sys
sys.path.append(x)

import simpleStartStop as ss

reload(ss)

try:
    
    run_timing = time.time() - sc.sticky["start_time"]
    
    if run_timing > 2.0:
    
        sc.sticky["start_time"] = time.time()
        
        run = True
        
    else:
        
        run = False
    
except:
    
    sc.sticky["start_time"] = time.time()
    
    run = True

if y and run:
    
    count_file = None
    
    try:
        count_file = os.path.join(x, "GCodeDefinitions", "countSheet.json")
    except:
        print("count file not found, it's fine")
    
    nozzle_dia = round(sc.sticky["PrintSettings"]["print_extrusion_nozzle"], 1)
    
    if not(count_file == None):
        str = ss.file_count(nozzle_dia, count_file)

    date = time.strftime("%Y%m%d")

    if extra_name:
    
        file_name = "{}_{}_{}.gcode".format(str, date, extra_txt)
    
    else:
    
        file_name = "{}_{}{}.gcode".format(str, date, extra_tag)

    save_file = os.path.join(os.path.dirname(x), "GCode", file_name)

    print save_file

    data = '\n'.join(data)

    open(save_file, "a").write(data)
# ---------- end python_39 ----------
panel_22 = Panel(python_39.out)

# ==== cluster Cluster
M = ClusterInput()
L = ClusterInput()
wbsplitquads = WeaverbirdsConstantQuadsSplitSubdivision(MeshCurves=M, Level=L, SmoothNakedEdges=1)
demesh = DeconstructMesh(Mesh=wbsplitquads)  # -> Vertices, Faces, Colours, Normals
B = ClusterInput()
brep_cp = BrepClosestPoint(Point=demesh.Vertices, Brep=B)  # -> Point, Normal, Distance
B_2 = ClusterInput()
conmesh = ConstructMesh(Vertices=brep_cp.Point, Faces=demesh.Faces)
smaller = SmallerThan(FirstNumber=brep_cp.Distance, SecondNumber=B_2)  # -> SmallerThan, graft(OrEqualTo)
merge = Merge(Data1=graft(demesh.Vertices), Data2=graft(brep_cp.Point))
item = ListItem(List=merge, Index=smaller.OrEqualTo, Wrap=True)  # -> flatten(Item)
conmesh_2 = ConstructMesh(Vertices=item, Faces=demesh.Faces)
M_2 = ClusterOutput(conmesh_2)
