# Grasshopper definition 221016_piped_mesh.gh (Grasshopper 1.0.7)
# plug-ins: Axolotl Info, ghgl

feed_rate_in_mm_s = Slider(75, range=0..100)

# ---- group: Brick Geometry Generator
number_slider = Slider(2.3, range=0..10)
number_slider_2 = Slider(2, range=0..10)
number_slider_3 = Slider(260, range=0..1000)
python = GhPythonScript(
    height_body=Slider(150, range=0..1000),
    height_pin=number_slider_3,
    start_height=number_slider,
    layer_height=number_slider)  # -> out, flatten(body_heights), flatten(pin_only_heights)
# ---------- python: Python ----------
import scriptcontext as sc

# creating the heights

body_heights = []
pin_only_heights = []

height = start_height

height_body, height_pin = min(height_body, height_pin), max(height_body, height_pin)

print (height_body, height_pin)

while height < height_body:
    
    body_heights.append(height)
    
    height += layer_height
    
while height < height_pin:
    
    pin_only_heights.append(height)
    
    height += layer_height

try:
    sc.sticky["PrintSettings"]["height_body"]=height_body
except:
    print("had to initialize the PrintSettings dict")
    sc.sticky["PrintSettings"]={"height_body":height_body}
sc.sticky["PrintSettings"]["height_pin"]=height_pin
sc.sticky["PrintSettings"]["start_height"]=start_height
sc.sticky["PrintSettings"]["layer_height"]=layer_height
sc.sticky["PrintSettings"]["layer_body_count"]=len(body_heights)
sc.sticky["PrintSettings"]["layer_pin_count"]=len(pin_only_heights)
sc.sticky["PrintSettings"]["layer_total_count"]=len(body_heights) + len(pin_only_heights)
# ---------- end python ----------

# ---- group: Brick Geometry Generator / where should we put it ?
number_slider_4 = Slider(220, range=40..250)
number_slider_5 = Slider(350, range=100..450)
number_slider_6 = Slider(250, range=40..250)

# ----
feed_rate_in_mm_s_2 = Slider(75, range=0..100)
line_linking_spacing = Slider(2.7, range=0..10)
inter_line_spacing = Slider(2, range=0..10)
split_distance = Slider(2, range=-10..10)
path = FilePath()

# ---- group: shrinkage scaling
multiplication = Multiplication(A=1, B=feed_rate_in_mm_s)

# ----
python_2 = GhPythonScript(default_dropbox_path=Toggle(True), custom_path=path)  # -> out, path, clean_code_path; inputs default_dropbox_path: Boolean
# ---------- python_2: Python ----------
import sys

import os
import Grasshopper

path=os.path.dirname(Grasshopper.Instances.ActiveCanvas.Document.FilePath)
base_path=os.path.dirname(path)
path=os.path.join(base_path, "PatternBrickLibrary")
clean_code_path=os.path.join(base_path, "clean_code")
sys.path.append(path)
# ---------- end python_2 ----------
feedratesettings = GhPythonScript(
    feed_rate=multiplication,
    variable_feed_rate=Toggle(False),
    feed_rate_max=feed_rate_in_mm_s_2,
    feed_rate_max_start_start_ramp=Slider(25, range=0..25),
    feed_rate_max_end_start_ramp=Slider(30, range=0..100),
    feed_rate_max_start_end_ramp=Slider(135, range=0..1000),
    feed_rate_max_end_end_ramp=Slider(145, range=0..1000))  # -> flatten(out); inputs variable_feed_rate: Boolean
# ---------- feedratesettings: Python ----------
import scriptcontext as sc

try:
    sc.sticky["PrintSettings"]["feed_rate"] = feed_rate
except:
    sc.sticky["PrintSettings"]={"feed_rate":feed_rate}
sc.sticky["PrintSettings"]["feed_rate_variable"] = variable_feed_rate

if variable_feed_rate:
    
    sc.sticky["PrintSettings"]["feed_rate_max"] = feed_rate_max
    sc.sticky["PrintSettings"]["feed_rate_max_end_start_ramp"] = feed_rate_max_start_start_ramp
    sc.sticky["PrintSettings"]["feed_rate_max_end_start_ramp"] = feed_rate_max_end_start_ramp
    sc.sticky["PrintSettings"]["feed_rate_max_start_end_ramp"] = feed_rate_max_start_end_ramp
    sc.sticky["PrintSettings"]["feed_rate_max_end_end_ramp"] = feed_rate_max_end_end_ramp
    
print(True)
# ---------- end feedratesettings ----------

# ---- group: Nozzle
list = ValueList({"3.5", "5"}, selected="5")
nozzlesettings = GhPythonScript(x=feedratesettings, nozzle_diameter=list, layer_height=number_slider)  # -> flatten(out)
# ---------- nozzlesettings: Python ----------
import scriptcontext as sc

def linearInterpolation(input_x, val_s, x_s):

    val_a, val_b = val_s
    x_a, x_b = x_s

    x_a, x_b, val_a, val_b = float(x_a), float(x_b), float(val_a), float(val_b)

    distance_val = (input_x - x_a) / (x_b - x_a)

    output_val = (1 - distance_val) * val_a + distance_val * val_b

    return output_val

x_s = (2.5, 3.2)

val_s_5_spacing_cross_paths = (2.5, 2.0)
val_s_5_spacing_link = (3.4, 2.7)

val_s_3_5_spacing_cross_paths = (2.0, 1.6)
val_s_3_5_spacing_link = (2.7, 2.2)

if nozzle_diameter == 3.5:
    
    extrusion_rate = .64
    spacing_cross_paths = round(linearInterpolation(layer_height, val_s_3_5_spacing_cross_paths, x_s), 1)
    spacing_link = round(linearInterpolation(layer_height, val_s_3_5_spacing_link, x_s), 1)
    start_stop_retraction = 130
    start_reextrusion_rate = 40
    
if nozzle_diameter == 5.0:
    
    extrusion_rate = .8
    spacing_cross_paths = round(linearInterpolation(layer_height, val_s_3_5_spacing_cross_paths, x_s), 1)
    spacing_link = round(linearInterpolation(layer_height, val_s_5_spacing_link, x_s), 1)
    start_stop_retraction = 150
    start_reextrusion_rate = 50
    
# print(spacing_cross_paths, spacing_cross_paths, spacing_link)

sc.sticky["PrintSettings"]["print_extrusion_nozzle"] = nozzle_diameter   
sc.sticky["PrintSettings"]["print_extrusion_rate"] = extrusion_rate
sc.sticky["PrintSettings"]["print_spacing_cross"] = spacing_cross_paths
sc.sticky["PrintSettings"]["print_spacing_paths"] = spacing_cross_paths
sc.sticky["PrintSettings"]["print_spacing_link"] = spacing_link
sc.sticky["PrintSettings"]["print_spacing_start_stop_retraction"] = start_stop_retraction
sc.sticky["PrintSettings"]["print_spacing_start_reextrusion_rate"] = start_reextrusion_rate

print(True)
# ---------- end nozzlesettings ----------

# ----
simplebrick = GhPythonScript(save_settings=Toggle(True), brick_length=number_slider_5, brick_width=number_slider_6, pin_spacing=number_slider_4)  # -> out, poly_crv, pin_pts; inputs save_settings: Boolean
# ---------- simplebrick: Python ----------
import Rhino.Geometry as rg
import scriptcontext as sc

# creating the base shape and pins

brick_width, brick_length  = min(brick_width, brick_length), max(brick_width, brick_length)

print (brick_length, brick_width)

half_l = brick_length * .5
half_w = brick_width * .5

#     *       *
#   *            *
#     *       *

val_list = [(1,1), (1, -1), (-1, -1), (-1, 1)]

pt_list = []

for i in range(4):
    
    pt_list.append(rg.Point3d(half_l * val_list[i][0], half_w * val_list[i][1], 0.0))
    
    if i == 0:
        
        pt_list.append(rg.Point3d(half_l + half_w, 0, 0))
        
    elif i == 2:
        
        pt_list.append(rg.Point3d(- (half_l + half_w), 0, 0))

arc_set = [[0,1,2],[3,4,5]]
line_set = [[5,0],[2,3]]

poly_crv = rg.PolyCurve()
pin_pts = [rg.Point3d(-.5 * pin_spacing, 0, 0), rg.Point3d(.5 * pin_spacing, 0, 0)]

for i in range(2):
    
    pt_0, pt_1, pt_2, pt_3 = pt_list[-1 + i * 3], pt_list[0 + i * 3], pt_list[1 + i * 3], pt_list[2 + i * 3]
    
    line = rg.Line(pt_0, pt_1)
    
    poly_crv.Append(line)
    
    crv = rg.Arc(pt_1, pt_2, pt_3)
    
    poly_crv.Append(crv)
    
if save_settings:
    
    try:
        sc.sticky["PrintSettings"]["brick_width"]=brick_width
    except:
        print("had to initialize the PrintSettings dict")
        sc.sticky["PrintSettings"]={"brick_width":brick_width}
    
    sc.sticky["PrintSettings"]["brick_length"]=brick_length
    sc.sticky["PrintSettings"]["pin_spacing"]=pin_spacing
# ---------- end simplebrick ----------
shrinkage = GhPythonScript(your_clay_shrinkage=Slider(8, range=-100..100))  # -> out, scale_value
# ---------- shrinkage: Python ----------
our_clay_shrinkage = 8.7

scale_value = (100. - our_clay_shrinkage) / (100. - your_clay_shrinkage)
# ---------- end shrinkage ----------
given_shell = Curve(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)
manualnozzloverwrite = GhPythonScript(
    x=nozzlesettings,
    overwrite=Toggle(False),
    spacing_cross=split_distance,
    spacing_paths=inter_line_spacing,
    spacing_link=line_linking_spacing)  # -> out; inputs overwrite: Boolean
# ---------- manualnozzloverwrite: Python ----------
import scriptcontext as sc

if overwrite:
    
    sc.sticky["PrintSettings"]["print_spacing_cross"] = spacing_cross
    sc.sticky["PrintSettings"]["print_spacing_paths"] = spacing_paths
    sc.sticky["PrintSettings"]["print_spacing_link"] = spacing_link
    
print(True)
# ---------- end manualnozzloverwrite ----------
given_points = Point([Point(-105, 0, 0), Point(105, 0, 0)])
X = UnitX(Factor=-1000)
curve = Curve(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)
crv = Curve(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)
point = Point([Point(104.9999408, 0, 0), Point(-104.9999408, 0, 0)])
crv_cp = CurveClosestPoint(Point=X, Curve=given_shell)  # -> Point, Parameter, Distance
seam = Seam(Curve=given_shell, Seam=crv_cp.Parameter)
panel = Panel(nozzlesettings)

# ---- group: Reverse the direction of curve
# Explanation: Based on how the curve is directed, offsetting and/or splitting it will behave differently
flip = FlipCurve()  # -> Curve, Flag

# ----
Z = UnitZ(Factor=number_slider)
splitting_geometry = Geometry(crv)
python_3 = GhPythonScript()  # -> out, a
# ---------- python_3: Python ----------
import scriptcontext as sc

print(sc.sticky["PrintSettings"])
# ---------- end python_3 ----------
panel_2 = Panel(python_3.out)
library_path = FilePath(python_2.path)
layer_slicing = GhPythonScript(x=library_path, geometry=seam, heights=python.body_heights)  # -> out, ori_crvs, crv_sets, a, b, c, d; inputs geometry: GeometryBase, heights: list
# ---------- layer_slicing: Python ----------
import sys

sys.path.append(x)

import brickSlicer as bs

reload(bs)

ori_crvs = bs.slicing(geometry, heights)
# crv_sets, a, b, c = bs.splitter(ori_crvs, slicing_object = slice_geo, split_type = "first_layer")
# ---------- end layer_slicing ----------
crv_2 = Curve(layer_slicing.ori_crvs)
move = Move(Geometry=layer_slicing.ori_crvs, Motion=Z)  # -> Geometry, Transform
panel_3 = Panel(layer_slicing.out)
clean_code_path = FilePath(python_2.clean_code_path)
item = ListItem(List=crv_2, Index=0, Wrap=True)
library_path_2 = FilePath(library_path)

# ---- group: — Slicing for pattern —
num = Number(100)
slicing_structuring = GhPythonScript(
    x=library_path_2,
    ori_crvs=crv_2,
    spacing=Slider(2.5, range=0..10),
    end_smooth=Toggle(False),
    custom_crv_length=Toggle(False),
    crv_l=num,
    split=Toggle(True),
    slice_geo=splitting_geometry,
    split_item=Slider(0, range=0..1))  # -> out, split, layers, set_tuple, crv_sets, ori_crvs, slice_geo; inputs ori_crvs: list, end_smooth: Boolean, custom_crv_length: Boolean, split: Boolean, split_item: Int32
# ---------- slicing_structuring: Python ----------
# snippet of code to make this python component look for it's   code in the parent folder of the .gh file

import sys

sys.path.append(x)

import vertexClass_v1 as vc
import brickSlicer as bs
import scriptcontext as sc

reload(bs)
reload(vc)

print(type(slice_geo))

    
if custom_crv_length:
    
    crv_l = crv_l
    
    sc.sticky["PrintSettings"]["pattern_crv_l"] = crv_l
    
else:
    
    crv_l = None


if split:

    crv_sets, vis_a, vis_b, pts_crv_a_and_b = bs.splitter(ori_crvs, slicing_object = slice_geo, split_type = "first_layer")
    
    crv_set_a = [crv_set[0] for crv_set in crv_sets]
    crv_set_b = [crv_set[1] for crv_set in crv_sets]
    
    crv_sets = [crv_set_a, crv_set_b]
    
    non_pattern_part = [vc.divideCurveByLength(crv, spacing) for crv in crv_sets[(split_item + 1) % 2]]
    
    pattern_part, set_tuple, _ = vc.moveSet(crv_sets[split_item], ori_crvs, spacing, crv_l)
    layers = [pattern_part, non_pattern_part]
    
    
else:

    layers, set_tuple = vc.singleCurve(ori_crvs, spacing, end_smooth, crv_l)
    
sc.sticky["PrintSettings"]["pattern_spacing"] = spacing
sc.sticky["PrintSettings"]["pattern_end_smooth"] = end_smooth
# ---------- end slicing_structuring ----------

# ----
item_2 = ListItem(List=slicing_structuring.set_tuple, Index=0, Wrap=True)  # -> Item, Item1, Item2
crv_l = Number(item_2.Item)

# ---- group: general pattern settings
pt = ConstructPoint(XCoordinate=Slider(24, range=0..100), YCoordinate=Slider(0, range=0..100), ZCoordinate=0)
pt_2 = Point(pt)
pyramidpattern = GhPythonScript(lib_path=clean_code_path, zero_end=Slider(0, range=0..100), ramp_end=Slider(49.292, range=0..100), length=crv_l)  # -> out, edge_easing
# ---------- pyramidpattern: Python ----------
import sys

sys.path.append(lib_path)

import patterns as pt
reload(pt)

edge_easing = pt.EdgeEasing(
    min(zero_end, ramp_end),
    max(zero_end, ramp_end),
    length
)
# ---------- end pyramidpattern ----------
inout = GhPythonScript(lib_path=clean_code_path, percentage=Slider(47.629, range=0..100), seed=Slider(1000, range=0..1000), length=crv_l)  # -> out, in_out; inputs seed: Int32
# ---------- inout: Python ----------
import sys

sys.path.append(lib_path)

import patterns as pt
reload(pt)

in_out = pt.InOut(
    percentage * .01,
    seed
)
# ---------- end inout ----------
dotmap = GhPythonScript(
    lib_path=clean_code_path,
    x_spacing=Slider(90, range=0..100),
    y_spacing=Slider(50, range=0..100),
    half_spacing=Toggle(True),
    b_pt=pt_2,
    with_in_out=Toggle(True),
    in_out_class=inout.in_out,
    direction=Toggle(True))  # -> out, dot_map; inputs half_spacing: Boolean, b_pt: Point3d, with_in_out: Boolean, direction: Boolean
# ---------- dotmap: Python ----------
import sys

sys.path.append(lib_path)

import patterns as pt
reload(pt)

dot_map = pt.DotMap(
    x_spacing = y_spacing,
    y_spacing = y_spacing,
    half_spacing = half_spacing,
    b_pt = b_pt,
    in_out_class = in_out_class if with_in_out else None,
    direction = direction
)
# ---------- end dotmap ----------

# ----
div_l = Number(item_2.Item1)
lay_h = Number(item_2.Item2)
pt_3 = ConstructPoint(XCoordinate=Slider(0, range=0..100), YCoordinate=Slider(0, range=0..100), ZCoordinate=0)
pt_4 = ConstructPoint(XCoordinate=Slider(0, range=0..100), YCoordinate=Slider(0, range=0..100), ZCoordinate=0)

# ---- group: pattern settings
python_4 = GhPythonScript()  # -> out, a
# ---------- python_4: Python ----------
a = [[2, 1, 1], [1, 2, 3], [0, 1, 2]]
# ---------- end python_4 ----------

# ----
rad = Radians(Degrees=Slider(30, range=0..1000))
pt_5 = Point(pt_4)
sinwave = GhPythonScript(
    lib_path=clean_code_path,
    period=Slider(50, range=0..100),
    amplitude=Slider(15, range=0..100),
    dir_angle=rad,
    b_pt=pt_5,
    edge_easing=pyramidpattern.edge_easing)  # -> out, sin_wave; inputs b_pt: Point3d
# ---------- sinwave: Python ----------
import sys

sys.path.append(lib_path)

import patterns as pt
reload(pt)

sin_wave = pt.SinWave(
    period, 
    amplitude, 
    dir_angle,
    b_pt,
    edge_easing
)
# ---------- end sinwave ----------

ellipsoidpattern = GhPythonScript(
    lib_path=clean_code_path,
    radius=Slider(10, range=0..100),
    amplitude=Slider(10, range=0..100),
    y_scale=Slider(2, range=0.01..10),
    dot_map=dotmap.dot_map,
    edge_easing=pyramidpattern.edge_easing)  # -> out, ellipsoid_pattern
# ---------- ellipsoidpattern: Python ----------
import sys

sys.path.append(lib_path)

import patterns as pt
reload(pt)

ellipsoid_pattern = pt.EllipsoidPattern(
    radius,
    amplitude,
    y_scale,
    dot_map,
    edge_easing
)
# ---------- end ellipsoidpattern ----------

cylinderpattern = GhPythonScript(
    lib_path=clean_code_path,
    radius_a=Slider(10, range=0..100),
    radius_b=Slider(20, range=0..100),
    height=Slider(30, range=0..100),
    amplitude=Slider(10, range=0..100),
    dot_map=dotmap.dot_map,
    edge_easing=pyramidpattern.edge_easing)  # -> out, cylinder_pattern
# ---------- cylinderpattern: Python ----------
import sys

sys.path.append(lib_path)

import patterns as pt
reload(pt)

cylinder_pattern = pt.CylinderPattern(
    radius_a,
    radius_b,
    height,
    amplitude,
    dot_map,
    edge_easing
)
# ---------- end cylinderpattern ----------

pyramidpattern_2 = GhPythonScript(
    lib_path=clean_code_path,
    radius=Slider(10, range=0..100),
    amplitude=Slider(10, range=0..100),
    y_scale=Slider(1, range=0.01..10),
    dot_map=dotmap.dot_map,
    edge_easing=pyramidpattern.edge_easing)  # -> out, pyramid_pattern
# ---------- pyramidpattern_2: Python ----------
import sys

sys.path.append(lib_path)

import patterns as pt
reload(pt)

pyramid_pattern = pt.PyramidPattern(
    radius,
    amplitude,
    y_scale,
    dot_map,
    edge_easing
)
# ---------- end pyramidpattern_2 ----------

layermap = GhPythonScript(
    lib_path=clean_code_path,
    spacing=Slider(50, range=0..100),
    pattern_set=python_4.a,
    radius=Slider(20, range=0..100),
    amplitude=Slider(20, range=0..100),
    length=crv_l,
    layer_spacing=lay_h,
    direction=Toggle(False),
    periodic=Toggle(False),
    b_pt=pt_3,
    edge_easing=pyramidpattern.edge_easing)  # -> out, layer_map; inputs pattern_set: list, direction: Boolean, b_pt: Point3d
# ---------- layermap: Python ----------
import sys

sys.path.append(lib_path)

import patterns as pt
reload(pt)

layer_map = pt.LayerMap(
    spacing,
    pattern_set,
    length,
    layer_spacing,
    radius,
    amplitude,
    direction,
    periodic,
    b_pt,
    edge_easing
)
# ---------- end layermap ----------

tpms = TPMS(Wavelength=Slider(98, range=0..100))
layer_height = Number(number_slider)
add = Add(DistanceObject=tpms, Addend=Slider(2, range=0..10))
toggle = BooleanToggle(True)
toggle_2 = BooleanToggle(True)
tpms_distance_object_modifier = TPMSD(Wavelength=Slider(25, range=0..100), Modulator=add)

number_slider_7 = Slider(6, range=0..100)
pt_6 = Point(pt_4)
axolotlflat = GhPythonScript(
    lib_path=clean_code_path,
    sdf=tpms_distance_object_modifier,
    amplitude=number_slider_7,
    direction=toggle_2,
    b_pt=pt_6,
    edge_easing=pyramidpattern.edge_easing)  # -> out, axolotl_flat; inputs direction: Boolean, b_pt: Point3d
# ---------- axolotlflat: Python ----------
import sys

sys.path.append(lib_path)

import patterns as pt
reload(pt)

axolotl_flat = pt.AxolotlFlat(
    sdf, 
    amplitude, 
    direction,
    b_pt,
    edge_easing
)
# ---------- end axolotlflat ----------

number_slider_8 = Slider(6, range=0..100)
pt_7 = Point(pt_4)
axolotlspatial = GhPythonScript(
    lib_path=clean_code_path,
    sdf=tpms_distance_object_modifier,
    amplitude=number_slider_7,
    direction=toggle_2,
    b_pt=pt_7,
    edge_easing=pyramidpattern.edge_easing)  # -> out, axolotl_spatial; inputs direction: Boolean, b_pt: Point3d
# ---------- axolotlspatial: Python ----------
import sys

sys.path.append(lib_path)

import patterns as pt
reload(pt)

axolotl_spatial = pt.AxolotlSpatial(
    sdf, 
    amplitude, 
    direction,
    b_pt,
    edge_easing
)
# ---------- end axolotlspatial ----------

intersection_pattern = CSharpScript(
    shell_curves=crv_2,
    layer_height=layer_height,
    max_width=Slider(60, range=0..100),
    max_depth=Slider(35, range=0..100),
    feature_height=Slider(50, range=0..100),
    vertical_gap=Slider(30, range=0..100),
    horizontal_gap=Slider(40, range=0..100),
    offset_y=Slider(20, range=0..100),
    alternating=Toggle(True),
    inset_x=Slider(2.5, range=0..100),
    crossing_w=Slider(5.594, range=0..100),
    dot_chance=Slider(0.5, range=0..1),
    seed=Slider(988, range=0..1000))  # -> out, A, B, C, D; inputs base_crv: Curve, shell_curves: list of Curve, layer_height: Double, max_width: Double, max_depth: Double, feature_height: Double, vertical_gap: Double, horizontal_gap: Double, offset_y: Double, alternating: Boolean, inset_x: Double, crossing_w: Double, dot_chance: Double, seed: Int32
# ---------- intersection_pattern: C# usings ----------
using Rhino.Geometry.Intersect;
using System.Linq;
# ---------- intersection_pattern: C# ----------
    // goal is to get per layer a list of points describing that layer
    // an inner curve / polyline that can be used for offset the interiors

    var randomGenerator = new Random(seed);

    double gapTolerance = 10.0;
    double pointSpacing = 2.5;
    double totalH = vertical_gap + feature_height;

    double horizontalSpacing = horizontal_gap + max_width;
    double startEndLength = (horizontalSpacing + gapTolerance) * 0.5;
    double startEndLengthAlternating = horizontalSpacing + gapTolerance * 0.5;

    // getting the base points on the base curve
    List<PolylineCurve> baseLayers = new List<PolylineCurve>();
    List<PolylineCurve> paths = new List<PolylineCurve>();
    Dictionary<double,Dictionary<double, double>> tValues = new Dictionary<double,Dictionary<double, double>>();

    double height = offset_y;

    foreach(Curve locS in shell_curves) {
        Curve s = locS.DuplicateCurve();
        Curve c = new Circle(s.PointAtStart, 0.001).ToNurbsCurve(3, 5);
        var ccxA = Intersection.CurveCurve(s, c, 0.000001, 0.000001);
        s.ChangeClosedCurveSeam(ccxA[0].ParameterA);
        var ccxB = Intersection.CurveCurve(s, c, 0.000001, 0.000001);
        s = s.Split(ccxB[1].ParameterA)[0];
        double l = s.GetLength();

        A = s;

        double localH = height % totalH;
        double localW = 0.0;
        double localR = 0.0;

        if (localH > vertical_gap) {
            localW = max_width * (localH - vertical_gap) / feature_height;
            localR = max_depth * (localH - vertical_gap) / feature_height;
        }

        List<Point3d> backLayer = new List<Point3d>();
        List<Point3d> path = new List<Point3d>();

        double tStartOriginal = s.Domain.T0;
            double tEndOriginal = s.Domain.T1;

        Curve backUp = s.DuplicateCurve();

        if (localW > 0.0001) {
            bool isAlternating = alternating && ((height % (totalH * 2.0)) < totalH);


            if (isAlternating) {
                s = s.Trim(CurveEnd.Both, startEndLengthAlternating);
            } else {
                s = s.Trim(CurveEnd.Both, startEndLength);
            }


            // trimming the curve
            int divisionCount = Convert.ToInt32(Math.Round(s.GetLength() / horizontalSpacing));

            double[] centerTs = s.DivideByCount(divisionCount, true);

            // resetting the domain
            s = backUp;

            backLayer.Add(s.PointAt(tStartOriginal));
            path.Add(s.PointAt(tStartOriginal));

            foreach(double t in centerTs) {
                // checking whether it should be added
                double thisHIndex = Math.Floor(height / totalH);
                double thisT = t;
                bool foundHIndex = false;
                bool foundT = false;

                foreach(double hIdx in tValues.Keys){
                    if (Math.Abs(thisHIndex - hIdx) < 0.1){
                        thisHIndex = hIdx;
                        foundHIndex = true;
                        break;
                    }
                }

                if (foundHIndex) {
                    foreach(double tIdx in tValues[thisHIndex].Keys){
                        if (Math.Abs(thisT - tIdx) < 0.1){
                            thisT = tIdx;
                            foundT = true;
                            break;
                        }
                    }

                    if (foundT) {
                        if (tValues[thisHIndex][thisT] < dot_chance) {
                            continue;
                        }
                    } else {
                        double chance = randomGenerator.Next(0, 1000) * .001;
                        tValues[thisHIndex].Add(thisT, chance);
                        if (chance < dot_chance) {
                            continue;
                        }
                    }

                } else {
                    double chance = randomGenerator.Next(0, 1000) * .001;

                    Dictionary<double, double> tChanceDict = new Dictionary<double, double>();
                    tChanceDict.Add(thisT, chance);
                    tValues.Add(thisHIndex, tChanceDict);

                    if (chance < dot_chance) {
                        continue;
                    }
                }

                // got the center point
                Point3d cPt = s.PointAt(t);
                Vector3d tangent = s.TangentAt(t);
                Vector3d normal = Vector3d.CrossProduct(tangent, Vector3d.ZAxis);
                normal.Unitize();

                // getting the local start and end points
                Curve circle = (new Circle(cPt, localW * 0.5)).ToNurbsCurve(3, 5);

                var ccxs = Intersection.CurveCurve(s, circle, 0.00001, 0.00001);

                if (ccxs.Count == 2) {
                    Point3d pa;
                    Point3d pb;

                    if (ccxs[0].ParameterA < ccxs[1].ParameterA) {
                        pa = ccxs[0].PointA;
                        pb = ccxs[1].PointA;
                    } else {
                        pa = ccxs[1].PointA;
                        pb = ccxs[0].PointA;
                    }

                    // adding some points before
                    Point3d previous = backLayer.Last();
                    double tPrev;
                    s.ClosestPoint(previous, out tPrev);
                    double tNext;
                    s.ClosestPoint(pa, out tNext);

                    var tmpCurve = s.DuplicateCurve();
                    Curve subSeg;
                    var result = tmpCurve.Split(new double[]{tPrev, tNext});
                    if (result.Length == 2) {
                        subSeg = result[0];
                    } else {
                        subSeg = result[1];
                    }
                    var points = subSeg.DivideByLength(pointSpacing, false);

                    foreach(double locT in points) {
                        Point3d p = s.PointAt(locT);
                        backLayer.Add(p);
                        path.Add(p);
                    };

                    // adding the back line
                    Vector3d insetVector = Vector3d.Multiply(normal, -1.0 * inset_x);
                    backLayer.Add(pa);

                    // interpolating the back
                    var segment = pb - pa;

                    double divisionsBis = Math.Ceiling(segment.Length / pointSpacing);
                    for (int i=0; i < divisionsBis + 1; i++) {
                        Vector3d scaledVector = Vector3d.Multiply(i / divisionsBis, segment);
                        double closestT;
                        s.ClosestPoint(Point3d.Add(pa, scaledVector), out closestT);
                        Point3d n_p = s.PointAt(closestT);
                        backLayer.Add(Point3d.Add(n_p, insetVector));
                    }

                    backLayer.Add(pb);

                    // adding the front
                    path.Add(pa);

                    double r0 = inset_x;
                    double w0 = crossing_w;

                    Vector3d dirX = Point3d.Subtract(pb, pa);
                    Point3d mid_point = Point3d.Add(pa, Vector3d.Multiply(dirX, .5));
                    dirX.Unitize();

                    if (w0 >= localW) w0 = localW;
                    if (localR > r0) {
                        // all key points
                        Point3d p0 = mid_point - dirX * w0 * .5;
                        Point3d p1 = mid_point + dirX * w0 * .5;
                        Point3d p2 = mid_point + dirX * localW * .5;
                        Point3d p3 = mid_point + dirX * localW * .5 + normal * localR * .15;
                        Point3d p4 = mid_point + dirX * localW * .5 + normal * localR;
                        Point3d p5 = mid_point + normal * localR;
                        Point3d p6 = mid_point - dirX * localW * .5 + normal * localR;
                        Point3d p7 = mid_point - dirX * localW * .5 + normal * localR * .15;
                        Point3d p8 = mid_point - dirX * localW * .5;
                        Point3d p9 = mid_point - dirX * w0 * .5;
                        Point3d p10 = mid_point + dirX * w0 * .5;

                        // first segment projection
                        segment = p0 - pa;

                        double divs = Math.Ceiling(segment.Length / pointSpacing);
                        for (int i=0; i < divs + 1; i++) {
                            Vector3d scaledVector = Vector3d.Multiply(i / divs, segment);
                            double closestT;
                            s.ClosestPoint(Point3d.Add(pa, scaledVector), out closestT);
                            Point3d n_p = s.PointAt(closestT);
                            path.Add(n_p);
                        }

                        // second segment projection
                        segment = p2 - p1;

                        divs = Math.Ceiling(segment.Length / pointSpacing);
                        for (int i=0; i < divs + 1; i++) {
                            Vector3d scaledVector = Vector3d.Multiply(i / divs, segment);
                            double closestT;
                            s.ClosestPoint(Point3d.Add(p1, scaledVector), out closestT);
                            Point3d n_p = s.PointAt(closestT);
                            path.Add(Point3d.Add(n_p, insetVector));
                        }

                        // interpolation curve A
                        double totalLength = p3.DistanceTo(p4) + p4.DistanceTo(p5);
                        divs = Math.Ceiling(totalLength / pointSpacing);

                        double tDelta = 1.0 / divs;
                        double locT = 0.0;

                        Vector3d dirA = p5 - p4;
                        Vector3d dirB = p3 - p4;
                        for (int i = 0; i < divs - 1; i++) {
                            locT += tDelta;

                            double t2 = locT * locT;
                            double tmin2 = 1 -  2 * locT + t2;

                            path.Add(Point3d.Add(p4, Vector3d.Add(Vector3d.Multiply(dirA, t2),  Vector3d.Multiply(dirB, tmin2))));
                        }

                        // interpolation curve B
                        totalLength = p5.DistanceTo(p6) + p6.DistanceTo(p7);
                        divs = Math.Ceiling(totalLength / pointSpacing);

                        tDelta = 1.0 / divs;
                        locT = 0.0;

                        dirA = p7 - p6;
                        dirB = p5 - p6;
                        for (int i = 0; i < divs - 1; i++) {
                            locT += tDelta;

                            double t2 = locT * locT;
                            double tmin2 = 1 -  2 * locT + t2;

                            path.Add(Point3d.Add(p6, Vector3d.Add(Vector3d.Multiply(dirA, t2),  Vector3d.Multiply(dirB, tmin2))));
                        }

                        // second segment projection
                        segment = p9 - p8;

                        divs = Math.Ceiling(segment.Length / pointSpacing);
                        for (int i=0; i < divs + 1; i++) {
                            Vector3d scaledVector = Vector3d.Multiply(i / divs, segment);
                            double closestT;
                            s.ClosestPoint(Point3d.Add(p8, scaledVector), out closestT);
                            Point3d n_p = s.PointAt(closestT);
                            path.Add(Point3d.Add(n_p, insetVector));
                        }

                        // first segment projection
                        segment = pb - p10;

                        divs = Math.Ceiling(segment.Length / pointSpacing);
                        for (int i=0; i < divs + 1; i++) {
                            Vector3d scaledVector = Vector3d.Multiply(i / divs, segment);
                            double closestT;
                            s.ClosestPoint(Point3d.Add(p10, scaledVector), out closestT);
                            Point3d n_p = s.PointAt(closestT);
                            path.Add(n_p);
                        }

                        path.Add(pb);
                    } else {
                        if (r0 >= localR) r0 = r0 - localR;
                        path.Add(cPt - dirX * w0 * .5);
                        path.Add(cPt + dirX * w0 * .5 - normal * localR);
                        path.Add(cPt - dirX * w0 * .5 + normal * localR);
                        path.Add(cPt + dirX * w0 * .5 + normal * localR);
                        path.Add(cPt - dirX * w0 * .5 - normal * localR);
                        path.Add(cPt + dirX * w0 * .5);

                    }
                }
            }

            Point3d pStart = path.Last();
            Point3d pEnd = s.PointAt(tStartOriginal);


            // second segment projection
            Vector3d seg = pEnd - pStart;

            double locDivs = Math.Ceiling(seg.Length / pointSpacing);
            for (int i=0; i < locDivs; i++) {
                Vector3d scaledVector = Vector3d.Multiply(i / locDivs, seg);
                double closestT;
                s.ClosestPoint(Point3d.Add(pStart, scaledVector), out closestT);
                Point3d n_p = s.PointAt(closestT);
                path.Add(n_p);
                backLayer.Add(n_p);
            }

        } else {
            double[] tS = s.DivideByLength(pointSpacing, false);
            foreach(double t in tS) {
                Point3d locP = s.PointAt(t);
                backLayer.Add(locP);
                path.Add(locP);
            }
        }

        backLayer.Add(s.PointAt(tStartOriginal));
        path.Add(s.PointAt(tStartOriginal));

        List<Point3d> filteredPath = new List<Point3d>();
        List<Point3d> filteredBack = new List<Point3d>();

        filteredPath.Add(path[0]);
        filteredBack.Add(backLayer[0]);

        foreach (Point3d p in path) if (filteredPath.Last().DistanceTo(p) > 0.01) filteredPath.Add(p);
        foreach (Point3d p in backLayer) if (filteredBack.Last().DistanceTo(p) > 0.01) filteredBack.Add(p);

        PolylineCurve pathCurve = new PolylineCurve(filteredPath);
        pathCurve.MakeClosed(10.0);
        paths.Add(pathCurve);

        PolylineCurve backCurve = new PolylineCurve(backLayer);
        backCurve.MakeClosed(10.0);
        baseLayers.Add(backCurve);


        height += layer_height;
    }

    C = baseLayers;
    D = paths;
# ---------- intersection_pattern: C# additional code ----------
  /// <summary>
  /// This method will be called once every solution, before any calls to RunScript.
  /// </summary>
  public override void BeforeRunScript()
  { }
  /// <summary>
  /// This method will be called once every solution, after any calls to RunScript.
  /// </summary>
  public override void AfterRunScript()
  { }
# ---------- end intersection_pattern ----------
divide = DivideCurve(Curve=intersection_pattern.D, Count=1, Kinks=True)  # -> flatten(Points), Tangents, Parameters
panel_4 = Panel(intersection_pattern.out)

# ---- group: connect patterns here!
python_5 = GhPythonScript(x=slicing_structuring.layers, pattern=cylinderpattern.cylinder_pattern)  # -> out, crvs; inputs x: list
# ---------- python_5: Python ----------
import Rhino.Geometry as rg

a_list, b_list = x

crvs = []

for i, vs in enumerate(a_list):
    
    pts = []
    
    for v in vs:
        pts.append(pattern.apply(v))
    
    pts.extend(b_list[i])
    
    crvs.append(rg.Polyline(pts + [pts[0]]))
# ---------- end python_5 ----------
crv_3 = Curve(python_5.crvs)

# ----
crv_4 = Curve(intersection_pattern.D)  # disabled
crv_5 = Curve(intersection_pattern.C)  # disabled
nozzlesettings_2 = GhPythonScript(x=flatten(manualnozzloverwrite))  # -> out, extrusion_rate, spacing_cross, spacing_paths, spacing_link, start_stop_retraction, start_reextrusion_rate
# ---------- nozzlesettings_2: Python ----------
import scriptcontext as sc

extrusion_rate = sc.sticky["PrintSettings"]["print_extrusion_rate"]
spacing_cross = sc.sticky["PrintSettings"]["print_spacing_cross"]
spacing_paths = sc.sticky["PrintSettings"]["print_spacing_paths"]
spacing_link = sc.sticky["PrintSettings"]["print_spacing_link"]
start_stop_retraction = sc.sticky["PrintSettings"]["print_spacing_start_stop_retraction"]
start_reextrusion_rate = sc.sticky["PrintSettings"]["print_spacing_start_reextrusion_rate"]

print(True)
# ---------- end nozzlesettings_2 ----------
panel_5 = Panel(python_5.out)
path_mapper = PathMapper(crv_3, source="{A;B;C;D}", target="{A;B;C}")

spacing_inter_paths = Number(nozzlesettings_2.spacing_paths)
spacing_link_exterior = Number(nozzlesettings_2.spacing_link)
spacing_cross = Number(nozzlesettings_2.spacing_cross)

line = Line(Line((-27.46198946, 138.4851678, 0), (-0.1413537679, -0.6893088134, 0)))

# ---- group: — Shell Setup —
list_2 = ValueList({"detached", "crossing"}, selected="detached")
list_3 = ValueList({"Inside": "inside", "Outside": "outside"}, selected="Outside")
# amount of layers per shell
# 
# Outside/Inside : which layer would be printed first or last
# 
# Split line = location of the seam
# 
# Side Bool = external or left or right.?
toggle_3 = BooleanToggle(True)
python_6 = GhPythonScript(
    x=library_path_2,
    crvs=crv_4,
    crvs_sec=crv_5,
    shell_spacing=spacing_inter_paths,
    direction=list_3,
    count=Slider(1, range=0..10),
    split_distance=spacing_cross,
    split_type=list_2,
    split_line=line,
    side_bool=toggle_3)  # -> out, a, b, link_inner_crvs, main_inner_crvs, outer_crvs, pt_sets; inputs crvs: list of Curve, crvs_sec: list of Curve, count: Int32, side_bool: Boolean
# ---------- python_6: Python ----------
import sys
import Rhino.Geometry as rg

sys.path.append(x)

# print(sys.path)

import generalFunctions as gf
import layerFunctions as lf
import scriptcontext as sc

sc.sticky["PrintSettings"]["shell_count"] = count
sc.sticky["PrintSettings"]["shell_direction"] = direction
sc.sticky["PrintSettings"]["shell_spacing"] = shell_spacing
sc.sticky["PrintSettings"]["shell_split_distance"] = split_distance
sc.sticky["PrintSettings"]["shell_split_type"] = split_type


reload(gf)
reload(lf)

o_crv_sets = []
outer_crvs = []

if count > 1:

    for crv_i, crv in enumerate(crvs):
        
        print(crv_i)
    
        o_crv_set = gf.offsetCurveSet(crv, shell_spacing, direction, count)
        layer_set = lf.LinkingLayers(o_crv_set, split_distance, side_bool, split_type, split_line)
        layer_set.createOrganisedCurves()
        pt_set = layer_set.joinCrvs()
    
        pt_set = pt_set[1:-1] + [pt_set[1]]
    
        crv = rg.Polyline(pt_set).ToPolylineCurve()
    
        o_crv_sets.append(o_crv_set)
        outer_crvs.append(crv)
        
else:
    
    outer_crvs = crvs

o_type = rg.CurveOffsetCornerStyle.Sharp

main_inner_crvs = []
link_inner_crvs = []

if count == 1:
    
    for i, crv in enumerate(crvs):
        
        print(crv)
    
        if (len(crvs_sec) > 0):
            main_inner_crv = crvs_sec[i]
        else:
            main_inner_crv = crv
        
        pln = rg.Plane(main_inner_crv.PointAt(0.0), rg.Vector3d(0,0,1))
        
        sim = rg.CurveSimplifyOptions.All
        # main_inner_crv = main_inner_crv.Simplify(sim, 10., 1.)
        
        try:
            link_inner_crv = main_inner_crv.Offset(pln, -shell_spacing, .01, o_type)[0]
        except:
            print("I Failed :/")
            print(main_inner_crv)
        
        main_inner_crvs.append(main_inner_crv)
        link_inner_crvs.append(link_inner_crv)

elif direction == "outside":
    
    for o_crv_set in o_crv_sets:
    
        main_inner_crv = rg.Polyline(o_crv_set[0]).ToPolylineCurve()
        
        pln = rg.Plane(main_inner_crv.PointAt(0.0), rg.Vector3d(0,0,1))
        
        link_inner_crv = main_inner_crv.Offset(pln, -shell_spacing, .01, o_type)[0]
        
        main_inner_crvs.append(main_inner_crv)
        link_inner_crvs.append(link_inner_crv)
    
else:
    
    for o_crv_set in o_crv_sets:
    
        main_inner_crv = rg.Polyline(o_crv_set[0]).ToPolylineCurve()
        
        pln = rg.Plane(main_inner_crv.PointAt(0.0), rg.Vector3d(0,0,1))
        
        link_inner_crv = main_inner_crv.Offset(pln, -shell_spacing, .01, o_type)[0]
        
        main_inner_crvs.append(main_inner_crv)
        link_inner_crvs.append(link_inner_crv)
# ---------- end python_6 ----------

# ----
pt_8 = Point(given_points)
pin_only_heights = Number(python.pin_only_heights)
library_path_3 = FilePath(library_path_2)

# ---- group: — PIN Setup —
python_7 = GhPythonScript(
    x=library_path_3,
    pin_pts=flatten(pt_8),
    connection_count=Slider(3, range=1..4),
    max_main_line=Slider(100, range=25..250),
    start_end_alfa=Slider(1.571, range=0..3.142),
    mid_alfa=Slider(0.5, range=0..3.142),
    pin_height=Slider(260, range=0..1000),
    bot_rad=Slider(35, range=0..100),
    top_rad=Slider(18, range=0..100),
    resolution=Slider(16, range=0..100),
    spacing=spacing_link_exterior)  # -> out, main_links, side_links, split_lines, pin_pt_sets, pins, mid_links, link_line_vis, pin_geo, extra_pts; inputs pin_pts: list of Point3d, connection_count: Int32, resolution: Int32
# ---------- python_7: Python ----------
import sys

sys.path.append(x)

import pinLinkingBis as pl

reload(pl)

main_links, link_lines, split_lines, pin_pt_sets, mid_links, b_mid_pts = pl.createLinks(
    pin_pts = pin_pts,
    connection_count = connection_count,
    max_main_line = max_main_line,
    start_end_alfa = start_end_alfa,
    mid_alfa = mid_alfa
)

link_line_vis = link_lines

main_links = pl.linkSetGeneration(main_links, spacing)
side_links = pl.linkSetGeneration(link_lines, spacing, 2)
mid_links = pl.linkSetGeneration(mid_links, spacing, 2)

extra_pts = []

for i, b_pt_set in enumerate(b_mid_pts):
    
    extra_pts.extend(pl.linkClosestPoints(main_links[i], b_pt_set))

pins = pl.pinMaker(pin_pts, pin_height, bot_rad, top_rad, resolution)

pin_geo = []

for pin in pins:
    
    pin_geo.append(pin.createGeometry())
# ---------- end python_7 ----------

# ----
panel_6 = Panel(python_6.out)
end_link_curve = Curve(graft(python_6.main_inner_crvs))
side_link_curve = Curve(graft(python_6.link_inner_crvs))
mesh = Mesh(python_7.pin_geo)

# ---- group: visualization
loft = Loft(Curves=python_5.crvs, Options={Adjust=False, Closed=False, LoftEnds=0, LoftSimp=0, LoftType=0, Rebuild=10, Refit=0.01})
col = Colour(RGB(230, 136, 37))
merge = Merge(Data1=loft, Data2=mesh)  # -> flatten(Result)
gate = StreamGate(Stream=merge, Gate=Toggle(True))  # -> Target0, Target1
preview = CustomPreview(Geometry=gate.Target1, Material=col)

# ----
panel_7 = Panel(python_7.out)

# ---- group: Main Link connection / Offset Pins Layers
number_slider_9 = Slider(3, range=0..10)
number_slider_10 = Slider(3, range=0..10)

# ----
python_8 = GhPythonScript(pin=python_7.pins, pin_heights=pin_only_heights)  # -> out, slices; inputs pin_heights: list
# ---------- python_8: Python ----------
slices = []

for h in pin_heights:
    
    slices.append(pin.createSlice(h))
# ---------- end python_8 ----------

# ---- group: Main Link connection
python_9 = GhPythonScript(x=flatten(end_link_curve))  # -> out, flatten(heights), flatten(index); inputs x: list of Curve
# ---------- python_9: Python ----------
heights = []
index = []

for crv_i, crv in enumerate(x):
    
    heights.append(crv.PointAt(0.0).Z)
    index.append(crv_i)
# ---------- end python_9 ----------
python_10 = GhPythonScript(
    x=library_path_3,
    main_links=flatten(python_7.main_links),
    pins=flatten(python_7.pins),
    link_set=flatten(python_7.side_links),
    heights=flatten(python_9.heights),
    count=flatten(python_9.index),
    bottom_shift_count=number_slider_9,
    bottom_max_shift=number_slider_10)  # -> out, graft(main_crv), b, c, inner_crvs, main_crv_pt_set, main_links; inputs main_links: list, pins: list, link_set: list
# ---------- python_10: Python ----------
import sys

sys.path.append(x)

import pinLinkingBis as pl

reload(pl)

if count < bottom_shift_count:
    
    print("I am shifting the bottom layer with: ")
    
    count_delta = bottom_max_shift / float(bottom_shift_count)
    
    bottom_offset = count_delta * (bottom_shift_count - count)
    print("bottom offset: %s" % bottom_offset)
    
else:
    
    bottom_offset = None

main_crv, b, main_links, inner_crvs = pl.makeMainShape(pins, main_links, heights, bottom_offset)
# ---------- end python_10 ----------

# ---- group: Interconnections - code
python_11 = GhPythonScript(side_links=python_7.side_links, end_link_index=Slider(1, range=0..100))  # -> out, flatten(side_links), flatten(end_link), end_link_vis; inputs side_links: list, end_link_index: Int32
# ---------- python_11: Python ----------
import Rhino.Geometry as rg
from copy import deepcopy as dc

side_link_count = len(side_links)

end_link_index = end_link_index % side_link_count

end_link = side_links.pop(end_link_index)

# visualisation of the end link

end_link_vis = dc(end_link.lines)

for end_link_line in end_link_vis:
    
    sc_m = rg.Transform.Scale(end_link_line.From, 100.0)
    
    end_link_line.Transform(sc_m)
# ---------- end python_11 ----------
path_mapper_2 = PathMapper(end_link_curve, source="{A;B;C;D;E}", target="{E}")
path_mapper_3 = PathMapper(python_10.main_crv, source="{A;B}", target="{B}")
path_mapper_4 = PathMapper(side_link_curve, source="{A;B;C;D;E}", target="{E}")
python_12 = GhPythonScript(x=library_path_3, end_link=flatten(python_11.end_link), interior_crv=path_mapper_3, exterior_crv=path_mapper_2)  # -> out, graft(output_end_link), side_link_lines; inputs interior_crv: Curve, exterior_crv: Curve
# ---------- python_12: Python ----------
import Rhino.Geometry as rg
from copy import deepcopy as dc

import sys

sys.path.append(x)

height_val = interior_crv.PointAt(0.0).Z

mv_m = rg.Transform.Translation(rg.Vector3d(0,0,height_val))
    
output_end_link = dc(end_link)
output_end_link.Transform(mv_m)
    
output_end_link.trimLines(exterior_crv, True)
output_end_link.trimLines(interior_crv, False)

side_link_lines = dc(output_end_link.lines)
# ---------- end python_12 ----------
python_13 = GhPythonScript(x=library_path_3, side_links=flatten(python_11.side_links), interior_crv=path_mapper_3, exterior_crv=path_mapper_4)  # -> out, output_side_links, side_link_lines; inputs side_links: list, interior_crv: Curve, exterior_crv: Curve
# ---------- python_13: Python ----------
import Rhino.Geometry as rg
from copy import deepcopy as dc

import sys

sys.path.append(x)

height_val = interior_crv.PointAt(0.0).Z

mv_m = rg.Transform.Translation(rg.Vector3d(0,0,height_val))

side_link_lines = []

print(type(exterior_crv))

output_side_links = []

for side_link in side_links:
    
    loc_link = dc(side_link)
    loc_link.Transform(mv_m)
    
    loc_link.trimLines(exterior_crv, True)
    loc_link.trimLines(interior_crv, False)
    
    output_side_links.append(loc_link)
    
    side_link_lines.extend(loc_link.lines)
    
print(side_link_lines[0].To.Z)
# ---------- end python_13 ----------
midlinks = GhPythonScript(x=library_path_3, mid_links=flatten(python_7.mid_links), interior_crv=path_mapper_3, exterior_crv=path_mapper_4)  # -> out, output_mid_links, mid_link_lines; inputs mid_links: list, interior_crv: Curve, exterior_crv: Curve
# ---------- midlinks: Python ----------
import Rhino.Geometry as rg
from copy import deepcopy as dc

import sys

sys.path.append(x)

height_val = interior_crv.PointAt(0.0).Z

mv_m = rg.Transform.Translation(rg.Vector3d(0,0,height_val))

mid_link_lines = []

print(type(exterior_crv))

output_mid_links = []

for mid_link in mid_links:
    
    loc_link = dc(mid_link)
    loc_link.Transform(mv_m)
    
    loc_link.trimLines(exterior_crv, True)
    loc_link.trimLines(interior_crv, False)
    
    output_mid_links.append(loc_link)
    
    mid_link_lines.extend(loc_link.lines)
    
print(mid_link_lines[0].To.Z)
# ---------- end midlinks ----------

# ----
item_3 = ListItem(List=pin_only_heights, Index=0, Wrap=True)  # -> Item1, Item
crv_6 = Curve(python_8.slices)
panel_8 = Panel(path_mapper_2)
panel_9 = Panel(midlinks.out)
path_mapper_5 = PathMapper(crv_6, source="{A;B;C}", target="{C}")
panel_10 = Panel(python_13.out)
panel_11 = Panel(path_mapper_5)
library_path_4 = FilePath(library_path_3)

# ---- group: Interior Curves
line_2 = Line(flatten(python_7.split_lines))
crv_7 = Curve(python_10.inner_crvs)
layer_count = Slider(1, range=0..10)
path_mapper_6 = PathMapper(python_10.main_links, source="{C;D}", target="{D}")
path_mapper_7 = PathMapper(python_12.output_end_link, source="{D;E}", target="{D}")
path_mapper_8 = PathMapper(midlinks.output_mid_links, source="{D;E}", target="{D}")
list_4 = ValueList({"detached", "crossing"}, selected="crossing")
list_5 = ValueList({"Inside": "inside", "Outside": "outside"}, selected="Inside")
path_mapper_9 = PathMapper(python_13.output_side_links, source="{D;E}", target="{D}")
path_mapper_10 = PathMapper(crv_7, source="{C;D}", target="{D}")
python_14 = GhPythonScript(
    x=library_path_4,
    extra_pts=flatten(python_7.extra_pts),
    main_links=path_mapper_6,
    side_links=path_mapper_9,
    end_link=path_mapper_7,
    mid_links=path_mapper_8,
    crvs=path_mapper_10,
    split_lines=line_2,
    distance=spacing_inter_paths,
    direction=list_5,
    count=layer_count,
    split_distance=spacing_cross,
    split_type=list_4,
    side_bool=Toggle(True),
    diamond_link=Toggle(True),
    safety=Toggle(True),
    main_link_length=Slider(26.1, range=0..100),
    side_length=Slider(61.3, range=0..100))  # -> out, log, b, c, d, e, pt_sets, start_and_end_pt, main_crv; inputs extra_pts: list of Point3d, main_links: list, side_links: list, mid_links: list, crvs: list of Curve, split_lines: list of Line, count: Int32, side_bool: Boolean
# ---------- python_14: Python ----------
import sys

sys.path.append(x)

# print(sys.path)

import generalFunctions as gf
import layerFunctions as lf
import Rhino.Geometry as rg
import pinLinkingBis as pl

from copy import deepcopy as dc

reload(gf)
reload(lf)
reload(pl)

log = ["new sequence start"]

diamond_settings = (diamond_link, safety, (main_link_length, side_length))

pt_sets = []

inner_crvs = []

height = crvs[0].PointAt(0.0).Z

mv_m = rg.Transform.Translation(rg.Vector3d(0,0, height))

loc_split_lines = dc(split_lines)
[line.Transform(mv_m) for line in loc_split_lines]

print loc_split_lines

crv_count = len(crvs)
print("there are %s curves in your list" % crv_count)

if count == 1:
    
    for crv in crvs:
        
        crv.Reverse()
        
    inner_crvs = crvs
    
else:
    
    for crv_i, crv in enumerate(crvs):
        
        a = gf.offsetCurveSet(crv, distance, direction, count)
        layer_set = lf.LinkingLayers(a, split_distance, side_bool, split_type, split_line = loc_split_lines[crv_i])
        # a = layer_set.split_a
        # b = layer_set.split_b
        # c = layer_set.split_line
        # d = layer_set.split_axis
        a, b, c, d, e = layer_set.createOrganisedCurves()
        
        pt_set = layer_set.joinCrvs()
        pt_set = pt_set[1:-1] + [pt_set[1]]
        
        crv = rg.Polyline(pt_set).ToPolylineCurve()
        
        inner_crvs.append(crv)

print("I passed this hurdle")

loc_extra_pts = []

for extra_pt in extra_pts:
    
    loc_pt = dc(extra_pt)
    loc_pt.Transform(mv_m)
    loc_extra_pts.append(loc_pt)
    
main_crv = pl.makeInnerCurve(inner_crvs, main_links, side_links, end_link, loc_extra_pts, mid_links, diamond_settings = diamond_settings)

print(main_crv)

start_and_end_pt = [main_crv.PointAt(main_crv.Domain[0]), main_crv.PointAt(main_crv.Domain[1])]
# ---------- end python_14 ----------

# ----
# PIN - INFILL
# connections...?
# 
# 
# system, if organic shell
outer_crv = Curve(graft(python_6.outer_crvs))
pt_9 = Point(pt_8)
path_mapper_11 = PathMapper(source="{A;B}", target="{A}")
pline = PolyLine(Closed=False)
crv_8 = Curve(item)
panel_12 = Panel(python_14.out)
number_slider_11 = Slider(1, range=0..1)

# ---- group: Background process (Layer unioning Generation)
path_mapper_12 = PathMapper(outer_crv, source="{A;B;C;D;E}", target="{E}")
path_mapper_13 = PathMapper(python_14.start_and_end_pt, source="{A;B}", target="{A}")
python_15 = GhPythonScript(x=library_path_4, start_end_pts=path_mapper_13, exterior_crv=path_mapper_12, interior_crv=python_14.main_crv)  # -> out, a; inputs start_end_pts: list of Point3d, exterior_crv: Curve, interior_crv: Curve
# ---------- python_15: Python ----------
import sys

sys.path.append(x)

import generalFunctions as gf

result_crvs, _ = gf.layer2ptIntersect(exterior_crv, start_end_pts)
pt_set = list(gf.curveToPolyline(gf.longestCurve(result_crvs)).ToArray())
pt_set_2 = list(gf.curveToPolyline(interior_crv).ToArray())

pt_set_2.reverse()

a = pt_set + pt_set_2[1:-1]
# ---------- end python_15 ----------

# ----
panel_13 = Panel(path_mapper_12)

# ---- group: Start Point - End Point LISTS
pt_10 = Point(flatten(python_15.a))
first_point_brim = ListItem(List=pt_10, Index=0, Wrap=True)
last_point_pin = ListItem(List=pt_10, Index=0, Wrap=True)  # -> Item1, Item

# ----
endpoint = Point(last_point_pin.Item1)
helixpin = GhPythonScript(
    pins=python_7.pins,
    start_height=item_3.Item,
    start_pt=endpoint,
    end_height=number_slider_3,
    start_alfa=Slider(4.33, range=0..10),
    layer_height=number_slider)  # -> out, pin_helix_lists; inputs pins: list, start_pt: Point3d
# ---------- helixpin: Python ----------
pin_helix_lists = []

for i, pin in enumerate(pins):
    
    if i == 0:
        
        # first pin, which uses a start point
        
        helix = pin.helix(
            end_h = end_height,
            start_pt = start_pt,
            layer_h = layer_height
        )
        
        pin_helix_lists.append(helix)
        
    else:
        
        helix = pin.helix(
            end_h = end_height,
            start_h = start_height - layer_height * .5,
            layer_h = layer_height,
            start_alfa = start_alfa
        )
        
        pin_helix_lists.append(helix)
# ---------- end helixpin ----------

# ---- group: Seam
endpoint_2 = Point(last_point_pin.Item1)
splitlines = Line(flatten(line_2))
update_split_lines = GhPythonScript(end_pt=endpoint_2, split_lines=splitlines)  # -> out, split_lines; inputs end_pt: Point3d, split_lines: list of Line
# ---------- update_split_lines: Python ----------
end_pt.Z = 0.0
split_lines[0].To = end_pt
# ---------- end update_split_lines ----------

# ----
python_16 = GhPythonScript(x=helixpin.pin_helix_lists)  # -> out, points
# ---------- python_16: Python ----------
import Rhino.Geometry as rg

print(len(x))

points = [rg.Point3d(pt) for pt in x]
# ---------- end python_16 ----------
item_4 = ListItem(List=helixpin.pin_helix_lists, Index=0, Wrap=True)  # -> Item, Item1
path_mapper_14 = PathMapper(python_16.points, source="{A;B;C;D}", target="{D}")
nozzlesettings_3 = GhPythonScript(x=flatten(nozzlesettings_2.out))  # -> out, feed_rate, variable_feed_rate, feed_rate_max, feed_rate_max_start_start_ramp, feed_rate_max_end_start_ramp, feed_rate_max_start_end_ramp, feed_rate_max_end_end_ramp
# ---------- nozzlesettings_3: Python ----------
import scriptcontext as sc

feed_rate = sc.sticky["PrintSettings"]["feed_rate"]
variable_feed_rate = sc.sticky["PrintSettings"]["feed_rate_variable"]

if variable_feed_rate:
    
    feed_rate_max = sc.sticky["PrintSettings"]["feed_rate_max"]
    feed_rate_max_start_start_ramp = sc.sticky["PrintSettings"]["feed_rate_max_end_start_ramp"]
    feed_rate_max_end_start_ramp = sc.sticky["PrintSettings"]["feed_rate_max_end_start_ramp"]
    feed_rate_max_start_end_ramp = sc.sticky["PrintSettings"]["feed_rate_max_start_end_ramp"]
    feed_rate_max_end_end_ramp = sc.sticky["PrintSettings"]["feed_rate_max_end_end_ramp"]
    
print(True)
# ---------- end nozzlesettings_3 ----------

# ---- group: Nozzle-Set@Start
nozzlesettings_4 = GhPythonScript(x=flatten(nozzlesettings_3.out))  # -> out, extrusion_rate, spacing_cross, spacing_paths, spacing_link, start_stop_retraction, start_reextrusion_rate
# ---------- nozzlesettings_4: Python ----------
import scriptcontext as sc

extrusion_rate = sc.sticky["PrintSettings"]["print_extrusion_rate"]
spacing_cross = sc.sticky["PrintSettings"]["print_spacing_cross"]
spacing_paths = sc.sticky["PrintSettings"]["print_spacing_paths"]
spacing_link = sc.sticky["PrintSettings"]["print_spacing_link"]
start_stop_retraction = sc.sticky["PrintSettings"]["print_spacing_start_stop_retraction"]
start_reextrusion_rate = sc.sticky["PrintSettings"]["print_spacing_start_reextrusion_rate"]
# ---------- end nozzlesettings_4 ----------

# ----
library_path_5 = FilePath(library_path_4)
num_2 = Number(number_slider)
number_slider_12 = Slider(3.5, range=0..10)
layerheight = Number(number_slider)
addition = Addition(A=num_2, B=0.001)
rectangle = Rectangle(Plane=PlaneXY(0, 0, 0), XSize=Domain(-1, 1), YSize=Domain(-2, 2), Radius=0)  # -> Rectangle, Length
multiplication_2 = Multiplication(A=layerheight, B=0.55)
value_list = ValueList({"marieGriesmar": "", "lehmHuus": "_lehmHuus", "WASP": "_deltaWasp"}, selected="marieGriesmar")
number_slider_13 = Slider(0.5, range=0..10)
number_slider_14 = Slider(8, range=0..100)
mesh_pipe_flat = CSharpScript(pts=divide.Points, r=multiplication_2, d=number_slider_14, max_angle=number_slider_13)  # -> out, flatten(A), B, C; inputs pts: list of Point3d, r: Double, d: Int32, max_angle: Double
# ---------- mesh_pipe_flat: C# ----------
    List<Vector3d> tangents = new List<Vector3d>();
    List<double> angles = new List<double>();
    List<Point3d> cleanedPts = new List<Point3d>();

    d = Convert.ToInt16(Math.Ceiling(d / 2.0) * 2.0);

    cleanedPts.Add(pts[0]);
    // constructing all the tangent vectors
    for (int i = 1; i < pts.Count; i++) {
      Point3d p0 = cleanedPts[cleanedPts.Count - 1];
      Point3d p1 = pts[i];

      if (p0.DistanceTo(p1) > .0001) cleanedPts.Add(p1);
    }

    // constructing all the tangent vectors
    for (int i = 1; i < cleanedPts.Count; i++) {
      Point3d p0 = cleanedPts[i - 1];
      Point3d p1 = cleanedPts[i];

      tangents.Add(p1 - p0);
    }

    tangents.Add(tangents[tangents.Count - 1]);

    // getting the first normal & binormal
    Vector3d t = tangents[0];
    Vector3d n;
    if (Math.Abs(t.Y) > Math.Abs(t.X)) {
      if (Math.Abs(t.Z) > Math.Abs(t.Y)) {
        n = new Vector3d(0, t.Z, -t.Y);
      } else if (Math.Abs(t.Z) >= Math.Abs(t.X)) {
        n = new Vector3d(0, -t.Z, t.Y);
      } else {
        n = new Vector3d(t.Y, -t.Y, 0);
      }
    } else if (Math.Abs(t.Z) > Math.Abs(t.X)) {
      n = new Vector3d(t.Z, 0, -t.X);
    } else if (Math.Abs(t.Z) > Math.Abs(t.Y)) {
      n = new Vector3d(-t.Z, 0, t.X);
    } else {
      n = new Vector3d(-t.Y, t.X, 0.0);
    }
    Vector3d bn = Vector3d.CrossProduct(t, n);

    n.Unitize();
    bn.Unitize();

    // populating the end and start frames of every plane
    List<Plane> frames = new List<Plane>();

    for (int i = 1; i < cleanedPts.Count; i++) {
      Point3d p0 = cleanedPts[i - 1];
      Point3d p1 = cleanedPts[i];

      frames.Add(new Plane(p0, n, bn));
      frames.Add(new Plane(p1, n, bn));

        if (i < pts.Count - 1) {
            t = tangents[i];
            n = Vector3d.CrossProduct(bn, t);
            bn = Vector3d.CrossProduct(t, n);

            n.Unitize();
            bn.Unitize();
        }
    }

    // when the angle between previous end and next start plane is larger than max angle
    // use halfSpace logic to create interpolation locations


    // add interpolation planes (rounded ends)
    List<Plane> interpolatedFrames = new List<Plane>();
    interpolatedFrames.Add(frames[0]);
    for (int i = 1; i < frames.Count - 2; i += 2) {
        Plane pln0 = frames[i];
        Plane pln1 = frames[i+1];

        double angle = Vector3d.VectorAngle(pln0.Normal, pln1.Normal);

        angles.Add(angle);

        Plane intPln = new Plane(pln0.Origin, pln0.XAxis + pln1.XAxis, pln0.YAxis + pln1.YAxis);

        interpolatedFrames.Add(intPln);
    }

    interpolatedFrames.Add(frames[frames.Count - 1]);

    // constructing the uv parameters
    List<Vector2d> uvParameters = new List<Vector2d>();
    for (int i = 0; i < d; i++) {
      double angle = i * (Math.PI * 2.0) / d;
      uvParameters.Add(new Vector2d(r * Math.Cos(angle), r * Math.Sin(angle)));
    }

    // constructing the mesh
    Mesh pipeMesh = new Mesh();
    foreach (Plane f in interpolatedFrames) {
      foreach (Vector2d v in uvParameters) {
        pipeMesh.Vertices.Add(f.Origin + f.XAxis * v.X + f.YAxis * v.Y);
      }
    }

    for (int i = 1 ; i < interpolatedFrames.Count ; i++) {
        int idxA = (i - 1) * uvParameters.Count;
        int idxB = i * uvParameters.Count;
      for (int j = 1; j < uvParameters.Count; j++) {
          int iA = idxA + j - 1;
          int iB = idxB + j - 1;
          int iC = idxB + j;
          int iD = idxA + j;

        pipeMesh.Faces.AddFace(iA, iB, iC, iD);
      }

        int iAEnd = idxA + uvParameters.Count - 1;
      int iBEnd = idxB + uvParameters.Count - 1;
      int iCEnd = idxB;
      int iDEnd = idxA;

        pipeMesh.Faces.AddFace(iAEnd, iBEnd, iCEnd, iDEnd);
    }

    int[] duplicateFaces = pipeMesh.Faces.GetDuplicateFaces();
    for (int i = 1; i < duplicateFaces.Length + 1; i ++) {
        pipeMesh.Faces.RemoveAt(duplicateFaces[duplicateFaces.Length - i]);
     }


    pipeMesh.FaceNormals.ComputeFaceNormals();

    A = pipeMesh;
    B = duplicateFaces;
# ---------- end mesh_pipe_flat ----------
mesh_2 = Mesh(mesh_pipe_flat.A)
mesh_3 = Mesh(rectangle.Rectangle)
col_2 = Colour(RGB(230, 136, 37))
demesh = DeconstructMesh(Mesh=mesh_3)  # -> Vertices, Faces, Colours, Normals
pt_11 = ConstructPoint(XCoordinate=1, YCoordinate=1, ZCoordinate=1)
medges = MeshEdges()  # -> NakedEdges, InteriorEdges, NonManifoldEdges
pl = PlaneNormal(Origin=Point(0, 0, 0), ZAxis=pt_11)
vlen = VectorLength()
line_3 = Line(medges.NonManifoldEdges)
gl_shader = GLShader(
    DepthTestingEnabled=True,
    DepthWritingEnabled=True,
    DrawMode=0,
    FragmentShader="""#version 330

in vec4 vertex_color;
out vec4 fragment_color;

void main() {
  fragment_color = vertex_color;
}""",
    GLShader=(0, 2, 0),
    PreviewSortOrder=5,
    VertexShader="""#version 330

layout(location = 0) in vec3 vertex;
layout(location = 1) in vec4 vcolor;

uniform mat4 _worldToClip;
out vec4 vertex_color;

void main() {
  vertex_color = vcolor;
  gl_Position = _worldToClip * vec4(vertex, 1.0);
}""",
    glLineWidth=3,
    glPointSize=8)  # -> Color, Depth
savefile = Button()

# ---- group: Brim
# SETTINGS need to be externalized
number_slider_15 = Slider(25, range=10..100)
item_5 = ListItem(List=crv_5, Index=0, Wrap=True)

# ----
simplify = SimplifyCurve(Curve=item_5)  # -> Curve, Simplified

# ---- group: Brim (continued)
divide_2 = DivideCurve(Curve=simplify.Curve, Count=1, Kinks=True)  # -> Points, Tangents, Parameters

# ----
hull = ConvexHull(Points=divide_2.Points, Plane=PlaneXY(0, 0, 0))  # -> Hull, HullZ, Indices
divide_3 = DivideCurve(Curve=hull.HullZ, Count=1, Kinks=True)  # -> Points, Tangents, Parameters

# ---- group: Brim (continued)
brim = GhPythonScript(
    x=library_path_4,
    first_pt=first_point_brim,
    pts=divide_3.Points,
    offset_amount=Slider(10, range=0..10),
    start_safety_distance=number_slider_15)  # -> out, flatten(a), start_pt, outer_brim_crv, base_pt, crv; inputs first_pt: Point3d, pts: list of Point3d
# ---------- brim: Python ----------
import sys

sys.path.append(x)

import Rhino.Geometry as rg
import generalFunctions as gf
import polyline as pl

reload(pl)

crv = rg.Polyline(pts).ToPolylineCurve()
_, t_val = crv.ClosestPoint(first_pt)

print(t_val)

crv.ChangeClosedCurveSeam(t_val)

base_pt_set = list(crv.ToPolyline().ToArray())

brim_pl = pl.StructuredPolyline(base_pt_set[:-1])
brim_pl.offset(offset_amount)

pt_set = brim_pl.pointSet() + [brim_pl.pointSet()[0]]

crv = rg.Polyline(pt_set).ToPolylineCurve()
_, t_val = crv.ClosestPoint(first_pt)

print(t_val)

base_pt = crv.PointAt(t_val)
crv.ChangeClosedCurveSeam(t_val)

# base_pt = brim_pl.v_set[0]
start_pt, first_pt = base_pt, first_pt

start_pt = first_pt + (start_pt - first_pt) * (start_safety_distance / offset_amount)

# a = [rg.Point3d(start_pt)] + brim_pt_set
a = list(crv.ToPolyline().ToArray())
# ---------- end brim ----------

# ----
panel_14 = Panel(brim.out)
clean = CleanTree(RemoveNulls=True, RemoveInvalid=True, RemoveEmpty=False, Tree=brim.a)
clean_2 = CleanTree(RemoveNulls=True, RemoveInvalid=True, RemoveEmpty=False, Tree=brim.start_pt)

# ---- group: START/STOP--> CODE
split = SplitTree(Data=path_mapper_14, Masks=flatten("{0}"))  # -> Positive, Negative
item_6 = ListItem(List=pt_9, Index=0, Wrap=True)  # -> Item, Item1
pdecon = Deconstruct(Point=item_6.Item)  # -> XComponent, YComponent, ZComponent
pt_12 = Point(split.Negative)
extraheight = Slider(30, range=0..100)
item_7 = ListItem(List=split.Positive, Index=0, Wrap=True)  # -> Item1, Item
item_8 = ListItem(List=split.Negative, Index=0, Wrap=True)
pdecon_2 = Deconstruct(Point=item_6.Item1)  # -> XComponent, YComponent, ZComponent
pdecon_3 = Deconstruct(Point=item_7.Item1)  # -> XComponent, YComponent, ZComponent
pdecon_4 = Deconstruct(Point=item_8)  # -> XComponent, YComponent, ZComponent
addition_2 = Addition(A=extraheight, B=pdecon_3.ZComponent)
pt_13 = ConstructPoint(XCoordinate=pdecon_2.XComponent, YCoordinate=pdecon_2.YComponent, ZCoordinate=pdecon_4.ZComponent)
pt_14 = ConstructPoint(XCoordinate=pdecon.XComponent, YCoordinate=pdecon.YComponent, ZCoordinate=addition_2)
dist = Distance(PointA=pt_13, PointB=item_8)
subtraction = Subtraction(A=item_8, B=pt_13)
division = Division(A=subtraction, B=dist)
multiplication_3 = Multiplication(A=division, B=extraheight)
addition_3 = Addition(A=multiplication_3, B=item_8)
pdecon_5 = Deconstruct(Point=addition_3)  # -> XComponent, YComponent, ZComponent
pt_15 = Point(clean_2)
pt_16 = ConstructPoint(XCoordinate=pdecon_5.XComponent, YCoordinate=pdecon_5.YComponent, ZCoordinate=addition_2)
pdecon_6 = Deconstruct(Point=pt_15)  # -> XComponent, YComponent, ZComponent
merge_2 = Merge(Data1=pt_14, Data2=pt_16, Data3=addition_3, Data4=item_8)  # -> flatten(Result)
pt_17 = ConstructPoint(XCoordinate=pdecon_6.XComponent, YCoordinate=pdecon_6.YComponent, ZCoordinate=extraheight)
merge_3 = Merge(Data1=pt_17, Data2=pt_15)

# ----
# BRIM - BODY - 1st PIN (without Start-Stop)
merge_4 = Merge(Data1=flatten(clean), Data2=flatten(pt_10), Data3=flatten(split.Positive))

pt_18 = Point(item_6.Item1)

# ---- group: Internalize ?
feed_rate_in_mm_s_3 = Slider(25, range=0..100)
pdecon_7 = Deconstruct(Point=pt_18)  # -> XComponent, YComponent, ZComponent
pt_19 = ConstructPoint(XCoordinate=pdecon_7.XComponent, YCoordinate=pdecon_7.YComponent, ZCoordinate=addition_2)
python_17 = GhPythonScript(feed_rate=feed_rate_in_mm_s_3, extrusion_rate=Slider(200, range=0..1000), pts=pt_19)  # -> out, a; inputs pts: list of Point3d
# ---------- python_17: Python ----------
f_rate = feed_rate * 60.0

for pt_i, pt in enumerate(pts):
    
    if pt_i == 0:
        
        e_rate = - extrusion_rate
    
    elif pt_i == len(pts) - 1:
        
        e_rate = extrusion_rate
        
    else:
        
        e_rate = 0.0
    
    print("G1 F{} X{} Y{} Z{} E{}".format(f_rate, pt.X, pt.Y, pt.Z, e_rate))
# ---------- end python_17 ----------

# ----
pt_20 = Point(flatten(merge_4))

# ---- group: shrinkage scaling
scale = Scale(Geometry=pt_20, Center=Point(0, 0, 0), Factor=shrinkage.scale_value)  # -> Geometry, Transform

scale_2 = Scale(Geometry=merge_2, Center=Point(0, 0, 0), Factor=shrinkage.scale_value)  # -> Geometry, Transform

# ---- group: START/STOP--> CODE / Restructure
extrusion_startstop_rate = Slider(150, range=-100..250)
feed_rate_in_mm_s_4 = Slider(50, range=0..100)
python_18 = GhPythonScript(
    feed_rate=nozzlesettings_3.feed_rate,
    extrusion_retraction=nozzlesettings_4.start_stop_retraction,
    extra_add=nozzlesettings_4.start_reextrusion_rate,
    pts=scale_2.Geometry)  # -> out, a; inputs pts: list of Point3d
# ---------- python_18: Python ----------
f_rate = feed_rate * 60.0

for pt_i, pt in enumerate(pts):
    
    if pt_i == 0:
        
        e_rate = - extrusion_retraction
    
    elif pt_i == len(pts) - 1:
        
        e_rate = extrusion_retraction + extra_add
        
    else:
        
        e_rate = 0.0
    
    print("G1 F{} X{} Y{} Z{} E{}".format(f_rate, pt.X, pt.Y, pt.Z, e_rate))
# ---------- end python_18 ----------

# ----
pt_21 = Point(flatten(pt_12))

# ---- group: shrinkage scaling
scale_3 = Scale(Geometry=pt_21, Center=Point(0, 0, 0), Factor=shrinkage.scale_value)  # -> Geometry, Transform

scale_4 = Scale(Geometry=merge_3, Center=Point(0, 0, 0), Factor=shrinkage.scale_value)  # -> Geometry, Transform

# ---- group: START/STOP--> CODE (continued)
starline = GhPythonScript(
    feed_rate=nozzlesettings_3.feed_rate,
    extrusion_retraction=nozzlesettings_4.start_stop_retraction,
    extra_add=nozzlesettings_4.start_reextrusion_rate,
    start_pts=scale_4.Geometry)  # -> flatten(out), a; inputs start_pts: list of Point3d
# ---------- starline: Python ----------
f_rate = feed_rate * 60.0

for i, pt in enumerate(start_pts):
    
    if i == 0:
        
        e_rate = 1

        print("G1 F{} X{} Y{} Z{} E{}".format(f_rate, pt.X, pt.Y, pt.Z, e_rate))
    
    elif i == 1:
   
        e_rate = extrusion_retraction + extra_add

        print("G1 F{} X{} Y{} Z{} E{}".format(f_rate, pt.X, pt.Y, pt.Z, e_rate))
# ---------- end starline ----------

# ---- group: G-Code
start_stop_feedrate_in_mm_min = Slider(100, range=0..1000)
number_slider_16 = Slider(0, range=0..10)
number_slider_17 = Slider(0, range=0..10)
number_slider_18 = Slider(4.4, range=0..10)
number_slider_19 = Slider(0, range=0..10)
number_slider_20 = Slider(300, range=0..1000)
list_6 = ValueList({"start / stop": "start_stop", "continious"}, selected="continious")
gcodelines = GhPythonScript(
    x=library_path_5,
    pts=scale.Geometry,
    feed_rate=nozzlesettings_3.feed_rate,
    extrusion_rate=nozzlesettings_4.extrusion_rate,
    link_type=list_6,
    global_trim_distance=number_slider_16,
    ss_trim_distance=number_slider_17,
    cull_distance=number_slider_19,
    lift_val=number_slider_18,
    ss_f_rate=start_stop_feedrate_in_mm_min,
    ss_e_rate=number_slider_20,
    variable_feed_rate=nozzlesettings_3.variable_feed_rate,
    peak_feed_rate=nozzlesettings_3.feed_rate_max,
    start_min=nozzlesettings_3.feed_rate_max_start_start_ramp,
    start_max=nozzlesettings_3.feed_rate_max_end_start_ramp,
    end_max=nozzlesettings_3.feed_rate_max_start_end_ramp,
    end_min=nozzlesettings_3.feed_rate_max_end_end_ramp)  # -> out, a, path_vis; inputs pts: list, variable_feed_rate: Boolean
# ---------- gcodelines: Python ----------
import sys

sys.path.append(x)

import Rhino.Geometry as rg
import simpleStartStop as ss

reload(ss)

# print(pts)

p_set = ss.PrintSettings(
    feed_rate = feed_rate, 
    extrusion_rate = extrusion_rate, 
    extrusion_mode = 'relative', 
    movement_mode = 'relative'
)

if variable_feed_rate:
    
    p_set.setComplexFeedrate(
        peak_feed_rate,
        min_h_ramp = (start_min, start_max),
        max_h_ramp = (end_max, end_min)
    )

l_type = ss.LinkType(
    link_type = link_type,
    global_trim_distance = global_trim_distance,
    ss_trim_distance = ss_trim_distance,
    cull_distance = cull_distance,
    lift_val = lift_val
)

l_type.ss_f_rate = ss_f_rate
l_type.ss_e_rate = ss_e_rate

gcodeset = ss.GCodeSet(pts, p_set, l_type)
a = gcodeset.generateGCode()

path_vis = gcodeset.path_vis
# ---------- end gcodelines ----------

# ---- group: 2nd PIN + safety position
gcodelines_2 = GhPythonScript(
    x=library_path_5,
    pts=scale_3.Geometry,
    feed_rate=nozzlesettings_3.feed_rate,
    extrusion_rate=nozzlesettings_4.extrusion_rate,
    link_type=list_6,
    global_trim_distance=number_slider_16,
    ss_trim_distance=number_slider_17,
    cull_distance=number_slider_19,
    lift_val=number_slider_18,
    ss_f_rate=start_stop_feedrate_in_mm_min,
    ss_e_rate=number_slider_20)  # -> out, a, path_vis; inputs pts: list
# ---------- gcodelines_2: Python ----------
import sys

sys.path.append(x)

import Rhino.Geometry as rg
import simpleStartStop as ss

reload(ss)

# print(pts)

p_set = ss.PrintSettings(
    feed_rate = feed_rate, 
    extrusion_rate = extrusion_rate, 
    extrusion_mode = 'relative', 
    movement_mode = 'relative'
)

l_type = ss.LinkType(
    link_type = link_type,
    global_trim_distance = global_trim_distance,
    ss_trim_distance = ss_trim_distance,
    cull_distance = cull_distance,
    lift_val = lift_val
)

l_type.ss_f_rate = ss_f_rate
l_type.ss_e_rate = ss_e_rate

gcodeset = ss.GCodeSet(pts, p_set, l_type)
a = gcodeset.generateGCode()

path_vis = gcodeset.path_vis
# ---------- end gcodelines_2 ----------

# ---- group: G-Code / LenghtPath Body + 1st PIN - check
pline_2 = PolyLine(Vertices=gcodelines.path_vis, Closed=False)

# ----
pt_22 = Point(gcodelines.path_vis)
pt_23 = Point(gcodelines_2.path_vis)
lenghtpath_2nd_pin_check = PolyLine(Vertices=gcodelines_2.path_vis, Closed=False)

# ---- group: Visualization lines
merge_5 = Merge(
    Data1=flatten(merge_3),
    Data2=flatten(gcodelines.path_vis),
    Data3=flatten(merge_2),
    Data4=flatten(gcodelines_2.path_vis),
    Data5=flatten(pt_19))
pline_3 = PolyLine(Vertices=merge_5, Closed=False)

# ----
merge_gcode_lines = Merge(
    Data1=flatten(starline.out),
    Data2=flatten(gcodelines.a),
    Data3=flatten(python_18.out),
    Data4=flatten(gcodelines_2.a),
    Data5=flatten(python_17.out))
panel_15 = Panel(gcodelines.out)
len = Length(Curve=lenghtpath_2nd_pin_check)
len_2 = Length(Curve=pline_2)
python_19 = GhPythonScript(pts=pt_22, h=addition, spacing=num_2)  # -> out, msh; inputs pts: list of Point3d, is_closed: Boolean
# ---------- python_19: Python ----------
import Rhino.Geometry as rg
from math import ceil

h_delta = spacing

msh = rg.Mesh()

for i in range(2):
    z = i * h_delta
    for p in pts:
        msh.Vertices.Add(p.X, p.Y, p.Z + z)

x_cnt = len(pts)
y_cnt = 2

for i in range(y_cnt - 1):
    base_a = i * x_cnt
    base_b = (i + 1) * x_cnt
    for j in range(x_cnt - 1):
        a = base_a + j
        b = base_a + j + 1
        c = base_b + j + 1
        d = base_b + j
        
        msh.Faces.AddFace(a, b, c, d)
    
    if is_closed:
        a = base_a + j + 1
        b = base_a
        c = base_b
        d = base_b + j + 1
        
        msh.Faces.AddFace(a, b, c, d)
# ---------- end python_19 ----------
python_20 = GhPythonScript(pts=pt_23, h=addition, spacing=num_2)  # -> out, msh; inputs pts: list of Point3d, is_closed: Boolean; same code as python_19
len_3 = Length(Curve=pline_3)
addition_4 = Addition(A=len_2, B=len)
python_21 = GhPythonScript(x=len_3)  # -> out, a
# ---------- python_21: Python ----------
import scriptcontext as sc

key_list = sc.sticky["PrintSettings"]["path_length"] = x
# ---------- end python_21 ----------
mesh_4 = Mesh(python_19.msh)
mesh_5 = Mesh(python_20.msh)
panel_16 = Panel(python_21.out)

# ---- group: G-Code (continued)
end_start_gcode = GhPythonScript(x=library_path_5, add_header=Toggle(True), lines=flatten(merge_gcode_lines), gcodeFiles=value_list)  # -> out, a; inputs add_header: Boolean, lines: list
# ---------- end_start_gcode: Python ----------
import os
import scriptcontext as sc

# creating the header of the gcode file

if add_header:
    key_list = sc.sticky["PrintSettings"].keys()
    key_list.sort()

    for key_item in key_list:
    
        print(";{} : {}".format(key_item, str(sc.sticky["PrintSettings"][key_item])) )

start_gcode_path = os.path.join(x, "GCodeDefinitions", "startGcode" + gcodeFiles + ".txt")
end_gcode_path = os.path.join(x, "GCodeDefinitions", "endGcode" + gcodeFiles + ".txt")

start_gcode = open(start_gcode_path, 'r').read()
end_gcode = open(end_gcode_path, 'r').read()

print start_gcode

for line in lines:

    print(line)

print end_gcode
# ---------- end end_start_gcode ----------

# ----
mesh_pipe_flat_2 = CSharpScript(pts=merge_5, r=multiplication_2, d=number_slider_14, max_angle=number_slider_13)  # -> out, A, B, C; inputs pts: list of Point3d, r: Double, d: Int32, max_angle: Double
# ---------- mesh_pipe_flat_2: C# ----------
    List<Vector3d> tangents = new List<Vector3d>();
    List<double> angles = new List<double>();
    List<Point3d> cleanedPts = new List<Point3d>();

    cleanedPts.Add(pts[0]);
    // constructing all the tangent vectors
    for (int i = 1; i < pts.Count; i++) {
      Point3d p0 = cleanedPts[cleanedPts.Count - 1];
      Point3d p1 = pts[i];

      if (p0.DistanceTo(p1) > .0001) cleanedPts.Add(p1);
    }

    // constructing all the tangent vectors
    for (int i = 1; i < cleanedPts.Count; i++) {
      Point3d p0 = cleanedPts[i - 1];
      Point3d p1 = cleanedPts[i];

      tangents.Add(p1 - p0);
    }

    tangents.Add(tangents[tangents.Count - 1]);

    // getting the first normal & binormal
    Vector3d t = tangents[0];
    Vector3d n;
    if (Math.Abs(t.Y) > Math.Abs(t.X)) {
      if (Math.Abs(t.Z) > Math.Abs(t.Y)) {
        n = new Vector3d(0, t.Z, -t.Y);
      } else if (Math.Abs(t.Z) >= Math.Abs(t.X)) {
        n = new Vector3d(0, -t.Z, t.Y);
      } else {
        n = new Vector3d(t.Y, -t.Y, 0);
      }
    } else if (Math.Abs(t.Z) > Math.Abs(t.X)) {
      n = new Vector3d(t.Z, 0, -t.X);
    } else if (Math.Abs(t.Z) > Math.Abs(t.Y)) {
      n = new Vector3d(-t.Z, 0, t.X);
    } else {
      n = new Vector3d(-t.Y, t.X, 0.0);
    }
    Vector3d bn = Vector3d.CrossProduct(t, n);

    n.Unitize();
    bn.Unitize();

    // populating the end and start frames of every plane
    List<Plane> frames = new List<Plane>();

    for (int i = 1; i < cleanedPts.Count; i++) {
      Point3d p0 = cleanedPts[i - 1];
      Point3d p1 = cleanedPts[i];

      frames.Add(new Plane(p0, n, bn));
      frames.Add(new Plane(p1, n, bn));

        if (i < pts.Count - 1) {
            t = tangents[i];
            n = Vector3d.CrossProduct(bn, t);
            bn = Vector3d.CrossProduct(t, n);

            n.Unitize();
            bn.Unitize();
        }
    }

    // when the angle between previous end and next start plane is larger than max angle
    // add interpolation planes (rounded ends)
    List<Plane> interpolatedFrames = new List<Plane>();
    interpolatedFrames.Add(frames[0]);
    for (int i = 1; i < frames.Count - 2; i += 2) {
        Plane pln0 = frames[i];
        Plane pln1 = frames[i+1];

        double angle = Vector3d.VectorAngle(pln0.Normal, pln1.Normal);

        angles.Add(angle);

        Plane intPln = new Plane(pln0.Origin, pln0.XAxis + pln1.XAxis, pln0.YAxis + pln1.YAxis);

        interpolatedFrames.Add(intPln);
    }

    interpolatedFrames.Add(frames[frames.Count - 1]);

    // constructing the uv parameters
    List<Vector2d> uvParameters = new List<Vector2d>();
    for (int i = 0; i < d; i++) {
      double angle = i * (Math.PI * 2.0) / d;
      uvParameters.Add(new Vector2d(r * Math.Cos(angle), r * Math.Sin(angle)));
    }

    // constructing the mesh
    Mesh pipeMesh = new Mesh();
    foreach (Plane f in interpolatedFrames) {
      foreach (Vector2d v in uvParameters) {
        pipeMesh.Vertices.Add(f.Origin + f.XAxis * v.X + f.YAxis * v.Y);
      }
    }

    for (int i = 1 ; i < interpolatedFrames.Count ; i++) {
        int idxA = (i - 1) * uvParameters.Count;
        int idxB = i * uvParameters.Count;
      for (int j = 1; j < uvParameters.Count; j++) {
          int iA = idxA + j - 1;
          int iB = idxB + j - 1;
          int iC = idxB + j;
          int iD = idxA + j;

        pipeMesh.Faces.AddFace(iA, iB, iC, iD);
      }

        int iAEnd = idxA + uvParameters.Count - 1;
      int iBEnd = idxB + uvParameters.Count - 1;
      int iCEnd = idxB;
      int iDEnd = idxA;

        pipeMesh.Faces.AddFace(iAEnd, iBEnd, iCEnd, iDEnd);
    }

    int[] duplicateFaces = pipeMesh.Faces.GetDuplicateFaces();
    for (int i = 1; i < duplicateFaces.Length + 1; i ++) {
        pipeMesh.Faces.RemoveAt(duplicateFaces[duplicateFaces.Length - i]);
     }


    pipeMesh.FaceNormals.ComputeFaceNormals();

    A = pipeMesh;
    B = duplicateFaces;
# ---------- end mesh_pipe_flat_2 ----------
mjoin = MeshJoin(Meshes=[mesh_4, mesh_5])
preview_2 = CustomPreview(Geometry=mesh_pipe_flat_2.A, Material=col_2)
mesh_6 = Mesh(mesh_pipe_flat_2.A)
demesh_2 = DeconstructMesh(Mesh=mesh_6)  # -> Vertices, Faces, Colours, Normals
cp = PlaneClosestPoint(Point=demesh_2.Normals, Plane=pl)  # -> Point, UVPoint, expr(".5 + x * .5", Distance)
python_22 = GhPythonScript(
    y=savefile,
    x=library_path_5,
    extra_name=Toggle(True),
    extra_txt="layerHeight2.3_60x35x50_E_eRate*3",
    data=flatten(end_start_gcode.out),
    extra_tag=value_list)  # -> out, a; inputs data: list
# ---------- python_22: Python ----------
import os
import scriptcontext as sc
import math
import time
import scriptcontext as sc

import sys
sys.path.append(x)

import simpleStartStop as ss

reload(ss)

try:
    
    run_timing = time.time() - sc.sticky["start_time"]
    
    if run_timing > 2.0:
    
        sc.sticky["start_time"] = time.time()
        
        run = True
        
    else:
        
        run = False
    
except:
    
    sc.sticky["start_time"] = time.time()
    
    run = True

if y and run:
    
    count_file = None
    
    try:
        count_file = os.path.join(x, "GCodeDefinitions", "countSheet.json")
    except:
        print("count file not found, it's fine")
    
    nozzle_dia = round(sc.sticky["PrintSettings"]["print_extrusion_nozzle"], 1)
    
    if not(count_file == None):
        str = ss.file_count(nozzle_dia, count_file)

    date = time.strftime("%Y%m%d")

    if extra_name:
    
        file_name = "{}_{}_{}.gcode".format(str, date, extra_txt)
    
    else:
    
        file_name = "{}_{}{}.gcode".format(str, date, extra_tag)

    save_file = os.path.join(os.path.dirname(x), "GCode", file_name)

    print save_file

    data = '\n'.join(data)

    open(save_file, "a").write(data)
# ---------- end python_22 ----------
multiplication_4 = Multiplication(A=cp.Distance, B=col_2)
mcol = MeshColours(Mesh=mesh_6, Colours=multiplication_4)
panel_17 = Panel(python_22.out)
