# Grasshopper definition clean_up.gh (Grasshopper 1.0.7)

# ---- group: Brick Geometry
brick_geometry_dict = GhPythonScript(
    height_body=Slider(30, range=0..1000),
    height_pin=Slider(370.1, range=0..1000),
    start_height=Slider(1.4, range=0..10),
    brick_length=Slider(372.8, range=100..450),
    brick_width=Slider(250, range=40..250),
    pin_spacing=Slider(250, range=40..250))  # -> out, brick_geometry_dict
# ---------- brick_geometry_dict: Python ----------
brick_geometry_dict={
    "height_body":height_body,
    "height_pin" :height_pin,
    "start_height":start_height,
    "brick_length":brick_length,
    "brick_width":brick_width,
    "pin_spacing":pin_spacing
}

brick_geometry_dict=[brick_geometry_dict]
# ---------- end brick_geometry_dict ----------

# ----
number_slider = Slider(2.5, range=0..10)
python = GhPythonScript()  # -> out, path
# ---------- python: Python ----------
import os

print(os.name)
os_name = str(os.name)

ghComp = ghenv.Component
ghDoc = ghComp.OnPingDocument()

path = str(ghDoc.FilePath)

second_part = [
    "Dropbox",
    "Clay_Printing_Brick",
    "PatternBrickLibrary"
]

if "posix" == os_name:
    
    print("I am a Mac")
    
    first_part = ['/Users']
    
    string_parts = path.split("/Users/")[1]
    user_name = string_parts.split('/')[0]
    print(string_parts)
    print(user_name)

elif "nt" == os_name:

    print("I am a Pc")
    
    first_part = ['C:\\Users']
    
    string_parts = path.split("\\Users\\")[1]
    user_name = string_parts.split('\\')[0]
    print(string_parts)
    print(user_name)

parts = first_part + [user_name] + second_part

path = os.path.join(*parts)
# ---------- end python ----------
defaultmap = FilePath(python.path)
path = FilePath()
python_2 = GhPythonScript(default_dropbox_path=defaultmap, costum_path=path)  # -> out, clean_code_path, path
# ---------- python_2: Python ----------
import sys
import Rhino.Geometry as rg

import os
import Grasshopper

path=os.path.dirname(Grasshopper.Instances.ActiveCanvas.Document.FilePath)
base_path=os.path.dirname(path)
path=os.path.join(base_path, "PatternBrickLibrary")
clean_code_path=os.path.join(base_path, "clean_code")
sys.path.append(path)
# ---------- end python_2 ----------
brick_geo_gen = GhPythonScript(geometry_dict=brick_geometry_dict.brick_geometry_dict)  # -> out, flatten(body_heights), flatten(pin_only_heights), flatten(poly_crv), flatten(pin_pts)
# ---------- brick_geo_gen: Python ----------
import sys
import Rhino.Geometry as rg

import os
import Grasshopper

path=os.path.dirname(Grasshopper.Instances.ActiveCanvas.Document.FilePath)
path=os.path.dirname(path)
path=os.path.join(path, "clean_code")
sys.path.append(path)

import gen_base_geometry as gbg
reload(gbg)

geo_obj=gbg.StandardObject(geometry_dict, production_dict)
print(geo_obj)

body_heights=geo_obj.body_heights()
pin_only_heights=geo_obj.pin_heights()
poly_crv=geo_obj.base_profile()
pin_pts=geo_obj.pin_points()
# ---------- end brick_geo_gen ----------
given_shell = Curve(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)
line = Line(Line((518.2783603, 30.70007247, 0), (-420.4290869, -5.036452568, 0)))
library_path = FilePath(python_2.path)
given_points = Point([Point(-105, 0, 0), Point(105, 0, 0)])
crv = Curve(line)
flip = FlipCurve(Curve=brick_geo_gen.poly_crv)  # -> Curve, Flag
lng = ListLength(List=brick_geo_gen.body_heights)
lng_2 = ListLength(List=brick_geo_gen.pin_only_heights)
addition = Addition(A=lng, B=lng_2)
layer_slicing = GhPythonScript(x=library_path, geometry=given_shell, heights=brick_geo_gen.body_heights)  # -> out, ori_crvs, crv_sets, a, b, c, d; inputs geometry: GeometryBase, heights: list
# ---------- layer_slicing: Python ----------
import sys

sys.path.append(x)

import brickSlicer as bs

reload(bs)

ori_crvs = bs.slicing(geometry, heights)
# crv_sets, a, b, c = bs.splitter(ori_crvs, slicing_object = slice_geo, split_type = "first_layer")
# ---------- end layer_slicing ----------
splitting_geometry = Geometry(crv)
total_layer_count = Panel(addition)
body_layer_count = Panel(lng)
pin_layer_count = Panel(lng_2)
clean_code_path = FilePath(python_2.clean_code_path)
crv_2 = Curve(layer_slicing.ori_crvs)
pt = ConstructPoint(XCoordinate=Slider(12, range=0..100), YCoordinate=Slider(12, range=0..100), ZCoordinate=0)
pt_2 = ConstructPoint(XCoordinate=Slider(12, range=0..100), YCoordinate=Slider(12, range=0..100), ZCoordinate=0)
library_path_2 = FilePath(library_path)

# ---- group: — Slicing for pattern —
num = Number(100)
slicing_structuring = GhPythonScript(
    x=library_path_2,
    ori_crvs=layer_slicing.ori_crvs,
    spacing=Slider(10, range=0..10),
    end_smooth=Toggle(False),
    custom_crv_length=Toggle(False),
    crv_l=num,
    split=Toggle(True),
    slice_geo=line,
    split_item=Slider(0, range=0..1))  # -> out, split, layers, set_tuple, crv_sets, ori_crvs, slice_geo; inputs ori_crvs: list, end_smooth: Boolean, custom_crv_length: Boolean, split: Boolean, split_item: Int32
# ---------- slicing_structuring: Python ----------
# snippet of code to make this python component look for it's   code in the parent folder of the .gh file

import sys

sys.path.append(x)

import vertexClass_v1 as vc
import brickSlicer as bs

reload(bs)
reload(vc)

print(type(slice_geo))

    
if custom_crv_length:
    
    crv_l = crv_l
    
else:
    
    crv_l = None


if split:

    crv_sets, vis_a, vis_b, pts_crv_a_and_b = bs.splitter(ori_crvs, slicing_object = slice_geo, split_type = "first_layer")
    
    crv_set_a = [crv_set[0] for crv_set in crv_sets]
    crv_set_b = [crv_set[1] for crv_set in crv_sets]
    
    crv_sets = [crv_set_a, crv_set_b]
    
    non_pattern_part = [vc.divideCurveByLength(crv, spacing) for crv in crv_sets[(split_item + 1) % 2]]
    
    pattern_part, set_tuple, _ = vc.moveSet(crv_sets[split_item], ori_crvs, spacing, crv_l)
    layers = [pattern_part, non_pattern_part]
    
    
else:

    layers, set_tuple = vc.singleCurve(ori_crvs, spacing, end_smooth, crv_l)
# ---------- end slicing_structuring ----------

# ----
python_3 = GhPythonScript()  # -> out, a
# ---------- python_3: Python ----------
a = [[2, 1, 1], [1, 2, 3], [0, 1, 2]]
# ---------- end python_3 ----------
pt_3 = Point(pt)
rad = Radians(Degrees=Slider(360, range=0..1000))
pt_4 = Point(pt_2)

# ---- group: cylinder
number_slider_2 = Slider(5, range=0..10)
number_slider_3 = Slider(10, range=0..100)

# ---- group: mod Based Dot Map
number_slider_4 = Slider(3, range=1..10)
number_slider_5 = Slider(9.69, range=5..100)
toggle = BooleanToggle(True)
number_slider_6 = Slider(1.5708, range=0..3.1416)
number_slider_7 = Slider(-0.2, range=-2..2)
number_slider_8 = Slider(1.4, range=0..2)

# ----
dotmap = GhPythonScript(
    lib_path=clean_code_path,
    x_spacing=Slider(15, range=0..100),
    y_spacing=Slider(15, range=0..100),
    half_spacing=Toggle(False),
    b_pt=pt_3,
    direction=Toggle(False))  # -> out, dot_map; inputs half_spacing: Boolean, b_pt: Point3d, direction: Boolean
# ---------- dotmap: Python ----------
import sys

sys.path.append(lib_path)

print(sys.path)

import patterns as pt
reload(pt)

dot_map = pt.DotMap(
    x_spacing = y_spacing,
    y_spacing = y_spacing,
    half_spacing = False,
    b_pt = b_pt,
    in_out_class = None,
    direction = direction
)
# ---------- end dotmap ----------
sinwave = GhPythonScript(lib_path=clean_code_path, period=Slider(15, range=0..100), amplitude=Slider(15, range=0..100), dir_angle=rad, b_pt=pt_4)  # -> out, a; inputs b_pt: Point3d
# ---------- sinwave: Python ----------
import sys

sys.path.append(lib_path)

print(sys.path)

import patterns as pt
reload(pt)

pt.SinWave(
    period, 
    amplitude, 
    dir_angle,
    b_pt
)
# ---------- end sinwave ----------
pyramidpattern = GhPythonScript(
    lib_path=clean_code_path,
    radius=Slider(15, range=0..100),
    amplitude=Slider(15, range=0..100),
    y_scale=Slider(1, range=0.01..10),
    dot_map=dotmap.dot_map)  # -> out, a
# ---------- pyramidpattern: Python ----------
import sys

sys.path.append(lib_path)

print(sys.path)

import patterns as pt
reload(pt)

pt.PyramidPattern(
    radius,
    amplitude,
    y_scale,
    dot_map
)
# ---------- end pyramidpattern ----------
ellipsoidpattern = GhPythonScript(
    lib_path=clean_code_path,
    radius=Slider(15, range=0..100),
    amplitude=Slider(15, range=0..100),
    y_scale=Slider(1, range=0.01..10),
    dot_map=dotmap.dot_map)  # -> out, a
# ---------- ellipsoidpattern: Python ----------
import sys

sys.path.append(lib_path)

print(sys.path)

import patterns as pt
reload(pt)

pt.EllipsoidPattern(
    radius,
    amplitude,
    y_scale,
    dot_map
)
# ---------- end ellipsoidpattern ----------
list = ValueList({"dotMap": 0, "ellipsoidBumpMap": 1, "sinWarp": 2, "cylinderMap": 3, "layerMap": 4, "modulorBased": 5}, selected="dotMap")
panel = Panel(ellipsoidpattern.out)
pattern = GhPythonScript(
    x=library_path_2,
    split=slicing_structuring.split,
    layers=slicing_structuring.layers,
    set_tuple=slicing_structuring.set_tuple,
    periodic=Toggle(True),
    sub_length=Slider(2, range=0..10),
    layer_count=Slider(70, range=0..100),
    layer_height=Slider(2.3, range=0..10),
    edge_easing=Toggle(True),
    edge_ease_zero=Slider(0, range=0..100),
    edge_ease_end=Slider(10, range=0..100),
    pattern_type=list,
    period=Slider(2, range=0..100),
    phase_shift=Slider(0.5, range=0..2),
    spacing=Slider(20, range=10..100),
    radius=Slider(9, range=0..100),
    max_val=Slider(4, range=0..100),
    y_spacing=number_slider_5,
    layer_shift=number_slider_4,
    shift_a=number_slider_8,
    shift_b=number_slider_7,
    ellipsoid=toggle,
    rot_alfa=number_slider_6,
    height=number_slider_3,
    radius_bot=number_slider_2,
    pattern_set=python_3.a,
    direction=Toggle(False))  # -> out, curve_list, pt_sets, curve_set, c; inputs split: Boolean, layers: list, set_tuple: list, periodic: Boolean, layer_count: Int32, layer_height: Int32, edge_easing: Boolean, pattern_type: Int32, ellipsoid: Boolean, pattern_set: list, direction: Boolean
# ---------- pattern: Python ----------
import sys

sys.path.append(x)

print(sys.path)

import patternGenv2_2_1 as pm

reload(pm)

if split:
    
    other_part = layers[1]
    pattern_part = layers[0]
    periodic = False
    
else:
    
    other_part = None
    pattern_part = layers
    edge_easing = False

pattern_map = pm.PatternMap(pattern_part, set_tuple, periodic, other_set = other_part)
pattern_map.build()
# pattern_map.subdivide(sub_length)
# pattern_map.generate(layer_height, layer_count)

print("I am out 3")

if edge_easing:

    pattern_map.edgeEasing(edge_ease_zero, edge_ease_end)

if pattern_type == 0:
    
    pattern_map.dotMap(spacing, radius, max_val, direction)

elif pattern_type == 1:

    pattern_map.ellipsoidBumpMap(spacing, radius, max_val, direction)

elif pattern_type == 2:

    pattern_map.sinWarp(period, max_val, phase_shift, direction)

elif pattern_type == 3:

    if radius_bot < .01:

        radius_bot = radius

    else:

        radius_bot = radius_bot

    pattern_map.cylinderMap(spacing, height, radius, max_val, radius_bot, direction)

elif pattern_type == 4:

    pattern_map.layerMap(spacing, pattern_set, radius, max_val, direction)
    
elif pattern_type == 5:
    
    print("I am out 4")
    
    pattern_map.modBasedDotMap(
        x_spacing = spacing,
        y_spacing = y_spacing,
        max_val = max_val,
        ellipsoid = ellipsoid,
        direction = direction,
        layer_shift = layer_shift,
        shift_a = shift_a,
        shift_b = shift_b,
        rot_alfa = rot_alfa
    )

print("I am out 5")

c = pattern_map.makeMesh()
curve_set = pattern_map.makeCurves()

pt_sets = pattern_map.pts_set
# ---------- end pattern ----------
line_linking_spacing = Slider(2.7, range=0..10)
inter_line_spacing = Slider(2, range=0..10)
split_distance = Slider(2, range=-10..10)
panel_2 = Panel(pattern.out)
line_2 = Line(Line((-27.46198946, 138.4851678, 0), (-0.1413537679, -0.6893088134, 0)))
loft = Loft(
    Curves=pattern.curve_set,
    Options={Adjust=False, Closed=False, LoftEnds=0, LoftSimp=0, LoftType=0, Rebuild=10, Refit=0.01})  # disabled
crv_3 = Curve(pattern.curve_set)
mesh = Mesh(pattern.c)

# ---- group: — Shell Setup —
list_2 = ValueList({"detached", "crossing"}, selected="detached")
list_3 = ValueList({"Inside": "inside", "Outside": "outside"}, selected="Outside")
python_4 = GhPythonScript(
    x=library_path_2,
    crvs=pattern.curve_set,
    distance=inter_line_spacing,
    direction=list_3,
    count=Slider(1, range=0..10),
    split_distance=split_distance,
    split_type=list_2,
    split_line=line_2,
    side_bool=Toggle(True))  # -> out, a, b, link_inner_crvs, main_inner_crvs, outer_crvs, pt_sets; inputs crvs: list of Curve, count: Int32, side_bool: Boolean
# ---------- python_4: Python ----------
import sys
import Rhino.Geometry as rg
import time

sys.path.append(x)

# print(sys.path)

import generalFunctions as gf
import layerFunctions as lf

reload(gf)
reload(lf)

start_time = time.time()

o_crv_sets = []
outer_crvs = []

print("start of the program:")
print(time.time() - start_time)

if count > 1:

    for crv_i, crv in enumerate(crvs):
        
        print(crv_i)
    
        o_crv_set = gf.offsetCurveSet(crv, distance, direction, count)
        layer_set = lf.LinkingLayers(o_crv_set, split_distance, side_bool, split_type, split_line)
        layer_set.createOrganisedCurves()
        pt_set = layer_set.joinCrvs()
    
        pt_set = pt_set[1:-1] + [pt_set[1]]
    
        crv = rg.Polyline(pt_set).ToPolylineCurve()
    
        o_crv_sets.append(o_crv_set)
        outer_crvs.append(crv)
        
else:
    
    outer_crvs = crvs

print("after curve set generation:")
print(time.time() - start_time)

o_type = rg.CurveOffsetCornerStyle.Sharp

main_inner_crvs = []
link_inner_crvs = []

if count == 1:
    
    for crv in crvs:
        
        print(crv)
    
        main_inner_crv = crv
        
        pln = rg.Plane(main_inner_crv.PointAt(0.0), rg.Vector3d(0,0,1))
        
        link_inner_crv = main_inner_crv.Offset(pln, -distance, .01, o_type)[0]
        
        main_inner_crvs.append(main_inner_crv)
        link_inner_crvs.append(link_inner_crv)

elif direction == "outside":
    
    for o_crv_set in o_crv_sets:
    
        main_inner_crv = rg.Polyline(o_crv_set[0]).ToPolylineCurve()
        
        pln = rg.Plane(main_inner_crv.PointAt(0.0), rg.Vector3d(0,0,1))
        
        link_inner_crv = main_inner_crv.Offset(pln, -distance, .01, o_type)[0]
        
        main_inner_crvs.append(main_inner_crv)
        link_inner_crvs.append(link_inner_crv)
    
else:
    
    for o_crv_set in o_crv_sets:
    
        main_inner_crv = rg.Polyline(o_crv_set[0]).ToPolylineCurve()
        
        pln = rg.Plane(main_inner_crv.PointAt(0.0), rg.Vector3d(0,0,1))
        
        link_inner_crv = main_inner_crv.Offset(pln, -distance, .01, o_type)[0]
        
        main_inner_crvs.append(main_inner_crv)
        link_inner_crvs.append(link_inner_crv)
    
print("program end:")
print(time.time() - start_time)
# ---------- end python_4 ----------

# ----
pt_5 = Point(given_points)
pin_only_heights = Number(brick_geo_gen.pin_only_heights)
split = SplitList(List=pt_5, Index=Slider(4, range=0..10))  # -> ListA, ListB
library_path_3 = FilePath(library_path_2)

# ---- group: — PIN Setup —
number_slider_9 = Slider(3, range=0..10)
number_slider_10 = Slider(3, range=0..10)
python_5 = GhPythonScript(
    x=library_path_3,
    pin_pts=flatten(pt_5),
    connection_count=Slider(3, range=1..4),
    max_main_line=Slider(100, range=25..250),
    start_end_alfa=Slider(1.571, range=0..3.142),
    mid_alfa=Slider(0.5, range=0..3.142),
    pin_height=Slider(260, range=0..1000),
    bot_rad=Slider(35, range=0..100),
    top_rad=Slider(18, range=0..100),
    resolution=Slider(16, range=0..100),
    spacing=line_linking_spacing)  # -> out, main_links, side_links, split_lines, pin_pt_sets, pins, mid_links, link_line_vis, pin_geo, extra_pts; inputs pin_pts: list of Point3d, connection_count: Int32, resolution: Int32
# ---------- python_5: Python ----------
import sys

sys.path.append(x)

import pinLinkingBis as pl

reload(pl)

main_links, link_lines, split_lines, pin_pt_sets, mid_links, b_mid_pts = pl.createLinks(
    pin_pts = pin_pts,
    connection_count = connection_count,
    max_main_line = max_main_line,
    start_end_alfa = start_end_alfa,
    mid_alfa = mid_alfa
)

link_line_vis = link_lines

main_links = pl.linkSetGeneration(main_links, spacing)
side_links = pl.linkSetGeneration(link_lines, spacing, 2)
mid_links = pl.linkSetGeneration(mid_links, spacing, 2)

extra_pts = []

for i, b_pt_set in enumerate(b_mid_pts):
    
    extra_pts.extend(pl.linkClosestPoints(main_links[i], b_pt_set))

pins = pl.pinMaker(pin_pts, pin_height, bot_rad, top_rad, resolution)

pin_geo = []

for pin in pins:
    
    pin_geo.append(pin.createGeometry())
# ---------- end python_5 ----------

# ----
pins = Geometry(python_5.pin_geo)
total = Geometry(pins)
panel_3 = Panel(python_4.out)
side_link_curve = Curve(graft(python_4.link_inner_crvs))
end_link_curve = Curve(graft(python_4.main_inner_crvs))
python_6 = GhPythonScript(x=python_5.pin_geo)  # -> out, a
# ---------- python_6: Python ----------
print(x)
# ---------- end python_6 ----------
python_7 = GhPythonScript(side_links=python_5.side_links, end_link_index=Slider(1, range=0..100))  # -> out, flatten(side_links), flatten(end_link), end_link_vis; inputs side_links: list, end_link_index: Int32
# ---------- python_7: Python ----------
import Rhino.Geometry as rg
from copy import deepcopy as dc

side_link_count = len(side_links)

end_link_index = end_link_index % side_link_count

end_link = side_links.pop(end_link_index)

# visualisation of the end link

end_link_vis = dc(end_link.lines)

for end_link_line in end_link_vis:
    
    sc_m = rg.Transform.Scale(end_link_line.From, 100.0)
    
    end_link_line.Transform(sc_m)
# ---------- end python_7 ----------
python_8 = GhPythonScript(x=python_5.pins)  # -> out, a
# ---------- python_8: Python ----------
print(x.bot_r)
print(x.top_r)
print(x.h)
print(x.b_pt.Z)
# ---------- end python_8 ----------
python_9 = GhPythonScript(x=flatten(end_link_curve))  # -> out, flatten(heights), flatten(index); inputs x: list of Curve
# ---------- python_9: Python ----------
heights = []
index = []

for crv_i, crv in enumerate(x):
    
    heights.append(crv.PointAt(0.0).Z)
    index.append(crv_i)
# ---------- end python_9 ----------
python_10 = GhPythonScript(pin=python_5.pins, pin_heights=pin_only_heights)  # -> out, slices; inputs pin_heights: list
# ---------- python_10: Python ----------
slices = []

for h in pin_heights:
    
    slices.append(pin.createSlice(h))
# ---------- end python_10 ----------
panel_4 = Panel(python_5.out)
python_11 = GhPythonScript(
    x=library_path_3,
    main_links=flatten(python_5.main_links),
    pins=flatten(python_5.pins),
    link_set=flatten(python_5.side_links),
    heights=flatten(python_9.heights),
    count=flatten(python_9.index),
    bottom_shift_count=number_slider_9,
    bottom_max_shift=number_slider_10)  # -> out, graft(main_crv), b, c, inner_crvs, main_crv_pt_set, main_links; inputs main_links: list, pins: list, link_set: list
# ---------- python_11: Python ----------
import sys

sys.path.append(x)

import pinLinkingBis as pl

reload(pl)

if count < bottom_shift_count:
    
    print("I am shifting the bottom layer with: ")
    
    count_delta = bottom_max_shift / float(bottom_shift_count)
    
    bottom_offset = count_delta * (bottom_shift_count - count)
    print("bottom offset: %s" % bottom_offset)
    
else:
    
    bottom_offset = None

main_crv, b, main_links, inner_crvs = pl.makeMainShape(pins, main_links, heights, bottom_offset)
# ---------- end python_11 ----------
path_mapper = PathMapper(python_11.main_crv, source="{A;B}", target="{B}")
path_mapper_2 = PathMapper(side_link_curve, source="{A;B;C;D;E}", target="{E}")
path_mapper_3 = PathMapper(end_link_curve, source="{A;B;C;D;E}", target="{E}")
crv_4 = Curve(python_10.slices)
midlinks = GhPythonScript(x=library_path_3, mid_links=flatten(python_5.mid_links), interior_crv=path_mapper, exterior_crv=path_mapper_2)  # -> out, output_mid_links, mid_link_lines; inputs mid_links: list, interior_crv: Curve, exterior_crv: Curve
# ---------- midlinks: Python ----------
import Rhino.Geometry as rg
from copy import deepcopy as dc

import sys

sys.path.append(x)

height_val = interior_crv.PointAt(0.0).Z

mv_m = rg.Transform.Translation(rg.Vector3d(0,0,height_val))

mid_link_lines = []

print(type(exterior_crv))

output_mid_links = []

for mid_link in mid_links:
    
    loc_link = dc(mid_link)
    loc_link.Transform(mv_m)
    
    loc_link.trimLines(exterior_crv, True)
    loc_link.trimLines(interior_crv, False)
    
    output_mid_links.append(loc_link)
    
    mid_link_lines.extend(loc_link.lines)
    
print(mid_link_lines[0].To.Z)
# ---------- end midlinks ----------
python_12 = GhPythonScript(x=library_path_3, side_links=flatten(python_7.side_links), interior_crv=path_mapper, exterior_crv=path_mapper_2)  # -> out, output_side_links, side_link_lines; inputs side_links: list, interior_crv: Curve, exterior_crv: Curve
# ---------- python_12: Python ----------
import Rhino.Geometry as rg
from copy import deepcopy as dc

import sys

sys.path.append(x)

height_val = interior_crv.PointAt(0.0).Z

mv_m = rg.Transform.Translation(rg.Vector3d(0,0,height_val))

side_link_lines = []

print(type(exterior_crv))

output_side_links = []

for side_link in side_links:
    
    loc_link = dc(side_link)
    loc_link.Transform(mv_m)
    
    loc_link.trimLines(exterior_crv, True)
    loc_link.trimLines(interior_crv, False)
    
    output_side_links.append(loc_link)
    
    side_link_lines.extend(loc_link.lines)
    
print(side_link_lines[0].To.Z)
# ---------- end python_12 ----------
python_13 = GhPythonScript(x=library_path_3, end_link=flatten(python_7.end_link), interior_crv=path_mapper, exterior_crv=path_mapper_3)  # -> out, graft(output_end_link), side_link_lines; inputs interior_crv: Curve, exterior_crv: Curve
# ---------- python_13: Python ----------
import Rhino.Geometry as rg
from copy import deepcopy as dc

import sys

sys.path.append(x)

height_val = interior_crv.PointAt(0.0).Z

mv_m = rg.Transform.Translation(rg.Vector3d(0,0,height_val))
    
output_end_link = dc(end_link)
output_end_link.Transform(mv_m)
    
output_end_link.trimLines(exterior_crv, True)
output_end_link.trimLines(interior_crv, False)

side_link_lines = dc(output_end_link.lines)
# ---------- end python_13 ----------
item = ListItem(List=python_11.inner_crvs, Index=0, Wrap=True)
path_mapper_4 = PathMapper(crv_4, source="{A;B;C}", target="{C}")
panel_5 = Panel(python_12.out)
path_mapper_5 = PathMapper(midlinks.output_mid_links, source="{D;E}", target="{D}")
library_path_4 = FilePath(library_path_3)

line_3 = Line(flatten(python_5.split_lines))
crv_5 = Curve(python_11.inner_crvs)
number_slider_11 = Slider(1, range=0..10)
path_mapper_6 = PathMapper(python_11.main_links, source="{C;D}", target="{D}")
path_mapper_7 = PathMapper(python_13.output_end_link, source="{D;E}", target="{D}")
list_4 = ValueList({"detached", "crossing"}, selected="crossing")
list_5 = ValueList({"Inside": "inside", "Outside": "outside"}, selected="Inside")
path_mapper_8 = PathMapper(crv_5, source="{C;D}", target="{D}")
path_mapper_9 = PathMapper(python_12.output_side_links, source="{D;E}", target="{D}")
python_14 = GhPythonScript(
    x=library_path_4,
    extra_pts=flatten(python_5.extra_pts),
    main_links=path_mapper_6,
    side_links=path_mapper_9,
    end_link=path_mapper_7,
    mid_links=path_mapper_5,
    crvs=path_mapper_8,
    split_lines=line_3,
    distance=inter_line_spacing,
    direction=list_5,
    count=number_slider_11,
    split_distance=split_distance,
    split_type=list_4,
    side_bool=Toggle(True),
    diamond_link=Toggle(True),
    safety=Toggle(True),
    main_link_length=Slider(26.1, range=0..100),
    side_length=Slider(62, range=0..100))  # -> out, log, b, c, d, e, pt_sets, start_and_end_pt, main_crv; inputs extra_pts: list of Point3d, main_links: list, side_links: list, mid_links: list, crvs: list of Curve, split_lines: list of Line, count: Int32, side_bool: Boolean
# ---------- python_14: Python ----------
import sys

sys.path.append(x)

# print(sys.path)

import generalFunctions as gf
import layerFunctions as lf
import Rhino.Geometry as rg
import pinLinkingBis as pl

from copy import deepcopy as dc

reload(gf)
reload(lf)
reload(pl)

log = ["new sequence start"]

diamond_settings = (diamond_link, safety, (main_link_length, side_length))

pt_sets = []

inner_crvs = []

height = crvs[0].PointAt(0.0).Z

mv_m = rg.Transform.Translation(rg.Vector3d(0,0, height))

loc_split_lines = dc(split_lines)
[line.Transform(mv_m) for line in loc_split_lines]

print loc_split_lines

crv_count = len(crvs)
print("there are %s curves in your list" % crv_count)

if count == 1:
    
    for crv in crvs:
        
        crv.Reverse()
        
    inner_crvs = crvs
    
else:
    
    for crv_i, crv in enumerate(crvs):
        
        a = gf.offsetCurveSet(crv, distance, direction, count)
        layer_set = lf.LinkingLayers(a, split_distance, side_bool, split_type, split_line = loc_split_lines[crv_i])
        # a = layer_set.split_a
        # b = layer_set.split_b
        # c = layer_set.split_line
        # d = layer_set.split_axis
        a, b, c, d, e = layer_set.createOrganisedCurves()
        
        pt_set = layer_set.joinCrvs()
        pt_set = pt_set[1:-1] + [pt_set[1]]
        
        crv = rg.Polyline(pt_set).ToPolylineCurve()
        
        inner_crvs.append(crv)

print("I passed this hurdle")

loc_extra_pts = []

for extra_pt in extra_pts:
    
    loc_pt = dc(extra_pt)
    loc_pt.Transform(mv_m)
    loc_extra_pts.append(loc_pt)
    
main_crv = pl.makeInnerCurve(inner_crvs, main_links, side_links, end_link, loc_extra_pts, mid_links, diamond_settings = diamond_settings)

print(main_crv)

start_and_end_pt = [main_crv.PointAt(main_crv.Domain[0]), main_crv.PointAt(main_crv.Domain[1])]
# ---------- end python_14 ----------

splitlines = Line(flatten(line_3))
panel_6 = Panel(path_mapper_4)
list_6 = ValueList({"Inside": "inside", "Outside": "outside"}, selected="Inside")
outer_crv = Curve(graft(python_4.outer_crvs))
panel_7 = Panel(python_14.out)
path_mapper_10 = PathMapper(outer_crv, source="{A;B;C;D;E}", target="{E}")
pt_6 = Point(pt_5)
path_mapper_11 = PathMapper(python_14.start_and_end_pt, source="{A;B}", target="{A}")
num_2 = Number(Slider(1, range=0..1))
crv_6 = Curve(python_14.main_crv)
item_2 = ListItem(List=pt_6, Index=0, Wrap=True)  # -> Item, Item1
pdecon = Deconstruct(Point=item_2.Item)  # -> XComponent, YComponent, ZComponent
neg = Negative(Value=num_2)
python_15 = GhPythonScript(x=library_path_4, start_end_pts=path_mapper_11, exterior_crv=path_mapper_10, interior_crv=crv_6)  # -> out, a; inputs start_end_pts: list of Point3d, exterior_crv: Curve, interior_crv: Curve
# ---------- python_15: Python ----------
import sys

sys.path.append(x)

import generalFunctions as gf

result_crvs, _ = gf.layer2ptIntersect(exterior_crv, start_end_pts)
pt_set = list(gf.curveToPolyline(gf.longestCurve(result_crvs)).ToArray())
pt_set_2 = list(gf.curveToPolyline(interior_crv).ToArray())

pt_set_2.reverse()

a = pt_set + pt_set_2[1:-1]
# ---------- end python_15 ----------
pt_7 = Point(python_15.a)
pline = PolyLine(Vertices=pt_7, Closed=False)
offset = OffsetCurve(Curve=pline, Distance=neg, Plane=PlaneXY(0, 0, 0), Corners=1)
offset_2 = OffsetCurve(Curve=pline, Distance=1, Plane=PlaneXY(0, 0, 0), Corners=1)
extraheight = Slider(30, range=0..100)
pdecon_2 = Deconstruct(Point=item_2.Item1)  # -> XComponent, YComponent, ZComponent
pt_8 = Point(flatten(python_15.a))
list_item = ListItem(List=pt_8, Index=0, Wrap=True)

# ---- group: — BRIM —
item_3 = ListItem(List=pattern.curve_set, Index=0, Wrap=True)
brim = GhPythonScript(first_pt=list_item, crv=item_3, offset_amount=Slider(10, range=0..10))  # -> out, flatten(a); inputs first_pt: Point3d, crv: Curve
# ---------- brim: Python ----------
import Rhino.Geometry as rg
import generalFunctions as gf
        
brim_pt_set = gf.offsetCurveSet(crv, offset_amount, "outside", count = 2)[1]

brim_crv = rg.Polyline(brim_pt_set).ToPolylineCurve()
_, t_val = brim_crv.ClosestPoint(first_pt)

brim_crv.ChangeClosedCurveSeam(t_val)
a = list(brim_crv.ToPolyline().ToArray())
# ---------- end brim ----------

# ----
python_16 = GhPythonScript(x=pt_8)  # -> out, a; inputs x: list of Point3d
# ---------- python_16: Python ----------
a = [list(x)]
# ---------- end python_16 ----------
item_4 = ListItem(List=pt_8, Index=0, Wrap=True)  # -> Item1, Item
endpoint = Point(item_4.Item1)
update_split_lines = GhPythonScript(end_pt=endpoint, split_lines=splitlines)  # -> out, split_lines; inputs end_pt: Point3d, split_lines: list of Line
# ---------- update_split_lines: Python ----------
end_pt.Z = 0.0
split_lines[0].To = end_pt
# ---------- end update_split_lines ----------
line_4 = Line(graft(update_split_lines.split_lines))
path_mapper_12 = PathMapper(line_4, source="{A;B;C}", target="{C}")
python_17 = GhPythonScript(
    x=library_path_4,
    invert=Toggle(False),
    crvs=path_mapper_4,
    split_line=path_mapper_12,
    distance=inter_line_spacing,
    direction=list_5,
    count=number_slider_11,
    split_distance=split_distance,
    split_type=list_4,
    side_bool=Toggle(True))  # -> out, log, b, c, d, e, pt_sets, start_and_end_pt, main_crv; inputs invert: Boolean, crvs: list of Curve, split_line: Line, count: Int32, side_bool: Boolean
# ---------- python_17: Python ----------
import sys

sys.path.append(x)

# print(sys.path)

import generalFunctions as gf
import layerFunctions as lf
import Rhino.Geometry as rg
import pinLinkingBis as pl

from copy import deepcopy as dc

reload(gf)
reload(lf)
reload(pl)


print(crvs)
log = ["new sequence start"]

pt_sets = []

inner_crvs = []

crv_count = len(crvs)
print("there are %s curves in your list" % crv_count)

# invert split line direction

if invert:
    
    split_line.To = rg.Point3d(-split_line.To.X, -split_line.To.Y, 0.0)

for crv in crvs:
    
    # moving the split line to the same height as the crv
    
    height = crv.PointAtEnd.Z
    
    mv_m = rg.Transform.Translation(rg.Vector3d(0,0, height))

    loc_split_line = dc(split_line)
    loc_split_line.Transform(mv_m)
    
    a = gf.offsetCurveSet(crv, distance, direction, count)
    layer_set = lf.LinkingLayers(a, split_distance, side_bool, split_type, split_line = loc_split_line)
    # a = layer_set.split_a
    # b = layer_set.split_b
    # c = layer_set.split_line
    # d = layer_set.split_axis
    a, b, c, d, e = layer_set.createOrganisedCurves()
    
    pt_set = layer_set.joinCrvs()
    # pt_set = pt_set[1:-1] + [pt_set[1]]
    
    pt_sets.extend(pt_set)
    
    crv = rg.Polyline(pt_set).ToPolylineCurve()
    
    inner_crvs.append(crv)

print("I passed this hurdle")

# main_crv = pl.makeInnerCurve(inner_crvs, main_links, side_links, end_link)

# print(main_crv)

# start_and_end_pt = [main_crv.PointAt(main_crv.Domain[0]), main_crv.PointAt(main_crv.Domain[1])]
# ---------- end python_17 ----------
path_mapper_13 = PathMapper(python_17.pt_sets, source="{A;B}", target="{A}")
pline_2 = PolyLine(Vertices=python_17.pt_sets, Closed=False)
panel_8 = Panel(python_17.out)
split_2 = SplitTree(Data=path_mapper_13, Masks=flatten("{0}"))  # -> Positive, Negative
pt_9 = Point(split_2.Negative)
item_5 = ListItem(List=split_2.Positive, Index=0, Wrap=True)  # -> Item1, Item
item_6 = ListItem(List=split_2.Negative, Index=0, Wrap=True)
split_3 = SplitList(List=pt_9, Index=0)  # -> ListA, ListB
pdecon_3 = Deconstruct(Point=item_5.Item1)  # -> XComponent, YComponent, ZComponent
addition_2 = Addition(A=extraheight, B=pdecon_3.ZComponent)
pdecon_4 = Deconstruct(Point=item_6)  # -> XComponent, YComponent, ZComponent
pt_10 = ConstructPoint(XCoordinate=pdecon.XComponent, YCoordinate=pdecon.YComponent, ZCoordinate=addition_2)
pt_11 = ConstructPoint(XCoordinate=pdecon_2.XComponent, YCoordinate=pdecon_2.YComponent, ZCoordinate=pdecon_4.ZComponent)
dist = Distance(PointA=pt_11, PointB=item_6)
subtraction = Subtraction(A=item_6, B=pt_11)
division = Division(A=subtraction, B=dist)
library_path_5 = FilePath(library_path_4)
merge = Merge(Data1=flatten(brim.a), Data2=flatten(pt_8), Data3=flatten(split_2.Positive))
multiplication = Multiplication(A=division, B=extraheight)
pt_12 = Point(item_2.Item1)
addition_3 = Addition(A=multiplication, B=item_6)
pdecon_5 = Deconstruct(Point=addition_3)  # -> XComponent, YComponent, ZComponent
extrusion_startstop_rate = Slider(150, range=-100..250)
extrusion_startstop_rate_2 = Slider(25, range=-100..100)
feed_rate_in_mm_s = Slider(25, range=0..100)
feed_rate_in_mm_s_2 = Slider(50, range=0..100)
feed_rate_in_mm_s_3 = Slider(25, range=0..100)
pt_13 = ConstructPoint(XCoordinate=pdecon_5.XComponent, YCoordinate=pdecon_5.YComponent, ZCoordinate=addition_2)
pdecon_6 = Deconstruct(Point=pt_12)  # -> XComponent, YComponent, ZComponent
pt_14 = Point(flatten(merge))
pt_15 = Point(flatten(pt_9))
pt_16 = ConstructPoint(XCoordinate=pdecon_6.XComponent, YCoordinate=pdecon_6.YComponent, ZCoordinate=addition_2)
merge_2 = Merge(Data1=pt_10, Data2=pt_13, Data3=addition_3, Data4=item_6)  # -> flatten(Result)
python_18 = GhPythonScript(feed_rate=feed_rate_in_mm_s_3, extrusion_rate=extrusion_startstop_rate_2, pts=pt_16)  # -> out, a; inputs pts: list of Point3d
# ---------- python_18: Python ----------
f_rate = feed_rate * 60.0

for pt_i, pt in enumerate(pts):
    
    if pt_i == 0:
        
        e_rate = - extrusion_rate
    
    elif pt_i == len(pts) - 1:
        
        e_rate = extrusion_rate
        
    else:
        
        e_rate = 0.0
    
    print("G1 F{} X{} Y{} Z{} E{}".format(f_rate, pt.X, pt.Y, pt.Z, e_rate))
# ---------- end python_18 ----------
python_19 = GhPythonScript(feed_rate=feed_rate_in_mm_s, extrusion_rate=extrusion_startstop_rate, extra_add=feed_rate_in_mm_s_2, pts=merge_2)  # -> out, a; inputs pts: list of Point3d
# ---------- python_19: Python ----------
f_rate = feed_rate * 60.0

for pt_i, pt in enumerate(pts):
    
    if pt_i == 0:
        
        e_rate = - extrusion_rate
    
    elif pt_i == len(pts) - 1:
        
        e_rate = extrusion_rate + extra_add
        
    else:
        
        e_rate = 0.0
    
    print("G1 F{} X{} Y{} Z{} E{}".format(f_rate, pt.X, pt.Y, pt.Z, e_rate))
# ---------- end python_19 ----------

# ---- group: G-Code
start_stop_feedrate_in_mm_min = Slider(100, range=0..1000)
number_slider_12 = Slider(0, range=0..10)
number_slider_13 = Slider(4.4, range=0..10)
number_slider_14 = Slider(0, range=0..10)
feed_rate_in_mm_s_4 = Slider(25, range=0..100)
number_slider_15 = Slider(0.64, range=0..10)
number_slider_16 = Slider(0, range=0..10)
number_slider_17 = Slider(300, range=0..1000)
list_7 = ValueList({"start / stop": "start_stop", "continious"}, selected="continious")
gcodelines = GhPythonScript(
    x=library_path_5,
    pts=pt_14,
    feed_rate=feed_rate_in_mm_s_4,
    extrusion_rate=number_slider_15,
    link_type=list_7,
    global_trim_distance=number_slider_12,
    ss_trim_distance=number_slider_14,
    cull_distance=number_slider_16,
    lift_val=number_slider_13,
    ss_f_rate=start_stop_feedrate_in_mm_min,
    ss_e_rate=number_slider_17)  # -> out, a, path_vis; inputs pts: list
# ---------- gcodelines: Python ----------
import sys

sys.path.append(x)

import Rhino.Geometry as rg
import simpleStartStop as ss

reload(ss)

# print(pts)

p_set = ss.PrintSettings(
    feed_rate = feed_rate, 
    extrusion_rate = extrusion_rate, 
    extrusion_mode = 'relative', 
    movement_mode = 'relative'
)

l_type = ss.LinkType(
    link_type = link_type,
    global_trim_distance = global_trim_distance,
    ss_trim_distance = ss_trim_distance,
    cull_distance = cull_distance,
    lift_val = lift_val
)

l_type.ss_f_rate = ss_f_rate
l_type.ss_e_rate = ss_e_rate

gcodeset = ss.GCodeSet(pts, p_set, l_type)
a = gcodeset.generateGCode()

path_vis = gcodeset.path_vis
# ---------- end gcodelines ----------

# ----
gcodelines_2 = GhPythonScript(
    x=library_path_5,
    pts=pt_15,
    feed_rate=feed_rate_in_mm_s_4,
    extrusion_rate=number_slider_15,
    link_type=list_7,
    global_trim_distance=number_slider_12,
    ss_trim_distance=number_slider_14,
    cull_distance=number_slider_16,
    lift_val=number_slider_13,
    ss_f_rate=start_stop_feedrate_in_mm_min,
    ss_e_rate=number_slider_17)  # -> out, a, path_vis; inputs pts: list; same code as gcodelines
merge_3 = Merge(Data1=flatten(gcodelines.path_vis), Data2=flatten(merge_2), Data3=flatten(gcodelines_2.path_vis), Data4=flatten(pt_16))
panel_9 = Panel(gcodelines_2.out)
pline_3 = PolyLine(Vertices=gcodelines_2.path_vis, Closed=False)
pline_4 = PolyLine(Vertices=gcodelines.path_vis, Closed=False)
merge_4 = Merge(Data1=gcodelines.a, Data2=python_19.out, Data3=gcodelines_2.a, Data4=python_18.out)
pline_5 = PolyLine(Vertices=merge_3, Closed=False)
panel_10 = Panel(gcodelines.out)

# ---- group: G-Code (continued)
end_start_gcode = GhPythonScript(x=library_path_5, lines=flatten(merge_4))  # -> out, a; inputs lines: list
# ---------- end_start_gcode: Python ----------
import os

start_gcode_path = os.path.join(x, "GCodeDefinitions", "startGcode.txt")
end_gcode_path = os.path.join(x, "GCodeDefinitions", "endGcode.txt")

start_gcode = open(start_gcode_path, 'r').read()
end_gcode = open(end_gcode_path, 'r').read()

print start_gcode

for line in lines:

    print(line)

print end_gcode
# ---------- end end_start_gcode ----------

# ----
len = Length(Curve=pline_3)
len_2 = Length(Curve=pline_4)
addition_4 = Addition(A=len_2, B=len)
total_path_length = Panel(addition_4)
panel_11 = Panel(end_start_gcode.out)
