# Grasshopper definition pins.gh (Grasshopper 1.0.7)

number_slider = Slider(15, range=0..100)
number_slider_2 = Slider(28, range=0..100)
number_slider_3 = Slider(3.5, range=0..10)
number_slider_4 = Slider(31, range=0..100)
Y = UnitY(Factor=Slider(25, range=0..100))
Z = UnitZ(Factor=0)
number_slider_5 = Slider(20, range=0..100)
circle = CircleCNR(Center=Z, Normal=Vector(0, 0, 1), Radius=number_slider)
merge = Merge(Data1=Slider(25, range=0..100), Data2=Slider(40, range=0..1000), Data3=Slider(25, range=0..100))
neg = Negative(Value=number_slider_3)
merge_2 = Merge(Data1=Slider(0, range=0..1), Data2=Slider(25, range=0..100), Data3=Slider(150, range=0..1000))
python = GhPythonScript(
    inner_radius=Slider(10, range=0..100),
    outer_radius=number_slider,
    path_width=number_slider_3,
    phase=Slider(0, range=0..1),
    direction=Toggle(False),
    resolution=Slider(100, range=0..1000),
    inwards=Toggle(False),
    height=Slider(2, range=0..10))  # -> out, pts, alfa; inputs direction: Boolean, resolution: Int32, inwards: Boolean
# ---------- python: Python ----------
from Rhino.Geometry import Point3d
from math import cos, sin

delta = 3.1415927 * 2. / resolution
path_delta = path_width / resolution

if inwards:
    r = outer_radius
else:
    r = inner_radius
    
alfa = phase

pts = []

keep_adding = True

while keep_adding:
    x = cos(alfa) * r
    y = sin(alfa) * r
    
    if inwards:
        r -= path_delta
    else:
        r += path_delta
        
    if direction:
        alfa += delta
    else:
        alfa -= delta
    
    pts.append(Point3d(x, y, height))
    
    if inwards:
        keep_adding = r > inner_radius
    else:
        keep_adding = r < outer_radius
# ---------- end python ----------
python_2 = GhPythonScript(
    inner_radius=Slider(10, range=0..100),
    outer_radius=number_slider,
    path_width=Slider(3.5, range=0..10),
    phase=python.alfa,
    direction=Toggle(True),
    resolution=Slider(100, range=0..1000),
    inwards=Toggle(True),
    height=Slider(5, range=0..10))  # -> out, pts, alfa; inputs direction: Boolean, resolution: Int32, inwards: Boolean; same code as python
python_3 = GhPythonScript(
    inner_radius=Slider(10, range=0..100),
    outer_radius=number_slider,
    path_width=Slider(3.5, range=0..10),
    phase=python_2.alfa,
    direction=Toggle(False),
    resolution=Slider(100, range=0..1000),
    inwards=Toggle(False),
    height=Slider(8, range=0..10))  # -> out, pts, alfa; inputs direction: Boolean, resolution: Int32, inwards: Boolean; same code as python
number_slider_6 = Slider(18, range=0..100)
number_slider_7 = Slider(3, range=0..10)
number_slider_8 = Slider(3.5, range=0..10)
Z_2 = UnitZ(Factor=merge_2)
offset = OffsetCurve(Curve=circle, Distance=neg, Plane=PlaneXY(0, 0, 0), Corners=1)
Z_3 = UnitZ(Factor=Slider(0, range=0..100))
neg_2 = Negative(Value=number_slider_3)
num = Number(number_slider_6)
ln = Line(StartPoint=Z, EndPoint=Y)
merge_3 = Merge(
    Data1=Slider(18, range=0..100),
    Data2=number_slider_6,
    Data3=Slider(20, range=0..100),
    Data4=Slider(20, range=0..100),
    Data5=Slider(18, range=0..100),
    Data6=Slider(10, range=0..10))
addition = Addition(A=Slider(5, range=0..10), B=num)
subtraction = Subtraction(A=num, B=Slider(4.751, range=0..10))
circle_2 = CircleCNR(Center=Z_2, Normal=Vector(0, 0, 1), Radius=merge)
merge_4 = Merge(Data1=circle, Data2=offset)  # -> flatten(Result)
merge_5 = Merge(Data1=number_slider_3, Data2=neg_2)
series = Series(Start=Slider(2, range=0..10), Step=number_slider_7, Count=Slider(3, range=0..10))
X = UnitX(Factor=addition)
division = Division(A=subtraction, B=number_slider_8)
item = ListItem(List=series, Index=0, Wrap=True)  # -> Item1, Item
merge_6 = Merge(
    Data2=flatten(item.Item1),
    Data3=Slider(35, range=0..100),
    Data4=Slider(36, range=0..100),
    Data5=Slider(39, range=0..100),
    Data6=Slider(40, range=0..100),
    Data7=Slider(150, range=0..1000))
multiplication = Multiplication(A=Slider(0.5, range=0..1), B=merge_5)
loft = Loft(Curves=circle_2, Options={Adjust=False, Closed=False, LoftEnds=0, LoftSimp=0, LoftType=3, Rebuild=10, Refit=0.01})
neg_3 = Negative(Value=number_slider_8)
round = Round(Number=division)  # -> Nearest, Floor, Ceiling
offset_2 = OffsetCurve(Curve=ln, Distance=multiplication, Plane=PlaneXY(0, 0, 0), Corners=1)  # -> flatten(Curve)
series_2 = Series(Start=num, Step=neg_3, Count=round.Floor)
ln_2 = Line(StartPoint=Z_3, EndPoint=X)
multiplication_2 = Multiplication(A=number_slider_8, B=0.5)
neg_4 = Negative(Value=multiplication_2)
ccx = CurveCurve(CurveA=graft(merge_4), CurveB=offset_2)  # -> Points, ParamsA, ParamsB
circle_3 = CircleCNR(Center=Z_3, Normal=Vector(0, 0, 1), Radius=series_2)  # -> graft(Circle)
merge_7 = Merge(Data1=neg_4, Data2=multiplication_2)
path_mapper = PathMapper()
path_mapper_2 = PathMapper(ccx.ParamsA, source="{A;B;C}", target="{C}")
path_mapper_3 = PathMapper(ccx.Points, source="{A;B;C}", target="{C}")
path_mapper_4 = PathMapper(circle_3, source="{A;B;C}", target="{C}")
offset_3 = OffsetCurve(Curve=ln_2, Distance=merge_7, Plane=PlaneXY(0, 0, 0), Corners=1)  # -> flatten(Curve)
item_2 = ListItem(List=path_mapper_2, Index=0, Wrap=True)  # -> Item, Item1
end = EndPoints(Curve=offset_3)  # -> Start, End
item_3 = ListItem(List=path_mapper_3, Index=0, Wrap=True)  # -> Item, Item1
item_4 = ListItem(List=end.End, Index=0, Wrap=True)  # -> Item, Item1
item_5 = ListItem(List=end.Start, Index=0, Wrap=True)  # -> Item, Item1
ln_3 = Line(StartPoint=item_3.Item, EndPoint=item_3.Item1)
seam = Seam(Curve=merge_4, Seam=flatten(item_2.Item))
merge_8 = Merge(Data1=item_5.Item, Data2=item_5.Item1, Data3=item_4.Item1, Data4=item_4.Item)
pline = PolyLine(Vertices=merge_8, Closed=True)
trim = TrimWithRegion(Curve=path_mapper_4, Region=pline)  # -> Inside, Outside
crv = Curve(trim.Outside)
flip = FlipCurve(Curve=crv)  # -> Curve, Flag
merge_9 = Merge(Data1=crv, Data2=flip.Curve)  # -> flatten(Result)
sift = SiftPattern(List=merge_9, SiftPattern=[0, 1, 1, 0])  # -> Output0, Output1
clean = CleanTree(RemoveNulls=True, RemoveInvalid=True, RemoveEmpty=False, Tree=sift.Output0)
lng = ListLength(List=series)
Z_4 = UnitZ(Factor=series)  # -> graft(UnitVector)
divide = DivideCurve(Curve=clean, Count=Slider(50, range=0..100), Kinks=False)  # -> flatten(Points), Tangents, Parameters
end_2 = EndPoints(Curve=clean)  # -> Start, End
series_3 = Series(Start=Toggle(True), Step=1, Count=lng)
lng_2 = ListLength(List=end_2.End)  # -> expr("x-1", Length)
mod = Modulus(A=series_3, B=2)
split = SplitList(List=end_2.End, Index=lng_2)  # -> ListA, ListB
split_2 = SplitList(List=end_2.Start, Index=1)  # -> ListA, ListB
move = Move(Geometry=divide.Points, Motion=Z_4)  # -> Geometry, Transform
rev = ReverseList(List=move.Geometry)
lng_3 = ListLength(List=divide.Points)
ln_4 = Line(StartPoint=split_2.ListB, EndPoint=split.ListA)
graft = GraftTree(Tree=move.Geometry, IncludeEmptyLists=True, IncludeNullItems=True)
graft_2 = GraftTree(Tree=rev, IncludeEmptyLists=True, IncludeNullItems=True)
series_4 = Series(Start=mod, Step=0, Count=lng_3)  # -> graft(Series)
merge_10 = Merge(Data1=graft, Data2=graft_2)
path_mapper_5 = PathMapper(series_4, source="{A;B;C;D;E}", target="{D;E}")
path_mapper_6 = PathMapper(merge_10, source="{A;B;C;D}", target="{C;D}")
item_6 = ListItem(List=path_mapper_6, Index=path_mapper_5, Wrap=True)
path_mapper_7 = PathMapper(item_6, source="{A;B}", target="{A}")
pline_2 = PolyLine(Vertices=flatten(path_mapper_7), Closed=False)
end_3 = EndPoints(Curve=pline_2)  # -> Start, End
xy = XYPlane(Origin=Point(0, 0, 0))
circle_4 = CircleCNR(Center=xy, Normal=Vector(0, 0, 1), Radius=Slider(1, range=0..1))
pi = Pi(Factor=2)
crvdom = CurveDomain(Curve=circle_4, Domain=pi)  # -> Curve, Domain
crv_cp = CurveClosestPoint(Point=end_3.End, Curve=crvdom.Curve)  # -> Point, Parameter, Distance
python_4 = GhPythonScript(
    height_list=merge_6,
    width_list=merge_3,
    phase=crv_cp.Parameter,
    direction=Toggle(False),
    resolution=Slider(100, range=0..1000),
    layer_height=number_slider_7)  # -> out, pts; inputs height_list: list, width_list: list, direction: Boolean, resolution: Int32
# ---------- python_4: Python ----------
from Rhino.Geometry import Point3d
from math import cos, sin

delta = 3.1415927 * 2. / resolution
h_delta = layer_height / resolution

h = height_list[0]
alfa = phase

pts = []

keep_adding = True

def radius(hs, rs, h):
    for i, h_set in enumerate(hs[1:]):
        # print(h_set, h, hs[i])
        if h < h_set and h > hs[i]:
            return rs[i] + (rs[i+1] - rs[i]) / (h_set - hs[i]) * (h - hs[i])
        elif h_set == h:
            return rs[i+1]
        elif hs[i] == h:
            return rs[i]
            
    print("don't have anything for you mate")

while keep_adding:
    r = radius(height_list, width_list, h)
    
    x = cos(alfa) * r
    y = sin(alfa) * r
    
    if direction:
        alfa += delta
    else:
        alfa -= delta
    
    pts.append(Point3d(x, y, h))
    
    h += h_delta
    
    keep_adding = h < height_list[-1]
# ---------- end python_4 ----------
merge_11 = Merge(Data1=python.pts, Data2=python_2.pts, Data3=python_3.pts, Data4=python_4.pts)
pline_3 = PolyLine(Vertices=merge_11, Closed=False)
panel = Panel(python_4.out)
merge_12 = Merge(Data1=flatten(path_mapper_7), Data2=python_4.pts)
pline_4 = PolyLine(Vertices=flatten(merge_12), Closed=False)
ln_5 = Line(StartPoint=end_3.End, EndPoint=crv_cp.Point)
